# Grasshopper definition Sets_Sets.ghx (Grasshopper 1.0.7)

panel = Panel("""5
3
1""")
panel_2 = Panel("""50
100
20""")
panel_3 = Panel("""8
4
2
10
1
3
0""")
entwine = Entwine(Branch00=panel, Branch01=panel_2, FlattenInputs=True)
gh_disjoint = CSharpScript(A=panel_3, B=entwine)  # -> out, R; inputs A: list, B: list
# ---------- gh_disjoint: C# ----------
    // Component written by @v-xup6

    // Test whether two sets are disjoint.

    // Check if list A contains any of the elements in B
    foreach(var obj in B){
      if(A.Contains(obj)){
        // If it A does contain elements in B, return false and stop searching.
        R = false;
        return;
      }
      else
        R = true;
    }
# ---------- end gh_disjoint ----------
disjoint = Disjoint(SetA=panel_3, SetB=entwine)
panel_4 = Panel(disjoint)
panel_5 = Panel(gh_disjoint.R)

panel_6 = Panel("""8
4
2
10
1
3
0""")
panel_7 = Panel("""5
3
1
7
2
6
5""")
gh_cprod = CSharpScript(A=panel_6, B=panel_7)  # -> out, P; inputs A: list, B: list
# ---------- gh_cprod: C# ----------
    // Component written by @v-xup6

    // Create the Carthesian product of two sets of identical cardinality

    this.Component.AddRuntimeMessage(
      GH_RuntimeMessageLevel.Warning,
      "Need to deal with path level issues, " +
      "Also not sure if this is indeed what the component does");

    // Output error message if length of two list isn't the same
    if(A.Count != B.Count){
      this.Component.AddRuntimeMessage(
        GH_RuntimeMessageLevel.Error,
        "A and B must have the same cardinality");
      return;
    }

    // Create data tree container to data
    var output = new DataTree<object>();

    // Add each element in the two lists to it's own branch
    for(int i = 0; i < A.Count - 2;i++){
      var path = new GH_Path(i);
      output.AddRange(new object[]{A[i],B[i]}, path);
    }

    // Output
    P = output;
# ---------- end gh_cprod ----------
cprod = CarthesianProduct(SetA=panel_6, SetB=panel_7)
panel_8 = Panel(cprod)
panel_9 = Panel(gh_cprod.P)

# ----
# Unable to understand the pattern of how it works
panel_10 = Panel("""0
1
2
3
0""")
panel_11 = Panel("""4
3
5""")
panel_12 = Panel("""1
2
3
4
5""")
majority = SetMajority(SetA=panel_12, SetB=panel_10, SetC=panel_11)
panel_13 = Panel(majority)

panel_14 = Panel("""10
11
12
13
14
15""")
panel_15 = Panel("""A
B
C
D
E
F""")
panel_16 = Panel("""10
5""")
gh_mindex = CSharpScript(K=panel_14, V=panel_15, S=panel_16)  # -> out, R; inputs K: list, V: list
# ---------- gh_mindex: C# ----------
    // Component written by @v-xup6

    // Extract an item from a collection using key-value match

    Dictionary<object,object> dict = new Dictionary<object,object>();

    for(int i = 0; i < K.Count;i++){
      if(!dict.ContainsKey(K[i]))
        dict.Add(K[i],V[i]);
    }

    dict.TryGetValue(S,out R);
# ---------- end gh_mindex ----------
keysearch = KeyValueSearch(Keys=panel_14, Values=panel_15, Search=panel_16)
panel_17 = Panel(gh_mindex.R)
panel_18 = Panel(keysearch)

# ----
# GH#: A C# dictionary of Grasshopper3D components.
# 
# This file contains a category of Grasshopper components, and a mirroring C#/RhinoCommon implementation.
# 
# This is an educational project initiated by students/faculty of GSD-6338: Introduction to Computational Design, at the Harvard Graduate School of Design.
# 
# More information: {{project link}}
# Sets Sets
panel_19 = Panel("""5
3
1
7
1
2
6
3
2
0
5
0
0
4""")
gh_cset = CSharpScript(L=panel_19)  # -> out, S, M; inputs L: list
# ---------- gh_cset: C# usings ----------
using System.Linq;
# ---------- gh_cset: C# ----------
    // Component written by @v-xup6

    // Creates a set of data without duplicates

    // Try to add all inputs into a hashset to create set of unique items
    HashSet<object> setList = new HashSet<Object>();
    foreach(var obj in L){
      setList.Add(obj);
    }
    
    // Array to store the member indices
    int[] members = new int[L.Count];
    // Convert hashset to Array to check for index
    object[] uniqueArray = setList.ToArray();
    for(int i = 0; i < L.Count;i++){
      members[i] = Array.IndexOf(uniqueArray, L[i]);
    }

    // Output
    S = setList;
    M = members;
# ---------- end gh_cset ----------
cset = CreateSet(List=panel_19)  # -> Set, Map
panel_20 = Panel(cset.Set)
panel_21 = Panel(gh_cset.S)
panel_22 = Panel(cset.Map)
panel_23 = Panel(gh_cset.M)

panel_24 = Panel("""5
3
1
7
2
6
0
4""")
panel_25 = Panel("""8
4
2
10
1
3
0""")
gh_difference = CSharpScript(A=panel_25, B=panel_24)  # -> out, U; inputs A: list, B: list
# ---------- gh_difference: C# ----------
    // Component written by @v-xup6

    // Creates the difference of two sets (the collection of objects present in A but not in B)

    // Try to add all inputs into a hashset to create set of unique items
    HashSet<object> setList = new HashSet<Object>();
    foreach(var obj in A){
      setList.Add(obj);
    }
    // Try to subtract B from A
    foreach(var obj in B){
      setList.Remove(obj);
    }

    // Output
    U = setList;
# ---------- end gh_difference ----------
difference = SetDifference(SetA=panel_25, SetB=panel_24)
panel_26 = Panel(difference)
panel_27 = Panel(gh_difference.U)

panel_28 = Panel("""5
3
1
7
2
6
0
4""")
panel_29 = Panel("""8
4
2
10
1
3
0""")
exdiff = SetDifferenceS(SetA=panel_29, SetB=panel_28)
gh_exdiff = CSharpScript(A=panel_29, B=panel_28)  # -> out, X; inputs A: list, B: list
# ---------- gh_exdiff: C# ----------
    // Component written by @v-xup6

    // Creates the symmetric difference of two sets (the collection of objects present in A or B bit not both)

    // Create large list of all the inputs
    List<object> inputs = new List<object>();
    inputs.AddRange(A);
    inputs.AddRange(B);

    // Create hashset and only add the object to the hashset if object isn't in both inputs lists
    HashSet<object> setList = new HashSet<Object>();
    foreach(var obj in inputs){
      bool a = A.Contains(obj);
      bool b = B.Contains(obj);
      if(a != b){
        setList.Add(obj);
      }
    }

    // Output
    X = setList;
# ---------- end gh_exdiff ----------
panel_30 = Panel(exdiff)
panel_31 = Panel(gh_exdiff.X)

panel_32 = Panel("""5
3
1
7
2
6
0
4""")
panel_33 = Panel("""8
4
2
10
1
3
0""")
gh_intersection = CSharpScript(A=panel_33, B=panel_32)  # -> out, U; inputs A: list, B: list
# ---------- gh_intersection: C# ----------
    // Component written by @v-xup6

    // Creates the intersection of two sets (the collection of unique objects present in both sets)

    // Create hashset and only add the object to the hashset if object is in both inputs lists
    HashSet<object> setList = new HashSet<Object>();
    foreach(var obj in B){
      if(A.Contains(obj)){
        setList.Add(obj);
      }
    }

    // Output
   U = setList;
# ---------- end gh_intersection ----------
intersection = SetIntersection(SetA=panel_33, SetB=panel_32)
panel_34 = Panel(gh_intersection.U)
panel_35 = Panel(intersection)

panel_36 = Panel("""5
3
1""")
panel_37 = Panel("""8
4
2
10
1
3
0
3""")
gh_mindex_2 = CSharpScript(S=panel_37, M=panel_36)  # -> out, I, N; inputs S: list
# ---------- gh_mindex_2: C# ----------
    // Component written by @v-xup6

    // Find the occurences of a spcific member in a set

    // A list to store all the index of matching objects
    List<int> index = new List<int>();

    // Loop thru the object list and check if any of them match
    // the member we want to check for
    for(int i = 0;i < S.Count;i++){
      // If the two objects match, record the index of when this happens
      // using Equals instead of == because the we're using Systems.Object
      // instead of a specific data type
      if(S[i].Equals(M))index.Add(i);
    }

    // Output
    I = index;
    N = S.FindAll(m => m.Equals(M)).Count;
    // FindAll extracts all the items in a list that matchs the condition.
    // Condition is expressed in lambda, for every item(m) in S, do/check (=>)
    // if m equals M.
    // Once all items are extracted we can simply count them using .Count
# ---------- end gh_mindex_2 ----------
mindex = MemberIndex(Set=panel_37, Member=panel_36)  # -> Index, Count
panel_38 = Panel(mindex.Index)
panel_39 = Panel(gh_mindex_2.I)
panel_40 = Panel(gh_mindex_2.N)
panel_41 = Panel(mindex.Count)

panel_42 = Panel("""8
4
2
10
1
3
0
3""")
panel_43 = Panel("""5
3
1
3""")
panel_44 = Panel("""A
B
C
D""")
gh_mindex_3 = CSharpScript(S=panel_42, F=panel_43, R=panel_44)  # -> out, Re; inputs S: list, F: list, R: list
# ---------- gh_mindex_3: C# ----------
    // Component written by @v-xup6

    // Replace members in a set.
    
    // Length of list known, so use an array to store result
    System.Object[] replaced = new System.Object[S.Count];
    // Loop thru all the items in the set
    for(int i = 0; i < S.Count;i++){
      // If this item should be replaced
      if(F.Contains(S[i]))
        // Find the replacement value
        replaced[i] = R[F.IndexOf(S[i])];
      else
        // Id it doesn't need to be replaced, take item as is
        replaced[i] = S[i];
    }

    // Output
    Re = replaced;
# ---------- end gh_mindex_3 ----------
replace = ReplaceMembers(Set=panel_42, Find=panel_43, Replace=panel_44)
panel_45 = Panel(replace)
panel_46 = Panel(gh_mindex_3.Re)

subset = SubSet()
dcon = DeleteConsecutive(Wrap=False)  # -> Set, Count
fsim = FindSimilarMember()  # -> Hit, Index

panel_47 = Panel("""5
3
1
7
2
6
0
4""")
panel_48 = Panel("""8
4
2
10
1
3
0""")
gh_intersection_2 = CSharpScript(A=panel_48, B=panel_47)  # -> out, U; inputs A: list, B: list
# ---------- gh_intersection_2: C# ----------
    // Component written by @v-xup6

    // Creates the union of two sets(the collection of unique objects present in either set)

    // Merge all inputs
    A.AddRange(B);
    // Create hashset and only add the object to the hashset if object is in both inputs lists
    HashSet<object> setList = new HashSet<object>();
    foreach(var obj in A){
      setList.Add(obj);
    }

    // Output
    U = setList;
# ---------- end gh_intersection_2 ----------
panel_49 = Panel(gh_intersection_2.U)

sunion = SetUnion(SetA=panel_48, SetB=panel_47)

panel_50 = Panel(sunion)
