# Grasshopper definition Math_Domain.ghx (Grasshopper 1.0.7)

panel = Panel("""5
5
7
10.01
-1
0
2.5
8""")
bnd = Bounds(Numbers=panel)
gh_bnd = CSharpScript(N=panel)  # -> out, I; inputs N: list of Double
# ---------- gh_bnd: C# ----------
    // Componenet created by @mirahx24
    
    // This component runs through the values from the input list
    // and find the domain of the values
    
    // First set the default vaules of max and min as the first element of the list
    double max = N[0];
    double min = N[0];
    
    // Then we iterate through the list to find the actual max and min values
    for(int i = 1;i < N.Count; i++) {
      if(max < N[i]) { // if max is smaller than the current iterated value, set max to that value
        max = N[i];
      }
      if(min > N[i]) { // if min is bigger than the current iterated value, set min to that value
        min = N[i];
      }
    }

    // Create the interval/domain with the min and max we found
    Interval interval = new Interval(min, max);
    
    // Output
    I = interval;
# ---------- end gh_bnd ----------
panel_2 = Panel(bnd)
panel_3 = Panel(gh_bnd.I)

panel_4 = Panel("""5
5
7
10.01
-1
0
2.5
8""")
toggle = BooleanToggle(True)
consec = ConsecutiveDomains(Numbers=panel_4, Additive=toggle)
gh_consec = CSharpScript(N=panel_4, A=toggle)  # -> out, D; inputs N: list of Double, A: Boolean
# ---------- gh_consec: C# ----------
    // Component created by @mirahx24

    // This component takes the input list, and out a list of domains
    // If A is set to True, then the list will be considered as cumulative
    // If A is set to False, then the list will be taken as it is
    // For example, if input list N is {0, 1, 2, 3}, and A is True
    // then the output D will be {<0, 1>, <1, 3>, <3, 6>}
    // If A is False, then the output D will be {<0, 1>, <1, 2>, <2, 3>}

    // Create a empty list to hold all the output domains
    List<Interval> domains = new List<Interval>();

    // Check if the item count of List N is greater or equals to 2
    double count = N.Count;
    if(count >= 2) {

      if(A) { // for cumulative case
        double first = 0; 
        double second = 0;
        for (int i = 0; i < count - 1; i++) {
          first += N[i];
          second = first + N[i + 1];
          Interval interval = new Interval(first, second);
          domains.Add(interval);
        }
      }
      else { // for non-cumulative case

        // Iterate through the input N to construct domains
        // Since we will access to items from the List at once, to avoid going out of the list bound
        // we will only iterate to the second to last item
        for (int i = 0;i < count - 1;i++) {
          Interval interval = new Interval(N[i], N[i + 1]);
          domains.Add(interval);
        }
      }
    }

    // Output
    D = domains;
# ---------- end gh_consec ----------
panel_5 = Panel(consec)
panel_6 = Panel(gh_consec.D)

# ---- group: Grasshopper Div
div = DivideDomain(Domain=Domain(0, 1), Count=10)

# ----
c_div = CSharpScript(I=-1, C=10)  # -> Out, S

# ---- group: Grasshopper FDom
fdom = FindDomain(Strict=False)  # -> Index, Neighbour

# ----
c_fdom = CSharpScript()  # -> Out, I, N

# ---- group: Grasshopper Inc
inc = Includes(Domain=Domain(0, 1))  # -> Includes, Deviation

# ---- group: C# Inc
c_script = CSharpScript()  # -> Out, I, D

# ---- group: Grasshopper ReMap
remap = RemapNumbers(Source=Domain(0, 1), Target=Domain(0, 1))  # -> Mapped, Clipped

# ----
c_remap = CSharpScript()  # -> Out, R, C

# ---- group: Grasshopper Dom²Num
dom²num = ConstructDomain²(UMin=0, UMax=1, VMin=0, VMax=1)

# ----
c_dom²num = CSharpScript()  # -> Out, _2dDomain

# ---- group: Grasshopper Dom²Num
dom² = ConstructDomain²(DomainU=Domain(0, 1), DomainV=Domain(0, 1))

# ----
c_dom²num_2 = CSharpScript()  # -> Out, _2dDomain

# ---- group: Grasshopper DeDom2Num
dedom2num = DeconstructDomain²()  # -> UMin, UMax, VMin, VMax

# ---- group: C# DeDom2Num
c_dom²num_3 = CSharpScript()  # -> Out, U0, U1, V0, V1

# ---- group: Grasshopper DeDom2
dedom2 = DeconstructDomain²()  # -> UComponent, VComponent

# ----
c_dedom2 = CSharpScript()  # -> Out, U, V

# ---- group: Grasshopper Bnd
bnd_2 = Bounds2D()

# ----
c_bnd = CSharpScript()  # -> Out, I

# ---- group: Grasshopper C# Divide
divide = DivideDomain²(UCount=10, VCount=10)

# ----
c_divide = CSharpScript()  # -> Out, I

# ----
# GH#: A C# dictionary of Grasshopper3D components.
# 
# This file contains a category of Grasshopper components, and a mirroring C#/RhinoCommon implementation.
# 
# This is an educational project initiated by students/faculty of GSD-6338: Introduction to Computational Design, at the Harvard Graduate School of Design.
# 
# More information: {{project link}}
# Math Domain
# Math Domain Incomplete: Bounds(Bnd)
# Consecutive Domains (Consec)
# Divide Domain (Div)
# Find Domain (FDom)
# Includes (Inc)
# Remap Numbers (ReMap)
# ConstructDomain² (Dom²Num)
# ConstructDomain² (Dom²)
# DeconstructDomain² (DeDom2Num)
# DeconstructDomain² (DeDom2)
# Bounds2D (Bnd)
# Divide Domain² (Divide)
number_slider = Slider(5, range=0..10)
number_slider_2 = Slider(6, range=0..10)
c_dom = CSharpScript(A=number_slider, B=number_slider_2)  # -> out, I; inputs A: Double, B: Double
# ---------- c_dom: C# ----------
    // Component written by @erinlinseyhunt

    // Creating a new Domain with an Interval
    Interval dx = new Interval(A, B);

    // Output
    I = dx;
# ---------- end c_dom ----------
panel_7 = Panel(c_dom.I)

# ---- group: Grasshopper Dom
dom = ConstructDomain(DomainStart=number_slider, DomainEnd=number_slider_2)

# ----
panel_8 = Panel(dom)

dom_2 = ConstructDomain(DomainStart=Slider(5, range=0..10), DomainEnd=Slider(6, range=0..10))

# ---- group: Grasshopper DeDomain
dedomain = DeconstructDomain(Domain=dom_2)  # -> Start, End

# ---- group: C# DeDomain
c_script_2 = CSharpScript(I=dom_2)  # -> out, S, E
# ---------- c_script_2: C# ----------
    // Component written by @erinlinseyhunt

    // Output
    S = I.T0;    // getting the lower bound of the domain
    E = I.T1; // getting the upper bound of the domain
# ---------- end c_script_2 ----------

# ----
panel_9 = Panel(dedomain.Start)
panel_10 = Panel(dedomain.End)

panel_11 = Panel(c_script_2.S)
panel_12 = Panel(c_script_2.E)
