# Grasshopper definition Math_Operators.ghx (Grasshopper 1.0.7)

# ----
# GH#: A C# dictionary of Grasshopper3D components.
# 
# This file contains a category of Grasshopper components, and a mirroring C#/RhinoCommon implementation.
# 
# This is an educational project initiated by students/faculty of GSD-6338: Introduction to Computational Design, at the Harvard Graduate School of Design.
# 
# More information: {{project link}}
# Math Operators
number_slider = Slider(5, range=0..10)
number_slider_2 = Slider(8.7, range=0..10)
c_a_b = CSharpScript(A=number_slider, B=number_slider_2)  # -> out, R; inputs A: Double, B: Double
# ---------- c_a_b: C# ----------
    // Component written by @erinlinseyhunt

    // Addition
    R = A + B;
# ---------- end c_a_b ----------
panel = Panel(c_a_b.R)

# ---- group: Grasshopper A+B
addition = Addition(A=number_slider, B=number_slider_2)

# ----
panel_2 = Panel(addition)

number_slider_3 = Slider(5, range=0..10)
number_slider_4 = Slider(8.7, range=0..10)

# ---- group: Grasshopper A×B
multiplication = Multiplication(A=number_slider_3, B=number_slider_4)

# ---- group: C# A×B
c_script = CSharpScript(A=number_slider_3, B=number_slider_4)  # -> out, R; inputs A: Double, B: Double
# ---------- c_script: C# ----------
    // Component written by @erinlinseyhunt

    // Multiplication
    R = A * B;
# ---------- end c_script ----------

# ----
panel_3 = Panel(multiplication)
panel_4 = Panel(c_script.R)

number_slider_5 = Slider(5, range=0..10)
number_slider_6 = Slider(8.7, range=0..10)
c_pow = CSharpScript(A=number_slider_5, B=number_slider_6)  # -> out, R; inputs A: Double, B: Double
# ---------- c_pow: C# ----------
    // Component written by @erinlinseyhunt

    // Power
    R = Math.Pow(A, B);
# ---------- end c_pow ----------
panel_5 = Panel(c_pow.R)

# ---- group: Grasshopper Pow
pow = Power(A=number_slider_5, B=number_slider_6)

# ----
panel_6 = Panel(pow)

number_slider_7 = Slider(-5, range=-5..5)

# ---- group: Grasshopper Abs
abs = Absolute(Value=number_slider_7)

# ---- group: C# Abs
c_script_2 = CSharpScript(x=number_slider_7)  # -> out, y; inputs x: Double
# ---------- c_script_2: C# ----------
    // Component written by @erinlinseyhunt

    // Absolute Value
    y = Math.Abs(x);
# ---------- end c_script_2 ----------

# ----
panel_7 = Panel(abs)
panel_8 = Panel(c_script_2.y)

number_slider_8 = Slider(5, range=0..10)
number_slider_9 = Slider(2, range=0..10)
c_a_b_2 = CSharpScript(A=number_slider_8, B=number_slider_9)  # -> out, R; inputs A: Int32, B: Int32
# ---------- c_a_b_2: C# ----------
    // Component written by @erinlinseyhunt

    // Integer division- finds the floor of a function.
    R = A / B;
# ---------- end c_a_b_2 ----------
panel_9 = Panel(c_a_b_2.R)

# ---- group: Grasshopper A\B
integer_division = IntegerDivision(A=number_slider_8, B=number_slider_9)

# ----
panel_10 = Panel(integer_division)

panel_11 = Panel("""6
8
5
3
2""")
c_ma = CSharpScript(I=panel_11)  # -> out, R, Pr; inputs I: list of Double
# ---------- c_ma: C# usings ----------
using System.IO;
using System.Linq;
using System.Data;
using System.Drawing;
using System.Reflection;
using System.Windows.Forms;
using System.Xml;
using System.Xml.Linq;
using System.Runtime.InteropServices;

using Rhino.DocObjects;
using Rhino.Collections;
using GH_IO;
using GH_IO.Serialization;
# ---------- c_ma: C# ----------
    // Component written by @erinlinseyhunt

    // Declaring a Variable
    double massAdd = 0.0;

    // Creating a new List of Doubles
    List<double> partResult = new List<double>();

    // Using a for loop to add all of the numbers together to get the total lump sum.
    // Then using the for loop and the above addition opperator to add the partical values to the new list.
    for (int i = 0; i < I.Count; i++) {
      massAdd += I[i];
      partResult.Add(massAdd);
    }

    //Outputs
    R = massAdd;
    Pr = partResult;
# ---------- end c_ma ----------
panel_12 = Panel(c_ma.R)
panel_13 = Panel(c_ma.Pr)

# ---- group: Grasshopper MA
ma = MassAddition(Input=panel_11)  # -> Result, PartialResults

# ----
panel_14 = Panel(ma.Result)
panel_15 = Panel(ma.PartialResults)

A = Slider(5, range=0..10)
B = Slider(5, range=0..10)
c_equals = CSharpScript(A=A, B=B)  # -> out, equal, notEqual; inputs A: Double, B: Double
# ---------- c_equals: C# ----------
    // Component written by @erinlinseyhunt

    // Conditional Statement if the inputs are equal it will output true if not false.
    if(A == B) {
      equal = true;
      notEqual = false;
    }
    else {
      equal = false;
      notEqual = true;
    }
# ---------- end c_equals ----------
panel_16 = Panel(c_equals.equal)
panel_17 = Panel(c_equals.notEqual)

# ---- group: Grasshopper Equals
equals = Equality(FirstNumber=A, SecondNumber=B)  # -> Equality, Inequality

# ----
panel_18 = Panel(equals.Equality)
panel_19 = Panel(equals.Inequality)

A_2 = Slider(5, range=0..10)
B_2 = Slider(2, range=0..10)
number_slider_10 = Slider(0.1, range=0..0.1)
c_similar = CSharpScript(A=A_2, B=B_2, T=number_slider_10)  # -> out, equal, dt; inputs A: Double, B: Double, T: Double
# ---------- c_similar: C# ----------
    // Component written by @erinlinseyhunt

    // Conditional Statement if the inputs are equal it will output true if not false.
    if(A == B) {
      equal = true;
    }
    else{
      equal = false;
    }

    //Finds the absolute difference between A and B
    dt = Math.Abs(A - B);
# ---------- end c_similar ----------
panel_20 = Panel(c_similar.equal)
panel_21 = Panel(c_similar.dt)

# ---- group: Grasshopper Similar
similar = Similarity(FirstNumber=A_2, SecondNumber=B_2, Threshold=number_slider_10)  # -> Similarity, AbsoluteDifference

# ----
panel_22 = Panel(similar.Similarity)
panel_23 = Panel(similar.AbsoluteDifference)

toggle = BooleanToggle(False)
toggle_2 = BooleanToggle(False)
c_and = CSharpScript(A=toggle, B=toggle_2)  # -> out, R; inputs A: Boolean, B: Boolean
# ---------- c_and: C# ----------
    // Component created by @mirahx24

    // Pre-defined and un-initialized output.
    // Set-up this way to access it outside of the scope of if-else statements
    bool result;

    // AND gate works exactly like the logical "&&"
    // It should return true only when both of the inputs are true.
    // Otherwise, return false.
    if(A && B) {
      result = true;
    }

    else {
      result = false;
    }

    // Output
    R = result;
# ---------- end c_and ----------
panel_24 = Panel(c_and.R)

# ---- group: Grasshopper And
and = GateAnd(A=toggle, B=toggle_2)

# ----
panel_25 = Panel(and)

toggle_3 = BooleanToggle(False)
toggle_4 = BooleanToggle(False)
c_or = CSharpScript(A=toggle_3, B=toggle_4)  # -> out, R; inputs A: Boolean, B: Boolean
# ---------- c_or: C# ----------
    // Component created by @mirahx24

    // Pre-defined and un-initialized output.
    // Set-up this way to access it outside of the scope of if-else statements
    bool result;

    // OR gate acts exactly like the logic "||"
    // If one of the inputs, A or B, is true, then it should return true.
    // Otherwise, return false
    if(A || B) {
      result = true;
    }

    else {
      result = false;
    }

    // Output
    R = result;
# ---------- end c_or ----------
panel_26 = Panel(c_or.R)

# ---- group: Grasshopper Or
or = GateOr(A=toggle_3, B=toggle_4)

# ----
panel_27 = Panel(or)

toggle_5 = BooleanToggle(False)
toggle_6 = BooleanToggle(False)
toggle_7 = BooleanToggle(False)
c_vote = CSharpScript(A=toggle_5, B=toggle_6, C=toggle_7)  # -> out, R; inputs A: Boolean, B: Boolean, C: Boolean
# ---------- c_vote: C# ----------
    // Component created by @mirahx24

    // Pre-defined and un-initialized output.
    // Set-up this way to access it outside of the scope of if-else statements
    bool result;

    // VOTE checks the majority of the inputs
    // If two or more inputs' values are TRUE, return true
    // Otherwise, return false.
    if(A && B || A && C || B && C) {
      result = true;
    }
    else {
      result = false;
    }

    // Output
    R = result;
# ---------- end c_vote ----------
panel_28 = Panel(c_vote.R)

# ---- group: Grasshopper Vote
vote = GateMajority(A=toggle_5, B=toggle_6, C=toggle_7)

# ----
panel_29 = Panel(vote)

toggle_8 = BooleanToggle(False)
toggle_9 = BooleanToggle(False)
c_nor = CSharpScript(A=toggle_8, B=toggle_9)  # -> out, R; inputs A: Boolean, B: Boolean
# ---------- c_nor: C# ----------
    // Component created by @mirahx24

    // Pre-defined and un-initialized output.
    // Set-up this way to access it outside of the scope of if-else statements
    bool result;

    // NOR gate is the compliment of OR gate.
    // If one of the input is true, return false.
    // Otherwise, return true;
    if(A || B){
      result = false;
    }

    else{
      result = true;
    }
    
    // Output
    R = result;
# ---------- end c_nor ----------
panel_30 = Panel(c_nor.R)

# ---- group: Grasshopper Nor
nor = GateNor(A=toggle_8, B=toggle_9)

# ----
panel_31 = Panel(nor)

panel_32 = Panel("""6
8
5
3
2""")
num = Number(panel_32)

# ---- group: Grasshopper RelDif
reldif = RelativeDifferences(Values=num)

# ---- group: C# RelDif
gh_reldif = CSharpScript(V=num)  # -> out, D; inputs V: list of Double
# ---------- gh_reldif: C# ----------
    // Component written by @garciadelcastillo

    // This component takes a list of numbers, points or vectors,
    // and computes their relative differences.

    // To do: this currently only works for numbers, and assumes
    // that all the elements on the list are valid numbers without empty elements.
    // This component should be improved to incorporate those safety checks.

    // Create a list of numbers to store the relative differences
    List<double> diffs = new List<double>();

    // Iterate over all numbers, and find the difference with previous value
    double prev = V[0];
    foreach (double num in V)
    {
      diffs.Add(num - prev);
      prev = num;
    }

    // Outputs
    D = diffs;
# ---------- end gh_reldif ----------

# ----
panel_33 = Panel(reldif)
panel_34 = Panel(gh_reldif.D)

number_slider_11 = Slider(1.7, range=0..10)
number_slider_12 = Slider(8.3, range=0..10)

# ---- group: Grasshopper A/B
division = Division(A=number_slider_11, B=number_slider_12)

# ---- group: C# A/B
c_script_3 = CSharpScript(A=number_slider_11, B=number_slider_12)  # -> out, R; inputs A: Double, B: Double
# ---------- c_script_3: C# ----------
    // Component written by @erinlinseyhunt

    // Division
    R = A / B;
# ---------- end c_script_3 ----------

# ----
panel_35 = Panel(division)
panel_36 = Panel(c_script_3.R)

number_slider_13 = Slider(-4, range=-4..0)
c_neg = CSharpScript(x=number_slider_13)  # -> out, y; inputs x: Double
# ---------- c_neg: C# ----------
    // Component written by @erinlinseyhunt

    // Returns the negative value of the input.
    y = -x;
# ---------- end c_neg ----------
panel_37 = Panel(c_neg.y)

# ---- group: Grasshopper Neg
neg = Negative(Value=number_slider_13)

# ----
panel_38 = Panel(neg)

number_slider_14 = Slider(7, range=0..10)

# ---- group: Grasshopper Fac
fac = Factorial(Number=number_slider_14)

# ---- group: C# Fac
c_script_4 = CSharpScript(N=number_slider_14)  # -> out, F; inputs N: Int32
# ---------- c_script_4: C# ----------
    // Component written by @erinlinseyhunt

    // Declaring variables
    int i, f = 1;

    // The factorial of a number n is the product of all positive numbers less than or equal to n
    for(i = 1; i <= N; i++) {
      f = f * i;
    }

    // Output
    F = f;
# ---------- end c_script_4 ----------

# ----
panel_39 = Panel(fac)
panel_40 = Panel(c_script_4.F)

number_slider_15 = Slider(3, range=0..10)
number_slider_16 = Slider(7.9, range=0..10)

# ---- group: Grasshopper Mod
mod = Modulus(A=number_slider_15, B=number_slider_16)

# ---- group: C# Mod
c_mod = CSharpScript(A=number_slider_15, B=number_slider_16)  # -> out, R; inputs A: Double, B: Double
# ---------- c_mod: C# ----------
    // Component written by @erinlinseyhunt

    // Modulus- finds the remainder of after dividing one number by another.
    R = A % B;
# ---------- end c_mod ----------

# ----
panel_41 = Panel(mod)
panel_42 = Panel(c_mod.R)

panel_43 = Panel("""6
8
5
3
2""")
c_mm = CSharpScript(I=panel_43)  # -> out, R, Pr; inputs I: list of Double
# ---------- c_mm: C# ----------
    // Component written by @erinlinseyhunt

    // Declaring a Variable
    double massMult = 1.0;

    // Creating a new list of doubles
    List<double> partResult = new List<double>();

    // Using a for loop to multiply all of the numbers together to get the total lump product.
    // Then using the for loop and the above multiplication opperator to add the partical values to the new list.
    for (int i = 0; i < I.Count; i++) {
      massMult *= I[i];
      partResult.Add(massMult);
    }

    // Output
    R = massMult;
    Pr = partResult;
# ---------- end c_mm ----------
panel_44 = Panel(c_mm.R)
panel_45 = Panel(c_mm.Pr)

# ---- group: Grasshopper MM
mm = MassMultiplication(Input=panel_43)  # -> Result, PartialResults

# ----
panel_46 = Panel(mm.Result)
panel_47 = Panel(mm.PartialResults)

A_3 = Slider(5, range=0..10)
B_3 = Slider(10, range=0..10)
c_larger = CSharpScript(A=A_3, B=B_3)  # -> out, largerThan, equal; inputs A: Double, B: Double
# ---------- c_larger: C# ----------
    // Component written by @erinlinseyhunt

    // Conditional Statement comparing the two numbers to see if they are larger than or equal to one another.
    if(A > B) {
      largerThan = true;
      equal = true;
    }
    else if(A < B) {
      largerThan = false;
      equal = false;
    }
    else {
      largerThan = false;
      equal = true;
    }
# ---------- end c_larger ----------
panel_48 = Panel(c_larger.largerThan)
panel_49 = Panel(c_larger.equal)

# ---- group: Grasshopper Larger
larger = LargerThan(FirstNumber=A_3, SecondNumber=B_3)  # -> LargerThan, OrEqualTo

# ----
panel_50 = Panel(larger.LargerThan)
panel_51 = Panel(larger.OrEqualTo)

A_4 = Slider(5, range=0..10)
B_4 = Slider(3, range=0..10)
c_smaller = CSharpScript(A=A_4, B=B_4)  # -> out, smallerThan, equal; inputs A: Double, B: Double
# ---------- c_smaller: C# ----------
    // Component written by @erinlinseyhunt

    // Conditional Statement comparing the two numbers to see if they are smaller than or equal to one another.
    if(A < B) {
      smallerThan = true;
      equal = true;
    }
    else if(A > B) {
      smallerThan = false;
      equal = false;
    }
    else {
      smallerThan = false;
      equal = true;
    }
# ---------- end c_smaller ----------
panel_52 = Panel(c_smaller.smallerThan)
panel_53 = Panel(c_smaller.equal)

# ---- group: Grasshopper Smaller
smaller = SmallerThan(FirstNumber=A_4, SecondNumber=B_4)  # -> SmallerThan, OrEqualTo

# ----
panel_54 = Panel(smaller.SmallerThan)
panel_55 = Panel(smaller.OrEqualTo)

toggle_10 = BooleanToggle(False)
c_not = CSharpScript(A=toggle_10)  # -> out, R; inputs A: Boolean
# ---------- c_not: C# ----------
    // Component created by @mirahx24

    // Pre-defined and un-initialized output.
    // Set-up this way to access it outside of the scope of if-else statements
    bool result;

    // NOT gate flips the input's value
    // if input A is true, output should be false, and vice versa
    if(A) {
      result = false;
    }

    else {
      result = true;
    }

    // Output
    R = result;
# ---------- end c_not ----------
panel_56 = Panel(c_not.R)

# ---- group: Grasshopper Not
not = GateNot(A=toggle_10)

# ----
panel_57 = Panel(not)

toggle_11 = BooleanToggle(False)
toggle_12 = BooleanToggle(False)
c_xor = CSharpScript(A=toggle_11, B=toggle_12)  # -> out, R; inputs A: Boolean, B: Boolean
# ---------- c_xor: C# ----------
    // Component created by @mirahx24

    // Pre-defined and un-initialized output.
    // Set-up this way to access it outside of the scope of if-else statements
    bool result;

    // XOR gate checks the inputs are the same
    // If both inputs has the same value, return false.
    // If both inputs has different values, return true.
    if(A == B) {
      result = false;
    }

    else {
      result = true;
    }
    
    // Output
    R = result;
# ---------- end c_xor ----------
panel_58 = Panel(c_xor.R)

# ---- group: Grasshopper Xor
xor = GateXor(A=toggle_11, B=toggle_12)

# ----
panel_59 = Panel(xor)

toggle_13 = BooleanToggle(False)
toggle_14 = BooleanToggle(False)
c_nand = CSharpScript(A=toggle_13, B=toggle_14)  # -> out, R; inputs A: Boolean, B: Boolean
# ---------- c_nand: C# ----------
    // Component created by @mirahx24

    // Pre-defined and un-initialized output.
    // Set-up this way to access it outside of the scope of if-else statements
    bool result;

    // NAND gate is the flipped version of AND gate.
    // If both inputs are true, then it returns false.
    // Otherwise, return true.
    if(A && B) {
      result = false;
    }
    else {
      result = true;
    }

    // Output
    R = result;
# ---------- end c_nand ----------
panel_60 = Panel(c_nand.R)

# ---- group: Grasshopper Nand
nand = GateNand(A=toggle_13, B=toggle_14)

# ----
panel_61 = Panel(nand)

toggle_15 = BooleanToggle(False)
toggle_16 = BooleanToggle(False)
c_xnor = CSharpScript(A=toggle_15, B=toggle_16)  # -> out, R; inputs A: Boolean, B: Boolean
# ---------- c_xnor: C# ----------
    // Component created by @mirahx24

    // Pre-defined and un-initialized output.
    // Set-up this way to access it outside of the scope of if-else statements
    bool result;

    // XNOR gate works like the compliement of XOR gate.
    // if both inputs has the same value, return true.
    // if both inputs has different values, return false.
    if(A == B){
      result = true;
    }

    else{
      result = false;
    }

    // Output
    R = result;
# ---------- end c_xnor ----------
panel_62 = Panel(c_xnor.R)

# ---- group: Grasshopper Xnor
xnor = GateXnor(A=toggle_15, B=toggle_16)

# ----
panel_63 = Panel(xnor)
