# Grasshopper definition Math_Polynomials.ghx (Grasshopper 1.0.7)

# ----
# GH#: A C# dictionary of Grasshopper3D components.
# 
# This file contains a category of Grasshopper components, and a mirroring C#/RhinoCommon implementation.
# 
# This is an educational project initiated by students/faculty of GSD-6338: Introduction to Computational Design, at the Harvard Graduate School of Design.
# 
# More information: {{project link}}
# Math Polynomials
number_slider = Slider(10, range=0..10)

# ---- group: Grasshopper Cube
cube = Cube(Value=number_slider)

# ---- group: C# Cube
c_script = CSharpScript(x=number_slider)  # -> out, y; inputs x: Double
# ---------- c_script: C# ----------
    // Component written by @erinlinseyhunt

    // Cubic power
    y = Math.Pow(x, 3);
# ---------- end c_script ----------

# ----
panel = Panel(cube)
panel_2 = Panel(c_script.y)

number_slider_2 = Slider(4, range=0..10)
c_2º = CSharpScript(x=number_slider_2)  # -> out, y; inputs x: Double
# ---------- c_2º: C# ----------
    // Component written by @erinlinseyhunt

    // Power of 2
    y = Math.Pow(2, x);
# ---------- end c_2º ----------
panel_3 = Panel(c_2º.y)

# ---- group: Grasshopper 2º
_2º = PowerOf2(Value=number_slider_2)

# ----
panel_4 = Panel(_2º)

number_slider_3 = Slider(10, range=0..10)
c_eº = CSharpScript(x=number_slider_3)  # -> out, y; inputs x: Double
# ---------- c_eº: C# ----------
    // Component written by @erinlinseyhunt

    // Power of E
    y = Math.Exp(x);
# ---------- end c_eº ----------
panel_5 = Panel(c_eº.y)

# ---- group: Grasshopper Eº
eº = PowerOfE(Value=number_slider_3)

# ----
panel_6 = Panel(eº)

number_slider_4 = Slider(5, range=0..10)
number_slider_5 = Slider(8, range=0..10)

# ---- group: C# LogN
c_logn = CSharpScript(V=number_slider_5, B=number_slider_4)  # -> out, R; inputs V: Double, B: Double
# ---------- c_logn: C# ----------
    // Component written by @erinlinseyhunt

    // Log N
    R = Math.Log(V, B);
# ---------- end c_logn ----------

# ---- group: Grasshopper LogN
logn = LogN(Number=number_slider_5, Base=number_slider_4)

# ----
panel_7 = Panel(logn)
panel_8 = Panel(c_logn.R)

number_slider_6 = Slider(6, range=0..10)

# ---- group: Grasshopper Cbrt
cbrt = CubeRoot(Value=number_slider_6)

# ---- group: C# Cbrt
c_script_2 = CSharpScript(x=number_slider_6)  # -> out, y; inputs x: Double
# ---------- c_script_2: C# ----------
    // Component written by @erinlinseyhunt

    // Cubic Root
    y = Math.Pow(x, (1.0 / 3.0));
# ---------- end c_script_2 ----------

# ----
panel_9 = Panel(cbrt)
panel_10 = Panel(c_script_2.y)

number_slider_7 = Slider(5, range=0..10)
c_sqr = CSharpScript(x=number_slider_7)  # -> out, y; inputs x: Double
# ---------- c_sqr: C# ----------
    // Component written by @erinlinseyhunt

    // Squared
    y = Math.Pow(x, 2);
# ---------- end c_sqr ----------
panel_11 = Panel(c_sqr.y)

# ---- group: Grasshopper Sqr
sqr = Square(Value=number_slider_7)

# ----
panel_12 = Panel(sqr)

number_slider_8 = Slider(6, range=0..10)
c_sqrt = CSharpScript(x=number_slider_8)  # -> out, y; inputs x: Double
# ---------- c_sqrt: C# ----------
    // Component written by @erinlinseyhunt

    // Square Root
    y = Math.Sqrt(x);
# ---------- end c_sqrt ----------
panel_13 = Panel(c_sqrt.y)

# ---- group: Grasshopper Sqrt
sqrt = SquareRoot(Value=number_slider_8)

# ----
panel_14 = Panel(sqrt)

number_slider_9 = Slider(3, range=0..10)
c_1_x = CSharpScript(x=number_slider_9)  # -> out, y; inputs x: Double
# ---------- c_1_x: C# ----------
    // Component written by @erinlinseyhunt

    // One over x
    y = 1 / x;
# ---------- end c_1_x ----------
panel_15 = Panel(c_1_x.y)

# ---- group: Grasshopper 1/x
one_over_x = OneOverX(Value=number_slider_9)

# ----
panel_16 = Panel(one_over_x)

number_slider_10 = Slider(10, range=0..10)
c_10º = CSharpScript(x=number_slider_10)  # -> out, y; inputs x: Double
# ---------- c_10º: C# ----------
    // Component written by @erinlinseyhunt

    // Power of 10
    y = Math.Pow(10, x);
# ---------- end c_10º ----------
panel_17 = Panel(c_10º.y)

# ---- group: Grasshopper 10º
_10º = PowerOf10(Value=number_slider_10)

# ----
panel_18 = Panel(_10º)

number_slider_11 = Slider(6, range=0..10)
c_log = CSharpScript(x=number_slider_11)  # -> out, y; inputs x: Double
# ---------- c_log: C# ----------
    // Component written by @erinlinseyhunt

    // Logarithm
    y = Math.Log10(x);
# ---------- end c_log ----------
panel_19 = Panel(c_log.y)

# ---- group: Grasshopper Log
log = Logarithm(Value=number_slider_11)

# ----
panel_20 = Panel(log)

number_slider_12 = Slider(5, range=0..10)
c_ln = CSharpScript(x=number_slider_12)  # -> out, y; inputs x: Double
# ---------- c_ln: C# ----------
    // Component written by @erinlinseyhunt

    // Natural Logarithm
    y = Math.Log(x);
# ---------- end c_ln ----------
panel_21 = Panel(c_ln.y)

# ---- group: Grasshopper Ln
ln = NaturalLogarithm(Value=number_slider_12)

# ----
panel_22 = Panel(ln)
