# Grasshopper definition Math_Trig.ghx (Grasshopper 1.0.7)

x = Slider(4, range=0..10)
acos = ArcCosine(Value=x)
c_acos = CSharpScript(x=x)  # -> out, y; inputs x: Double
# ---------- c_acos: C# ----------
    // Component written by @erinlinseyhunt

    // Arccosine
    y = Math.Acos(x);
# ---------- end c_acos ----------
panel = Panel(acos)
panel_2 = Panel(c_acos.y)

# ---- group: Grasshopper Centroid
centroid = Centroid()  # -> Centroid, MedianAB, MedianBC, MedianCA

# ----
c_centroid = CSharpScript()  # -> Out, C, AB, BC, CA

# ---- group: Grasshopper ICentre
icentre = Incentre()  # -> Incentre, BisectorA, BisectorB, BisectorC

# ----
c_icentre = CSharpScript()  # -> Out, I, A, B, C

# ---- group: Grasshopper CCentre
ccentre = Circumcentre()  # -> Circumcentre, BisectorAB, BisectorBC, BisectorCA

# ----
c_ccentre = CSharpScript()  # -> Out, C, AB, BC, CA

# ---- group: Grasshopper OCentre
ocentre = Orthocentre()  # -> Orthocentre, AltitudeAB, AltitudeBC, AltitudeCA

# ----
c_ocentre = CSharpScript()  # -> Out, C, AB, BC, CA

# ----
# GH#: A C# dictionary of Grasshopper3D components.
# 
# This file contains a category of Grasshopper components, and a mirroring C#/RhinoCommon implementation.
# 
# This is an educational project initiated by students/faculty of GSD-6338: Introduction to Computational Design, at the Harvard Graduate School of Design.
# 
# More information: {{project link}}
# Maths Trig
# Math Trig Incomplete: Centroid (Centroid)
# Incentre (ICentre)
# Circumcentre (CCentre)
# Orthocentre (OCentre)
x_2 = Slider(4, range=0..10)

# ---- group: Grasshopper Cos
cos = Cosine(Value=x_2)

# ---- group: C# Cos
c_script = CSharpScript(x=x_2)  # -> out, y; inputs x: Double
# ---------- c_script: C# ----------
    // Component written by @erinlinseyhunt

    // Cos
    y = Math.Cos(x);
# ---------- end c_script ----------

# ----
panel_3 = Panel(cos)
panel_4 = Panel(c_script.y)

x_3 = Slider(5, range=0..10)
c_sin = CSharpScript(x=x_3)  # -> out, y; inputs x: Double
# ---------- c_sin: C# ----------
    // Component written by @erinlinseyhunt

    // Sin
    y = Math.Sin(x);
# ---------- end c_sin ----------
panel_5 = Panel(c_sin.y)

# ---- group: Grasshopper Sin
sin = Sine(Value=x_3)

# ----
panel_6 = Panel(sin)

x_4 = Slider(5, range=0..10)
c_atan = CSharpScript(x=x_4)  # -> out, y; inputs x: Double
# ---------- c_atan: C# ----------
    // Component written by @erinlinseyhunt

    // Atan
    y = Math.Atan(x);
# ---------- end c_atan ----------
panel_7 = Panel(c_atan.y)

# ---- group: Grasshopper ATan
atan = ArcTangent(Value=x_4)

# ----
panel_8 = Panel(atan)

x_5 = Slider(5, range=0..10)
c_cot = CSharpScript(x=x_5)  # -> out, y; inputs x: Double
# ---------- c_cot: C# ----------
    // Component written by @erinlinseyhunt

    // Cotangent
    y = 1 / Math.Tan(x);
# ---------- end c_cot ----------
panel_9 = Panel(c_cot.y)

# ---- group: Grasshopper Cot
cot = CoTangent(Value=x_5)

# ----
panel_10 = Panel(cot)

number_slider = Slider(8, range=0..10)
c_deg = CSharpScript(R=number_slider)  # -> out, D; inputs R: Double
# ---------- c_deg: C# ----------
    // Component written by @erinlinseyhunt

    // Angle input in Degrees
    double radians = R;

    // Converts the angle from Degrees to Radians
    double degree = (180 / Math.PI) * radians;

    // Output
    D = degree;
# ---------- end c_deg ----------
panel_11 = Panel(c_deg.D)

# ---- group: Grasshopper Deg
deg = Degrees(Radians=number_slider)

# ----
panel_12 = Panel(deg)

x_6 = Slider(2, range=0..10)
c_sinc = CSharpScript(x=x_6)  # -> out, y; inputs x: Double
# ---------- c_sinc: C# ----------
    // Component written by @erinlinseyhunt

    // Sinc
    y = Math.Sin(x) / x;
# ---------- end c_sinc ----------
panel_13 = Panel(c_sinc.y)

# ---- group: Grasshopper Sinc
sinc = Sinc(Value=x_6)

# ----
panel_14 = Panel(sinc)

x_7 = Slider(5, range=0..10)
c_tan = CSharpScript(x=x_7)  # -> out, y; inputs x: Double
# ---------- c_tan: C# ----------
    // Component written by @erinlinseyhunt

    // Tan
    y = Math.Tan(x);
# ---------- end c_tan ----------
panel_15 = Panel(c_tan.y)

# ---- group: Grasshopper Tan
tan = Tangent(Value=x_7)

# ----
panel_16 = Panel(tan)

x_8 = Slider(1, range=0..10)
c_asin = CSharpScript(x=x_8)  # -> out, y; inputs x: Double
# ---------- c_asin: C# ----------
    // Component written by @erinlinseyhunt

    // Arcsine
    y = Math.Asin(x);
# ---------- end c_asin ----------
panel_17 = Panel(c_asin.y)

# ---- group: Grasshopper ASin
asin = ArcSine(Value=x_8)

# ----
panel_18 = Panel(asin)

x_9 = Slider(6, range=0..10)
c_csc = CSharpScript(x=x_9)  # -> out, y; inputs x: Double
# ---------- c_csc: C# ----------
    // Component written by @erinlinseyhunt

    // Cosecant
    y = 1 / Math.Sin(x);
# ---------- end c_csc ----------
panel_19 = Panel(c_csc.y)

# ---- group: Grasshopper Csc
csc = CoSecant(Value=x_9)

# ----
panel_20 = Panel(csc)

x_10 = Slider(4, range=0..10)
c_sec = CSharpScript(x=x_10)  # -> out, y; inputs x: Double
# ---------- c_sec: C# ----------
    // Component written by @erinlinseyhunt

    // Secant
    y = 1 / Math.Cos(x);
# ---------- end c_sec ----------
panel_21 = Panel(c_sec.y)

# ---- group: Grasshopper Sec
sec = Secant(Value=x_10)

# ----
panel_22 = Panel(sec)

number_slider_2 = Slider(1, range=0..10)
c_rad = CSharpScript(D=number_slider_2)  # -> out, R; inputs D: Double
# ---------- c_rad: C# ----------
    // Component written by @erinlinseyhunt

    // Angle input in Degrees
    double degree = D;

    // Converting the angle from Degrees to Radians
    double radians = Math.PI * (degree / 180.00);

    // Output
    R = radians;
# ---------- end c_rad ----------
panel_23 = Panel(c_rad.R)

# ---- group: Grasshopper Rad
rad = Radians(Degrees=number_slider_2)

# ----
panel_24 = Panel(rad)
