# Grasshopper definition Maths_Domain.ghx (Grasshopper 1.0.7)

number_slider = Slider(-0.5, range=-1..10)
dom = ConstructDomain(DomainStart=Slider(5, range=0..10), DomainEnd=Slider(10, range=0..10))
dom_2 = ConstructDomain(DomainStart=Slider(0, range=0..10), DomainEnd=Slider(1, range=0..10))
remap = RemapNumbers(Value=number_slider, Source=dom_2, Target=dom)  # -> Mapped, Clipped
gh_remap = CSharpScript(V=number_slider, S=dom_2, T=dom)  # -> out, R, C; inputs V: Double
# ---------- gh_remap: C# ----------
    // Component created by @garciadelcastillo

    // This component takes a value and two domains, and adapts the value
    // proportionally from one domain to the other.

    // Let's first find the "normalized" position (from 0 to 1) of the
    // value in the source domain.
    double normValue = (V - S.T0) / S.Length;

    // The remapped value is that normalized position on the new domain.
    double newValue = T.T0 + normValue * T.Length;

    // If the value was outside the source domain (outside the 0 to 1 range),
    // clip it to the appropriate boundary:
    double clippedValue = newValue;
    if (normValue < 0)
    {
      clippedValue = T.T0;
    }
    else if (normValue > 1)
    {
      clippedValue = T.T1;
    }

    // Outputs
    R = newValue;
    C = clippedValue;
# ---------- end gh_remap ----------
panel = Panel(remap.Mapped)
panel_2 = Panel(gh_remap.R)
panel_3 = Panel(remap.Clipped)
panel_4 = Panel(gh_remap.C)

number_slider_2 = Slider(5, range=0..10)
number_slider_3 = Slider(5, range=0..10)
dom²num = ConstructDomain²(UMin=Slider(0, range=0..10), UMax=Slider(1, range=0..10), VMin=Slider(5, range=0..10), VMax=Slider(10, range=0..10))
divide = DivideDomain²(Domain=dom²num, UCount=number_slider_2, VCount=number_slider_3)
gh_divide = CSharpScript(I=dom²num, U=number_slider_2, V=number_slider_3)  # -> out, S; inputs U: Int32, V: Int32
# ---------- gh_divide: C# ----------
    // Component written by @garciadelcastillo

    // This component takes a two-dimensional domain,
    // and subdivides it into a "grid" of two-dimensional domains
    // in the U and V directions.

    // Create an empty list of UV domains
    List<UVInterval> uvInts = new List<UVInterval>();

    // Compute length of domains in each direction
    double uLen = I.U.Length / U;
    double vLen = I.V.Length / V;

    // Use a nested for loop to subdivide into smaller domains
    for (int i = 0; i < U; i++)
    {
      double u0 = I.U0 + i * uLen;
      double u1 = I.U0 + (i + 1) * uLen;
      Interval uInt = new Interval(u0, u1);

      for (int j = 0; j < V; j++)
      {
        double v0 = I.V0 + j * vLen;
        double v1 = I.V0 + (j + 1) * vLen;
        Interval vInt = new Interval(v0, v1);

        UVInterval uvInt = new UVInterval(uInt, vInt);
        uvInts.Add(uvInt);
      }
    }

    // Outputs
    S = uvInts;
# ---------- end gh_divide ----------
panel_5 = Panel(divide)
panel_6 = Panel(gh_divide.S)

number_slider_4 = Slider(-0.5, range=-1..10)
dom_3 = ConstructDomain(DomainStart=Slider(0, range=0..10), DomainEnd=Slider(6, range=0..10))
gh_inc = CSharpScript(V=number_slider_4, D=dom_3)  # -> out, I, Dout; inputs V: Double
# ---------- gh_inc: C# ----------
    // Component created by @garciadelcastillo

    // This component takes a value and a domain, and tests it for inclusion.
    // If outside the domain, it returns the distance to the closest boundary.
    bool included = D.IncludesParameter(V);

    double distance = 0;
    if (included == false)
    {
      // Check start and end boundaries
      double distToStart = Math.Abs(D.T0 - V);
      double distToEnd = Math.Abs(D.T1 - V);
      distance = Math.Min(distToStart, distToEnd);
    }

    // Outputs
    I = included;
    Dout = distance;
# ---------- end gh_inc ----------
inc = Includes(Value=number_slider_4, Domain=dom_3)  # -> Includes, Deviation
panel_7 = Panel(inc.Includes)
panel_8 = Panel(gh_inc.I)
panel_9 = Panel(inc.Deviation)
panel_10 = Panel(gh_inc.Dout)

number_slider_5 = Slider(10, range=0..10)
dom_4 = ConstructDomain(DomainStart=Slider(0, range=0..10), DomainEnd=Slider(6, range=0..10))
gh_div = CSharpScript(I=dom_4, C=number_slider_5)  # -> out, S; inputs C: Int32
# ---------- gh_div: C# ----------
    // Component created by @garciadelcastillo

    // This component takes an input domain and a number,
    // and divides the interval in that many intervals.

    // First find the length of each subdomain.
    // Note this can be negative, if the interval start is larger than the end.
    double len = I.Length / C;

    // Create a list of subdomains and populate it
    List<Interval> subDoms = new List<Interval>();
    for (int i = 0; i < C; i++) {
      double start = I.T0 + i * len;
      double end = I.T0 + (i + 1) * len;
      Interval dom = new Interval(start, end);
      subDoms.Add(dom);
    }

    // Output
    S = subDoms;
# ---------- end gh_div ----------
div = DivideDomain(Domain=dom_4, Count=number_slider_5)
panel_11 = Panel(div)
panel_12 = Panel(gh_div.S)

dom²num_2 = ConstructDomain²(UMin=Slider(0, range=0..10), UMax=Slider(1, range=0..10), VMin=Slider(5, range=0..10), VMax=Slider(10, range=0..10))
dedom2num = DeconstructDomain²(Domain=dom²num_2)  # -> UMin, UMax, VMin, VMax
gh_dedom2num = CSharpScript(I=dom²num_2)  # -> out, U0, U1, V0, V1
# ---------- gh_dedom2num: C# ----------
    // Component written by @garciadelcastillo

    // This component takes a two-dimensional interval,
    // and outputs its boundaries.

    // Outputs can be read directly from the UVInterval object
    U0 = I.U0;
    U1 = I.U1;
    V0 = I.V0;
    V1 = I.V1;
# ---------- end gh_dedom2num ----------
panel_13 = Panel(gh_dedom2num.U0)
panel_14 = Panel(gh_dedom2num.V0)
panel_15 = Panel(dedom2num.UMin)
panel_16 = Panel(dedom2num.VMin)
panel_17 = Panel(gh_dedom2num.U1)
panel_18 = Panel(gh_dedom2num.V1)
panel_19 = Panel(dedom2num.UMax)
panel_20 = Panel(dedom2num.VMax)

dom²num_3 = ConstructDomain²(UMin=Slider(0, range=0..10), UMax=Slider(1, range=0..10), VMin=Slider(5, range=0..10), VMax=Slider(10, range=0..10))
dedom2 = DeconstructDomain²(Domain=dom²num_3)  # -> UComponent, VComponent
gh_dedom2 = CSharpScript(I=dom²num_3)  # -> out, U, V
# ---------- gh_dedom2: C# ----------
    // Component written by @garciadelcastillo

    // This component takes a two-dimensional interval,
    // and outputs each domain.

    // Outputs can be read directly from the UVInterval object
    U = I.U;
    V = I.V;
# ---------- end gh_dedom2 ----------
panel_21 = Panel(dedom2.UComponent)
panel_22 = Panel(gh_dedom2.U)
panel_23 = Panel(dedom2.VComponent)
panel_24 = Panel(gh_dedom2.V)

# ----
# GH#: A C# dictionary of Grasshopper3D components.
# 
# This file contains a category of Grasshopper components, and a mirroring C#/RhinoCommon implementation.
# 
# This is an educational project initiated by students/faculty of GSD-6338: Introduction to Computational Design, at the Harvard Graduate School of Design.
# 
# More information: {{project link}}
# Maths Domain
number_slider_6 = Slider(5, range=0..10)
number_slider_7 = Slider(6, range=0..10)
dom_5 = ConstructDomain(DomainStart=number_slider_6, DomainEnd=number_slider_7)
gh_dom = CSharpScript(A=number_slider_6, B=number_slider_7)  # -> out, I; inputs A: Double, B: Double
# ---------- gh_dom: C# ----------
    // Component written by @erinlinseyhunt

    // Creating a new Domain with an Interval
    Interval dx = new Interval(A, B);

    // Output
    I = dx;
# ---------- end gh_dom ----------
panel_25 = Panel(dom_5)
panel_26 = Panel(gh_dom.I)

dom_6 = ConstructDomain(DomainStart=Slider(5, range=0..10), DomainEnd=Slider(6, range=0..10))
dedomain = DeconstructDomain(Domain=dom_6)  # -> Start, End
gh_dedomain = CSharpScript(I=dom_6)  # -> out, S, E
# ---------- gh_dedomain: C# ----------
    // Component written by @erinlinseyhunt

    // Output
    S = I.T0;   // getting the lower bound of the domain
    E = I.T1;   // getting the upper bound of the domain
# ---------- end gh_dedomain ----------
panel_27 = Panel(gh_dedomain.S)
panel_28 = Panel(gh_dedomain.E)

dom_7 = ConstructDomain(DomainStart=Slider(0, range=0..10), DomainEnd=Slider(1, range=0..10))
dom_8 = ConstructDomain(DomainStart=Slider(5, range=0..10), DomainEnd=Slider(10, range=0..10))
dom² = ConstructDomain²(DomainU=dom_7, DomainV=dom_8)
gh_dom² = CSharpScript(U=dom_7, V=dom_8)  # -> out, I2
# ---------- gh_dom²: C# ----------
    // Component created by @garciadelcastillo

    // This component takes two domains, and creates a 2D domain with them.
    // Note that UVInterval is not part of RhinoCommon, but from Grashopper instead.
    UVInterval uvInt = new UVInterval(U, V);

    // Outputs
    I2 = uvInt;
# ---------- end gh_dom² ----------
panel_29 = Panel(dom²)
panel_30 = Panel(gh_dom².I2)

number_slider_8 = Slider(2.4, range=-1..10)
domain = Domain([Domain(0, 0.6), Domain(0.6, 1.2), Domain(1.2, 1.8), Domain(1.8, 2.4), Domain(2.4, 3), Domain(3, 3.6), Domain(3.6, 4.2), Domain(4.2, 4.8), Domain(4.8, 5.4), Domain(5.4, 6)])
toggle = BooleanToggle(True)
gh_fdom = CSharpScript(D=domain, N=number_slider_8, S=toggle)  # -> out, I, Nout; inputs D: list, N: Double, S: Boolean
# ---------- gh_fdom: C# ----------
    // Component created by @garciadelcastillo

    // This component takes list of domains and a value,
    // and returns the index of the first domain that contains that value.
    // If Strict is true, the value must lie within the domain, cannot be an extreme.

    // Let's first do a check if the value is contained in any of the domains.
    int index = -1;
    int closestIndex = -1;
    for (int i = 0; i < D.Count; i++)
    {
      Interval dom = D[i];
      if (dom.IncludesParameter(N, S))
      {
        index = i;
        closestIndex = i;
        break;  // stop the for loop
      }
    }

    // If no domain was found containing the value...
    if (index == -1)
    {
      // ...look at all the domains, and find the one whose boundary
      // is closest to the value.
      double distance = double.MaxValue;
      for (int i = 0; i < D.Count; i++)
      {
        Interval dom = D[i];

        // Check start and end boundaries
        double distToStart = Math.Abs(dom.T0 - N);
        double distToEnd = Math.Abs(dom.T1 - N);
        if (distToStart < distance)
        {
          closestIndex = i;
          distance = distToStart;
        }
        if (distToEnd < distance)
        {
          closestIndex = i;
          distance = distToEnd;
        }
      }
    }

    // Outputs
    I = index;
    Nout = closestIndex;
# ---------- end gh_fdom ----------
fdom = FindDomain(Domains=domain, Number=number_slider_8, Strict=toggle)  # -> Index, Neighbour
panel_31 = Panel(fdom.Index)
panel_32 = Panel(gh_fdom.I)
panel_33 = Panel(fdom.Neighbour)
panel_34 = Panel(gh_fdom.Nout)

number_slider_9 = Slider(0, range=0..10)
number_slider_10 = Slider(1, range=0..10)
number_slider_11 = Slider(5, range=0..10)
number_slider_12 = Slider(10, range=0..10)
gh_dom²num = CSharpScript(U0=number_slider_9, U1=number_slider_10, V0=number_slider_11, V1=number_slider_12)  # -> out, I2; inputs U0: Double, U1: Double, V0: Double, V1: Double
# ---------- gh_dom²num: C# ----------
    // Component created by @garciadelcastillo

    // This component takes four values, and creates a 2D domain with them.

    Interval uInt = new Interval(U0, U1);
    Interval vInt = new Interval(V0, V1);
    // Note that UVInterval is not part of RhinoCommon, but from Grashopper instead.
    UVInterval uvInt = new UVInterval(uInt, vInt);

    // Outputs
    I2 = uvInt;
# ---------- end gh_dom²num ----------
dom²num_4 = ConstructDomain²(UMin=number_slider_9, UMax=number_slider_10, VMin=number_slider_11, VMax=number_slider_12)
panel_35 = Panel(dom²num_4)
panel_36 = Panel(gh_dom²num.I2)

panel_37 = Panel("""5
5
7
10.01
-1
0
2.5
8""")
bnd = Bounds(Numbers=panel_37)
gh_bnd = CSharpScript(N=panel_37)  # -> out, I; inputs N: list of Double
# ---------- gh_bnd: C# ----------
    // Componenet created by @mirahx24

    // This component runs through the values from the input list
    // and find the domain of the values

    // First set the default vaules of max and min as the first element of the list
    double max = N[0];
    double min = N[0];

    // Then we iterate through the list to find the actual max and min values
    for(int i = 1;i < N.Count; i++) {
      if(max < N[i]) { // if max is smaller than the current iterated value, set max to that value
        max = N[i];
      }
      if(min > N[i]) { // if min is bigger than the current iterated value, set min to that value
        min = N[i];
      }
    }

    // Create the interval/domain with the min and max we found
    Interval interval = new Interval(min, max);

    // Output
    I = interval;
# ---------- end gh_bnd ----------
panel_38 = Panel(bnd)
panel_39 = Panel(gh_bnd.I)

panel_40 = Panel("""5
5
7
10.01
-1
0
2.5
8""")
toggle_2 = BooleanToggle(True)
consec = ConsecutiveDomains(Numbers=panel_40, Additive=toggle_2)
gh_consec = CSharpScript(N=panel_40, A=toggle_2)  # -> out, D; inputs N: list of Double, A: Boolean
# ---------- gh_consec: C# ----------
    // Component created by @mirahx24

    // This component takes the input list, and out a list of domains
    // If A is set to True, then the list will be considered as cumulative
    // If A is set to False, then the list will be taken as it is
    // For example, if input list N is {0, 1, 2, 3}, and A is True
    // then the output D will be {<0, 1>, <1, 3>, <3, 6>}
    // If A is False, then the output D will be {<0, 1>, <1, 2>, <2, 3>}

    // Create a empty list to hold all the output domains
    List<Interval> domains = new List<Interval>();

    // Check if the item count of List N is greater or equals to 2
    double count = N.Count;
    if(count >= 2) {

      if(A) { // for cumulative case
        double first = 0;
        double second = 0;
        for (int i = 0; i < count - 1; i++) {
          first += N[i];
          second = first + N[i + 1];
          Interval interval = new Interval(first, second);
          domains.Add(interval);
        }
      }
      else { // for non-cumulative case

        // Iterate through the input N to construct domains
        // Since we will access to items from the List at once, to avoid going out of the list bound
        // we will only iterate to the second to last item
        for (int i = 0;i < count - 1;i++) {
          Interval interval = new Interval(N[i], N[i + 1]);
          domains.Add(interval);
        }
      }
    }

    // Output
    D = domains;
# ---------- end gh_consec ----------
panel_41 = Panel(consec)
panel_42 = Panel(gh_consec.D)

pop2d = Populate2D(Region={Plane=PlaneXY(0, 0, 0), Size=Domain2(u=0..20, v=0..10)}, Count=100, Seed=1)
gh_bnd_2 = CSharpScript(C=pop2d)  # -> out, I; inputs C: list of Point3d
# ---------- gh_bnd_2: C# ----------
    // Component written by @garciadelcastillo

    // This component takes a list of points,
    // and returns a two-dimensional domain that fits all their
    // X and Y coordinates.

    // Start by defining the starting boundaries and setting them to really
    // large values in the opposite direction.
    double minX = double.MaxValue;
    double maxX = double.MinValue;
    double minY = double.MaxValue;
    double maxY = double.MinValue;

    // Iterate all the points, and adjust these boundaries to new extreme values
    foreach (Point3d p in C)
    {
      if (p.X < minX)
      {
        minX = p.X;
      }
      if (p.X > maxX)
      {
        maxX = p.X;
      }

      if (p.Y < minY)
      {
        minY = p.Y;
      }
      if (p.Y > maxY)
      {
        maxY = p.Y;
      }
    }

    Interval uInt = new Interval(minX, maxX);
    Interval vInt = new Interval(minY, maxY);
    UVInterval uvInt = new UVInterval(uInt, vInt);

    // Outputs
    I = uvInt;
# ---------- end gh_bnd_2 ----------
bnd_2 = Bounds2D(Coordinates=pop2d)
panel_43 = Panel(bnd_2)
panel_44 = Panel(gh_bnd_2.I)

panel_45 = Panel(dedomain.Start)
panel_46 = Panel(dedomain.End)
