# Grasshopper definition Maths_Matrix.ghx (Grasshopper 1.0.7)

matrix = Matrix({0;0=0.7710938983, 0;1=0.4041625948, 0;2=0.1659986703, 0;3=0.9850470526, 0;4=0.1090046336, 0;5=0.306680408, 1;0=0.8021404612, 1;1=0.4455466789, 1;2=0.224983154, 1;3=0.01120665297, 1;4=0.7653673407, 1;5=0.02874359071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})
matrix_2 = Matrix({0;0=0.7710938983, 0;1=0.4041625948, 0;2=0.1659986703, 0;3=0.9850470526, 1;0=0.1090046336, 1;1=0.306680408, 1;2=0.8021404612, 1;3=0.4455466789, 2;0=0.224983154, 2;1=0.01120665297, 2;2=0.7653673407, 2;3=0.02874359071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})
matrix_3 = DisplayMatrix(matrix)
gh_transpose = CSharpScript(M=matrix)  # -> out, Mout
# ---------- gh_transpose: C# ----------
    // Component written by @garciadelcastillo

    // This component takes a numerical matrix, and transposes it.
    // Transposing means swapping rows and columns. 
    
    // Since C# Script components do not have the Matrix class as an input option,
    // we must first cast the generic object to a Matrix object.
    Matrix m;
    try
    {
      m = (Matrix) M;
    }
    catch
    {
      Component.AddRuntimeMessage(GH_RuntimeMessageLevel.Error, "Please provide a valid Matrix");
      return;
    }

    // Let's make a copy of the original matrix first
    Matrix trans = m.Duplicate();
    
    // Transpose it (this operation will always be successful, all matrices can be transposed)
    trans.Transpose();
    
    // Outputs
    Mout = trans;
# ---------- end gh_transpose ----------
transpose = TransposeMatrix(Matrix=matrix)
matrix_4 = DisplayMatrix(transpose)
matrix_5 = DisplayMatrix(gh_transpose.Mout)

# ----
# GH#: A C# dictionary of Grasshopper3D components.
# 
# This file contains a category of Grasshopper components, and a mirroring C#/RhinoCommon implementation.
# 
# This is an educational project initiated by students/faculty of GSD-6338: Introduction to Computational Design, at the Harvard Graduate School of Design.
# 
# More information: {{project link}}
# Maths Matrix
number_slider = Slider(4, range=0..10)
number_slider_2 = Slider(4, range=0..10)
number_slider_3 = Slider(10, range=0..10)
num = Number([0.7710938983, 0.4041625948, 0.1659986703, 0.9850470526, 0.1090046336, 0.306680408, 0.8021404612, 0.4455466789, 0.224983154, 0.01120665297, 0.7653673407, 0.02874359071, 0.007561190523, 0.5100224169, 0.3820949846, 0.2794087833])
panel = Panel(num)
gh_matrix = CSharpScript(R=number_slider, C=number_slider_2, V=num)  # -> out, M; inputs R: Int32, C: Int32, V: list of Double
# ---------- gh_matrix: C# ----------
    // Component written by @garciadelcastillo

    // This component takes the dimensions of a numerical matrix and an optional value,
    // and returns the matrix.

    // RhinoCommon provides a Matrix class to work with matrices
    Matrix m = new Matrix(R, C);

    // If no value provided, create an identity matrix
    if (V.Count == 0)
    {
      m.SetDiagonal(1);
    }
    // If one value is provided, populate the matrix with that value
    else if (V.Count == 1)
    {
      double v = V[0];
      // Matrix values can be accessed as a two dimensional row/column array
      for (int i = 0; i < R; i++)
      {
        for (int j = 0; j < C; j++) 
        {
          m[i, j] = v;
        }
      }
    }
    // If provided exactly all values for the matrix, populate them
    else if (V.Count == R * C)
    {
      // Matrix values can be accessed as a two dimensional row/column array
      int it = 0;
      for (int i = 0; i < R; i++)
      {
        for (int j = 0; j < C; j++) 
        {
          m[i, j] = V[it];
          it++;
        }
      }
    }
    // If all the above failed, the number of values provided was probably wrong
    else
    {
      Component.AddRuntimeMessage(GH_RuntimeMessageLevel.Error, "Amount of Matrix values must equal rows*columns");
      return;
    }

    // Output
    M = m;
# ---------- end gh_matrix ----------
matrix_6 = ConstructMatrix(Rows=number_slider, Columns=number_slider_2, Values=num)
panel_2 = Panel(matrix_6)
panel_3 = Panel(gh_matrix.M)
matrix_7 = DisplayMatrix(matrix_6)
matrix_8 = DisplayMatrix(gh_matrix.M)

matrix_9 = Matrix({0;0=0.7710938983, 0;1=0.4041625948, 0;2=0.1659986703, 0;3=0.9850470526, 0;4=0.1090046336, 0;5=0.306680408, 1;0=0.8021404612, 1;1=0.4455466789, 1;2=0.224983154, 1;3=0.01120665297, 1;4=0.7653673407, 1;5=0.02874359071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})
matrix_10 = Matrix({0;0=0.7710938983, 0;1=0.4041625948, 0;2=0.1659986703, 0;3=0.9850470526, 1;0=0.1090046336, 1;1=0.306680408, 1;2=0.8021404612, 1;3=0.4455466789, 2;0=0.224983154, 2;1=0.01120665297, 2;2=0.7653673407, 2;3=0.02874359071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})
number_slider_4 = Slider(2, range=0..10)
number_slider_5 = Slider(4, range=0..10)
gh_swapc = CSharpScript(M=matrix_9, A=number_slider_4, B=number_slider_5)  # -> out, Mout; inputs A: Int32, B: Int32
# ---------- gh_swapc: C# ----------
    // Component written by @garciadelcastillo

    // This component takes a numerical matrix, 
    // and swaps two of its columns given their indices.

    // Since C# Script components do not have the Matrix class as an input option,
    // we must first cast the generic object to a Matrix object.
    Matrix m;
    try
    {
      m = (Matrix) M;
    }
    catch
    {
      Component.AddRuntimeMessage(GH_RuntimeMessageLevel.Error, "Please provide a valid Matrix");
      return;
    }
    
    // Let's do some sanity checks first
    if (A >= m.ColumnCount || B >= m.ColumnCount)
    {
      Component.AddRuntimeMessage(GH_RuntimeMessageLevel.Error, "Column index must be smaller than the matrix column count");
      return;
    }

    // Let's make a copy of the original matrix first
    Matrix swap = m.Duplicate();

    // And swap the values now
    bool success = swap.SwapColumns(A, B);

    // Outputs
    Mout = swap;
# ---------- end gh_swapc ----------
swapc = SwapColumns(Matrix=matrix_9, ColumnA=number_slider_4, ColumnB=number_slider_5)
matrix_11 = DisplayMatrix(swapc)
matrix_12 = DisplayMatrix(gh_swapc.Mout)

number_slider_6 = Slider(0, range=0..10)
matrix_13 = Matrix({0;0=0.7710938983, 0;1=0.4041625948, 0;2=0.1659986703, 0;3=0.9850470526, 0;4=0.1090046336, 0;5=0.306680408, 1;0=0.8021404612, 1;1=0.4455466789, 1;2=0.224983154, 1;3=0.01120665297, 1;4=0.7653673407, 1;5=0.02874359071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})
matrix_14 = Matrix({0;0=0.7710938983, 0;1=0.4041625948, 0;2=0.1659986703, 0;3=0.9850470526, 1;0=0.1090046336, 1;1=0.306680408, 1;2=0.8021404612, 1;3=0.4455466789, 2;0=0.224983154, 2;1=0.01120665297, 2;2=0.7653673407, 2;3=0.02874359071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})
number_slider_7 = Slider(2, range=0..10)
gh_swapr = CSharpScript(M=matrix_13, A=number_slider_6, B=number_slider_7)  # -> out, Mout; inputs A: Int32, B: Int32
# ---------- gh_swapr: C# ----------
    // Component written by @garciadelcastillo

    // This component takes a numerical matrix,
    // and swaps two of its rows given their indices.

    // Since C# Script components do not have the Matrix class as an input option,
    // we must first cast the generic object to a Matrix object.
    Matrix m;
    try
    {
      m = (Matrix) M;
    }
    catch
    {
      Component.AddRuntimeMessage(GH_RuntimeMessageLevel.Error, "Please provide a valid Matrix");
      return;
    }

    // Let's do some sanity checks first
    if (A >= m.RowCount || B >= m.RowCount)
    {
      Component.AddRuntimeMessage(GH_RuntimeMessageLevel.Error, "Row index must be smaller than the matrix row count");
      return;
    }

    // Let's make a copy of the original matrix first
    Matrix swap = m.Duplicate();

    // And swap the values now
    bool success = swap.SwapRows(A, B);

    // Outputs
    Mout = swap;
# ---------- end gh_swapr ----------
swapr = SwapRows(Matrix=matrix_13, RowA=number_slider_6, RowB=number_slider_7)
matrix_15 = DisplayMatrix(swapr)
matrix_16 = DisplayMatrix(gh_swapr.Mout)

matrix_17 = Matrix({0;0=0.7710938983, 0;1=0.4041625948, 0;2=0.1659986703, 0;3=0.9850470526, 1;0=0.1090046336, 1;1=0.306680408, 1;2=0.8021404612, 1;3=0.4455466789, 2;0=0.224983154, 2;1=0.01120665297, 2;2=0.7653673407, 2;3=0.02874359071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})
matrix_18 = Matrix({0;0=1, 0;1=0, 0;2=0, 0;3=0, 1;0=0, 1;1=1, 1;2=0, 1;3=0, 2;0=0, 2;1=0, 2;2=1, 2;3=0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})
number_slider_8 = Slider(0.001, range=0..1)
gh_minvert = CSharpScript(M=matrix_17, t=number_slider_8)  # -> out, Mout, S; inputs t: Double
# ---------- gh_minvert: C# ----------
    // Component written by @garciadelcastillo

    // This component takes a numerical matrix, 
    // and tries to compute its inverse.
    // More on https://en.wikipedia.org/wiki/Invertible_matrix
    
    // Since C# Script components do not have the Matrix class as an input option,
    // we must first cast the generic object to a Matrix object.
    Matrix m;
    try
    {
      m = (Matrix) M;
    }
    catch
    {
      Component.AddRuntimeMessage(GH_RuntimeMessageLevel.Error, "Please provide a valid Matrix");
      return;
    }

    // Let's make a copy of the original matrix first
    Matrix inv = m.Duplicate();
    
    // Invert it, and store the success flag
    bool success = inv.Invert(t);

    // Outputs
    Mout = inv;
    S = success;
# ---------- end gh_minvert ----------
minvert = InvertMatrix(Matrix=matrix_17, Tolerance=number_slider_8)  # -> Matrix, Success
matrix_19 = DisplayMatrix(minvert.Matrix)
matrix_20 = DisplayMatrix(gh_minvert.Mout)
panel_4 = Panel(minvert.Success)
panel_5 = Panel(gh_minvert.S)

matrix_21 = Matrix({0;0=1, 0;1=0, 0;2=0, 0;3=0, 0;4=0, 0;5=0, 1;0=0, 1;1=1, 1;2=0, 1;3=0, 1;4=0, 1;5=0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})
matrix_22 = Matrix({0;0=0.7710938983, 0;1=0.4041625948, 0;2=0.1659986703, 0;3=0.9850470526, 1;0=0.1090046336, 1;1=0.306680408, 1;2=0.8021404612, 1;3=0.4455466789, 2;0=0.224983154, 2;1=0.01120665297, 2;2=0.7653673407, 2;3=0.02874359071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})
gh_dematrix = CSharpScript(M=matrix_22)  # -> out, R, C, V
# ---------- gh_dematrix: C# ----------
    // Component written by @garciadelcastillo

    // This component takes a numerical matrix, 
    // and returns row + column count, plus its values.

    // Since C# Script components do not have the Matrix class as an input option,
    // we must first cast the generic object to a Matrix object. 
    Matrix m;
    try
    {
      m = (Matrix) M;
    }
    catch
    {
      Component.AddRuntimeMessage(GH_RuntimeMessageLevel.Error, "Please provide a valid Matrix");
      return;
    }
    
    // Extract properties of matrix
    int rowCount = m.RowCount;
    int colCount = m.ColumnCount;
    
    // Extract its values
    List<double> vals = new List<double>();
    for (int i = 0; i < rowCount; i++)
    {
      for (int j = 0; j < colCount; j++)
      {
        double v = m[i, j];
        vals.Add(v);
      }
    }
    
    // Outputs
    R = rowCount;
    C = colCount;
    V = vals;
# ---------- end gh_dematrix ----------
dematrix = DeconstructMatrix(Matrix=matrix_22)  # -> Rows, Columns, Values
panel_6 = Panel(gh_dematrix.R)
panel_7 = Panel(gh_dematrix.C)
panel_8 = Panel(dematrix.Rows)
panel_9 = Panel(dematrix.Columns)
panel_10 = Panel(gh_dematrix.V)
panel_11 = Panel(dematrix.Values)

matrix_23 = DisplayMatrix()
