# Grasshopper definition Maths_Operators.ghx (Grasshopper 1.0.7)

panel = Panel("""6
8
5
3
2""")
vec = VectorXYZ(XComponent=panel, YComponent=0, ZComponent=0)  # -> Vector, Length
pt = Point(vec.Vector)
vec_2 = Vector(vec.Vector)
num = Number(vec.Length)
data = Data(pt)
reldif = RelativeDifferences(Values=data)
gh_reldif = CSharpScript(V=data)  # -> out, D; inputs V: list
# ---------- gh_reldif: C# ----------
    // Component written by @garciadelcastillo & @v-xup6

    // This component takes a list of numbers, points or vectors,
    // and computes their relative differences.

    // Create a list of numbers to store the relative differences,
    // use list type object so it can store numbers, points or vectors
    List<object> diffs = new List<object>();

    // Iterate over all data, and find the difference with previous value
    // keep data as type object for versatility
    object prev = V[0];
    for(int i = 0; i < V.Count; i++)
    {
      // Object variable to store the difference
      object diff = new object();

      // Check data type and cast to that data type for operation
      if(prev.GetType().Name == "Point3d"){
        diff = (object) ((Point3d) V[i] - (Point3d) prev);
      }
      if(prev.GetType().Name == "Vector3d"){
        diff = (object) ((Vector3d) V[i] - (Vector3d) prev);
      }
      if(prev.GetType().Name == "Double"){
        diff = (object) ((double) V[i] - (double) prev);
      }

      diffs.Add(diff);
      prev = V[i];
    }

    // Outputs
    D = diffs;
# ---------- end gh_reldif ----------
panel_2 = Panel(reldif)
panel_3 = Panel(gh_reldif.D)

# ----
# GH#: A C# dictionary of Grasshopper3D components.
# 
# This file contains a category of Grasshopper components, and a mirroring C#/RhinoCommon implementation.
# 
# This is an educational project initiated by students/faculty of GSD-6338: Introduction to Computational Design, at the Harvard Graduate School of Design.
# 
# More information: {{project link}}
# Maths Operators
number_slider = Slider(5, range=0..10)
number_slider_2 = Slider(8.7, range=0..10)
addition = Addition(A=number_slider, B=number_slider_2)
gh_a_b = CSharpScript(A=number_slider, B=number_slider_2)  # -> out, R; inputs A: Double, B: Double
# ---------- gh_a_b: C# ----------
    // Component written by @erinlinseyhunt

    // Addition
    R = A + B;
# ---------- end gh_a_b ----------
panel_4 = Panel(addition)
panel_5 = Panel(gh_a_b.R)

number_slider_3 = Slider(5, range=0..10)
number_slider_4 = Slider(8.7, range=0..10)
multiplication = Multiplication(A=number_slider_3, B=number_slider_4)
gh_axb = CSharpScript(A=number_slider_3, B=number_slider_4)  # -> out, R; inputs A: Double, B: Double
# ---------- gh_axb: C# ----------
    // Component written by @erinlinseyhunt

    // Multiplication
    R = A * B;
# ---------- end gh_axb ----------
panel_6 = Panel(multiplication)
panel_7 = Panel(gh_axb.R)

number_slider_5 = Slider(5, range=0..10)
number_slider_6 = Slider(8.7, range=0..10)
pow = Power(A=number_slider_5, B=number_slider_6)
gh_pow = CSharpScript(A=number_slider_5, B=number_slider_6)  # -> out, R; inputs A: Double, B: Double
# ---------- gh_pow: C# ----------
    // Component written by @erinlinseyhunt

    // Power
    R = Math.Pow(A, B);
# ---------- end gh_pow ----------
panel_8 = Panel(pow)
panel_9 = Panel(gh_pow.R)

number_slider_7 = Slider(-5, range=-5..5)
abs = Absolute(Value=number_slider_7)
gh_abs = CSharpScript(x=number_slider_7)  # -> out, y; inputs x: Double
# ---------- gh_abs: C# ----------
    // Component written by @erinlinseyhunt

    // Absolute Value
    y = Math.Abs(x);
# ---------- end gh_abs ----------
panel_10 = Panel(abs)
panel_11 = Panel(gh_abs.y)

number_slider_8 = Slider(5, range=0..10)
number_slider_9 = Slider(2, range=0..10)
integer_division = IntegerDivision(A=number_slider_8, B=number_slider_9)
gh_a_b_2 = CSharpScript(A=number_slider_8, B=number_slider_9)  # -> out, R; inputs A: Int32, B: Int32
# ---------- gh_a_b_2: C# ----------
    // Component written by @erinlinseyhunt

    // Integer division- finds the floor of a division
    R = A / B;
# ---------- end gh_a_b_2 ----------
panel_12 = Panel(integer_division)
panel_13 = Panel(gh_a_b_2.R)

panel_14 = Panel("""6
8
5
3
2""")
ma = MassAddition(Input=panel_14)  # -> Result, PartialResults
gh_ma = CSharpScript(I=panel_14)  # -> out, R, Pr; inputs I: list of Double
# ---------- gh_ma: C# usings ----------
using System.IO;
using System.Linq;
using System.Data;
using System.Drawing;
using System.Reflection;
using System.Windows.Forms;
using System.Xml;
using System.Xml.Linq;
using System.Runtime.InteropServices;

using Rhino.DocObjects;
using Rhino.Collections;
using GH_IO;
using GH_IO.Serialization;
# ---------- gh_ma: C# ----------
    // Component written by @erinlinseyhunt

    // Declaring a Variable
    double massAdd = 0.0;

    // Creating a new List of Doubles
    List<double> partResult = new List<double>();

    // Using a for loop to add all of the numbers together to get the total lump sum.
    // Then using the for loop and the above addition opperator to add the partical values to the new list.
    for (int i = 0; i < I.Count; i++) {
      massAdd += I[i];
      partResult.Add(massAdd);
    }

    //Outputs
    R = massAdd;
    Pr = partResult;
# ---------- end gh_ma ----------
panel_15 = Panel(ma.Result)
panel_16 = Panel(ma.PartialResults)
panel_17 = Panel(gh_ma.R)
panel_18 = Panel(gh_ma.Pr)

A = Slider(5, range=0..10)
B = Slider(5, range=0..10)
equals = Equality(FirstNumber=A, SecondNumber=B)  # -> Equality, Inequality
gh_equals = CSharpScript(A=A, B=B)  # -> out, equal, notEqual; inputs A: Double, B: Double
# ---------- gh_equals: C# ----------
    // Component written by @erinlinseyhunt

    // Conditional Statement if the inputs are equal it will output true if not false.
    if(A == B) {
      equal = true;
      notEqual = false;
    }
    else {
      equal = false;
      notEqual = true;
    }
# ---------- end gh_equals ----------
panel_19 = Panel(equals.Equality)
panel_20 = Panel(equals.Inequality)
panel_21 = Panel(gh_equals.equal)
panel_22 = Panel(gh_equals.notEqual)

A_2 = Slider(2.94, range=-10..10)
B_2 = Slider(10, range=-10..10)
number_slider_10 = Slider(50, range=0..100)
similar = Similarity(FirstNumber=A_2, SecondNumber=B_2, Threshold=number_slider_10)  # -> Similarity, AbsoluteDifference
gh_similar = CSharpScript(A=A_2, B=B_2, T=number_slider_10)  # -> out, equal, dt; inputs A: Double, B: Double, T: Double
# ---------- gh_similar: C# ----------
    // Component written by @erinlinseyhunt, @garciadelcastillo

    // This component checks if the inputs are similar, or in other words,
    // their difference is below a certain threshold measured in percentage.

    // Find the value with the largest absolute value
    double max = A, min = B;
    if (Math.Abs(A) < Math.Abs(B))
    {
      max = B;
      min = A;
    }

    // Compute the percentage level of the max value
    double threshold = Math.Abs(max * T / 100.0);

    // Is the min value within boundaries of this threshold?
    if (min < max + threshold && min > max - threshold)
    {
      equal = true;
    }
    else
    {
      equal = false;
    }

    //Finds the absolute difference between A and B
    dt = Math.Abs(A - B);
# ---------- end gh_similar ----------
panel_23 = Panel(similar.Similarity)
panel_24 = Panel(similar.AbsoluteDifference)
panel_25 = Panel(gh_similar.equal)
panel_26 = Panel(gh_similar.dt)

toggle = BooleanToggle(False)
toggle_2 = BooleanToggle(False)
and = GateAnd(A=toggle, B=toggle_2)
gh_and = CSharpScript(A=toggle, B=toggle_2)  # -> out, R; inputs A: Boolean, B: Boolean
# ---------- gh_and: C# ----------
    // Component created by @mirahx24

    // Pre-defined and un-initialized output.
    // Set-up this way to access it outside of the scope of if-else statements
    bool result;

    // AND gate works exactly like the logical "&&"
    // It should return true only when both of the inputs are true.
    // Otherwise, return false.
    if(A && B) {
      result = true;
    }

    else {
      result = false;
    }

    // Output
    R = result;
# ---------- end gh_and ----------
panel_27 = Panel(and)
panel_28 = Panel(gh_and.R)

toggle_3 = BooleanToggle(False)
toggle_4 = BooleanToggle(False)
or = GateOr(A=toggle_3, B=toggle_4)
gh_or = CSharpScript(A=toggle_3, B=toggle_4)  # -> out, R; inputs A: Boolean, B: Boolean
# ---------- gh_or: C# ----------
    // Component created by @mirahx24

    // Pre-defined and un-initialized output.
    // Set-up this way to access it outside of the scope of if-else statements
    bool result;

    // OR gate acts exactly like the logic "||"
    // If one of the inputs, A or B, is true, then it should return true.
    // Otherwise, return false
    if(A || B) {
      result = true;
    }

    else {
      result = false;
    }

    // Output
    R = result;
# ---------- end gh_or ----------
panel_29 = Panel(or)
panel_30 = Panel(gh_or.R)

toggle_5 = BooleanToggle(False)
toggle_6 = BooleanToggle(False)
toggle_7 = BooleanToggle(False)
vote = GateMajority(A=toggle_5, B=toggle_6, C=toggle_7)
gh_vote = CSharpScript(A=toggle_5, B=toggle_6, C=toggle_7)  # -> out, R; inputs A: Boolean, B: Boolean, C: Boolean
# ---------- gh_vote: C# ----------
    // Component created by @mirahx24

    // Pre-defined and un-initialized output.
    // Set-up this way to access it outside of the scope of if-else statements
    bool result;

    // VOTE checks the majority of the inputs
    // If two or more inputs' values are TRUE, return true
    // Otherwise, return false.
    if(A && B || A && C || B && C) {
      result = true;
    }
    else {
      result = false;
    }

    // Output
    R = result;
# ---------- end gh_vote ----------
panel_31 = Panel(vote)
panel_32 = Panel(gh_vote.R)

toggle_8 = BooleanToggle(False)
toggle_9 = BooleanToggle(False)
nor = GateNor(A=toggle_8, B=toggle_9)
gh_nor = CSharpScript(A=toggle_8, B=toggle_9)  # -> out, R; inputs A: Boolean, B: Boolean
# ---------- gh_nor: C# ----------
    // Component created by @mirahx24

    // Pre-defined and un-initialized output.
    // Set-up this way to access it outside of the scope of if-else statements
    bool result;

    // NOR gate is the compliment of OR gate.
    // If one of the input is true, return false.
    // Otherwise, return true;
    if(A || B){
      result = false;
    }

    else{
      result = true;
    }

    // Output
    R = result;
# ---------- end gh_nor ----------
panel_33 = Panel(nor)
panel_34 = Panel(gh_nor.R)

number_slider_11 = Slider(-4, range=-4..0)
neg = Negative(Value=number_slider_11)
gh_neg = CSharpScript(x=number_slider_11)  # -> out, y; inputs x: Double
# ---------- gh_neg: C# ----------
    // Component written by @erinlinseyhunt

    // Returns the negative value of the input.
    y = -x;
# ---------- end gh_neg ----------
panel_35 = Panel(neg)
panel_36 = Panel(gh_neg.y)

toggle_10 = BooleanToggle(False)
not = GateNot(A=toggle_10)
gh_not = CSharpScript(A=toggle_10)  # -> out, R; inputs A: Boolean
# ---------- gh_not: C# ----------
    // Component created by @mirahx24

    // Pre-defined and un-initialized output.
    // Set-up this way to access it outside of the scope of if-else statements
    bool result;

    // NOT gate flips the input's value
    // if input A is true, output should be false, and vice versa
    if(A == true) {
      result = false;
    }

    else {
      result = true;
    }

    // Output
    R = result;
# ---------- end gh_not ----------
panel_37 = Panel(not)
panel_38 = Panel(gh_not.R)

toggle_11 = BooleanToggle(True)
toggle_12 = BooleanToggle(True)
xor = GateXor(A=toggle_11, B=toggle_12)
gh_xor = CSharpScript(A=toggle_11, B=toggle_12)  # -> out, R; inputs A: Boolean, B: Boolean
# ---------- gh_xor: C# ----------
    // Component created by @mirahx24

    // Pre-defined and un-initialized output.
    // Set-up this way to access it outside of the scope of if-else statements
    bool result;

    // XOR gate checks the inputs are the same
    // If both inputs has the same value, return false.
    // If both inputs has different values, return true.
    if(A == B) {
      result = false;
    }

    else {
      result = true;
    }

    // Output
    R = result;
# ---------- end gh_xor ----------
panel_39 = Panel(xor)
panel_40 = Panel(gh_xor.R)

toggle_13 = BooleanToggle(False)
toggle_14 = BooleanToggle(False)
nand = GateNand(A=toggle_13, B=toggle_14)
gh_nand = CSharpScript(A=toggle_13, B=toggle_14)  # -> out, R; inputs A: Boolean, B: Boolean
# ---------- gh_nand: C# ----------
    // Component created by @mirahx24

    // Pre-defined and un-initialized output.
    // Set-up this way to access it outside of the scope of if-else statements
    bool result;

    // NAND gate is the flipped version of AND gate.
    // If both inputs are true, then it returns false.
    // Otherwise, return true.
    if(A && B) {
      result = false;
    }
    else {
      result = true;
    }

    // Output
    R = result;
# ---------- end gh_nand ----------
panel_41 = Panel(gh_nand.R)
panel_42 = Panel(nand)

toggle_15 = BooleanToggle(False)
toggle_16 = BooleanToggle(False)
xnor = GateXnor(A=toggle_15, B=toggle_16)
gh_xnor = CSharpScript(A=toggle_15, B=toggle_16)  # -> out, R; inputs A: Boolean, B: Boolean
# ---------- gh_xnor: C# ----------
    // Component created by @mirahx24

    // Pre-defined and un-initialized output.
    // Set-up this way to access it outside of the scope of if-else statements
    bool result;

    // XNOR gate works like the compliement of XOR gate.
    // if both inputs has the same value, return true.
    // if both inputs has different values, return false.
    if(A == B){
      result = true;
    }

    else{
      result = false;
    }

    // Output
    R = result;
# ---------- end gh_xnor ----------
panel_43 = Panel(gh_xnor.R)
panel_44 = Panel(xnor)

number_slider_12 = Slider(1.7, range=0..10)
number_slider_13 = Slider(8.3, range=0..10)
division = Division(A=number_slider_12, B=number_slider_13)
gh_a_b_3 = CSharpScript(A=number_slider_12, B=number_slider_13)  # -> out, R; inputs A: Double, B: Double
# ---------- gh_a_b_3: C# ----------
    // Component written by @erinlinseyhunt

    // Division
    R = A / B;
# ---------- end gh_a_b_3 ----------
panel_45 = Panel(gh_a_b_3.R)
panel_46 = Panel(division)

number_slider_14 = Slider(7, range=0..10)
fac = Factorial(Number=number_slider_14)
gh_fac = CSharpScript(N=number_slider_14)  # -> out, F; inputs N: Int32
# ---------- gh_fac: C# ----------
    // Component written by @erinlinseyhunt

    // Declaring variables
    int i, f = 1;

    // The factorial of a number n is the product of all positive numbers less than or equal to n
    for(i = 1; i <= N; i++) {
      f = f * i;
    }

    // Output
    F = f;
# ---------- end gh_fac ----------
panel_47 = Panel(fac)
panel_48 = Panel(gh_fac.F)

number_slider_15 = Slider(3, range=0..10)
number_slider_16 = Slider(7.9, range=0..10)
mod = Modulus(A=number_slider_15, B=number_slider_16)
gh_mod = CSharpScript(A=number_slider_15, B=number_slider_16)  # -> out, R; inputs A: Double, B: Double
# ---------- gh_mod: C# ----------
    // Component written by @erinlinseyhunt

    // Modulus- finds the remainder of after dividing one number by another.
    R = A % B;
# ---------- end gh_mod ----------
panel_49 = Panel(mod)
panel_50 = Panel(gh_mod.R)

panel_51 = Panel("""6
8
5
3
2""")
mm = MassMultiplication(Input=panel_51)  # -> Result, PartialResults
gh_mm = CSharpScript(I=panel_51)  # -> out, R, Pr; inputs I: list of Double
# ---------- gh_mm: C# ----------
    // Component written by @erinlinseyhunt

    // Declaring a Variable
    double massMult = 1.0;

    // Creating a new list of doubles
    List<double> partResult = new List<double>();

    // Using a for loop to multiply all of the numbers together to get the total lump product.
    // Then using the for loop and the above multiplication opperator to add the partical values to the new list.
    for (int i = 0; i < I.Count; i++) {
      massMult *= I[i];
      partResult.Add(massMult);
    }

    // Output
    R = massMult;
    Pr = partResult;
# ---------- end gh_mm ----------
panel_52 = Panel(mm.Result)
panel_53 = Panel(mm.PartialResults)
panel_54 = Panel(gh_mm.R)
panel_55 = Panel(gh_mm.Pr)

A_3 = Slider(5, range=0..10)
B_3 = Slider(10, range=0..10)
larger = LargerThan(FirstNumber=A_3, SecondNumber=B_3)  # -> LargerThan, OrEqualTo
gh_larger = CSharpScript(A=A_3, B=B_3)  # -> out, largerThan, equal; inputs A: Double, B: Double
# ---------- gh_larger: C# ----------
    // Component written by @erinlinseyhunt

    // Conditional Statement comparing the two numbers to see if they are larger than or equal to one another.
    if(A > B) {
      largerThan = true;
      equal = true;
    }
    else if(A < B) {
      largerThan = false;
      equal = false;
    }
    else {
      largerThan = false;
      equal = true;
    }
# ---------- end gh_larger ----------
panel_56 = Panel(larger.LargerThan)
panel_57 = Panel(gh_larger.largerThan)
panel_58 = Panel(gh_larger.equal)
panel_59 = Panel(larger.OrEqualTo)

A_4 = Slider(5, range=0..10)
B_4 = Slider(3, range=0..10)
smaller = SmallerThan(FirstNumber=A_4, SecondNumber=B_4)  # -> SmallerThan, OrEqualTo
gh_smaller = CSharpScript(A=A_4, B=B_4)  # -> out, smallerThan, equal; inputs A: Double, B: Double
# ---------- gh_smaller: C# ----------
    // Component written by @erinlinseyhunt

    // Conditional Statement comparing the two numbers to see if they are smaller than or equal to one another.
    if(A < B) {
      smallerThan = true;
      equal = true;
    }
    else if(A > B) {
      smallerThan = false;
      equal = false;
    }
    else {
      smallerThan = false;
      equal = true;
    }
# ---------- end gh_smaller ----------
panel_60 = Panel(smaller.SmallerThan)
panel_61 = Panel(smaller.OrEqualTo)
panel_62 = Panel(gh_smaller.smallerThan)
panel_63 = Panel(gh_smaller.equal)
