# Grasshopper definition Maths_Polynomials.ghx (Grasshopper 1.0.7)

# ----
# GH#: A C# dictionary of Grasshopper3D components.
# 
# This file contains a category of Grasshopper components, and a mirroring C#/RhinoCommon implementation.
# 
# This is an educational project initiated by students/faculty of GSD-6338: Introduction to Computational Design, at the Harvard Graduate School of Design.
# 
# More information: {{project link}}
# Maths Polynomials
number_slider = Slider(10, range=0..10)
cube = Cube(Value=number_slider)
gh_cube = CSharpScript(x=number_slider)  # -> out, y; inputs x: Double
# ---------- gh_cube: C# ----------
    // Component written by @erinlinseyhunt

    // Cubic power
    y = Math.Pow(x, 3);
# ---------- end gh_cube ----------
panel = Panel(cube)
panel_2 = Panel(gh_cube.y)

number_slider_2 = Slider(4, range=0..10)
_2º = PowerOf2(Value=number_slider_2)
gh_2º = CSharpScript(x=number_slider_2)  # -> out, y; inputs x: Double
# ---------- gh_2º: C# ----------
    // Component written by @erinlinseyhunt

    // Power of 2
    y = Math.Pow(2, x);
# ---------- end gh_2º ----------
panel_3 = Panel(_2º)
panel_4 = Panel(gh_2º.y)

number_slider_3 = Slider(10, range=0..10)
gh_eº = CSharpScript(x=number_slider_3)  # -> out, y; inputs x: Double
# ---------- gh_eº: C# ----------
    // Component written by @erinlinseyhunt

    // Power of E
    y = Math.Exp(x);
# ---------- end gh_eº ----------
eº = PowerOfE(Value=number_slider_3)
panel_5 = Panel(eº)
panel_6 = Panel(gh_eº.y)

number_slider_4 = Slider(5, range=0..10)
number_slider_5 = Slider(8, range=0..10)
gh_logn = CSharpScript(V=number_slider_5, B=number_slider_4)  # -> out, R; inputs V: Double, B: Double
# ---------- gh_logn: C# ----------
    // Component written by @erinlinseyhunt

    // Log N
    R = Math.Log(V, B);
# ---------- end gh_logn ----------
logn = LogN(Number=number_slider_5, Base=number_slider_4)
panel_7 = Panel(logn)
panel_8 = Panel(gh_logn.R)

number_slider_6 = Slider(6, range=0..10)
cbrt = CubeRoot(Value=number_slider_6)
gh_cbrt = CSharpScript(x=number_slider_6)  # -> out, y; inputs x: Double
# ---------- gh_cbrt: C# ----------
    // Component written by @erinlinseyhunt

    // Cubic Root
    y = Math.Pow(x, 1.0 / 3.0);
# ---------- end gh_cbrt ----------
panel_9 = Panel(cbrt)
panel_10 = Panel(gh_cbrt.y)

number_slider_7 = Slider(5, range=0..10)
sqr = Square(Value=number_slider_7)
gh_sqr = CSharpScript(x=number_slider_7)  # -> out, y; inputs x: Double
# ---------- gh_sqr: C# ----------
    // Component written by @erinlinseyhunt, @garciadelcastillo

    // Squared
    y = x * x;
# ---------- end gh_sqr ----------
panel_11 = Panel(sqr)
panel_12 = Panel(gh_sqr.y)

number_slider_8 = Slider(6, range=0..10)
sqrt = SquareRoot(Value=number_slider_8)
gh_sqrt = CSharpScript(x=number_slider_8)  # -> out, y; inputs x: Double
# ---------- gh_sqrt: C# ----------
    // Component written by @erinlinseyhunt

    // Square Root
    y = Math.Sqrt(x);
# ---------- end gh_sqrt ----------
panel_13 = Panel(sqrt)
panel_14 = Panel(gh_sqrt.y)

number_slider_9 = Slider(3, range=0..10)
one_over_x = OneOverX(Value=number_slider_9)
gh_1_x = CSharpScript(x=number_slider_9)  # -> out, y; inputs x: Double
# ---------- gh_1_x: C# ----------
    // Component written by @erinlinseyhunt

    // One over x
    y = 1 / x;
# ---------- end gh_1_x ----------
panel_15 = Panel(one_over_x)
panel_16 = Panel(gh_1_x.y)

number_slider_10 = Slider(10, range=0..10)
_10º = PowerOf10(Value=number_slider_10)
gh_10º = CSharpScript(x=number_slider_10)  # -> out, y; inputs x: Double
# ---------- gh_10º: C# ----------
    // Component written by @erinlinseyhunt

    // Power of 10
    y = Math.Pow(10, x);
# ---------- end gh_10º ----------
panel_17 = Panel(_10º)
panel_18 = Panel(gh_10º.y)

number_slider_11 = Slider(6, range=0..10)
gh_log = CSharpScript(x=number_slider_11)  # -> out, y; inputs x: Double
# ---------- gh_log: C# ----------
    // Component written by @erinlinseyhunt

    // Logarithm
    y = Math.Log10(x);
# ---------- end gh_log ----------
log = Logarithm(Value=number_slider_11)
panel_19 = Panel(log)
panel_20 = Panel(gh_log.y)

number_slider_12 = Slider(5, range=0..10)
gh_ln = CSharpScript(x=number_slider_12)  # -> out, y; inputs x: Double
# ---------- gh_ln: C# ----------
    // Component written by @erinlinseyhunt

    // Natural Logarithm
    y = Math.Log(x);
# ---------- end gh_ln ----------
ln = NaturalLogarithm(Value=number_slider_12)
panel_21 = Panel(ln)
panel_22 = Panel(gh_ln.y)
