# Grasshopper definition Maths_Trig.ghx (Grasshopper 1.0.7)

# ---- group: Right Trigonometry
alpha = Slider(47.18, range=0..360)
beta = Slider(73.85, range=0..360)
P = Slider(62.53, range=0..100)
Q = Slider(65.67, range=0..100)
R = Slider(70.36, range=0..100)
rad = Radians(Degrees=alpha)
rad_2 = Radians(Degrees=beta)
rtrig = RightTrigonometry(PLength=P, QLength=Q)  # -> Alpha, Beta, PLength, QLength, RLength
gh_rtrig = CSharpScript(P=P, Q=Q)  # -> out, alphaOut, betaOut, POut, QOut, ROut; inputs alpha: Double, beta: Double, P: Double, Q: Double, R: Double
# ---------- gh_rtrig: C# ----------
    // Component written by @garciadelcastillo

    // This component calculates the trigonometry of the square triangle,
    // given any valid combination of inputs.
    // WARNING: behavior is not identical to vanilla component,
    // as the original would yield invalid combinations of values
    // when input data is overconstrained.

    // Define terms to compute
    double computedA = 0,
      computedB = 0,
      computedC = 0,
      computedAlpha = 0,
      computedBeta = 0;
    string computedMessage = "";

    // We will rely on a custom function to take care of figuring out
    // amount of inputs, their valid combinations and sanity checks:
    bool success = ComputeSquareTriangleFromAnglesAndSides(alpha, beta, Q, P, R,
      out computedA, out computedB, out computedC,
      out computedAlpha, out computedBeta, out computedMessage);
    if (!success)
    {
      this.Component.AddRuntimeMessage(GH_RuntimeMessageLevel.Warning, computedMessage);
    }

    // Outputs
    alphaOut = computedAlpha;
    betaOut = computedBeta;
    POut = computedB;
    QOut = computedA;
    ROut = computedC;
# ---------- gh_rtrig: C# additional code ----------
  /// <summary>
  /// Computes the sides of a square triangle and their angles,
  /// given a variable amount of input angle and sides data.
  /// Includes sanity checks and an output message parameter
  /// informing of what was going on.
  /// Returns false if calculations went wrong.
  /// </summary>
  /// <param name="alpha"></param>
  /// <param name="beta"></param>
  /// <param name="a"></param>
  /// <param name="b"></param>
  /// <param name="c"></param>
  /// <param name="sideA"></param>
  /// <param name="sideB"></param>
  /// <param name="sideC"></param>
  /// <param name="alphaOut"></param>
  /// <param name="betaOut"></param>
  /// <param name="message"></param>
  /// <returns></returns>
  bool ComputeSquareTriangleFromAnglesAndSides(double alpha, double beta,
    double a, double b, double c,
    out double sideA, out double sideB, out double sideC,
    out double alphaOut, out double betaOut, out string message)
  {
    double HALF_PI = 0.5 * Math.PI;
    string msg = "";

    // Compute how many angles and sides are available as inputs
    int availableAngles = 0;
    int availableSides = 0;
    if (!Equals(alpha, 0)) availableAngles++;
    if (!Equals(beta, 0)) availableAngles++;
    if (!Equals(a, 0)) availableSides++;
    if (!Equals(b, 0)) availableSides++;
    if (!Equals(c, 0)) availableSides++;

    // If only one input angle is available, compute the other and count up
    if (availableAngles == 1)
    {
      // Override input arguments
      if (Equals(alpha, 0))
      {
        alpha = HALF_PI - beta;
      }
      else
      {
        beta = HALF_PI - alpha;
      }
      availableAngles = 2;
    }

    // Are angles right?
    if (alpha < 0 || beta < 0 || alpha > HALF_PI || beta > HALF_PI)
    {
      msg = "Angles sum up to more than Pi, which precludes a valid triangle";
    }

      // If both input angles are zero
    else if (availableAngles == 0)
    {
      // If all sides are available, return ComputeSquareTriangleFromSides
      if (availableSides > 1)
      {
        return ComputeSquareTriangleFromSides(a, b, c, out sideA, out sideB, out sideC, out alphaOut, out betaOut, out message);
      }
      else
      {
        msg = "Not enough data to compute triangle";
      }
    }

      // If both input angles are available
    else if (availableAngles == 2)
    {
      // If they add up to Pi
      if (Equals(alpha + beta - 0.5 * Math.PI, 0))
      {
        // If more or less than one input side
        if (availableSides < 1)
        {
          msg = "Triangulation is underconstrained, please reduce number of inputs.";
        }
        else if (availableSides > 1)
        {
          msg = "Triangulation is overconstrained, please reduce number of inputs.";
        }
        else {
          alphaOut = alpha;
          betaOut = beta;

          // Is hypotenuse available?
          if (!Equals(c, 0))
          {
            sideC = c;
            sideA = sideC * Math.Sin(alpha);
            sideB = sideC * Math.Sin(beta);
            message = "Computed sides A & B";
          }
            // Are the cathethi (legs) available?
          else if (!Equals(a, 0))
          {
            sideA = a;
            sideC = sideA / Math.Sin(alpha);
            sideB = sideC * Math.Sin(beta);
            message = "Computed sides B & C";
          }
          else
          {
            sideB = b;
            sideC = sideB / Math.Sin(beta);
            sideA = sideC * Math.Sin(alpha);
            message = "Computed sides A & C";
          }

          return true;
        }
      }
      else
      {
        msg = "Alpha, Beta and Gamma angles do not sum up to Pi, which precludes a valid triangle";
      }
    }

    // If here, something went wrong,
    // so zero everything and return false.
    sideA = 0;
    sideB = 0;
    sideC = 0;
    alphaOut = 0;
    betaOut = 0;
    message = msg;
    return false;
  }

  /// <summary>
  /// Computes the sides of a square triangle and their angles,
  /// given a variable amount of input sides data.
  /// Includes sanity checks and an output message parameter
  /// informing of what was going on.
  /// Returns false if calculations went wrong.
  /// </summary>
  /// <param name="a"></param>
  /// <param name="b"></param>
  /// <param name="c"></param>
  /// <param name="sideA"></param>
  /// <param name="sideB"></param>
  /// <param name="sideC"></param>
  /// <param name="alpha"></param>
  /// <param name="beta"></param>
  /// <param name="message"></param>
  /// <returns></returns>
  bool ComputeSquareTriangleFromSides(double a, double b, double c,
    out double sideA, out double sideB, out double sideC,
    out double alpha, out double beta, out string message)
  {
    string msg = "";

    // Sanity: check if there are at least two sides available as arguments
    if ((Equals(a, 0) && (Equals(b, 0) || Equals(c, 0)))
      || (Equals(b, 0) && Equals(c, 0)))
    {
      // Do nothing, silently fail at the end of function
      msg = "Not enough input data to compute triangle sides";
    }

      // Sanity: check if all sides are given
    else if (!Equals(a, 0) && !Equals(b, 0) && !Equals(c, 0))
    {
      msg = "Too much data to compute triangle sides, problem is overconstrained";
    }

      // Are the catheti (legs) available?
    else if (!Equals(a, 0) && !Equals(b, 0))
    {
      // Apply straight Pythagorean theorem
      sideA = a;
      sideB = b;
      sideC = Math.Sqrt(a * a + b * b);
      alpha = Math.Asin(sideA / sideC);
      beta = Math.Asin(sideB / sideC);
      message = "Computed side C";
      return true;
    }

      // Is a cathetus (leg) and hypotenuse available?
    else if (!Equals(a, 0) && !Equals(c, 0))
    {
      if (a > c)
      {
        msg = "Invalid right triangle: cathetus is larger than hypotenuse";
      }
      else
      {
        sideA = a;
        sideC = c;
        sideB = Math.Sqrt(c * c - a * a);
        alpha = Math.Asin(sideA / sideC);
        beta = Math.Asin(sideB / sideC);
        message = "Computed side B";
        return true;
      }
    }
    else if (!Equals(b, 0) && !Equals(c, 0))
    {
      if (b > c)
      {
        msg = "Invalid right triangle: cathetus is larger than hypotenuse";
      }
      else
      {
        sideB = b;
        sideC = c;
        sideA = Math.Sqrt(c * c - b * b);
        alpha = Math.Asin(sideA / sideC);
        beta = Math.Asin(sideB / sideC);
        message = "Computed side A";
        return true;
      }
    }

    // If here, something went wrong,
    // so zero everything and return false.
    sideA = 0;
    sideB = 0;
    sideC = 0;
    alpha = 0;
    beta = 0;
    message = msg;
    return false;
  }



  /// <summary>
  /// Calculate if two values approximately equal each other.
  /// Doubles cannot be compared with == due to precision problems.
  /// It is better to use some small tolerance value to compare them.
  /// </summary>
  /// <param name="a"></param>
  /// <param name="b"></param>
  /// <returns></returns>
  bool Equals(double a, double b)
  {
    return Math.Abs(a - b) < RhinoMath.ZeroTolerance;
  }
# ---------- end gh_rtrig ----------
panel = Panel([rtrig.Alpha, rtrig.Beta, rtrig.PLength, rtrig.QLength, rtrig.RLength])
panel_2 = Panel([gh_rtrig.alphaOut, gh_rtrig.betaOut, gh_rtrig.POut, gh_rtrig.QOut, gh_rtrig.ROut])

# ---- group: Centroid
pt = Point(Point(3.575077238, 11.91778967, 0))
pt_2 = Point(Point(7.511515682, 22.57259671, 0))
pt_3 = Point(Point(14.51166702, 18.48562451, -1.769557008))
gh_centroid = CSharpScript(A=pt, B=pt_2, C=pt_3)  # -> out, COut, AB, BC, CA; inputs A: Point3d, B: Point3d, C: Point3d
# ---------- gh_centroid: C# ----------
    // Component written by @garciadelcastillo

    // Returns the centroid point of this triangle,
    // and the median lines whose intersection generates it.
    // This could be computed with regular Rhino intersections.
    // However, let's do it with simple vector algebra,
    // to learn the arithmetic meaning! :)

    // The centroid is actually the average of the three points!
    double x = (A.X + B.X + C.X) / 3;
    double y = (A.Y + B.Y + C.Y) / 3;
    double z = (A.Z + B.Z + C.Z) / 3;
    Point3d centroid = new Point3d(x, y, z);
    //    Point3d centroid = (A + B + C) / 3;  // this shorthand also works in Rhino

    // The median lines are simply the lines connecting each vertex,
    // with the center point of the opposite side of the triangle.
    double abx = A.X + 0.5 * (B.X - A.X);
    double aby = A.Y + 0.5 * (B.Y - A.Y);
    double abz = A.Z + 0.5 * (B.Z - A.Z);
    Point3d ABMid = new Point3d(abx, aby, abz);

    Point3d ACMid = A + 0.5 * (C - A);  // let's use shorthands for the rest! :)
    Point3d BCMid = B + 0.5 * (C - B);

    // Generate the median lines
    Line ABMedian = new Line(ABMid, C);
    Line ACMedian = new Line(ACMid, B);
    Line BCMedian = new Line(BCMid, A);

    // Outputs
    COut = centroid;
    AB = ABMedian;
    BC = BCMedian;
    CA = ACMedian;
# ---------- end gh_centroid ----------
centroid = Centroid(PointA=pt, PointB=pt_2, PointC=pt_3)  # -> Centroid, MedianAB, MedianBC, MedianCA
panel_3 = Panel([centroid.Centroid, centroid.MedianAB, centroid.MedianBC, centroid.MedianCA])
panel_4 = Panel([gh_centroid.COut, gh_centroid.AB, gh_centroid.BC, gh_centroid.CA])

# ---- group: Incentre
pt_4 = Point(Point(3.575077238, 11.91778967, 0))
pt_5 = Point(Point(7.511515682, 22.57259671, 0))
pt_6 = Point(Point(14.51166702, 18.48562451, -1.769557008))
gh_icentre = CSharpScript(A=pt_4, B=pt_5, C=pt_6)  # -> out, I, AOut, BOut, COut; inputs A: Point3d, B: Point3d, C: Point3d
# ---------- gh_icentre: C# usings ----------
using Rhino.Geometry.Intersect;
# ---------- gh_icentre: C# ----------
    // Component written by @garciadelcastillo

    // Returns the incenter of this triangle, this is,
    // the center of the circle that is inscribed in the triangle.
    // Geometrically, this point can be found by intersecting
    // the angle bisectors of the triangle.

    this.Component.AddRuntimeMessage(GH_RuntimeMessageLevel.Remark, "Bisector lines on this component only extend to the incenter");

    // Let's create angle bisecctor lines by computing the addition
    // of the vectors along the sides.
    Vector3d ab = B - A;
    ab.Unitize();
    Vector3d ac = C - A;
    ac.Unitize();
    Vector3d ao = ab + ac;
    Line AO = new Line(A, ao);

    Vector3d ba = A - B;
    ba.Unitize();
    Vector3d bc = C - B;
    bc.Unitize();
    Vector3d bo = ba + bc;
    Line BO = new Line(B, bo);

    // Calculate the intersection between them
    double tAO, tBO;
    Intersection.LineLine(AO, BO, out tAO, out tBO);
    Point3d incenter = AO.PointAt(tAO);

    // Generate perpendicular lines for visualization
    Line AIN = new Line(A, incenter);
    Line BIN = new Line(B, incenter);
    Line CIN = new Line(C, incenter);

    //Outputs
    I = incenter;
    AOut = AIN;
    BOut = BIN;
    COut = CIN;
# ---------- end gh_icentre ----------
icentre = Incentre(PointA=pt_4, PointB=pt_5, PointC=pt_6)  # -> Incentre, BisectorA, BisectorB, BisectorC
panel_5 = Panel([icentre.Incentre, icentre.BisectorA, icentre.BisectorB, icentre.BisectorC])
panel_6 = Panel([gh_icentre.I, gh_icentre.AOut, gh_icentre.BOut, gh_icentre.COut])

# ----
x = Slider(5, range=0..10)
gh_sin = CSharpScript(x=x)  # -> out, y; inputs x: Double
# ---------- gh_sin: C# ----------
    // Component written by @erinlinseyhunt

    // Sin
    y = Math.Sin(x);
# ---------- end gh_sin ----------
sin = Sine(Value=x)
panel_7 = Panel(gh_sin.y)
panel_8 = Panel(sin)

# ----
# GH#: A C# dictionary of Grasshopper3D components.
# 
# This file contains a category of Grasshopper components, and a mirroring C#/RhinoCommon implementation.
# 
# This is an educational project initiated by students/faculty of GSD-6338: Introduction to Computational Design, at the Harvard Graduate School of Design.
# 
# More information: {{project link}}
# Maths Trig
x_2 = Slider(4, range=0..10)
gh_cos = CSharpScript(x=x_2)  # -> out, y; inputs x: Double
# ---------- gh_cos: C# ----------
    // Component written by @erinlinseyhunt

    // Cos
    y = Math.Cos(x);
# ---------- end gh_cos ----------
cos = Cosine(Value=x_2)
panel_9 = Panel(cos)
panel_10 = Panel(gh_cos.y)

x_3 = Slider(1, range=-1..1)
gh_acos = CSharpScript(x=x_3)  # -> out, y; inputs x: Double
# ---------- gh_acos: C# ----------
    // Component written by @erinlinseyhunt

    // Arccosine
    y = Math.Acos(x);
# ---------- end gh_acos ----------
acos = ArcCosine(Value=x_3)
panel_11 = Panel(acos)
panel_12 = Panel(gh_acos.y)

x_4 = Slider(5, range=0..10)
gh_atan = CSharpScript(x=x_4)  # -> out, y; inputs x: Double
# ---------- gh_atan: C# ----------
    // Component written by @erinlinseyhunt

    // Atan
    y = Math.Atan(x);
# ---------- end gh_atan ----------
atan = ArcTangent(Value=x_4)
panel_13 = Panel(atan)
panel_14 = Panel(gh_atan.y)

x_5 = Slider(5, range=0..10)
gh_cot = CSharpScript(x=x_5)  # -> out, y; inputs x: Double
# ---------- gh_cot: C# ----------
    // Component written by @erinlinseyhunt

    // Cotangent
    y = 1 / Math.Tan(x);
# ---------- end gh_cot ----------
cot = CoTangent(Value=x_5)
panel_15 = Panel(cot)
panel_16 = Panel(gh_cot.y)

number_slider = Slider(8, range=0..10)
gh_deg = CSharpScript(R=number_slider)  # -> out, D; inputs R: Double
# ---------- gh_deg: C# ----------
    // Component written by @erinlinseyhunt

    // Angle input in Degrees
    double radians = R;

    // Converts the angle from Degrees to Radians
    double degree = (180 / Math.PI) * radians;

    // Output
    D = degree;
# ---------- end gh_deg ----------
deg = Degrees(Radians=number_slider)
panel_17 = Panel(deg)
panel_18 = Panel(gh_deg.D)

# ---- group: Triangle Trigonometry
alpha_2 = Slider(47.18, range=0..360)
beta_2 = Slider(62.42, range=0..360)
gamma = Slider(73.85, range=0..360)
A = Slider(62.53, range=0..100)
B = Slider(65.67, range=0..100)
C = Slider(70.36, range=0..100)
rad_3 = Radians(Degrees=alpha_2)
rad_4 = Radians(Degrees=beta_2)
rad_5 = Radians(Degrees=gamma)
trig = TriangleTrigonometry(Alpha=rad_3, Gamma=rad_4, CLength=C)  # -> Alpha, Beta, Gamma, ALength, BLength, CLength
gh_trig = CSharpScript(alpha=rad_3, gamma=rad_5, C=C)  # -> out, alphaOut, betaOut, gammaOut, AOut, BOut, COut; inputs alpha: Double, beta: Double, gamma: Double, A: Double, B: Double, C: Double
# ---------- gh_trig: C# ----------
    // Component written by @garciadelcastillo

    // This component calculates the trigonometry of the square triangle,
    // given any valid combination of inputs.
    // WARNING: behavior is not identical to vanilla component,
    // as the original would yield invalid combinations of values
    // when input data is overconstrained.

    // Define terms to compute
    double computedA = 0,
      computedB = 0,
      computedC = 0,
      computedAlpha = 0,
      computedBeta = 0,
      computedGamma = 0;
    string computedMessage = "";

    // We will rely on a custom function to take care of figuring out
    // amount of inputs, their valid combinations and sanity checks:
    bool success = ComputeTriangleFromAnglesAndSides(alpha, beta, gamma, A, B, C,
      out computedA, out computedB, out computedC,
      out computedAlpha, out computedBeta, out computedGamma, out computedMessage);
    if (!success)
    {
      this.Component.AddRuntimeMessage(GH_RuntimeMessageLevel.Warning, computedMessage);
    }

    // Outputs
    alphaOut = computedAlpha;
    betaOut = computedBeta;
    gammaOut = computedGamma;
    AOut = computedA;
    BOut = computedB;
    COut = computedC;
# ---------- gh_trig: C# additional code ----------
  /// <summary>
  /// Computes the sides of a triangle and their angles,
  /// given a variable amount of input angle and sides data.
  /// Includes sanity checks and an output message parameter
  /// informing of what was going on.
  /// Returns false if calculations went wrong.
  /// </summary>
  /// <param name="alpha"></param>
  /// <param name="beta"></param>
  /// <param name="a"></param>
  /// <param name="b"></param>
  /// <param name="c"></param>
  /// <param name="sideA"></param>
  /// <param name="sideB"></param>
  /// <param name="sideC"></param>
  /// <param name="alphaOut"></param>
  /// <param name="betaOut"></param>
  /// <param name="message"></param>
  /// <returns></returns>
  bool ComputeTriangleFromAnglesAndSides(double alpha, double beta, double gamma,
    double a, double b, double c,
    out double sideA, out double sideB, out double sideC,
    out double alphaOut, out double betaOut, out double gammaOut, 
    out string message)
  {
    double PI = Math.PI;
    string msg = "";

    // Compute how many angles and sides are available as inputs
    int availableAngles = 0;
    int availableSides = 0;
    if (!Equals(alpha, 0)) availableAngles++;
    if (!Equals(beta, 0)) availableAngles++;
    if (!Equals(gamma, 0)) availableAngles++;
    if (!Equals(a, 0)) availableSides++;
    if (!Equals(b, 0)) availableSides++;
    if (!Equals(c, 0)) availableSides++;

    // If two angles are available, compute the other and count up
    if (availableAngles == 2)
    {
      // Override input arguments
      if (Equals(alpha, 0))
      {
        alpha = PI - beta - gamma;
      }
      else if (Equals(beta, 0))
      {
        beta = PI - alpha - gamma;
      }
      else 
      {
        gamma = PI - alpha - beta;
      }
      availableAngles = 3;
    }

    // Are angles right?
    if (alpha < 0 || beta < 0 || gamma < 0 || alpha > PI || beta > PI || gamma > PI)
    {
      msg = "Angles sum up to more than Pi, which precludes a valid triangle";
    }
     
    // Choose case depending on number of sides & angles
    else if (availableSides == 0)
    {
      msg = "Need at least one side to compute the triangle";
    }
      
    else if ((availableAngles == 0 && availableSides < 3) || 
      (availableAngles == 1 && availableSides < 2) || 
      (availableAngles == 2 && availableSides < 1))
    {
      msg = "Not enough information to compute angle";
    }
      
      // If one side and two angles, use Law of Sines
    else if (availableSides == 1 && availableAngles > 1)
    {
      alphaOut = alpha;
      betaOut = beta;
      gammaOut = gamma;
      LawOfSinesFromAngles(alpha, beta, gamma, a, b, c, out sideA, out sideB, out sideC);
      message = "Computed from law of sines";
      return true;
    }
    
      // If two sides and one angle
    else if (availableSides == 2 && availableAngles == 1)
    {
      // Check if we got a side and its opposite angle
      if ((!Equals(a, 0) && !Equals(alpha, 0)) ||
        (!Equals(b, 0) && !Equals(beta, 0)) ||
        (!Equals(c, 0) && !Equals(gamma, 0)))
      {
        LawOfSinesFromSides(alpha, beta, gamma, a, b, c,
          out sideA, out sideB, out sideC, out alphaOut, out betaOut, out gammaOut);
        message = "Computed from law of sines";
        return true;
      }
      else {
        if (!Equals(alpha, 0))
        {
          alphaOut = alpha;
          sideB = b;
          sideC = c;
          LawOfCosinesAngleTwoSides(alpha, b, c, out sideA, out betaOut, out gammaOut);
        }
        else if (!Equals(beta, 0))
        {
          betaOut = beta;
          sideA = a;
          sideC = c;
          LawOfCosinesAngleTwoSides(beta, a, c, out sideB, out alphaOut, out gammaOut);
        }
        else
        {
          gammaOut = gamma;
          sideA = a;
          sideB = b;
          LawOfCosinesAngleTwoSides(gamma, a, b, out sideC, out alphaOut, out betaOut);
        }
        message = "Computed from law of cosines";
        return true;
      }
    }
    
      // If three sides
    else if (availableSides == 3)
    {
      sideA = a;
      sideB = b;
      sideC = c;
      LawOfCosinesThreeSides(sideA, sideB, sideC, out alphaOut, out betaOut, out gammaOut);
      message = "Computed from law of cosines";
      return true;
    }
      

    // If here, something went wrong,
    // so zero everything and return false.
    sideA = 0;
    sideB = 0;
    sideC = 0;
    alphaOut = 0;
    betaOut = 0;
    gammaOut = 0;
    message = msg;
    return false;
  }

  
  /// <summary>
  /// Calculates the sides of any triangle given its three angles, 
  /// and at least one valid side. 
  /// Assumes input angles are valid (no sanity checks).
  /// </summary>
  /// <param name="alpha"></param>
  /// <param name="beta"></param>
  /// <param name="gamma"></param>
  /// <param name="a"></param>
  /// <param name="b"></param>
  /// <param name="c"></param>
  /// <param name="sideA"></param>
  /// <param name="sideB"></param>
  /// <param name="sideC"></param>
  /// <returns></returns>
  void LawOfSinesFromAngles(double alpha, double beta, double gamma, 
    double a, double b, double c, 
    out double sideA, out double sideB, out double sideC)
  {
    // https://math.libretexts.org/Bookshelves/Precalculus/Book%3A_Elementary_Trigonometry_(Corral)/02%3A_General_Triangles/2.01%3A_The_Law_of_Sines
    // Compute if input has side A
    if (!Equals(a, 0))
    {
      sideA = a;
      sideB = sideA * Math.Sin(beta) / Math.Sin(alpha);
      sideC = sideA * Math.Sin(gamma) / Math.Sin(alpha);
    }
    // If side B is available
    else if (!Equals(b, 0))
    {
      sideB = b;
      sideA = sideB * Math.Sin(alpha) / Math.Sin(beta);
      sideC = sideB * Math.Sin(gamma) / Math.Sin(beta);
    }
    else 
    {
      sideC = c;
      sideA = sideC * Math.Sin(alpha) / Math.Sin(gamma);
      sideB = sideC * Math.Sin(beta) / Math.Sin(gamma);
    }
  }
  
  
  /// <summary>
  /// Calculates the sides and angles of any triangle, 
  /// given two angles and one side, including a pair of
  /// opposite angle-side. 
  /// Assumes all inputs are valid and sufficient (no sanity checks).
  /// </summary>
  /// <param name="alpha"></param>
  /// <param name="beta"></param>
  /// <param name="gamma"></param>
  /// <param name="a"></param>
  /// <param name="b"></param>
  /// <param name="c"></param>
  /// <param name="sideA"></param>
  /// <param name="sideB"></param>
  /// <param name="sideC"></param>
  /// <param name="alphaOut"></param>
  /// <param name="betaOut"></param>
  /// <param name="gammaOut"></param>
  /// <returns></returns>
  void LawOfSinesFromSides(double alpha, double beta, double gamma, 
    double a, double b, double c, 
    out double sideA, out double sideB, out double sideC,
    out double alphaOut, out double betaOut, out double gammaOut)
  {
    // https://math.libretexts.org/Bookshelves/Precalculus/Book%3A_Elementary_Trigonometry_(Corral)/02%3A_General_Triangles/2.01%3A_The_Law_of_Sines
    // This doesn't account for the problem having multiple solutions though...
    if (!Equals(a, 0) && !Equals(alpha, 0))
    {
      sideA = a;
      alphaOut = alpha;
      if (!Equals(b, 0))
      {
        sideB = b;
        betaOut = Math.Asin(sideB * Math.Sin(alphaOut) / sideA);
        gammaOut = Math.PI - alphaOut - betaOut;
        sideC = sideA * Math.Sin(gammaOut) / Math.Sin(alphaOut);
      }
      else 
      {
        sideC = c;
        gammaOut = Math.Asin(sideC * Math.Sin(alphaOut) / sideA);
        betaOut = Math.PI - alphaOut - gammaOut;
        sideB = sideA * Math.Sin(betaOut) / Math.Sin(alphaOut);
      }
    }
    
    else if (!Equals(b, 0) && !Equals(beta, 0))
    {
      sideB = b;
      betaOut = beta;
      if (!Equals(a, 0))
      {
        sideA = a;
        alphaOut = Math.Asin(sideA * Math.Sin(betaOut) / sideB);
        gammaOut = Math.PI - betaOut - alphaOut;
        sideC = sideB * Math.Sin(gammaOut) / Math.Sin(betaOut);
      }
      else 
      {
        sideC = c;
        gammaOut = Math.Asin(sideC * Math.Sin(betaOut) / sideB);
        alphaOut = Math.PI - betaOut - gammaOut;
        sideA = sideB * Math.Sin(alphaOut) / Math.Sin(betaOut);
      }
    }
    
    else
    {
      sideC = c;
      gammaOut = gamma;
      if (!Equals(a, 0))
      {
        sideA = a;
        alphaOut = Math.Asin(sideA * Math.Sin(gammaOut) / sideC);
        betaOut = Math.PI - gammaOut - alphaOut;
        sideB = sideC * Math.Sin(betaOut) / Math.Sin(gammaOut);
      }
      else 
      {
        sideB = b;
        betaOut = Math.Asin(sideB * Math.Sin(gammaOut) / sideC);
        alphaOut = Math.PI - gammaOut - betaOut;
        sideA = sideC * Math.Sin(alphaOut) / Math.Sin(gammaOut);
      }
    }
  }
  
  
  /// <summary>
  /// Given an angle, and the lengths of the non-opposite sides
  /// of that angle in a triangle, returns the length of the opposite side. 
  /// </summary>
  /// <param name="angleA"></param>
  /// <param name="sideB"></param>
  /// <param name="sideC"></param>
  /// <param name="sideA"></param>
  /// <param name="angleB"></param>
  /// <param name="angleC"></param>
  /// <returns></returns>
  void LawOfCosinesAngleTwoSides(double angleA, double sideB, double sideC, 
    out double sideA, out double angleB, out double angleC)
  {
    sideA = Math.Sqrt(sideB * sideB + sideC * sideC - 2 * sideB * sideC * Math.Cos(angleA));
    angleB = Math.Acos((sideC * sideC + sideA * sideA - sideB * sideB) / (2 * sideC * sideA));
    angleC = Math.PI - angleA - angleB;
  }
  
  /// <summary>
  /// Given the three sides of a triangle, returns
  /// the angles at the opposite corners. 
  /// </summary>
  /// <param name="sideA"></param>
  /// <param name="sideB"></param>
  /// <param name="sideC"></param>
  /// <param name="angleA"></param>
  /// <param name="angleB"></param>
  /// <param name="angleC"></param>
  /// <returns></returns>
  void LawOfCosinesThreeSides(double sideA, double sideB, double sideC, 
    out double angleA, out double angleB, out double angleC) {
    // TODO: check that no side is longer than the other two added
    angleB = Math.Acos((sideC * sideC + sideA * sideA - sideB * sideB) / (2 * sideC * sideA));
    angleC = Math.Acos((sideA * sideA + sideB * sideB - sideC * sideC) / (2 * sideA * sideB));
    angleA = Math.PI - angleB - angleC;
  }
  
  
  
  

  /// <summary>
  /// Calculate if two values approximately equal each other.
  /// Doubles cannot be compared with == due to precision problems.
  /// It is better to use some small tolerance value to compare them.
  /// </summary>
  /// <param name="a"></param>
  /// <param name="b"></param>
  /// <returns></returns>
  bool Equals(double a, double b)
  {
    return Math.Abs(a - b) < RhinoMath.ZeroTolerance;
  }
# ---------- end gh_trig ----------
panel_19 = Panel([trig.Alpha, trig.Beta, trig.Gamma, trig.ALength, trig.BLength, trig.CLength])
panel_20 = Panel([gh_trig.alphaOut, gh_trig.betaOut, gh_trig.gammaOut, gh_trig.AOut, gh_trig.BOut, gh_trig.COut])

# ----
x_6 = Slider(2, range=0..10)
sinc = Sinc(Value=x_6)
gh_sinc = CSharpScript(x=x_6)  # -> out, y; inputs x: Double
# ---------- gh_sinc: C# ----------
    // Component written by @erinlinseyhunt

    // Sinc
    y = Math.Sin(x) / x;
# ---------- end gh_sinc ----------
panel_21 = Panel(sinc)
panel_22 = Panel(gh_sinc.y)

x_7 = Slider(5, range=0..10)
tan = Tangent(Value=x_7)
gh_tan = CSharpScript(x=x_7)  # -> out, y; inputs x: Double
# ---------- gh_tan: C# ----------
    // Component written by @erinlinseyhunt

    // Tan
    y = Math.Tan(x);
# ---------- end gh_tan ----------
panel_23 = Panel(tan)
panel_24 = Panel(gh_tan.y)

x_8 = Slider(4, range=0..10)
sec = Secant(Value=x_8)
gh_sec = CSharpScript(x=x_8)  # -> out, y; inputs x: Double
# ---------- gh_sec: C# ----------
    // Component written by @erinlinseyhunt

    // Secant
    y = 1 / Math.Cos(x);
# ---------- end gh_sec ----------
panel_25 = Panel(sec)
panel_26 = Panel(gh_sec.y)

number_slider_2 = Slider(1, range=0..10)
rad_6 = Radians(Degrees=number_slider_2)
gh_rad = CSharpScript(D=number_slider_2)  # -> out, R; inputs D: Double
# ---------- gh_rad: C# ----------
    // Component written by @erinlinseyhunt

    // Angle input in Degrees
    double degree = D;

    // Converting the angle from Degrees to Radians
    double radians = Math.PI * (degree / 180.00);

    // Output
    R = radians;
# ---------- end gh_rad ----------
panel_27 = Panel(rad_6)
panel_28 = Panel(gh_rad.R)

x_9 = Slider(1, range=0..10)
asin = ArcSine(Value=x_9)
gh_asin = CSharpScript(x=x_9)  # -> out, y; inputs x: Double
# ---------- gh_asin: C# ----------
    // Component written by @erinlinseyhunt

    // Arcsine
    y = Math.Asin(x);
# ---------- end gh_asin ----------
panel_29 = Panel(gh_asin.y)
panel_30 = Panel(asin)

x_10 = Slider(6, range=0..10)
csc = CoSecant(Value=x_10)
gh_csc = CSharpScript(x=x_10)  # -> out, y; inputs x: Double
# ---------- gh_csc: C# ----------
    // Component written by @erinlinseyhunt

    // Cosecant
    y = 1 / Math.Sin(x);
# ---------- end gh_csc ----------
panel_31 = Panel(gh_csc.y)
panel_32 = Panel(csc)

# ---- group: Circumcentre
pt_7 = Point(Point(3.575077238, 11.91778967, 0))
pt_8 = Point(Point(7.511515682, 22.57259671, 0))
pt_9 = Point(Point(14.51166702, 18.48562451, -1.769557008))
ccentre = Circumcentre(PointA=pt_7, PointB=pt_8, PointC=pt_9)  # -> Circumcentre, BisectorAB, BisectorBC, BisectorCA
gh_ccentre = CSharpScript(A=pt_7, B=pt_8, C=pt_9)  # -> out, COut, AB, BC, CA; inputs A: Point3d, B: Point3d, C: Point3d
# ---------- gh_ccentre: C# ----------
    // Component written by @garciadelcastillo

    // Returns the circumcenter of this triangle, this is,
    // the center of the circle that inscribes the three vertices.

    // Jonathan R Shewchuk proposes a direct algebraic computation here:
    //   https://www.ics.uci.edu/~eppstein/junkyard/circumcenter.html
    // for which @bobobobo offers a C++ implementation that could similarly
    // be implemented here:
    //   https://gamedev.stackexchange.com/a/60631
    // Geometrically, this means calculating the perpendicular lines
    // to two sides of the triangle, and compute their intersection.

    this.Component.AddRuntimeMessage(GH_RuntimeMessageLevel.Remark, "Perpendicular lines on this component only extend to circumcenter");

    // Create two small line segments on the sides of the triangle,
    // and rotate them 90 degrees in the triangle plane.
    Plane trianglePlane = new Plane(A, B, C);

    Point3d ABmid = A + 0.5 * (B - A);
    Line AB2 = new Line(ABmid, B);
    Transform rot = Transform.Rotation(0.5 * Math.PI, trianglePlane.Normal, ABmid);
    AB2.Transform(rot);

    Point3d BCmid = B + 0.5 * (C - B);
    Line BC2 = new Line(BCmid, C);
    rot = Transform.Rotation(0.5 * Math.PI, trianglePlane.Normal, BCmid);
    BC2.Transform(rot);

    // Calculate the intersection between them
    double tAB, tBC;
    Intersection.LineLine(AB2, BC2, out tAB, out tBC);
    Point3d circumcenter = AB2.PointAt(tAB);

    // Generate perpendicular lines for visualization
    Line ABO = new Line(ABmid, circumcenter);
    Line BCO = new Line(BCmid, circumcenter);
    Line CAO = new Line(C + 0.5 * (A - C), circumcenter);

    // Outputs
    COut = circumcenter;
    AB = ABO;
    BC = BCO;
    CA = CAO;
# ---------- end gh_ccentre ----------
panel_33 = Panel([ccentre.Circumcentre, ccentre.BisectorAB, ccentre.BisectorBC, ccentre.BisectorCA])
panel_34 = Panel([gh_ccentre.COut, gh_ccentre.AB, gh_ccentre.BC, gh_ccentre.CA])

# ---- group: Orthocentre
pt_10 = Point(Point(3.575077238, 11.91778967, 0))
pt_11 = Point(Point(7.511515682, 22.57259671, 0))
pt_12 = Point(Point(14.51166702, 18.48562451, -1.769557008))
ocentre = Orthocentre(PointA=pt_10, PointB=pt_11, PointC=pt_12)  # -> Orthocentre, AltitudeAB, AltitudeBC, AltitudeCA
gh_ocentre = CSharpScript(A=pt_10, B=pt_11, C=pt_12)  # -> out, COut, AB, BC, CA; inputs A: Point3d, B: Point3d, C: Point3d
# ---------- gh_ocentre: C# ----------
    // Component written by @garciadelcastillo

    // Returns the orthocenter of this triangle, this is,
    // the intersection of the three altitudes of the triangle.
    // The altitude is the perpendicular line to a side of the triangle
    // that passes through the opposite vertex.
    // Geometrically, this line can be found by obtaining the closest
    // point to the vertex on the opposite side.

    // Let's calculate the altitude lines
    Line ABline = new Line(A, B);
    Point3d ConAB = ABline.ClosestPoint(C, false);
    Line CtoAB = new Line(C, ConAB);

    Line BCline = new Line(B, C);
    Point3d AonBC = BCline.ClosestPoint(A, false);
    Line AtoBC = new Line(A, AonBC);

    Line CAline = new Line(C, A);
    Point3d BonCA = CAline.ClosestPoint(B, false);
    Line BtoCA = new Line(B, BonCA);

    // And compute the intersection of two of them
    double tCtoAB, tAtoBC;
    Rhino.Geometry.Intersect.Intersection.LineLine(CtoAB, AtoBC, out tCtoAB, out tAtoBC);
    Point3d orthocenter = CtoAB.PointAt(tCtoAB);
    
    // Outputs
    COut = orthocenter;
    AB = CtoAB;
    BC = AtoBC;
    CA = BtoCA;
# ---------- end gh_ocentre ----------
panel_35 = Panel([ocentre.Orthocentre, ocentre.AltitudeAB, ocentre.AltitudeBC, ocentre.AltitudeCA])
panel_36 = Panel([gh_ocentre.COut, gh_ocentre.AB, gh_ocentre.BC, gh_ocentre.CA])
