# Grasshopper definition Maths_Util.ghx (Grasshopper 1.0.7)

# ----
# GH#: A C# dictionary of Grasshopper3D components.
# 
# This file contains a category of Grasshopper components, and a mirroring C#/RhinoCommon implementation.
# 
# This is an educational project initiated by students/faculty of GSD-6338: Introduction to Computational Design, at the Harvard Graduate School of Design.
# 
# More information: {{project link}}
# Maths Util
number_slider = Slider(1, range=0..10)
c_script = CSharpScript(N=number_slider)  # -> out, y; inputs N: Double
# ---------- c_script: C# ----------
    // Component written by @garciadelcastillo

    // This component returns "epsilon", a system property that defines
    // a very small value typically used for precision comparisons.
    y = N * double.Epsilon;
# ---------- end c_script ----------
eps = Epsilon(Factor=number_slider)
panel = Panel(c_script.y)
panel_2 = Panel(eps)

number_slider_2 = Slider(1, range=0..10)
c_script_2 = CSharpScript(N=number_slider_2)  # -> out, y; inputs N: Double
# ---------- c_script_2: C# ----------
    // Component written by @garciadelcastillo

    // This component returns a factor of the natural number e.
    
    y = N * Math.E;
# ---------- end c_script_2 ----------
E = NaturalLogarithm(Factor=number_slider_2)
panel_3 = Panel(c_script_2.y)
panel_4 = Panel(E)

number_slider_3 = Slider(0.985, range=0..1)
genes = GenePool(Decimals=2, Maximum=100, Minimum=0, Value=[34.37, 77.76, 15.82, 22.27, 9.67, 4.25, 34.08, 73.88, 18.16, 77.86, 50])
list = ValueList({"Block", "Linear", "Cubic", "Catmull"}, selected="Catmull")
c_script_3 = CSharpScript(D=genes, t=number_slider_3, type=list)  # -> out, V; inputs D: list of Double, t: Double, type: String
# ---------- c_script_3: C# ----------
    // Component written by @garciadelcastillo

    // This component computes an interpolated value among a list of values
    // at a normalized parameter, using different interpolation techniques.

    // If out of normalized range, return extremes
    if (t <= 0)
    {
      V = D[0];
      return;
    }
    else if (t >= 1.0)
    {
      V = D[D.Count - 1];
      return;
    }

    // Otherwise, let's calculate the interpolated value using the appropriate method
    double interp = 0;
    if (type == "Block")
    {
      interp = BlockInterpolation(D, t);
    }
    else if (type == "Linear")
    {
      interp = LinearInterpolation(D, t);
    }
    else if (type == "Cubic" || type == "Catmull")
    {
      interp = CubicInterpolation(D, t, type);
    }
    else
    {
      Component.AddRuntimeMessage(GH_RuntimeMessageLevel.Error, "Method not implemented");
      return;
    }


    // Outputs
    V = interp;
# ---------- c_script_3: C# additional code ----------
  // Block interpolation
  double BlockInterpolation(List<double> values, double t)
  {
    // Block interpolation finds the closest value on the list
    // at the normalized position 0-1, without smoothing.
    // This is equivalent to finding the rounded position!
    int index = (int) Math.Round(t * (values.Count - 1));

    return values[index];
  }

  // Linear interpolation
  double LinearInterpolation(List<double> values, double t)
  {
    // Linear interpolation finds the simple linearly distributed
    // value between two extremes.

    // Calculate the position of the lower value to interpolate from.
    int lowerIndex = (int) Math.Floor(t * (values.Count - 1));

    // Get the lower and upper interpolation extremes.
    double a = values[lowerIndex];
    double b = values[lowerIndex + 1];

    // Calculate the new 0-1 interpolation factor between them.
    double tStep = 1.0 / (values.Count - 1.0);
    double newT = (t - lowerIndex * tStep) / tStep;

    // Interpolate linearly
    double interpolated = a + (b - a) * newT;

    return interpolated;
  }

  // Cubic interpolations
  double CubicInterpolation(List<double> values, double t, string type)
  {
    // Calculate the position of the lower value to interpolate from.
    int lowerIndex = (int) Math.Floor(t * (values.Count - 1));

    // Get the lower and upper interpolation extremes.
    double p1 = values[lowerIndex];
    double p2 = values[lowerIndex + 1];

    // If one of them is at the boundary, create a "ghost point" over it
    // forming a straight line to ease the tangency of the interpolation.
    double p0 = lowerIndex > 0 ? values[lowerIndex - 1] : p1 - (p2 - p1);
    double p3 = lowerIndex + 2 < values.Count - 1 ? values[lowerIndex + 2] : p2 - (p1 - p2);

    // Calculate the new 0-1 interpolation factor between them.
    double tStep = 1.0 / (values.Count - 1.0);
    double newT = (t - lowerIndex * tStep) / tStep;

    // Choose cubic interpolation based on type
    double interpolated = type == "Cubic"
      ? InterpolationCubic(p0, p1, p2, p3, newT)
      : InterpolationCatmullRom(p0, p1, p2, p3, newT);

    return interpolated;
  }

  // Cubic interpolation
  double InterpolationCubic(double p0, double p1, double p2, double p3, double t)
  {
    // Cubic interpolation uses twice the slope of lines p0-p2 and p1-p3
    // resulting in more abrupt curvature changes.
    // http://paulbourke.net/miscellaneous/interpolation/
    double t2 = t * t;
    double a = -p0 + p1 - p2 + p3;
    double b = p0 - p1 - a;
    double c = p2 - p0;
    double d = p1;

    double interpolated = a * t2 * t + b * t2 + c * t + d;

    return interpolated;
  }

  // Catmull-Rom interpolation
  double InterpolationCatmullRom(double p0, double p1, double p2, double p3, double t)
  {
    // Cubic interpolation uses the slope of lines p0-p2 and p1-p3
    // resulting in smoother curvature transitions.
    // http://danceswithcode.net/engineeringnotes/interpolation/interpolation.html
    double a = -0.5 * p0 + 1.5 * p1 - 1.5 * p2 + 0.5 * p3;
    double b = p0 - 2.5 * p1 + 2 * p2 - 0.5 * p3;
    double c = -0.5 * p0 + 0.5 * p2;
    double d = p1;

    double interpolated = a * t * t * t + b * t * t + c * t + d;

    return interpolated;
  }
# ---------- end c_script_3 ----------
interp = InterpolateData(Data=genes, Parameter=number_slider_3, Interpolation=4)
panel_5 = Panel(interp)
panel_6 = Panel(c_script_3.V)

number_slider_4 = Slider(29.31, range=0..100)
number_slider_5 = Slider(67.18, range=0..100)
number_slider_6 = Slider(23.42, range=0..100)
number_slider_7 = Slider(63.81, range=0..100)
number_slider_8 = Slider(12.48, range=0..100)
number_slider_9 = Slider(78.96, range=0..100)
number_slider_10 = Slider(41.09, range=0..100)
extrz = Extremes(
    A=number_slider_4,
    B=number_slider_5,
    C=number_slider_6,
    D=number_slider_7,
    E=number_slider_8,
    F=number_slider_9,
    G=number_slider_10)  # -> Mininum, Maximum
c_script_4 = CSharpScript(
    A=number_slider_4,
    B=number_slider_5,
    C=number_slider_6,
    D=number_slider_7,
    E=number_slider_8,
    F=number_slider_9,
    G=number_slider_10)  # -> out, Vminus, Vplus; inputs A: Double, B: Double, C: Double, D: Double, E: Double, F: Double, G: Double
# ---------- c_script_4: C# ----------
    // Component written by @garciadelcastillo

    // This component takes a bunch of numerical inputs,
    // and calculates the minimum and maximum values.

    // TODO: Accept non-numerical inputs like points, vectors, etc.
    Component.AddRuntimeMessage(GH_RuntimeMessageLevel.Warning, "Only accepting numerical inputs at this time");

    // Create a list with all the input values.
    List<double> values = new List<double>() {A, B, C, D, E, F, G};

    // Initialize two comparison values at the extremes
    // of the capacity of a double number.
    double min = double.MaxValue;
    double max = double.MinValue;

    // Iterate over all values, and if greater/smaller than max/min,
    // keep track of these.
    foreach(double v in values)
    {
      if (v > max)
      {
        max = v;
      }
      if (v < min)
      {
        min = v;
      }
    }

    // Outputs
    Vminus = min;
    Vplus = max;
# ---------- end c_script_4 ----------
panel_7 = Panel([extrz.Mininum, extrz.Maximum])
panel_8 = Panel([c_script_4.Vminus, c_script_4.Vplus])

number_slider_11 = Slider(29.31, range=0..100)
number_slider_12 = Slider(67.18, range=0..100)
min = Minimum(A=number_slider_11, B=number_slider_12)
c_script_5 = CSharpScript(A=number_slider_11, B=number_slider_12)  # -> out, R; inputs A: Double, B: Double
# ---------- c_script_5: C# ----------
    // Component written by @garciadelcastillo

    // This component returns the smaller of the two input values.
    
    // TODO: Accept non-numerical inputs like points, vectors, etc.
    Component.AddRuntimeMessage(GH_RuntimeMessageLevel.Warning, "Only accepting numerical inputs at this time");

    // Outputs
    R = Math.Min(A, B);
# ---------- end c_script_5 ----------
panel_9 = Panel(min)
panel_10 = Panel(c_script_5.R)

genes_2 = GenePool(Decimals=2, Maximum=100, Minimum=0, Value=[34.37, 73.45, 25.44, 68.98, 24.32, 67.63, 34.08, 73.88, 18.16, 77.86])
avr = Average(Input=genes_2)
c_script_6 = CSharpScript(I=genes_2)  # -> out, AM; inputs I: list of Double
# ---------- c_script_6: C# ----------
    // Component written by @garciadelcastillo

    // This component computes the average of a list of numbers.

    // Compute the mass addition of this list
    double total = 0;
    foreach (double val in I)
    {
      total += val;
    }

    // Compute the average
    double avg = total / I.Count;

    // Outputs
    AM = avg;
# ---------- end c_script_6 ----------
panel_11 = Panel(avr)
panel_12 = Panel(c_script_6.AM)

number_slider_13 = Slider(1, range=0..10)
c_script_7 = CSharpScript(N=number_slider_13)  # -> out, y; inputs N: Double
# ---------- c_script_7: C# ----------
    // Component written by @garciadelcastillo

    // This component returns the value of the golden ratio.
    double phi = (1 + Math.Sqrt(5)) / 2;
    
    // Output
    y = N * phi;
# ---------- end c_script_7 ----------
phi = GoldenRatio(Factor=number_slider_13)
panel_13 = Panel(c_script_7.y)
panel_14 = Panel(phi)

number_slider_14 = Slider(1, range=0..10)
c_script_8 = CSharpScript(N=number_slider_14)  # -> out, y; inputs N: Double
# ---------- c_script_8: C# ----------
    // Component written by @garciadelcastillo

    // This component returns a factor of Pi.

    y = N * Math.PI;
# ---------- end c_script_8 ----------
pi = Pi(Factor=number_slider_14)
panel_15 = Panel(c_script_8.y)
panel_16 = Panel(pi)

number_slider_15 = Slider(32.8, range=0..100)
round = Round(Number=number_slider_15)  # -> Nearest, Floor, Ceiling
c_script_9 = CSharpScript(x=number_slider_15)  # -> out, N, F, C; inputs x: Double
# ---------- c_script_9: C# ----------
    // Component written by @garciadelcastillo

    // This component applies different rounding methods to the input value.
    
    // Rounding to the closest integer.
    N = Math.Round(x);
    
    // Rounding to the closest smaller integer.
    F = Math.Floor(x);
    
    // Rounding to the closest larger integer.
    C = Math.Ceiling(x);
# ---------- end c_script_9 ----------
panel_17 = Panel([c_script_9.N, c_script_9.F, c_script_9.C])
panel_18 = Panel([round.Nearest, round.Floor, round.Ceiling])

number_slider_16 = Slider(29.31, range=0..100)
number_slider_17 = Slider(67.18, range=0..100)
c_script_10 = CSharpScript(A=number_slider_16, B=number_slider_17)  # -> out, R; inputs A: Double, B: Double
# ---------- c_script_10: C# ----------
    // Component written by @garciadelcastillo

    // This component returns the larger of the two input values.

    // TODO: Accept non-numerical inputs like points, vectors, etc.
    Component.AddRuntimeMessage(GH_RuntimeMessageLevel.Warning, "Only accepting numerical inputs at this time");

    // Outputs
    R = Math.Max(A, B);
# ---------- end c_script_10 ----------
max = Maximum(A=number_slider_16, B=number_slider_17)
panel_19 = Panel(max)
panel_20 = Panel(c_script_10.R)

number_slider_18 = Slider(2020, range=0..2100)
number_slider_19 = Slider(11, range=0..12)
number_slider_20 = Slider(11, range=0..31)
number_slider_21 = Slider(13, range=0..24)
number_slider_22 = Slider(26, range=0..60)
number_slider_23 = Slider(21, range=0..60)
gh_date = CSharpScript(Y=number_slider_18, M=number_slider_19, D=number_slider_20, h=number_slider_21, m=number_slider_22, s=number_slider_23)  # -> out, Dout; inputs Y: Int32, M: Int32, D: Int32, h: Int32, m: Int32, s: Int32
# ---------- gh_date: C# ----------
    // Component written by @garciadelcastillo

    // This component creates a system DateTime object.

    // TODO: Implement all the DateTime checks the original component features
    Component.AddRuntimeMessage(GH_RuntimeMessageLevel.Warning, "This component doesn't mimic the error checks of the original");

    // Create DateTime object from inputs
    DateTime dt = new DateTime(Y, M, D, h, m, s);

    // Output
    Dout = dt;
# ---------- end gh_date ----------
date = ConstructDate(
    Year=number_slider_18,
    Month=number_slider_19,
    Day=number_slider_20,
    Hour=number_slider_21,
    Minute=number_slider_22,
    Second=number_slider_23)
panel_21 = Panel(date)
panel_22 = Panel(gh_date.Dout)

number_slider_24 = Slider(11.38, range=0..31)
number_slider_25 = Slider(13, range=0..24)
number_slider_26 = Slider(26, range=0..60)
number_slider_27 = Slider(21, range=0..60)
c_script_11 = CSharpScript(D=number_slider_24, H=number_slider_25, M=number_slider_26, S=number_slider_27)  # -> out, T; inputs D: Double, H: Double, M: Double, S: Double
# ---------- c_script_11: C# usings ----------
// We need to bring in the calendars
using System.Globalization;
# ---------- c_script_11: C# ----------
    // Component written by @garciadelcastillo

    // This component creates a time object accepting non-integer
    // parameters as inputs and aggregating them "smoothly".

    // For this, let's compute the total time in milliseconds to get some precision
    long mS = (long) (S * 1000);
    long mM = (long) (M * 60 * 1000);
    long mH = (long) (H * 60 * 60 * 1000);
    long mD = (long) (D * 24 * 60 * 60 * 1000);
    long totalMillis = mS + mM + mH + mD;

    // Create a time object using these millis,
    // converted to "ticks" (1 ms == 10000 ticks).
    // https://docs.microsoft.com/en-us/dotnet/api/system.datetime.ticks?view=net-5.0
    DateTime dt = new DateTime(totalMillis * 10000);

    // Output
    T = dt;
# ---------- end c_script_11 ----------
smtime = ConstructSmoothTime(Days=number_slider_24, Hours=number_slider_25, Minutes=number_slider_26, Seconds=number_slider_27)
panel_23 = Panel(c_script_11.T)
panel_24 = Panel(smtime)

number_slider_28 = Slider(13, range=0..24)
number_slider_29 = Slider(26, range=0..60)
number_slider_30 = Slider(21, range=0..60)
time = ConstructTime(Hour=number_slider_28, Minute=number_slider_29, Second=number_slider_30)
c_script_12 = CSharpScript(H=number_slider_28, M=number_slider_29, S=number_slider_30)  # -> out, T; inputs H: Int32, M: Int32, S: Int32
# ---------- c_script_12: C# ----------
    // Component written by @garciadelcastillo

    // Creates a time-only object using GH's DateTime converter
    DateTime dt = GH_Convert.CreatePureTime(H, M, S);

    // Output
    T = dt;
# ---------- end c_script_12 ----------
panel_25 = Panel(c_script_12.T)
panel_26 = Panel(time)

date_2 = ConstructDate(
    Year=Slider(2020, range=0..2100),
    Month=Slider(11, range=0..12),
    Day=Slider(11, range=0..31),
    Hour=12,
    Minute=0,
    Second=0)
date_3 = ConstructDate(Year=1970, Month=1, Day=1, Hour=Slider(13, range=0..24), Minute=Slider(26, range=0..60), Second=Slider(21, range=0..60))
panel_27 = Panel([date_2, date_3])
c_script_13 = CSharpScript(D=date_2, T=date_3)  # -> out, R
# ---------- c_script_13: C# ----------
    // Component written by @garciadelcastillo

    // This component creates a DateTime object combining
    // the date portion of the first input with
    // the time portion of the second.

    R = new DateTime(D.Year, D.Month, D.Day, T.Hour, T.Minute, T.Second);
# ---------- end c_script_13 ----------
cdate = CombineDateTime(Date=date_2, Time=date_3)
panel_28 = Panel(c_script_13.R)
panel_29 = Panel(cdate)

number_slider_31 = Slider(2020, range=0..2100)
number_slider_32 = Slider(11, range=0..12)
number_slider_33 = Slider(11, range=0..31)
list_2 = ValueList({"Gregorian", "Julian", "Hebrew", "Persian", "Um Al Qura", "Hijri", "Buddist (Thai)", "Chinese (LS)", "Japanese", "Japanese (LS)", "Korean", "Korean (LS)", "Taiwan", "Taiwan (LS)"}, selected="Persian")
c_script_14 = CSharpScript(Y=number_slider_31, M=number_slider_32, D=number_slider_33, c=list_2)  # -> out, T; inputs Y: Int32, M: Int32, D: Int32, c: String
# ---------- c_script_14: C# ----------
    // Component written by @garciadelcastillo

    // This component creates a system DateTime object with an "exotic" calendar.

    // Create an instance of the target calendar
    Calendar calendar = CultureInfo.InvariantCulture.Calendar;
    if (c == "Gregorian")
    {
      calendar = new GregorianCalendar();
    }
    else if (c == "Julian")
    {
      calendar = new JulianCalendar();
    }
    else if (c == "Hebrew")
    {
      calendar = new HebrewCalendar();
    }
    else if (c == "Persian")
    {
      calendar = new PersianCalendar();
    }
    else if (c == "Um Al Qura")
    {
      calendar = new UmAlQuraCalendar();
    }
    else if (c == "Hijri")
    {
      calendar = new HijriCalendar();
    }
    else if (c == "Buddist (Thai)")
    {
      calendar = new ThaiBuddhistCalendar();
    }
    else if (c == "Chinese (LS)")
    {
      calendar = new ChineseLunisolarCalendar();
    }
    else if (c == "Japanese")
    {
      calendar = new JapaneseCalendar();
    }
    else if (c == "Japanese (LS)")
    {
      calendar = new JapaneseLunisolarCalendar();
    }
    else if (c == "Korean")
    {
      calendar = new KoreanCalendar();
    }
    else if (c == "Korean (LS)")
    {
      calendar = new KoreanLunisolarCalendar();
    }
    else if (c == "Taiwan")
    {
      calendar = new TaiwanCalendar();
    }
    else if (c == "Taiwan (LS)")
    {
      calendar = new TaiwanLunisolarCalendar();
    }
    else
    {
      Component.AddRuntimeMessage(GH_RuntimeMessageLevel.Error, "Calendar not implemented");
      return;
    }

    // Create DateTime object from inputs, using this calendar
    DateTime dt = new DateTime(Y, M, D, calendar);

    // Output
    T = dt;
# ---------- end c_script_14 ----------
dateex = ConstructExoticDate(Year=number_slider_31, Month=number_slider_32, Day=number_slider_33, Calendar=3)
panel_30 = Panel(dateex)
panel_31 = Panel(c_script_14.T)

number_slider_34 = Slider(0.652, range=0..1)
time_2 = Time(date_3)
time_3 = Time(date_2)
intdate = InterpolateDate(DateA=time_3, DateB=time_2, Interpolation=number_slider_34)
c_script_15 = CSharpScript(A=time_3, B=time_2, t=number_slider_34)  # -> out, R; inputs t: Double
# ---------- c_script_15: C# ----------
    // Component written by @garciadelcastillo

    // This component takes to DateTimes, and calculates
    // an intermediate one at a proportional distance between them.

    // To do these calculations, let's convert the times to ticks.
    // https://docs.microsoft.com/en-us/dotnet/api/system.datetime.ticks?view=net-5.0
    long start = A.Ticks;
    long end = B.Ticks;
    
    // Calculate the difference, and the proportional ticks for the new date.
    long diff = end - start;
    long interpolatedTicks = start + (long) (t * diff);
    DateTime dt = new DateTime(interpolatedTicks);
    
    // Output
    R = dt;
# ---------- end c_script_15 ----------
panel_32 = Panel(c_script_15.R)
panel_33 = Panel(intdate)

time_4 = Time(date)
c_script_16 = CSharpScript(D=time_4)  # -> out, Y, M, Dout, h, m, s
# ---------- c_script_16: C# ----------
    // Component written by @garciadelcastillo
    
    // This component takes a DateTime object and extracts its parameters
    Y = D.Year;
    M = D.Month;
    Dout = D.Day;
    h = D.Hour;
    m = D.Minute;
    s = D.Second;
# ---------- end c_script_16 ----------
ddate = DeconstructDate(Date=time_4)  # -> Year, Month, Day, Hour, Minute, Second
panel_34 = Panel([ddate.Year, ddate.Month, ddate.Day, ddate.Hour, ddate.Minute, ddate.Second])
panel_35 = Panel([c_script_16.Y, c_script_16.M, c_script_16.Dout, c_script_16.h, c_script_16.m, c_script_16.s])

number_slider_35 = Slider(5, range=0..10)
time_5 = Time(date_3)
time_6 = Time(date_2)
c_script_17 = CSharpScript(A=time_6, B=time_5, N=number_slider_35)  # -> out, R; inputs N: Int32
# ---------- c_script_17: C# ----------
    // Component written by @garciadelcastillo

    // This component divides the time between the two DateTime extremes
    // and outputs a list of the intermediate dates.
    
    // To do these calculations, let's convert the times to ticks
    // and calculate the amount of ticks on each interval.
    // https://docs.microsoft.com/en-us/dotnet/api/system.datetime.ticks?view=net-5.0
    long start = A.Ticks;
    long end = B.Ticks;
    double interval = (end - start) / (N - 1);
    
    // Create a list of DateTimes and compute them incrementally.
    List<DateTime> dates = new List<DateTime>();
    for (int i = 0; i < N; i++)
    {
      long ticks = start + (long) (i * interval);
      DateTime date = new DateTime(ticks);
      dates.Add(date);
    }
    
    // Output
    R = dates;
# ---------- end c_script_17 ----------
rdate = DateRange(TimeA=time_6, TimeB=time_5, Count=number_slider_35)
panel_36 = Panel(rdate)
panel_37 = Panel(c_script_17.R)
