# Grasshopper definition Sets_List.ghx (Grasshopper 1.0.7)

# ---- group: Weave
panel = Panel("""1
2
3
4
5
6""")
panel_2 = Panel("""0
1
1
0
1
0
1""")
panel_3 = Panel("""3.855469
2.020813
0.829993
4.925235
0.824293""")
gh_weave = CSharpScript(P=panel_2, I0=panel_3, I1=panel)  # -> out, W; inputs P: list of Int32, I0: list, I1: list
# ---------- gh_weave: C# ----------
    //Component written by @bava-kumaravel
    //Weaves two or more input lists by picking elements from them
    //based on a recurring pattern P

    //Declare an output list
    List<System.Object> outputList = new List<System.Object>();

    //Get the available number of input lists provided
    int numberOfInputs = Component.Params.Input.Count - 1;
    //Set the access types of all the input lists to list access
    for(int i = 1;i <= numberOfInputs;i++){
      Component.Params.Input[i].Access = GH_ParamAccess.list;
    }

    //Declare an array of numbers of length equal to the
    //number of inputs, that will hold the item indices to pick
    //for each list
    int[] indexRef = new int[numberOfInputs];
    //Initiate all values in the array with 0
    for(int i = 0;i < numberOfInputs;i++){
      indexRef[i] = 0;
    }

    //Get the total number of items in all input lists included
    //in the weaving pattern P
    int total = 0;
    for(int i = 0;i < numberOfInputs;i++){
      //Check if i is present within the pattern list P
      if(P.Contains(i)){
        IList currentList = Component.Params.Input[i + 1].
          VolatileData.get_Branch(new GH_Path(0));
        total += currentList.Count;
      }
    }

    //While the total number of items is more than 0,
    //Go through the pattern list and assign values from the
    //respective list to the output list
    while(total > 0){
      for(int i = 0;i < P.Count;i++){
        //Get the index of the list referenced at i
        int listIndex = P[i];
        //Check if list index lies within the number of input lists
        if(listIndex < numberOfInputs){
          //Get the input list at the list index
          IList currentList = Component.Params.Input[listIndex + 1].
            VolatileData.get_Branch(new GH_Path(0));
          //Also, get the item index from the reference array
          int itemIndex = indexRef[listIndex];
          //Check if the list is not null and if the item index is
          //less than the length of the list
          if(currentList != null && itemIndex < currentList.Count){
            //If so, get the item at the itemIndex from the list
            System.Object currentItem = currentList[itemIndex];
            //Add the item to the output list
            outputList.Add(currentItem);
            //Increase the item index by 1 and update the index
            //reference array
            itemIndex++;
            indexRef[listIndex] = itemIndex;
            //Decrease the total number of items by 1
            total--;
          }
        }
        else{
          //If the list index doesn't lie within the number of input
          //lists, display a error message
          string error = "Weave index " + listIndex +
            " out of bounds {0 <= i < " + numberOfInputs + "}";
          Component.AddRuntimeMessage(GH_RuntimeMessageLevel.Error,
            error);
        }
      }
    }

    //Outputs
    W = outputList;
# ---------- end gh_weave ----------
weave = Weave(Pattern=panel_2, Stream0=panel_3, Stream1=panel, NullGaps=False)
panel_4 = Panel(weave)
panel_5 = Panel(gh_weave.W)

# ---- group: Cross Reference
panel_6 = Panel("""1
2
3
4""")
panel_7 = Panel("""a
b
c
d""")
list = ValueList({"Holistic", "Diagonal", "Coincident", "Lower Triangle", "Lower Triangle (strict)", "Upper Triangle", "Upper Triangle (strict)"}, selected="Upper Triangle (strict)")
gh_crossref = CSharpScript(Option=list, IA=panel_6, IB=panel_7)  # -> out, OA, OB; inputs Option: String, IA: list, IB: list
# ---------- gh_crossref: C# ----------
    //Component written by @bava-kumaravel
    //Cross references values between two or more input
    //lists based on the option selected

    //Note:
    //This component is originally designed to work with
    //2 or more lists, but the definition here restricts
    //to only two lists to better illustrate the options

    //Define two output lists
    List<System.Object> outListA = new List<System.Object>();
    List<System.Object> outListB = new List<System.Object>();

    //Option 1: Holistic
    if(Option == "Holistic"){
      //Cross Reference every element in the first list
      //to every element in the second list
      //Go through the second list
      for(int i = 0;i < IB.Count;i++){
        //Get the second list item
        System.Object secondItem = IB[i];
        //Go through the first list
        for(int j = 0;j < IA.Count;j++){
          //Get the first list item
          System.Object firstItem = IA[j];
          //Add the first list item to the first output list
          //and second list item to second output list
          outListA.Add(firstItem);
          outListB.Add(secondItem);
        }
      }
    }

      //Option 2: Diagonal
    else if(Option == "Diagonal"){
      //Print the first list diangonally, starting from
      //second element, i.e. element at index 1
      //For example, for a list like 1, 2, 3, 4
      //Output is 2, 3, 4, 1,
      //          3, 4, 1, 2,
      //          4, 1, 2, 3,
      //          1, 2, 3, 4,     (After diagonal is done,
      //          1, 2, 3, 4,      keep repeating original
      //          ...              as in holistic)

      //The number of values in diagonal
      int diagonal = IA.Count * (IA.Count - 1);

      //Go through second list
      for(int i = 0;i < IB.Count;i++){
        //Get the second list item
        System.Object secondItem = IB[i];
        //If diagonalling is still in progress,
        if(diagonal > 0){
          //Go diagonally through the first list
          for(int j = 0;j < IA.Count;j++){
            if(j == i){
              //The diagonal effect is achieved by skipping
              //elements which have the same index value as
              //first list
              continue;
            }
            else{
              System.Object firstItem = IA[j];
              //Add the first list item to the first output list
              //and second list item to second output list
              outListA.Add(firstItem);
              outListB.Add(secondItem);
            }
            //Decrease diagonal items count by 1
            diagonal--;
          }
        }

          //If diagonalling is done, continue holistically
        else{
          for(int j = 0;j < IA.Count;j++){
            System.Object firstItem = IA[j];
            //Add the first list item to the first output list
            //and second list item to second output list
            outListA.Add(firstItem);
            outListB.Add(secondItem);
          }
        }
      }
    }

      //Option 3: Coincident
    else if(Option == "Coincident"){
      //Coincident works exactly similar to diagonal
      //for two input lists.

      //The number of values in diagonal
      int diagonal = IA.Count * (IA.Count - 1);

      //Go through second list
      for(int i = 0;i < IB.Count;i++){
        //Get the second list item
        System.Object secondItem = IB[i];
        //If diagonalling is still in progress,
        if(diagonal > 0){
          //Go diagonally through the first list
          for(int j = 0;j < IA.Count;j++){
            if(j == i){
              //The difference between 'diagonal' and
              //'coincident' happens here for 2+ lists
              //Diagonal skips values for all items of
              //same list index, while coincident only
              //skips values when any 2 items have same
              //list index
              continue;
            }
            else{
              //Get the first list item
              System.Object firstItem = IA[j];
              //Add the first list item to the first output list
              //and second list item to second output list
              outListA.Add(firstItem);
              outListB.Add(secondItem);
            }
            //Decrease diagonal items count by 1
            diagonal--;
          }
        }

          //If diagonalling is done, continue holistically
        else{
          for(int j = 0;j < IA.Count;j++){
            System.Object firstItem = IA[j];
            //Add the first list item to the first output list
            //and second list item to second output list
            outListA.Add(firstItem);
            outListB.Add(secondItem);
          }
        }
      }
    }

      //Option 4: Lower Triangle
    else if(Option == "Lower Triangle"){
      //Lower Triangling is done by consecutively
      //skipping the top element in the first list
      //For example, for the list 1, 2, 3, 4
      //Output is 1, 2, 3, 4
      //             2, 3, 4
      //                3, 4
      //                   4
      //The referencing stops once the triangling is done
      //irrespective of the number of elements left out
      //on the second list. But if second list is done
      //first, the triangling is cut short

      //Define start index of triangle
      int startIndex = 0;

      //Go through second list
      for(int i = 0;i < IB.Count;i++){
        //Get the second list item
        System.Object secondItem = IB[i];
        //If start index of triangle is not exceeding
        //the length of first list
        if(startIndex < IA.Count){
          for(int j = startIndex;j < IA.Count;j++){
            //Get the first list item
            System.Object firstItem = IA[j];
            //Add the first list item to the first output list
            //and second list item to second output list
            outListA.Add(firstItem);
            outListB.Add(secondItem);
          }
          //Increase triangle start index by 1
          startIndex++;
        }
      }
    }

      //Option 5: Lower Triangle (strict)
    else if(Option == "Lower Triangle (strict)"){
      //Strict Lower Triangling is similar to lower
      //triangling except it starts from 2nd element
      //For example, for the list 1, 2, 3, 4
      //Output is 2, 3, 4
      //             3, 4
      //                4
      //The referencing stops once the triangling is done
      //irrespective of the number of elements left out
      //on the second list. But if second list is done
      //first, the triangling is cut short

      //Define start index of triangle
      int startIndex = 1;

      //Go through second list
      for(int i = 0;i < IB.Count;i++){
        //Get the second list item
        System.Object secondItem = IB[i];
        //If start index of triangle is not exceeding
        //the length of first list
        if(startIndex < IA.Count){
          for(int j = startIndex;j < IA.Count;j++){
            //Get the first list item
            System.Object firstItem = IA[j];
            //Add the first list item to the first output list
            //and second list item to second output list
            outListA.Add(firstItem);
            outListB.Add(secondItem);
          }
          //Increase triangle start index by 1
          startIndex++;
        }
      }
    }

      //Option 6:  Upper Triangle
    else if(Option == "Upper Triangle"){
      //Upper Triangling is the opposite of lower
      //triangling. It begins with one element and
      //consecutively keeps adding the next elements
      //For example, for the list 1, 2, 3, 4
      //Output is 1
      //          1, 2
      //          1, 2, 3
      //          1, 2, 3, 4
      //          1, 2, 3, 4
      //          1, 2, 3, 4
      //          ...
      //After the triangling is done, if there are
      //elements left out on the second list, the
      //cross referencing continues holistically

      //Define the step of triangle
      int step = 0;

      //Go through second list
      for(int i = 0;i < IB.Count;i++){
        //Get the second list item
        System.Object secondItem = IB[i];
        //If the step of triangle is not exceeding
        //the length of first list
        if(step < IA.Count){
          for(int j = 0;j <= step;j++){
            //Get the first list item
            System.Object firstItem = IA[j];
            //Add the first list item to the first output list
            //and second list item to second output list
            outListA.Add(firstItem);
            outListB.Add(secondItem);
          }
          //Increase triangle step by 1
          step++;
        }
          //If the step length is exceeding the length
          //of the list, continue the rest holistically
        else{
          for(int j = 0;j < IA.Count;j++){
            System.Object firstItem = IA[j];
            //Add the first list item to the first output list
            //and second list item to second output list
            outListA.Add(firstItem);
            outListB.Add(secondItem);
          }
        }
      }
    }

      //Option 7: Upper Triangle (strict)
    else if(Option == "Upper Triangle (strict)"){
      //Strict Upper Triangling is similar to upper
      //triangling except the cross referencing also
      //starts from the second element of the second list

      //Define the step of triangle
      int step = 0;

      //Go through second list
      for(int i = 1;i < IB.Count;i++){
        //Get the second list item
        System.Object secondItem = IB[i];
        //If start index of triangle is not exceeding
        //the length of first list
        if(step < IA.Count){
          for(int j = 0;j <= step;j++){
            //Get the first list item
            System.Object firstItem = IA[j];
            //Add the first list item to the first output list
            //and second list item to second output list
            outListA.Add(firstItem);
            outListB.Add(secondItem);
          }
          //Increase triangle step by 1
          step++;
        }
          //If the step length is exceeding the length
          //of the list, continue the rest holistically
        else{
          for(int j = 0;j < IA.Count;j++){
            System.Object firstItem = IA[j];
            //Add the first list item to the first output list
            //and second list item to second output list
            outListA.Add(firstItem);
            outListB.Add(secondItem);
          }
        }
      }
    }

    //Outputs
    OA = outListA;
    OB = outListB;
# ---------- end gh_crossref ----------
crossref = CrossReference(ListA=panel_6, ListB=panel_7, CrossMode=7)  # -> ListA, ListB, ListC
panel_8 = Panel(crossref.ListA)
panel_9 = Panel(gh_crossref.OA)
panel_10 = Panel(crossref.ListB)
panel_11 = Panel(gh_crossref.OB)

# ---- group: Shortest List
panel_12 = Panel("""1
2
3
4""")
panel_13 = Panel("""a
b
c
d
e
f
g
h
i
j
k""")
list_2 = ValueList({"Trim Start", "Trim End", "Interpolate"}, selected="Trim End")
gh_short = CSharpScript(Option=list_2, IA=panel_12, IB=panel_13)  # -> out, OA, OB; inputs Option: String, IA: list, IB: list
# ---------- gh_short: C# ----------
    //Component written by @bava-kumaravel
    //Shrinks a collection of lists to the length of the
    //shortest list among them

    //NOTE//
    //Since we are working with dynamic outputs in this component,
    //the variable to hold the outputs, outputTree is defined
    //as a persistent variable, outside the scope of the RunScript()
    //function. Also, from the outputTree, the outputs from each
    //branch are passed to their respective output parameters in
    //the AfterRunScript()function. Hence, before every execution
    //of the RunScript() function, we manually clear out all
    //the branches and data in the outputTree
    outputTree.Clear();

    //Get the available number of input lists provided
    int numberOfInputs = Component.Params.Input.Count - 1;
    //Set the access types of all the input lists to list access
    for(int i = 1;i <= numberOfInputs;i++){
      Component.Params.Input[i].Access = GH_ParamAccess.list;
    }
    //Get the number of output lists
    int numberOfOutputs = Component.Params.Output.Count - 1;

    //Sanity Check - Check if the number of inputs and number
    //of outputs are equal
    //If the outputs are lesser than the input lists, add the rest
    if(numberOfOutputs < numberOfInputs){
      //Calculate the number of output parameters needed
      int shortage = numberOfInputs - numberOfOutputs;
      for(int i = 0;i < shortage;i++){
        //Define a parameter
        Grasshopper.Kernel.Parameters.Param_ScriptVariable output =
          new Grasshopper.Kernel.Parameters.Param_ScriptVariable();
        //Assign its insertion index
        int index = numberOfOutputs + i + 1;
        //Get the name of the corresponding input parameter
        string inputName = Component.Params.Input[index].Name;
        //Define the name of the output parameter
        string outputName = "O" + inputName[inputName.Length - 1];
        //Assign name to the output parameter
        output.Name = outputName;
        output.NickName = outputName;
        Component.Params.RegisterOutputParam(output, index);
      }
    }
      //Likewise, if the number of outputs are in excess of
      //the number of inputs, delete the excess
    else if(numberOfOutputs > numberOfInputs){
      //Calculate the number of output parameters in excess
      int excess = numberOfOutputs - numberOfInputs;
      for(int i = excess;i > 0;i--){
        //Define the index
        int index = i + numberOfInputs;
        Grasshopper.Kernel.Parameters.Param_ScriptVariable output =
          (Grasshopper.Kernel.Parameters.Param_ScriptVariable) Component.Params.Output[index];
        Component.Params.UnregisterOutputParameter(output);
      }
    }

    //Go through the list of the inputs and find the length of
    //the shortest list among them
    //Define an integer to hold the value
    int shortLength = -1;
    for(int i = 1;i <= numberOfInputs;i++){
      //Get the input list at index i and its length
      IList currentList = Component.Params.Input[i].
        VolatileData.get_Branch(new GH_Path(0));
      if(currentList != null){
        int currentLength = currentList.Count;
        //If the value of shortest length is not initiated
        //assign the current length value to the variable
        if(shortLength == -1){
          shortLength = currentLength;
        }
        else{
          //Else only if the current list's length is lower than
          //the shortest length value, update the shortest length
          //value with the current value
          if(currentLength < shortLength){
            shortLength = currentLength;
          }
        }
      }
    }

    Print("Shortest length: " + shortLength);
    //Option 1: Trim Start
    if(Option == "Trim Start"){
      //We reduce the longer lists to the length of the shortest
      //list by trimming their first elements at the start

      //Go through the input lists
      for(int i = 1;i <= numberOfInputs;i++){
        //Get the input list at index i
        IList currentList = Component.Params.Input[i].
          VolatileData.get_Branch(new GH_Path(0));
        //If the current list is not null
        if(currentList != null){
          int currentLength = currentList.Count;
          //Define an output list
          List<System.Object> outputList = new List<System.Object>();

          //If the current list's length is higher than the
          //shortest length value, reduce it
          if(currentLength > shortLength){
            //Calculate number of extras to be trimmed
            int extra = currentLength - shortLength;
            //Exclude 'extra' elements at the beginning
            //and add the rest elements from the input list
            //to the output list
            for(int j = extra;j < currentLength;j++){
              outputList.Add(currentList[j]);
            }
          }

          else{
            //Else if the current list's length matches
            //the shortest list length add it as it is to the
            //output list
            for(int j = 0;j < currentLength;j++){
              outputList.Add(currentList[j]);
            }
          }

          //Add the output list to the output datatree
          outputTree.AddRange(outputList, new GH_Path(i));
        }
      }
    }

      //Option 2: Trim End
    else if(Option == "Trim End"){
      //We reduce the longer lists to the length of the shortest
      //list by trimming their last elements

      //Go through the input lists
      for(int i = 1;i <= numberOfInputs;i++){
        //Get the input list at index i
        IList currentList = Component.Params.Input[i].
          VolatileData.get_Branch(new GH_Path(0));

        //If the current list is not null
        if(currentList != null){
          int currentLength = currentList.Count;
          //Define an output list
          List<System.Object> outputList = new List<System.Object>();
          //Only add to the output list, values in the input list
          //until the shortest length limit is reached. That way
          //any excess elements in the end will be automatically
          //trimmed off
          for(int j = 0;j < shortLength;j++){
            outputList.Add(currentList[j]);
          }

          //Add the output list to the output datatree
          outputTree.AddRange(outputList, new GH_Path(i));
        }
      }
    }

      //Option 3: Interpolate
    else if(Option == "Interpolate"){
      //We reduce the longer lists to the length of the shortest
      //list by interpolating them at regular intervals

      //This option gives outputs different from that of the
      //vanilla GH component
      Component.AddRuntimeMessage(GH_RuntimeMessageLevel.Warning,
        "Interpolate option gives outputs different from those of the vanilla GH Component");

      //Go through the list of the input lists
      for(int i = 1;i <= numberOfInputs;i++){
        //Get the input list at index i
        IList currentList = Component.Params.Input[i].
          VolatileData.get_Branch(new GH_Path(0));
        if(currentList != null){
          int currentLength = currentList.Count;
          //Define an output list
          List<System.Object> outputList = new List<System.Object>();
          //If the current list's length is higher than the
          //shortest length value, reduce it
          if(currentLength > shortLength){
            //Divide the longer lists into intervals to match
            //the shortest list length and interpolate it using
            //the interval values
            double interval = ((double) currentLength - 1) /
              ((double) shortLength - 1);
            for(int j = 0;j < shortLength;j++){
              double currentInterval = interval * j;
              //Round off the interval to the closest list index
              int itemIndex = (int) Math.Round(currentInterval);
              //Add the element at this index to the output list
              System.Object element = currentList[itemIndex];
              outputList.Add(element);
            }
          }
          else{
            //If the list is the of the same length as the longest
            //list, add it as such to the output list
            for(int j = 0;j < currentLength;j++){
              outputList.Add(currentList[j]);
            }
          }

          //Add the output list to the output datatree
          outputTree.AddRange(outputList, new GH_Path(i));
        }
      }
    }
# ---------- gh_short: C# additional code ----------
  //Define an output data tree
  //Define it as a persistent variable to access it outside the
  //RunScript() function
  DataTree<System.Object> outputTree = new DataTree<System.Object>();

  /// <summary>
  /// This method will be called once every solution, after any calls to RunScript.
  /// </summary>
  public override void AfterRunScript()
  {
    //Outputs
    //Derive the outputs from the outputs tree
    for(int i = 0;i < outputTree.BranchCount;i++){
      //Get the list at branch i from the output datatree
      List<System.Object> currentBranch = outputTree.Branches[i];
      //Assign the list to the corresponding output list
      //But first, clear the existing values in the output stream
      Component.Params.Output[i + 1].ClearData();
      Component.Params.Output[i + 1].AddVolatileDataList
        (new GH_Path(0), currentBranch);
    }

  }
# ---------- end gh_short ----------
short = ShortestList(ListA=panel_12, ListB=panel_13, TrimMode=2)  # -> ListA, ListB
panel_14 = Panel(short.ListA)
panel_15 = Panel(gh_short.OA)
panel_16 = Panel(short.ListB)
panel_17 = Panel(gh_short.OB)

# ---- group: Dispatch
panel_18 = Panel("""1
2
3
4
5""")
panel_19 = Panel("""True
False
True
True""")
gh_dispatch = CSharpScript(L=panel_18, P=panel_19)  # -> out, A, B; inputs L: list, P: list of Boolean
# ---------- gh_dispatch: C# ----------
    //Component written by @bava-kumaravel
    //Filters a list L using the boolean pattern P, and
    //dispatch the true elements into list A and the false
    //elements into list B

    //Declare two lists to hold the true and false elements
    List<System.Object> trueList = new List<System.Object>();
    List<System.Object> falseList = new List<System.Object>();

    //Check if the length of the boolean pattern P is null
    if(P.Count == 0){
      //If so, stop execution
      return;
    }

    else{
      //If the boolean pattern is not null,
      //Go through the input list L and filter it
      for(int i = 0;i < L.Count;i++){
        int index = i;
        //Check if the index exceeds the length of the
        //bool pattern P
        if(index >= P.Count){
          //If so, wrap it using the length of pattern P
          index = index % P.Count;
        }
        //Get the boolean value for the index from P
        bool filter = P[index];
        //If it is true, add the element to the true list,
        //else to the false list
        if(filter){
          trueList.Add(L[i]);
        }
        else{
          falseList.Add(L[i]);
        }
      }
    }

    //Outputs
    A = trueList;
    B = falseList;
# ---------- end gh_dispatch ----------
dispatch = Dispatch(List=panel_18, DispatchPattern=panel_19)  # -> ListA, ListB
panel_20 = Panel(dispatch.ListA)
panel_21 = Panel(gh_dispatch.A)
panel_22 = Panel(dispatch.ListB)
panel_23 = Panel(gh_dispatch.B)

# ---- group: Pick'n'Choose
panel_24 = Panel("""0
0
1
0
1""")
panel_25 = Panel("""3.855469
2.020813
0.829993
4.925235
0.824293""")
panel_26 = Panel("""1
2
3
4
5
6""")
gh_p_n_c = CSharpScript(P=panel_24, I0=panel_25, I1=panel_26)  # -> out, R; inputs P: list of Int32, I0: list, I1: list
# ---------- gh_p_n_c: C# ----------
    //Component written by @bava-kumaravel
    //Defines an output list R from two or more input lists,
    //by choosing elements from them based on a pattern P

    //Declare an output list
    List<System.Object> outputList = new List<System.Object>();

    //Get the available number of input lists provided
    int numberOfInputs = Component.Params.Input.Count - 1;
    //Set the access types of all the input lists to list access
    for(int i = 1;i <= numberOfInputs;i++){
      Component.Params.Input[i].Access = GH_ParamAccess.list;
    }

    //Go through the pattern list and assign values to output list
    for(int i = 0;i < P.Count;i++){
      //Get the index of the list referenced at i
      int listIndex = P[i];
      //Check if list index lies within the number of input lists
      if(listIndex < numberOfInputs){
        //Get the input list at the list index
        IList currentList = Component.Params.Input[listIndex + 1].
          VolatileData.get_Branch(new GH_Path(0));
        //Check if the list is not null and if the index i exists
        //within the list's length
        if(currentList != null && i < currentList.Count){
          //If so, get the item at index i from the list
          System.Object currentItem = currentList[i];
          //Assign the item to the output list
          outputList.Add(currentItem);
        }
        else{
          //Else, show a warning and assign a null to the output list
          Component.AddRuntimeMessage(GH_RuntimeMessageLevel.Warning,
            "Input stream too short for pattern");
          outputList.Add(null);
        }
      }
      else{
        //If the list index doesn't lie within the number of input
        //lists, give a warning message
        Component.AddRuntimeMessage(GH_RuntimeMessageLevel.Warning,
          "Pattern index is out of range");
      }
    }

    //Outputs
    R = outputList;
# ---------- end gh_p_n_c ----------
p_n_c = PickNChoose(Pattern=panel_24, Stream0=panel_25, Stream1=panel_26)
panel_27 = Panel(p_n_c)
panel_28 = Panel(gh_p_n_c.R)

# ---- group: Combine Data
data = Data([0, 1])
panel_29 = Panel(data)
panel_30 = Panel("""3.855469
2.020813
0.829993
4.925235
0.824293""")
gh_combine = CSharpScript(I0=panel_29, I1=panel_30)  # -> out, R, I; inputs I0: list, I1: list
# ---------- gh_combine: C# ----------
    //Component written by @bava-kumaravel
    //Combines data from two or more lists into an
    //an output list R with fewer nulls as possible

    //Declare an output list
    List<System.Object> outputList = new List<System.Object>();
    //Declare an index list to hold the indices of the list
    //which contribute items to the output list
    List<int> indicesList = new List<int>();

    //Get the available number of input lists provided
    int numberOfInputs = Component.Params.Input.Count;
    //Set the access types of all the input lists to list access
    for(int i = 0;i < numberOfInputs;i++){
      Component.Params.Input[i].Access = GH_ParamAccess.list;
    }

    //The total number of outputs in the output list is equal
    //to the length of the longest input list
    //Define a variable to hold it, and initiate it with 0
    int length = 0;
    //Go through list of input lists and find the longest
    for(int i = 0;i < numberOfInputs;i++){
      //Get the input list at index i
      IList currentList = Component.Params.Input[i].
        VolatileData.get_Branch(new GH_Path(0));
      if(currentList != null){
        //Get the length of the list if it is not null
        int currentLength = currentList.Count;
        //If the length of the current list exceeds the length
        //variable, update it with the current length value
        if(currentLength > length){
          length = currentLength;
        }
      }
    }

    //Go through the output list
    for(int i = 0;i < length;i++){
      //Define a variable to store the current item
      System.Object currentItem = null;
      //Also, define an integer to store the index
      //of the contributing list
      int listIndex = -1;

      //Go through the input lists and find the first
      //non-null item at index i (or at the last index
      //if index i does not exist in the list)
      for(int j = 0;j < numberOfInputs;j++){
        IList currentList = Component.Params.Input[j].
          VolatileData.get_Branch(new GH_Path(0));
        //Check if the current list is not null
        if(currentList != null){
          //If the list is not null, check if it has an
          //item at index i, else choose the last item
          if(i < currentList.Count){
            //If the index i is available
            if(currentList[i] != null){
              //If the item is not null, assign it to the
              //current item variable
              currentItem = currentList[i];
              //Set list index as j
              listIndex = j;
              break;
            }
          }
          else{
            //If the index is not available, check if
            //last index is not null
            if(currentList[currentList.Count - 1] != null){
              currentItem = currentList[currentList.Count - 1];
              //Set list index as j
              listIndex = j;
              break;
            }
          }
        }
      }
      //Add the current item to the output list
      outputList.Add(currentItem);
      indicesList.Add(listIndex);
    }

    //Outputs
    R = outputList;
    I = indicesList;
# ---------- end gh_combine ----------
combine = CombineData(Input0=panel_29, Input1=panel_30)  # -> Result, Index
panel_31 = Panel(combine.Result)
panel_32 = Panel(gh_combine.R)
panel_33 = Panel(combine.Index)
panel_34 = Panel(gh_combine.I)

# ---- group: Insert Items
number_slider = Slider(8, range=0..10)
number_slider_2 = Slider(10, range=0..10)
toggle = BooleanToggle(False)
# GH#: A C# dictionary of Grasshopper3D components.
# 
# This file contains a category of Grasshopper components, and a mirroring C#/RhinoCommon implementation.
# 
# This is an educational project initiated by students/faculty of GSD-6338: Introduction to Computational Design, at the Harvard Graduate School of Design.
# 
# More information: {{project link}}
# Sets List
panel_35 = Panel("""1
2
3
4
5""")
gh_ins = CSharpScript(LIn=panel_35, I=number_slider, i=number_slider_2, W=toggle)  # -> out, LOut; inputs LIn: list, I: list, i: list of Int32, W: Boolean
# ---------- gh_ins: C# ----------
    //Component written by @bava-kumaravel
    //Inserts a list of items I, in a list LIn at indices i

    //Define an output list
    //Initiate it with the input list LIn
    List<System.Object> outputList = LIn;

    //Sanity Check
    //Check if atleast one index i is supplied
    if(i.Count == 0){
      //Else, Give a warning and stop execution
      Component.AddRuntimeMessage(GH_RuntimeMessageLevel.Warning,
        "Input parameter i failed to collect data");
      return;
    }

    //Check if the number of items and indices supplied are
    //equal in number if they are more than 1
    if(i.Count > 1 && I.Count > 1 && i.Count != I.Count){
      //Else, Give an error and stop execution
      Component.AddRuntimeMessage(GH_RuntimeMessageLevel.Error,
        "You should supply equal amounts of items and indices.");
      return;
    }

    //Scenario 1:
    //Null item or single item
    if(I.Count <= 1){

      //Declare a variable to hold the item to be inserted
      //Initiate it with null
      System.Object item = null;
      if(I.Count == 1){
        //If there is one element in the insertion list,
        //assign it to the item variable
        item = I[0];
      }

      //Go through the list of indices and wrap them if necessary
      //Declare a list to hold the updated indices
      List<int> indices = new List<int>();
      for(int j = 0;j < i.Count;j++){
        //Get the index at the current value of j
        int index = i[j];
        //Check if the index exceeds the length of the input list
        if(index > LIn.Count){
          //If Wrap is true, wrap it within the length of the list
          if(W){
            index = index % (LIn.Count + 1);
          }
        }
        indices.Add(index);
      }

      //Sort the list of indices
      indices.Sort();

      //Go through the list of updated indices and insert the
      //null item accordingly
      for(int j = indices.Count - 1;j >= 0;j--){
        //Get the index at the current value of j
        int index = indices[j];
        //Check if the index exceeds the length of the input list
        //in which case add nulls until the insertion index is reached
        if(index > LIn.Count){
          //Calculate the amount of null items to be added
          int nulls = index - LIn.Count;
          for(int k = 0;k < nulls;k++){
            outputList.Add(null);
          }
        }
        outputList.Insert(index, item);
      }
    }

      //Scenario 2:
      //Multiple items
    else{
      
      //We declare a datatree to group items according to
      //their insertion indices (which will be the path indices)
      DataTree<System.Object> items = new DataTree<System.Object>();
      //Go through the list of insertion items and indices to
      //populate the data tree
      for(int j = 0;j < i.Count;j++){
        //Get the item and the index at the value of j
        System.Object item = I[j];
        int index = i[j];
        //Check if the index exceeds the length of the input list
        if(index > LIn.Count){
          //If Wrap is true, wrap it within the length of the list
          if(W){
            index = index % (LIn.Count + 1);
          }
        }
        //Define a datatree path using the index
        GH_Path pathIndex = new GH_Path(index);
        //Add the item at the pathIndex in the datatree
        items.Add(item, pathIndex);
      }

      //Go through the branches in the datatree and add the
      //items in each branch to their respective indices
      for(int j = items.BranchCount - 1;j >= 0;j--){
        //Get the index from the branch
        int index = items.Path(j).Indices[0];
        Print("index: " + index);
        //Check if the index exceeds the length of the input list
        //in which case add nulls until the insertion index is reached
        if(index > LIn.Count){
          //Calculate the amount of null items to be added
          int nulls = index - LIn.Count;
          for(int k = 0;k < nulls;k++){
            outputList.Add(null);
          }
        }

        //Get the list of items at the current branch in the
        //data tree and insert them in the output list at the index
        List<System.Object> item = items.Branches[j];
        outputList.InsertRange(index, item);
      }
    }

    //Outputs
    LOut = outputList;
# ---------- end gh_ins ----------
ins = InsertItems(List=panel_35, Item=number_slider, Indices=number_slider_2, Wrap=toggle)
panel_36 = Panel(ins)
panel_37 = Panel(gh_ins.LOut)

# ---- group: Partition list
panel_38 = Panel("""1
2
3
4
5""")
panel_39 = Panel("""1
2
0
2""")
gh_partition = CSharpScript(L=panel_38, S=panel_39)  # -> out, C; inputs L: tree, S: list of Int32
# ---------- gh_partition: C# ----------
    //Component written by @bava-kumaravel
    //Partitions a list L into sub-lists based on lengths in the list S

    //Declare a datatree to hold the output
    DataTree<System.Object> subLists = new DataTree<System.Object>();

    //Go through input data tree of lists
    for(int branchIndex = 0; branchIndex < L.BranchCount;branchIndex++){
      List<System.Object> list = L.Branches[branchIndex];
      GH_Path parentPath = L.Paths[branchIndex];

      //Calculate how many times the list needs to be looped
      //to be fully partitioned
      //To find that, get the sum of the partitions
      int total = 0;
      foreach(int part in S){
        if(part > 0){
          total += part;
        }
      }
      //Check if the total is greater than 0
      if(total > 0){
        //Divide the length of the parent list by the total to find
        //how many times the list needs to be looped
        double division = (double) list.Count / (double) total;
        //Round off the division result to the next highest integer
        int looptimes = (int) Math.Ceiling(division);
        //Declare an integer to hold the branch paths
        int branch = 0;

        //Loop through the parent list
        for(int loop = 0;loop < looptimes;loop++){
          //Go through list of partition lengths
          for(int i = 0;i < S.Count;i++){
            //Define a sublist
            List<System.Object> sublist = new List<System.Object>();
            //Get the length of the partition
            int length = S[i];
            //Check if the length is not negative
            if(length < 0){
              //If it is negative, throw error
              Component.AddRuntimeMessage(GH_RuntimeMessageLevel.Error,
                "Partial list lengths cannot be negative.");
              //If there are still elements in the parent list, add a null
              //element in the sublist
              if(list.Count > 0){
                sublist.Add(null);
              }
            }
            else{
              //If it is positive, go through the list and create a sublist
              for(int j = 0;j < length;j++){
                if(list.Count > 0){
                  //If there are elements in the parent list, add the first to the sublist
                  sublist.Add(list[0]);
                  //Remove that element from the parent list
                  list.RemoveAt(0);
                }
                else{
                  //If the parent list doesnt have any elements left, break the loop
                  break;
                }
              }
            }
            //If the length of the sublist is more than 0, add it to the output data tree
            if(sublist.Count > 0){
              //Define a branch path
              GH_Path branchPath = parentPath.AppendElement(branch);
              //Add the sublist to the datatree at the branchpath
              subLists.AddRange(sublist, branchPath);
            }
            branch++;
          }
        }
      }
      else{
        //If the sum total of all the partitions is zero, throw an error
        Component.AddRuntimeMessage(GH_RuntimeMessageLevel.Error,
          "The sum-total of all partition sizes must be larger than zero");
      }
    }

    //Outputs
    C = subLists;
# ---------- end gh_partition ----------
partition = PartitionList(List=panel_38, Size=panel_39)
panel_40 = Panel(partition)
panel_41 = Panel(gh_partition.C)

# ---- group: Reverse List
panel_42 = Panel("""1
2
3
4
5""")
gh_rev = CSharpScript(LIn=panel_42)  # -> out, LOut; inputs LIn: list
# ---------- gh_rev: C# ----------
    //Component written by @bava-kumaravel
    //Reverses the order of the list LIn

    //Reverse the input list
    LIn.Reverse();

    //Output
    LOut = LIn;
# ---------- end gh_rev ----------
rev = ReverseList(List=panel_42)
panel_43 = Panel(rev)
panel_44 = Panel(gh_rev.LOut)

# ---- group: Sort List
panel_45 = Panel("""3.855469
2.020813
0.829993
4.925235
0.545023""")
pt = Point([Point(2.486685842, 1.107439772, 0.9340213597), Point(8.75821514, 7.961442879, 0.4404517982), Point(0.960044973, 9.516898365, 0.9651758973), Point(9.142282707, 0.9184793154, 1.504984329), Point(4.419897676, 6.225770733, 1.422511779)])
gh_sort = CSharpScript(KIn=panel_45, AIn=pt)  # -> out, KOut, AOut; inputs KIn: list of Double, AIn: list
# ---------- gh_sort: C# ----------
    //Component written by @bava-kumaravel
    //Sorts a list of numeric keys KIn and an optional
    //list of values AIn along with them

    //Set the input parameter AIn as optional
    Component.Params.Input[1].Optional = true;

    //Check if the optional data list AIn is provided
    if(Component.Params.Input[1].VolatileDataCount > 0){
      //Check if both the keys and data are of equal length
      //Else throw an error and stop execution
      if(KIn.Count != AIn.Count){
        Component.AddRuntimeMessage(GH_RuntimeMessageLevel.Error,
          "Key and Value lists have different lengths, " +
          "synchronous sorting is impossible");
        return;
      }
      else{
        //Declare RhinoLists to hold the input data and keys
        RhinoList<System.Object> data = new RhinoList<System.Object>(AIn);
        RhinoList<double> keys = new RhinoList<double>(KIn);

        //Copy the keys KIn to an array
        double[] keysArray = KIn.ToArray();

        //Sort the data list using the keys array
        data.Sort(keysArray);

        //Sort the keys list
        keys.Sort();

        //Output
        AOut = data;
        KOut = keys;
      }
    }
    else{
      //Declare a RhinoList to hold the input keys KIn
      RhinoList<double> keys = new RhinoList<double>(KIn);

      //Sort the keys
      keys.Sort();

      //Output
      KOut = keys;
    }
# ---------- end gh_sort ----------
sort = SortList(Keys=panel_45, ValuesA=pt)  # -> Keys, ValuesA
panel_46 = Panel(sort.Keys)
panel_47 = Panel(gh_sort.KOut)
panel_48 = Panel(sort.ValuesA)
panel_49 = Panel(gh_sort.AOut)

# ---- group: Sub List
panel_50 = Panel("""3.855469
2.020813
0.829993
4.925235
0.545023""")
toggle_2 = BooleanToggle(False)
dom = ConstructDomain(DomainStart=Slider(6, range=0..10), DomainEnd=Slider(2, range=0..10))
gh_subset = CSharpScript(LIn=panel_50, D=dom, W=toggle_2)  # -> out, LOut, I; inputs LIn: list, W: Boolean
# ---------- gh_subset: C# ----------
    //Component written by @bava-kumaravel
    //Creates a sublist from a list LIn using an interval D

    //Get the endpoints of the interval I
    int min = (int) D.Min;
    int max = (int) D.Max;

    //Sanity Check
    //If wrap W is false and the minimum endpoint of interval
    //D exceeds the length of list L, the output is null
    if(!W && min >= LIn.Count){
      return;
    }

    //Case 1: Wrap W is true
    if(W){

      //Calculate the length of the output sublist
      int length = max - min + 1;

      //Declare arrays to hold the output sublist and
      //their indices
      System.Object[] subList = new System.Object[length];
      System.Object[] indices = new System.Object[length];

      //Populate the sublist
      for(int i = 0;i < length;i++){
        //Index of element to assign to sublist is the
        //sum of the start of interval and iterator i
        //wrapped with the length of the input list
        int index = (min + i) % LIn.Count;
        //Assign the elements to the sublist
        subList[i] = LIn[index];
        //Assign the index to the list of indices
        indices[i] = index;
      }

      //Outputs
      LOut = subList;
      I = indices;
    }

      //Case 2: Wrap W is false
    else{
      //Calculate the length of the output sublist
      int length = LIn.Count - min;

      //Declare arrays to hold the output sublist and
      //their indices
      System.Object[] subList = new System.Object[length];
      System.Object[] indices = new System.Object[length];

      //Populate the sublist
      for(int i = 0;i < length;i++){
        //Index of element to assign to sublist is the
        //sum of the start of interval and iterator i
        int index = min + i;
        //Assign the elements to the sublist
        subList[i] = LIn[index];
        //Assign the index to the list of indices
        indices[i] = index;
      }

      //Outputs
      LOut = subList;
      I = indices;
    }
# ---------- end gh_subset ----------
subset = SubList(List=panel_50, Domain=dom, Wrap=toggle_2)  # -> List, Index
panel_51 = Panel(subset.List)
panel_52 = Panel(gh_subset.LOut)
panel_53 = Panel(subset.Index)
panel_54 = Panel(gh_subset.I)

# ---- group: Shift List
panel_55 = Panel("""1
2
3
4
5""")
number_slider_3 = Slider(2, range=0..10)
toggle_3 = BooleanToggle(True)
gh_shift = CSharpScript(LIn=panel_55, S=number_slider_3, W=toggle_3)  # -> out, LOut; inputs LIn: list, S: Int32, W: Boolean
# ---------- gh_shift: C# ----------
    //Component written by @bava-kumaravel
    //Shifts an input list LIn by an offset S

    //Check if the offset exceeds the length of the list
    //given wrap is false, in which case, stop execution
    if(!W && S >= LIn.Count){
      return;
    }

    //Case 1: If wrap is true
    if(W){

      //Declare an array to hold the shifted list
      //of length equal to the length of the input list
      System.Object[] shiftedList = new System.Object[LIn.Count];

      //Assign values to the shifted list
      for(int i = 0;i < LIn.Count;i++){
        //The index of the item from the input list is equal
        //to sum of i and the offset S
        int index = i + S;
        //Check if index exceeds the length of the input list
        //In which case, wrap it
        if(index >= LIn.Count){
          index = index % LIn.Count;
        }
        //Assign the item LIn[index] as the current item in the
        //shifted list [i]
        shiftedList[i] = LIn[index];
      }

      //Outputs
      LOut = shiftedList;
    }

      //Case 2: If wrap is false
    else{
      //Declare an array to hold the output list
      //of length equal to the difference of input list length
      //and the shift offset
      System.Object[] shiftedList = new System.Object[LIn.Count - S];

      //Assign values to the shifted list
      for(int i = 0;i < shiftedList.Length;i++){
        //The index of the item from the input list is equal
        //to sum of i and the offset S
        int index = i + S;
        //Assign the item at this index in the input list
        //as the current item in the shifted list
        shiftedList[i] = LIn[index];
      }

      //Outputs
      LOut = shiftedList;
    }
# ---------- end gh_shift ----------
shift = ShiftList(List=panel_55, Shift=number_slider_3, Wrap=toggle_3)
panel_56 = Panel(shift)
panel_57 = Panel(gh_shift.LOut)

# ---- group: Split List
panel_58 = Panel("""1
2
3
4
5""")
number_slider_4 = Slider(2, range=0..10)
gh_split = CSharpScript(L=panel_58, i=number_slider_4)  # -> out, A, B; inputs L: list, i: Int32
# ---------- gh_split: C# ----------
    //Component written by @bava-kumaravel
    //Splits a list L into two parts A and B at the given index i

    //Check if the index lies within the length of list L
    if(i < L.Count){
      //Calculate the lengths of both sublists A and B
      //Length of sublist A is equal to the splitting index i
      int countA = i;
      //Length of sublist B is the difference between the
      //length of input list L and the splitting index i
      int countB = L.Count - i;

      //Declare two arrays to hold the two sublists A and B
      System.Object[] sublistA = new System.Object[countA];
      System.Object[] sublistB = new System.Object[countB];

      //Copy the elements from the input list L into the respective sublists
      L.CopyTo(0, sublistA, 0, countA);
      L.CopyTo(i, sublistB, 0, countB);

      //Outputs
      A = sublistA;
      B = sublistB;
    }

      //If the index exceeds the length of list L
    else{
      //Sublist A is equal to list L and Sublist B is null
      //Outputs
      A = L;
    }
# ---------- end gh_split ----------
split = SplitList(List=panel_58, Index=number_slider_4)  # -> ListA, ListB
panel_59 = Panel(split.ListA)
panel_60 = Panel(gh_split.A)
panel_61 = Panel(gh_split.B)
panel_62 = Panel(split.ListB)

# ---- group: Null Item
mesh = Mesh(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)
gh_null = CSharpScript(I=mesh)  # -> out, N, X, D
# ---------- gh_null: C# ----------
    //Component written by @bava-kumaravel
    //Check if an item I is null or invalid

    //Declare variables to hold the outputs
    bool isNull = true;
    bool isValid = true;
    string description = "";

    if(I == null){
      isNull = true;
      isValid = false;
      description = "Data does not exist";
    }
    else{
      isNull = false;
      //To check for validity, check if the object
      //is a geometry type
      if(I.GetType().BaseType.ToString() ==
      "Rhino.Geometry.GeometryBase"){
        //If so, cast the object into a GeometryBase instance
        GeometryBase geo = (GeometryBase) I;
        //Check for validity
        isValid = geo.IsValidWithLog(out description);
      }
      else{
        //Else, check if the data is a number
        //Both int and double can be checked with the double check
        if(I.GetType().IsPrimitive &&
        I.GetType().Name == "Double"){
          //If it is a double, cast it into a double variable
          double val = (double) I;
          //Check for its validity
          if(RhinoMath.IsValidDouble(val)){
            Print("Number is equal to the RhinoMath.UnsetValue constant.");
          }
        }
      }
    }

    //Outputs
    N = isNull;
    X = !isValid;
    D = description;
# ---------- end gh_null ----------
null = NullItem(Item=mesh)  # -> NullFlags, InvalidFlags, Description
panel_63 = Panel(null.NullFlags)
panel_64 = Panel(null.InvalidFlags)
panel_65 = Panel(null.Description)
panel_66 = Panel(gh_null.N)
panel_67 = Panel(gh_null.X)
panel_68 = Panel(gh_null.D)

# ---- group: Sift Pattern
panel_69 = Panel("""3.855469
2.020813
0.829993
4.925235
0.824293""")
panel_70 = Panel("""1
1
0
2""")
gh_sift = CSharpScript(L=panel_69, P=panel_70)  # -> out, O0, O1, A; inputs L: list, P: list of Int32
# ---------- gh_sift: C# usings ----------
using System.IO;
using System.Linq;
using System.Data;
using System.Drawing;
using System.Reflection;
using System.Windows.Forms;
using System.Xml;
using System.Xml.Linq;
using System.Runtime.InteropServices;

using Rhino.DocObjects;
using Rhino.Collections;
using GH_IO;
using GH_IO.Serialization;
# ---------- gh_sift: C# ----------
    //Component written by @bava-kumaravel
    //Sifts a list L using a recurring integer pattern P
    //and returns two or more lists

    //NOTE//
    //Since we are working with dynamic outputs in this component,
    //the variable to hold the outputs, outputTree is defined
    //as a persistent variable, outside the scope of the RunScript()
    //function. Also, from the outputTree, the outputs from each
    //branch are passed to their respective output parameters in
    //the AfterRunScript()function. Hence, before every execution
    //of the RunScript() function, we manually clear out all
    //the branches and data in the outputTree
    outputTree.Clear();

    //Get the available number of output lists provided
    int numberOfOutputs = Component.Params.Output.Count - 1;

    //Define a variable to hold  the total number of items
    //in the list L yet to be sifted
    //Initiate it with the total length of L
    int total = L.Count;

    //Initiate the output data tree with branches equal to
    //the number of outputs and null items in each branch
    //equal to the total number of elements in input list L
    for(int i = 0;i < numberOfOutputs;i++){
      //For every output list, add a new path
      GH_Path path = new GH_Path(i);
      //Define a list to hold the null items
      List<System.Object> list = new List<System.Object>();
      //Add null items to the list based on the total
      //number of items in the input list
      for(int j = 0;j < total;j++){
        list.Add(null);
      }
      //Add the list with nulls to the current branch of the
      //output tree
      outputTree.AddRange(list, path);
    }


    //While there are elements left in the list L (i.e., total>0)
    //Keep going through the pattern list P and keep sifting
    while(total > 0){
      for(int i = 0;i < P.Count;i++){
        //If total is less than 0, break the for loop
        if(total <= 0){
          break;
        }
        //Get the current value from pattern P
        int siftValue = P[i];
        //Also, get the current item from the input list
        //using total value
        int itemIndex = L.Count - total;
        System.Object currentItem = L[itemIndex];

        //Check if the sift value lies within the total number of
        //output lists available
        if(siftValue < numberOfOutputs){
          //Assign the current item to the coresponding branch
          //in the output data tree
          outputTree.Branches[siftValue][itemIndex] = currentItem;
        }
        else{
          //Display a warning message
          string warning = "Filter index " + siftValue +
            " is too high, data will be discarded entirely";
          Component.AddRuntimeMessage(GH_RuntimeMessageLevel.Warning,
            warning);
        }

        //Decrease the yet to be sifted total by 1
        total--;
      }
    }
# ---------- gh_sift: C# additional code ----------
  //Declare a data tree to hold all the output lists
  //Declare it as a persistent variable to access it outside the
  //RunScript() function
  DataTree<System.Object> outputTree = new DataTree<System.Object>();

  /// </summary>
  public override void AfterRunScript()
  {
    //Outputs
    //Derive the outputs from the outputs tree
    for(int i = 0;i < outputTree.BranchCount;i++){
      //Get the list at branch i from the output datatree
      List<System.Object> currentBranch = outputTree.Branches[i];
      //Assign the list to the corresponding output parameter
      //But first, clear the existing items in the output streams
      Component.Params.Output[i + 1].ClearData();
      Component.Params.Output[i + 1].AddVolatileDataList
        (new GH_Path(0), currentBranch);
    }
  }
# ---------- end gh_sift ----------
sift = SiftPattern(List=panel_69, SiftPattern=panel_70)  # -> Output0, Output1, Output2
panel_71 = Panel(sift.Output0)
panel_72 = Panel(gh_sift.O0)
panel_73 = Panel(sift.Output1)
panel_74 = Panel(gh_sift.O1)

# ---- group: Longest List
panel_75 = Panel("""1
2
3
4""")
panel_76 = Panel("""a
b
c
d
e
f
g
h
i
j
k""")
list_3 = ValueList({"Repeat First", "Repeat Last", "Interpolate", "Wrap", "Flip"}, selected="Repeat First")
gh_long = CSharpScript(Option=list_3, IA=panel_75, IB=panel_76)  # -> out, OA, OB; inputs Option: String, IA: list, IB: list
# ---------- gh_long: C# ----------
    //Component written by @bava-kumaravel
    //Grows a collection of lists to the length of the
    //longest list among them
    
    //NOTE//
    //Since we are working with dynamic outputs in this component,
    //the variable to hold the outputs, outputTree is defined
    //as a persistent variable, outside the scope of the RunScript()
    //function. Also, from the outputTree, the outputs from each
    //branch are passed to their respective output parameters in 
    //the AfterRunScript()function. Hence, before every execution
    //of the RunScript() function, we manually clear out all
    //the branches and data in the outputTree
    outputTree.Clear();

    //Get the available number of input lists provided
    int numberOfInputs = Component.Params.Input.Count - 1;
    //Set the access types of all the input lists to list access
    for(int i = 1;i <= numberOfInputs;i++){
      Component.Params.Input[i].Access = GH_ParamAccess.list;
    }
    //Get the number of output lists
    int numberOfOutputs = Component.Params.Output.Count - 1;

    //Sanity Check - Check if the number of inputs and number
    //of outputs are equal
    //If the outputs are lesser than the input lists, add the rest
    if(numberOfOutputs < numberOfInputs){
      //Calculate the number of output parameters needed
      int shortage = numberOfInputs - numberOfOutputs;
      for(int i = 0;i < shortage;i++){
        //Define a parameter
        Grasshopper.Kernel.Parameters.Param_ScriptVariable output =
          new Grasshopper.Kernel.Parameters.Param_ScriptVariable();
        //Assign its insertion index
        int index = numberOfOutputs + i + 1;
        //Get the name of the corresponding input parameter
        string inputName = Component.Params.Input[index].Name;
        //Define the name of the output parameter
        string outputName = "O" + inputName[inputName.Length - 1];
        //Assign name to the output parameter
        output.Name = outputName;
        output.NickName = outputName;
        Component.Params.RegisterOutputParam(output, index);
      }
    }
      //Likewise, if the number of outputs are in excess of
      //the number of inputs, delete the excess
    else if(numberOfOutputs > numberOfInputs){
      //Calculate the number of output parameters in excess
      int excess = numberOfOutputs - numberOfInputs;
      for(int i = excess;i > 0;i--){
        //Define the index
        int index = i + numberOfInputs;
        Grasshopper.Kernel.Parameters.Param_ScriptVariable output =
          (Grasshopper.Kernel.Parameters.Param_ScriptVariable)
          Component.Params.Output[index];
        Component.Params.UnregisterOutputParameter(output);
      }
    }

    //Go through the list of the inputs and find the length of
    //the longest list among them
    //Define an integer to hold the value
    int longLength = 0;
    for(int i = 1;i <= numberOfInputs;i++){
      //Get the input list at index i and its length
      IList currentList = Component.Params.Input[i].
        VolatileData.get_Branch(new GH_Path(0));
      if(currentList != null){
        int currentLength = currentList.Count;
        //If the current list's length is higher than the
        //longest length value, update the longest length
        //value with the current value
        if(currentLength > longLength){
          longLength = currentLength;
        }
      }
    }

    //Option 1: Repeat First
    if(Option == "Repeat First"){
      //We extend the shorter lists to the length of the longest
      //list by repeating their first element at the start

      //Go through the list of the input lists
      for(int i = 1;i <= numberOfInputs;i++){
        //Get the input list at index i
        IList currentList = Component.Params.Input[i].
          VolatileData.get_Branch(new GH_Path(0));
        if(currentList != null){
          int currentLength = currentList.Count;
          //Define an output list
          List<System.Object> outputList = new List<System.Object>();

          //If the current list's length is lesser than the
          //longest length value, extend it
          if(currentLength < longLength){
            //Calculate number of extras to be added
            int extra = longLength - currentLength;
            //Value to be added is the first element
            System.Object element = currentList[0];
            for(int j = 0;j < extra;j++){
              outputList.Add(element);
            }
          }

          //Add the rest elements from input list to the output list
          for(int j = 0;j < currentLength;j++){
            outputList.Add(currentList[j]);
          }

          //Add the output list to the output datatree
          outputTree.AddRange(outputList, new GH_Path(i));
        }
      }
    }

      //Option 2: Repeat Last
    else if(Option == "Repeat Last"){
      //We extend the shorter lists to the length of the longest
      //list by repeating their last element

      //Go through the list of the input lists
      for(int i = 1;i <= numberOfInputs;i++){
        //Get the input list at index i
        IList currentList = Component.Params.Input[i].
          VolatileData.get_Branch(new GH_Path(0));
        if(currentList != null){
          int currentLength = currentList.Count;
          //Define an output list
          List<System.Object> outputList = new List<System.Object>();
          //Copy values from input list to the output list
          for(int j = 0;j < currentLength;j++){
            outputList.Add(currentList[j]);
          }
          //If the current list's length is lesser than the
          //longest length value, extend it
          if(currentLength < longLength){
            //Calculate number of extras to be added
            int extra = longLength - currentLength;
            //Value to be added is the last element
            System.Object element = currentList[currentLength - 1];
            for(int j = 0;j < extra;j++){
              outputList.Add(element);
            }
          }

          //Add the output list to the output datatree
          outputTree.AddRange(outputList, new GH_Path(i));
        }
      }
    }

      //Option 3: Interpolate
    else if(Option == "Interpolate"){
      //We extend the shorter lists to the length of the longest
      //list by interpolating them at regular intervals

      //This option gives outputs different from that of the
      //vanilla GH component
      Component.AddRuntimeMessage(GH_RuntimeMessageLevel.Warning,
        "Interpolate option gives outputs different from those of the vanilla GH Component");

      //Go through the list of the input lists
      for(int i = 1;i <= numberOfInputs;i++){
        //Get the input list at index i
        IList currentList = Component.Params.Input[i].
          VolatileData.get_Branch(new GH_Path(0));
        if(currentList != null){
          int currentLength = currentList.Count;
          //Define an output list
          List<System.Object> outputList = new List<System.Object>();
          //If the current list's length is lesser than the
          //longest length value, extend it
          if(currentLength < longLength){
            //Divide the shorter list into intervals to match
            //the longer list length and interpolate it using
            //the interval values
            double interval = ((double) currentLength - 1) /
              ((double) longLength - 1);
            for(int j = 0;j < longLength;j++){
              double currentInterval = interval * j;
              //Round off the interval to the closest list index
              int itemIndex = (int) Math.Round(currentInterval);
              //Add the element at this index to the output list
              System.Object element = currentList[itemIndex];
              outputList.Add(element);
            }
          }
          else{
            //If the list is the of the same length as the longest
            //list, add it as such to the output list
            for(int j = 0;j < currentLength;j++){
              outputList.Add(currentList[j]);
            }
          }

          //Add the output list to the output datatree
          outputTree.AddRange(outputList, new GH_Path(i));
        }
      }
    }

      //Option 4: Wrap
    else if(Option == "Wrap"){
      //We extend the shorter lists to the length of the longest
      //list by repeating their elements in the original order
      //until the desired length is reached
      //Go through the list of the input lists
      for(int i = 1;i <= numberOfInputs;i++){
        //Get the input list at index i
        IList currentList = Component.Params.Input[i].
          VolatileData.get_Branch(new GH_Path(0));

        if(currentList != null){
          int currentLength = currentList.Count;
          //Define an output list
          List<System.Object> outputList = new List<System.Object>();

          //First populate the output list with the existing elements
          //in the input list
          for(int j = 0;j < currentLength;j++){
            outputList.Add(currentList[j]);
          }

          //Then, If the current list's length is lesser than the
          //longest length value, extend it
          if(currentLength < longLength){

            //Calculate the excess needed
            int excess = longLength - currentLength;

            //Go through the list and keep adding its elements
            //to the output list until excess count is complete
            for(int j = 0;j < excess;j++){
              int itemIndex = j % currentLength;
              //Add the element at this index to the output list
              System.Object element = currentList[itemIndex];
              outputList.Add(element);
            }
          }
          //Add the output list to the output datatree
          outputTree.AddRange(outputList, new GH_Path(i));
        }
      }
    }

    //Option 5:Flip
    if(Option == "Flip"){
      //We extend the shorter lists to the length of the longest
      //list by flipping the order of the elements and adding
      //them until the desired length is achieved
      for(int i = 1;i <= numberOfInputs;i++){
        //Get the input list at index i
        IList currentList = Component.Params.Input[i].
          VolatileData.get_Branch(new GH_Path(0));

        if(currentList != null){
          int currentLength = currentList.Count;
          //Define an output list
          List<System.Object> outputList = new List<System.Object>();

          //First populate the output list with the existing elements
          //in the input list
          for(int j = 0;j < currentLength;j++){
            outputList.Add(currentList[j]);
          }

          //Then, If the current list's length is lesser than the
          //longest length value, extend it
          if(currentLength < longLength){

            //Calculate the excess needed
            int excess = longLength - currentLength;

            //Initiate a bool to hold the flip value
            bool flip = true;
            //Initiate the item index value with the last index
            int itemIndex = currentLength - 1;

            while(excess > 0){
              //Based on flip value, the item indexes decrease or
              //increase
              if(flip){
                itemIndex--;
              }
              else{
                itemIndex++;
              }
              //Get the element at this index and assign it to the
              //output list
              System.Object element = currentList[itemIndex];
              outputList.Add(element);
              //If the item index has reached the lower or upper
              //limit of the list, invert the flip value
              if(itemIndex == 0 || itemIndex == currentLength - 1){
                flip = !flip;
              }
              //Decrease the excess count by 1
              excess--;
            }
          }
          //Add the output list to the output datatree
          outputTree.AddRange(outputList, new GH_Path(i));
        }
      }
    }
# ---------- gh_long: C# additional code ----------
  //Define an output data tree
  //Define it as a persistent variable to use its values outside the
  //RunScript() function
  DataTree<System.Object> outputTree = new DataTree<System.Object>();

  /// <summary>
  /// This method will be called once every solution, after any calls to RunScript.
  /// </summary>
  public override void AfterRunScript()
  {
    //Outputs
    //Derive the outputs from the outputs tree
    for(int i = 0;i < outputTree.BranchCount;i++){
      //Get the list at branch i from the output datatree
      List<System.Object> currentBranch = outputTree.Branches[i];
      //Assign the list to the corresponding output list
      //First, clear the existing values in the output stream
      Component.Params.Output[i + 1].ClearData();
      Component.Params.Output[i + 1].AddVolatileDataList
        (new GH_Path(0), currentBranch);
    }
  }
# ---------- end gh_long ----------
long = LongestList(ListA=panel_75, ListB=panel_76, PaddingMode=1)  # -> ListA, ListB
panel_77 = Panel(long.ListA)
panel_78 = Panel(gh_long.OA)
panel_79 = Panel(long.ListB)
panel_80 = Panel(gh_long.OB)

# ---- group: Item Index
geo = Geometry([Point(1, 0, 0), Point(2, 0, 0), Point(3, 0, 0), Point(4, 0, 0), Point(5, 0, 0)])
item = ListItem(List=geo, Index=Slider(3, range=0..10), Wrap=True)
gh_index = CSharpScript(L=geo, iIn=item)  # -> out, iOut; inputs L: list
# ---------- gh_index: C# ----------
    //Component written by @bava-kumaravel
    //Retrieves the index iOut of an item IIn in a list L

    //Declare the input parameters as mandatory
    Component.Params.Input[0].Optional = false;
    Component.Params.Input[1].Optional = false;

    //Find the index
    int index = L.IndexOf(iIn);

    //Output
    iOut = index;
# ---------- end gh_index ----------
index = ItemIndex(List=geo, Item=item)
panel_81 = Panel(index)
panel_82 = Panel(gh_index.iOut)

# ----
panel_83 = Panel("""Null data
Data not found""")

# ---- group: Null Item
data_2 = Data([0, 1, 0])
panel_84 = Panel(data_2)
gh_nullrep = CSharpScript(IIn=panel_84, R=panel_83)  # -> out, IOut, N; inputs IIn: list, R: list
# ---------- gh_nullrep: C# ----------
    //Component written by @bava-kumaravel
    //Replaces null values in a list IIn with values from
    //a replacement list R

    //Define an output list and an integer to hold the
    //number of replacements
    List<System.Object> replacedList = new List<System.Object>();
    int numOfRep = 0;

    //Define an integer to hold the index of the replacement
    //value to be used from the replacement list R
    //Initiate it with 0
    int repIndex = 0;

    //Go through the input list
    for(int i = 0;i < IIn.Count;i++){
      //Get the item at index i in the input list
      System.Object currentItem = IIn[i];

      //Check if it is null
      if(currentItem == null){
        //Get the replacement item with the replacement Index
        System.Object replacement = R[repIndex];
        //Add the replacement element to the output list
        replacedList.Add(replacement);
        //Increase the number of replacements by 1
        numOfRep++;

        //Increase the value of the replacement index by 1
        //If it exceeds the length for the replacement list
        //make it equal to the last index in the list
        repIndex++;
        if(repIndex >= R.Count){
          repIndex = R.Count - 1;
        }
      }

      else{
        //If the item is not null, add it as it is to the
        //output list
        replacedList.Add(currentItem);
      }
    }

    //Outputs
    IOut = replacedList;
    N = numOfRep;
# ---------- end gh_nullrep ----------
nullrep = ReplaceNulls(Items=panel_84, Replacements=panel_83)  # -> Items, Count
panel_85 = Panel(nullrep.Items)
panel_86 = Panel(nullrep.Count)
panel_87 = Panel(gh_nullrep.IOut)
panel_88 = Panel(gh_nullrep.N)

# ---- group: List Item
number_slider_5 = Slider(3, range=0..10)
toggle_4 = BooleanToggle(True)
panel_89 = Panel("""1
2
3
4
5""")
gh_item = CSharpScript(L=panel_89, iIn=number_slider_5, W=toggle_4)  # -> out, iOut; inputs L: list, iIn: Int32, W: Boolean
# ---------- gh_item: C# ----------
    //Component written by @bava-kumaravel
    //Retrieves the item at index iIn in a list L

    //Define an object to hold the output item
    System.Object item = new System.Object();

    //Check if the index is within the length of the input list
    bool indexPresent = false;
    if(iIn < L.Count){
      indexPresent = true;
    }
    else{
      indexPresent = false;
    }

    if(indexPresent){
      //If the index is present, retrieve the item at the index i
      item = L[iIn];
    }
    else{
      //If the item is outside the range of the input list L
      //Check if wrap is true
      if(W){
        //If wrap is true, convert the index into a wrapped index
        int wrappedIndex = iIn % L.Count;
        item = L[wrappedIndex];
      }
      else{
        //If wrap is not true, throw an error and return null
        Component.AddRuntimeMessage(GH_RuntimeMessageLevel.Warning,
          "Supplied index is too high.");
        item = null;
      }
    }

    //Output
    iOut = item;
# ---------- end gh_item ----------
panel_90 = Panel(gh_item.iOut)

# ----
item_2 = ListItem(List=panel_89, Index=number_slider_5, Wrap=toggle_4)

# ---- group: List Item (continued)
panel_91 = Panel(item_2)

# ---- group: Replace Items
number_slider_6 = Slider(10, range=0..10)
number_slider_7 = Slider(3, range=0..10)
toggle_5 = BooleanToggle(True)
panel_92 = Panel("""1
2
3
4
5""")
gh_replace = CSharpScript(LIn=panel_92, I=number_slider_6, i=number_slider_7, W=toggle_5)  # -> out, LOut; inputs LIn: list, I: list, i: list of Int32, W: Boolean
# ---------- gh_replace: C# ----------
    //Component written by @bava-kumaravel
    //Replaces values at indices i in a list LIn
    //with the values in list i

    //Declare a list to hold the outputs
    //Initiate it with the input list
    List<System.Object> outputList = LIn;

    //Sanity Check
    //Check if the number of indices is either 1
    //or equal to the length of the replacement items
    if(i.Count == 0){
      //If no index is supplied, throw an error and
      //stop execution
      Component.AddRuntimeMessage(GH_RuntimeMessageLevel.Warning,
        "Input parameter i failed to collect data");
      return;
    }

    else if(i.Count > 1 && I.Count > 1
    && i.Count != I.Count){
      //If the number of indices and replacement items
      //are both over 1 and are unequal, throw an error
      //and stop execution
      Component.AddRuntimeMessage(GH_RuntimeMessageLevel.Error,
        "You should supply equal amounts of items and indices.");
      return;
    }

    //Scenario 1 - single index and multiple items
    if(i.Count == 1 && I.Count > 1){
      //Get the replacement index
      int index = i[0];
      //Check if the index is within the length
      //of the input list, else wrap it
      if(index >= outputList.Count){
        if(W){
          //Get the length of the output list
          int length = outputList.Count;
          //Calculate wrapped Index
          int wrappedIndex = index % length;
          index = wrappedIndex;
        }
        else{
          //Else if wrap is false, throw an error
          //and stop execution
          Component.AddRuntimeMessage(GH_RuntimeMessageLevel.Error,
            "Index too high, it must already exist within the original list");
          return;
        }
      }

      //Go through the outputlist and replace the
      //elements following the index with the items
      //in the replacement list
      for(int j = 0;j < I.Count;j++){
        int replacementIndex = j + index;
        if(replacementIndex < outputList.Count){
          //If the replacementIndex lies within the
          //length of the output list, replace the
          //value at the index
          outputList[replacementIndex] = I[j];
        }
        else{
          //If the replacement index exceeds the
          //output list length add the replacement
          //item at the end
          outputList.Add(I[j]);
        }
      }
    }

      //Scenario 2 - multiple indices and 1 item
    else if(I.Count == 1 && i.Count > 1){
      //Replace the same item at the multiple indices
      System.Object item = I[0];
      for(int j = 0;j < i.Count;j++){
        int index = i[j];
        //Check if the index is within the length
        //of the input list
        if(index < outputList.Count){
          outputList[index] = item;
        }
          //Else if it exceeds the length of the list,
          //check if wrap is true
        else{
          //If wrap is true, wrap the indices exceeding
          //the length ofthe output list
          if(W){
            //Get the length of the input list
            int length = outputList.Count;
            //Calculate wrapped Index
            int wrappedIndex = index % length;
            outputList[wrappedIndex] = item;
          }
          else{
            //Else if wrap is false, throw an error and
            //stop execution
            Component.AddRuntimeMessage(GH_RuntimeMessageLevel.Error,
              "Index too high, it must already exist within the original list");
            return;
          }
        }
      }
    }

      //Scenario 3 - Same number of items and indices
    else if(I.Count == i.Count){
      for(int j = 0;j < i.Count;j++){
        //Get the respective index and item
        System.Object item = I[j];
        int index = i[j];
        //Check if the index is within the length
        //of the input list
        if(index < outputList.Count){
          outputList[index] = item;
        }
          //Else if it exceeds the length of the list,
          //check if wrap is true
        else{
          //If wrap is true, wrap the indices exceeding
          //the length of the output list
          if(W){
            //Get the length of the output list
            int length = outputList.Count;
            //Calculate wrapped Index
            int wrappedIndex = index % length;
            outputList[wrappedIndex] = item;
          }
          else{
            //Else if wrap is false, throw an error and
            //stop execution
            Component.AddRuntimeMessage(GH_RuntimeMessageLevel.Error,
              "Index too high, it must already exist within the original list");
            return;
          }
        }
      }
    }

    //Output
    LOut = outputList;
# ---------- end gh_replace ----------
panel_93 = Panel(gh_replace.LOut)

# ----
replace = ReplaceItems(List=panel_92, Item=number_slider_6, Indices=number_slider_7, Wrap=toggle_5)

# ---- group: Replace Items (continued)
panel_94 = Panel(replace)

# ---- group: List Length
panel_95 = Panel("""1
2
3
4
5""")

# ----
gh_lng = CSharpScript(LIn=panel_95)  # -> out, LOut; inputs LIn: list
# ---------- gh_lng: C# ----------
    //Component written by @bava-kumaravel
    //Gets the length of a list LIn
    
    //Get the length
    int length = LIn.Count;
    
    //Output
    LOut = length;
# ---------- end gh_lng ----------
lng = ListLength(List=panel_95)

# ---- group: List Length (continued)
panel_96 = Panel(lng)
panel_97 = Panel(gh_lng.LOut)
