# Grasshopper definition Sets_Sequence.ghx (Grasshopper 1.0.4)

# ---- group: Cull Index
# GH#: A C# dictionary of Grasshopper3D components.
# 
# This file contains a category of Grasshopper components, and a mirroring C#/RhinoCommon implementation.
# 
# This is an educational project initiated by students/faculty of GSD-6338: Introduction to Computational Design, at the Harvard Graduate School of Design.
# 
# More information: {{project link}}
# Sets Sequence
panel = Panel("""1
2
3
4
5""")
number_slider = Slider(6, range=0..10)
toggle = BooleanToggle(True)
gh_cull_i = CSharpScript(LIn=panel, I=number_slider, W=toggle)  # -> out, LOut; inputs LIn: list, I: list of Int32, W: Boolean
# ---------- gh_cull_i: C# ----------
    //Component written by @bava-kumaravel
    //Removes from an input list LIn, items at indices specified
    //in list I

    //Sanity Check
    //Set the inputs LIn and I to be mandatory
    Component.Params.Input[0].Optional = false;
    Component.Params.Input[1].Optional = false;

    //Declare an output list
    List<System.Object> outputList = new List<System.Object>();

    //Go through the list of indices I and check if they
    //lie within the length of the input list LIn
    for(int i = 0; i < I.Count; i++){
      //Get the index at the value of I
      int index = I[i];
      //Check if the index is exceeding the length of the
      //input list LIn
      if(index >= LIn.Count){
        //If wrap W is true, calculate the wrapped index
        if(W){
          index = index % LIn.Count;
          //Update the indices list with the wrapped index
          I[i] = index;
        }
        else{
          //Show an error
          Component.AddRuntimeMessage(GH_RuntimeMessageLevel.Warning,
            "Culling index is out of range");
        }
      }
    }


    //Go through the input list and pass to the output list
    //only those elements whose indices do not occur in the
    //index list
    for(int i = 0 ; i < LIn.Count; i++){
      //Check if index i is not in the cull index list I
      if(!I.Contains(i)) {
        //Add the element to the output list
        outputList.Add(LIn[i]);
      }
    }

    //Output
    LOut = outputList;
# ---------- end gh_cull_i ----------
cull_i = CullIndex(List=panel, Indices=number_slider, Wrap=toggle)
panel_2 = Panel(cull_i)
panel_3 = Panel(gh_cull_i.LOut)

# ---- group: Cull Nth
panel_4 = Panel("""1
2
3
4
5""")
number_slider_2 = Slider(2, range=0..10)
gh_culln = CSharpScript(LIn=panel_4, N=number_slider_2)  # -> out, LOut; inputs LIn: list, N: Int32
# ---------- gh_culln: C# ----------
    //Component written by @bava-kumaravel
    //Culls (Removes) elements from a list LIn at a frequency N

    //Set the inputs to be mandatory
    Component.Params.Input[0].Optional = false;
    Component.Params.Input[1].Optional = false;

    //Sanity Check
    //Check if the frequency N is atleast 2, else throw an error
    //and stop execution
    if(N < 2){
      Component.AddRuntimeMessage(GH_RuntimeMessageLevel.Error,
        "Frequency must be at least 2");
      return;
    }

    //Declare an output list
    List<System.Object> outputList = new List<System.Object>();

    //Go through the input list
    for(int i = 0;i < LIn.Count;i++){
      //The frequence check begins with index 1, hence if the
      //index + 1 value is a multiple of N, then the element
      //will be culled
      if((i + 1) % N != 0){
        //If it is not a multiple of N, then add the corresponding
        //element to the output list
        outputList.Add(LIn[i]);
      }
    }

    //Output
    LOut = outputList;
# ---------- end gh_culln ----------
culln = CullNth(List=panel_4, CullFrequency=number_slider_2)
panel_5 = Panel(culln)
panel_6 = Panel(gh_culln.LOut)

# ---- group: Cull Pattern
panel_7 = Panel("""1
2
3
4
5""")
panel_8 = Panel("""False
True""")
gh_cull = CSharpScript(LIn=panel_7, P=panel_8)  # -> out, LOut; inputs LIn: list, P: list of Boolean
# ---------- gh_cull: C# ----------
    //Component written by @bava-kumaravel
    //Culls (Removes) elements in an input list LIn, based on a
    //recurring boolean pattern P

    //Set the input list parameter to be mandatory
    Component.Params.Input[0].Optional = false;
    
    //Declare an output list
    List<System.Object> outputList = new List<System.Object>();
    
    //Get the length of the input list
    int count = LIn.Count;
    
    //Define a counter index to go through the input list
    //Initialize it with 0
    int index = 0;
    
    //While there are still elements left in the input list
    //keep going through the boolean pattern P to cull the
    //input list
    while(count > 1){
      //Go through the boolean pattern P
      for(int i = 0;i < P.Count;i++){
        //Get the boolean value at index i
        bool filter = P[i];
        //If the filter value is true, add the corresponding
        //element to the output list
        if(filter){
          outputList.Add(LIn[index]);
        }
        //Increase the index counter by 1
        index++;
        //Decrease the value of count by 1
        count--;
      }
    }
    
    //Output
    LOut = outputList;
# ---------- end gh_cull ----------
cull = CullPattern(List=panel_7, CullPattern=panel_8)
panel_9 = Panel(cull)
panel_10 = Panel(gh_cull.LOut)

# ---- group: Random Reduce
panel_11 = Panel("""1
2
3
4
5""")
number_slider_3 = Slider(0, range=0..10)
number_slider_4 = Slider(10, range=0..10)
gh_reduce = CSharpScript(LIn=panel_11, R=number_slider_3, S=number_slider_4)  # -> out, LOut; inputs LIn: list, R: Int32, S: Int32
# ---------- gh_reduce: C# ----------
    //Component written by @bava-kumaravel
    //Reduce a list LIn by randomly removing R number of elements
    //from it

    //Declare LIn and R inputs to be mandatory
    Component.Params.Input[0].Optional = false;
    Component.Params.Input[1].Optional = false;

    //Declare an output list with the values from the input list
    RhinoList<System.Object> outputList = new RhinoList<System.Object>(LIn);

    //If the number of elements to be removed R is greater than 0,
    //execute the random reduce algorithm
    if(R > 0){
      //Define a random object
      System.Random rand = new System.Random(S);

      //Declare an array equal to the size of the input list
      //which will hold the random values that help shuffle the
      //output list
      double[] shuffler = new double[LIn.Count];

      //Loop through the input list and find a random number for
      //each element to be stored in the shuffler array
      for(int i = 0;i < LIn.Count;i++){
        //Generate a random double
        double randomNum = rand.NextDouble();
        //Add the random number to the shuffler array
        shuffler[i] = randomNum;
      }

      //Sort the output list using the shuffler array
      outputList.Sort(shuffler);

      //Remove R number of elements from the end of the output list
      for(int i = 0;i < R;i++){
        //If there are elements in the output list
        //remove the last element
        if(outputList.Count > 0){
          //The removal index is the index of the last element
          int index = outputList.Count - 1;
          outputList.RemoveAt(index);
        }
        else{
          //Else if it is empty, break the loop
          break;
        }
      }
    }
    
    //Outputs
    LOut = outputList;
# ---------- end gh_reduce ----------
reduce = RandomReduce(List=panel_11, Reduction=number_slider_3, Seed=number_slider_4)
panel_12 = Panel(reduce)
panel_13 = Panel(gh_reduce.LOut)

# ----
number_slider_5 = Slider(10, range=0..10)
gh_charseq = CSharpScript(C=number_slider_5, P="HELLO", F="GH {0} {0} SHARP")  # -> out, S; inputs C: Int32, P: String, F: String
# ---------- gh_charseq: C# ----------
    //Component written by @bava-kumaravel
    //Creates a sequence of C character combinations from a
    //string P and an optional format F

    //Define an output list to store the sequence of character combinations
    List<string> outputList = new List<string>();

    for(int i = 0;i < C;i++){
      string combination = getCombination(P, i);
      string output = String.Format(F, combination);
      outputList.Add(output);
    }

    S = outputList;
# ---------- gh_charseq: C# additional code ----------
  string getCombination(string word, int index){
    //Based on the index, find how many characters will be there
    //in the combination tring
    int numberOfCharacters = 0;
    //The counter adds the values of how many combinations of
    //textual characters are possible for the specified number
    //of characters
    int possibleCombinations = 0;
    int counter = -1;

    while(counter < index){
      numberOfCharacters++;
      //The possible combinations for every number of characters is the
      //input string's length raised to the power of the number of characters
      possibleCombinations = (int) Math.Pow(word.Length, numberOfCharacters);
      //The counter is incremented with the possible combinations
      counter += possibleCombinations;
      //The loop keeps executing until the counter exceeds the input index
      //meaning, the index requires a output string of length equal to the
      //current number of characters
    }

    //Declare a character array to store the individual characters
    //in the output combination string
    char[] characters = new char[numberOfCharacters];
    //Convert the input index into an index within the list of possible 
    //combinations for the current number of combinations
    int combinationIndex = index - counter + possibleCombinations - 1;
    
    //Populate the characters array
    for(int i = 0;i < numberOfCharacters;i++){
      //Calculate the index of the character to be referenced from
      //the input string
      int characterIndex = (int) Math.Floor(combinationIndex /
        (Math.Pow(word.Length, i))) % word.Length;
      //Using the index, fetch the respective character from the input string
      char character = word[characterIndex];
      //Add the character to the characters array in reverse
      characters[numberOfCharacters - i - 1] = character;
    }

    //Combine the characters array into a string and return it
    string combination = new string(characters);
    return combination;
  }
# ---------- end gh_charseq ----------
charseq = CharSequence(Count=number_slider_5, CharPool="HELLO", Format="GH {0} {0} SHARP")
panel_14 = Panel(charseq)
panel_15 = Panel(gh_charseq.S)

# ---- group: Duplicate Data
panel_16 = Panel("""1
2
3
4
5""")
number_slider_6 = Slider(2, range=0..10)
toggle_2 = BooleanToggle(True)
gh_dup = CSharpScript(DIn=panel_16, N=number_slider_6, O=toggle_2)  # -> out, DOut; inputs DIn: list, N: Int32, O: Boolean
# ---------- gh_dup: C# ----------
    //Component written by @bava-kumaravel
    //Duplicate a list of data DIn, N number of times

    //Declare the data list input as mandatory
    Component.Params.Input[0].Optional = false;

    //Declare an output list
    List<System.Object> outputList = new List<System.Object>();
    
    //If order O is true, duplicate the list N number of times
    //in the exact order
    if(O){
      //Loop N times and add the input list repeatedly to the
      //output list
      for(int i = 0;i < N;i++){
        outputList.AddRange(DIn);
      }
    }
    else{
      //Else if order O is false, add each item N times one
      //after the other
      //Go through the input list
      for(int i = 0;i < DIn.Count;i++){
        //Get the item at index i
        System.Object item = DIn[i];
        //Add the item N times
        for(int j = 0;j < N;j++){
          outputList.Add(item);
        }
      }
    }
    
    //Output
    DOut = outputList;
# ---------- end gh_dup ----------
dup = DuplicateData(Data=panel_16, Number=number_slider_6, Order=toggle_2)
panel_17 = Panel(dup)
panel_18 = Panel(gh_dup.DOut)

# ---- group: Fibonacci
number_slider_7 = Slider(2, range=0..10)
number_slider_8 = Slider(5, range=0..10)
number_slider_9 = Slider(2, range=0..10)
gh_fib = CSharpScript(A=number_slider_7, B=number_slider_8, N=number_slider_9)  # -> out, S; inputs A: Double, B: Double, N: Int32
# ---------- gh_fib: C# ----------
    //Component written by @bava-kumaravel
    //Creates a fibonacci sequence of N numbers from two starting
    //numbers A and B

    //Declare the output list to hold the fibonacci sequence
    List<double> fibSeq = new List<double>();

    //Add the elements A and B to the sequence
    fibSeq.Add(A);
    fibSeq.Add(B);

    //To find the fibonacci sequence,
    //the value at nth item = (n - 1)th item + (n - 2)th item
    for(int i = 0;i < N;i++){
      //The n index of an element is i+2 (As the first 2 elements
      //are already set
      int n = i + 2;
      //Find the next number
      double newNum = fibSeq[n - 1] + fibSeq[n - 2];
      //Add this number to the sequence
      fibSeq.Add(newNum);
    }

    //Output
    S = fibSeq;
# ---------- end gh_fib ----------
fib = Fibonacci(SeedA=number_slider_7, SeedB=number_slider_8, Number=number_slider_9)
panel_19 = Panel(fib)
panel_20 = Panel(gh_fib.S)

# ---- group: Range
number_slider_10 = Slider(3, range=0..10)
dom = ConstructDomain(DomainStart=Slider(6, range=0..10), DomainEnd=Slider(4, range=0..10))
gh_range = CSharpScript(D=dom, N=number_slider_10)  # -> out, R; inputs N: Int32
# ---------- gh_range: C# ----------
    //Component written by @bava-kumaravel
    //Creates a range of N numbers between a domain interval D

    //Define the output list
    List<System.Object> outputList = new List<System.Object>();

    //Get the lower and upper limits of the domain
    double lower = D.U0;
    double higher = D.U1;
    
    //If N is not not less than or equal to 0
    if(N > 0){
      //Calculate the interval with which individual steps will be
      //made in the range of numbers
      double interval = (higher - lower) / N;
    
      //Populate the output list, beginning with the lower limit 
      for(int i = 0;i <= N;i++){
        //The current value is the lower limit added by N times
        //the interval
        double currentNum = lower + (interval * i);
        outputList.Add(currentNum);
      }
    }
    
    //Outputs
    R = outputList;
# ---------- end gh_range ----------
range = Range(Domain=dom, Steps=number_slider_10)
panel_21 = Panel(range)
panel_22 = Panel(gh_range.R)

# ---- group: Repeat Data
panel_23 = Panel("""1
2
3
4
5""")
number_slider_11 = Slider(7, range=0..10)
gh_repeat = CSharpScript(DIn=panel_23, L=number_slider_11)  # -> out, DOut; inputs DIn: list, L: Int32
# ---------- gh_repeat: C# ----------
    //Component written by @bava-kumaravel
    //Repeat a list of data DIn until L number of items are reached
    //in the output list DOut

    //Declare the input parameters mandatory
    Component.Params.Input[0].Optional = false;
    Component.Params.Input[1].Optional = false;
    
    //Define an output list
    List<System.Object> outputList = new List<System.Object>();
    
    //Populate the output list by going through the elements
    //of the input list until L number of items are added to it
    for(int i = 0;i < L;i++){
      //Calculate the index of the element to be added
      int index = i % DIn.Count;
      //Add the element at this index to the output list
      outputList.Add(DIn[index]);
    }

    //Outputs
    DOut = outputList;
# ---------- end gh_repeat ----------
repeat = RepeatData(Data=panel_23, Length=number_slider_11)
panel_24 = Panel(repeat)
panel_25 = Panel(gh_repeat.DOut)

# ----
panel_26 = Panel("""1
2
4""")

number_slider_12 = Slider(15, range=0..100)
gh_seq = CSharpScript(N="[N-4]+[N-3]", L=number_slider_12, I=panel_26)  # -> out, S; inputs N: String, L: Int32, I: list of Double
# ---------- gh_seq: C# ----------
    //Component written by @bava-kumaravel
    //Generates a sequence of L numbers, using sequence initiators
    //in list I and a sequence notation N

    //Declare an output list to hold the sequence
    List<double> sequence = new List<double>();

    //Add the elements from the initiator list I to the sequence
    for(int i = 0;i < L;i++){
      //If index i is present within the initiator list, add the
      //respective item to the output sequence
      if(i < I.Count){
        sequence.Add(I[i]);
      }
      else{
        //Else if the index i is not within the scope of initiator
        //list I, then break the loop
        break;
      }
    }

    //Deconstruct the sequence notation into elements using the
    //square brackets which hold the N+x values denoting the index
    //Define a regular expression to get the values within the square
    //bracket separately
    System.Text.RegularExpressions.MatchCollection matches =
      System.Text.RegularExpressions.Regex.Matches(N, @"\[(.*?)\]");
    //Get the number of matches from the input notation
    int matchCount = matches.Count;
    //Declare lists to hold the expressions from the matches with and
    //without brackets
    List<string> expressions = new List<string>();
    List<string> expressionsWithBrackets = new List<string>();
    //Go through the matches and check if the notations are of the
    //format N - x
    for(int i = 0;i < matchCount;i++){
      //Get the string enclosed in the square brackets from the match
      string expression = matches[i].Groups[1].Value;
      //Check the expression with the format of N - x
      bool correct = System.Text.RegularExpressions.Regex.
        IsMatch(expression, @"^N\-[1-9]+$");
      //If the boolean is false, throw an error and stop execution
      if(!correct){
        Component.AddRuntimeMessage(GH_RuntimeMessageLevel.Error,
          "Solution exception:Sequence notation parser did not resolve correctly for: " + expression);
        return;
      }
      else{
        //Add the matching expressions to an expression list
        expressions.Add(expression);
        //Also get the expression with brakcets from the match and add it
        //to the respective list
        string expressionWithBrackets = matches[i].Groups[0].Value;
        expressionsWithBrackets.Add(expressionWithBrackets);
      }
    }

    //If the expression is valid, pass it as a remark in the component
    Component.AddRuntimeMessage(GH_RuntimeMessageLevel.Remark, N);

    //Loop through the outputlist until length L and add values to
    //the sequence
    for(int i = I.Count;i < L;i++){
      //Store the sequence notation in a local variable, to update
      //it with the items from the sequence
      string notation = N;
      //Go through the expressions list and solve them to find
      //the indices of the items to be referenced from the sequence
      //to update them in the notation
      for(int j = 0;j < matchCount;j++){
        //Get the expression at index j
        string expression = expressions[j];
        //Replce the letter N in the expression with the current index i
        expression = expression.Replace("N", i.ToString());
        //Solve the expression and find the index
        int index = (int) RhinoMath.ParseNumber(expression);
        //Get the item in the sequence using this index
        //if the index is positive
        double item = 0;
        if(index >= 0){
          item = sequence[index];
        }
        //Replace the expression with brackets in the original format with
        //the current item
        string expressionWithBrackets = expressionsWithBrackets[j];
        notation = notation.Replace(expressionWithBrackets, item.ToString());
      }
      //Solve the notation replaced with the items to find the current item
      double currentItem = RhinoMath.ParseNumber(notation);
      //Add the current item to the sequence list
      sequence.Add(currentItem);
    }

    //Outputs
    S = sequence;
# ---------- end gh_seq ----------
seq = Sequence(Notation="[N-4]+[N-3]", Length=number_slider_12, Initial=panel_26)
panel_27 = Panel(seq)
panel_28 = Panel(gh_seq.S)

# ---- group: Series
number_slider_13 = Slider(6, range=0..10)
number_slider_14 = Slider(4, range=0..10)
number_slider_15 = Slider(8, range=0..10)
gh_series = CSharpScript(SIn=number_slider_13, N=number_slider_14, C=number_slider_15)  # -> out, SOut; inputs SIn: Double, N: Double, C: Int32
# ---------- gh_series: C# ----------
    //Component written by @bava-kumaravel
    //Creates a series of C numbers starting at SIn, with a 
    //step size of N
    
    //Define an output list to store the series of numbers
    List<double> series = new List<double>();
    
    //Populate the list with C number of items
    for(int i = 0;i < C;i++){
      //The current number is equal to the starting number
      //added by the step size times i
      double number = SIn + (i * N);
      //Add the number to the series
      series.Add(number);
    }
    
    //Output
    SOut = series;
# ---------- end gh_series ----------
series = Series(Start=number_slider_13, Step=number_slider_14, Count=number_slider_15)
panel_29 = Panel(series)
panel_30 = Panel(gh_series.SOut)

# ---- group: Stack Data
panel_31 = Panel("""A
B
C
D
E
F""")
panel_32 = Panel("""1
0
4
3""")
gh_stack = CSharpScript(DIn=panel_31, S=panel_32)  # -> out, DOut; inputs DIn: list, S: list of Int32
# ---------- gh_stack: C# ----------
    //Component written by @bava-kumaravel
    //Duplicate individual items in a list of data a certain
    //number of times as mentioned in the list S

    //Define an output list
    List<System.Object> outputList = new List<System.Object>();

    //Declare a variable to hold the index of the duplicating
    //pattern list
    int dupIndex = 0;

    //Loop through the input list
    for(int i = 0;i < DIn.Count;i++){
      //Get the item at index i
      System.Object item = DIn[i];
      //Get the number of time the item needs to be duplicated
      int dupNum = S[dupIndex];
      //Add the item to the outputlist 'dupNum' number of times
      for(int j = 0; j < dupNum;j++){
        outputList.Add(item);
      }
      //Increase the duplicating list index by 1
      dupIndex++;
      //Check if it is exceeding the length of the duplicating list
      //in which case set it back to 0
      if(dupIndex >= S.Count){
        dupIndex = 0;
      }
    }

    //Outputs
    DOut = outputList;
# ---------- end gh_stack ----------
stack = StackData(Data=panel_31, Stack=panel_32)
panel_33 = Panel(stack)
panel_34 = Panel(gh_stack.DOut)

# ---- group: Jitter
panel_35 = Panel("""1
2
3
4
5""")
number_slider_16 = Slider(0.5, range=0..1)
number_slider_17 = Slider(8, range=0..10)
gh_jitter = CSharpScript(L=panel_35, J=number_slider_16, S=number_slider_17)  # -> out, V, I, A; inputs L: list, J: Double, S: Int32
# ---------- gh_jitter: C# ----------
    //Component written by @bava-kumaravel
    //Randomly shuffle a list of data L using a jitter value J
    //and seed S

    //WIP
    Component.AddRuntimeMessage(GH_RuntimeMessageLevel.Warning,
      "Gives outputs different from those of the vanilla GH component");

    //Declare the input list mandatory
    Component.Params.Input[0].Optional = false;

    //Define an output list and index list
    RhinoList<System.Object> outputList = new RhinoList<System.Object> (L);
    RhinoList<int> indexList = new RhinoList<int>();
    //Populate index list
    
    for(int i = 0;i < L.Count;i++){
      indexList.Add(i);
    }

    //Define a random object with seed S
    System.Random rand = new System.Random(S);

    //Contain the value of Jitter J within 0.0 and 1.0
    //If it is lesser than 0, set its value to 0 and if
    //it exceeds 1, set its value to one
    if(J < 0){
      J = 0;
    }
    else if(J > 1){
      J = 1;
    }
    
    //Multiply the jitter strength with the length of the 
    //list L
    double r = J * (double)L.Count;

    //Declare a sorter list
    double[] sorter = new double[L.Count];

    for(int i = 0;i < L.Count;i++){
      //Calculate domain of randomization for each value of i
      //And contain it within the 0 and the length of the list
      double min = Math.Max(i - r, 0.0);
      double max = Math.Min(i + r, L.Count);
      //Get a random double
      double randomNum = rand.NextDouble();
      //Interpolate this double within the min and max limits
      double val = min + (randomNum * (max - min));
      //Add the interpolated value to the sorter array
      sorter[i] = val;
    }

    //Sort the output and indices lists with the sorter array
    outputList.Sort(sorter);
    indexList.Sort(sorter);

    //Outputs
    V = outputList;
    I = indexList;
# ---------- end gh_jitter ----------
jitter = Jitter(List=panel_35, Jitter=number_slider_16, Seed=number_slider_17)  # -> Values, Indices
panel_36 = Panel(gh_jitter.V)
panel_37 = Panel(jitter.Values)
panel_38 = Panel(jitter.Indices)
panel_39 = Panel(gh_jitter.I)

# ---- group: Random
number_slider_18 = Slider(3, range=0..10)
number_slider_19 = Slider(3, range=0..10)
dom_2 = ConstructDomain(DomainStart=Slider(2, range=0..10), DomainEnd=Slider(4, range=0..10))
gh_random = CSharpScript(RIn=dom_2, N=number_slider_18, S=number_slider_19)  # -> out, ROut; inputs N: Int32, S: Int32
# ---------- gh_random: C# ----------
    //Component written by @bava-kumaravel
    //Creates a list of N random numbers ROut with the seed S
    //within the domain of RIn

    //Define a random object with seed S
    System.Random rand = new System.Random(S);

    //Define an output list
    List<System.Object> outputList = new List<System.Object>();

    //Get the minimum and maximum limits of the domain
    double min = RIn.U0;
    double max = RIn.U1;

    //Populate the output list
    for(int i = 0;i < N;i++){
      //Get a random double between 0.0 and 1.0
      double factor = rand.NextDouble();
      //Use this as a factor to find a random number
      //in the domain RIn
      double num = min + (factor * (max - min));
      //Add the random number to the output list
      outputList.Add(num);
    }

    //Outputs
    ROut = outputList;
# ---------- end gh_random ----------
random = Random(Range=dom_2, Number=number_slider_18, Seed=number_slider_19)
panel_40 = Panel(random)
panel_41 = Panel(gh_random.ROut)
