# Grasshopper definition Sets_Sets.ghx (Grasshopper 1.0.7)

panel = Panel("""5
3
1""")
panel_2 = Panel("""50
100
20""")
panel_3 = Panel("""8
4
2
10
1
3
0""")
entwine = Entwine(Branch00=panel, Branch01=panel_2, FlattenInputs=True)
gh_disjoint = CSharpScript(A=panel_3, B=entwine)  # -> out, R; inputs A: list, B: list
# ---------- gh_disjoint: C# ----------
    // Component written by @v-xup6

    // Test whether two sets are disjoint.

    // Check if list A contains any of the elements in B
    foreach(var obj in B){
      if(A.Contains(obj)){
        // If it A does contain elements in B, return false and stop searching.
        R = false;
        return;
      }
      else
        R = true;
    }
# ---------- end gh_disjoint ----------
disjoint = Disjoint(SetA=panel_3, SetB=entwine)
panel_4 = Panel(disjoint)
panel_5 = Panel(gh_disjoint.R)

panel_6 = Panel("""8
4
2
10
1
3
0""")
panel_7 = Panel("""5
3
1
7
2
6
5""")
gh_cprod = CSharpScript(A=panel_6, B=panel_7)  # -> out, P; inputs A: list, B: list
# ---------- gh_cprod: C# ----------
    // Component written by @v-xup6

    // Create the Carthesian product of two sets of identical cardinality

    this.Component.AddRuntimeMessage(
      GH_RuntimeMessageLevel.Warning,
      "Need to deal with path level issues, " +
      "Also not sure if this is indeed what the component does");

    // Output error message if length of two list isn't the same
    if(A.Count != B.Count){
      this.Component.AddRuntimeMessage(
        GH_RuntimeMessageLevel.Error,
        "A and B must have the same cardinality");
      return;
    }

    // Create data tree container to data
    var output = new DataTree<object>();

    // Add each element in the two lists to it's own branch
    for(int i = 0; i < A.Count - 2;i++){
      var path = new GH_Path(i);
      output.AddRange(new object[]{A[i],B[i]}, path);
    }

    // Output
    P = output;
# ---------- end gh_cprod ----------
cprod = CarthesianProduct(SetA=panel_6, SetB=panel_7)
panel_8 = Panel(cprod)
panel_9 = Panel(gh_cprod.P)

# ----
# Unable to understand the pattern of how it works
panel_10 = Panel("""0
1
2
3
0""")
panel_11 = Panel("""4
3
5""")
panel_12 = Panel("""1
2
3
4
5""")
majority = SetMajority(SetA=panel_12, SetB=panel_10, SetC=panel_11)
panel_13 = Panel(majority)

panel_14 = Panel("""0.1
1
0.5
2
2.3
5.2""")
panel_15 = Panel("""5
0.11""")
gh_fsim = CSharpScript(D=panel_15, S=panel_14)  # -> out, H, i; inputs S: list
# ---------- gh_fsim: C# ----------
    // Component by V-xup6
    
    // Find the most similar memeber in a set
    this.Component.AddRuntimeMessage(GH_RuntimeMessageLevel.Error, "Needs to deal with data conversion");
    
    // If thereare exact matchs, the follow works
    // but if there's data type conversion need then it won't
 /*
    // Find object in list that is similar
    var obj = S.Find(m => m.Equals(D));
    // If not found return the first item in list
    if(obj == null) obj = S[0];

    // Find index of the object that is similar
    var index = S.FindIndex(m => m.Equals(D));
    // If no similar object found return 0 for index
    if(index == -1)index = 0;

    // Output
    H = obj;
    i = index;
 */
# ---------- end gh_fsim ----------
fsim = FindSimilarMember(Data=panel_15, Set=panel_14)  # -> Hit, Index
panel_16 = Panel(fsim.Hit)
panel_17 = Panel(gh_fsim.H)
panel_18 = Panel(fsim.Index)
panel_19 = Panel(gh_fsim.i)

panel_20 = Panel("""5
3
1
7
2
6
0
4""")
panel_21 = Panel("""8
4
2
10
1
3
0""")
gh_difference = CSharpScript(A=panel_21, B=panel_20)  # -> out, U; inputs A: list, B: list
# ---------- gh_difference: C# usings ----------
using System.Linq;
# ---------- gh_difference: C# ----------
    // Component written by @v-xup6

    // Creates the difference of two sets (the collection of objects present in A but not in B)

    // Try to add all inputs into a hashset to create set of unique items
    HashSet<object> setList = new HashSet<Object>();
    foreach(var obj in A){
      setList.Add(obj);
    }
    // Try to subtract B from A
    foreach(var obj in B){
      setList.Remove(obj);
    }

    // Output
    U = setList;
# ---------- end gh_difference ----------
difference = SetDifference(SetA=panel_21, SetB=panel_20)
panel_22 = Panel(difference)
panel_23 = Panel(gh_difference.U)

panel_24 = Panel("""5
3
1
7
2
6
0
4""")
panel_25 = Panel("""8
4
2
10
1
3
0""")
gh_exdiff = CSharpScript(A=panel_25, B=panel_24)  # -> out, X; inputs A: list, B: list
# ---------- gh_exdiff: C# ----------
    // Component written by @v-xup6

    // Creates the symmetric difference of two sets (the collection of objects present in A or B bit not both)

    // Create large list of all the inputs
    List<object> inputs = new List<object>();
    inputs.AddRange(A);
    inputs.AddRange(B);

    // Create hashset and only add the object to the hashset if object isn't in both inputs lists
    HashSet<object> setList = new HashSet<Object>();
    foreach(var obj in inputs){
      bool a = A.Contains(obj);
      bool b = B.Contains(obj);
      if(a != b){
        setList.Add(obj);
      }
    }

    // Output
    X = setList;
# ---------- end gh_exdiff ----------
exdiff = SetDifferenceS(SetA=panel_25, SetB=panel_24)
panel_26 = Panel(exdiff)
panel_27 = Panel(gh_exdiff.X)

panel_28 = Panel("""10
11
12
13
14
15""")
panel_29 = Panel("""A
B
C
D
E
F""")
panel_30 = Panel("""5
10""")
gh_mindex = CSharpScript(K=panel_28, V=panel_29, S=panel_30)  # -> out, R; inputs K: list, V: list
# ---------- gh_mindex: C# ----------
    // Component written by @v-xup6

    // Extract an item from a collection using key-value match

    Dictionary<object,object> dict = new Dictionary<object,object>();

    for(int i = 0; i < K.Count;i++){
      if(!dict.ContainsKey(K[i]))
        dict.Add(K[i], V[i]);
    }

    dict.TryGetValue(S, out R);
    if(R==null)
      this.Component.AddRuntimeMessage(GH_RuntimeMessageLevel.Warning,
        "Search key [" + S + "] was not found");
# ---------- end gh_mindex ----------
keysearch = KeyValueSearch(Keys=panel_28, Values=panel_29, Search=panel_30)
panel_31 = Panel(gh_mindex.R)
panel_32 = Panel(keysearch)

panel_33 = Panel("""5
3
1
7
2
6
0
4""")
panel_34 = Panel("""8
4
2
10
1
3
0""")
gh_intersection = CSharpScript(A=panel_34, B=panel_33)  # -> out, U; inputs A: list, B: list
# ---------- gh_intersection: C# ----------
    // Component written by @v-xup6

    // Creates the intersection of two sets (the collection of unique objects present in both sets)

    // Create hashset and only add the object to the hashset if object is in both inputs lists
    HashSet<object> setList = new HashSet<Object>();
    foreach(var obj in B){
      if(A.Contains(obj)){
        setList.Add(obj);
      }
    }

    // Output
   U = setList;
# ---------- end gh_intersection ----------
intersection = SetIntersection(SetA=panel_34, SetB=panel_33)
panel_35 = Panel(gh_intersection.U)
panel_36 = Panel(intersection)

panel_37 = Panel("""5
3
1""")
panel_38 = Panel("""8
4
2
10
1
3
0
3""")
gh_mindex_2 = CSharpScript(S=panel_38, M=panel_37)  # -> out, I, N; inputs S: list
# ---------- gh_mindex_2: C# ----------
    // Component written by @v-xup6

    // Find the occurences of a spcific member in a set

    // A list to store all the index of matching objects
    List<int> index = new List<int>();

    // Loop thru the object list and check if any of them match
    // the member we want to check for
    for(int i = 0;i < S.Count;i++){
      // If the two objects match, record the index of when this happens
      // using Equals instead of == because the we're using Systems.Object
      // instead of a specific data type
      if(S[i].Equals(M))index.Add(i);
    }

    // Output
    I = index;
    N = S.FindAll(m => m.Equals(M)).Count;
    // FindAll extracts all the items in a list that matchs the condition.
    // Condition is expressed in lambda, for every item(m) in S, do/check (=>)
    // if m equals M.
    // Once all items are extracted we can simply count them using .Count
# ---------- end gh_mindex_2 ----------
mindex = MemberIndex(Set=panel_38, Member=panel_37)  # -> Index, Count
panel_39 = Panel(mindex.Index)
panel_40 = Panel(gh_mindex_2.I)
panel_41 = Panel(gh_mindex_2.N)
panel_42 = Panel(mindex.Count)

toggle = BooleanToggle(True)
panel_43 = Panel("""1
1
2
2
1
2
1
1""")
gh_dcon = CSharpScript(S=panel_43, W=toggle)  # -> out, Sout, N; inputs S: list, W: Boolean
# ---------- gh_dcon: C# ----------
    // Component written by @v-xup6
    
    // Delete consecutive similar membes in a set
    
    // Counter for duplicate counts
    int n = 0;

    // Start at end of list descending, stop when first item in list reached
    for(int i = S.Count - 1;i > 0;i--){
      // If Wrap and at end of list and last item equals the first item
      if(W && i == S.Count - 1 && S[i].Equals(S[0])){
        // Remove this duplicate
        S.RemoveAt(i);
        // Add to dup counter
        n++;
        // Next iteration
        continue;
      }
      // If this item equals the previous item on list
      // AKA if equals item of next iteration
      if(S[i].Equals(S[i - 1])){
        // Remove this item
        S.RemoveAt(i);
        // Add to dup counter
        n++;
      }
      // If not equal then no need to do anything
    }

    // Output
    Sout = S;
    N = n;
# ---------- end gh_dcon ----------
dcon = DeleteConsecutive(Set=panel_43, Wrap=toggle)  # -> Set, Count
panel_44 = Panel(gh_dcon.N)
panel_45 = Panel(dcon.Count)
panel_46 = Panel(dcon.Set)
panel_47 = Panel(gh_dcon.Sout)

panel_48 = Panel("""8
4
2
10
1
3
0
3""")
panel_49 = Panel("""5
3
1
3""")
panel_50 = Panel("""A
B
C
D""")
gh_mindex_3 = CSharpScript(S=panel_48, F=panel_49, R=panel_50)  # -> out, Re; inputs S: list, F: list, R: list
# ---------- gh_mindex_3: C# ----------
    // Component written by @v-xup6

    // Replace members in a set.
    
    // Length of list known, so use an array to store result
    System.Object[] replaced = new System.Object[S.Count];
    // Loop thru all the items in the set
    for(int i = 0; i < S.Count;i++){
      // If this item should be replaced
      if(F.Contains(S[i]))
        // Find the replacement value
        replaced[i] = R[F.IndexOf(S[i])];
      else
        // Id it doesn't need to be replaced, take item as is
        replaced[i] = S[i];
    }

    // Output
    Re = replaced;
# ---------- end gh_mindex_3 ----------
replace = ReplaceMembers(Set=panel_48, Find=panel_49, Replace=panel_50)
panel_51 = Panel(replace)
panel_52 = Panel(gh_mindex_3.Re)

panel_53 = Panel("""8
4
2
10
1
3
0""")
panel_54 = Panel("""3
1""")
gh_subset = CSharpScript(A=panel_53, B=panel_54)  # -> out, R; inputs A: list, B: list
# ---------- gh_subset: C# ----------
    // Component written by @v-xup6

    // Replace members in a set.

    // Go thru all the members (b) of B
    foreach(var b in B){
      // Check if A contains b, if not output false
      if(!A.Contains(b))
      {
        R = false;
        return;
      }
    }

    R = true;
# ---------- end gh_subset ----------
subset = SubSet(SetA=panel_53, SetB=panel_54)
panel_55 = Panel(subset)
panel_56 = Panel(gh_subset.R)

# ----
# GH#: A C# dictionary of Grasshopper3D components.
# 
# This file contains a category of Grasshopper components, and a mirroring C#/RhinoCommon implementation.
# 
# This is an educational project initiated by students/faculty of GSD-6338: Introduction to Computational Design, at the Harvard Graduate School of Design.
# 
# More information: {{project link}}
# Sets Sets
panel_57 = Panel("""5
3
1
7
1
2
6
3
2
0
5
0
0
4""")
gh_cset = CSharpScript(L=panel_57)  # -> out, S, M; inputs L: list
# ---------- gh_cset: C# ----------
    // Component written by @v-xup6

    // Creates a set of data without duplicates

    // Try to add all inputs into a hashset to create set of unique items
    HashSet<object> setList = new HashSet<Object>();
    foreach(var obj in L){
      setList.Add(obj);
    }
    
    // Array to store the member indices
    int[] members = new int[L.Count];
    // Convert hashset to Array to check for index
    object[] uniqueArray = setList.ToArray();
    for(int i = 0; i < L.Count;i++){
      members[i] = Array.IndexOf(uniqueArray, L[i]);
    }

    // Output
    S = setList;
    M = members;
# ---------- end gh_cset ----------
cset = CreateSet(List=panel_57)  # -> Set, Map
panel_58 = Panel(cset.Set)
panel_59 = Panel(gh_cset.S)
panel_60 = Panel(cset.Map)
panel_61 = Panel(gh_cset.M)

panel_62 = Panel("""5
3
1
7
2
6
0
4""")
panel_63 = Panel("""8
4
2
10
1
3
0""")
gh_intersection_2 = CSharpScript(A=panel_63, B=panel_62)  # -> out, U; inputs A: list, B: list
# ---------- gh_intersection_2: C# ----------
    // Component written by @v-xup6

    // Creates the union of two sets(the collection of unique objects present in either set)

    // Merge all inputs
    A.AddRange(B);
    // Create hashset and only add the object to the hashset if object is in both inputs lists
    HashSet<object> setList = new HashSet<object>();
    foreach(var obj in A){
      setList.Add(obj);
    }

    // Output
    U = setList;
# ---------- end gh_intersection_2 ----------
panel_64 = Panel(gh_intersection_2.U)

sunion = SetUnion(SetA=panel_63, SetB=panel_62)

panel_65 = Panel(sunion)
