# Grasshopper definition Sets_Text.ghx (Grasshopper 1.0.7)

# ---- group: Characters
# GH#: A C# dictionary of Grasshopper3D components.
# 
# This file contains a category of Grasshopper components, and a mirroring C#/RhinoCommon implementation.
# 
# This is an educational project initiated by students/faculty of GSD-6338: Introduction to Computational Design, at the Harvard Graduate School of Design.
# 
# More information: {{project link}}
# Sets Text
panel = Panel("$&H1)569Gr@")
chars = Characters(Text=panel)  # -> Result, Unicode
gh_char = CSharpScript(T=panel)  # -> C, U; inputs T: String
# ---------- gh_char: C# ----------
    // Component written by @sonomirco

    // The component breaks the string in singular character and also passed a Unicode
    // https://en.wikipedia.org/wiki/Unicode

    // Global variables
    // Once we know the dimension of the container and we don't have to perform heavy operations through the list,
    // better to use arrays that are lighter containers in terms of memory.
    // We define the dimension of the array as the length of string, and because a string is a list of characters has
    // a length property.
    string[] letters = new string[T.Length];
    int[] unicodeLetterValues = new int[T.Length];

    // Initialize a variable int that we will use as a counter for the while loop.
    int index = 0;

    // All the collection start with the first value at index zero, we iterate the loop for the length of string minus 1.
    while(index <= T.Length - 1)
    {
      // Retrieving the character.
      // Because the string is a list of characters, we have just to pass the index to the string and we have the character back.
      char character = T[index];

      // We convert the character that is a type char, to string and collect it inside the array.
      letters[index] = character.ToString();

      // We cast the character in int to retrieve the Unicode of the char and collect it inside the array.
      unicodeLetterValues[index] = (int) character;
      ++index;
    }

    // Outputs
    C = letters;
    U = unicodeLetterValues;
# ---------- end gh_char ----------
panel_2 = Panel(chars.Result)
panel_3 = Panel(gh_char.C)
panel_4 = Panel(chars.Unicode)
panel_5 = Panel(gh_char.U)

# ---- group: Format
panel_6 = Panel("""{0:#0,0}
GH#{1}""")
int = Integer("50800")
culture = Culture(3081)
format = Format(Format=panel_6, Culture=culture, Data0=int, Data1="Format")
gh_format = CSharpScript(F=panel_6, C=culture, a=int, b="Format")  # -> T; inputs F: String, C: String
# ---------- gh_format: C# ----------
    // Component written by @sonomirco

    // Format some data using formatting tags.
    // The format component derives from the string method Format.
    // https://docs.microsoft.com/en-us/dotnet/api/system.string.format?view=netframework-4.7.2
    // Here a link explaining some good information regarding the component.
    // https://discourse.mcneel.com/t/digit-grouping-using-formatting-culture/79046/9

    // Define culture info from input C.
    // https://docs.microsoft.com/en-us/dotnet/api/system.globalization.cultureinfo?view=net-5.0
    System.Globalization.CultureInfo culture = new System.Globalization.CultureInfo(C);

    // Using the method Format to formatting the information as defined by the input F.
    string dataFormatted = string.Format(culture, F, a, b);

    //Output.
    T = dataFormatted;
# ---------- end gh_format ----------
panel_7 = Panel(format)
panel_8 = Panel(gh_format)

# ---- group: Concatenate
gh_concat = CSharpScript(Separator="||", A="GH#", B="Concatenate")  # -> R; inputs Separator: String, A: String, B: String
# ---------- gh_concat: C# ----------
    // Component written by @sonomirco

    // The component concatenate texts.
    // Here we provide some different solutions to concatenate text.
    // The vanilla component has some custom features, like inputting the separator or adding extra input dynamically.
    // These functionalities are not integrated into this component, because the aim is to explain how to concatenate texts.

    // Solution 1
    // https://docs.microsoft.com/en-us/dotnet/api/system.string.concat?view=net-5.0
    string solution1 = string.Concat(A, Separator, B);

    // Solution 2
    // https://docs.microsoft.com/en-us/dotnet/api/system.string.format?view=net-5.0
    string solution2 = string.Format("{0}{1}{2}", A, Separator, B);

    // Solution 3
    // It is possible to concatenate strings using the operator +.
    string solution3 = A + Separator + B;

    // Output
    R = solution1;
# ---------- end gh_concat ----------
concat = Concatenate(FragmentA="GH#", FragmentB="Concatenate", JoinSeparator="||")
panel_9 = Panel(gh_concat)
panel_10 = Panel(concat)

# ---- group: Match Text
panel_11 = Panel("^GH#")
panel_12 = Panel("""VanillaGrasshopper
GH#Grasshopper
LearningGrasshopper""")
toggle = BooleanToggle(True)
tmatch = MatchText(Text=panel_12, Pattern="Learning*", Case=toggle)
gh_tmatch = CSharpScript(T=panel_12, P="Learning*", C=toggle)  # -> M; inputs T: String, P: String, R: String, C: Boolean
# ---------- gh_tmatch: C# usings ----------
using System.Text.RegularExpressions;
using Microsoft.VisualBasic;
using Microsoft.VisualBasic.CompilerServices;
# ---------- gh_tmatch: C# ----------
    // Component written by @sonomirco

    // Match a text against a pattern.

    // Check if P and R are connected, if are not we through a warning message.
    if (P != null && R != null)
      this.Component.AddRuntimeMessage(GH_RuntimeMessageLevel.Warning, "You can't use both patterns, select if you math using pattern or rexgen");

    // If input P (pattern) is not null test the two inputs.
    if(P != null)
    {
      // If C is true, we test the two strings as they are, so with upper and lower characters.
      // If C is false, we convert the two strings to upper case, so the operation of comparison doesn't account for case sensitivity.
      // https://docs.microsoft.com/en-us/dotnet/api/system.string.toupperinvariant?view=net-5.0
      // To compare the two strings we use the LikeOperator.
      // https://docs.microsoft.com/en-us/dotnet/api/microsoft.visualbasic.compilerservices.likeoperator.likestring?view=net-5.0
      if(C == true)
        M = LikeOperator.LikeString(T, P, CompareMethod.Binary);
      else
        M = LikeOperator.LikeString(T.ToUpperInvariant(), P.ToUpperInvariant(), CompareMethod.Binary);
    }
      // If P is null but R is not we compare the two strings using regular expressions (Regex).
      // https://docs.microsoft.com/en-us/dotnet/api/system.text.regularexpressions.regex?view=net-5.0
    else if (R != null)
    {
      // Firstly we create a regexOptions and specify the cultural differences in language is ignored.
      // https://docs.microsoft.com/en-us/dotnet/api/system.text.regularexpressions.regexoptions?view=net-5.0
      // If C is false we set the option to ignore the case.
      RegexOptions regexOptions = RegexOptions.CultureInvariant;
      if (C == false)
        regexOptions |= RegexOptions.IgnoreCase;
      else
        // We use the method isMatch to compare the two strings.
        // https://docs.microsoft.com/en-us/dotnet/api/system.text.regularexpressions.regex.ismatch?view=net-5.0
        M = new Regex(R, regexOptions).IsMatch(T);
    }
      // If no one of the previous checks is valued return true.
    else
      M = true;
# ---------- end gh_tmatch ----------
panel_13 = Panel(tmatch)
panel_14 = Panel(gh_tmatch)

# ---- group: Text join
panel_15 = Panel("""GH#
Joint
String""")
gh_join = CSharpScript(T=panel_15, J="//")  # -> R; inputs T: list of String, J: String
# ---------- gh_join: C# ----------
    // Component written by @sonomirco

    // Join a collection of texts into one.

    // We define the input 'T' as a list of strings and we check if the length of the list is zero, we exit.
    if(T.Count == 0)
      return;

    // Join a string is a method of string and takes a string 'J' as separator and a collection as an array.
    // https://docs.microsoft.com/en-us/dotnet/api/system.string.join?view=net-5.0
    // List has a method to convert the list into an Array (ToArray method).
    // https://docs.microsoft.com/en-us/dotnet/api/system.collections.generic.list-1.toarray?view=net-5.0
    string joinedStrings = string.Join(J, T.ToArray());

    // Output.
    R = joinedStrings;
# ---------- end gh_join ----------
join = TextJoin(Text=panel_15, Join="//")
panel_16 = Panel(join)
panel_17 = Panel(gh_join)

# ---- group: Sort Text
panel_18 = Panel("""D
M
A
F""")
panel_19 = Panel("""10
80
30
40""")
culture_2 = Culture(3081)
gh_tsort = CSharpScript(K=panel_18, V=panel_19, C=culture_2)  # -> Kr, Vr; inputs K: list of String, V: list, C: String
# ---------- gh_tsort: C# ----------
    // Component written by @sonomirco

    // Sort a series of text, and associate with a value.

    // Global parameters
    // We copy the input inside arrays because we will use the sorting methods provided by the arrays.
    string[] sortedTexts = K.ToArray();
    object[] sortedValues = V.ToArray();

    // Define culture info from input C.
    // In this case the culture sets the sorting rules, so we have to set it as global information.
    // https://docs.microsoft.com/en-us/dotnet/api/system.globalization.cultureinfo?view=net-5.0
    System.Globalization.CultureInfo culture = new System.Globalization.CultureInfo(C);

    // Define the culture info as a current thread.
    System.Threading.Thread.CurrentThread.CurrentCulture = culture;

    // If the length of input V doesn't match with the length of input K we through an error message.
    if (V.Count > 0 && K.Count != V.Count)
      this.Component.AddRuntimeMessage(GH_RuntimeMessageLevel.Error, "You must supply equal amounts of keys and values");

      // If we don't have any objects in input V, we only have to sort the list of texts.
    else if (V.Count == 0)
      Array.Sort(sortedTexts);

      // if we have input K and V with the same length, we use the sorting method provide by the array that allows us to sort a pair of Array objects.
      // https://docs.microsoft.com/en-us/dotnet/api/system.array.sort?view=net-5.0#System_Array_Sort__2___0_____1___
    else
      Array.Sort<string, object>(sortedTexts, sortedValues);

    // Outputs.
    Kr = sortedTexts;
    Vr = sortedValues;
# ---------- end gh_tsort ----------
tsort = SortText(Keys=panel_18, Values=panel_19, Culture=culture_2)  # -> Keys, Values
panel_20 = Panel(gh_tsort.Kr)
panel_21 = Panel(tsort.Keys)
panel_22 = Panel(gh_tsort.Vr)
panel_23 = Panel(tsort.Values)

# ---- group: Text Case
culture_3 = Culture(3081)
case = TextCase(Text="CaSiNg", Culture=culture_3)  # -> UpperCase, LowerCase
gh_case = CSharpScript(T="CaSiNg", C=culture_3)  # -> U, L; inputs T: String, C: String
# ---------- gh_case: C# ----------
    // Component written by @sonomirco

    // Change the case of some text.

    // Define culture info from input C.
    // https://docs.microsoft.com/en-us/dotnet/api/system.globalization.cultureinfo?view=net-5.0
    System.Globalization.CultureInfo culture = new System.Globalization.CultureInfo(C);

    // Using the string method ToUpper to change the text in upper case.
    string upperCase = T.ToUpper(culture);

    // Using the string method ToUpper to change the text in upper case.
    string lowerCase = T.ToLower(culture);

    //Outputs.
    U = upperCase;
    L = lowerCase;
# ---------- end gh_case ----------
panel_24 = Panel(case.UpperCase)
panel_25 = Panel(case.LowerCase)
panel_26 = Panel(gh_case.U)
panel_27 = Panel(gh_case.L)

# ---- group: Text Fragment
int_2 = Integer("15")
int_3 = Integer("6")
fragment = TextFragment(Text="VanillaGrasshopper", Start=int_2, Count=int_3)
gh_fragment = CSharpScript(T="VanillaGrasshopper", i=int_2, N=int_3)  # -> F; inputs T: String, i: Int32, N: Int32
# ---------- gh_fragment: C# ----------
    // Component written by @sonomirco

    // Extract a subset of a text.
    // This component is focused on the use of the string method Substring.
    // https://docs.microsoft.com/en-us/dotnet/api/system.string.substring?view=net-5.0

    // Check if the start index is not less than zero and throw an error message.
    if (i < 0)
      this.Component.AddRuntimeMessage(GH_RuntimeMessageLevel.Error, "Start index must be equal to or larger than zero");

      // Check if the start index is bigger than the string length, and throw a warning message.
      // We also output an empty string.
    else if (i >= T.Length)
    {
      this.Component.AddRuntimeMessage(GH_RuntimeMessageLevel.Warning, "Start index beyond end of text");
      F = string.Empty;
    }

      // Check if the length of the subset we want to obtain is not less than zero.
      // We output the substring starting from the index i until the end of the string.
    else if (N < 0)
    {
      F = T.Substring(i);
    }

      // If all the checks are passed define the subset based on the inputs provided.
      // we output the substring starting from index i and for the length provided from the input N.
    else
    {
      // This avoid to have a null result if we input a start index very close to the end of the string and an N input that is bigger than the number
      // of characters remaining.
      int subSetLength = Math.Min(N, (T.Length - i));
      F = T.Substring(i, subSetLength);
      };
# ---------- end gh_fragment ----------
panel_28 = Panel(gh_fragment)
panel_29 = Panel(fragment)

# ---- group: Replace Text
gh_rep = CSharpScript(T="VanillaGrasshopper ", F="Vanilla", R="GH#")  # -> Re; inputs T: String, F: String, R: String
# ---------- gh_rep: C# ----------
    // Component written by @sonomirco

    // Replace a specific part of a text with another.
    // The replace text component derives from the string method Replace.
    // https://docs.microsoft.com/en-us/dotnet/api/system.string.replace?view=net-5.0

    //Output.
    Re = T.Replace(F, R);
# ---------- end gh_rep ----------
rep = ReplaceText(Text="VanillaGrasshopper ", Find="Vanilla", Replace="GH#", RecursiveReplace=False)
panel_30 = Panel(rep)
panel_31 = Panel(gh_rep)

# ---- group: Text Trim
toggle_2 = BooleanToggle(True)
toggle_3 = BooleanToggle(False)
trim = TextTrim(Text=" VanillaGrasshopper ", Start=toggle_2, End=toggle_3)
gh_trim = CSharpScript(T=" VanillaGrasshopper ", S=toggle_2, E=toggle_3)  # -> R; inputs T: String, S: Boolean, E: Boolean
# ---------- gh_trim: C# ----------
    // Component written by @sonomirco

    // Remove whitespace at the beginning or at the end of a text.
    // This component is focused on the use of the string method TrimEnd and TrimStart.
    // https://docs.microsoft.com/en-us/dotnet/api/system.string.trimend?view=net-5.0

    // Global variable
    // Copied the input text.
    string trimmedText = T;

    // If the input S is true trim the start.
    // If the input E is true trim the end
    if (S)
      trimmedText = trimmedText.TrimStart();
    if (E)
      trimmedText = trimmedText.TrimEnd();

    // Output.
    R = trimmedText;
# ---------- end gh_trim ----------
panel_32 = Panel(trim)
panel_33 = Panel(gh_trim)

# ---- group: Text split
panel_34 = Panel(""" 
GH#Split""")
split = TextSplit(Text=panel_34, Separators="#")
gh_split = CSharpScript(T=panel_34, C="#")  # -> R; inputs T: String, C: String
# ---------- gh_split: C# ----------
    // Component written by @sonomirco

    // Split some text using separator.
    // String has a method called Split that takes a CharArray as separator
    // https://docs.microsoft.com/en-us/dotnet/api/system.string.split?view=net-5.0
    R = T.Split(C.ToCharArray(), StringSplitOptions.None);
# ---------- end gh_split ----------
panel_35 = Panel(split)
panel_36 = Panel(gh_split)

# ----
panel_37 = Panel("""Grass

VanillaGrasshopper """)
toggle_4 = BooleanToggle(True)
tdist = TextDistance(TextA=panel_37, TextB="Grass", Case=toggle_4)
gh_tdist = CSharpScript(A=panel_37, B="Grass", C=toggle_4)  # -> D; inputs A: String, B: String, C: Boolean
# ---------- gh_tdist: C# ----------
    // Component written by @sonomirco

    // Compute the Levenshtein distance between two texts.
    // This is a good link explaining what the Levenshtein distance is and how to implement it, with nice links at the end.
    // https://medium.com/@ethannam/understanding-the-levenshtein-distance-equation-for-beginners-c4285a5604f0
    // Because Levenshtein distance is a very famous algo, we just copy one of the implementations found on the web.

    // Global parameter
    // We copied the input into two variables so we can modify them in the process.
    string stringA = A;
    string stringB = B;

    // If one of the texts has length zero we return as result the difference between them.
    // we use Math.Abs, so we guaranty the result is always positive and we don't have to check which input has length zero.
    if(A.Length == 0 || B.Length == 0)
      D = Math.Abs(A.Length - B.Length);
      // If both inputs have lengths zero, return as result zero.
    else if(A.Length == 0 && B.Length == 0)
      D = 0;
    else
    {
      // If C is false, we convert the two strings to upper case, so the operation of comparison doesn't account for case sensitivity.
      // https://docs.microsoft.com/en-us/dotnet/api/system.string.toupperinvariant?view=net-5.0
      if(!C)
      {
        stringA = A.ToUpperInvariant();
        stringB = B.ToUpperInvariant();
      }
      // Calling our private method the LevenshteinDistance.
      D = LevenshteinDistance(stringA, stringB);
    }
# ---------- gh_tdist: C# additional code ----------
  // Code source
  // https://gist.github.com/Davidblkx/e12ab0bb2aff7fd8072632b396538560

  private int LevenshteinDistance(string source1, string source2)
  {
    int source1Length = source1.Length;
    int source2Length = source2.Length;

    // Creation of a double array.
    int[,] matrix = new int[source1Length + 1, source2Length + 1];

    // First calculation, if one entry is empty return full length.
    if (source1Length == 0)
      return source2Length;

    if (source2Length == 0)
      return source1Length;

    // Initialization of matrix with row size source1Length and columns size source2Length.
    for (int i = 0; i <= source1Length; i++)
    {
      matrix[i, 0] = i;
    }
    for (int j = 0; j <= source2Length; j++)
    {
      matrix[0, j] = j;
    }

    // Calculate rows and collumns distances.
    for (int i = 1; i <= source1Length; i++)
    {
      for (int j = 1; j <= source2Length; j++)
      {
        // We we have a condition that is true or false, instead of use if/else statment
        // we can use conditional operator.
        // https://docs.microsoft.com/en-us/dotnet/csharp/language-reference/operators/conditional-operator
        int cost = (source2[j - 1] == source1[i - 1]) ? 0 : 1;
        
        // We add to the matrix the min value calculated.
        matrix[i, j] = Math.Min(
          Math.Min(matrix[i - 1, j] + 1, matrix[i, j - 1] + 1),
          matrix[i - 1, j - 1] + cost);
      }
    }
    // return result.
    return matrix[source1Length, source2Length];
  }
# ---------- end gh_tdist ----------
panel_38 = Panel(tdist)
panel_39 = Panel(gh_tdist)

# ---- group: Text length
panel_40 = Panel(""" 
GH#
Joint
String""")
gh_len = CSharpScript(T=panel_40)  # -> out, L; inputs T: String
# ---------- gh_len: C# ----------
    // Component written by @sonomirco

    // Get the length (character count) of some text.
    // Becuase a string is a list of characters has a length property.

    // Output
    L = T.Length;
# ---------- end gh_len ----------
len = TextLength(Text=panel_40)
panel_41 = Panel(gh_len.L)
panel_42 = Panel(len)
