# Grasshopper definition Sets_Tree.ghx (Grasshopper 1.0.7)

# ---- group: Flip matrix / Testing error path mismatch
panel = Panel("""{50, 50, 0}
{50, 50, 0}""")
panel_2 = Panel("""{0, 0, 0}
{0, 0, 0}""")
flatten = FlattenTree(Tree=panel, Path="{0;2}")
flatten_2 = FlattenTree(Tree=panel_2, Path="{0;1}")
entwine = Entwine(Branch0X=flatten_2, Branch1X=flatten, FlattenInputs=False)

# ---- group: Flip matrix / Testing error path length
panel_3 = Panel("""{0, 0, 0}
Null Point""")
panel_4 = Panel("""{0, 0, 0}
{50, 50, 0}""")
flatten_3 = FlattenTree(Tree=panel_4, Path="{0;1}")
flatten_4 = FlattenTree(Tree=panel_3, Path="{0;1;0}")
entwine_2 = Entwine(Branch0X=flatten_4, Branch1X=flatten_3, FlattenInputs=False)

# ---- group: Shift Paths
shift = Slider(2, range=-4..4)
panel_5 = Panel(entwine_2)
gh_pshift = CSharpScript(D=panel_5, O=shift)  # -> Dr; inputs D: tree, O: Int32
# ---------- gh_pshift: C# ----------
    // Component written by @sonomirco

    // The component shifts the indices for all the paths.

    // Glabal variables.
    // Collect the input structure.
    // Instantiate a DataTree.
    // Collect the dimension of the structure, number of branches.
    // Collect the input shift and ensure is positive.
    GH_Structure<IGH_Goo> inputTree = (GH_Structure<IGH_Goo>) this.Component.Params.Input[0].VolatileData;
    DataTree<IGH_Goo> tree = new DataTree<IGH_Goo>();
    int treeCapacity = inputTree.Branches.Count;
    int shift = Math.Abs(O);

    // Loop the input structure.
    for (int i = 0; i < treeCapacity; i++)
    {
      // Collect the path capacity, the length of the path.
      int pathCapacity = inputTree.get_Path(i).Length;
      // If the input shift is equal or bigger than the path capacity
      // we throw an error message, and we step to the next iteration.
      if(shift >= pathCapacity)
      {
        this.Component.AddRuntimeMessage(GH_RuntimeMessageLevel.Error, string.Format("Path {0} was shifted out of existence", inputTree.get_Path(i)));
        continue;
      }
      else
      {
        // Get the path of the branch.
        GH_Path path = inputTree.get_Path(i);
        // Loop for the value of the shift
        for (int j = 0; j < shift; j++)
        {
          // Here we are using a conditional operation to shift the indices of the path
          // picking one of the two methods provided.
          // https://docs.microsoft.com/en-us/dotnet/csharp/language-reference/operators/conditional-operator
          path = O >= 0 ? path.CullFirstElement() : path.CullElement();
        }
        // Adding the data to the variable tree using the modified path.
        tree.AddRange(inputTree.Branches[i], path);
      }
    }
    // Output result.
    Dr = tree;
# ---------- end gh_pshift ----------
pshift = ShiftPaths(Data=panel_5, Offset=shift)
panel_6 = Panel(pshift)
panel_7 = Panel(gh_pshift)

# ---- group: GH# Match
panel_8 = Panel("""{0, 0, 0}
Null Point
{50, 50, 0}
<null>""")
panel_9 = Panel("""{0, 0, 0}
Null Point
{50, 50, 0}
<null>""")
gh_match = CSharpScript(T=panel_8, G=panel_9)  # -> Tr; inputs T: tree, G: tree
# ---------- gh_match: C# ----------
    // Component written by @sonomirco

    // The component matches the path structure to another.

    // Glabal variables.
    // We collect the two inputs structure.
    // We instantiate a DataTree.
    // We collect the length or dimension of the input tree.
    GH_Structure<IGH_Goo> inputTree = (GH_Structure<IGH_Goo>) this.Component.Params.Input[0].VolatileData;
    GH_Structure<IGH_Goo> treeGuide = (GH_Structure<IGH_Goo>) this.Component.Params.Input[1].VolatileData;
    DataTree<IGH_Goo> tree = new DataTree<IGH_Goo>();
    int treeCapacity = inputTree.PathCount;

    // We check if the two trees have the same path dimensions,
    // if it isn't we throw an error and we exit the process.
    if(inputTree.PathCount != treeGuide.PathCount)
    {
      this.Component.AddRuntimeMessage(GH_RuntimeMessageLevel.Error, "Input trees must have equal number of paths");
      return;
    }
    else
    {
      // If the paths match, we add to our variable tree the branch from the input tree and the path from the treeGuide.
      for (int i = 0; i < treeCapacity; i++)
        tree.AddRange((IEnumerable<IGH_Goo>) inputTree.Branches[i], treeGuide.get_Path(i));
    }
    // Output result.
    Tr = tree;
# ---------- end gh_match ----------
match = MatchTree(Tree=panel_8, Guide=panel_9)
panel_10 = Panel(match)
panel_11 = Panel(gh_match)

# ---- group: Trim Tree
panel_12 = Panel("""{0, 0, 0}
{50, 50, 0}""")
depth = Slider(1, range=-1..4)
panel_13 = Panel("""{0, 0, 0}
Null Point
{50, 50, 0}
<null>""")
flatten_5 = FlattenTree(Tree=panel_12, Path="{0;1;0}")
flatten_6 = FlattenTree(Tree=panel_13, Path="{0;1;0}")
graft = GraftTree(Tree=flatten_5, IncludeEmptyLists=True, IncludeNullItems=True)
graft_2 = GraftTree(Tree=flatten_6, IncludeEmptyLists=True, IncludeNullItems=True)
merge = Merge(Data1=graft_2, Data2=graft)
gh_trim = CSharpScript(T=merge, D=depth)  # -> Tr; inputs T: tree, D: Int32
# ---------- gh_trim: C# ----------
    // Component written by @sonomirco

    // The component reduces the complexity of the tree,
    // merging the last index of the path and moving to the first stepping the number of times is defined by the value D.

    // Global parameter
    DataTree<object> trimedTree = new DataTree<object>();

    // First step we are checking that we are not taking more than one value for the input D.
    if(this.Component.Params.Input[1].VolatileDataCount > 1)
      this.Component.AddRuntimeMessage(GH_RuntimeMessageLevel.Warning, "This component only accepts a snigle number for Depth");

      // Second step is to check that input D is not less than zero.
    else if(D < 0)
      this.Component.AddRuntimeMessage(GH_RuntimeMessageLevel.Error, "Depth has to be a positive integer");

    else
    {
      int counter = 0;
      // We loop through the branches.
      for (int i = 0; i < T.BranchCount; i++)
      {
        // Collecting the path and data for each branch.
        GH_Path path = T.Path(i);
        List<object> branch = T.Branch(i);
        // If the path length is smaller than the input increment the counter of one;
        if(path.Length <= D)
          ++counter;
        else
        {
          // GH_Path class has a method to remove the last index of the path.
          // https://developer.rhino3d.com/api/grasshopper/html/M_Grasshopper_Kernel_Data_GH_Path_CullElement.htm
          // So we call the method inside a loop for the number of times is defined by the input D.
          for (int j = 0; j < D; j++)
          {
            path = path.CullElement();
          }
          // We add the values to the DataTree using the 'trimmed' path.
          trimedTree.AddRange(branch, path);
        }
      }
      // If the path length is smaller than input D trigger the counter.
      // If the counter is equal or bigger than one, we throw a warning message.
      if(counter >= 1)
      {
        string warningMessage = string.Format("The collapse depth is too large for {0} branches, they were omitted", counter);
        this.Component.AddRuntimeMessage(GH_RuntimeMessageLevel.Warning, warningMessage);
      }
    }
    // Output result.
    Tr = trimedTree;
# ---------- end gh_trim ----------
trim = TrimTree(Tree=merge, Depth=depth)
panel_14 = Panel(trim)
panel_15 = Panel(gh_trim)

# ---- group: Entwine
flatteninputs = BooleanToggle(False)
mocked = CSharpScript()  # -> out, Tree
# ---------- mocked: C# ----------
    GH_Point[] mockedList = new GH_Point[4];
    mockedList[0] = new GH_Point(new Point3d(0, 0, 0));
    mockedList[1] = new GH_Point(Point3d.Unset);
    mockedList[2] = new GH_Point(new Point3d(50, 50, 0));
    mockedList[3] = null;

    DataTree<IGH_Goo> mockedTree = new DataTree<IGH_Goo>();

    for (int i = 0; i < mockedList.Length; i++)
    {
      GH_Path path = new GH_Path(i);
      mockedTree.Add(mockedList[i], path);
    }

    mockedTree.EnsurePath(mockedList.Length);

    Tree = mockedTree;
# ---------- end mocked ----------
panel_16 = Panel("""{0, 0, 0}
{0, 0, 0}
Null Point
{50, 50, 0}
{50, 50, 0}
<null>""")
gh_entwine = CSharpScript(FlattenInputs=flatteninputs, G1=panel_16, G2=mocked.Tree)  # -> R; inputs FlattenInputs: Boolean, G1: tree, G2: tree, G3: tree
# ---------- gh_entwine: C# ----------
    // Component written by @sonomirco

    // Flatten and combine a collection (Lists or Trees) of data.
    // We replace the right click event with a bool input.
    // We can mimic the same input namings because C#script will spit out a serious of errors.
    // We will use Fn to specify we are flattening the structure and Gn when we keep the structure.
    // To mimic as much as possible the component we added also the message below the component.

    // First think we do is to pass the bolean input to the private input we have in the area custom additional code.
    // Second we call a ScheduleSolution used to modify the naming of the inputs.
    // https://discourse.mcneel.com/t/can-t-quite-figure-out-how-to-use-schedulesolution/105590/3?u=bianchini
    _flattenInputs = FlattenInputs;
    GrasshopperDocument.ScheduleSolution(5, CallBack);

    // Glabal variables.
    DataTree<IGH_Goo> tree = new DataTree<IGH_Goo>();
    // We loop throught the number of inputs.
    int numberOfInputs = this.Component.Params.Input.Count;
    for (int i = 1; i < numberOfInputs; i++)
    {
      // We collect the data, extracting them directly from the inputs and we cast them in GH_Structure<IGH_Goo>
      GH_Structure<IGH_Goo> inputStru = (GH_Structure<IGH_Goo>) this.Component.Params.Input[i].VolatileData;
      // If it is true
      if(FlattenInputs)
      {
        // We modify the message below the component.
        this.Component.Message = "Flatten";
        // We flatten the data in a unique list, using the FlattenData method.
        inputStru.FlattenData();
        // We set the new index path for this data structure.
        // Here we can see another way to structure the path, using an integer array.
        // The definition of the path is the order of the values in the array.
        int[] indexPath = new int[2]{0,i - 1};
        GH_Path path = new GH_Path(indexPath);
        // We add the branch to the tree.
        tree.AddRange(inputStru, path);
      }
        // it it is false.
      else
      {
        // We modify the message below the component
        this.Component.Message = "Graft";
        // We loop throught the number of paths or branches.
        int pathLength = inputStru.PathCount;
        for (int j = 0; j < pathLength; j++)
        {
          // We collect the branch in a list.
          List<IGH_Goo> branch = inputStru.Branches[j];
          // Here we are prepending a index to the path of the branch.
          GH_Path path = inputStru.Paths[j].PrependElement(i - 1);
          // We add the branch to the tree.
          tree.AddRange(branch, path);
        }
      }
    }

    // Output result.
    R = tree;
# ---------- gh_entwine: C# additional code ----------
  // Private property.
  private bool _flattenInputs;

  // Method used to modify the input names.
  public void VariableParameterMaintenance()
  {
    // We loop through the inputs.
    int num = this.Component.Params.Input.Count - 1;
    for (int index = 1; index <= num; ++index)
    {
      // If it is true we rename the inputs using the prefix F for flatten.
      if(_flattenInputs)
      {
        this.Component.Params.Input[index].Name = string.Format("Branch {0}", (object) index);
        this.Component.Params.Input[index].NickName = string.Format("F{0}", (object) index);
      }
        // Otherwise we rename the inputs with the prefix B for Graft.
      else
      {
        this.Component.Params.Input[index].Name = string.Format("Branch {0}", (object) index);
        this.Component.Params.Input[index].NickName = string.Format("G{0}", (object) index);
      }
      // We set the input accessing the tree, this is the same action we do when we right click on a input and we select if
      // it has to be a item a list of a tree.
      this.Component.Params.Input[index].Access = GH_ParamAccess.tree;
    }
  }
  // Inside the CallBack we call the method we defined to change the input names, and we expire the component solution so
  // in the next new solution this component can be solved again.
  // It is necessary define the CallBack method with a GH_Document input otherweise the ScheduleSolution won't work.
  public void CallBack(GH_Document gh)
  {
    VariableParameterMaintenance();
    this.Component.Params.OnParametersChanged();
    this.Component.ExpireSolution(false);
  }
# ---------- end gh_entwine ----------
entwine_3 = Entwine(Branch0X=panel_16, Branch1X=mocked.Tree, FlattenInputs=False)
panel_17 = Panel(entwine_3)
panel_18 = Panel(gh_entwine)

# ----
mocked_2 = CSharpScript()  # -> Tr
# ---------- mocked_2: C# ----------
    GH_Point[] mockedList = new GH_Point[4];
    mockedList[0] = new GH_Point(new Point3d(0, 0, 0));
    mockedList[1] = new GH_Point(Point3d.Unset);
    mockedList[2] = new GH_Point(new Point3d(50, 50, 0));
    mockedList[3] = null;

    DataTree<IGH_Goo> mockedTree = new DataTree<IGH_Goo>();

    for (int i = 0; i < mockedList.Length; i++)
    {
      GH_Path path = new GH_Path(i);
      mockedTree.Add(mockedList[i], path);
    }

    mockedTree.EnsurePath(mockedList.Length);

    Tr = mockedTree;
# ---------- end mocked_2 ----------

# ---- group: Clean Tree
# GH#: A C# dictionary of Grasshopper3D components.
# 
# This file contains a category of Grasshopper components, and a mirroring C#/RhinoCommon implementation.
# 
# This is an educational project initiated by students/faculty of GSD-6338: Introduction to Computational Design, at the Harvard Graduate School of Design.
# 
# More information: {{project link}}
# Sets Text
remove_nulls = BooleanToggle(False)
remove_invalid = BooleanToggle(False)
remove_empty = BooleanToggle(False)
clean = CleanTree(RemoveNulls=remove_nulls, RemoveInvalid=remove_invalid, RemoveEmpty=remove_empty, Tree=mocked_2)
gh_clean = CSharpScript(N=remove_nulls, X=remove_invalid, E=remove_empty, T=mocked_2)  # -> Tr; inputs N: Boolean, X: Boolean, E: Boolean, T: tree
# ---------- gh_clean: C# ----------
    // Component written by @sonomirco

    // The component removes all the null and invalid values from the tree structure.

    // The first step is to check if the bool inputs are single values and not lists.
    // To check this, we take the information directly from the input parameters of the C# component.
    // Retrieving the VolatileDataCount we can have the count of values passed from each input.
    for (int i = 0; i <= 2; i++)
    {
      IGH_Param param = this.Component.Params.Input[i];
      if (param.VolatileDataCount > 1)
        this.Component.AddRuntimeMessage(GH_RuntimeMessageLevel.Error, string.Format("This component only accepts a single value for [{0}].", (string) param.NickName));
    }

    // If input N and X are true we enter in the if statement.
    if(N || X)
    {
      // Each branch in a DataTree is a list, and we have to declare the type of the list.
      // https://developer.rhino3d.com/api/grasshopper/html/M_Grasshopper_DataTree_1_Branch_1.htm
      // In our case the type of the list is an object because we want to keep the type as generic as possible starting from the DataTree.
      foreach (List<object> branch in T.Branches)
      {
        // If the branch is not null we enter in the statement.
        if(branch != null)
        {
          // Here a little trick to remove elements from a list without having problems with the order,
          // starting from the end of the list and moving backward.
          for (int j = branch.Count - 1; j >= 0; j += -1)
          {
            // We set a boolean value that we will use to trigger the action of removing the elements we want.
            bool flag = false;
            // This is another little trick for taking advantage of the IsValid property provided by the IGH_Goo
            // that is the interface for all the data inside Grasshopper.
            // https://developer.rhino3d.com/api/grasshopper/html/T_Grasshopper_Kernel_Types_IGH_Goo.htm
            // To obtain an IGH_Goo Grasshopper has a dedicated class to convert data into specific Goo, GH_Convert.
            // https://developer.rhino3d.com/api/grasshopper/html/T_Grasshopper_Kernel_GH_Convert.htm
            IGH_Goo tempValue = GH_Convert.ToGoo(branch[j]);
            // If the value is null and the input N is true we want to remove the null values, so we set the flag = true.
            // We use the property isValid to check the validity of the value
            // and if the input X is true, we set the flag = true.
            // Little note, because IsValid retrieves a true value we have to negate a false result to have true when the value is not valid.
            if(tempValue == null)
              flag = N;
            else if(X)
              flag = !tempValue.IsValid;
            // At the end if the flag is true, we remove the value at the index j.
            if(flag)
              branch.RemoveAt(j);
          }
        }
      }
    }
    // If E is true, so we want to remove empty branches.
    if(E)
    {
      // We use the same little trick as before so we start from the end and move backward.
      for (int i = T.Branches.Count - 1; i >= 0; i += -1)
      {
        // If the count of a branch (list of values) is less or equal to zero, meaning the list is empty.
        // Using RemovePath we remove the entire branch, from the DataTree.
        if(T.Branch(i).Count <= 0)
          T.RemovePath(i);
      }
    }

    // Output result.
    Tr = T;
# ---------- end gh_clean ----------
panel_19 = Panel(clean)
panel_20 = Panel(gh_clean)

# ---- group: Graf Tree
panel_21 = Panel(gh_clean)
include_null_items = BooleanToggle(True)
include_emplty_lists = BooleanToggle(True)
flatten_7 = FlattenTree(Tree=panel_21, Path="{0}")
gh_tree = CSharpScript(N=include_null_items, E=include_emplty_lists, T=panel_21)  # -> Tr; inputs N: Boolean, E: Boolean, T: tree
# ---------- gh_tree: C# ----------
    // Component written by @sonomirco

    // The component graft the data in a new data tree.

    // Global parameters
    DataTree<object> tree = new DataTree<object>();
    List<object> branch = null;

    // If the branch is not composed of a single branch, meaning a list, we enter in this statement.
    if(T.BranchCount > 1)
    {
      // We loop through each branch.
      for (int j = 0; j < T.BranchCount; j++)
      {
        // We extract each branch in a list.
        branch = T.Branch(j);
        // If the branch is null or doesn't have any data, we jump in this statement.
        if(branch == null || branch.Count == 0)
        {
          // If input E is true, so we want to consider null values, we enter in this statement.
          if(E)
          {
            // First thing we do is to create a path.
            // We take the path of the branch and we add an index path of value zero.
            // We add to our tree an empty list and the path defined.
            GH_Path path = T.Path(j).AppendElement(0);
            tree.AddRange(new List<object>(), path);
          }
        }
        else
        {
          // If the branch is not null, so we loop through all the data in the branch.
          for (int k = 0; k <= branch.Count - 1; k++)
          {
            // We create a new path for every single item, appending to the branch path the index of the loop.
            GH_Path path = T.Path(j).AppendElement(k);
            // If the value at index k in the branch is not null OR N is true so we want to consider null values.
            // We add to the tree the value with the new path.
            if(branch[k] != null || N)
              tree.Add(branch[k], path);
          }
        }
      }
    }
      // if the branch is a single list.
    else
    {
      // We take the branch.
      branch = T.Branch(0);
      // We loop for all the elements has inside.
      for (int j = 0; j < branch.Count; j++)
      {
        // If N input is false and the value at the index j is null we skip it and jump to the next interaction of the loop.
        if(!N && branch[j] == null)
          continue;
        // We create a new path for every single element of the list, appending the index j to the path.
        GH_Path path = T.Path(0).AppendElement(j);
        // We add each element in a separate branch defined by the path.
        tree.Add(branch[j], path);
      }
    }
    // Output result.
    Tr = tree;
# ---------- end gh_tree ----------
graft_3 = GraftTree(Tree=panel_21, IncludeEmptyLists=True, IncludeNullItems=True)
graft_4 = GraftTree(Tree=flatten_7, IncludeEmptyLists=False, IncludeNullItems=True)
panel_22 = Panel(graft_4)
panel_23 = Panel(gh_tree)
panel_24 = Panel(graft_3)

# ----
mocked_3 = CSharpScript(T=graft_3)  # -> Tr; inputs T: tree
# ---------- mocked_3: C# ----------
    DataTree<object> mockedTree = new DataTree<object>();
    for (int i = 0; i < T.BranchCount; i++)
    {
      GH_Path path = T.Path(i);
      path = path.PrependElement(0);
      mockedTree.AddRange(T.Branch(i), path);
    }

    Tr = mockedTree;
# ---------- end mocked_3 ----------

# ---- group: Simplify Tree
front = BooleanToggle(True)
panel_25 = Panel(mocked_3)
simplify = SimplifyTree(Tree=panel_25, Front=front)
gh_simplify = CSharpScript(T=panel_25, F=front)  # -> Tr; inputs T: tree, F: Boolean
# ---------- gh_simplify: C# ----------
    // Component written by @sonomirco

    // The component remove the overlap indexes for each branch's path.
    // For this component we can obtain the same result using two different ways, using the DataTree object or GH_Structure object.
    // Here two links that explain the difference between the two objects.
    // https://discourse.mcneel.com/t/datatree-vs-igh-structure/67242
    // https://discourse.mcneel.com/t/datatree-t-or-gh-structure-t-in-visual-studio/106871

    // The DataTree class has a method SimplifyPaths that carry out perfectly the main goal, but it doesn't give you
    // the full capability provided from the component provided with the input boolean F.
    // Here the method using DataTree
    // T.SimplifyPaths();

    // To represent the full behavior of the component we decided to use GH_Structure.
    // We collect the data from the component input because VolatileData is structured as GH_Structure.
    // And we make a copy of the collected data, so we avoid overwriting the original values.
    // Because we are declaring a specific type, we have to cast the VolatileData in GH_Structure<IGH_Goo>.
    GH_Structure<IGH_Goo> struFromInput = (GH_Structure<IGH_Goo>) this.Component.Params.Input[0].VolatileData;
    GH_Structure<IGH_Goo> copiedStru = struFromInput.ShallowDuplicate();
    // These two lines of code can be shrunk into one line like this
    // GH_Structure<IGH_Goo> copiedStru = ((GH_Structure<IGH_Goo>) this.Component.Params.Input[0].VolatileData).ShallowDuplicate();

    // The Simplify method we will use, required a GH_SimplificationMode, here we initialize it.
    // https://developer.rhino3d.com/api/grasshopper/html/T_Grasshopper_Kernel_Data_GH_SimplificationMode.htm
    GH_SimplificationMode simplificationMode = GH_SimplificationMode.CollapseAllOverlaps;
    // If input F is true, we change the type of simplification mode.
    if(F)
      simplificationMode = GH_SimplificationMode.CollapseLeadingOverlaps;
    // We use the simplify method.
    // https://developer.rhino3d.com/api/grasshopper/html/M_Grasshopper_Kernel_Data_IGH_Structure_Simplify.htm
    copiedStru.Simplify(simplificationMode);
    // Here the problem of using GH_Structure we can't output, because grasshopper is not able to converted in DataTree straingh away.
    // So to solve this problem, we created a small function.
    // Output result.
    Tr = StructureToDataTree(copiedStru);
# ---------- gh_simplify: C# additional code ----------
  private DataTree<IGH_Goo> StructureToDataTree(GH_Structure<IGH_Goo> structure)
  {
    // We instantiate a tree.
    DataTree<IGH_Goo> tree = new DataTree<IGH_Goo>();
    // We loop through each branch and copied in the DataTree.
    for(int i = 0;i < structure.Branches.Count;++i)
    {
      tree.AddRange((List<IGH_Goo>) structure.get_Branch(i), structure.get_Path(i));
    }
    // We return the tree.
    return tree;
  }
# ---------- end gh_simplify ----------
panel_26 = Panel(simplify)
panel_27 = Panel(gh_simplify)

# ---- group: Relative Item
panel_28 = Panel("{+1}[0]")
toggle = BooleanToggle(False)
toggle_2 = BooleanToggle(False)
recgrid = Rectangular(Plane=PlaneXY(0, 0, 0), SizeX=5, SizeY=5, ExtentX=10, ExtentY=10)  # -> Cells, simplify(Points)
gh_relitem = CSharpScript(T=recgrid.Points, O="{0}[+1]", Wp=toggle, Wi=toggle_2)  # -> A, B; inputs T: tree, O: String, Wp: Boolean, Wi: Boolean
# ---------- gh_relitem: C# ----------
    // Component written by @sonomirco

    // The component enables to extract 2 lists from a single list, the lists are dictated by the Relative Offset input O.
    // For more information about the component check this link
    // https://discourse.mcneel.com/t/relative-items/107728/7
    // Despety the apparently complexity of the component, everything is managed by the GH_PathOffset class.
    // https://developer.rhino3d.com/api/grasshopper/html/T_Grasshopper_Kernel_Data_GH_PathOffset.htm

    // Global variables.
    // Collect the data tree structure from the input zero.
    GH_Structure<IGH_Goo> inputTree = (GH_Structure<IGH_Goo>) this.Component.Params.Input[0].VolatileData;
    // Initizialize two data trees.
    DataTree<IGH_Goo> tree1 = new DataTree<IGH_Goo>();
    DataTree<IGH_Goo> tree2 = new DataTree<IGH_Goo>();

    // Create a pathOffset, parsing the string from the input O.
    GH_PathOffset pathOffset = GH_PathOffset.ParseString(O);
    // If the result is null, we throws an error message.
    if(pathOffset == null)
      this.Component.AddRuntimeMessage(GH_RuntimeMessageLevel.Error, "Offset mask is not valid");

    // We set PathWrap and ItemWrap based on the inputs Wp and Wi.
    pathOffset.PathWrap = Wp;
    pathOffset.ItemWrap = Wi;

    // We loop through the branches.
    for (int i = 0; i < inputTree.PathCount; i++)
    {
      // We extract the path of the branch.
      GH_Path path = inputTree.get_Path(i);

      // We loop inside the branch.
      for (int j = 0; j < inputTree.Branches[i].Count; j++)
      {
        // We initialize a GH_Path and int variable used to collect the results from the following method.
        GH_Path relativePath = new GH_Path();
        int relativeIndex = 0;

        // Here the core of the component, the use of the method OffsetPath.
        // https://developer.rhino3d.com/api/grasshopper/html/M_Grasshopper_Kernel_Data_GH_PathOffset_OffsetPath_1.htm
        bool check = pathOffset.OffsetPath(path, j, inputTree, out relativePath, out relativeIndex);
        // If the offset path is made, we enter in the statement.
        if(check)
        {
          // We extract the data for the first input.
          IGH_Goo data1 = inputTree[path][j];
          // We extract the data for the second input.
          IGH_Goo data2 = inputTree[relativePath][relativeIndex];
          // We collect the data in the first tree collection.
          tree1.Add(data1, path);
          // We collect the data in the second tree collection.
          tree2.Add(data2, path);
        }
      }
    }
    // Outputs result.
    A = tree1;
    B = tree2;
# ---------- end gh_relitem ----------
relitem = RelativeItem(Tree=recgrid.Points, Offset="{0}[+1]", WrapPaths=toggle, WrapItems=toggle_2)  # -> ItemA, ItemB
panel_29 = Panel(relitem.ItemB)
panel_30 = Panel(gh_relitem.B)
panel_31 = Panel(relitem.ItemA)
panel_32 = Panel(gh_relitem.A)

# ---- group: Tree Branch
panel_33 = Panel(panel_17)
maintainpath = BooleanToggle(False)
panel_34 = Panel("""{1;2}
{0;0}""")
gh_branch = CSharpScript(T=panel_33, P=panel_34, maintainPath=maintainpath)  # -> B; inputs T: tree, P: String, maintainPath: Boolean
# ---------- gh_branch: C# ----------
    // Component written by @sonomirco

    // The component retrieves a specific branch from a data tree.
    // As for other components we simulate the behavior using an additional input, in this case, the one named maintainPath.

    // Glabal variables.
    // We extract the GH_Structure from the input index zero.
    // We initialize a DataTree and two GH_Paths.
    // The second GH_Path we initialize as a copy of the first one.
    GH_Structure<IGH_Goo> inputTree = (GH_Structure<IGH_Goo>) this.Component.Params.Input[0].VolatileData;
    DataTree<IGH_Goo> tree = new DataTree<IGH_Goo>();
    GH_Path searchedPath = new GH_Path();
    GH_Path path = searchedPath;

    // Because we are passing the input as a string and not a path, we create the GH_Path using the method FromString.
    // https://developer.rhino3d.com/api/grasshopper/html/M_Grasshopper_Kernel_Data_GH_Path_FromString.htm
    searchedPath.FromString(P);
    // We set the message below the component.
    this.Component.Message = "Maintain";

    // If maintainPath is false
    if(!maintainPath)
    {
      // We change the message below the component.
      this.Component.Message = "Renumber";
      // We set the path as a new GH_Path using the integer value counter.
      path = new GH_Path(counter);
      // We increment the counter.
      // This is a little trick to avoid the use of a for loop.
      // Because the P input is set as item access, the component executes the script for each value that has been passed.
      // So we can use this internal loop to increment our counter, the only thing we need to care about
      // is to initialize the counter in the are below "custom additional code", in this way every increment is recorded,
      // and also we re-set the value to zero all the time the RunScript re-start.
      counter++;
    }

    // We check if the path exists in the GH_Structure, using the method PathExists.
    // If doesn't exist, we throw an error message.
    // Otherwise we add to the DataTree the branch and the path defined by the maintainPath input.
    if(!inputTree.PathExists(searchedPath))
      this.Component.AddRuntimeMessage(GH_RuntimeMessageLevel.Error, string.Format("Path {0} does not exist within this tree", searchedPath.ToString()));
    else
      tree.AddRange(inputTree[searchedPath], path);

    // Output result.
    B = tree;
# ---------- gh_branch: C# additional code ----------
  // Initialize internal value.
  int counter = 0;

  // Used to re-set the counter all the time the script re-start.
  public override void BeforeRunScript()
  {
    counter = 0;
  }
# ---------- end gh_branch ----------
branch = TreeBranch(Tree=panel_33, Path=panel_34, MaintainPaths=True)
panel_35 = Panel(gh_branch)
panel_36 = Panel(branch)

# ---- group: Stream Filter
list = ValueList({"FilterLessThanZero": -1, "FilterZero": 0, "FilterOne": 1, "FilterTwo": 2}, selected="FilterZero")
panel_37 = Panel("""{0, 0, 0}
{50, 50, 0}""")
panel_38 = Panel("""{0, 0, 0}
Null Point
{50, 50, 0}
<null>""")
filter = StreamFilter(Gate=list, Stream0=panel_38, Stream1=panel_37)
gh_filter = CSharpScript(G=list, A1=panel_38, A2=panel_37)  # -> S0; inputs G: Int32
# ---------- gh_filter: C# ----------
    // Component written by @sonomirco

    // The component filters the input streams.
    // This component acts like a switch, only one of the input streams is allowed to pass through the component.

    // NOTE
    // Since we are working with dynamic outputs in this component,
    // the output parameter is set in the AfterRunScript()function. Hence, before every execution
    // of the RunScript() function, we manually clear out all the data in the output.
    // We identify the internal variable using underscore.

    // If the input G, input index 0, has more than one value.
    // We set the flag false, and throw an error.
    if(this.Component.Params.Input[0].VolatileData.DataCount > 1)
    {
      _flag = false;
      this.Component.AddRuntimeMessage(GH_RuntimeMessageLevel.Error, "Filter component can only operate on a single Filter Index value.");
    }
      // If the input G value is less than zero.
      // We set the flag false, and throw an error.
    else if(G < 0)
    {
      _flag = false;
      this.Component.AddRuntimeMessage(GH_RuntimeMessageLevel.Error, "Filter index too low.");
    }
      // If the input G value is bigger than the number of input.
      // We reduce the count by two because the list start with index zero and we don't want to consider the first input.
      // We set the flag false, and throw an error.
    else if(G > this.Component.Params.Input.Count - 2)
    {
      _flag = false;
      this.Component.AddRuntimeMessage(GH_RuntimeMessageLevel.Error, "Filter index too high.");
    }
      // If we passed all the check we set the flag true and the gateValue equal to the G input.
    else
    {
      _flag = true;
      _gateValue = G;
    }
# ---------- gh_filter: C# additional code ----------
  // Persistante variables.
  // A boolean value, to trigger some behaviors we have inside the AfterRunScript.
  // A integer value used in the behaviors.
  private bool _flag;
  private int _gateValue;
  // This method will be called once every solution, after any calls to RunScript.
  // https://discourse.mcneel.com/t/output-addvolatiledata-in-c-script-component-overridden-with-null-element/113520/2?u=bianchini
  public override void AfterRunScript()
  {
    // We loop through the input to update the nickName of each of them.
    // We avoid changing the first input (index 0) and we started from the second (index 1).
    for (int i = 1; i < this.Component.Params.Input.Count; i++)
      this.Component.Params.Input[i].NickName = "A" + i;

    // If the flag is true trigger the AfterRunScript and we jamp in this condition.
    if(_flag)
    {
      // We clear the data to avoid null values where passed by the RunScript in the output.
      this.Component.Params.Output[0].ClearData();
      // We pass the data from the input to the output.
      this.Component.Params.Output[0].AddVolatileDataTree(this.Component.Params.Input[_gateValue + 1].VolatileData);
      // We rename the output adding the index of the input we are using.
      this.Component.Params.Output[0].NickName = string.Format("S{0}", _gateValue);
    }
    else
    {
      // If the flag is negative, we rename the output with a generic nickName and we expire the output.
      this.Component.Params.Output[0].NickName = "S";
      this.Component.Params.Output[0].ExpireSolution(true);
    }
  }
# ---------- end gh_filter ----------
panel_39 = Panel(filter)
panel_40 = Panel(gh_filter)

# ---- group: Path Mapper
panel_41 = Panel(panel_17)
list_2 = ValueList({"Editor mode": 0, "Create Null Mapping": 1, "Create Flatten Mapping": 2, "Create Graft Mapping": 3, "Create Trim Mapping": 4, "Create Reverse Mapping": 5, "Create Renumber Mapping": 6}, selected="Editor mode")
source = Panel("""{A;B}
{A;B}""")
target = Panel("""{B;A}
{A}""")
path_mapper = PathMapper(panel_41, source=["{A;B}", "{A;B}"], target=["{B;A}", "{A}"])
gh_path_mapper = CSharpScript(T=panel_41, MappingOptions=list_2, Source=source, Target=target)  # -> O; inputs T: tree, MappingOptions: Int32, Source: list of String, Target: list of String
# ---------- gh_path_mapper: C# ----------
    // Component written by @sonomirco

    // The component performs lexical operations on data trees.
    // For more information, the help description is very exhaustive and clear in the vanilla component.
    // As per other components we are not able to recreate the same interaction, but we were been able to reproduce the same functionalities.

    // Glabal variables.
    // We collect the input tree as an IGH_Goo structure so we can manage all the types of data, null, empty, etc.
    // We initialize the output tree.
    // We collect the path length of the first branch of the tree.
    // We initialize a GH_LexerCode
    // https://developer.rhino3d.com/api/grasshopper/html/T_Grasshopper_Kernel_Data_GH_LexerCombo.htm
    GH_Structure<IGH_Goo> inputTree = (GH_Structure<IGH_Goo>) this.Component.Params.Input[0].VolatileData;
    GH_Structure<IGH_Goo> outputTree = new GH_Structure<IGH_Goo>();
    int pathLength = T.Paths[0].Length;
    GH_LexerCombo lexers = new GH_LexerCombo();

    // We generate the tree path as a lexer code, using a function we defined.
    string pathLexerCode = GetPathLexerCode(pathLength);

    // We use a switch statement to recreate the options pre-defined by clicking the right button of the mouse on the vanilla component.
    // https://docs.microsoft.com/en-us/dotnet/csharp/language-reference/keywords/switch
    // Setting the mapping options on editor mode, you can perform lexical operation using the two attached panels.
    switch(MappingOptions)
    {
      // Editor mode, we are using the inputs in the panels.
      // We move all the login in a loop and we exit when is finished.
      case 0:
        for (int i = 0; i < Source.Count; i++)
        {
          lexers = new GH_LexerCombo(Source[i], Target[i]);
          GH_Lexer.PerformLexicalReplace(lexers.Source, lexers.Target, inputTree, outputTree);
          O = StructureToDataTree(outputTree);
        }
        return;
      // Null solution, we are using the same lexical pattern for the source and the target.
      case 1:
        lexers = new GH_LexerCombo(pathLexerCode, pathLexerCode);
        break;
      // Flatten solution the target is a flat list descibed as {0}.
      case 2:
        lexers = new GH_LexerCombo(pathLexerCode, "{0}");
        break;
      // Graft solution, every data is moved in a branch.
      // So the source has to be {X;X}(i) and the target {X;X;i}.
      case 3:
        lexers = new GH_LexerCombo(pathLexerCode + "(i)", pathLexerCode.Replace("}", ";i}"));
        break;
      // Timmed solution, we use the function to creat a lexical path shorter of one path index.
      case 4:
        lexers = new GH_LexerCombo(pathLexerCode, GetPathLexerCode(pathLength, 1));
        break;
      // Reversed solution, revers the order of data inside the branches.
      // So the source has to be {X;X}(i) and the target {X;X}(item_count - 1 - i).
      case 5:
        lexers = new GH_LexerCombo(pathLexerCode + "(i)", pathLexerCode + "(item_count - 1 - i)");
        break;
      // Renumber solution, renumbers the path of the tree.
      // So the source has to be {X;X} and the target {path_index}.
      case 6:
        lexers = new GH_LexerCombo(pathLexerCode, "{path_index}");
        break;
    }

    // We perform a lexical replacement using the method provide by the GH_Lexer class.
    // https://developer.rhino3d.com/wip/api/grasshopper/html/T_Grasshopper_Kernel_Data_GH_Lexer.htm
    GH_Lexer.PerformLexicalReplace(lexers.Source, lexers.Target, inputTree, outputTree);

    // Output result, transforming the tree structure in a DataTree.
    O = StructureToDataTree(outputTree);
# ---------- gh_path_mapper: C# additional code ----------
  // This function greats a lexer code based on the dimension of the tree path.
  // As you can see, this function is repeated twice, but with a different signature,
  // this is what is called function overloading:
  // it is a process of creating multiple methods in a class with the same name but with a different signature.
  private string GetPathLexerCode(int pathLength)
  {
    // We initialize an array as bigger as the input passed.
    char[] pathCaracthers = new char[pathLength];
    // We loop for the quantity of the input, and we collect in the array
    // the character derived from the integer value.
    // The Latin capital letter A in the Unicode table is the decimal number 65.
    for (int i = 0; i < pathLength; i++)
      pathCaracthers[i] = (char) (i + 65);
    // We return the Lexur code as a string in the specific forma required, example {A;B}.
    return string.Format("{{{0}}}", string.Join(";", pathCaracthers));
  }

  // We are doing the same process of the function above, with the only difference that we have
  // a trimmer input used to reduce the result by the value used.
  private string GetPathLexerCode(int pathLength, int trimmer)
  {
    char[] pathCaracthers = new char[pathLength - trimmer];

    for (int i = 0; i < pathLength - trimmer; i++)
      pathCaracthers[i] = (char) (i + 65);

    return string.Format("{{{0}}}", string.Join(";", pathCaracthers));
  }

  // Private method to convert a GH_Structure in DataTree.
  private DataTree<IGH_Goo> StructureToDataTree(GH_Structure<IGH_Goo> structure)
  {
    // We instantiate a tree.
    DataTree<IGH_Goo> tree = new DataTree<IGH_Goo>();
    // We loop through each branch and copied in the DataTree.
    for(int i = 0;i < structure.Branches.Count;++i)
    {
      tree.AddRange((List<IGH_Goo>) structure.get_Branch(i), structure.get_Path(i));
    }
    // We return the tree.
    return tree;
  }
# ---------- end gh_path_mapper ----------
panel_42 = Panel(path_mapper)
panel_43 = Panel(gh_path_mapper)

# ---- group: Split
merge_2 = Merge(Data1=panel_41, Data2=panel_5)
panel_44 = Panel(merge_2)
panel_45 = Panel("(1;2)")
panel_47 = Panel("""{(0 to 1);0}
{1;1}""")
panel_48 = Panel("""{0;*}[0 to 1]
{1;1}""")
panel_49 = Panel("""{1;1}

{1;2}""")
split = SplitTree(Data=panel_44, Masks=flatten(panel_47))  # -> Positive, Negative
gh_split = CSharpScript(D=panel_44, M=panel_47)  # -> P, N; inputs D: tree, M: list of String
# ---------- gh_split: C# ----------
    // Component written by @sonomirco

    // The component splits a data tree into two parts using path masks.
    // You can have more information on path masks using the link below.
    // https://discourse.mcneel.com/t/c-component-with-split-tree-input/44674
    // And here a very brief description of how the split tree works.
    // https://discourse.mcneel.com/t/c-component-with-split-tree-input/44674/3?u=bianchini

    // Glabal variables.
    // We collect the data directly from the inputs so we can make better checks on the data e structure.
    GH_Structure<IGH_Goo> inputTree = (GH_Structure<IGH_Goo>) this.Component.Params.Input[0].VolatileData;
    GH_Structure<IGH_Goo> inputMask = (GH_Structure<IGH_Goo>) this.Component.Params.Input[1].VolatileData;
    // We initialize two data trees of type IGH_Goo, so we can handle all the null and empty data.
    DataTree<IGH_Goo> positiveTree = new DataTree<IGH_Goo>();
    DataTree<IGH_Goo> negativeTree = new DataTree<IGH_Goo>();
    // We initialize a list of GH_TreeRules, which is the core of the split tree.
    // https://developer.rhino3d.com/api/grasshopper/html/T_Grasshopper_Kernel_Data_GH_TreeRules.htm
    List<GH_TreeRules> treeRules = new List<GH_TreeRules>();
    // And we initialize two boolean values that we will use to filter some behaviors.
    bool pathFlag = false;
    bool addFlag = false;

    // We throw a warning message if we don't have any data passed to the input M
    if(inputMask.IsEmpty)
    {
      this.Component.AddRuntimeMessage(GH_RuntimeMessageLevel.Warning, "Input parameter M failed to collect data");
      return;
    }
    else
    {
      // We initialize two strings.
      // message, will collect the error message from the method FromString.
      // https://developer.rhino3d.com/api/grasshopper/html/M_Grasshopper_Kernel_Data_GH_TreeRules_FromString.htm
      // ruleString, will collect the conversation from a IGH_Goo to a string.
      // https://developer.rhino3d.com/api/grasshopper/html/M_Grasshopper_Kernel_GH_Convert_ToString.htm
      string message = null;
      string ruleString = string.Empty;
      // We loop through the list of masks.
      foreach (IGH_Goo rule in inputMask.Branches[0])
      {
        // We convert the IGH_Goo into a string using the converter.
        GH_Convert.ToString(rule, out ruleString, GH_Conversion.Primary);
        // We create a tree rule from a string.
        GH_TreeRules treeRule = GH_TreeRules.FromString(ruleString, ref message);
        // If we catch a message we throw it as an error.
        if(message != null)
          this.Component.AddRuntimeMessage(GH_RuntimeMessageLevel.Error, message);
        // If the rule is valid we store it in treeRules list.
        if(treeRule != null)
        {
          treeRules.Add(treeRule);
          // If the rule is valid and is index rule, we flag the first boolean.
          // https://developer.rhino3d.com/api/grasshopper/html/P_Grasshopper_Kernel_Data_GH_TreeRules_HasItemRule.htm
          if(treeRule.HasItemRule)
            pathFlag = true;
        }
        // If the list of rules is empty, we output the input tree and terminate the process.
        if(treeRules.Count <= 0)
        {
          // We expire the solution of the output P, to avoid null data as result.
          this.Component.Params.Output[0].ExpireSolution(true);
          N = D;
          return;
        }
      }
      // We loop through the tree dimension, number of branches.
      for (int i = 0; i < inputTree.Branches.Count; i++)
      {
        // We collect the data of the branch by index.
        List<IGH_Goo> tempBranch = inputTree.Branches[i];
        // We collect the path of the branch by index.
        GH_Path path = inputTree.get_Path(i);
        // If this flag is true we jump in this process.
        if(pathFlag)
        {
          // We initialize two lists, and we start to loop every branch.
          List<IGH_Goo> tempConteiner1 = new List<IGH_Goo>();
          List<IGH_Goo> tempConteiner2 = new List<IGH_Goo>();
          for (int j = 0; j < tempBranch.Count; j++)
          {
            // We reset the value to false every interaction.
            addFlag = false;
            // We loop through the tree rules we created.
            foreach (GH_TreeRules rule in treeRules)
            {
              // We check if the rule is appliable, if it is true, we flag our second boolean value and we break the loop.
              // https://developer.rhino3d.com/api/grasshopper/html/M_Grasshopper_Kernel_Data_GH_TreeRules_Apply_1.htm
              if (rule.Apply(path, j))
              {
                addFlag = true;
                break;
              }
            }
            // If our second flag is true, we collect the data in the first container and we add a null value in the second.
            // If it is false is the opposite.
            if(addFlag)
            {
              tempConteiner1.Add(tempBranch[j]);
              tempConteiner2.Add((IGH_Goo) null);
            }
            else
            {
              tempConteiner1.Add((IGH_Goo) null);
              tempConteiner2.Add(tempBranch[j]);
            }
          }
          // We collect the list in the data tree.
          positiveTree.AddRange(tempConteiner1, path);
          negativeTree.AddRange(tempConteiner2, path);
        }
          // If we don't have rules using index rule. We step in this condition.
        else
        {
          // We reset the value to false every interaction.
          addFlag = false;
          // We loop through the tree rules we created.
          foreach (GH_TreeRules rule in treeRules)
          {
            // We check if the rule is appliable, if it is true, we flag our second boolean value and we break the loop.
            // https://developer.rhino3d.com/api/grasshopper/html/M_Grasshopper_Kernel_Data_GH_TreeRules_Apply.htm
            if (rule.Apply(path))
            {
              addFlag = true;
              break;
            }
          }
          // If our second flag is true, we collect the data in the positive tree.
          // If it is false, we collect the data in the negative tree.
          if(addFlag)
            positiveTree.AddRange(inputTree.Branches[i], path);
          else
            negativeTree.AddRange(inputTree.Branches[i], path);
        }
      }
    }
    // Output results.
    P = positiveTree;
    N = negativeTree;
# ---------- gh_split: C# additional code ----------
  //Print(treeRules.Count.ToString());

  //        if((string) ruleString == compareString)
  //        {
  //          this.Component.Params.Output[1].ExpireSolution(true);
  //          N = D;
  //          return;
  //        }
# ---------- end gh_split ----------
panel_50 = Panel(gh_split.P)
panel_51 = Panel(split.Positive)
panel_52 = Panel(split.Negative)
panel_53 = Panel(gh_split.N)

# ---- group: Path Compare
tstat = TreeStatistics(Tree=panel_44)  # -> Paths, Length, Count
panel_54 = Panel("(1;1)")
panel_55 = Panel(tstat.Paths)
panel_56 = Panel("{(0 to 1);0}")
panel_57 = Panel("{1;1}")
compare = PathCompare(Path=panel_55, Mask="{0;*}[0 to 1]")
gh_compare = CSharpScript(P=panel_55, M="{0;*}[0 to 1]")  # -> C; inputs P: list of String, M: String
# ---------- gh_compare: C# ----------
    // Component written by @sonomirco

    // The component compares a path to a mask pattern, and returns true of false.

    // We collect the data directly from the inputs so we can make better checks on the data e structure.
    GH_Structure<IGH_Goo> inputPath = (GH_Structure<IGH_Goo>) this.Component.Params.Input[0].VolatileData;
    // We throw a warning message if we don't have any data passed to the input M
    if(inputPath.IsEmpty || inputPath.DataCount == 0)
    {
      this.Component.AddRuntimeMessage(GH_RuntimeMessageLevel.Warning, "Input parameter M failed to collect data");
      return;
    }
    // Glabal variables.
    List<bool> results = new List<bool>();
    string message = null;
    string pathString = string.Empty;

    // We create a tree rule from a string.
    GH_TreeRules treeRule = GH_TreeRules.FromString(M, ref message);
    // If we catch a message during the creation of the rule, we throw it as an error.
    if(message != null)
      this.Component.AddRuntimeMessage(GH_RuntimeMessageLevel.Error, message);

    // We loop through the branches.
    foreach (IGH_Goo pathGoo in inputPath.Branches[0])
    {
      // We convert the IGH_Goo into a string using the converter.
      GH_Convert.ToString(pathGoo, out pathString, GH_Conversion.Primary);
      // We create a GH_Path by a string.
      GH_Path path = new GH_Path();
      path.FromString(pathString);

      // We use the method Apply to check which rule matches the path and we collect the result.
      results.Add(treeRule.Apply(path));
    }

    // Output result.
    C = results;
# ---------- end gh_compare ----------
panel_58 = Panel(compare)
panel_59 = Panel(gh_compare)

# ---- group: Relative Item 2
pt = ConstructPoint(XCoordinate=0, YCoordinate=0, ZCoordinate=10)
xy = XYPlane(Origin=pt)
panel_60 = Panel("{+1}[+1]")
toggle_3 = BooleanToggle(False)
toggle_4 = BooleanToggle(True)
recgrid_2 = Rectangular(Plane=PlaneXY(0, 0, 0), SizeX=5, SizeY=5, ExtentX=10, ExtentY=10)  # -> Cells, simplify(Points)
recgrid_3 = Rectangular(Plane=xy, SizeX=5, SizeY=5, ExtentX=10, ExtentY=10)  # -> Cells, simplify(Points)
gh_relitem2 = CSharpScript(A=recgrid_2.Points, B=recgrid_3.Points, O="{+1}[-1]", Wp=toggle_3, Wi=toggle_4)  # -> Aout, Bout; inputs A: tree, B: tree, O: String, Wp: Boolean, Wi: Boolean
# ---------- gh_relitem2: C# ----------
    // Component written by @sonomirco

    // The component enables to extract 2 lists from two lists, the outp lists are dictated by the Relative Offset input O.
    // For more information about the component check this link
    // https://discourse.mcneel.com/t/relative-items/107728/7
    // Despety the apparently complexity of the component, everything is managed by the GH_PathOffset class.
    // https://developer.rhino3d.com/api/grasshopper/html/T_Grasshopper_Kernel_Data_GH_PathOffset.htm

    // Global variables.
    // Collect the data tree structure from the input zero, and the input one.
    GH_Structure<IGH_Goo> inputTree1 = (GH_Structure<IGH_Goo>) this.Component.Params.Input[0].VolatileData;
    GH_Structure<IGH_Goo> inputTree2 = (GH_Structure<IGH_Goo>) this.Component.Params.Input[1].VolatileData;
    // Initizialize two data trees.
    DataTree<IGH_Goo> tree1 = new DataTree<IGH_Goo>();
    DataTree<IGH_Goo> tree2 = new DataTree<IGH_Goo>();

    // Create a pathOffset, parsing the string from the input O.
    GH_PathOffset pathOffset = GH_PathOffset.ParseString(O);
    // If the result is null, we throws an error message.
    if(pathOffset == null)
      this.Component.AddRuntimeMessage(GH_RuntimeMessageLevel.Error, "Offset mask is not valid");

    // We set PathWrap and ItemWrap based on the inputs Wp and Wi.
    pathOffset.PathWrap = Wp;
    pathOffset.ItemWrap = Wi;

    // We loop through the branches.
    for (int i = 0; i < inputTree1.PathCount; i++)
    {
      // We extract the path of the branch.
      GH_Path path = inputTree1.get_Path(i);

      // We loop inside the branch.
      for (int j = 0; j < inputTree1.Branches[i].Count; j++)
      {
        // We initialize a GH_Path and int variable used to collect the results from the following method.
        GH_Path relativePath = new GH_Path();
        int relativeIndex = 0;

        // Here the core of the component, the use of the method OffsetPath.
        // https://developer.rhino3d.com/api/grasshopper/html/M_Grasshopper_Kernel_Data_GH_PathOffset_OffsetPath_1.htm
        bool check = pathOffset.OffsetPath(path, j, inputTree2, out relativePath, out relativeIndex);
        if(check)
        {
          // We extract the data for the first input.
          IGH_Goo data1 = inputTree1[path][j];
          // We extract the data for the second input.
          IGH_Goo data2 = inputTree2[relativePath][relativeIndex];
          // We collect the data in the first tree collection.
          tree1.Add(data1, path);
          // We collect the data in the second tree collection.
          tree2.Add(data2, path);
        }
      }
    }
    // Outputs result.
    Aout = tree1;
    Bout = tree2;
# ---------- end gh_relitem2 ----------
relitem2 = RelativeItems(TreeA=recgrid_2.Points, TreeB=recgrid_3.Points, Offset="{+1}[-1]", WrapPaths=toggle_3, WrapItems=toggle_4)  # -> ItemA, ItemB
panel_61 = Panel(relitem2.ItemB)
panel_62 = Panel(gh_relitem2.Bout)
panel_63 = Panel(relitem2.ItemA)
panel_64 = Panel(gh_relitem2.Aout)

# ---- group: Replace Paths
panel_65 = Panel("""{0, 0, 0}
Null Point
{50, 50, 0}
<null>""")
panel_66 = Panel("""{2;0}
{2;1}""")
panel_67 = Panel("""{0;0}
{1;0}""")
gh_replace = CSharpScript(D=panel_65, S=panel_67, R=panel_66)  # -> Dout; inputs D: tree, S: list of String, R: list of String
# ---------- gh_replace: C# ----------
    // Component written by @sonomirco

    // The component finds and replace paths in a data tree.

    // Glabal variables.
    // We collect the data directly from the inputs so we can make better checks on the data e structure.
    GH_Structure<IGH_Goo> inputTree = (GH_Structure<IGH_Goo>) this.Component.Params.Input[0].VolatileData;
    // We initialize a DataTree object.
    DataTree<IGH_Goo> treeOutput = new DataTree<IGH_Goo>();
    string message = null;

    // We throw a warning message if we don't have any data passed to the input D.
    if(inputTree.IsEmpty)
      this.Component.AddRuntimeMessage(GH_RuntimeMessageLevel.Warning, "Input parameter D failed to collect data");
    // If S and R don't have the same dimension we throw a warning message.
    if (S.Count != R.Count)
      this.Component.AddRuntimeMessage(GH_RuntimeMessageLevel.Error, "Path search/replace requires equal numbers of search masks and paths.");

    // We loop through the inputTree, counting the number of paths.
    for (int i = 0; i < inputTree.PathCount; i++)
    {
      // We define a flag parameter, and we extract the path from the branch at index i.
      bool flag = false;
      GH_Path pathBranch = inputTree.get_Path(i);

      // We loop for the dimension of S or can be R as well, the two list have the same size.
      for (int j = 0; j < S.Count; j++)
      {
        // We create a tree rule from a string.
        GH_TreeRules mask = GH_TreeRules.FromString(S[j], ref message);
        // If we catch a message during the creation of the rule, we throw it as an error.
        if (message != null)
          this.Component.AddRuntimeMessage(GH_RuntimeMessageLevel.Error, message);

        // We create the replacePath from a string.
        GH_Path replacedPath = new GH_Path();
        replacedPath.FromString(R[j]);

        // We use the Apply method to check if the mask matches some paths.
        if(mask.Apply(pathBranch))
        {
          // If we have a match, we add the branch to the tree and replace the path.
          // We flag true, so we don't add this branch again into the tree.
          // We break this loop.
          treeOutput.AddRange(inputTree.Branches[i], replacedPath);
          flag = true;
          break;
        }
      }
      // If the flag is false, we add the branch to the tree, keeping the same path.
      if(!flag)
        treeOutput.AddRange(inputTree.Branches[i], pathBranch);
    }

    // Output result.
    Dout = treeOutput;
# ---------- end gh_replace ----------
replace = ReplacePaths(Data=panel_65, Search=panel_67, Replace=panel_66)
panel_68 = Panel(replace)
panel_69 = Panel(gh_replace)

# ---- group: Tree Item
panel_70 = Panel(panel_17)
wrap = BooleanToggle(True)
panel_71 = Panel("""2
1""")
panel_72 = Panel("""{1;2}
{0;0}""")
item = TreeItem(Tree=panel_70, Path=panel_72, Index=panel_71, Wrap=wrap)
gh_item = CSharpScript(T=panel_70, P=panel_72, i=panel_71, W=wrap)  # -> E; inputs T: tree, P: String, i: Int32, W: Boolean
# ---------- gh_item: C# ----------
    // Component written by @sonomirco

    // The component retrieves a specific branch from a data tree.
    // As for other components we simulate the behavior using an additional input, in this case, the one named maintainPath.

    // Glabal variables.
    // We extract the GH_Structure from the input index zero.
    // We initialize a GH_Path.
    // We initialize an integer value equal to the i input.
    GH_Structure<IGH_Goo> inputTree = (GH_Structure<IGH_Goo>) this.Component.Params.Input[0].VolatileData;
    GH_Path path = new GH_Path();
    int indexValue = i;

    // Because we are passing the input as a string and not a path, we create the GH_Path using the method FromString.
    // https://developer.rhino3d.com/api/grasshopper/html/M_Grasshopper_Kernel_Data_GH_Path_FromString.htm
    path.FromString(P);

    // We check if the path exists in the GH_Structure, using the method PathExists.
    // If doesn't exist, we throw an error message.
    if(!inputTree.PathExists(path))
      this.Component.AddRuntimeMessage(GH_RuntimeMessageLevel.Error, string.Format("Path {0} does not exist within this tree", path.ToString()));
    else
    {
      // We extract the branch.
      List<IGH_Goo> branch = inputTree[path];
      // If input W is true, we use the WrapInteger method.
      // https://www.grasshopper3d.com/forum/topics/how-acts-list-item-comp-with-index-out-of-range
      if(W)
        indexValue = Grasshopper.Kernel.GH_MathUtil.WrapInteger(i, branch.Count);
      // We check if indexValue is smaller of zero or bigger then the branch length.
      if(indexValue < 0)
        this.Component.AddRuntimeMessage(GH_RuntimeMessageLevel.Warning, "Supplied index too low, no possible solution");
      else if (indexValue >= branch.Count)
        this.Component.AddRuntimeMessage(GH_RuntimeMessageLevel.Warning, "Supplied index too high, no possible solution");
        // Output result.
      else
        E = branch[indexValue];
    }
# ---------- end gh_item ----------
panel_73 = Panel(item)
panel_74 = Panel(gh_item)

# ---- group: Deconstruct Path
panel_75 = Panel("""{0;1;0}
{1;1;2}""")
gh_dpath = CSharpScript(B=panel_75)  # -> I; inputs B: String
# ---------- gh_dpath: C# ----------
    // Component written by @sonomirco

    // The component deconstructs a data tree path into individual integers.

    // Glabal variables.
    // We initialize a GH_Path.
    GH_Path path = new GH_Path();

    // Because we can't have tree path as input in the C# component,
    // we create the path from the string we are passing in.
    path.FromString(B);

    // Output result.
    // The path deconstruction is computed by extracting the single indices of the path.
    I = path.Indices;
# ---------- end gh_dpath ----------
dpath = DeconstructPath(Branch=panel_75)
panel_76 = Panel(dpath)
panel_77 = Panel(gh_dpath)

# ---- group: Construct Path
panel_78 = Panel(dpath)
gh_path = CSharpScript(I=panel_78)  # -> B; inputs I: list of Int32
# ---------- gh_path: C# ----------
    // Component written by @sonomirco

    // The component constructs a data tree branch path, by indices.

    // We check the input is not empty and null.
    if(I == null || I.Count == 0) return;

    // Because a GH_Path is basically an array of int,
    // we can create a GH_Path passing our set of integers straight away.
    // The constructor ask for an array so we convert our list into an array.
    GH_Path path = new GH_Path(I.ToArray());

    // Output result.
    B = path;
# ---------- end gh_path ----------
path = ConstructPath(Indices=panel_78)
panel_79 = Panel(path)
panel_80 = Panel(gh_path)

# ---- group: Stream Gate
list_3 = ValueList({"GateLessThanZero": -1, "GateZero": 0, "GateOne": 1, "GateTwo": 2}, selected="GateZero")
panel_81 = Panel("""{0, 0, 0}
Null Point
{50, 50, 0}
<null>""")
gh_gate = CSharpScript(S=panel_81, G=list_3)  # -> G0, G1; inputs G: Int32
# ---------- gh_gate: C# ----------
    // Component written by @sonomirco

    // The component redirects a stream into specific output.
    // This component acts like a switch, the input is allowed to pass through the component into a specific output.

    // NOTE
    // Since we are working with dynamic outputs in this component,
    // the output parameter is set in the AfterRunScript()function. Hence, before every execution
    // of the RunScript() function, we manually clear out all the data in the output.
    // We identify the internal variable using underscore.

    // If the input G, input index 0, is empty, so no values have been passed to input.
    // We throw a warning message.
    if(this.Component.Params.Input[0].VolatileData.IsEmpty)
      this.Component.AddRuntimeMessage(GH_RuntimeMessageLevel.Warning, "Input parameter S failed to collect data");
    // If the input G, input index 0, has more than one value.
    // We set the flagGateInputs true, and throw an error.
    if(this.Component.Params.Input[1].VolatileData.DataCount > 1)
    {
      _flagGateInputs = true;
      this.Component.AddRuntimeMessage(GH_RuntimeMessageLevel.Error, "Gate component can only operate on a single Gate Index value.");
    }
      // If the input G value is less than zero.
      // We set the flag false, and throw an error.
    else if(G < 0)
    {
      _flag = false;
      this.Component.AddRuntimeMessage(GH_RuntimeMessageLevel.Error, "Gate index too low.");
    }
      // If the input G value is bigger than the number of input.
      // We reduce the count by one because the ouputs start with index zero.
      // We set the flag false, and throw an error.
    else if(G > this.Component.Params.Input.Count - 1)
    {
      _flag = false;
      this.Component.AddRuntimeMessage(GH_RuntimeMessageLevel.Error, "Gate index too high.");
    }
      // If we passed all the check we set the flag true and the gateValue equal to the G input.
    else
    {
      _flag = true;
      _gateValue = G;
    }
# ---------- gh_gate: C# additional code ----------
  // Persistante variables.
  // Two boolean values, to trigger some behaviors we have inside the AfterRunScript.
  // A integer value used in the behaviors.
  private bool _flag;
  private bool _flagGateInputs;
  private int _gateValue;

  // Private method to expire all the outputs we are not using.
  // We declare the integer value nullable adding a question mark after the type.
  // https://docs.microsoft.com/en-us/dotnet/csharp/language-reference/builtin-types/nullable-value-types
  // So passing null, the if statement will be ignored, and we expire all the outputs.
  // Other solution could be passing a negative value like -1.
  private void ExpireOutput(int? skipOutput)
  {
    for (int i = 0; i < this.Component.Params.Input.Count; i++)
    {
      if(i == skipOutput)
        continue;
      this.Component.Params.Output[i].ExpireSolution(true);
    }
  }

  // This method will be called once every solution, after any calls to RunScript.
  // https://discourse.mcneel.com/t/output-addvolatiledata-in-c-script-component-overridden-with-null-element/113520/2?u=bianchini
  public override void AfterRunScript()
  {
    // We loop through the input to update the nickName of each of them.
    // We avoid changing the first input (index 0) and we started from the second (index 1).
    for (int i = 0; i < this.Component.Params.Output.Count; i++)
      this.Component.Params.Output[i].NickName = "G" + i;

    if(_flagGateInputs)
    {
      // We clear the data to avoid null values where passed by the RunScript in the output.
      this.Component.Params.Output[0].ClearData();
      // We pass the data from the input to the output.
      this.Component.Params.Output[0].AddVolatileDataTree(this.Component.Params.Input[0].VolatileData);
      // We call our private method and we expire all the outputs except that the one with index 0
      ExpireOutput(0);
    }

    if(_flag)
    {
      // We clear the data to avoid null values where passed by the RunScript in the output.
      this.Component.Params.Output[_gateValue].ClearData();
      // We pass the data from the input to the output.
      this.Component.Params.Output[_gateValue].AddVolatileDataTree(this.Component.Params.Input[0].VolatileData);
      // We call our private method and we expire all the outputs except that the one passed as input G.
      ExpireOutput(_gateValue);
    }
    else
      // We call our private method and we expire all the outputs, passing null as the input of the argument.
      ExpireOutput(null);
  }
# ---------- end gh_gate ----------
gate = StreamGate(Stream=panel_81, Gate=list_3)  # -> Target0, Target1
panel_82 = Panel([gh_gate.G1, gh_gate.G0])
panel_83 = Panel([gate.Target0, gate.Target1])

# ---- group: Explode tree
panel_84 = Panel(entwine_3)
match_outputs = Button()
gh_bang = CSharpScript(MatchOutputs=match_outputs, D=panel_84)  # -> B0, B1, B2, B3, B4, B5; inputs MatchOutputs: Boolean, D: tree
# ---------- gh_bang: C# usings ----------
using Grasshopper.Kernel.Parameters;
# ---------- gh_bang: C# ----------
    // Component written by @sonomirco

    // The component extracts all the branches from a tree.

    // Using a C#script is very inconvenient to try to define a dynamic behavior of the component,
    // but we tried to mimic as much as possible the original component.
    // We extract the match outputs in a boolean input.
    // What the component is able to do:
    // 1. Pressing the button, the component updates the output to the number of branches of the tree.
    // 2. Connecting a different input the component is able to recognize if the number of branches is less of the outputs and
    // identify this difference updating the name of the output as Empty Branch (EB).
    // What the component is not able to do:
    // 1. Reducing the number of outputs base on the number of branches requires a manual remotion of the output identifies with the name EB.

    // NOTE
    // Since we are working with dynamic outputs in this component,
    // the variable to hold the outputs, _tree is defined
    // as a persistent variable, outside the scope of the RunScript()
    // function. Also, from the _tree, the outputs from each
    // branch are passed to their respective output parameters in
    // the AfterRunScript()function. Hence, before every execution
    // of the RunScript() function, we manually clear out all
    // the branches and data in the outputTree.
    // We identify the internal variable using underscore.
    _tree.Clear();

    // Collect number of branches and number of outputs.
    int numberOfBranchInput = D.BranchCount;
    int numberOfOutputs = this.Component.Params.Output.Count;
    // Check is the number of branches is bigger than the number of outputs, if it is true, throw a warning message.
    if(numberOfBranchInput > numberOfOutputs)
    {
      this.Component.AddRuntimeMessage(GH_RuntimeMessageLevel.Warning, "Tree contains more branches than this component has output parameters.");
    }

    // Passing a true value, using the button, we trigger the creation of the outputs based on the number of branches.
    if(MatchOutputs)
    {
      for (int i = numberOfOutputs; i < numberOfBranchInput; i++)
      {
        // Instantiation of a generic object parameter.
        // https://developer.rhino3d.com/api/grasshopper/html/fbfe5e40-ba8d-4e53-97c6-27572e049835.htm
        // To do this we have to add to the using list Grasshopper.Kernel.Parameters;
        Param_GenericObject param = new Param_GenericObject();
        // The nickname of an input or output is the visible 'name' on the component.
        param.NickName = string.Format("B{0}", i);
        param.Name = string.Format("B{0}", i);
        // We specify the type of access the output can support, all the data will be treated at the same time as a list.
        param.Access = GH_ParamAccess.list;
        // We add the parameter to the outputs, using the method RegisterOutputParam, which ask for a IGH_Param, so we execute a cast.
        // https://developer.rhino3d.com/api/grasshopper/html/M_Grasshopper_Kernel_GH_ComponentParamServer_RegisterOutputParam.htm
        this.Component.Params.RegisterOutputParam((IGH_Param) param);
      }
    }

    // We loop for the number of outputs the component has.
    for (int i = 0; i <= numberOfOutputs; i++)
    {
      // If index i is bigger than the number of branches, we replace the nickName of the output with EB (Empty Branch).
      if(i >= numberOfBranchInput)
        this.Component.Params.Output[i].NickName = string.Format("EB{0}", i);
      else
        // We populate the persistante variable.
        _tree.AddRange(D.Branch(i), D.Path(i));
    }
# ---------- gh_bang: C# additional code ----------
  // Persistante variable.
  DataTree<object> _tree = new DataTree<object>();
  // This method will be called once every solution, after any calls to RunScript.
  // https://discourse.mcneel.com/t/output-addvolatiledata-in-c-script-component-overridden-with-null-element/113520/2?u=bianchini
  public override void AfterRunScript()
  {
    // Loop through the ouputs
    int numberOfOutputs = this.Component.Params.Output.Count;
    for (int i = 0; i < numberOfOutputs; i++)
    {
      // If index i is bigger than branch count return.
      if(i >= _tree.BranchCount) return;
      // Because we are in an after process,
      // we have to clean the outputs that have been set with null value during the primary process
      // and after we add our data.
      this.Component.Params.Output[i].ClearData();
      this.Component.Params.Output[i].AddVolatileDataList(_tree.Path(i), _tree.Branch(i));
    }
  }
# ---------- end gh_bang ----------
bang = ExplodeTree(Data=panel_84)  # -> Branch0, Branch1, Branch2, Branch3, Branch4, Branch5
panel_85 = Panel(bang.Branch1)
panel_86 = Panel(bang.Branch2)
panel_87 = Panel(gh_bang.B1)
panel_88 = Panel(gh_bang.B2)

# ---- group: Merge
panel_89 = Panel(mocked.Tree)
gh_merge = CSharpScript(D1=panel_89, D2=panel_89)  # -> R; inputs D1: tree, D2: tree
# ---------- gh_merge: C# ----------
    // Component written by @sonomirco

    // Flatten and combine a collection (Lists or Trees) of data.

    // We call a ScheduleSolution used to modify the naming of the inputs.
    // Schedule a new solution after a specified time interval.
    // This means, that after the component has run, a new solution will be called to solve the specific operations we are passing through the CallBack method.
    // https://discourse.mcneel.com/t/can-t-quite-figure-out-how-to-use-schedulesolution/105590/3?u=bianchini
    GrasshopperDocument.ScheduleSolution(5, CallBack);

    // Global parameter.
    GH_Structure<IGH_Goo> tree = new GH_Structure<IGH_Goo>();
    int numberOfInputs = this.Component.Params.Input.Count;
    // We loop through the inputs.
    for (int i = 0; i < numberOfInputs; i++)
    {
      // We collect the input as a GH_Structure.
      GH_Structure<IGH_Goo> inputTree = (GH_Structure<IGH_Goo>) this.Component.Params.Input[i].VolatileData;
      // We merge the inputTree one by one in our global variable, using the method MergeStructure.
      // https://developer.rhino3d.com/api/grasshopper/html/M_Grasshopper_Kernel_Data_GH_Structure_1_MergeStructure.htm
      tree.MergeStructure(inputTree);
    }

    // Output result.
    // Using our private method we convert the GH_Structure in a DataTree.
    R = StructureToDataTree(tree);
# ---------- gh_merge: C# additional code ----------
  // Method used to modify the input names.
  public void VariableParameterMaintenance()
  {
    // We loop through the inputs.
    int num = this.Component.Params.Input.Count - 1;
    for (int index = 0; index <= num; ++index)
    {
      // We set the NickName and Name of the inputs.
      // NickName is the 'name' visible on the component.
      // Name is the 'name' in the description when you put the mouse on an input or output.
      this.Component.Params.Input[index].Name = string.Format("Branch {0}", index);
      this.Component.Params.Input[index].NickName = string.Format("D{0}", index + 1);
      // We set the input access, this is the same action we do when we right click
      // on a input or output and we select an item a list or a tree, in this case we select a tree.
      this.Component.Params.Input[index].Access = GH_ParamAccess.tree;
    }
  }
  // Inside the CallBack we call the method we defined to change the input names, and we expire the component solution so
  // in the next new solution this component can be solved again.
  // It is necessary to define the CallBack method with a GH_Document input otherwise the ScheduleSolution won't work.
  public void CallBack(GH_Document gh)
  {
    VariableParameterMaintenance();
    this.Component.Params.OnParametersChanged();
    this.Component.ExpireSolution(false);
  }

  // Private method to convert a GH_Structure in DataTree.
  private DataTree<IGH_Goo> StructureToDataTree(GH_Structure<IGH_Goo> structure)
  {
    // We instantiate a tree.
    DataTree<IGH_Goo> tree = new DataTree<IGH_Goo>();
    // We loop through each branch and copied in the DataTree.
    for(int i = 0;i < structure.Branches.Count;++i)
    {
      tree.AddRange((List<IGH_Goo>) structure.get_Branch(i), structure.get_Path(i));
    }
    // We return the tree.
    return tree;
  }
# ---------- end gh_merge ----------
merge_3 = Merge(Data1=panel_89, Data2=panel_89)
panel_90 = Panel(merge_3)
panel_91 = Panel(gh_merge)

# ---- group: Flip matrix
panel_92 = Panel(panel_90)
gh_flip = CSharpScript(D=panel_92)  # -> Dr; inputs D: tree
# ---------- gh_flip: C# ----------
    // Component written by @sonomirco

    // The component flips the data tree.
    // Thinking about the data tree like an excel file and you are swapping rows and columns.

    // Global variables.
    // Collecting the data input as a GH_Structure, as in previous example we have to cust the data.
    GH_Structure<IGH_Goo> inputTree = (GH_Structure<IGH_Goo>) this.Component.Params.Input[0].VolatileData;
    // We collect the length of the first branch,
    // the number of branches,
    // the path length of the first branch and
    // we set a parameter check.
    int branchCapacity = inputTree.Branches[0].Count;
    int treeCapacity = inputTree.Branches.Count;
    int pathCapacity = inputTree.get_Path(0).Length;
    int indexPathChecks = -1;

    // If the path count is equal one we don't have to execute any checks.
    // We set out check parameter and we move to the foor loop.
    if(inputTree.PathCount == 1)
    {
      indexPathChecks = pathCapacity - 1;
    }
    else
    {
      // We loop using the tree dimension, the number of branches.
      for (int t = 1; t < treeCapacity; t++)
      {
        // We execute a first check.
        // If the path length of each branch is different of the path length of the first branch
        // we throw an error message, we expire the solution so we don't output anything and we terminate the process.
        if(inputTree.get_Path(t).Length != pathCapacity)
        {
          this.Component.AddRuntimeMessage(GH_RuntimeMessageLevel.Error, "All paths in the input tree must have the same length");
          this.Component.Params.Output[0].ExpireSolution(true);
          return;
        }
        // We loop using the dimension of the path.
        for (int v = 0; v < pathCapacity; v++)
        {
          // We compare the first branch index path at the index position v to the following branch index paths at the same index position v.
          // If are not the same, we jump in the statement.
          if(inputTree.get_Path(0)[v] != inputTree.get_Path(t)[v])
          {
            // We check if the path check value is less than zero or it's the same as index value v.
            if (indexPathChecks < 0 || indexPathChecks == v)
            {
              // We set path check equal value v.
              // This is a simple strategy to verify if the values are the same, if aren't we jump in the else statement.
              indexPathChecks = v;
            }
            else
            {
              // As for the previous error, we throw an error message, expire the solution, and terminate the process.
              this.Component.AddRuntimeMessage(GH_RuntimeMessageLevel.Error, "All paths may only differ at a single locus");
              this.Component.Params.Output[0].ExpireSolution(true);
              return;
            }
          }
        }
      }
    }

    // Glabal variable.
    DataTree<object> tree = new DataTree<object>();

    // This part is the real logic of the component.
    // We have nested loops because we have to swap raws(branches) with columns(elements in the branches).
    // So we start the first loop using the number of elements.
    for (int i = 0; i < branchCapacity; i++)
    {
      // We store the path of the first branch.
      // And we instantiate a new list every time we re-start the loop.
      GH_Path path = new GH_Path(inputTree.get_Path(0));
      List<object> tempBranch = new List<object>();
      // We enter in the second loop, using the branches.
      for (int j = 0; j < treeCapacity; j++)
      {
        // We check if the branch is empty, or the index i (counting the branch capacity)
        // is bigger or equal to the branch count.
        // If it is true, we add to the list a null value.
        // Otherwise we add to the list the value we have from the branch.
        if(inputTree.Branches[j].Count == 0 || i >= inputTree.Branches[j].Count)
          tempBranch.Add(null);
        else
          tempBranch.Add(inputTree.Branches[j][i]);
      }
      // The branch path is like an array of integer, so we can modify any values
      // accessing it by an index value.
      path[indexPathChecks] = i;
      // We add the list to the tree, with the modified path.
      tree.AddRange(tempBranch, path);
    }

    // Output result.
    Dr = tree;
# ---------- end gh_flip ----------
flip = FlipMatrix(Data=panel_92)
panel_93 = Panel(flip)
panel_94 = Panel(gh_flip)

# ---- group: Prune Tree
series = Series(Start=0, Step=1, Count=3)
series_2 = Series(Start=0, Step=1, Count=6)
series_3 = Series(Start=0, Step=1, Count=4)
number_slider = Slider(3, range=-1..10)
n1 = Slider(6, range=1..10)
entwine_4 = Entwine(Branch00=series, Branch01=series_2, Branch02=series_3, FlattenInputs=True)
gh_prune = CSharpScript(T=entwine_4, N_0=number_slider, N_1=n1)  # -> out, Tr; inputs T: tree, N_0: Int32, N_1: Int32
# ---------- gh_prune: C# ----------
    // Component written by @sonomirco

    // This component removes all branches from a Tree that are smaller or bigger than the input thresholds provided.
    // For this component we will use the method RemovePath.
    // https://developer.rhino3d.com/api/grasshopper/html/M_Grasshopper_DataTree_1_RemovePath.htm

    // Looping through the DataTree.
    for (int i = 0; i < T.BranchCount; i++)
    {
      // Record the path of the branch.
      GH_Path path = T.Path(i);
      // If the dimension of the branch is smaller than input N_0, remove the path.
      if(T.Branch(i).Count < N_0)
        T.RemovePath(path);
        // If the dimension of the branch is bigger than input N_1, remove the path.
      else if(T.Branch(i).Count > N_1)
        T.RemovePath(path);
    }
    // Output result.
    Tr = T;
# ---------- end gh_prune ----------
prune = PruneTree(Tree=entwine_4, Minimum=number_slider, Maximum=n1)
panel_95 = Panel(prune)
panel_96 = Panel(gh_prune.Tr)

# ---- group: Flatten Tree
panel_97 = Panel(merge)
path_2 = DataPath("{0;1;0;1}")
flatten_8 = FlattenTree(Tree=panel_97, Path="{0;1;0;1}")
gh_flatten = CSharpScript(T=panel_97, P=path_2)  # -> out, Tr; inputs T: tree
# ---------- gh_flatten: C# ----------
    // Component written by @sonomirco

    // The component flatten all the branches into one.

    // DataTree and GH_Structure have the same method Flatten, so for simplicity, we will use DataTree object.

    // First things first, because C# component doesn't have an input type GH_Path we have to cast the input
    // P that we pass as a generical object in a GH_Path.
    // We can do this in two ways:
    // GH_Path path = P as GH_Path;
    GH_Path path = (GH_Path) P;
    // https://developer.rhino3d.com/api/grasshopper/html/M_Grasshopper_DataTree_1_Flatten.htm
    T.Flatten(path);

    // Output result.
    Tr = T;
# ---------- end gh_flatten ----------
panel_98 = Panel(flatten_8)
panel_99 = Panel(gh_flatten.Tr)

# ---- group: Unflatten Tree
panel_100 = Panel(gh_flatten.Tr)
tree = Data(merge)
gh_unflatten = CSharpScript(T=panel_100, G=tree)  # -> Tr; inputs T: tree, G: tree
# ---------- gh_unflatten: C# ----------
    // Component written by @sonomirco

    // The component moves items back into branches.

    // Glabal variables.
    DataTree<object> tree = new DataTree<object>();
    int startingRange = 0;
    // We flat the input tree T, and we extract the first branch in a list.
    T.Flatten();
    List<object> flattenTree = T.Branch(0);

    // We looping through the branches of tree input G.
    for (int i = 0; i < G.BranchCount; i++)
    {
      // Collecting branch path and count in two variables.
      GH_Path path = G.Path(i);
      int branchCount = G.Branch(i).Count;
      // If the length of the list, minus the startingRange incremented  every interaction, is less than the length of the branch
      // we throw an error message and the result produced until this point.
      if (flattenTree.Count - startingRange < branchCount)
      {
        this.Component.AddRuntimeMessage(GH_RuntimeMessageLevel.Error, "Flattened tree has fewer items than guide tree.");
        Tr = tree;
        return;
      }
      // We extract a subList using the method GetRange.
      // https://docs.microsoft.com/en-us/dotnet/api/system.collections.generic.list-1.getrange?view=net-5.0
      List<object> subSet = flattenTree.GetRange(startingRange, branchCount);
      // We add the subList to the new tree with the path provided by input G.
      tree.AddRange(subSet, path);
      // We increase the startingRange of the branch's length, so next time we will use GetRange, it will start
      // after the value-added in the previous interaction.
      // Using this way we don't remove items from the list, so we keep the input unmutated.
      startingRange += branchCount;
    }
    // If the length of the list minus the startingRange incremented every interaction is bigger than zero
    // we throw an error message.
    if(flattenTree.Count - startingRange > 0)
      this.Component.AddRuntimeMessage(GH_RuntimeMessageLevel.Error, "Flattened tree has more items than guide tree.");

    // Output result.
    Tr = tree;
# ---------- end gh_unflatten ----------
unflatten = UnflattenTree(Tree=panel_100, Guide=tree)
panel_101 = Panel(unflatten)
panel_102 = Panel(gh_unflatten)

# ---- group: Tree Statistics
panel_103 = Panel(entwine_4)
tstat_2 = TreeStatistics(Tree=panel_103)  # -> Paths, Length, Count
gh_tstat = CSharpScript(T=panel_103)  # -> P, L, C; inputs T: tree
# ---------- gh_tstat: C# ----------
    // Component written by @sonomirco

    // The component provide some information regarding the tree, paths, branch lengths, number of branches.

    // Global parameters.
    GH_Path[] paths = new GH_Path[T.BranchCount];
    int[] branchLength = new int[T.BranchCount];
    // Looping through the branches.
    for (int i = 0; i < T.BranchCount; i++)
    {
      // Collecting branch path and count in the two arrays.
      paths[i] = T.Path(i);
      branchLength[i] = T.Branch(i).Count;
    }
    // Output resut.
    P = paths;
    L = branchLength;
    C = T.BranchCount;
# ---------- end gh_tstat ----------
panel_104 = Panel(tstat_2.Paths)
panel_105 = Panel(gh_tstat.P)
panel_106 = Panel(tstat_2.Length)
panel_107 = Panel(gh_tstat.L)
panel_108 = Panel(gh_tstat.C)
panel_109 = Panel(tstat_2.Count)
