# Grasshopper definition Vector_Grid.ghx (Grasshopper 1.0.7)

# ---- group: Hexagonal
# GH#: A C# dictionary of Grasshopper3D components.
# 
# This file contains a category of Grasshopper components, and a mirroring C#/RhinoCommon implementation.
# 
# This is an educational project initiated by students/faculty of GSD-6338: Introduction to Computational Design, at the Harvard Graduate School of Design.
# 
# More information: {{project link}}
# Vector Grid
pln = Plane(PlaneXY(6.002839061, 8.575233017, 0))
number_slider = Slider(6, range=0..100)
number_slider_2 = Slider(10, range=0..100)
number_slider_3 = Slider(11, range=0..100)
gh_hexgrid = CSharpScript(P=pln, S=number_slider, Ex=number_slider_2, Ey=number_slider_3)  # -> out, C, Pout; inputs P: Plane, S: Double, Ex: Int32, Ey: Int32
# ---------- gh_hexgrid: C# ----------
    // Component written by @krichterlunn & @garciadelcastillo

    // This component creates a hexagonal grid of curves.
    // TODO: make the DataTree branches mimic the input structure.

    // Declare your new lists which you will be creating (point, line, plane, circle, polyline)
    DataTree<Point3d> pts = new DataTree<Point3d>();
    DataTree<Polyline> hexagons = new DataTree<Polyline>();

    // Here you create your center points from which you can create your cirlces and hexagons
    // running through two loops: one for your columns and one for your rows. You can then determine the
    // spacing and position of each point based on equations related to the hexagon.

    for (int i = 0; i < Ex; i++)
    {
      double x = 1.5 * S * i;
      GH_Path path = new GH_Path(i);

      for (int j = 0; j < Ey; j++)
      {
        double y = 3 * S * Math.Tan(Math.PI / 6.0) * j;
        if (i % 2 == 1)
        {
          y += 1.5 * S * Math.Tan(Math.PI / 6.0);
        }

        Point3d pt = P.PointAt(x, y);
        pts.Add(pt, path);
      }
    }


    // For each point you will now orient a new plane at that point.
    // This will allow you to construct a circle and then a polygon at those points.
    for (int i = 0; i < pts.BranchCount; i++)
    {
      List<Point3d> row = pts.Branches[i];
      GH_Path path = pts.Paths[i];
      for (int j = 0; j < row.Count; j++)
      {
        Plane tempP = new Plane(P);
        tempP.Origin = row[j];
        Circle circ = new Circle(tempP, S);
        Polyline hex = Polyline.CreateInscribedPolygon(circ, 6);
        hexagons.Add(hex, path);
      }
    }

    // Output
    Pout = pts;
    C = hexagons;
# ---------- end gh_hexgrid ----------
hexgrid = Hexagonal(Plane=pln, Size=number_slider, ExtentX=number_slider_2, ExtentY=number_slider_3)  # -> Cells, Points
panel = Panel(hexgrid.Cells)
panel_2 = Panel(hexgrid.Points)
panel_3 = Panel(gh_hexgrid.C)
panel_4 = Panel(gh_hexgrid.Pout)

# ---- group: Radial
pln_2 = Plane(PlaneXY(6.002839061, 8.575233017, 0))
number_slider_4 = Slider(5, range=0..100)
number_slider_5 = Slider(3, range=0..100)
number_slider_6 = Slider(7, range=0..100)
gh_radgrid = CSharpScript(P=pln_2, S=number_slider_4, Er=number_slider_5, Ep=number_slider_6)  # -> out, C, Pout; inputs P: Plane, S: Double, Er: Int32, Ep: Int32
# ---------- gh_radgrid: C# ----------
    // Component written by  @garciadelcastillo

    // This component creates a circular grid of polylines.
    // TODO: make the DataTree branches mimic the input structure.

    // Declare your new lists which you will be creating (point,  polyline)
    DataTree<Point3d> pts = new DataTree<Point3d>();
    DataTree<Polyline> sectors = new DataTree<Polyline>();

    // Let's create the corner points for each sector, already sorted as a DataTree.
    // Loop over radius direction first, then along ring.
    double angleInc = 2 * Math.PI / Ep;
    for (int i = 0; i < Er + 1; i++)
    {
      GH_Path path = new GH_Path(i);
      double radius = i * S;

      for (int j = 0; j < Ep; j++)
      {
        // Use a little trigonometry here
        double angle = 0.5 * Math.PI - angleInc * j;  // points are sorted in clock-wise direction
        double x = radius * Math.Cos(angle);
        double y = radius * Math.Sin(angle);

        Point3d p = P.PointAt(x, y);
        pts.Add(p, path);
      }
    }

    // Now use these points to create circular sectors.
    for (int i = 0; i < Er; i++)
    {
      List<Point3d> innerRing = pts.Branches[i];
      List<Point3d> outerRing = pts.Branches[i + 1];
      GH_Path path = pts.Paths[i];

      for (int j = 0; j < Ep; j++)
      {
        Point3d p0, p1, p2, p3;

        // If on the last sector of the ring, make sure to use the initial points
        if (j == Ep - 1)
        {
          p0 = innerRing[j];
          p1 = outerRing[j];
          p2 = outerRing[0];
          p3 = innerRing[0];
        }
          // Otherwise, create a polyline in clockwise direction
        else
        {
          p0 = innerRing[j];
          p1 = outerRing[j];
          p2 = outerRing[j + 1];
          p3 = innerRing[j + 1];
        }

        // Initialize a list with elements in it
        List<Point3d> vertices = new List<Point3d>() {p0, p1, p2, p3, p0};

        Polyline poly = new Polyline(vertices);
        sectors.Add(poly, path);
      }
    }

    // Outputs
    C = sectors;
    Pout = pts;
# ---------- end gh_radgrid ----------
radgrid = Radial(Plane=pln_2, Size=number_slider_4, ExtentR=number_slider_5, ExtentP=number_slider_6)  # -> Cells, Points
panel_5 = Panel(radgrid.Cells)
panel_6 = Panel(radgrid.Points)
panel_7 = Panel(gh_radgrid.C)
panel_8 = Panel(gh_radgrid.Pout)

# ---- group: Rectangular
pln_3 = Plane(PlaneXY(6.002839061, 8.575233017, 0))
number_slider_7 = Slider(6, range=0..100)
number_slider_8 = Slider(7, range=0..100)
number_slider_9 = Slider(20, range=0..100)
number_slider_10 = Slider(17, range=0..100)
gh_recgrid = CSharpScript(P=pln_3, Sx=number_slider_7, Sy=number_slider_8, Ex=number_slider_9, Ey=number_slider_10)  # -> out, C, Pout; inputs P: Plane, Sx: Double, Sy: Double, Ex: Int32, Ey: Int32
# ---------- gh_recgrid: C# ----------
    // Component written by @krichterlunn & @garciadelcastillo

    // This component creates a rectangular grid of curves.
    // TODO: make the DataTree branches mimic the input structure.

    // Declare your new lists which you will be creating (point, rectangle)
    DataTree<Point3d> pts = new DataTree<Point3d>();
    DataTree<Rectangle3d> rectangle = new DataTree<Rectangle3d>();

    // Creating your points using two for loops.
    // First loop runs through all your columns for x and multiplies it by your value Sx (input value).
    // Second loop runs through all your rows for y and multiplies it by your value Sy (input value).
    // These points are then oriented to the plane iPx and iPy which we declared at the begining.
    for (int i = 0; i < Ex + 1; i++)
    {
      double x = i * Sx;
      GH_Path path = new GH_Path(i);

      for (int j = 0; j < Ey + 1; j++)
      {
        double y = j * Sy;
        
        Point3d p = P.PointAt(x, y);
        pts.Add(p, path);
      }
    }

    // This loop runs through all the points we created above (except last ones per row and column),
    // and creates a new plane at each point.
    // From those planes we are then able to create our rectangles with take (plane, x, y) as its input.
    for (int i = 0; i < pts.BranchCount - 1; i++)
    {
      List<Point3d> column = pts.Branches[i];
      GH_Path path = pts.Paths[i];

      for (int j = 0; j < column.Count - 1; j++)
      {
        Plane tempP = new Plane(P);
        tempP.Origin = column[j];
        Rectangle3d rec = new Rectangle3d(tempP, Sx, Sy);
        rectangle.Add(rec, path);
      }
    }

    // Output
    Pout = pts;
    C = rectangle;
# ---------- end gh_recgrid ----------
recgrid = Rectangular(Plane=pln_3, SizeX=number_slider_7, SizeY=number_slider_8, ExtentX=number_slider_9, ExtentY=number_slider_10)  # -> Cells, Points
panel_9 = Panel(recgrid.Cells)
panel_10 = Panel(recgrid.Points)
panel_11 = Panel(gh_recgrid.C)
panel_12 = Panel(gh_recgrid.Pout)

# ---- group: Square
pln_4 = Plane(PlaneXY(6.002839061, 8.575233017, 0))
number_slider_11 = Slider(3, range=0..100)
number_slider_12 = Slider(20, range=0..100)
number_slider_13 = Slider(20, range=0..100)
gh_sqgrid = CSharpScript(P=pln_4, S=number_slider_11, Ex=number_slider_12, Ey=number_slider_13)  # -> out, C, Pout; inputs P: Plane, S: Double, Ex: Int32, Ey: Int32
# ---------- gh_sqgrid: C# ----------
    // Component written by @krichterlunn & @garciadelcastillo

    // This component creates a square grid of curves.
    // TODO: make the DataTree branches mimic the input structure.

    // Declare your new lists which you will be creating (pointrectangle)
    DataTree<Point3d> pts = new DataTree<Point3d>();
    DataTree<Rectangle3d> rectangle = new DataTree<Rectangle3d>();

    // Creating your points using two for loops.
    // First loop runs through all your columns for x and multiplies it by your value Sx (input value).
    // Second loop runs through all your rows for y and multiplies it by your value Sy (input value).
    // These points are then oriented to the plane iPx and iPy which we declared at the begining.
    for (int i = 0; i < Ex + 1; i++)
    {
      double x = i * S;
      GH_Path path = new GH_Path(i);

      for (int j = 0; j < Ey + 1; j++)
      {
        double y = j * S;
        
        Point3d p = P.PointAt(x, y);
        pts.Add(p, path);
      }
    }

    // This loop runs through all the points we created above (except last ones per row and column),
    // and creates a new plane at each point.
    // From those planes we are then able to create our rectangles with take (plane, x, y) as its input.
    for (int i = 0; i < pts.BranchCount - 1; i++)
    {
      List<Point3d> column = pts.Branches[i];
      GH_Path path = pts.Paths[i];

      for (int j = 0; j < column.Count - 1; j++)
      {
        Plane tempP = new Plane(P);
        tempP.Origin = column[j];
        Rectangle3d rec = new Rectangle3d(tempP, S, S);
        rectangle.Add(rec, path);
      }
    }

    // Output
    Pout = pts;
    C = rectangle;
# ---------- end gh_sqgrid ----------
sqgrid = Square(Plane=pln_4, Size=number_slider_11, ExtentX=number_slider_12, ExtentY=number_slider_13)  # -> Cells, Points
panel_13 = Panel(sqgrid.Cells)
panel_14 = Panel(sqgrid.Points)
panel_15 = Panel(gh_sqgrid.C)
panel_16 = Panel(gh_sqgrid.Pout)

# ---- group: Triangular
pln_5 = Plane(PlaneXY(6.002839061, 8.575233017, 0))
number_slider_14 = Slider(3, range=0..100)
number_slider_15 = Slider(7, range=0..100)
number_slider_16 = Slider(4, range=0..100)
gh_trigrid = CSharpScript(P=pln_5, S=number_slider_14, Ex=number_slider_15, Ey=number_slider_16)  # -> out, C, Pout; inputs P: Plane, S: Double, Ex: Int32, Ey: Int32
# ---------- gh_trigrid: C# ----------
    // Component written by  @garciadelcastillo

    // This component creates a grid of triangular polylines.
    // TODO: make the DataTree branches mimic the input structure.

    // Declare lists to store the data we will be using
    DataTree<Point3d> pts = new DataTree<Point3d>();
    DataTree<Point3d> centers = new DataTree<Point3d>();
    DataTree<Polyline> triangles = new DataTree<Polyline>();

    // Let's first create the grid of vertices that will be used for the triangles.
    // We will sort them in row-column order.
    for (int i = 0; i < Ey + 1; i++)
    {
      GH_Path path = new GH_Path(i);

      // Let's figure out the height of this row of points
      double y = i * S * Math.Sqrt(3.0) / 2.0;  // height of an equilateral triangle

      // Now, let's compute how many there are in this row
      // (they might be staggered due to the triangle packing logic)
      int count;
      if (Ex % 2 == 0)
      {
        // Even amount of triangles always needs same points per row
        count = Ex / 2 + 1;
      }
      else if (i % 2 == 0)
      {
        // For even rows, round the value up
        count = (int) Math.Ceiling(Ex / 2.0) + 1;  // note 2.0 to force non-integer division
      }
      else
      {
        // For odd rows, round down (using integer division)
        count = Ex / 2 + 1;
      }

      // Also, offset points by half size in x direction on odd rows
      double offX = i % 2 == 1 ? 0.5 * S : 0;

      // Now create the points
      for (int j = 0; j < count; j++)
      {
        double x = offX + j * S;
        Point3d p = P.PointAt(x, y);
        pts.Add(p, path);
      }
    }
    
    // Once the baseline points has been created, we can use them
    // to generate the polylines and compute their centers.
    // Let's iterate in column-row order.
    for (int col = 0; col < Ex; col++)
    {
      GH_Path path = new GH_Path(col);
      
      for (int row = 0; row < Ey; row++)
      {
        // Declare the three vertices
        Point3d p0, p1, p2;
        
        // Select them depending on which row/colum we are on
        if (col % 2 == 0 && row % 2 == 0)
        {
          p0 = pts.Branches[row][col / 2];
          p1 = pts.Branches[row][col / 2 + 1];
          p2 = pts.Branches[row + 1][col / 2];
        }
        else if (col % 2 == 1 && row % 2 == 0)
        {
          p0 = pts.Branches[row][col / 2 + 1];
          p1 = pts.Branches[row + 1][col / 2 + 1];
          p2 = pts.Branches[row + 1][col / 2];
        }
        else if (col % 2 == 0 && row % 2 == 1)
        {
          p0 = pts.Branches[row][col / 2];
          p1 = pts.Branches[row + 1][col / 2 + 1];
          p2 = pts.Branches[row + 1][col / 2];
        }
        else 
        {
          p0 = pts.Branches[row][col / 2];
          p1 = pts.Branches[row][col / 2 + 1];
          p2 = pts.Branches[row + 1][col / 2 + 1];
        }
        
        List<Point3d> vertices = new List<Point3d>(){p0, p1, p2, p0};
        Polyline poly = new Polyline(vertices);
        triangles.Add(poly, path);
        
        Point3d center = (p0 + p1 + p2) / 3.0;
        centers.Add(center, path);
      }
    }
    
    // Outputs
    C = centers;
    Pout = triangles;
# ---------- end gh_trigrid ----------
trigrid = Triangular(Plane=pln_5, Size=number_slider_14, ExtentX=number_slider_15, ExtentY=number_slider_16)  # -> Cells, Points
panel_17 = Panel(trigrid.Cells)
panel_18 = Panel(trigrid.Points)
panel_19 = Panel(gh_trigrid.C)
panel_20 = Panel(gh_trigrid.Pout)

# ---- group: Populate 2D
rec = Rectangle({Plane=PlaneXY(16.52941808, 22.96342887, 0), Size=Domain2(u=-12.16496808..12.16496808, v=-19.19207777..19.19207777)})
number_slider_17 = Slider(51, range=0..1000)
number_slider_18 = Slider(3, range=0..10)
gh_pop2d = CSharpScript(R=rec, N=number_slider_17, S=number_slider_18)  # -> out, P; inputs R: Box, N: Double, S: Int32
# ---------- gh_pop2d: C# ----------
    // Component written by @krichterlunn and @mirahx24

    this.Component.AddRuntimeMessage(GH_RuntimeMessageLevel.Warning, "Random pattern differs from the original");

    // Create List of points to hold random points
    List<Point3d> pts = new List<Point3d>();

    // Random is a native C# class
    // We can initialize it with a seed
    // Create random float numbers by creating two number -- one is the integer and one is the remainder -- and combine them into one
    Random random = new Random(S);

    for(int i = 0; i < N; i++){
      double x = random.Next(Convert.ToInt32(R.X.Min), Convert.ToInt32(R.X.Max)); // integer part
      double xRemain = random.NextDouble(); // remainder part
      x += xRemain;
      double y = random.Next(Convert.ToInt32(R.Y.Min), Convert.ToInt32(R.Y.Max)); // integer part
      double yRemain = random.NextDouble(); // remainder part
      y += yRemain;

      // Create new points using the x and y values and add it to the list of points
      pts.Add(new Point3d(x, y, 0.0));
    }

    // Output
    P = pts;
# ---------- end gh_pop2d ----------
pop2d = Populate2D(Region=rec, Count=number_slider_17, Seed=number_slider_18)
panel_21 = Panel(gh_pop2d.P)
panel_22 = Panel(pop2d)

# ---- group: Populate 3D
brep = Brep(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)
number_slider_19 = Slider(51, range=0..1000)
number_slider_20 = Slider(3, range=0..10)
gh_pop3d = CSharpScript(R=brep, N=number_slider_19, S=number_slider_20)  # -> out, P; inputs R: Box, N: Double, S: Int32
# ---------- gh_pop3d: C# ----------
    // Component written by @krichterlunn and @mirahx24

    this.Component.AddRuntimeMessage(GH_RuntimeMessageLevel.Warning, "Random pattern differs from the original");

    // Create List of points to hold randon points
    List<Point3d> pts = new List<Point3d>();

    // Random is a native C# class
    // We can initialize it with a seed
    // Create random float numbers by creating two number -- one is the integer and one is the remainder -- and combine them into one
    Random random = new Random(S);

    for(int i = 0; i < N; i++){
      double x = random.Next(Convert.ToInt32(R.X.Min), Convert.ToInt32(R.X.Max)); // x integer
      double xRemain = random.NextDouble(); // x remainder
      x += xRemain;
      double y = random.Next(Convert.ToInt32(R.Y.Min), Convert.ToInt32(R.Y.Max)); // y integer
      double yRemain = random.NextDouble(); // y remainder
      y += yRemain;
      double z = random.Next(Convert.ToInt32(R.Z.Min), Convert.ToInt32(R.Z.Max)); // z integer
      double zRemain = random.NextDouble(); // z remainder
      z += zRemain;

      // Create new points using the x, y, and z values and add it to the list of points
      pts.Add(new Point3d(x, y, z));
    }

    // Output
    P = pts;
# ---------- end gh_pop3d ----------
pop3d = Populate3D(Region=brep, Count=number_slider_19, Seed=number_slider_20)
panel_23 = Panel(gh_pop3d.P)
panel_24 = Panel(pop3d)

# ----
gh_popgeo = CSharpScript()  # -> Out, Pout
popgeo = PopulateGeometry(Count=100, Seed=1)
