# Grasshopper definition Vector_Point.ghx (Grasshopper 1.0.7)

# ---- group: Cull Duplicates
number_slider = Slider(5.47, range=0..10)
list = ValueList({"Leave One": 1, "Cull All": 2, "Average": 3}, selected="Leave One")
pt = Point([Point(8.607951551, 2.486685842, 3.832204693), Point(5.778370651, 1.107439772, 8.712556827), Point(9.619506323, 4.670106799, 6.609386227), Point(8.388187749, 7.71604122, 0.5226170553), Point(9.149475926, 6.575188938, 3.664333324), Point(8.022716347, 4.327826013, 6.761694414)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])
gh_cullpt = CSharpScript(P=pt, T=number_slider, Option=list)  # -> out, POut, I, V; inputs P: list of Point3d, T: Double, Option: Int32
# ---------- gh_cullpt: C# ----------
    //Component written by @bava-kumaravel & @garciadelcastillo
    //Cull points in a Point cloud P that are within a tolerance T
    //and return culled points, the indices I retained and the valence V
    //of each point (number of points represented by a point)

    //Duplicate the input point list and store the input indices
    List<Point3d> inputP = P;
    List<int> inputI = new List<int>();
    for(int i = 0;i < inputP.Count;i++){
      inputI.Add(i);
    }

    //We take a square of the tolerance so we can compare with the
    //squared distances, because distance operations require square roots
    //which are very computationally expensive
    double sqrTol = T * T;

    //Define lists to hold the outputs
    List<Point3d> points = new List<Point3d>();
    List<int> indices = new List<int>();
    List<int> valence = new List<int>();

    //Option 1 - LEAVE ONE
    //Go through the list of input points and check if each point
    //has a duplicate. If yes, then leave the point only and cull all its
    //duplicates
    if(Option == 1){
      for(int i = 0; i < inputP.Count; i++){
        int index = -1;
        int valen = 1;
        for(int j = i + 1; j < inputP.Count; j++){
          if(inputP[i].DistanceToSquared(inputP[j]) <= sqrTol){
            //Remove the point at index j
            inputP.RemoveAt(j);
            inputI.RemoveAt(j);
            valen++;
            //Since a point is removed, the other points on the list
            //move one index forward, so the index is decreased by 1
            j--;
          }
        }
        //Add the checked point to the final output list
        points.Add(inputP[i]);
        index = inputI[i];
        indices.Add(index);
        valence.Add(valen);
      }
      
      //WIP Warning Message
      Component.AddRuntimeMessage(GH_RuntimeMessageLevel.Warning,
        "The valence values do not match those from the original component. Work in Progress.");
    }

      //Option 2 - CULL ALL
      //Go through the list of points and check if they have a duplicate
      //If yes, then cull all its duplicates and also cull the point too
    else if(Option == 2){
      for(int i = 0;i < inputP.Count;i++){
        //Define a boolean to check if a point has a duplicate
        bool duplicateFound = false;
        int valen = 1;
        int index = -1;
        for(int j = i + 1;j < inputP.Count;j++){
          if(inputP[i].DistanceToSquared(inputP[j]) <= sqrTol){
            //Remove the point at index j
            inputP.RemoveAt(j);
            inputI.RemoveAt(j);
            //Since a point is removed, the other points on the list
            //move one index forward, so the index is decreased by 1
            j--;
            duplicateFound = true;
          }
        }
        if(!duplicateFound){
          //Only add a point to the final list if its doesn't have a duplicate
          points.Add(inputP[i]);
          index = inputI[i];
          indices.Add(index);
          valence.Add(valen);
        }
      }
    }

      //Option 3 - AVERAGE
      //Go through the list of points and check if they have a duplicate
      //If yes, then calculate the average between them and return it
    else{
      for(int i = 0;i < inputP.Count;i++){
        Point3d point1 = inputP[i];
        int valen = 1;
        int index = -1;
        bool averaged = false;
        Point3d averagedPoint = point1;
        for(int j = i + 1;j < inputP.Count;j++){
          if(point1.DistanceToSquared(inputP[j]) <= sqrTol){
            //Take average between point i and j
            averagedPoint = AveragePoint(averagedPoint, inputP[j], valen, 1);
            //Remove the point j and its index from the list
            inputP.RemoveAt(j);
            inputI.RemoveAt(j);
            //Since a point is removed, the other points on the list
            //move one index forward, so the index is decreased by 1
            j--;
            valen++;
            averaged = true;
          }
        }

        points.Add(averagedPoint);
        if(!averaged){
          //If the point is not an average, retain its index.
          index = inputI[i];
        }
        indices.Add(index);
        valence.Add(valen);
      }

      //WIP Warning Message
      Component.AddRuntimeMessage(GH_RuntimeMessageLevel.Warning,
        "The outputs do not match those from the original component. Work in Progress.");
    }

    //Outputs
    POut = points;
    I = indices;
    V = valence;
# ---------- gh_cullpt: C# additional code ----------
  private Point3d AveragePoint(Point3d pointA, Point3d pointB, int valenA, int valenB){
    //Function to calculate cumulative average of point A and B
    //The points are multiplied by their valence(number of points each represents)
    //Then, the points are added and divided by the sum of the valence
    Point3d totalPointA = Point3d.Multiply(pointA, (double) valenA);
    Point3d totalPointB = Point3d.Multiply(pointB, (double) valenB);
    Point3d total = totalPointA + totalPointB;
    double num = (double) valenA + (double) valenB;
    Point3d averagePt = total / num;
    return averagePt;
  }
# ---------- end gh_cullpt ----------
cullpt = CullDuplicates(Points=pt, Tolerance=number_slider, CullMode=1)  # -> Points, Indices, Valence
panel = Panel(cullpt.Points)
panel_2 = Panel(gh_cullpt.POut)
panel_3 = Panel(cullpt.Indices)
panel_4 = Panel(gh_cullpt.I)
panel_5 = Panel(cullpt.Valence)
panel_6 = Panel(gh_cullpt.V)

# ---- group: Construct Point
# GH#: A C# dictionary of Grasshopper3D components.
# 
# This file contains a category of Grasshopper components, and a mirroring C#/RhinoCommon implementation.
# 
# This is an educational project initiated by students/faculty of GSD-6338: Introduction to Computational Design, at the Harvard Graduate School of Design.
# 
# More information: {{project link}}
# Vector Point
number_slider_2 = Slider(10, range=0..10)
number_slider_3 = Slider(10, range=0..10)
number_slider_4 = Slider(10, range=0..10)
gh_pt = CSharpScript(X=number_slider_2, Y=number_slider_3, Z=number_slider_4)  # -> out, Pt; inputs X: Double, Y: Double, Z: Double
# ---------- gh_pt: C# ----------
    //Component written by @bava-kumaravel
    //Construct a point using the given X, Y, Z coordinates

    //Create a point using the available X, Y, Z coordinates
    Point3d point = new Point3d(X, Y, Z);

    //Output
    Pt = point;
# ---------- end gh_pt ----------
pt_2 = ConstructPoint(XCoordinate=number_slider_2, YCoordinate=number_slider_3, ZCoordinate=number_slider_4)
panel_7 = Panel(pt_2)
panel_8 = Panel(gh_pt.Pt)

# ---- group: Numbers To Points
num = Number([77.16946539, 46.82424659, 27.12809004, 94.86339125, 22.41468319, 38.76246974, 79.73701614, 50.24671035, 32.00610683, 14.3267902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])
gh_num2pt = CSharpScript(N=num, M="yxz")  # -> out, P; inputs N: list of Double, M: String
# ---------- gh_num2pt: C# ----------
    //Component written by @bava-kumaravel
    //Takes a list of numbers N and convert them into a list of
    //points P, based on a coordinate mask M

    //Define a character array to hold the characters
    //extracted from the character mask M
    char[] coordinates = M.ToCharArray();

    //Sanity check
    //To check if the input data are of the right format

    //Check one - check if the list of numbers provided
    //has a count that is a multiple of 3
    if(N.Count % 3 != 0)
    {
      //Throw error and stop execution of the component
      Component.AddRuntimeMessage(GH_RuntimeMessageLevel.Error,
        "The amount of numbers must be a multiple of three");
    }

    //Check two - check if the coordinate mask has 3 characters only
    //that is, check if the coordinate array has a length of 3 characters
    if(coordinates.Length != 3){
      //Throw error and stop execution of the component
      Component.AddRuntimeMessage(GH_RuntimeMessageLevel.Error,
        "Data conversion failed from Text to Coordinate Mask");
      return;
    }

    //Check three - check if the coordinate mask has valid information
    //on the X, Y, Z coordinate locations
    //Define three variables to store their location values (either 0, 1 or 2)
    int xLoc = -1;
    int yLoc = -1;
    int zLoc = -1;

    //Go through coordinate array and retrieve X, Y, Z locations
    for(int i = 0;i < coordinates.Length;i++){
      char c = coordinates[i];
      if(c == 'x' || c == 'X'){    //The mask is case-insensitive
        xLoc = i;
        continue;
      }
      if(c == 'y' || c == 'Y'){    //The mask is case-insensitive
        yLoc = i;
        continue;
      }
      if(c == 'z' || c == 'Z'){     //The mask is case-insensitive
        zLoc = i;
        continue;
      }
    }

    //Check if any of the location variables of X, Y and Z remain unassigned
    if(xLoc == -1 || yLoc == -1 || zLoc == -1){
      //Throw error and stop execution of the component
      Component.AddRuntimeMessage(GH_RuntimeMessageLevel.Error,
        "Data conversion failed from Text to Coordinate Mask");
      return;
    }

    //Define an array to hold the points
    //The length of the array is the length of numbers list divided by 3
    Point3d[] pts = new Point3d[N.Count / 3];

    //Go through the point array and assign the values of the points
    //based on the input numbers array N
    for(int i = 0;i < N.Count;i++){
      //Store the number in a local variable
      double num = N[i];
      //The index of the point to be updated in the array is got
      //by the integer division of the index i with 3
      int index = i / 3;
      //To determine if the number num is an x, y or z coordinate
      //we perform a modulo operation on the index i with 3
      //and compare it with the location variables - xLoc, yLoc and zLoc
      int loc = i % 3;
      if(loc == xLoc){
        pts[index].X = num;
      }
      else if(loc == yLoc){
        pts[index].Y = num;
      }
      else{
        pts[index].Z = num;
      }
    }

    //Output
    P = pts;
# ---------- end gh_num2pt ----------
num2pt = NumbersToPoints(Numbers=num, Mask="yxz")
panel_9 = Panel(num2pt)
panel_10 = Panel(gh_num2pt.P)

# ---- group: Barycentric
pt_3 = Point(Point(10, 7.4, 3.32))
pt_4 = Point(Point(10, 7.15, 7.11))
pt_5 = Point(Point(5.05, 4.64, 3.32))
number_slider_5 = Slider(0.86, range=0..1)
number_slider_6 = Slider(0.65, range=0..1)
number_slider_7 = Slider(0.84, range=0..1)
gh_bcentric = CSharpScript(A=pt_3, B=pt_4, C=pt_5, U=number_slider_5, V=number_slider_6, W=number_slider_7)  # -> out, P; inputs A: Point3d, B: Point3d, C: Point3d, U: Double, V: Double, W: Double
# ---------- gh_bcentric: C# ----------
    //Component written by @bava-kumaravel
    //Create a point using Barycentric coordinates U, V and W
    //with respect to a triangle ABC

    //Sanity Check
    //Check if the barycentric coordinates do not add upto zero
    if(U + V + W == 0){
      //Throw error and stop the execution of the component
      Component.AddRuntimeMessage(GH_RuntimeMessageLevel.Error,
        "The sum of the barycentric coordinates must not be zero.");
      return;
    }

    //Normalize the barycentric coordinates
    //To normalize the coordinates, we divide each by the total of all 3
    double total = U + V + W;
    U /= total;
    V /= total;
    W /= total;

    //Formula for the barycentric point = U*A + V*B + W*C
    Point3d newPt = Point3d.Multiply(A, U) +
      Point3d.Multiply(B, V) + Point3d.Multiply(C, W);

    //Output
    P = newPt;
# ---------- end gh_bcentric ----------
bcentric = Barycentric(
    PointA=pt_3,
    PointB=pt_4,
    PointC=pt_5,
    CoordinateU=number_slider_5,
    CoordinateV=number_slider_6,
    CoordinateW=number_slider_7)
panel_11 = Panel(bcentric)
panel_12 = Panel(gh_bcentric.P)

# ---- group: Point Cylindrical
pln = Plane(Plane(origin=(12.71903134, 8.479354227, 0), x=(-1, 0, 0), y=(0, -1, 0)))
number_slider_8 = Slider(6.36, range=0..10)
number_slider_9 = Slider(2.87, range=0..10)
rad = Radians(Degrees=Slider(181, range=0..360))
pt_6 = PointCylindrical(BasePlane=pln, Angle=rad, Radius=number_slider_8, Elevation=number_slider_9)
gh_pt_2 = CSharpScript(P=pln, A=rad, R=number_slider_8, E=number_slider_9)  # -> out, Pt; inputs P: Plane, A: Double, R: Double, E: Double
# ---------- gh_pt_2: C# ----------
    //Component written by @bava-kumaravel
    //Construct a point Pt with Cylindrical coordinates angle A,
    //radius R and elevation E with respect to the plane P

    //The x,y,z coordinates of the point Pt with respect to
    //the plane P are found using the cylindrical coordinates formula
    double u = R * Math.Cos(A);
    double v = R * Math.Sin(A);
    double w = E;

    //Define the point with the u, v, w coordinates
    Point3d point = P.PointAt(u, v, w);

    //Output
    Pt = point;
# ---------- end gh_pt_2 ----------
panel_13 = Panel(pt_6)
panel_14 = Panel(gh_pt_2.Pt)

# ---- group: Point Polar
pln_2 = Plane(Plane(origin=(-3.745863771, 3.20329782, 3.439972624), x=(0.4964591083, 0.8307284622, 0.2518304506), y=(-0.2627430746, -0.1326939364, 0.9556978581)))
number_slider_10 = Slider(4.65, range=0..10)
rad_2 = Radians(Degrees=Slider(59, range=0..360))
rad_3 = Radians(Degrees=Slider(122, range=0..360))
gh_pt_3 = CSharpScript(P=pln_2, xy=rad_2, z=rad_3, d=number_slider_10)  # -> out, Pt; inputs P: Plane, xy: Double, z: Double, d: Double
# ---------- gh_pt_3: C# ----------
    //Component written by @bava-kumaravel
    //Create a point using polar coordinates radius d,
    //angle xy and angle z with respect to plane P

    //The z angle in the polar coordinates formula is
    //measured from the z-axis towards the xy plane
    //but in the Point Polar component it is measured from
    //the xy plane towards the z-axis. So we subtract the z value
    //from 90 deg (i.e., half PI radians) to be used in the formula
    z = 0.5 * Math.PI - z;

    //The u, v and w coordinates of the point computed
    //using the polar to cartesian coordinates formula
    double u = d * Math.Sin(z) * Math.Cos(xy);
    double v = d * Math.Sin(z) * Math.Sin(xy);
    double w = d * Math.Cos(z);

    //Define a point using the u, v, w coordinates
    Point3d point = P.PointAt(u, v, w);

    //Output
    Pt = point;
# ---------- end gh_pt_3 ----------
pt_7 = PointPolar(BasePlane=pln_2, XYAngle=rad_2, ZAngle=rad_3, Offset=number_slider_10)
panel_15 = Panel(pt_7)
panel_16 = Panel(gh_pt_3.Pt)

# ---- group: Closest Point
pt_8 = Point(Point(6.14131138, 9.497784469, 7.470016762))
pt_9 = Point([Point(8.607951551, 2.486685842, 3.832204693), Point(5.778370651, 1.107439772, 8.712556827), Point(9.619506323, 4.670106799, 6.609386227), Point(8.388187749, 7.71604122, 0.5226170553), Point(9.149475926, 6.575188938, 3.664333324), Point(8.022716347, 4.327826013, 6.761694414)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])
gh_cp = CSharpScript(P=pt_8, C=pt_9)  # -> out, POut, i, D; inputs P: Point3d, C: list of Point3d
# ---------- gh_cp: C# ----------
    //Component written by @bava-kumaravel
    //Find the closest point to the Point P in a cloud of points C

    //Create a Point Cloud from the list of Points C
    PointCloud ptCld = new PointCloud(C);

    //Find the index of the closest point to P in the point cloud
    int index = ptCld.ClosestPoint(P);

    //Use the index to retrieve the point from the list of points C
    Point3d point = C[index];

    //Find distance between Point P and the closest point
    double dist = P.DistanceTo(point);

    //Outputs
    POut = point;
    i = index;
    D = dist;
# ---------- end gh_cp ----------
cp = ClosestPoint(Point=pt_8, Cloud=pt_9)  # -> ClosestPoint, CPIndex, Distance
panel_17 = Panel(cp.ClosestPoint)
panel_18 = Panel(cp.CPIndex)
panel_19 = Panel(cp.Distance)
panel_20 = Panel(gh_cp.POut)
panel_21 = Panel(gh_cp.i)
panel_22 = Panel(gh_cp.D)

# ---- group: Project Point
pt_10 = Point([Point(8.607951551, 2.486685842, 3.832204693), Point(5.778370651, 1.107439772, 8.712556827), Point(9.619506323, 4.670106799, 6.609386227), Point(8.388187749, 7.71604122, 0.5226170553), Point(9.149475926, 6.575188938, 3.664333324)])
vec = Vector(Vector(5.49, 7.28, -5.94))
geo = Geometry([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, Line((13, 3, 0), (3, 11, 0))])
gh_project = CSharpScript(P=pt_10, D=vec, G=geo)  # -> out, POut, I; inputs P: Point3d, D: Vector3d, G: list of GeometryBase
# ---------- gh_project: C# ----------
    //Component written by @bava-kumaravel
    //Project a point P onto a list of geometries G
    //along an optional direction vector D

    //The direction vector is set to optional
    Component.Params.Input[1].Optional = true;
    //Check if an input is passed in for the vector D
    if(Component.Params.Input[1].VolatileDataCount == 0){
      //If no input is available, assign -ve Z axis (downward direction)
      //as the direction vector D
      D = new Vector3d(0, 0, -1);
    }

    //Define an array to hold the projected points and indices
    Point3d[] points = new Point3d[0];
    int[] indices = new int[0];

    //Go through the Geometry List and convert them into Breps
    //Define a Brep List to hold them
    List<Brep> brepsList = new List<Brep>();
    for(int i = 0;i < G.Count;i++){
      //Check if the Geometry is a Brep already
      if(G[i].ObjectType == ObjectType.Brep){
        //Cast the geometry into a brep
        Brep brep = (Brep) G[i];
        brepsList.Add(brep);
      }
        //Else check if it is a Mesh
      else if(G[i].ObjectType == ObjectType.Mesh){
        //Cast the Geometry into a Mesh
        Mesh mesh = (Mesh) G[i];
        //Convert the mesh into a brep
        Brep brep = Brep.CreateFromMesh(mesh, true);
        brepsList.Add(brep);
      }
    }

    //Project the list of points P onto the list of Breps brepsList
    //with the direction vector D
    points = Rhino.Geometry.Intersect.Intersection.
      ProjectPointsToBrepsEx(brepsList, new List<Point3d>(){P}, D, 0, out indices);

    //Define closest projected point and index of Brep it is on
    Point3d pointP = Point3d.Unset;
    int index = -1;
    
    if(points.Length > 0){      //If there are any projected points
      //Go through the array of points to check which is the closest to point P
      //and which is in the same direction as V
      double shortDist = P.DistanceToSquared(points[0]);
      //(We calculate squared distance to avoid the unnecessary computational
      //expense of square roots)
      for(int i = 0;i < points.Length;i++){
        if(i == 0 || P.DistanceToSquared(points[i]) < shortDist){
          //Check if the vector between two points is parallel to vector D
          Vector3d vector = new Vector3d(Point3d.Subtract(points[i], P));
          if(vector.IsParallelTo(D) == 1){
            pointP = points[i];
            break;
          }
        }
      }

      if(pointP.IsValid){   //If the closest point is in a valid direction
        //Go through the list of breps to find the index of the brep which
        //the point lies on
        for(int i = 0;i < brepsList.Count;i++){
          //Find closest point on the brep, and if their distance is 0
          //then the point lies on the brep
          Point3d clPoint = brepsList[i].ClosestPoint(pointP);
          double distSqr = clPoint.DistanceToSquared(pointP);
          if(distSqr < doc.ModelAbsoluteTolerance){
            index = i;
            break;
          }
        }
      }
    }

    //Outputs
    POut = pointP;
    I = index;
# ---------- end gh_project ----------
project = ProjectPoint(Point=pt_10, Direction=vec, Geometry=geo)  # -> Point, Index
panel_23 = Panel(project.Point)
panel_24 = Panel(gh_project.POut)
panel_25 = Panel(project.Index)
panel_26 = Panel(gh_project.I)

# ---- group: Sort Along Curve
pt_11 = Point([Point(8.607951551, 2.486685842, 3.832204693), Point(5.778370651, 1.107439772, 8.712556827), Point(9.619506323, 4.670106799, 6.609386227), Point(8.388187749, 7.71604122, 0.5226170553), Point(9.149475926, 6.575188938, 3.664333324), Point(8.022716347, 4.327826013, 6.761694414)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])
crv = Curve(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)
gh_alongcrv = CSharpScript(P=pt_11, C=crv)  # -> out, POut, I; inputs P: list of Point3d, C: Curve
# ---------- gh_alongcrv: C# ----------
    //Component written by @bava-kumaravel
    //Sorts a list of points P along a curve C

    //Go through the list of points and find the parameter on the curve
    //closest to them - we will then use these parameters to sort the points
    //Define an array to hold the parameters
    double[] parameters = new double[P.Count];
    for(int i = 0;i < P.Count;i++){
      double t;
      bool success = C.ClosestPoint(P[i], out t);
      parameters[i] = t;
    }

    //Define RhinoLists to hold the points P and its indices
    //We use RhinoLists instead of lists because they have
    //the Sort(double[]) method
    RhinoList<Point3d> points = new RhinoList<Point3d>(P);
    RhinoList<int> indices = new RhinoList<int>();
    for(int i = 0;i < P.Count;i++){
      indices.Add(i);
    }

    //Sort the RhinoLists according to the parameters array
    points.Sort(parameters);
    indices.Sort(parameters);

    //Outputs
    POut = points;
    I = indices;
# ---------- end gh_alongcrv ----------
alongcrv = SortAlongCurve(Points=pt_11, Curve=crv)  # -> Points, Indices
panel_27 = Panel(alongcrv.Points)
panel_28 = Panel(gh_alongcrv.POut)
panel_29 = Panel(alongcrv.Indices)
panel_30 = Panel(gh_alongcrv.I)

# ---- group: Deconstruct Point
pt_12 = Point(Point(30.8022043, -44.10034382, 0))
gh_pdecon = CSharpScript(P=pt_12)  # -> out, X, Y, Z; inputs P: Point3d
# ---------- gh_pdecon: C# ----------
    //Component written by @bava-kumaravel
    //Deconstruct a point into its X, Y, Z coordinates

    //Define three doubles x, y and z
    double x,y,z;

    //Fetch x, y, z values from the point P
    x = P.X;
    y = P.Y;
    z = P.Z;

    //Outputs
    X = x;
    Y = y;
    Z = z;
# ---------- end gh_pdecon ----------
pdecon = Deconstruct(Point=pt_12)  # -> XComponent, YComponent, ZComponent
panel_31 = Panel(pdecon.XComponent)
panel_32 = Panel(pdecon.ZComponent)
panel_33 = Panel(gh_pdecon.X)
panel_34 = Panel(gh_pdecon.Y)
panel_35 = Panel(gh_pdecon.Z)
panel_36 = Panel(pdecon.YComponent)

# ----
pt_13 = Point([Point(46.82424659, 77.16946539, 27.12809004), Point(22.41468319, 94.86339125, 38.76246974), Point(50.24671035, 79.73701614, 32.00610683)])

# ---- group: Distance
pt_14 = Point(Point(10, 7.4, 3.32))
pt_15 = Point(Point(10, 7.15, 7.11))
gh_dist = CSharpScript(A=pt_14, B=pt_15)  # -> out, D; inputs A: Point3d, B: Point3d
# ---------- gh_dist: C# ----------
    //Component written by @bava-kumaravel
    //Compute the distance between two points A and B

    //Find the distance
    double dist = A.DistanceTo(B);

    //Output
    D = dist;
# ---------- end gh_dist ----------
dist = Distance(PointA=pt_14, PointB=pt_15)
panel_37 = Panel(dist)
panel_38 = Panel(gh_dist.D)

# ---- group: Point Oriented
pln_3 = Plane(Plane(origin=(12.71903134, 8.479354227, 0), x=(-1, 0, 0), y=(0, -1, 0)))
number_slider_11 = Slider(3.58, range=0..10)
number_slider_12 = Slider(3.82, range=0..10)
number_slider_13 = Slider(4.39, range=0..10)
gh_pt_4 = CSharpScript(P=pln_3, U=number_slider_11, V=number_slider_12, W=number_slider_13)  # -> out, Pt; inputs P: Plane, U: Double, V: Double, W: Double
# ---------- gh_pt_4: C# ----------
    //Component written by @bava-kumaravel
    //Create a point with u, v, w coordinates with respect to a Plane P

    //Define the point with the input u, v, w coordinates
    Point3d point = P.PointAt(U, V, W);

    //Output
    Pt = point;
# ---------- end gh_pt_4 ----------
pt_16 = PointOriented(BasePlane=pln_3, UComponent=number_slider_11, VComponent=number_slider_12, WComponent=number_slider_13)
panel_39 = Panel(pt_16)
panel_40 = Panel(gh_pt_4.Pt)

# ---- group: To Polar
pt_17 = Point(Point(9.812478744, -4.697588169, 5.98908997))
pln_4 = Plane(Plane(origin=(6.177208941, -8.496442722, 11.02730809), x=(-0.5224854568, 0.6905323819, 0.5001739467), y=(0.8363739371, 0.3010034862, 0.4581217509)))
gh_polar = CSharpScript(P=pt_17, S=pln_4, planeUp=Toggle(True))  # -> out, POut, T, R; inputs P: Point3d, S: Plane, planeUp: Boolean
# ---------- gh_polar: C# ----------
    //Component written by @bava-kumaravel & @garciadelcastillo
    //Converts a point P from cartesian coordinates to polar
    //coordinates with respect to the Plane S

    //Draw a vector from Origin on the Plane S to Point P
    Vector3d pV = P - S.Origin;

    //Project the point P on the Plane S
    Point3d projectP = S.ClosestPoint(P);

    //Draw a projection vector from Origin of S to the Projected point
    Vector3d projectV = projectP - S.Origin;

    //The planar angle is given by the angle between the X-Axis and the
    //projected vector projectV on the plane S
    double pAng = Vector3d.VectorAngle(S.XAxis, projectV);

    //Define the vertical angle
    double vAng = 0.0;
    if (planeUp) {
      //if the Plane is facing up, the vertical angle is computed between
      //horizontal projection of the vector and the vector pV
      vAng = Vector3d.VectorAngle(projectV, pV);
    }
    else {
      //Else, the vertical angle is computed between the Z Axis of the plane
      //and the vector pV
      vAng = Vector3d.VectorAngle(S.ZAxis, pV);
    }

    //The radius is the distance between the Origin of plane S and point P
    double radius = S.Origin.DistanceTo(P);

    //Outputs
    R = radius;
    T = vAng;
    POut = pAng;
# ---------- end gh_polar ----------
polar = ToPolar(Point=pt_17, System=pln_4)  # -> Phi, Theta, Radius
panel_41 = Panel(polar.Phi)
panel_42 = Panel(polar.Theta)
panel_43 = Panel(polar.Radius)
panel_44 = Panel(gh_polar.POut)
panel_45 = Panel(gh_polar.T)
panel_46 = Panel(gh_polar.R)

# ---- group: Closest Points
pt_18 = Point(Point(6.14131138, 9.497784469, 7.470016762))
pt_19 = Point([Point(8.607951551, 2.486685842, 3.832204693), Point(5.778370651, 1.107439772, 8.712556827), Point(9.619506323, 4.670106799, 6.609386227), Point(8.388187749, 7.71604122, 0.5226170553), Point(9.149475926, 6.575188938, 3.664333324), Point(8.022716347, 4.327826013, 6.761694414)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])
number_slider_14 = Slider(6, range=0..10)
gh_cps = CSharpScript(P=pt_18, C=pt_19, N=number_slider_14)  # -> out, POut, i, D; inputs P: Point3d, C: list of Point3d, N: Int32
# ---------- gh_cps: C# ----------
    //Component written by @bava-kumaravel
    //Find N closest points to the Point P in a cloud of points C

    //Create three RhinoLists to hold the points, indices and distances
    //We use RhinoLists instead of regular lists because
    //they offer Sort based on double array function
    RhinoList<Point3d> points = new RhinoList<Point3d>(C);
    RhinoList<int> indices = new RhinoList<int>();
    RhinoList<double> dist = new RhinoList<double>();

    //Go through the points list and populate the indices and distances lists
    for(int j = 0;j < points.Count;j++){
      Point3d point = points[j];
      double d = point.DistanceTo(P);
      dist.Add(d);
      indices.Add(j);
    }

    //Convert the distance list to an array, and sort the points and indices with it
    //Sort the distance lists with the default sort method
    points.Sort(dist.ToArray());
    indices.Sort(dist.ToArray());
    dist.Sort();

    //Shorten the list to the number of closest points N required
    points.RemoveRange(N, points.Count - N);
    indices.RemoveRange(N, indices.Count - N);
    dist.RemoveRange(N, dist.Count - N);

    //Output
    POut = points;
    i = indices;
    D = dist;
# ---------- end gh_cps ----------
cps = ClosestPoints(Point=pt_18, Cloud=pt_19, Count=number_slider_14)  # -> ClosestPoint, CPIndex, Distance
panel_47 = Panel(gh_cps.POut)
panel_48 = Panel(cps.ClosestPoint)
panel_49 = Panel(gh_cps.i)
panel_50 = Panel(cps.CPIndex)
panel_51 = Panel(cps.Distance)
panel_52 = Panel(gh_cps.D)

# ---- group: Point Groups
pt_20 = Point([Point(8.607951551, 2.486685842, 3.832204693), Point(5.778370651, 1.107439772, 8.712556827), Point(9.619506323, 4.670106799, 6.609386227), Point(8.388187749, 7.71604122, 0.5226170553), Point(9.149475926, 6.575188938, 3.664333324), Point(8.022716347, 4.327826013, 6.761694414)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])
number_slider_15 = Slider(2.15, range=0..10)
gh_pgroups = CSharpScript(P=pt_20, D=number_slider_15)  # -> out, G, I; inputs P: tree of Point3d, D: Double
# ---------- gh_pgroups: C# ----------
    //Component written by @bava-kumaravel & @garciadelcastillo
    //Creates point groups G from a list of points P, that are within a
    //distance of D

    //Define Data Trees for holding the outputs
    DataTree<Point3d> pointGroups = new DataTree<Point3d>();
    DataTree<int> pointGroupsIndex = new DataTree<int>();

    // Iterate over all the input branches, and operate on them
    for(int branchIndex = 0; branchIndex < P.BranchCount; branchIndex++)
    {
      //Get the points on this branch and the full path
      List<Point3d> branch = P.Branches[branchIndex];
      GH_Path branchPath = P.Paths[branchIndex];

      //Define an array to hold the state of each point - whether it is
      //assigned to a point group or not. Initially set the valaues to false
      bool[] assigned = new bool[branch.Count];
      for(int i = 0;i < branch.Count;i++){
        assigned[i] = false;
      }

      //Define an integer to hold number of values that have been unassigned
      //Initially the value is equal to length of point list P
      int unassigned = branch.Count;

      //Find and store the square of the distance tolerance. We compare
      //squared tolerances to squared distances so as to avoid square roots
      //in the distance function that are computationally expensive
      double sqrTol = D * D;

      // Define a List to hold the points that are part of the same point group
      List<int> pointQueue = new List<int>();

      //Initiate the point group count as 0
      int groupCount = 0;

      while(unassigned > 0){
        //Go through the entire point list
        for(int i = branch.Count - 1;i >= 0;i--){
          //If a point has not been assigned to any group yet
          if(!assigned[i]){
            //Initiate a new branch, using the previous path as the base
            GH_Path groupNum = branchPath.AppendElement(groupCount);

            //Add the point to the queue
            pointQueue.Add(i);
            while(pointQueue.Count > 0){
              //Get the first index in the queue and remove it
              int index = pointQueue[0];
              pointQueue.RemoveAt(0);

              //If the point has not been assigned yet
              if(!assigned[index]){
                //Add it to the output data tree
                pointGroups.Add(branch[index], groupNum);
                pointGroupsIndex.Add(index, groupNum);
                //Set it assigned value to true, and reduce the unassigned count by 1
                assigned[index] = true;
                unassigned--;
              }
              //Go through the list of points P and check the distance against
              //the point under consideration
              for(int j = branch.Count - 1;j >= 0;j--){
                double sqrDist = branch[index].DistanceToSquared(branch[j]);
                if(sqrDist > 0 && sqrDist <= sqrTol){
                  //If the point has not been assigned yet
                  if(!assigned[j]){
                    //Add it to the queue
                    pointQueue.Add(j);
                    //Add it to the output data trees
                    pointGroups.Add(branch[j], groupNum);
                    pointGroupsIndex.Add(j, groupNum);
                    //Set its assigned value to false and reduce the unassigned count by 1
                    assigned[j] = true;
                    unassigned--;
                  }
                }
              }
            }
            //When the queue count becomes null, increase the group count
            //by 1 to initiate a new branch in the data tree
            groupCount++;
          }
        }
      }
    }

    //Outputs
    G = pointGroups;
    I = pointGroupsIndex;
# ---------- end gh_pgroups ----------
pgroups = PointGroups(Points=pt_20, Distance=number_slider_15)  # -> Groups, Indices
panel_53 = Panel(pgroups.Groups)
panel_54 = Panel(gh_pgroups.G)
panel_55 = Panel(pgroups.Indices)
panel_56 = Panel(gh_pgroups.I)

# ---- group: Sort Points
pt_21 = Point([Point(8.607951551, 2.486685842, 3.832204693), Point(5.778370651, 1.107439772, 8.712556827), Point(9.619506323, 4.670106799, 6.609386227), Point(8.388187749, 7.71604122, 0.5226170553), Point(9.149475926, 6.575188938, 3.664333324), Point(8.022716347, 4.327826013, 6.761694414)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])
gh_sort_pt = CSharpScript(P=pt_21)  # -> out, POut, I; inputs P: list of Point3d
# ---------- gh_sort_pt: C# ----------
    //Component written by @bava-kumaravel
    //Sort a list of points P by its coordinates (first x, then y, then z)

    //Define a list to hold the indices of the list of Points
    List<int> indices = new List<int>();
    //Go through the list of points P and populate the indices list
    for(int i = 0;i < P.Count;i++){
      indices.Add(i);
    }

    //Using the order by function, the lists are sorted by X, then Y, then Z
    //Outputs
    POut = P.OrderBy(i => i.X).ThenBy(j => j.Y).ThenBy(k => k.Z);
    I = indices.OrderBy(i => P[i].X).ThenBy(j => P[j].Y).ThenBy(k => P[k].Z);
# ---------- end gh_sort_pt ----------
sort_pt = SortPoints(Points=pt_21)  # -> Points, Indices
panel_57 = Panel(sort_pt.Points)
panel_58 = Panel(gh_sort_pt.POut)
panel_59 = Panel(sort_pt.Indices)
panel_60 = Panel(gh_sort_pt.I)

# ---- group: Pull Point
pt_22 = Point([Point(8.607951551, 2.486685842, 3.832204693), Point(5.778370651, 1.107439772, 8.712556827), Point(9.619506323, 4.670106799, 6.609386227), Point(8.388187749, 7.71604122, 0.5226170553), Point(9.149475926, 6.575188938, 3.664333324)])
geo_2 = Geometry([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])
gh_pull = CSharpScript(P=pt_22, G=geo_2, ClosestOnly=Toggle(True))  # -> out, POut, D; inputs P: Point3d, G: list of GeometryBase, ClosestOnly: Boolean
# ---------- gh_pull: C# ----------
    //Component written @bava-kumaravel
    //Pull a point P to a list of Geometry G, and return the list of
    //point locations and the distances to them

    //Convert all the input Geometry into Breps
    //Define a list to hold them
    List<Brep> brepsList = new List<Brep>();
    for(int i = 0;i < G.Count;i++){
      //Check if the Geometry is a Brep already
      if(G[i].ObjectType == ObjectType.Brep){
        //Cast the geometry into a brep
        Brep brep = (Brep) G[i];
        brepsList.Add(brep);
      }
        //Else check if it is a Mesh
      else if(G[i].ObjectType == ObjectType.Mesh){
        //Cast the Geometry into a Mesh
        Mesh mesh = (Mesh) G[i];
        //Convert the mesh into a brep
        Brep brep = Brep.CreateFromMesh(mesh, true);
        brepsList.Add(brep);
      }
    }

    //Define a list to hold all the closest points and their distances
    List<Point3d> clPoints = new List<Point3d>();
    List<double> dist = new List<double>();

    //Go through the list of breps and find the closest points &
    //distances to the point P and add them to the lists
    for(int i = 0;i < brepsList.Count;i++){
      Brep brep = brepsList[i];
      Point3d point = brep.ClosestPoint(P);
      clPoints.Add(point);
      double d = P.DistanceTo(point);
      dist.Add(d);
    }

    if(ClosestOnly){
      //Go through the list of distances and find the one with the shortest
      //distance and find its index
      int index = 0;
      double shortDist = dist[index];
      for(int i = 1;i < dist.Count;i++){
        if(dist[i] < shortDist){
          shortDist = dist[i];
          index = i;
        }
      }

      //Output    
      POut = clPoints[index];
      D = shortDist;
    }
    else{
      //Output    
      POut = clPoints;
      D = dist;
    }
# ---------- end gh_pull ----------
pull = PullPoint(Point=pt_22, Geometry=geo_2, ClosestOnly=True)  # -> ClosestPoint, Distance
panel_61 = Panel(pull.ClosestPoint)
panel_62 = Panel(gh_pull.POut)
panel_63 = Panel(pull.Distance)
panel_64 = Panel(gh_pull.D)

# ---- group: Points to Numbers
panel_65 = Panel("yxz")
gh_num2pt_2 = CSharpScript(P=pt_13, M=panel_65)  # -> out, N; inputs P: list of Point3d, M: String
# ---------- gh_num2pt_2: C# ----------
    //Component written by @bava-kumaravel
    //Takes a list of points P and convert them into a list of numbers N,
    //based on a coordinate mask M

    //Define a character array to hold the characters
    //extracted from the character mask M
    char[] coordinates = M.ToCharArray();

    //Sanity check
    //To check if the coordinate mask is in the right format

    //Check one - check if the coordinate mask has 3 characters only
    //that is, check if the coordinate array has a length of 3 characters
    if(coordinates.Length != 3){
      //Throw error and stop execution of the component
      Component.AddRuntimeMessage(GH_RuntimeMessageLevel.Error,
        "Data conversion failed from Text to Coordinate Mask");
      return;
    }

    //Check two - check if the coordinate mask has valid information
    //on the X, Y, Z coordinate locations
    //Define three variables to store their location values (either 0, 1 or 2)
    int xLoc = -1;
    int yLoc = -1;
    int zLoc = -1;

    //Go through coordinate array and retrieve X, Y, Z locations
    for(int i = 0;i < coordinates.Length;i++){
      char c = coordinates[i];
      if(c == 'x' || c == 'X'){    //The mask is case-insensitive
        xLoc = i;
        continue;
      }
      if(c == 'y' || c == 'Y'){    //The mask is case-insensitive
        yLoc = i;
        continue;
      }
      if(c == 'z' || c == 'Z'){     //The mask is case-insensitive
        zLoc = i;
        continue;
      }
    }

    //Check if any of the location variables of X, Y and Z remain unassigned
    if(xLoc == -1 || yLoc == -1 || zLoc == -1){
      //Throw error and stop execution of the component
      Component.AddRuntimeMessage(GH_RuntimeMessageLevel.Error,
        "Data conversion failed from Text to Coordinate Mask");
      return;
    }

    //Define an array to hold the numbers
    //The length of the array is the number of points multiplied by 3
    double[] num = new double[P.Count * 3];

    //Go through the number array and assign the values
    //based on the input points array P
    for(int i = 0;i < num.Length;i++){
      //The index of the point to be converted to numbers is got
      //by the integer division of the index i with 3
      int index = i / 3;
      //To determine if the number num[i] is an x, y or z coordinate
      //we perform a modulo operation on the index i with 3
      //and compare it with the location variables - xLoc, yLoc and zLoc
      int loc = i % 3;
      if(loc == xLoc){
        num[i] = P[index].X;
      }
      else if(loc == yLoc){
        num[i] = P[index].Y;
      }
      else{
        num[i] = P[index].Z;
      }
    }

    //Output
    N = num;
# ---------- end gh_num2pt_2 ----------
panel_66 = Panel(gh_num2pt_2.N)

# ----
pt2num = PointsToNumbers(Points=pt_13, Mask=panel_65)

# ---- group: Points to Numbers (continued)
panel_67 = Panel(pt2num)
