# Grasshopper definition Vector_Vector.ghx (Grasshopper 1.0.7)

pt = Point(Point(-0.111258938, -0.06423349353, 0))
pt_2 = Point(Point(12.60102352, -3.116514494, 0))
toggle = BooleanToggle(False)
c_vec2pt = CSharpScript(A=pt, B=pt_2, U=toggle)  # -> V, L; inputs A: Point3d, B: Point3d, U: Boolean
# ---------- c_vec2pt: C# ----------
    //Component written by @erinlinseyhunt

    double axcoord = A.X;
    double aycoord = A.Y;
    double azcoord = A.Z;

    double bxcoord = B.X;
    double bycoord = B.Y;
    double bzcoord = B.Z;

    V = new Vector3d((B.X - A.X), (B.Y - A.Y), (B.Z - A.Z));
    L = Math.Sqrt(Math.Pow((B.X - A.X), 2) + Math.Pow((B.Y - A.Y), 2) + Math.Pow((B.Z - A.Z), 2));


    if (U == true)
    {
      //Vector A
      double ALen = Math.Sqrt((Math.Pow(A.X, 2)) + (Math.Pow(A.Y, 2)) + (Math.Pow(A.Z, 2))); //Length
      double AInverse = 1 / ALen; //Inverse Length
      double AUX = (A.X * AInverse); //Unitizing X, Y, and Z
      double AUY = (A.Y * AInverse);
      double AUZ = (A.Z * AInverse);

      //Vector B
      double BLen = Math.Sqrt((Math.Pow(B.X, 2)) + (Math.Pow(B.Y, 2)) + (Math.Pow(B.Z, 2)));
      double BInverse = 1 / BLen;
      double BUX = (B.X * BInverse);
      double BUY = (B.Y * BInverse);
      double BUZ = (B.Z * BInverse);

      V = new Vector3d((BUX - AUX), (BUX - AUX), (BUZ - AUZ));

      L = Math.Sqrt((Math.Pow(AUX, 2)) + (Math.Pow(AUY, 2)) + (Math.Pow(AUZ, 2)));

    }
# ---------- end c_vec2pt ----------
panel = Panel(c_vec2pt.L)

# ---- group: Grasshopper Vec2Pt
vec2pt = Vector2Pt(PointA=pt, PointB=pt_2, Unitize=toggle)  # -> Vector, Length

# ----
panel_2 = Panel(vec2pt.Vector)
panel_3 = Panel(vec2pt.Length)

panel_4 = Panel(c_vec2pt.V)

number_slider = Slider(10, range=0..10)
number_slider_2 = Slider(6, range=0..10)
number_slider_3 = Slider(3, range=0..10)

# ---- group: Grasshopper Vector
vec = VectorXYZ(XComponent=number_slider, YComponent=number_slider_2, ZComponent=number_slider_3)  # -> Vector, Length

# ---- group: C# Vector
c_vec = CSharpScript(X=number_slider, Y=number_slider_2, Z=number_slider_3)  # -> V, L; inputs X: Double, Y: Double, Z: Double
# ---------- c_vec: C# usings ----------
using System.IO;
using System.Linq;
using System.Data;
using System.Drawing;
using System.Reflection;
using System.Windows.Forms;
using System.Xml;
using System.Xml.Linq;
using System.Runtime.InteropServices;

using Rhino.DocObjects;
using Rhino.Collections;
using GH_IO;
using GH_IO.Serialization;
# ---------- c_vec: C# ----------
    //Component written by @erinlinseyhunt

    //Create a new vector
    Vector3d v = new Vector3d(X, Y, Z);

    //Output the vector and its length
    V = v;
    L = v.Length;
# ---------- end c_vec ----------

# ----
panel_5 = Panel(c_vec.V)
panel_6 = Panel(vec.Vector)
panel_7 = Panel(vec.Length)
panel_8 = Panel(c_vec.L)

number_slider_4 = Slider(3, range=0..10)
vec_2 = Vector(Vector(22, -6, 0))
c_amp = CSharpScript(V=vec_2, A=number_slider_4)  # -> out, Vout; inputs V: Vector3d, A: Double
# ---------- c_amp: C# ----------
    //Component written by @krichterlunn

    //Unitize Vector
    V.Unitize();

    //Multiply vector by Amplitude A
    Vout = V * A;
# ---------- end c_amp ----------
panel_9 = Panel(c_amp.Vout)

# ---- group: Grasshopper Amp
amp = Amplitude(Vector=vec_2, Amplitude=number_slider_4)

# ----
panel_10 = Panel(amp)

number_slider_5 = Slider(7, range=0..10)
c_z = CSharpScript(F=number_slider_5)  # -> out, V; inputs F: Double
# ---------- c_z: C# ----------
    //Component written by @krichterlunn

    //Multiplies your ZVector with your input value of F
    Vector3d ZVector = new Vector3d(0, 0, 1 * F);
    V = ZVector;
# ---------- end c_z ----------
panel_11 = Panel(c_z.V)

# ---- group: Grasshopper Z
Z = UnitZ(Factor=number_slider_5)

# ----
panel_12 = Panel(Z)

number_slider_6 = Slider(5, range=0..10)
X = UnitX(Factor=1)
vec_3 = Vector(Vector(4, 13, 0))
c_vrot = CSharpScript(V=vec_3, X=X, A=number_slider_6)  # -> out, Vout; inputs V: Vector3d, X: Vector3d, A: Double
# ---------- c_vrot: C# ----------
    //Component written by @krichterlunn

    //Rotate Vector 
    V.Rotate(A, X);
    
    //output rotated vector
    Vout = V;
# ---------- end c_vrot ----------
panel_13 = Panel(c_vrot.Vout)

# ---- group: Grasshopper VRot
vrot = Rotate(Vector=vec_3, Axis=X, Angle=number_slider_6)

# ----
panel_14 = Panel(vrot)

number_slider_7 = Slider(3, range=0..10)
c_y = CSharpScript(F=number_slider_7)  # -> out, V; inputs F: Double
# ---------- c_y: C# ----------
    //Component written by @krichterlunn

    //Multiplies your YVector with your input value of F
    Vector3d YVector = new Vector3d(0, 1 * F, 0);
    V = YVector;
# ---------- end c_y ----------
panel_15 = Panel(c_y.V)

# ---- group: Grasshopper Y
Y = UnitY(Factor=number_slider_7)

# ----
panel_16 = Panel(Y)

number_slider_8 = Slider(5, range=0..10)
c_x = CSharpScript(F=number_slider_8)  # -> out, V; inputs F: Double
# ---------- c_x: C# ----------
    //Component written by @krichterlunn

    //Multiplies your XVector with your input value of F
    Vector3d XVector = new Vector3d(1 * F, 0, 0);
    V = XVector;
# ---------- end c_x ----------
panel_17 = Panel(c_x.V)

# ---- group: Grasshopper X
X_2 = UnitX(Factor=number_slider_8)

# ----
panel_18 = Panel(X_2)

toggle_2 = BooleanToggle(False)
vec_4 = Vector(Vector(-10, 19, 0))
vec_5 = Vector(Vector(6, -6, 0))
c_xprod = CSharpScript(A=vec_4, B=vec_5, U=toggle_2)  # -> out, V, L; inputs A: Vector3d, B: Vector3d, U: Boolean
# ---------- c_xprod: C# ----------
    //Component written by @krichterlunn

    // get the crossproduct of two vectors (A, B)
    Vector3d crossproduct = Vector3d.CrossProduct(A, B);

    //outputs for when boolean = false
    V = crossproduct;
    L = crossproduct.Length;

    // define boolean value is = true
    if (U == true)
    {
      // get the crossproduct of two vectors (A, B) unitized
      Vector3d crossproduct2 = Vector3d.CrossProduct(A, B);
      crossproduct2.Unitize();
      
      // outputs for when boolean = true 
      V = crossproduct2;
      L = crossproduct2.Length;
    }
# ---------- end c_xprod ----------
panel_19 = Panel(c_xprod.V)
panel_20 = Panel(c_xprod.L)

# ---- group: Grasshopper XProd
xprod = CrossProduct(VectorA=vec_4, VectorB=vec_5, Unitize=toggle_2)  # -> Vector, Length

# ----
panel_21 = Panel(xprod.Length)
panel_22 = Panel(xprod.Vector)

toggle_3 = BooleanToggle(False)
vec_6 = Vector(Vector(-10, 19, 0))
vec_7 = Vector(Vector(6, -6, 0))
c_dprod = CSharpScript(A=vec_6, B=vec_7, U=toggle_3)  # -> out, D; inputs A: Vector3d, B: Vector3d, U: Boolean
# ---------- c_dprod: C# ----------
    //Component written by @krichterlunn

    // get the dot product of two vectors (A, B)
    double dot = Vector3d.Multiply(A, B);

    //output if boolean = false
    D = dot;

    if (U == true)
    {
      // Unitize A and B Vectors
      A.Unitize();
      B.Unitize();

      //get the dot product of two vectors (A, B) unitized
      double dot2 = Vector3d.Multiply(A, B);

      //output if boolean = true
      D = dot2;
    }
# ---------- end c_dprod ----------
panel_23 = Panel(c_dprod.D)

# ---- group: Grasshopper DProb
dprod = DotProduct(VectorA=vec_6, VectorB=vec_7, Unitize=toggle_3)

# ----
panel_24 = Panel(dprod)

# ----
# GH#: A C# dictionary of Grasshopper3D components.
# 
# This file contains a category of Grasshopper components, and a mirroring C#/RhinoCommon implementation.
# 
# This is an educational project initiated by students/faculty of GSD-6338: Introduction to Computational Design, at the Harvard Graduate School of Design.
# 
# More information: {{project link}}
# Vector Vector
vec_8 = Vector(Vector(10, 6, 3))
c_devec = CSharpScript(V=vec_8)  # -> X, Y, Z; inputs V: Vector3d
# ---------- c_devec: C# ----------
    //Component written by @erinlinseyhunt

    //Get the X, Y and Z values from the vector
    double xcoord = V.X;
    double ycoord = V.Y;
    double zcoord = V.Z;

    //Output their values
    X = xcoord;
    Y = ycoord;
    Z = zcoord;
# ---------- end c_devec ----------
panel_25 = Panel(c_devec.X)
panel_26 = Panel(c_devec.Y)
panel_27 = Panel(c_devec.Z)

# ---- group: Grasshopper DeVec
devec = DeconstructVector(Vector=vec_8)  # -> XComponent, YComponent, ZComponent

# ----
panel_28 = Panel(devec.XComponent)
panel_29 = Panel(devec.YComponent)
panel_30 = Panel(devec.ZComponent)

vec_9 = Vector(Vector(12.71228246, -3.052281001, 0))
c_unit = CSharpScript(V=vec_9)  # -> Vout; inputs V: Vector3d
# ---------- c_unit: C# ----------
    //Component written by @krichterlunn

    // Unitize vector
    V.Unitize();
    Vout = V;
# ---------- end c_unit ----------
panel_31 = Panel(c_unit)

# ---- group: Grasshopper Unit
unit = UnitVector(Vector=vec_9)

# ----
panel_32 = Panel(unit)

vec_10 = Vector(Vector(7, 4, 0))
pln = Plane(Plane(origin=(6, 1, 0), x=(1, 0, 0), y=(0, 0.847998304, 0.52999894)))
vec_11 = Vector(Vector(-5, 22, 0))
c_angle = CSharpScript(A=vec_11, B=vec_10, P=pln)  # -> out, Ang, R; inputs A: Vector3d, B: Vector3d, P: Plane
# ---------- c_angle: C# ----------
    //Component written by @krichterlunn

    // Vector angle based on two vectors (A, B) and a base plane
    double angle = Vector3d.VectorAngle(A, B, P);
    // Vector reflex angle
    double reflex = (2 * Math.PI) - angle;

    // outputs
    Ang = angle;
    R = reflex;
# ---------- end c_angle ----------
panel_33 = Panel(c_angle.R)
panel_34 = Panel(c_angle.Ang)

# ---- group: Grasshopper Angle
angle = Angle(VectorA=vec_11, VectorB=vec_10, Plane=pln)  # -> Angle, Reflex

# ----
panel_35 = Panel(angle.Angle)
panel_36 = Panel(angle.Reflex)

vec_12 = Vector(Vector(16, 5, 0))
c_vlen = CSharpScript(V=vec_12)  # -> out, L; inputs V: Vector3d
# ---------- c_vlen: C# ----------
    //Component written by @krichterlunn

    // outputs Vector Length
    L = V.Length;
# ---------- end c_vlen ----------
panel_37 = Panel(c_vlen.L)

# ---- group: Grasshopper VLen
vlen = VectorLength(Vector=vec_12)

# ----
panel_38 = Panel(vlen)

vec_13 = Vector(Vector(10, 4, 0))
c_rev = CSharpScript(V=vec_13)  # -> out, Vout; inputs V: Vector3d
# ---------- c_rev: C# ----------
    //Component written by @krichterlunn

    // reverse vector
    V.Reverse();

    // output vector
    Vout = V;
# ---------- end c_rev ----------
panel_39 = Panel(c_rev.Vout)

# ---- group: Grasshopper Rev
rev = Reverse(Vector=vec_13)

# ----
panel_40 = Panel(rev)
