# Grasshopper definition Curve.Division.ghx (Grasshopper 1.0.7)

# ---- group: DivDist
number_slider = Slider(2, range=0..10)
crv = Curve(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)
divdist = DivideDistance(Curve=crv, Distance=number_slider)  # -> Points, Tangents, Parameters
gh_divdist = GHDivideDistance(C=crv, D=number_slider)  # -> out, P, T, t; inputs C: Curve, D: Double
# ---------- gh_divdist: C# ----------
    // Written by @v-xup6.

    // Divide a curve with a preset linear distance between points

    // Divide curve with equal linear distance between points
    // and store results in array
    Point3d[] divPt = C.DivideEquidistant(D);
    
    // Lists to store parameter and tangents
    List<double> parameters = new List<double>();
    List<Vector3d> tangents = new List<Vector3d>();
    
    // Loop thru all division points
    for(int i = 0; i < divPt.Length;i++){
      // Find and store its parameter
      double param;
      C.ClosestPoint(divPt[i], out param);
      // Add found parameter to parameters list
      parameters.Add(param);
      
      // Find tangents at parameter
      Vector3d tang = C.TangentAt(param);
      // Add tangent to tangents list
      tangents.Add(tang);
    }

    // Outputs
    P = divPt;
    T = tangents;
    t = parameters;
# ---------- end gh_divdist ----------
panel = Panel(divdist.Points)
panel_2 = Panel(gh_divdist.P)
panel_3 = Panel(divdist.Tangents)
panel_4 = Panel(gh_divdist.T)
panel_5 = Panel(divdist.Parameters)
panel_6 = Panel(gh_divdist.t)

# ---- group: Dash
crv_2 = Curve(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)
panel_7 = Panel("""1
2
6""")
dash = DashPattern(Curve=crv_2, Pattern=panel_7)  # -> Dashes, Gaps
gh_dash = GHDashPattern(C=crv_2, Pt=panel_7)  # -> out, D, G; inputs C: Curve, Pt: list of Double
# ---------- gh_dash: C# usings ----------
using System.Linq;
# ---------- gh_dash: C# ----------
    // Written by @v-xup6.

    // Convert a curve to a dash pattern by defining
    // the curve length of dash and gaps

    if(Pt.Sum() <= 0.0){
      this.Component.AddRuntimeMessage(
        GH_RuntimeMessageLevel.Error,
        "Total pattern length is too short.");
      return;
    }

    // List to store parameter of where each dash should start and end
    List<double> parameters = new List<double>();

    // Find parameter of where each dash should start and end
    // 3 double variables to store:
    // current position parameter on curve
    // start position parameter of crv
    // end position parameter of curve
    // accumulated length of dashes and gaps at current position
    double t, t0, t1;

    // Find start and end point of curve
    Point3d startPt = C.PointAtStart;
    Point3d endPt = C.PointAtEnd;

    // Find start and end parameter of curve
    C.ClosestPoint(startPt, out t0);
    C.ClosestPoint(endPt, out t1);

    // Create a domain: range to evaluate the dash
    Interval subdomain = new Interval(t0, t1);

    // Accumulated length of dashes and gaps at current position
    double dashLength = 0.0;

    // Boolean to start the for loop
    bool run = true;
    for(int i = 0; run; i++){
      // Find dash start end parameters using a "rolling check" technique:
      // query the curve for parameters until not possible.

      // Find accumulated dash length from input list
      dashLength += Pt[i % Pt.Count];

      // Find parameter at accumulated length
      run = C.LengthParameter(dashLength, out t, subdomain);

      // Record found parameter
      parameters.Add(t);
    }

    // Create a List of 2 lists:
    // list 1 - dash curve
    // list 2 - gap curves
    List<List<Curve>> crvs = new List<List<Curve>>();
    crvs.Add(new List<Curve>());
    crvs.Add(new List<Curve>());

    // Split curve at parameters
    Curve[] crvSplit = C.Split(parameters);

    // Loop thru curve segments
    for(int i = 0;i < crvSplit.Length; i++){
      // Odd segments are added to 1st list, even to 2nd list
      crvs[i % 2].Add(crvSplit[i]);
    }

    // Outputs
    D = crvs[0];
    G = crvs[1];
# ---------- end gh_dash ----------
panel_8 = Panel(dash.Dashes)
panel_9 = Panel(gh_dash.D)
panel_10 = Panel(dash.Gaps)
panel_11 = Panel(gh_dash.G)

# ---- group: Contour (ex)
offset = Panel("""0
20
40""")
pln = Plane(Plane(origin=(0, 0, 0), x=(0.7649596321, 0.4240240481, -0.4848096202), y=(-0.4848096202, 0.8746197071, 0)))
distance = Panel("""0
3
5
7""")
crv_3 = Curve(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)
contour = ContourEx(Curve=crv_3, Plane=pln, Offsets=offset, Distances=distance)  # -> Contours, Parameters
gh_contour = GHContour(C=crv_3, P=pln, O=offset, D=distance)  # -> out, Cont, t; inputs C: Curve, P: Plane, O: list of Double, D: list of Double
# ---------- gh_contour: C# usings ----------
using Rhino.Geometry.Intersect;
# ---------- gh_contour: C# ----------
    // Written by @v-xup6.

    // Create a set of Curve contours by defining
    // a starting plane and either offsets from plane
    // or the distances between each contour

    this.Component.AddRuntimeMessage(
      GH_RuntimeMessageLevel.Warning,
      "Issue with output path if any of the inputs is more than a single item");

    // List to store intersection events
    List<CurveIntersections> intEvent = new List<CurveIntersections>();

    // Check offsets or disatances, offsets takes priority over distances
    if(O.Count != 0) {
      // If there's something in offsets input
      intEvent = FindInt(C, P, O, 0);
    }
    else if(D.Count != 0) {
      // If nothing in offsets input, but there's something in distances input
      intEvent = FindInt(C, P, D, 1);
    }
    else{
      // If neither offset or distances are set, give warning and exit program
      this.Component.AddRuntimeMessage(
        GH_RuntimeMessageLevel.Warning,
        "You either have to specify Distances or Offsets");
      return;
    }

    // DataTree to store parameters and intersection points
    DataTree<double> parameter = new DataTree<double>();
    DataTree<Point3d> intersects = new DataTree<Point3d>();

    // Iterate thru intersection events
    for(int i = 0;i < intEvent.Count; i++){
      // Create a new branch for each level
      GH_Path path = new GH_Path(i);

      // Create empty paths if there's no intersection
      if(intEvent[i] == null){
        intersects.EnsurePath(path);
        parameter.EnsurePath(path);
        continue;
      }

      // Iterate thru all intersections at each level
      for(int j = 0;j < intEvent[i].Count;j++){
        // Find intersection point and add to DataTree for output
        Point3d pt = intEvent[i][j].PointA;
        intersects.Add(pt, path);

        // Find intersection parameter and add to DataTree for output
        double param = intEvent[i][j].ParameterA;
        parameter.Add(param, path);
      }
    }

    // Outputs
    Cont = intersects;
    t = parameter;
# ---------- gh_contour: C# additional code ----------
  List<CurveIntersections> FindInt(Curve crv, Plane pln, List<double> levels, int option){
    // Read document tolerance value, needed for finding intersections
    double tolerance = RhinoDoc.ActiveDoc.ModelAbsoluteTolerance;

    // List to store intersection events
    List<CurveIntersections> intersects = new List<CurveIntersections>();

    if(option == 0){
      // Using offset values from plane
      // Iterate thu the contour levels
      for(int i = 0; i < levels.Count;i++){
        // Vector of how far this level should be from starting plane
        Vector3d offset = pln.Normal * levels[i];

        // Origin position for this level
        Point3d origin = pln.Origin + offset;

        // Create plane for contour
        Plane pos = new Plane(origin, pln.Normal);

        // Find contour with plane
        CurveIntersections intersect = Intersection.CurvePlane(crv, pos, tolerance);

        // Add intersection event to list
        intersects.Add(intersect);
      }
    }
    else{
      // Using distance between contours
      // Iterate thu the contour levels
      for(int i = 0; i < levels.Count;i++){
        // Vector of how far this level should be from previous plane
        Vector3d offset = pln.Normal * levels[i];

        // Move plane to offset position
        pln.Origin = pln.Origin + (pln.Normal * levels[i]);

        // Find contour with plane
        CurveIntersections intersect = Intersection.CurvePlane(crv, pln, tolerance);

        // Add intersection event to list
        intersects.Add(intersect);
      }
    }
    return intersects;
  }
# ---------- end gh_contour ----------
panel_12 = Panel(contour.Contours)
panel_13 = Panel(gh_contour.Cont)
panel_14 = Panel(contour.Parameters)
panel_15 = Panel(gh_contour.t)

# ---- group: Divide Curve
number_slider_2 = Slider(3, range=0..10)
toggle = BooleanToggle(True)
crv_4 = Curve(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)
divide = DivideCurve(Curve=crv_4, Count=number_slider_2, Kinks=toggle)  # -> Points, Tangents, Parameters
gh_divide = GHDivideCurve(C=crv_4, N=number_slider_2, K=toggle)  # -> out, P, T, t; inputs C: Curve, N: Int32, K: Boolean
# ---------- gh_divide: C# ----------
    // Written by @v-xup6 & @garciadelcastillo.

    // Divide a curve into equal length segments, with length
    // considered as the arc length along the curve.

    // Let's first figure out what the parameters of the points on the curve are.
    List<double> parameters = new List<double>();
    if (N != 0)
    {
      double[] divParams = C.DivideByCount(N, true);
      parameters.AddRange(divParams.ToList());
    }

    // If kinks should be taken into consideration, find
    // their parameters, and sort them into the list.
    if (K == true)
    {
      // Find the kinks using a "rolling check" technique:
      // query the curve for discontinuities until no more are left.

      // List to store parameters of the kinks
      List<double> tk = new List<double>();

      // Start finding kinks from the start of the curve
      double t0 = C.Domain.T0;

      // Boolean to start the while loop
      bool run = true;
      while(run){
        // Find first kink between t0 and end of curve.
        // If kink found, run remains true, kink parameter
        // overwrites t0 so next iteration starts after this kink.
        // If not found, run turns false, 0 outputted to t0.
        run = C.GetNextDiscontinuity(Continuity.C2_continuous, t0, C.Domain.T1, out t0);

        // If kink found add to tk list, else do nothing and while loop ends
        if(run) tk.Add(t0);
      }

      // Add kink parameters to previously found parameters and sort them ascending
      parameters.AddRange(tk);
      parameters.Sort();
    }

    // Once we have all the parameters for all possible division points,
    // find the points and the corresponding tangents.
    List<Point3d> pts = new List<Point3d>();
    List<Vector3d> tangents = new List<Vector3d>();
    foreach (double param in parameters)
    {
      Point3d p = C.PointAt(param);
      pts.Add(p);
      Vector3d v = C.TangentAt(param);
      tangents.Add(v);
    }

    // Outputs
    P = pts;
    T = tangents;
    t = parameters;
# ---------- end gh_divide ----------
panel_16 = Panel(gh_divide.P)
panel_17 = Panel(divide.Points)
panel_18 = Panel(divide.Tangents)
panel_19 = Panel(gh_divide.T)
panel_20 = Panel(gh_divide.t)
panel_21 = Panel(divide.Parameters)

# ---- group: Contour
unit_z = UnitZ(Factor=1)
number_slider_3 = Slider(11, range=0..40)
pt = Point(Point(0, -16, -5.760509808))
# Curve Division
crv_5 = Curve(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)
gh_contour_2 = GHContour(C=crv_5, P=pt, N=unit_z, D=number_slider_3)  # -> out, Cont, t; inputs C: Curve, P: Point3d, N: Vector3d, D: Double
# ---------- gh_contour_2: C# ----------
    // Written by @v-xup6.

    // Create a set of curve contours by defining
    // a starting point, direction and distance between contours

    this.Component.AddRuntimeMessage(
      GH_RuntimeMessageLevel.Warning,
      "Issue with output path if any of the inputs is more than a single item");

    // Sanity check: if no direction is provided, infinite loop occurs
    if(N == new Vector3d(0, 0, 0)){
      this.Component.AddRuntimeMessage(
        GH_RuntimeMessageLevel.Error,
        "Direction must be provided to avoid infinite loop");
      return;
    }

    // Sanity check: if contour distance too small,
    // don't calculate to avoid crashing
    if(D <= tolerance){
      this.Component.AddRuntimeMessage(
        GH_RuntimeMessageLevel.Error,
        "Contour distance must be larger than the document absolute tolerance");
      return;
    }

    // Start of actual function of the component

    // Main list to store all the intersection events
    // below and above the starting point
    List<CurveIntersections> intEvent = new List<CurveIntersections>();

    // Starting level for contour
    Plane pln = new Plane(P, N);

    // List to temporary store intersections
    // in one direction, below/above plane
    List<CurveIntersections> intersection1D = new List<CurveIntersections>();

    // Find intersection events below plane
    // then reverse order to match ascending order
    intersection1D = FindInt(C, pln, -D);
    intersection1D.Reverse();

    // Add intersection event below plane to main list
    intEvent.AddRange(intersection1D);

    // Move plane up one step to avoid duplicates at starting level
    pln.Origin = pln.Origin + (N * D);

    // Find intersection events above plane
    // and overwrite intersection1D list
    intersection1D = FindInt(C, pln, D);

    // Add intersection events above plane to main list
    intEvent.AddRange(intersection1D);

    // List to store parameters and intersection points
    DataTree<double> parameter = new DataTree<double>();
    DataTree<Point3d> intPt = new DataTree<Point3d>();

    // Iterate thru intersection events
    for(int i = 0;i < intEvent.Count; i++){
      // Create a new branch for each level
      GH_Path path = new GH_Path(i);

      // Iterate thru all intersections at each level
      // find the point and parameter
      for(int j = 0;j < intEvent[i].Count;j++){
        // Find inter intersection point
        Point3d pt = intEvent[i][j].PointA;
        // Add point to list of intersection points
        intPt.Add(pt, path);

        // Find intersection parameter
        double intParam = intEvent[i][j].ParameterA;
        // Add parameter to list of intersection parameters
        parameter.Add(intParam, path);
      }
    }

    // Outputs
    Cont = intPt;
    t = parameter;
# ---------- gh_contour_2: C# additional code ----------
  // Read tolerance value for current rhino document
  double tolerance = RhinoDoc.ActiveDoc.ModelAbsoluteTolerance;

  List<CurveIntersections> FindInt(Curve crv, Plane pln, double dist){
    //list to store intersection events
    List<CurveIntersections> intersects = new List<CurveIntersections>();

    //Vector of direction we are checking for intersection events
    Vector3d direction = pln.Normal * dist;

    // Check if either or both start and end points of curve are
    // in the direction we are checking for intersection events
    //
    // If only one point is in the direction we are checking
    // we are starting on the curve, there should be at least
    // one intersection event
    //
    // If both points are in the direction we are checking
    // there should be at least one intersection event, except
    // when step is too big and curve in drawn inbetween steps
    // this is why 2 booleans are required
    //
    // If both points are not in the direction we are checking,
    // we should still check for intersection event at least once,
    // since curve might cross our starting position and then back
    //
    // If both point are not in the direction we are checking,
    // and first cut does not intersect anything, it is guaranteed
    // not possible to have any intersection in this direction

    // Check if intersection plausible in this direction at starting plane
    bool plausible = Possible(crv, pln, dist);

    // Create plane of fist step to check if intersection still plausible,
    // in case step is too big and curve is inbetween steps
    Point3d origin = pln.Origin + direction;
    Plane first = new Plane(origin, pln.Normal);
    bool plausible1 = Possible(crv, pln, dist);

    // Booleans to store if intersection in direction we are checking is possible
    bool possible = plausible && plausible1;

    // Boolean to start the while loop
    bool run = true;
    while(run){
      // Find intersection events using a "rolling check" technique:
      // check for intersection events until there's no intersection.

      // Check intersection at starting plane
      CurveIntersections intersect = Intersection.CurvePlane(crv, pln, tolerance);
      if(intersect != null){
        // If there was an intersection, store the intersection event
        intersects.Add(intersect);
      }
      else if((possible && intersects.Count > 0) || !possible){
        // Exit conditions for when there's no intersection at this step:
        // intersection is possible AND we already have intersection(s)
        // intersection wasn't possible to begin with
        run = false;
      }

      // Move plane position by a step for next iteration
      pln.Origin = pln.Origin + direction;
    }
    return intersects;
  }

  bool Possible(Curve crv, Plane pln, double dist){
    // Find z height of curve start and end points in contour plane coordinates
    double startZ = LocalCoordinate(crv.PointAtStart, pln);
    double endZ = LocalCoordinate(crv.PointAtEnd, pln);

    // Test if either is above contour plane
    bool start = startZ > 0;
    bool end = endZ > 0;

    // If testing for above, return test result
    // else we're testing for below, flip test result
    if(dist > 0){
      return (start || end);
    }
    else{
      return !(start || end);
    }
  }

  double LocalCoordinate(Point3d pt, Plane cSys){
    // Refer to Geometry Gem for addition explaination:
    // https://youtu.be/Brf4huewj-A

    // Vector from origin of coordinate system to point
    Vector3d posVec = pt - cSys.Origin;

    // Dot product = a.x*b.x+a.y*b.y+a.z*b.z
    double projZ = posVec * cSys.ZAxis;

    return projZ;
  }
# ---------- end gh_contour_2 ----------
# GH#: A C# dictionary of Grasshopper3D components.
# 
# This file contains a category of Grasshopper components, and a mirroring C#/RhinoCommon implementation.
# 
# This is an educational project initiated by students/faculty of GSD-6338: Introduction to Computational Design, at the Harvard Graduate School of Design.
# 
# More information: https://github.com/garciadelcastillo/gh-sharp
contour_2 = Contour(Curve=crv_5, Point=pt, Direction=unit_z, Distance=number_slider_3)  # -> Contours, Parameters
panel_22 = Panel(contour_2.Contours)
panel_23 = Panel(gh_contour_2.Cont)
panel_24 = Panel(contour_2.Parameters)
panel_25 = Panel(gh_contour_2.t)

# ----
number_slider_4 = Slider(2, range=0..10)
crv_6 = Curve(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)
divlength = DivideLength(Curve=crv_6, Length=number_slider_4)  # -> Points, Tangents, Parameters
gh_divlength = GHDivideLength(C=crv_6, L=number_slider_4)  # -> out, P, T, t; inputs C: Curve, L: Double
# ---------- gh_divlength: C# ----------
    // Written by @v-xup6.

    // Divide a curve into segments with a preset length

    // Get division point parameter
    double[] parameters = C.DivideByLength(L, true);

    // Lists to store tangents and points
    List<Vector3d> tangents = new List<Vector3d>();
    List<Point3d> points = new List<Point3d>();

    // Loop thru all parameter values
    foreach(double param in parameters){
      // Find division point and store it in points list
      Point3d pt = C.PointAt(param);
      points.Add(pt);

      // Find tangents and store it in tangents list
      Vector3d tang = C.TangentAt(param);
      tangents.Add(tang);
    }

    // Output
    P = points;
    T = tangents;
    t = parameters;
# ---------- end gh_divlength ----------
panel_26 = Panel(divlength.Points)
panel_27 = Panel(gh_divlength.P)
panel_28 = Panel(gh_divlength.T)
panel_29 = Panel(divlength.Tangents)
panel_30 = Panel(gh_divlength.t)
panel_31 = Panel(divlength.Parameters)

panel_32 = Panel("""50
100
500""")
crv_7 = Curve(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)
shatter = Shatter(Curve=crv_7, Parameters=panel_32)
gh_shatter = GHShatter(C=crv_7, t=panel_32)  # -> out, S; inputs C: Curve, t: list of Double
# ---------- gh_shatter: C# ----------
    // Written by @v-xup6.

    // Shatter a curve into segments with defined parameters
    S = C.Split(t);
# ---------- end gh_shatter ----------
panel_33 = Panel(shatter)
panel_34 = Panel(gh_shatter.S)

number_slider_5 = Slider(2, range=0..10)
crv_8 = Curve(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)
gh_hframes = GHHorizontalFrames(C=crv_8, N=number_slider_5)  # -> out, F, t; inputs C: Curve, N: Int32
# ---------- gh_hframes: C# ----------
    // Written by @v-xup6.

    // Generate a number of equally spaced, horitonally aligned curve frames

    if(N <= 0){
      // If no division, output empty array instead of null
      F = new Plane[]{};
      t = new double[]{};
      return;
    }

    // Find division points and parameters
    Point3d[] divPt;
    double[] parameters = C.DivideByCount(N, true, out divPt);

    // List to store the horizontal frames
    List<Plane> frames = new List<Plane>();

    // Integer to keep track of iteration count
    int i = 0;
    // Foreach instead of for simplifies parameters[i] into p
    foreach(double p in parameters){
      // Find tangent at parameter
      Vector3d tang = C.TangentAt(p);

      // Create a vector similar to tangent but without Z value
      // this will be used as the X axis of the horizontal plane
      Vector3d frameX = new Vector3d(tang.X, tang.Y, 0);

      // Make a copy of the flate tangent and rotate 90 degree
      // this will be used as the Y axis of the horizontal plane
      Vector3d frameY = frameX;
      frameY.Rotate(0.5 * Math.PI, Vector3d.ZAxis);

      // Create a plane using division point and the 2 vectors
      Plane frame = new Plane(divPt[i], frameX, frameY);
      // Add the frame into the list of other horizontal frames
      frames.Add(frame);

      // Increase iteration count for next iteration
      i++;
    }

    // Outputs
    F = frames;
    t = parameters;
# ---------- end gh_hframes ----------
hframes = HorizontalFrames(Curve=crv_8, Count=number_slider_5)  # -> Frames, Parameters
panel_35 = Panel(gh_hframes.F)
panel_36 = Panel(hframes.Frames)
panel_37 = Panel(gh_hframes.t)
panel_38 = Panel(hframes.Parameters)

number_slider_6 = Slider(2, range=0..10)
crv_9 = Curve(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)
gh_frames = GHCurveFrames(C=crv_9, N=number_slider_6)  # -> out, F, t; inputs C: Curve, N: Int32
# ---------- gh_frames: C# ----------
    // Written by @v-xup6.

    // Generate a number of equally spaced curve frames.

    if(N <= 0){
      // If no division, output empty array instead of null
      F = new Plane[]{};
      t = new double[]{};
      return;
    }
    
    // Find parameter
    double[] param = C.DivideByCount(N, true);

    // Find frames
    List<Plane> frames = new List<Plane>();
    // Loop thru the parameters to find frames
    foreach(double p in param){
      // Plane variable to store the plane at parameter
      Plane pln = new Plane();

      // Find plane
      C.FrameAt(p, out pln);

      // Add plane to plns list
      frames.Add(pln);
    }

    // Outputs
    F = frames;
    t = param;
# ---------- end gh_frames ----------
frames = CurveFrames(Curve=crv_9, Count=number_slider_6)  # -> Frames, Parameters
panel_39 = Panel(frames.Frames)
panel_40 = Panel(gh_frames.F)
panel_41 = Panel(frames.Parameters)
panel_42 = Panel(gh_frames.t)

number_slider_7 = Slider(1, range=0..10)
toggle_2 = BooleanToggle(True)
crv_10 = Curve(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)
gh_pframes = GHPerpFrames(C=crv_10, N=number_slider_7, A=toggle_2)  # -> out, F, t; inputs C: Curve, N: Int32, A: Boolean
# ---------- gh_pframes: C# ----------
    // Written by @v-xup6.

    // Generate a number of equally spaced, perpendicular frames along a curve

    if(N <= 0){
      // If no division, output empty array instead of null
      F = new Plane[]{};
      t = new double[]{};
      return;
    }

    // Find division points and parameters
    Point3d[] divPt;
    double[] parameters = C.DivideByCount(N, true, out divPt);

    // Create array of planes to store planes
    Plane[] frames = new Plane[parameters.Length];

    if(A){
      // If planes are to aligned use build in method
      frames = C.GetPerpendicularFrames(parameters);
    }
    else{
      // If planes don't need to align
      for(int i = 0; i < parameters.Length;i++){
        // Loop thru parameters to find tangent
        Vector3d tangent = C.TangentAt(parameters[i]);

        // Create a plane using tangent as normal
        Plane pln = new Plane(divPt[i], tangent);

        // Store the planes in frames array
        frames[i] = pln;
      }
    }

    // Outputs
    F = frames;
    t = parameters;
# ---------- end gh_pframes ----------
pframes = PerpFrames(Curve=crv_10, Count=number_slider_7, Align=toggle_2)  # -> Frames, Parameters
panel_43 = Panel(pframes.Frames)
panel_44 = Panel(gh_pframes.F)
panel_45 = Panel(gh_pframes.t)
panel_46 = Panel(pframes.Parameters)
