# Grasshopper definition Curve_Analysis.ghx (Grasshopper 1.0.7)

# ---- group: Curvature
non_planar_curve = Geometry(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)
curvepoint = PointOnCurve(non_planar_curve, parameter=0.534)
crv_cp = CurveClosestPoint(Point=curvepoint, Curve=non_planar_curve)  # -> Point, Parameter, Distance
gh_cruvature = CSharpScript(C=non_planar_curve, t=crv_cp.Parameter)  # -> out, P, K, Cir; inputs C: Curve, t: Double
# ---------- gh_cruvature: C# ----------
    // Component written by @joonhaeng-code & @v-xup6
    // This grasshopper component get a point, curvature and curvature circle on curve parameter t

    // get point and curvature at parameter t on curve C
    Point3d pointOnCurve = C.PointAt(t);
    Vector3d curvature = C.CurvatureAt(t);

    // Curvature = 1/r, r = 1/curvature
    double radius = 1.0 / curvature.Length;

    // Duplicate curvature vector to be unitized
    Vector3d curvatureU = curvature;
    curvatureU.Unitize();

    // Get center point of curvature circle using unitized curvature vector
    Point3d tempPoint = pointOnCurve + curvatureU * radius * 2;
    Circle curvatureCircle = new Circle(pointOnCurve, C.TangentAt(t), tempPoint);
    
    // Change circle to nurbs curve so output matchs GH (Circular Curve)
    NurbsCurve nCrv = curvatureCircle.ToNurbsCurve();

    // Outputs
    P = pointOnCurve;
    K = curvature;
    Cir = nCrv;
# ---------- end gh_cruvature ----------
curvature = Curvature(Curve=non_planar_curve, Parameter=crv_cp.Parameter)  # -> P, K, C
panel = Panel(curvature.P)
panel_2 = Panel(curvature.C)
panel_3 = Panel(gh_cruvature.Cir)
panel_4 = Panel(gh_cruvature.P)
panel_5 = Panel(gh_cruvature.K)
panel_6 = Panel(curvature.K)

# ----
pt = Point(Point(-2.47056265, 4.097518542, 0))
crv = Curve(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)
gh_crv_cp = CSharpScript(P=pt, C=crv)  # -> out, Pt, t, D; inputs P: Point3d, C: Curve
# ---------- gh_crv_cp: C# ----------
    // Component written by @joonhaeng-code
    // joonhaenglee@gsd.harvard.edu

    // Now we will get a closest point on input curve from input point.
    // To do that I found one function that find curve parameter t of the closest point.
    // Curve.Closest Point( input Point, Out t)
    // To extract the value t, we need to define that value first. lets say that as tempt (temporary t value).

    double tempt;

    // And run the function to get tempt

    C.ClosestPoint(P, out tempt);

    // Good! Now we have tempt value. It means, we can get the actual Point3d with xyz value in it.
    // Curve.PointAt(t) returns a point on input t value. Let's use this.

    Point3d pointOnCurve = C.PointAt(tempt);

    // Now you have a tempt and a point!
    // Lastly, lets get the distance between the input point and closest point!

    double distance = P.DistanceTo(pointOnCurve);

    // Done!
    // Now lets send tempt, pointOnCurve, and distance to c# output value.

    Pt = pointOnCurve;
    t = tempt;
    D = distance;
# ---------- end gh_crv_cp ----------
crv_cp_2 = CurveClosestPoint(Point=pt, Curve=crv)  # -> Point, Parameter, Distance
panel_7 = Panel(crv_cp_2.Point)
panel_8 = Panel(crv_cp_2.Parameter)
panel_9 = Panel(crv_cp_2.Distance)
panel_10 = Panel(gh_crv_cp.Pt)
panel_11 = Panel(gh_crv_cp.t)
panel_12 = Panel(gh_crv_cp.D)

geo = Geometry(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)
geo_2 = Geometry(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)
gh_crvprox = CSharpScript(A=geo, B=geo_2)  # -> out, PtA, PtB, D; inputs A: Curve, B: Curve
# ---------- gh_crvprox: C# ----------
    // Component written by @joonhaeng-code
    // joonhaenglee@gsd.harvard.edu

    // We will get a points in each curve which makes minial distance between two curves.
    // There is a method in Curve class to do this fucntion.
    // Curve.ClosestPoints( Curve, out Point1, out Point2)
    // to use this function, we need to define Point1 and Point2 first.

    // Let's make empty two Point3ds.

    Point3d Pt1;
    Point3d Pt2;

    // Let's use the method to get two points!

    A.ClosestPoints(B, out Pt1, out Pt2);

    // Now we have two Points. Pt1 is a point on A curve, and Pt2 is a curve on B.

    // Lastly, lets send this data to our C# component output.

    PtA = Pt1;
    PtB = Pt2;

    // One more, Let's get distance between those two points!

    D = Pt1.DistanceTo(Pt2);
# ---------- end gh_crvprox ----------
crvprox = CurveProximity(CurveA=geo, CurveB=geo_2)  # -> PointA, PointB, Distance
panel_13 = Panel(crvprox.PointA)
panel_14 = Panel(crvprox.PointB)
panel_15 = Panel(crvprox.Distance)
panel_16 = Panel(gh_crvprox.PtA)
panel_17 = Panel(gh_crvprox.PtB)
panel_18 = Panel(gh_crvprox.D)

crv_2 = Curve(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)
midpt = CurveMiddle(Curve=crv_2)
gh_midpt = CSharpScript(C=crv_2)  # -> out, M; inputs C: Curve
# ---------- gh_midpt: C# ----------
    // Component written by @joonhaeng-code
    // joonhaenglee@gsd.harvard.edu

    // Now we will get a middle point of input curve.
    // What is middle by the way? It could be the point that divide curve into two curves with same length.
    //
    // From Rhinocommon documentation, there is a function(below) that get Point that get a point at certain length from the startpoint.
    // Curve.PointAtLengt(Length)

    // So, If I know the "half length" of the curve, we might get the point in the middle.
    // To get "half length" lets try to get full length of the curve by using syntax
    // Curve.GetLength();

    double leng = C.GetLength();

    // Since we have leng, which is length of the curve, we can use
    // Curve.PointAtLengt(half length)

    M = C.PointAtLength(leng / 2);
# ---------- end gh_midpt ----------
panel_19 = Panel(midpt)
panel_20 = Panel(gh_midpt.M)

rec = Geometry(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)
drec = DeconstuctRectangle(Rectangle=rec)  # -> BasePlane, XInterval, YInterval
gh_drec = CSharpScript(R=rec)  # -> out, B, X, Y; inputs R: Rectangle3d
# ---------- gh_drec: C# ----------
    // Component written by @joonhaeng-code
    // joonhaenglee@gsd.harvard.edu

    // We will going to get Base Plane, width(X) and height(Y) of Rectangle.
    // Luckly, those are all properties of Rectangle.
    // So we can get those values directly buy using below.

    B = R.Plane;
    X = R.X;
    Y = R.Y;
# ---------- end gh_drec ----------
panel_21 = Panel(drec.YInterval)
panel_22 = Panel(gh_drec.B)
panel_23 = Panel(drec.BasePlane)
panel_24 = Panel(drec.XInterval)
panel_25 = Panel(gh_drec.X)
panel_26 = Panel(gh_drec.Y)

crv_3 = Curve(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)
gh_cls = CSharpScript(C=crv_3)  # -> out, Cl, P; inputs C: Curve
# ---------- gh_cls: C# ----------
    // Component written by @joonhaeng-code
    // joonhaenglee@gsd.harvard.edu

    // We will check whether the input curve is closed and is periodic.
    // Those are the properties of the curve.
    // We can get those value by using function below.

    Cl = C.IsClosed;
    P = C.IsPeriodic;
# ---------- end gh_cls ----------
cls = Closed(Curve=crv_3)  # -> Closed, Periodic
panel_27 = Panel(cls.Closed)
panel_28 = Panel(cls.Periodic)
panel_29 = Panel(gh_cls.Cl)
panel_30 = Panel(gh_cls.P)

# ----
# Curve Analysis
crv_4 = Curve(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)
# GH#: A C# dictionary of Grasshopper3D components.
# 
# This file contains a category of Grasshopper components, and a mirroring C#/RhinoCommon implementation.
# 
# This is an educational project initiated by students/faculty of GSD-6338: Introduction to Computational Design, at the Harvard Graduate School of Design.
# 
# More information: {{project link}}
cp = ControlPoints(Curve=crv_4)  # -> Points, Weights, Knots
gh_cp = CSharpScript(C=crv_4)  # -> out, P, W, K; inputs C: Curve
# ---------- gh_cp: C# ----------
    // Component written by @joonhaeng-code
    // joonhaenglee@gsd.harvard.edu

    // We will going to get Control Points, Weight, and Knots from curve.
    // Oh, in Rhinocommon, we can get those values from NurbsCurve Class since those are the properties of NurbsCurve.
    // Let change our Curve input to NurbsCurve.

    NurbsCurve tempC = C.ToNurbsCurve();

    // There will be more than one items or values in Point, Weight, and Knot. So I will going to make empty lists.

    List <Point3d> controlPoint = new List<Point3d>();
    List <double> Weights = new List<double>();
    List <double> Knots = new List<double>();

    // Lets get Control Points and Weights.
    // Control Point is a property of Nurbscurve, and Weight is a property of Control Point. So, we can use
    // Nurbscurve.Points
    // Nurbscurve.Points.GetWeight
    //
    // Let's get those value using for loop.
    // I will define a n value as the number of control points in Nurbscurve.

    int n = tempC.Points.Count;

    for (int i = 0 ; i < n ; i++)
    {

      // It does not mean that Control Point is same as point.
      // To get XYZ coordinate of control point, we have do extract XYZ value from control points and make a new points.

      Point3d tempControlPoint = new Point3d(tempC.Points[i].X, tempC.Points[i].Y, tempC.Points[i].Z);

      // Now tempControlPoint is a temporary new point on the [i]th controlpoint on Nurbscurve. Let's Put this point in our list.

      controlPoint.Add(tempControlPoint);

      // To get weight of control point, we can use
      // NurbsCurve.Points.GetWeight();

      double tempW = tempC.Points.GetWeight(i);

      // Let's add this weight value in our list.
      Weights.Add(tempW);

    }

    // Let's get Knots value using for loop.
    // I will define a np value as the number of knots in Nurbscurve.

    int np = tempC.Knots.Count;

    for (int i = 0 ; i < np ; i++)
    {
      Knots.Add(tempC.Knots[i]);
    }

    // Done!
    // Lastly, lets sent this list to our output values of this C# component.


    P = controlPoint;
    W = Weights;
    K = Knots;
# ---------- end gh_cp ----------
panel_31 = Panel(cp.Points)
panel_32 = Panel(cp.Weights)
panel_33 = Panel(cp.Knots)
panel_34 = Panel(gh_cp.P)
panel_35 = Panel(gh_cp.W)
panel_36 = Panel(gh_cp.K)

polygon = Geometry(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)
pcen = PolygonCenter(Polyline=polygon)  # -> CenterV, CenterE, CenterA
gh_pcen = CSharpScript(P=polygon)  # -> out, Cv, Ce, Ca; inputs P: Polyline
# ---------- gh_pcen: C# ----------
    // Component written by @joonhaeng-code, @garciadelcastillo
    // This grasshopper component gets 3 types of center points from Polyline

    // First, let's define temporary 0 values to contain sum of each vertex valuses.
    double tempX = 0;
    double tempY = 0;
    double tempZ = 0;
    int n = P.Count - 1;  // do not count the last vertex (duplicate on polylines)

    // For loop to add vertex values
    for (int i = 0 ; i < n; i++)
    {
      tempX = tempX + P.X[i];
      tempY = tempY + P.Y[i];
      tempZ = tempZ + P.Z[i];
    }

    // get average value and create a point.
    Point3d centerVertex = new Point3d(tempX / n, tempY / n, tempZ / n);

    // To get center area center point, lets make suface first and get mass centroid
    Brep[] brep = Brep.CreatePlanarBreps(P.ToNurbsCurve(), 0.001);
    if (brep != null && brep.Length > 0) {
      AreaMassProperties props = AreaMassProperties.Compute(brep[0]);
      Ca = props.Centroid;
    }

    Cv = centerVertex;

    // Center of edge point
    Ce = P.CenterPoint();
# ---------- end gh_pcen ----------
panel_37 = Panel(pcen.CenterV)
panel_38 = Panel(gh_pcen.Cv)
panel_39 = Panel(pcen.CenterE)
panel_40 = Panel(gh_pcen.Ce)
panel_41 = Panel(pcen.CenterA)
panel_42 = Panel(gh_pcen.Ca)

geo_3 = Geometry(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)
gh_disc = CSharpScript(C=geo_3, L="3")  # -> out, P, t; inputs C: Curve, L: Int32
# ---------- gh_disc: C# ----------
    // Component written by @joonhaeng-code
    // This grasshopper component checks contiuity of the curve.

    // There are 3 types of input L, 1 ,2,and 3. Those are choosing which curve continuous options to search.
    // In Rhinocommon, it is possible to search 'Next non-Continuity parameter' on curve rather than the number of total non continuity points.
    // So let's make empty list to put non continuity points, and count the number of each list.

    double temp;
    List<double> discont = new List<double>();
    List<Point3d> pts = new List<Point3d>();

    double a = C.Domain[0];
    double b = C.Domain[1];

    discont.Add(C.Domain[0]);
    pts.Add(C.PointAt(C.Domain[0]));

    // Check C1 continuity
    if( L == 1){
      while( C.GetNextDiscontinuity(Rhino.Geometry.Continuity.C1_continuous, a, b, out temp) ) {
        discont.Add(temp);
        pts.Add(C.PointAt(temp));
        a = temp;
      }
    }
      // Check C2 continuity
    else if(L == 2){
      while( C.GetNextDiscontinuity(Rhino.Geometry.Continuity.C2_continuous, a, b, out temp) ) {
        discont.Add(temp);
        pts.Add(C.PointAt(temp));
        a = temp;
      }
    }
      // Check Cinfinity continuity
    else if(L == 3){
      while( C.GetNextDiscontinuity(Rhino.Geometry.Continuity.Cinfinity_continuous, a, b, out temp) ) {
        discont.Add(temp);
        pts.Add(C.PointAt(temp));
        a = temp;
      }
    }


    discont.Add(C.Domain[1]);
    pts.Add(C.PointAt(C.Domain[1]));

    // Get discontinuity points and t parameters
    P = pts;
    t = discont;
# ---------- end gh_disc ----------
disc = Discontinuity(Curve=geo_3, Level="3")  # -> Points, Parameters
panel_43 = Panel(disc.Points)
panel_44 = Panel(gh_disc.P)
panel_45 = Panel(disc.Parameters)
panel_46 = Panel(gh_disc.t)

# ---- group: Planar
crv_5 = Curve(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)
crv_6 = Curve(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)
merge = Merge(Data1=crv_5, Data2=crv_6)
planar = Planar(Curve=merge)  # -> Planar, Plane, Deviation
gh_planar = GHPlanar(C=merge)  # -> out, p, P, D; inputs C: Curve
# ---------- gh_planar: C# usings ----------
using Rhino.Collections;
# ---------- gh_planar: C# ----------
    // Component written by @v-xup6.

    // Test a curve for planarity

    this.Component.AddRuntimeMessage(
      GH_RuntimeMessageLevel.Warning,
      "Don't know how to calculate for plane and deviation when curve not planar");


    // Test for planarity
    bool isPlanar = C.IsPlanar();
    double deviation = -1;

    // Plane to for plane of curve
    Plane pln = new Plane();
    if(isPlanar){
      // Find frame at start of curve
      Point3d startPt = C.PointAtStart;
      double t;
      C.ClosestPoint(startPt, out t);
      C.FrameAt(t, out pln);
      deviation = 0;
    }
    else{
      // Not correct
      NurbsCurve nCrv = C.ToNurbsCurve();
      Point3dList nCrvPt = nCrv.GrevillePoints(true);
      Plane.FitPlaneToPoints(nCrvPt, out pln);
    }

    // Output
    p = isPlanar;
    P = pln;
    D = deviation;
# ---------- end gh_planar ----------
panel_47 = Panel(planar.Planar)
panel_48 = Panel(planar.Deviation)
panel_49 = Panel(gh_planar.D)
panel_50 = Panel(gh_planar.p)
panel_51 = Panel(planar.Plane)
panel_52 = Panel(gh_planar.P)

# ----
non_planar_curve_2 = Geometry(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)
curvepoint_2 = PointOnCurve(non_planar_curve_2, parameter=0.5)
crv_cp_3 = CurveClosestPoint(Point=curvepoint_2, Curve=non_planar_curve_2)  # -> Point, Parameter, Distance
gh_hframe = CSharpScript(C=non_planar_curve_2, t=crv_cp_3.Parameter)  # -> out, F; inputs C: Curve, t: Double
# ---------- gh_hframe: C# ----------
    // Component written by @joonhaeng-code
    // This grasshopper component get a hrozontal plane on curve parameter t.

    // horontal plane' Z Axis will be (0,0,1)
    // Let's remove Z Axis from C tangent vector

    Vector3d temp = new Vector3d(C.TangentAt(t).X, C.TangentAt(t).Y, 0);

    // Since we forced to remove ZAxis value, the size of vector will not be a 1. Make it unit vector
    temp.Unitize();

    // Set PlnX as temp
    Vector3d PlnX = temp;

    // Rotate 90 degreee or 0.25 T and make it as plnY
    temp.Rotate(Math.PI * 0.5, Vector3d.ZAxis);
    Vector3d PlnY = temp;

    // Construct Plane
    Plane horizontalPlane = new Plane(C.PointAt(t), PlnX, PlnY);

    F = horizontalPlane;
# ---------- end gh_hframe ----------
hframe = HorizontalFrame(Curve=non_planar_curve_2, Parameter=crv_cp_3.Parameter)
panel_53 = Panel(hframe)
panel_54 = Panel(gh_hframe.F)

non_planar_curve_3 = Geometry(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)
curvepoint_3 = PointOnCurve(non_planar_curve_3, parameter=0.509)
crv_cp_4 = CurveClosestPoint(Point=curvepoint_3, Curve=non_planar_curve_3)  # -> Point, Parameter, Distance
gh_cdiv = CSharpScript(C=non_planar_curve_3, t=crv_cp_4.Parameter)  # -> out, P, V; inputs C: Curve, t: Double
# ---------- gh_cdiv: C# ----------
    // Component written by @joonhaeng-code
    // This grasshopper component get a point and tangent vector on curve parameter t

    // TODO: Match result with original
    Component.AddRuntimeMessage(GH_RuntimeMessageLevel.Warning, "Output doesn't match original exactly");

    P = C.PointAt(t);
    V = C.TangentAt(t);
# ---------- end gh_cdiv ----------
cdiv = Derivatives(Curve=non_planar_curve_3, Parameter=crv_cp_4.Parameter)  # -> Point, FirstDerivative
panel_55 = Panel(cdiv.Point)
panel_56 = Panel(cdiv.FirstDerivative)
panel_57 = Panel(gh_cdiv.P)
panel_58 = Panel(gh_cdiv.V)

non_planar_curve_4 = Geometry(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)
curvepoint_4 = PointOnCurve(non_planar_curve_4, parameter=0.5)
gh_curvepoint = CSharpScript(C=non_planar_curve_4, l="0.500")  # -> out, P; inputs C: Curve, l: Double
# ---------- gh_curvepoint: C# ----------
    // Component written by @joonhaeng-code
    // This grasshopper component get a point and middle( length) of the curve
    
    P = C.PointAtLength(C.GetLength() * l);
# ---------- end gh_curvepoint ----------
panel_59 = Panel(gh_curvepoint.P)
panel_60 = Panel(curvepoint_4)

geo_4 = Geometry(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)
gh_crvdom = CSharpScript(C=geo_4, D="0 To 2")  # -> out, Cr, Dm; inputs C: Curve
# ---------- gh_crvdom: C# ----------
    // Component written by @joonhaeng-code, @garciadelcastillo
    // This grasshopper component get a domain of curve.

    // First, let's export current input curve's domain.
    Dm = C.Domain;

    // Let's define curve's new domain with input interval D
    C.Domain = D;

    // Let's place our updated Curve into cr as an output.
    Cr = C;
# ---------- end gh_crvdom ----------
crvdom = CurveDomain(Curve=geo_4, Domain="0 To 2")  # -> Curve, Domain
panel_61 = Panel(crvdom.Curve)
panel_62 = Panel(crvdom.Domain)
panel_63 = Panel(gh_crvdom.Cr)
panel_64 = Panel(gh_crvdom.Dm)
crvdom_2 = CurveDomain(Curve=crvdom.Curve)  # -> Curve, Domain
crvdom_3 = CurveDomain(Curve=gh_crvdom.Cr)  # -> Curve, Domain
panel_65 = Panel(crvdom_2.Domain)
panel_66 = Panel(crvdom_3.Domain)

number_slider = Slider(0.5, range=0..1)
geo_5 = Geometry(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)
gh_lenp = CSharpScript(C=geo_5, P=number_slider)  # -> out, L1, L2; inputs C: Curve, P: Double
# ---------- gh_lenp: C# ----------
   
    // Component written by @joonhaeng-code
    // This grasshopper component get a split curves' length.
    
    // Get first half length of curve
    L1 = C.Split(P)[0].GetLength();
    
    // Get second half length of curve
    L2 = C.Split(P)[1].GetLength();
# ---------- end gh_lenp ----------
lenp = LengthParameter(Curve=geo_5, Parameter=number_slider)  # -> Length, Length_2
panel_67 = Panel(lenp.Length)
panel_68 = Panel(lenp.Length_2)
panel_69 = Panel(gh_lenp.L1)
panel_70 = Panel(gh_lenp.L2)

geo_6 = Geometry(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)
gh_len = CSharpScript(C=geo_6)  # -> out, L; inputs C: Curve
# ---------- gh_len: C# ----------
   
    // Component written by @joonhaeng-code
    // This grasshopper component get a length of curve.
    L = C.GetLength();
# ---------- end gh_len ----------
len = Length(Curve=geo_6)
panel_71 = Panel(len)
panel_72 = Panel(gh_len.L)

# ---- group: Point In Curve
crv_7 = Curve(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)
pt_2 = Point([Point(-63.36121546, 16.93946743, 0), Point(27.45252375, -20.33885982, 0), Point(76.69504536, -18.99021904, 0), Point(94.81213182, 38.03725162, 0), Point(30.35759894, 25.64138058, 0), Point(35.80793074, 16.93946743, 11.86398482), Point(-22.20049952, 0.04331655673, -15.37283461), Point(9.409906102, 37.76277836, 9.474822003)])
incurve = PointInCurve(Point=pt_2, Curve=crv_7)  # -> Relationship, Point
gh_incurve = GHPointInCurve(P=pt_2, C=crv_7)  # -> out, R, projPt; inputs P: Point3d, C: Curve
# ---------- gh_incurve: C# ----------
    // Component written by @v-xup6.

    // Test a point for closed curve containment

    this.Component.AddRuntimeMessage(
      GH_RuntimeMessageLevel.Warning,
      "Need to find plane of curve for correct output");

    // Find plane of curve
    // ?????
    Plane pln = Plane.WorldXY;

    // Test for containment, need to specify plane
    // Will not match GH output unless defined plane of curve is correct
    PointContainment inside = C.Contains(P, pln, Rhino.RhinoDoc.ActiveDoc.ModelAbsoluteTolerance);

    // Change output value to match GH output
    int intValue = (int) inside;
    switch(intValue){
      case 2:
        intValue = 0;
        break;
      case 1:
        intValue = 2;
        break;
      case 3:
        intValue = 1;
        break;
    }

    // Project point to plane
    Transform project = Transform.PlanarProjection(pln);
    P.Transform(project);

    R = intValue;
    projPt = P;
# ---------- end gh_incurve ----------
panel_73 = Panel(incurve.Relationship)
panel_74 = Panel(gh_incurve.R)
panel_75 = Panel(gh_incurve.projPt)
panel_76 = Panel(incurve.Point)

# ----
crv_8 = Geometry(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)
darc = DeconstructArc(Arc=crv_8)  # -> BasePlane, Radius, Angle
gh_darc = CSharpScript(A=crv_8)  # -> out, B, R, An
# ---------- gh_darc: C# ----------
    // Component written by @joonhaeng-code
    // joonhaenglee@gsd.harvard.edu

    // We will get Plane, Radius and Angle Domain of input arc.
    // Those are the properties of the arc.
    // We can get those value by using function below.

    B = A.Plane;
    R = A.Radius;
    An = A.AngleDomain;
# ---------- end gh_darc ----------
panel_77 = Panel(darc.BasePlane)
panel_78 = Panel(darc.Radius)
panel_79 = Panel(darc.Angle)
panel_80 = Panel(gh_darc.B)
panel_81 = Panel(gh_darc.R)
panel_82 = Panel(gh_darc.An)

crv_9 = Curve(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)
cpoly = ControlPolygon(Curve=crv_9)  # -> Polygon, Points
gh_cpoly = CSharpScript(C=crv_9)  # -> out, CP, P; inputs C: Curve
# ---------- gh_cpoly: C# ----------
    // Component written by @joonhaeng-code
    // joonhaenglee@gsd.harvard.edu

    // We will get Control Points of input curve and polyline that links those points.
    // So, first, let's make a empty list to contain the control points.

    List<Point3d> Points = new List<Point3d>();

    for (int i = 0, n = C.ToNurbsCurve().Points.Count; i < n; i++)
    {
      // It does not mean that Control Point is same as point.
      // To get XYZ coordinate of control point, we have do extract XYZ value from control points and make a new points.
      // Meanwhile, to get Control Points from Curve, we have to convert Curve to Nurbscurve.
      // To do that, we can use
      // Curve.ToNurbsCurve()

      // So, X coordiate of ith Control Point of Curve may looks like following.
      // C.ToNurbsCurve().Points[i].X

      Point3d temp = new Point3d(C.ToNurbsCurve().Points[i].X, C.ToNurbsCurve().Points[i].Y, C.ToNurbsCurve().Points[i].Z);

      //Let's add this temp to our point list.
      Points.Add(temp);
    }

    // We can simply make polyline using Point list by using below.
    Polyline pl = new Polyline(Points);

    // Finally, let's make pl and Points as output of this C# components.
    CP = pl;
    P = Points;
# ---------- end gh_cpoly ----------
panel_83 = Panel(cpoly.Polygon)
panel_84 = Panel(cpoly.Points)
panel_85 = Panel(gh_cpoly.CP)
panel_86 = Panel(gh_cpoly.P)

crv_10 = Curve(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)
end = EndPoints(Curve=crv_10)  # -> Start, End
gh_end = CSharpScript(C=crv_10)  # -> out, S, E; inputs C: Curve
# ---------- gh_end: C# ----------
    // Component written by @joonhaeng-code
    // joonhaenglee@gsd.harvard.edu

    // Now we will get start Point and end point of input curve.
    // From Properties tap in Curve Class we can find that those two values are inherent properties of the curve.
    // So we can get those value easily by using function below.

    S = C.PointAtStart;
    E = C.PointAtEnd;
# ---------- end gh_end ----------
panel_87 = Panel(end.End)
panel_88 = Panel(end.Start)
panel_89 = Panel(gh_end.S)
panel_90 = Panel(gh_end.E)

geo_7 = Geometry(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)
number_slider_2 = Slider(1, range=0..100)
number_slider_3 = Slider(114, range=0..114)
gh_crvgraph = CSharpScript(C=geo_7, D=number_slider_2, S=number_slider_3)  # -> out, P, L, Crv; inputs C: Curve, D: Int32, S: Double
# ---------- gh_crvgraph: C# ----------
    // Component written by @joonhaeng-code
    // This grasshopper component express curvature graph in form of curve

    // TODO: Match result with original (need to understand what exactly D and S input means)
    Component.AddRuntimeMessage(GH_RuntimeMessageLevel.Warning, "Output doesn't match original exactly");

    // Let's make a list of points which will be a point to make a curvature curve.
    List<Point3d> pt = new List<Point3d>();

    // k will be the number of points which will represent curvature graph. you can modifiy it.
    // if k is too small, curvature graph would be too simplyfied.
    int k = 100;

    // using for loop, let's get curvature vectors
    for ( int i = 0, n = k + 1; i < n; i++){

      Point3d dividPt = C.PointAt(C.DivideByCount(k, true)[i]);
      Vector3d temp = C.CurvatureAt(C.DivideByCount(k, true)[i]);

      // move k points on curve in direction of curvature.
      double tempr = temp.Length;
      pt.Add(dividPt + temp * S * -1);

    }

    P = pt;
    Crv = Curve.CreateInterpolatedCurve(pt, 3);
# ---------- end gh_crvgraph ----------
crvgraph = CurvatureGraph(Curve=geo_7, Density=number_slider_2, Scale=number_slider_3)
panel_91 = Panel(gh_crvgraph.P)
panel_92 = Panel(gh_crvgraph.Crv)

# ---- group: Curve Nearest Object
pt_3 = Point([Point(-20.27984284, 26.30401803, 6.032683482), Point(3.085970012, -19.51233244, 0), Point(29.15193141, 22.71321734, 0)])
rec_2 = Rectangle({Plane=PlaneYZ(0, 0, 0), Size=Domain2(u=-1..1, v=-2..2)})
box = Box({Plane=PlaneXY(0, 0, 0), X=Domain(2.984716777, 6.948818392), Y=Domain(12.84288693, 15.70891233), Z=Domain(0, 0.25)})
circle = Circle({Plane=PlaneYZ(0, 0, 0), Radius=5})
line = Line(Line((-3.801189799, 13.04257221, 0), (24.68721712, 12.3578816, 0)))
crv_11 = Curve(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)
pln = Plane(Plane(origin=(3.085970012, -19.51233244, 0), x=(0.5252809825, 0.8509288392, 0), y=(-0.8430238816, 0.5204012279, 0.1359900624)))
brep = Brep([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])
srf = Surface(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)
crv_12 = Curve(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)
merge_2 = Merge(
    Data1=rec_2,
    Data2=pt_3,
    Data3=circle,
    Data4=box,
    Data5=crv_12,
    Data6=brep,
    Data7=line,
    Data8=srf,
    Data9=crv_11,
    Data10=pln)
crv_13 = Curve(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)
gh_crvnear = GHCurveNearestObject(C=crv_13, G=merge_2)  # -> out, A, B, I; inputs C: Curve, G: list of GeometryBase
# ---------- gh_crvnear: C# ----------
    // Component written by @v-xup6.

    // Find the nearest point on an object nearest to a curve
    // and the closest point on the curve to the object

    Point3d ptOnCrv, ptOnGeo;
    int closestIndex;
    C.ClosestPoints(G, out ptOnCrv, out ptOnGeo, out closestIndex);

    A = ptOnCrv;
    B = ptOnGeo;
    I = closestIndex;
# ---------- end gh_crvnear ----------
crvnear = CurveNearestObject(Curve=crv_13, Geometry=merge_2)  # -> PointA, PointB, Index
panel_93 = Panel(crvnear.PointB)
panel_94 = Panel(crvnear.PointA)
panel_95 = Panel(crvnear.Index)
panel_96 = Panel(gh_crvnear.A)
panel_97 = Panel(gh_crvnear.B)
panel_98 = Panel(gh_crvnear.I)

# ---- group: Evaluate Length
length = Slider(54, range=0..100)
normalized = Slider(0.95, range=0..1)
normalize = BooleanToggle(True)
filter = StreamFilter(Gate=normalize, Stream0=length, Stream1=normalized)
crv_14 = Curve(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)
gh_eval = GHEvaluateLength(C=crv_14, L=filter, N=normalize)  # -> out, P, T, t; inputs C: Curve, L: Double, N: Boolean
# ---------- gh_eval: C# ----------
    
     // Component written by @v-xup6.
    
    // Evaluate a curve at a certain factor along its length. 
    // Length factor can be supplied either in curve units or normalized units
    
    double param;
    if(N){
      C.NormalizedLengthParameter(L, out param);
    }
    else{
      C.LengthParameter(L, out param);
    }

    P = C.PointAt(param);
    T = C.TangentAt(param);
    t = param;
# ---------- end gh_eval ----------
eval = EvaluateLength(Curve=crv_14, Length=filter, Normalized=normalize)  # -> Point, Tangent, Parameter
panel_99 = Panel(eval.Point)
panel_100 = Panel(eval.Tangent)
panel_101 = Panel(eval.Parameter)
panel_102 = Panel(gh_eval.T)
panel_103 = Panel(gh_eval.P)
panel_104 = Panel(gh_eval.t)

# ---- group: Length Domain
crv_15 = Curve(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)
dom = ConstructDomain(DomainStart=Slider(6, range=0..30), DomainEnd=Slider(50, range=50..90))
lend = LengthDomain(Curve=crv_15, Domain=dom)
gh_lend = LengthDomain(C=crv_15, D=dom)  # -> out, L; inputs C: Curve
# ---------- gh_lend: C# ----------
    // Component written by @v-xup6.

    // Measure the length of a curve subdomain

    L = C.GetLength(D);
# ---------- end gh_lend ----------
panel_105 = Panel(lend)
panel_106 = Panel(gh_lend.L)

# ---- group: Segment Lengths
crv_16 = Curve(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)
lenseg = SegmentLengths(Curve=crv_16)  # -> ShortestLength, ShortestDomain, LongestLength, LongestDomain
gh_lenseg = GHSegmentLengths(C=crv_16)  # -> out, Sl, Sd, Ll, Ld; inputs C: Curve
# ---------- gh_lenseg: C# ----------
    // Component written by @v-xup6.
    
    // Finds the shortest and longest segments of a curve
    
    // Explode the curve into segments
    Curve[] crv = C.DuplicateSegments();
    
    // Variables to store lengths and domains
    double shortest = double.MaxValue;
    double longest = double.MinValue;
    Interval sDomain = new Interval();
    Interval lDomain = new Interval();
    
    // Loop thru segments to find longest and shortest
    foreach(Curve c in crv){
      double length = c.GetLength();
      if(length < shortest){ 
        shortest = length;
        sDomain = c.Domain;
      }
      if(length > longest){
        longest = length;
        lDomain = c.Domain;
      }
    }
      
    // Output
    Sl = shortest;
    Sd = sDomain;
    Ll = longest;
    Ld = lDomain;
# ---------- end gh_lenseg ----------
panel_107 = Panel(gh_lenseg.Ll)
panel_108 = Panel(lenseg.LongestLength)
panel_109 = Panel(gh_lenseg.Sl)
panel_110 = Panel(lenseg.ShortestLength)
panel_111 = Panel(gh_lenseg.Ld)
panel_112 = Panel(lenseg.ShortestDomain)
panel_113 = Panel(lenseg.LongestDomain)
panel_114 = Panel(gh_lenseg.Sd)

# ---- group: Point in Curves
pt_4 = Point([Point(-63.36121546, 16.93946743, 0), Point(27.45252375, -20.33885982, 0), Point(76.69504536, -18.99021904, 0), Point(94.81213182, 38.03725162, 0), Point(30.35759894, 25.64138058, 0), Point(35.80793074, 16.93946743, 11.86398482), Point(-22.20049952, 0.04331655673, -15.37283461), Point(9.409906102, 37.76277836, 9.474822003), Point(-13.53521869, -30.28976401, 0)])
crv_17 = Curve([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])
crv_18 = Curve([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])
gh_incurves = GHPointInCurves(P=pt_4, C=crv_18)  # -> out, R, I, projPt; inputs P: Point3d, C: list of Curve
# ---------- gh_incurves: C# ----------
    // Component written by @v-xup6.

    // Test a point for closed curve containment

    this.Component.AddRuntimeMessage(
      GH_RuntimeMessageLevel.Warning,
      "Need to find plane of curve for correct output");

    List<Plane> cPln = new List<Plane>();
    foreach(Curve c in C){
      // Find plane of curve ????
      // need proper logic instead of XY plane
      Plane p = Plane.WorldXY;

      cPln.Add(p);
    }

    // Find tolerance of document
    double tolerance = Rhino.RhinoDoc.ActiveDoc.ModelAbsoluteTolerance;

    // Unset = 0, inside = 1, outside = 2, coincident = 3
    // assume coincident
    int pc = (int) PointContainment.Unset;
    int result = 0;
    int index = -1;

    // Check if point inside any curve
    for(int i = 0;i < C.Count;i++){
      pc = (int) C[i].Contains(P, cPln[i], tolerance);
      if(pc == 1){
        result = pc;
        index = i;
        goto project;
        continue;
      }
      else if(pc == 3){
        result = pc;
        index = i;
        goto project;
        continue;
      }
      else if(pc == 2 && result == 0){
        result = pc;
        continue;
      }
      project:
        // Project point to plane
        Transform project = Transform.PlanarProjection(cPln[i]);
      P.Transform(project);
    }

    // Change output value to match GH output
    switch(result){
      case 2:
        result = 0;
        break;
      case 1:
        result = 2;
        break;
      case 3:
        result = 1;
        break;
    }

    R = result;
    I = index;
    projPt = P;
# ---------- end gh_incurves ----------
incurves = PointInCurves(Point=pt_4, Curves=crv_18)  # -> Relationship, Index, Point
panel_115 = Panel(incurves.Relationship)
panel_116 = Panel(gh_incurves.R)
panel_117 = Panel(incurves.Index)
panel_118 = Panel(gh_incurves.I)
panel_119 = Panel(incurves.Point)
panel_120 = Panel(gh_incurves.projPt)

# ---- group: Curve Side
pt_5 = Point([Point(-20.27984284, 26.30401803, 6.032683482), Point(3.085970012, -19.51233244, 0), Point(29.15193141, 22.71321734, 0)])
yz = YZPlane(Origin=Point(0, 0, 0))
crv_19 = Curve(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)
gh_side = GHCurveSide(C=crv_19, P=pt_5, Pl=yz)  # -> out, S, L, R; inputs C: Curve, P: Point3d, Pl: Plane
# ---------- gh_side: C# ----------
    // Component written by @v-xup6.

    // Find the nearest point on an object nearest to a curve
    // and the closest point on the curve to the object


    // Reference: https://discourse.mcneel.com/t/curve-side-relationship-to-points/74776/3

    this.Component.AddRuntimeMessage(GH_RuntimeMessageLevel.Warning, "Plane input not implemented");

    // ClosestPoint
    double t;
    C.ClosestPoint(P, out t);
    Print(t + "");
    Point3d pt = C.PointAt(t);

    // TangentVector
    Vector3d tang = C.TangentAt(t);

    // Vector2Point
    Vector3d v2p = new Vector3d (P - pt);

    // CrossProduct
    Vector3d newVec = new Vector3d(pt.X, pt.Y, pt.Z);//vectorOutOfPoint
    Vector3d crPo = Vector3d.CrossProduct(v2p, newVec);

    if (crPo.Z < 0){
      S = "-1";
      L = true;
      R = false;
    }
    else if(crPo.Z > 0){
      S = "1";
      L = false;
      R = true;
    }
    else{
      S = "0";
      L = false;
      R = false;
    }
# ---------- end gh_side ----------
side = CurveSide(Curve=crv_19, Point=pt_5, Plane=yz)  # -> Side, Left, Right
panel_121 = Panel(side.Side)
panel_122 = Panel(gh_side.S)
panel_123 = Panel(gh_side.L)
panel_124 = Panel(side.Left)
panel_125 = Panel(gh_side.R)
panel_126 = Panel(side.Right)

# ---- group: Extremes
xz = XZPlane(Origin=Point(0, 0, 0))
crv_20 = Curve(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)
gh_x_tremez = Extremes(C=crv_20, P=xz)  # -> out, H, L; inputs C: Curve, P: Plane
# ---------- gh_x_tremez: C# ----------
    // Component written by @v-xup6.

    // Find the point on the curve with highest and lowest
    // z value in the coordinate system of the input plane

    // Abbreviate commonly used xy plane
    Plane xy = Plane.WorldXY;

    // If P input not set, default to XY
    if(P == new Plane()) P = xy;
    else{
      // If plane set, transform curve to match its orientation
      Transform x = Transform.ChangeBasis(xy, P);
      C.Transform(x);
    }

    // Array to store highest and lowest points
    Point3d[] extreme = new Point3d[2];

    // Create nullable double, ensures no false positives
    double? low = null;
    double? high = null;

    // Find parameters of all local extrema in world Z direction
    double[] parameters = C.ExtremeParameters(xy.ZAxis);

    // Loop thru parameters, find highest and lowest Point
    foreach(double p in parameters){
      Point3d pt = C.PointAt(p);
      double height = pt.Z;
      if(low > height || low == null){
        low = height;
        extreme[0] = pt;
      }
      if(high < height || high == null){
        high = height;
        extreme[1] = pt;
      }
    }

    // Orient extremes back to world coordinate system
    Transform xR = Transform.ChangeBasis(P, xy);
    extreme[0].Transform(xR);
    extreme[1].Transform(xR);

    // Output
    H = extreme[1];
    L = extreme[0];
# ---------- end gh_x_tremez ----------
x_tremez = Extremes(Curve=crv_20, Plane=xz)  # -> Highest, Lowest
panel_127 = Panel(x_tremez.Highest)
panel_128 = Panel(x_tremez.Lowest)
panel_129 = Panel(gh_x_tremez.L)
panel_130 = Panel(gh_x_tremez.H)

# ----
number_slider_4 = Slider(83, range=0..100)
non_planar_curve_5 = Geometry(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)
gh_frame = CSharpScript(C=non_planar_curve_5, t=number_slider_4)  # -> out, F; inputs C: Curve, t: Double
# ---------- gh_frame: C# ----------
    // Component written by @joonhaeng-code
    // This grasshopper component get a frame plane of the curve

    Plane tempPl = new Plane(C.PointAt(t), C.TangentAt(t), C.CurvatureAt(t));
    F = tempPl;
# ---------- end gh_frame ----------
frame = CurveFrame(Curve=non_planar_curve_5, Parameter=number_slider_4)
panel_131 = Panel(gh_frame.F)
panel_132 = Panel(frame)

# ---- group: Evaluate Curve
crv_21 = Curve(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)
disc_2 = Discontinuity(Curve=crv_21, Level=1)  # -> Points, Parameters
jitter = Jitter(List=disc_2.Parameters, Jitter=1, Seed=2)  # -> Values, Indices
eval_2 = EvaluateCurve(Curve=crv_21, Parameter=jitter.Values)  # -> Point, Tangent, Angle
gh_eval_2 = GHEvaluateCurve(C=crv_21, t=jitter.Values)  # -> out, P, T, A; inputs C: Curve, t: Double
# ---------- gh_eval_2: C# ----------
    // Component written by @v-xup6.

    // Evaluate a curve at the specified parameter for
    // point, tangent and angle

    // Tangent at parameter
    Vector3d tangent = C.TangentAt(t);

    // Check if curve at parameter is continuous
    // if continuous no change in angle
    bool cont = C.IsContinuous(Continuity.G1_continuous, t);
    double angle = 0;

    // If not continuous, compare to previous discontinuity to find angle
    if(!cont){
      // Start by finding all discontinuity on curve

      // Start search range from start to end of curve
      double t0,t1;
      double p = double.MaxValue;
      C.ClosestPoint(C.PointAtStart, out t0);
      C.ClosestPoint(C.PointAtEnd, out t1);

      // List to store parameters of discontinuity
      List<double> parameters = new List<double>();

      // Start finding discontinuities
      while(true){
        bool found = C.GetNextDiscontinuity(Continuity.G1_continuous, t0, t1, out p);
        if(found){
          // If discontinuity found, shrink search range and record the parameter
          t0 = p;
          parameters.Add(p);
        }
        else break;
        // If no discontinuity found, stop searching
      }

      // Add current evaluation parameter to list and sort ascending
      parameters.Add(t);
      parameters.Sort();

      // Figure out where current evalution is on list
      int i = parameters.IndexOf(t);
      if(i == 0){
        // If at start of list, measure angle betwen tangent at start and tangent
        angle = Vector3d.VectorAngle(C.TangentAtStart, tangent);
      }
      else
        // Else find angle between tangent at previous discontinuity and tangent
        angle = Vector3d.VectorAngle(C.TangentAt(parameters[i - 1]), tangent);
    }

    // Output
    P = C.PointAt(t);
    T = tangent;
    A = angle;
# ---------- end gh_eval_2 ----------
panel_133 = Panel(eval_2.Point)
panel_134 = Panel(gh_eval_2.P)
panel_135 = Panel(gh_eval_2.T)
panel_136 = Panel(eval_2.Tangent)
panel_137 = Panel(eval_2.Angle)
panel_138 = Panel(gh_eval_2.A)

# ---- group: Perp Frame
number_slider_5 = Slider(87.281213, range=-1e-06..147.661445)
crv_22 = Curve(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)
gh_pframe = GHPerpFrame(C=crv_22, t=number_slider_5)  # -> out, F; inputs C: Curve, t: Double
# ---------- gh_pframe: C# ----------
    // Component written by @v-xup6.

    // Solve the perpendicular (zero-twisting) frame
    // at a specified curve parameter

    // Find parameter at start and end of curve
    // start and end needed to calculate zero-twist
    List<double> p = new List<double>();
    Point3d startPt = C.PointAtStart;
    Point3d endPt = C.PointAtEnd;
    double p0,p2;
    C.ClosestPoint(startPt, out p0);
    C.ClosestPoint(endPt, out p2);
    p.Add(p0);
    p.Add(p2);

    // Parameter has to be ascending and non-duplicate for
    // GetPerpendicularFrames, if t is at start or end of curve,
    // no need to add it in
    int i = 1;
    if((t != p0 || t != p2) && t > p0 && t < p2){
      p.Add(t);
      p.Sort();
    }
    else if(t == p0){
      // If at start of curve output first plane instead of second
      i = 0;
    }
    else if(t < p0 || t > p2){
      // Parameter outside of curve domain, give warning, end program
      this.Component.AddRuntimeMessage(
        GH_RuntimeMessageLevel.Warning,
        "Parameter outside of domain");
      return;
    }

    Plane[] pln = C.GetPerpendicularFrames(p);

    F = pln[i];
# ---------- end gh_pframe ----------
pframe = PerpFrame(Curve=crv_22, Parameter=number_slider_5)
panel_139 = Panel(pframe)
panel_140 = Panel(gh_pframe.F)

# ----
number_slider_6 = Slider(0, range=0..50)
non_planar_curve_6 = Geometry(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)
torsion = Torsion(Curve=non_planar_curve_6, Parameter=number_slider_6)  # -> Point, Torsion
c_script = CSharpScript(C=non_planar_curve_6, t=number_slider_6)  # -> out, P, T; inputs C: Curve, t: Double
# ---------- c_script: C# ----------
    this.Component.AddRuntimeMessage(GH_RuntimeMessageLevel.Warning, "Need to implement torsion calculation");

    P = C.PointAt(t);
# ---------- end c_script ----------
panel_141 = Panel(c_script.P)
panel_142 = Panel(c_script.T)
panel_143 = Panel(torsion.Point)
panel_144 = Panel(torsion.Torsion)

# ---- group: Self implemented method
gh_crvnear_2 = GHCurveNearestObject(C=crv_13, G=merge_2)  # -> out, A, B, I; inputs C: Curve, G: list of GeometryBase; disabled
# ---------- gh_crvnear_2: C# ----------
    // Component written by @v-xup6.

    // Find the nearest point on an object nearest to a curve
    // and the closest point on the curve to the object

    // Find parameter at start and end of curve
    double tStart, tEnd;
    Point3d startPt = C.PointAtStart;
    Point3d endPt = C.PointAtEnd;
    C.ClosestPoint(startPt, out tStart);
    C.ClosestPoint(endPt, out tEnd);

    // Int to store index of closest object
    // Double to store its distance
    // Point3d to store the closest point on object
    int iClosest = -1;
    double d0 = double.MaxValue;
    Point3d bClosestPoint = new Point3d();

    // Array to store closest curve parameter for each object
    double[] t = new double[G.Count];
    for(int i = 0;i < t.Length;i++){
      t[i] = double.MaxValue;
    }

    // Loop thru geometries
    for(int j = 0; j < G.Count; j++){
      // Ensure to search full range of curve at first iteration of each object
      double t0 = tStart;
      double t1 = tEnd;

      // Double to store shortest distance found for this geometry
      // Point3d to store the closest point on geometry to curve
      double gShortestDist = d0;
      Point3d bClosePt = new Point3d();

      // Continuously shrink search range until best result found
      while(true){
        // Find parameters in between search range
        int divCount = 140;
        double step = (t1 - t0) / divCount;
        List<double> parameters = new List<double>();
        for(int i = 0; i <= divCount; i++){
          parameters.Add(t0 + step * i);
        }

        // Double to store shortest distance for this iteration
        // and its curve parameter
        double iShortestDist = double.MaxValue;
        double iShortestParam = 0;

        // Loop to find closest point from parameter list of this search range
        for(int i = 0;i < parameters.Count;i++){
          Point3d point = C.PointAt(parameters[i]);
          // Point to store the closest point on geometry for this point in param list
          Point3d ptOnB = new Point3d();

          // Determine data type of geometry
          string type = G[j].GetType().Name;
          //Print(type); // Uncomment to debug data type

          // Switch case to deal with different data types differently
          switch(type){
            case "Point":
              // Cast to Point data type
              Point p = (Point) G[j];
              // Convert Point to Point3d
              double x = p.Location.X;
              double y = p.Location.Y;
              double z = p.Location.Z;
              // Store closest point on geometry
              ptOnB = new Point3d(x, y, z);
              break;

            case "Brep":
              // Cast to Brep data type
              Brep b = (Brep) G[j];
              // Store closest point on geometry
              ptOnB = b.ClosestPoint(point);
              break;

            case "NurbsCurve":
              // Cast to NurbsCurve
              NurbsCurve nCrv = (NurbsCurve) G[j];
              // Find parameter of closest point on geometry
              double nCrvParam;
              nCrv.ClosestPoint(point, out nCrvParam);
              // Store closest point on geometry
              ptOnB = nCrv.PointAt(nCrvParam);
              break;

            case "LineCurve":
              // Cast to LineCurve
              LineCurve lCrv = (LineCurve) G[j];
              // Find parameter of closest point on geometry
              double lCrvParam;
              lCrv.ClosestPoint(point, out lCrvParam);
              // Store closest point on geometry
              ptOnB = lCrv.PointAt(lCrvParam);
              break;

            case "PolylineCurve":
              // Cast to PolylineCurve
              PolylineCurve pCrv = (PolylineCurve) G[j];
              // Find parameter of closest point on geometry
              double pCrvParam;
              pCrv.ClosestPoint(point, out pCrvParam);
              // Store closest point on geometry
              ptOnB = pCrv.PointAt(pCrvParam);
              break;

            case "ArcCurve":
              // Cast to ArcCurve
              ArcCurve aCrv = (ArcCurve) G[j];
              // Find parameter of closest point on geometry
              double aCrvParam;
              aCrv.ClosestPoint(point, out aCrvParam);
              // Store closest point on geometry
              ptOnB = aCrv.PointAt(aCrvParam);
              break;

            default:
              // Give warning if geometry not implemented
              // Can be deleted if 100% all geometry covered
              // Mesh not implemented in vanilla GH
              this.Component.AddRuntimeMessage(
                GH_RuntimeMessageLevel.Warning,
                "Sorry geometry not supported, needs to be implemented");
              Print("Not supported object, distance to origin");
              break;
          }

          // Find distance of closest point on geometry to point in parameter list
          double ptDist = iShortestDist;
          ptDist = ptOnB.DistanceTo(point);

          // If distance to geometry is shorter at this point in parameter list
          // set/shrink search range for next parameter list iteration
          if(ptDist < iShortestDist){
            // Update shortest distance, its param and point location on geometry
            iShortestDist = ptDist;
            gShortestDist = ptDist;
            iShortestParam = parameters[i];
            bClosePt = ptOnB;

            if(i == 0){
              // If currently on first point in param list and closest
              // next search range is between this point to next point in param list
              t0 = parameters[i];
              t1 = parameters[i + 1];
            }
            else if(i == parameters.Count - 1){
              // If currently on last point in param list and closest
              // next search range is between last point and this point in param list
              t0 = parameters[i - 1];
              t1 = parameters[i];
            }
            else{
              // If currently not at ends of search range
              // next search range is between last point and next point in param list
              t0 = parameters[i - 1];
              t1 = parameters[i + 1];
            }
          }
        }

        // If found closest curve parameter is not the same as stored for iterations
        if(t[j] != iShortestParam){
          // Update the stored closest curve parameter for iterations to current value
          t[j] = iShortestParam;

          // If current closest distance is chorter than previously tested geometries
          if(gShortestDist < d0){
            // Update overall shortest distance, its geometry list index
            // and the point on the geometry
            d0 = gShortestDist;
            iClosest = j;
            bClosestPoint = bClosePt;
          }
        }
        else{
          // If closestest curve parameter for this iterations is same as previous
          // no need to do any more iterations, best result already found
          break;
        }
      }
    }

    // Output
    A = C.PointAt(t[iClosest]);
    B = bClosestPoint;
    I = iClosest;
# ---------- end gh_crvnear_2 ----------
panel_145 = Panel(gh_crvnear_2.B)
panel_146 = Panel(gh_crvnear_2.A)
panel_147 = Panel(gh_crvnear_2.I)
