# Grasshopper definition Curve_Spline.ghx (Grasshopper 1.0.7)

# ---- group: Nurbs Curve
toggle = BooleanToggle(True)
pt = Point([Point(-23.73101456, 20.19434579, 0), Point(-24.43059041, 7.382133632, 0), Point(-23.21463355, -4.035099513, 0), Point(-16.68371546, -9.839233117, 0), Point(-5.525365682, -11.17519216, 0), Point(-9.587424958, 1.548416205, 0)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])
number_slider = Slider(3, range=1..3)
gh_nurbs = CSharpScript(V=pt, D=number_slider, P=toggle)  # -> out, C, L, Dout; inputs V: list of Point3d, D: Int32, P: Boolean
# ---------- gh_nurbs: C# ----------
    //Component written by @range-et

    // Create the variables to be used
    // The output nurbs curve
    NurbsCurve curve;

    // Create the nurbs curve
    // P if periodic
    // D - the dergree
    // V the list of vertices
    curve = NurbsCurve.Create(P, D, V);

    // Output the curve
    C = curve;
    // Output the curve length
    L = curve.GetLength();
    // Output the curve domain
    Dout = curve.Domain;
# ---------- end gh_nurbs ----------
nurbs = NurbsCurve(Vertices=pt, Degree=number_slider, Periodic=toggle)  # -> Curve, Length, Domain
panel = Panel(nurbs.Curve)
panel_2 = Panel(gh_nurbs.C)
panel_3 = Panel(nurbs.Length)
panel_4 = Panel(gh_nurbs.L)
panel_5 = Panel(nurbs.Domain)
panel_6 = Panel(gh_nurbs.Dout)

# ---- group: Polyline
toggle_2 = BooleanToggle(True)
pt_2 = Point([Point(-23.73101456, 20.19434579, 0), Point(-24.43059041, 7.382133632, 0), Point(-23.21463355, -4.035099513, 0), Point(-16.68371546, -9.839233117, 0), Point(-5.525365682, -11.17519216, 0), Point(-9.587424958, 1.548416205, 0)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])
gh_pline = CSharpScript(V=pt_2, C=toggle_2)  # -> out, Pl; inputs V: list of Point3d, C: Boolean
# ---------- gh_pline: C# ----------
    //Component written by @range-et
    // Create the variables to be used
    // The output nurbs curve

    NurbsCurve polyline;

    // A polyline is just a nurbs curve of degree 1
    // C = Closed or not
    // 1 is the degree, which is 1
    // V - the vertices
    polyline = NurbsCurve.Create(C, 1, V);

    // Output the polyline
    Pl = polyline;
# ---------- end gh_pline ----------
pline = PolyLine(Vertices=pt_2, Closed=toggle_2)
panel_7 = Panel(pline)
panel_8 = Panel(gh_pline.Pl)

# ---- group: Curve on Surface
toggle_3 = BooleanToggle(True)
panel_9 = Panel("""{0.5,0.5,0}
{0.25,0.25,0}
{0.75,0.75,0}
{0.75,0.25,0}""")
srf = Surface(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)
gh_crvsrf = CSharpScript(S=srf, uv=panel_9, C=toggle_3)  # -> out, Cout, L, D; inputs S: Surface, uv: list of Point3d, C: Boolean
# ---------- gh_crvsrf: C# usings ----------
using System.IO;
using System.Linq;
using System.Data;
using System.Drawing;
using System.Reflection;
using System.Windows.Forms;
using System.Xml;
using System.Xml.Linq;
using System.Runtime.InteropServices;

using Rhino.DocObjects;
using Rhino.Collections;
using GH_IO;
using GH_IO.Serialization;
# ---------- gh_crvsrf: C# ----------
    // Component written by @range-et

    // TODO: Match result with original
    Component.AddRuntimeMessage(GH_RuntimeMessageLevel.Warning, "Output doesn't match original exactly");
    
    // Create all the points that would be used
    // The list stores all the points that need to
    // be interpolated through
    List<Point3d> SurfacePoints = new List<Point3d>();
    // stores the curve
    Curve curve;
    // the curve knot style
    CurveKnotStyle CKS;

    // Loop through the points and create them on the given surface
    foreach (Point3d point in uv)
    {
      // Create the point
      Point3d UVpoint = S.PointAt(point.X, point.Y);
      // Add the point
      SurfacePoints.Add(UVpoint);
    }

    // filter based on if the end curve is Closed
    if (C)
    {
      // the curve knot style
      CKS = CurveKnotStyle.ChordPeriodic;
      // Add the first point again, becaue this is a closed curve
      SurfacePoints.Add(SurfacePoints[0]);
      // Create the curve
      curve = Curve.CreateInterpolatedCurve(SurfacePoints, 3, CKS);
      // Output the curve
      Cout = curve;
      // Output the length
      L = curve.GetLength();
      // Output the Domain
      D = curve.Domain;
    }
      // filter based on if the end curve is open
    else
    {
      // the curve knot style
      CKS = CurveKnotStyle.Chord;
      // No need to add the extra point
      // Because this is an open curve
      curve = Curve.CreateInterpolatedCurve(SurfacePoints, 3, CKS);
      // Output the curve
      Cout = curve;
      // Output the length
      L = curve.GetLength();
      // Output the Domain
      D = curve.Domain;
    }
# ---------- end gh_crvsrf ----------
crvsrf = CurveOnSurface(Surface=srf, UVCoordinates=panel_9, Closed=toggle_3)  # -> Curve, Length, Domain
panel_10 = Panel(crvsrf.Curve)
panel_11 = Panel(gh_crvsrf.Cout)
panel_12 = Panel(crvsrf.Length)
panel_13 = Panel(gh_crvsrf.L)
panel_14 = Panel(crvsrf.Domain)
panel_15 = Panel(gh_crvsrf.D)

# ---- group: Interpolate (t)
pt_3 = Point([Point(-13.9177749, 6.747626161, 0), Point(-12.02784808, 3.121464247, 0), Point(-3.369718223, -1.631992011, 0), Point(-6.062575811, 6.397863685, 0), Point(-7.07606085, 9.620053092, 0), Point(-3.261529577, 12.28441769, 0)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])
vec = Vector(Vector(0, -5.559879474, 0))
vec_2 = Vector(Vector(-5.747075069, 0, 0))
number_slider_2 = Slider(0, range=0..2)
gh_intcrv_t = CSharpScript(V=pt_3, Ts=vec, Te=vec_2, K=number_slider_2)  # -> out, C, L, D; inputs V: list of Point3d, Ts: Vector3d, Te: Vector3d, K: Int32
# ---------- gh_intcrv_t: C# ----------
    //Component written by @range-et

    // Create a new variable for the curve
    Curve curve;
    // Cast the integer to the enumu and get the knot style
    CurveKnotStyle CKS = (CurveKnotStyle) K;

    // interpolate through the points and then create
    // a curve. The variables here are:
    // V - the vertices
    // 3 - the curve degree
    // CKS - the curve knot style
    // Ts - Tangent Start
    // Te - Tangent End
    curve = Curve.CreateInterpolatedCurve(V, 3, CKS, Ts, -Te);
    // Output the curve
    C = curve;
    // Output the length
    L = curve.GetLength();
    // Output the domain
    D = curve.Domain;
# ---------- end gh_intcrv_t ----------
intcrv_t = InterpolateT(Vertices=pt_3, TangentStart=vec, TangentEnd=vec_2, KnotStyle=number_slider_2)  # -> Curve, Length, Domain
panel_16 = Panel(intcrv_t.Curve)
panel_17 = Panel(gh_intcrv_t.C)
panel_18 = Panel(intcrv_t.Length)
panel_19 = Panel(gh_intcrv_t.L)
panel_20 = Panel(intcrv_t.Domain)
panel_21 = Panel(gh_intcrv_t.D)

# ---- group: Iso Curve
srf_2 = Surface(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)
panel_22 = Panel("""{0.5,0.5,0}
{0.25,0.25,0}
{0.75,0.75,0}
{0.75,0.25,0}""")
gh_iso = CSharpScript(S=srf_2, uv=panel_22)  # -> out, U, V; inputs S: Surface, uv: Point3d
# ---------- gh_iso: C# usings ----------
using System.IO;
using System.Linq;
using System.Data;
using System.Drawing;
using System.Reflection;
using System.Windows.Forms;
using System.Xml;
using System.Xml.Linq;
using System.Runtime.InteropServices;
using Rhino.DocObjects;
using Rhino.Collections;
using GH_IO;
using GH_IO.Serialization;
# ---------- gh_iso: C# ----------
    //Component written by @range-et

    // the uv values are input as points
    // this allows us to get the X-U and Y-V values of the point
    // its just a convenient data structure

    // Extract and use the U and V values
    // get the U and V line values and output them
    U = S.IsoCurve(0, uv.Y);
    V = S.IsoCurve(1, uv.X);
# ---------- end gh_iso ----------
iso = IsoCurve(Surface=srf_2, UVPoint=panel_22)  # -> UIsocurve, VIsocurve
panel_23 = Panel(iso.UIsocurve)
panel_24 = Panel(gh_iso.U)
panel_25 = Panel(iso.VIsocurve)
panel_26 = Panel(gh_iso.V)

# ---- group: Tween Curve
crv = Curve(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)
crv_2 = Curve(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)
number_slider_3 = Slider(0.474, range=0..1)
gh_tweencrv = CSharpScript(A=crv, B=crv_2, F=number_slider_3)  # -> out, T; inputs A: Curve, B: Curve, F: Double
# ---------- gh_tweencrv: C# ----------
    //Component written by @range-et

    // Create all the variables that we need
    Curve curve;
    double ratio = F;
    // this value controlls how many divisions  are made to
    // the original curve which shall be used for sampling and
    // interpolating the final curve
    int DivValue = 20;

    // the domains need to be the same otherwise we dont
    // get the same number of divisions
    var Adom = B.Domain;

    // creates a list where all the final interpolation points
    // are stored
    List<Point3d> FinalControlPoints = new List<Point3d>();

    //Divide the curves for sampling
    var CurveAControlPoints = A.DivideByCount(DivValue, true);
    var CurveBControlPoints = B.DivideByCount(DivValue, true);

    //Loop through both the lists and then get a point which is
    //a certain factor between the two points
    // the index we loop through is added by 1 becuase the end
    // points are included in the loop calculation
    for (int i = 0; i < DivValue + 1; i++)
    {
      //Select the point from the list
      Point3d PointA = A.PointAt(CurveAControlPoints[i]);
      Point3d PointB = B.PointAt(CurveAControlPoints[i]);
      //get the final point and add it to the list
      Point3d finalPoint = SubPoint(PointA, PointB, ratio);
      FinalControlPoints.Add(finalPoint);
    }
    //interpolate through and create the final curve
    curve = Curve.CreateInterpolatedCurve(FinalControlPoints, 3, CurveKnotStyle.Chord);
    //Output the final curve
    T = curve;
# ---------- gh_tweencrv: C# additional code ----------
  // this function takes in two points and then returns a point
  // this point is a certain ratio between the two points
  public Point3d SubPoint(Point3d Apt, Point3d Bpt, double ratio)
  {
    return new Point3d(ratio * (Bpt.X - Apt.X) + Apt.X,
      ratio * (Bpt.Y - Apt.Y) + Apt.Y,
      ratio * (Bpt.Z - Apt.Z) + Apt.Z);
  }
# ---------- end gh_tweencrv ----------
tweencrv = TweenCurve(CurveA=crv, CurveB=crv_2, Factor=number_slider_3, BlendType=0)
panel_27 = Panel(tweencrv)
panel_28 = Panel(gh_tweencrv.T)

# ---- group: Blend Curve
crv_3 = Curve(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)
crv_4 = Curve(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)
number_slider_4 = Slider(0.874, range=0..1)
number_slider_5 = Slider(0.681, range=0..1)
number_slider_6 = Slider(2, range=0..2)
gh_blendc = CSharpScript(A=crv_3, B=crv_4, Fa=number_slider_4, Fb=number_slider_5, C=number_slider_6)  # -> out, Bout; inputs A: Curve, B: Curve, Fa: Double, Fb: Double, C: Int32
# ---------- gh_blendc: C# ----------
    //Component written by @range-et

    //Initialize the varialbe that we will be using
    Curve curve;

    //Create the curve
    // Variables are
    // A and B are the input curves
    // (BlendContinuity) C is the type of continuity from the
    // enum BlendContinuity found here:
    // https://developer.rhino3d.com/api/RhinoCommon/html/T_Rhino_Geometry_BlendContinuity.htm
    // Here we are casting
    // Fa - Factor of blending from Curve A
    // Fb - Factor of blending from Curve B
    curve = Curve.CreateBlendCurve(A, B, (BlendContinuity) C, Fa, Fb);
    // Output the curve
    Bout = curve;
# ---------- end gh_blendc ----------
blendc = BlendCurve(CurveA=crv_3, CurveB=crv_4, BulgeA=number_slider_4, BulgeB=number_slider_5, Continuity=number_slider_6)
panel_29 = Panel(blendc)
panel_30 = Panel(gh_blendc.Bout)

# ----
pt_4 = Point(Point(-10.27045767, -19.72148118, 0))  # disabled
pt_5 = Point(Point(9.441553927, 7.70561889, 0))  # disabled
num = Number(67.55173482)  # disabled
panel_31 = Panel("{1,2,3}")  # disabled

# ---- group: Pts
panel_32 = Panel("""{0,0,0}
{5,5,0}
{10,-5,0}
{15,15,0}""")
pt_6 = Point(panel_32)
lng = ListLength(List=pt_6)

# ---- group: Bezier Span
bt = Vector(Vector(-1.464178903, -8.2664496, 0))
# GH#: A C# dictionary of Grasshopper3D components.
# 
# This file contains a category of Grasshopper components, and a mirroring C#/RhinoCommon implementation.
# 
# This is an educational project initiated by students/faculty of GSD-6338: Introduction to Computational Design, at the Harvard Graduate School of Design.
# 
# More information: {{project link}}
# Curve Spline
A = Point(Point(6.725376233, -5.050564099, 0))
at = Vector(Vector(2.745571227, 10.35384878, 0))
B = Point(Point(-12.58123983, 3.715637046, 0))
gh_bzspan = CSharpScript(A=A, At=at, B=B, Bt=bt)  # -> out, C, L, D; inputs A: Point3d, At: Vector3d, B: Point3d, Bt: Vector3d
# ---------- gh_bzspan: C# ----------
    //    Curve curve;
    //    BezierCurve BCurve;
    //    List<Point3d> points = new List<Point3d>();
    //
    //    points.Add(A);
    //    points.Add(B);
    //
    //    curve = Curve.CreateInterpolatedCurve(points, 3, CurveKnotStyle.Chord, At, -Bt);
    //    BCurve = BezierCurve.CreateBeziers(curve);
    //
    //    C = BCurve;
    //    L = BCurve.GetLength();
    //    D = BCurve.Domain;
    
    // Component written by @sonomirco & @garciadelcastillo
    
    // This component reates a Bézier curve from two points and the tangents at that point.
    
    // Rhino can only create Bézier curves from a list of control points. 
    // The four control points are the A and B inputs, plus these points 
    // translated by their tangents (sequentially sorted):
    Point3d first = A;
    Point3d  second = A + At;
    Point3d  third = B + Bt;
    Point3d  fourth = B;
    List<Point3d> controlPoints = new List<Point3d>() { first, second, third, fourth };
    BezierCurve bezier = new BezierCurve(controlPoints);
    
    // The BezierCurve Class in RhinoCommon doesn't inherit from Curve, 
    // so we need to convert it to a NurbsCurve in order to access length/domain
    // properties:
    Curve crv = bezier.ToNurbsCurve();
    
    // Outpus
    C = crv;
    L = crv.GetLength();
    D = crv.Domain;
# ---------- end gh_bzspan ----------
bzspan = BezierSpan(StartPoint=A, StartTangent=at, EndPoint=B, EndTangent=bt)  # -> Curve, Length, Domain
panel_33 = Panel(bzspan.Curve)
panel_34 = Panel(gh_bzspan.C)
panel_35 = Panel(bzspan.Length)
panel_36 = Panel(gh_bzspan.L)
panel_37 = Panel(bzspan.Domain)
panel_38 = Panel(gh_bzspan.D)

# ----
vec_3 = Vector(panel_31)  # disabled

# ---- group: Knots
toggle_4 = BooleanToggle(False)
number_slider_7 = Slider(2, range=-1..13)
gh_knots = CSharpScript(N=lng, D=number_slider_7, P=toggle_4)  # -> K; inputs N: Int32, D: Int32, P: Boolean
# ---------- gh_knots: C# ----------
    // Component written by @sonomirco

    // The component constructs a nurbs curve knot vector.

    // Checks if the number of points are less than 2.
    int copyDegree = D;
    if(N < 2)
    {
      this.Component.AddRuntimeMessage(GH_RuntimeMessageLevel.Error, "Cannot compute knot vector for less than 2 points.");
    }
    else
    {
      // Serios of checking to convalidate the inputs.
      if(D <= 0)
      {
        this.Component.AddRuntimeMessage(GH_RuntimeMessageLevel.Warning, "Degrees cannot be lower than 1.");
        copyDegree = 1;
      }
      if(D > 11)
      {
        this.Component.AddRuntimeMessage(GH_RuntimeMessageLevel.Warning, "Degrees cannot be higher than 11.");
        copyDegree = 11;
      }
      if(D > N - 1)
      {
        this.Component.AddRuntimeMessage(GH_RuntimeMessageLevel.Warning, "Degrees cannot be higher than [PointCount - 1].");
        copyDegree = N - 1;
      }

      // We create a collection which will be the house of our knots.
      int[] knots = new int[D + N - 1];

      // If the periodic input is true we enter in this loop.
      if(P)
      {
        for (int i = 0; i < knots.Length; i++)
        {
          knots[i] = i;
        }
      }

      else
      {
        int controlledValue = 0;
        for (int i = 0; i < knots.Length; i++)
        {
          knots[i] = controlledValue;
          if(i > D - 2 && i < knots.Length - D) controlledValue++;
        }
      }
      // Output result.
      K = knots;
    }
# ---------- end gh_knots ----------
knots = KnotVector(Count=lng, Degree=number_slider_7, Periodic=toggle_4)
panel_39 = Panel(knots)
panel_40 = Panel(gh_knots)

# ----
cat = Catenary(PointA=pt_4, PointB=pt_5, Length=num, Gravity=vec_3)  # disabled

# ---- group: Weigths
repeat = RepeatData(Data="1.0", Length=lng)

# ---- group: Interpolate
toggle_5 = BooleanToggle(True)
pt_7 = Point([Point(-39.32548302, 59.4358134, 0), Point(-39.62553495, 49.93214518, 0), Point(-46.90519782, 34.85517631, 0), Point(-68.07628774, 29.69868843, 0), Point(-41.02310037, -14.12191058, 0), Point(-28.13510983, 1.693105572, 0)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])
number_slider_8 = Slider(3, range=0..10)
number_slider_9 = Slider(1, range=0..2)
gh_intcrv = CSharpScript(V=pt_7, D=number_slider_8, P=toggle_5, K=number_slider_9)  # -> out, C, L, Dout; inputs V: list of Point3d, D: Int32, P: Boolean, K: Int32
# ---------- gh_intcrv: C# ----------
    // Component written by @range-et & garciadelcastillo

    // Compute the numerical value of knot style based on periodicity
    int knotStyle = K;
    if (P) {
      // Here where we modify the Knot style by shifting it
      // since this is a closed curve and has to be periodic
      // Knot styles can be looked up at:
      // https://developer.rhino3d.com/api/RhinoCommon/html/T_Rhino_Geometry_Curve.htm
      knotStyle = K + 3;

      // If periodic, duplicate the first point at the end of the curve
      V.Add(V[0]);
    }

    // Figure out knot style based on input K
    CurveKnotStyle CKS = (CurveKnotStyle) knotStyle;

    // Create the interpolated curve
    // V - the vertices
    // D - the degree
    // CKS - the set knot style
    Curve curve = Curve.CreateInterpolatedCurve(V, D, CKS);

    // Outputs
    C = curve;
    // Output the length
    L = curve.GetLength();
    // Output the curve's domain
    Dout = curve.Domain;
# ---------- end gh_intcrv ----------
intcrv = Interpolate(Vertices=pt_7, Degree=number_slider_8, Periodic=toggle_5, KnotStyle=number_slider_9)  # -> Curve, Length, Domain
panel_41 = Panel(intcrv.Curve)
panel_42 = Panel(gh_intcrv.C)
panel_43 = Panel(intcrv.Length)
panel_44 = Panel(gh_intcrv.L)
panel_45 = Panel(intcrv.Domain)
panel_46 = Panel(gh_intcrv.Dout)

# ---- group: Connect Curves
toggle_6 = BooleanToggle(True)
crv_5 = Curve([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])
number_slider_10 = Slider(2, range=0..2)
number_slider_11 = Slider(1, range=0..1)
gh_connect = CSharpScript(C=crv_5, G=number_slider_10, L=toggle_6, B=number_slider_11)  # -> out, Cout; inputs C: list of Curve, G: Int32, L: Boolean, B: Double
# ---------- gh_connect: C# ----------
    //Component written by @range-et

    // Initialize the list that will contain all the curves
    List<Curve> OutputCurve = new List<Curve>();

    for (int i = 0; i < C.Count - 1; i++)
    {
      // this is the curve that is the connection
      Curve connection;
      // this is the first curve
      Curve curve1 = C[i];
      // this is the second curve
      Curve curve2 = C[i + 1];

      // Create the connection
      // variables here are:
      // curve1 & curve2
      // The blend continuity type
      // The two blend factors
      connection = Curve.CreateBlendCurve(curve1,
        curve2, (BlendContinuity) G, B, B);
      //add the first curve to the list
      OutputCurve.Add(curve1);
      //add the connection curve
      // we dont add the last curve because when we
      // process the next set of curves, we would duplicate
      // the curves. i.e. the second curve of the first set
      // and the first curve of the second set
      OutputCurve.Add(connection);
    }
    // lastly we add the second curve of the last set back
    OutputCurve.Add(C[C.Count - 1]);

    // incase the output is a closed curve, we've got to add the
    // the last connection back into the list to process out a closed curve
    if(L)
    {
      Curve curveLast = C[C.Count - 1]; // the last curve
      // get the first curve
      // we pick them in this order because of the direction of the
      // curve which dictates the direction of the connection
      Curve curveFirst = C[0]; // the first curve
      Curve connectionClosed = Curve.CreateBlendCurve(curveLast,
        curveFirst, (BlendContinuity) G, B, B);
      // add that curve back into the list of connection curves
      // and the connected curves
      OutputCurve.Add(connectionClosed);
    }
    // Join the curves and output that curve
    Cout = Curve.JoinCurves(OutputCurve);
# ---------- end gh_connect ----------
connect = ConnectCurves(Curves=crv_5, Continuity=number_slider_10, Close=toggle_6, Bulge=number_slider_11)
panel_47 = Panel(gh_connect.Cout)
panel_48 = Panel(connect)

# ---- group: Geodesic
srf_3 = Surface(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)
pt_8 = Point(Point(-15.70287516, -5.95740112, 0))
pt_9 = Point(Point(19.36843496, 9.377548154, 0))
gh_geodesic = CSharpScript(Su=srf_3, St=pt_8, E=pt_9)  # -> out, G; inputs Su: Surface, St: Point3d, E: Point3d
# ---------- gh_geodesic: C# ----------
    //Component written by @range-et

    //initialize all the variables that we will be using
    //The starting points U value
    double StartU;
    //The starting points V value
    double StartV;
    //The end points U value
    double EndU;
    //The end points U value
    double EndV;
    //The tolerance of finding out the geodesic
    double Tolerance = 0;
    //The curve which shall be the output
    Curve geodesic;

    //Figure out the closest point on the surface
    // These values are then used to calculate the surface points
    Su.ClosestPoint(St, out StartU, out StartV);
    Su.ClosestPoint(E, out EndU, out EndV);

    // The new points used to be used to calculate the geodisc
    Point2d StartSurfPoint = new Point2d(StartU, StartV);
    Point2d EndSurfPoint = new Point2d(EndU, EndV);

    //calculate and output the geodisc
    geodesic = Su.ShortPath(StartSurfPoint, EndSurfPoint, Tolerance);
    G = geodesic;
# ---------- end gh_geodesic ----------
geodesic = Geodesic(Surface=srf_3, Start=pt_8, End=pt_9)
panel_49 = Panel(geodesic)
panel_50 = Panel(gh_geodesic.G)

# ---- group: Sub Curve
crv_6 = Curve(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)
dom = ConstructDomain(DomainStart=Slider(0.25, range=0..1), DomainEnd=Slider(0.683, range=0..1))
gh_subcurve = CSharpScript(C=crv_6, D=dom)  # -> out, curve; inputs C: Curve
# ---------- gh_subcurve: C# ----------
    //Component written by @range-et
    
    // use the curve trim command and pass
    // in the sub-domain to be trimmed
    curve = C.Trim(D);
# ---------- end gh_subcurve ----------
subcrv = SubCurve(BaseCurve=crv_6, Domain=dom)
panel_51 = Panel(gh_subcurve.curve)
panel_52 = Panel(subcrv)

# ---- group: NurbCrv
nurbcrv = NurbsCurvePWK(Points=pt_6, Weights=repeat, Knots=panel_40)  # -> Curve, Length, Domain
gh_nurbcrv = CSharpScript(P=pt_6, W=repeat, K=panel_40)  # -> C, L, D; inputs P: list of Point3d, W: list of Double, K: list of Double
# ---------- gh_nurbcrv: C# ----------
    // Component written by @sonomirco

    // The component creates a nurbs curve based on number of points, weights and knot vector.

    // Some checks before to compute the nurbs curve.
    // The nurbs curve to be create has some specific requiremente like: number of points, number of points and weights, and number of points and knots.
    List<double> copyWeights = new  List<double>(W);
    if(P.Count < 2)
    {
      this.Component.AddRuntimeMessage(GH_RuntimeMessageLevel.Error, "Insufficient points for a nurbs curve.");
    }

    // Some checkings on the weights.
    if(copyWeights.Count == 0)
    {
      for (int i = 0; i < P.Count; i++)
      {
        copyWeights.Add(1.0);
      }
    }

    if(P.Count != copyWeights.Count)
    {
      this.Component.AddRuntimeMessage(GH_RuntimeMessageLevel.Error, "You must supply equal numbers of weights and points.");
    }

    // Checks degree
    int degree = K.Count - P.Count + 1;
    if(degree <= 0 || degree > 11)
    {
      this.Component.AddRuntimeMessage(GH_RuntimeMessageLevel.Error, "This curve does not have a valid degree.");
    }

    // We create a nurbs curve based on the degree and the point.
    NurbsCurve nurbsCurve = NurbsCurve.Create(false, degree, P);

    // Checking if the nurbs is created if it is null the curve is not valid.
    if(nurbsCurve == null)
    {
      this.Component.AddRuntimeMessage(GH_RuntimeMessageLevel.Error, "Nurbs curve is not valid.");
    }

    // If the curve is created, we added update the control points and the knots.
    // The control points are the points multiply for the weights.
    for (int i = 0; i < nurbsCurve.Points.Count; i++)
    {
      nurbsCurve.Points[i] = new ControlPoint(P[i], copyWeights[i]);
    }
    for (int i = 0; i < K.Count; i++)
    {
      nurbsCurve.Knots[i] = K[i];
    }

    // After the changes we check the nurbs again.
    if(!nurbsCurve.IsValid)
    {
      this.Component.AddRuntimeMessage(GH_RuntimeMessageLevel.Error, "Nurbs curve is not valid.");
    }

    // Output results.
    C = nurbsCurve;
    L = nurbsCurve.GetLength();
    D = nurbsCurve.Domain;
# ---------- end gh_nurbcrv ----------
panel_53 = Panel(nurbcrv.Curve)
panel_54 = Panel(nurbcrv.Length)
panel_55 = Panel(nurbcrv.Domain)
panel_56 = Panel(gh_nurbcrv.L)
panel_57 = Panel(gh_nurbcrv.C)
panel_58 = Panel(gh_nurbcrv.D)

# ----
parc = PolyArc(Closed=False)
kinkcrv = KinkyCurve(Degree=3, Angle=0.1745329252)  # -> Curve, Length, Domain
tancurve = TangentCurve(Blend=0.5, Degree=3)  # -> Curve, Length, Domain
blendcpt = BlendCurvePt(Continuity=2)
