# Grasshopper definition Surface_Analysis.ghx (Grasshopper 1.0.7)

# ---- group: {Point in Trim
brep = Brep(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)
brep_2 = Brep(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)
panel = Panel("""{0.5, 0.5, 0}
{1, 1, 0}
{1, 10, 0}
{-8.5, 10, 0}""")
gh_triminc = CSharpScript(S=brep, P=panel)  # -> out, I; inputs S: Brep, P: Point3d
# ---------- gh_triminc: C# ----------
    // Component written by @garciadelcastillo

    // This component checks if the UV coordinates
    // represented by the input point are contained
    // inside the trimmed area of the surface.

    // Input S is a Brep because we need the trimming information
    // which is removed from Surface objects. We obtain such
    // information from the BrepFace contained in it
    // (a BrepFace is like a Surface with trimming info).
    BrepFace face = S.Faces[0];

    // Test for inclusion
    PointFaceRelation relation = face.IsPointOnFace(P.X, P.Y);
    bool inside = relation == PointFaceRelation.Interior;

    // Outputs
    I = inside;
# ---------- end gh_triminc ----------
triminc = PointInTrim(Surface=brep, UVPoint=panel)
panel_2 = Panel(triminc)
panel_3 = Panel(gh_triminc.I)

# ---- group: Area / error testing
pt = Point(Point(-0.614617653, 1.396960664, 0))
crv = Curve(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)
crv_2 = Curve(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)

# ---- group: Point in Brep / test points
pt_2 = Point(Point(-0.4506977088, -1.374628012, 3.911992067))
pt_3 = Point(Point(2.216256994, 2.247253595, 2.777777632))
pt_4 = Point(Point(0, 0, 3.911992067))

# ---- group: Volume / error testing
pt_5 = Point(Point(-0.614617653, 1.396960664, 0))
geo = Geometry(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)

# ---- group: Brep Topology
box = CenterBox(Base=PlaneXY(0, 0, 0), X=Slider(7, range=0..10), Y=Slider(3, range=0..10), Z=Slider(3, range=0..10))
brep_3 = Brep(box)
topology = BrepTopology(Brep=brep_3, PerspectiveOnly=False)  # -> FaceFaceAdjacency, FaceEdgeAdjacency, EdgeFaceAdjacency
gh_topology = CSharpScript(B=brep_3)  # -> out, FF, FE, EF; inputs B: tree of Brep
# ---------- gh_topology: C# ----------
    // This component is created by @mirahx24

    // In order to access Brep Topology, we need to use a new type of data storage class: DataTree
    // DataTree contains information about each node and its connected "branches"
    // For more information about DataTree, visit
    // https://developer.rhino3d.com/api/grasshopper/html/T_Grasshopper_DataTree_1.htm

    // Create DataTrees to storage Brep Data
    DataTree<int> fFaceIndices = new DataTree<int>(); // DataTree of face indices connected to each face
    DataTree<int> fEdgeIndices = new DataTree<int>(); // DataTree of edge indices connected to each face
    DataTree<int> eFaceIndices = new DataTree<int>(); // DataTree of face indices connected to each edge

    // Iterate through each "branch" of the original DataTree<Brep>
    for (int j = 0; j < B.BranchCount; j++) {
      // Create a List of Brep for each branch
      // Create a path to remember the current path for later access
      List<Brep> brepsList = B.Branches[j];
      GH_Path currentPath = B.Paths[j];

      // Iterate through each brep in current brepsList
      for (int i = 0; i < brepsList.Count; i++) {
        Brep brep = brepsList[i];

        // Iterate through each face in current Brep
        for (int k = 0; k < brep.Faces.Count; k++) {
          // Create a path to "copy" to the fFaceIndices and fEdgeIndice DataTrees
          GH_Path targetPath = currentPath.AppendElement(k);

          // Get an array of adjcent faces and edges of current face
          int[] adjacentFaces = brep.Faces[k].AdjacentFaces();
          int[] adjacentEdges = brep.Faces[k].AdjacentEdges();

          // Add the faces and edges to the corresponding DataTrees, with the path information
          fFaceIndices.AddRange(adjacentFaces, targetPath);
          fEdgeIndices.AddRange(adjacentEdges, targetPath);
        }

        // Iterate through each edge in current Brep
        for (int n = 0;n < brep.Edges.Count; n++) {
          // Create a path to "copy" to the eFaceIndices DataTrees
          GH_Path edgePath = currentPath.AppendElement(n);

          // Get an array of adjcent faces of current edge
          int[] adjacentEdgeFaces = brep.Edges[n].AdjacentFaces();
          // Add the faces to the eFaceIndices DataTree, with the path information
          eFaceIndices.AddRange(adjacentEdgeFaces, edgePath);
        }
      }
    }

    // Output
    FF = fFaceIndices;
    FE = fEdgeIndices;
    EF = eFaceIndices;
# ---------- end gh_topology ----------
panel_4 = Panel(topology.FaceFaceAdjacency)
panel_5 = Panel(gh_topology.FF)
panel_6 = Panel(topology.FaceEdgeAdjacency)
panel_7 = Panel(gh_topology.FE)
panel_8 = Panel(topology.EdgeFaceAdjacency)
panel_9 = Panel(gh_topology.EF)

# ---- group: Is Planar
brep_4 = Brep(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)
brep_5 = Brep(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)
brep_6 = Brep(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)
toggle = BooleanToggle(False)
gh_planar = CSharpScript(S=brep_5, I=toggle)  # -> out, F, P; inputs S: Surface, I: Boolean
# ---------- gh_planar: C# ----------
    // Component written by @garciadelcastillo

    // This component tries to identify if a Surface is planar,
    // optionally taking into consideration trimming information.

    // TODO: approximate behavior to original, including trim checks
    // and default plane outputs (from bounding box calculations?)
    Component.AddRuntimeMessage(GH_RuntimeMessageLevel.Warning, "Only basic planarity check implemented");

    // Pre-allocate the information we want from the planarity check.
    bool success = false;
    Plane surfacePlane = Plane.Unset;

    if (I == true)
    {
      Component.AddRuntimeMessage(GH_RuntimeMessageLevel.Error, "Functionality not implemented");
    }
    else
    {
      // Try checking for planarity
      success = S.TryGetPlane(out surfacePlane);
    }



    // Outputs
    F = success;
    P = surfacePlane;
# ---------- end gh_planar ----------
planar = IsPlanar(Surface=brep_5, Interior=toggle)  # -> Planar, Plane
panel_10 = Panel(gh_planar.F)
panel_11 = Panel(gh_planar.P)
panel_12 = Panel(planar.Planar)
panel_13 = Panel(planar.Plane)

# ---- group: Shape in Brep
brep_7 = Brep(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)
pt_6 = Point([Point(0.5, 0.5, 0), Point(1, 1, 0), Point(1, 0, 0), Point(1, 10, 0), Point(-8.5, 10, 0)])
line = Line([Line((-0.1516055781, -0.7551137275, 0), (0.5905074527, 0.1245970883, 0)), Line((0.9292915767, -2.174821921, 0), (0.4694893239, 2.349639151, 0)), Line((0.3986411651, -0.7832033705, 0), (1.594453475, 0.08555931259, 0)), Line((-1.262870666, -0.4615047686, 0), (-0.02492010909, -0.1588196315, 0)), Line((1, -1, -1), (1, 1, 1)), Line((1, -0.5, -0.5), (1, 0.5, 0.5)), Line((1.588871845, -0.8761258755, 0), (1.847863907, 1.163049956, 0))])
gh_shapein = CSharpScript(B=brep_7, S=pt_6)  # -> out, R; inputs B: Brep, S: GeometryBase
# ---------- gh_shapein: C# usings ----------
// To check for geometry types
using Rhino.DocObjects;
# ---------- gh_shapein: C# ----------
    // Component written by @garciadelcastillo

    // This component tests if a particular Geometry type
    // is inside the Brep applying different logics.

    // TODO: add more Geometry types to checks
    Component.AddRuntimeMessage(GH_RuntimeMessageLevel.Warning, "Not all Geometry types available for checks");

    // Some sanity
    if (B.IsSolid == false)
    {
      Component.AddRuntimeMessage(GH_RuntimeMessageLevel.Error, "Brep must be a closed solid");
    }


    int relation = -1;
    if (S.ObjectType == ObjectType.Point)
    {
      // Must cast to the generic Point type, and obtain the Point3d location
      Point3d p = ((Point) S).Location;
      relation = ComputeRelationBrep(B, p);
    }
    else if (S.ObjectType == ObjectType.Curve)
    {
      Curve curve = (Curve) S;
      relation = ComputeRelationBrep(B, curve);
    }
    
      // TODO: add more data types here! 
      
    else
    {
      Component.AddRuntimeMessage(GH_RuntimeMessageLevel.Error, "Sorry, this type of geometry is not supported");
    }


    // Outputs
    R = relation;
# ---------- gh_shapein: C# additional code ----------
  int ComputeRelationBrep(Brep brep, Point3d p)
  {
    bool inside = brep.IsPointInside(p, 0.00001, false);
    if (inside) return 0;
    else return 2;
  }
  
  int ComputeRelationBrep(Brep brep, Curve curve)
  {
    //Define arrays to hold the intersection curves and points
    Curve[] curves = new Curve[0];
    Point3d[] points = new Point3d[0];

    //Define tolerance as the model space absolute tolerance
    double tol = doc.ModelAbsoluteTolerance;
    
    bool success = Rhino.Geometry.Intersect.Intersection.CurveBrep
      (curve, brep, tol, out curves, out points);
    
    // If some intersection was found, then curve is intersecting!
    if (curves.Length != 0 || points.Length != 0) return 1; 
    
    // Otherwise, check a point on the curve for Brep inclusion
    bool pointInside = brep.IsPointInside(curve.PointAtStart, 0.00001, false);
    if (pointInside) return 0;
    return 2;
  }
# ---------- end gh_shapein ----------
shapein = ShapeInBrep(Brep=brep_7, Shape=pt_6)
panel_14 = Panel(shapein)
panel_15 = Panel(gh_shapein.R)

# ---- group: Area Moments / error testing
pt_7 = Point(Point(-0.614617653, 1.396960664, 0))
crv_3 = Curve(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)
crv_4 = Curve(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)

# ---- group: Volume Moments / error testing
pt_8 = Point(Point(-0.614617653, 1.396960664, 0))
geo_2 = Geometry(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)

# ---- group: Point in Breps / outside Pt
pt_9 = Point(Point(0.2066013269, 5.463709837, 1.934946635))

# ---- group: Point in Breps / inside Pt
pt_10 = Point(Point(8.739623683, 4.154964077, 1.934946635))

# ---- group: Box Corners
# GH#: A C# dictionary of Grasshopper3D components.
# 
# This file contains a category of Grasshopper components, and a mirroring C#/RhinoCommon implementation.
# 
# This is an educational project initiated by students/faculty of GSD-6338: Introduction to Computational Design, at the Harvard Graduate School of Design.
# 
# More information: {{project link}}
# Surface Analysis
geo_3 = Geometry(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)

# ----
gh_box_corners = CSharpScript(box=geo_3)  # -> out, A, B, C, D, E, F, G, H; inputs box: Box
# ---------- gh_box_corners: C# ----------
    // Component created by @mirahx24

    // Rhinocommon's method of getting box's corners: box.GetCorners()
    Point3d[] corners = box.GetCorners();

    // Output
    A = corners[0];
    B = corners[1];
    C = corners[2];
    D = corners[3];
    E = corners[4];
    F = corners[5];
    G = corners[6];
    H = corners[7];
# ---------- end gh_box_corners ----------
box_corners = BoxCorners(Box=geo_3)  # -> CornerA, CornerB, CornerC, CornerD, CornerE, CornerF, CornerG, CornerH

# ---- group: Box Corners (continued)
panel_16 = Panel(box_corners.CornerA)
panel_17 = Panel(box_corners.CornerB)
panel_18 = Panel(box_corners.CornerC)
panel_19 = Panel(box_corners.CornerD)
panel_20 = Panel(box_corners.CornerE)
panel_21 = Panel(box_corners.CornerF)
panel_22 = Panel(box_corners.CornerG)
panel_23 = Panel(box_corners.CornerH)
panel_24 = Panel(gh_box_corners.A)
panel_25 = Panel(gh_box_corners.B)
panel_26 = Panel(gh_box_corners.C)
panel_27 = Panel(gh_box_corners.D)
panel_28 = Panel(gh_box_corners.E)
panel_29 = Panel(gh_box_corners.F)
panel_30 = Panel(gh_box_corners.G)
panel_31 = Panel(gh_box_corners.H)

# ---- group: Deconstruct Box
geo_4 = Geometry(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)

# ----
gh_debox = CSharpScript(B=geo_4)  # -> out, P, X, Y, Z; inputs B: Box
# ---------- gh_debox: C# ----------
    // This component is created by @mirahx24

    // Output
    P = B.Plane; // box's plane
    X = B.X; // box's domain on X direction
    Y = B.Y; // box's domain on Y direction
    Z = B.Z; // box's domain on Z direction
# ---------- end gh_debox ----------
debox = DeconstructBox(Box=geo_4)  # -> Plane, X, Y, Z

# ---- group: Deconstruct Box (continued)
panel_32 = Panel(debox.Y)
panel_33 = Panel(debox.Plane)
panel_34 = Panel(debox.X)
panel_35 = Panel(debox.Z)
panel_36 = Panel(gh_debox.P)
panel_37 = Panel(gh_debox.X)
panel_38 = Panel(gh_debox.Y)
panel_39 = Panel(gh_debox.Z)

# ---- group: Brep Wireframe
geo_5 = Geometry(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)
number_slider = Slider(1, range=-1..1)

# ----
gh_wires = CSharpScript(B=geo_5, D=number_slider)  # -> out, W; inputs B: Brep, D: Int32
# ---------- gh_wires: C# ----------
    // This component is created by @mirahx24

    // Safety Check! Only run the script if Brep is not empty
    if(B != null) {
      // B.GetWireframe(int density) method will get all the "Wires" of Brep B
      W = B.GetWireframe(D);
    }
# ---------- end gh_wires ----------
wires = BrepWireframe(Brep=geo_5, Density=number_slider)

# ---- group: Brep Wireframe (continued)
panel_40 = Panel(gh_wires.W)
panel_41 = Panel(wires)

# ---- group: Dimensions
srf = Surface(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)

# ----
gh_dim = CSharpScript(S=srf)  # -> out, U, V; inputs S: Surface
# ---------- gh_dim: C# ----------
    // This component is created by @mirahx24

    // A surface has two main domains
    // Domain(0) is at u-direction
    // Domain(1) is at v-direction
    // The grasshopper component returns the dimension at u and v directions

    // Output
    U = S.Domain(0).Length;
    V = S.Domain(1).Length;
# ---------- end gh_dim ----------
dim = Dimensions(Surface=srf)  # -> UDimension, VDimension

# ---- group: Dimensions (continued)
panel_42 = Panel(gh_dim.U)
panel_43 = Panel(gh_dim.V)
panel_44 = Panel(dim.UDimension)
panel_45 = Panel(dim.VDimension)

# ---- group: Brep Edges
geo_6 = Geometry(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)

# ----
gh_edges = CSharpScript(B=geo_6)  # -> out, En, Ei, Em; inputs B: Brep
# ---------- gh_edges: C# ----------
    // This component is created by @mirahx24


    // Safety check! only run this component when there is infomation passed into it
    if(B != null){
      // First create lists to store the geometry data
      // The edges of brep will be of BrepEdge class, so here we declare lists of BrepEdge
      List<BrepEdge> nakedEdges = new List<BrepEdge>(); // list for naked edges
      List<BrepEdge> interiorEdges = new List<BrepEdge>(); // list for interior edges
      List<BrepEdge> nonManifoldEdges = new List<BrepEdge>(); //list for nonManifold edges

      // Brep.Edges returns a list of edges, and is of class BrepEdge
      // We use Valence property of this class to check edges connectivity
      // Valence is an enumerator of edge adjcency
      // It checks how many faces is an edge connected to
      // If an edge is connected to only one face, then the edge is a naked edge
      // If an edge is connected to two faces, then it is a interior edge
      // if an edge is connected to three or more faces, then it is a nonmanifold edge

      // We first iterate through the entire edge list of Brep B
      for(int i = 0; i < B.Edges.Count;i++){
        EdgeAdjacency v = B.Edges[i].Valence; // get the valence for each edge

        // if the valence returns as Naked, then add the current edge to nakedEdges list
        if (v == EdgeAdjacency.Naked){
          nakedEdges.Add(B.Edges[i]);
        }

          // if the valence returns as Interior, then add the current edge to interiorEdges list
        else if (v == EdgeAdjacency.Interior){
          interiorEdges.Add(B.Edges[i]);
        }

          // if the valence returns as NonManifold, then add the current edge to nonManifoldEdges list
        else if (v == EdgeAdjacency.NonManifold) {
          nonManifoldEdges.Add(B.Edges[i]);
        }
      }

      // Output
      En = nakedEdges;
      Ei = interiorEdges;
      Em = nonManifoldEdges;
    }
# ---------- end gh_edges ----------
edges = BrepEdges(Brep=geo_6)  # -> Naked, Interior, NonManifold

# ---- group: Brep Edges (continued)
panel_46 = Panel(gh_edges.En)
panel_47 = Panel(gh_edges.Ei)
panel_48 = Panel(gh_edges.Em)
panel_49 = Panel(edges.Naked)
panel_50 = Panel(edges.Interior)
panel_51 = Panel(edges.NonManifold)

# ---- group: Surface Points
srf_2 = Surface(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)

# ----
gh_srfpt = CSharpScript(S=srf_2)  # -> out, P, W, G, U, V; inputs S: Surface
# ---------- gh_srfpt: C# usings ----------
using Rhino.Geometry.Collections;
# ---------- gh_srfpt: C# ----------
    // This component is created by @mirahx24

    // NurbsSurface is easier to to access certain information
    // So first we convert Surface to NurbsSurface
    NurbsSurface nurbsSurf = S.ToNurbsSurface();

    // Then get all the control points of surface by envoking the NurbsSurface.Points property
    // But since it is of class NurbsSurfacePointList, it is better to convert them to class Point3d
    // For better understanding of their positions
    NurbsSurfacePointList controlPoints = nurbsSurf.Points;

    // Create empty lists for data storage later
    List<Point3d> points = new List<Point3d>();
    List<Point2d> grevillePoints = new List<Point2d>();
    List<double> weights = new List<double>();
    int uCount = controlPoints.CountU; // number of points in u direction
    int vCount = controlPoints.CountV; // number of points in v direction

    // Iterate through u direction
    for(int u = 0; u < uCount; u++) {
      // Iterate through v direction
      for(int v = 0; v < vCount;v++){
        Point3d pt; // Creating un-initialized Point3d

        // Invoke method to get the control points coordinate
        // This method returns bool if the operation is successful
        // and output the control point coordinate to pt variable
        if(!controlPoints.GetPoint(u, v, out pt)){
          // if method is not successful, add error message and stop script from executing
          Component.AddRuntimeMessage(GH_RuntimeMessageLevel.Error, "Cannot get control points.");
          return;
        }
        
        Point2d grePt = controlPoints.GetGrevillePoint(u, v); // invoke method to get the greville points of uv coordinate
        double w = controlPoints.GetWeight(u, v); // invoke method to get weight of each points
        points.Add(pt); 
        grevillePoints.Add(grePt); 
        weights.Add(w);
      }
    }

    // Output
    P = points;
    W = weights;
    G = grevillePoints;
    U = uCount;
    V = vCount;
# ---------- end gh_srfpt ----------
srfpt = SurfacePoints(Surface=srf_2)  # -> Points, Weights, Greville, UCount, VCount

# ---- group: Surface Points (continued)
control_points = Panel(gh_srfpt.P)
control_points_2 = Panel(srfpt.Points)
control_points_weights = Panel(srfpt.Weights)
control_points_weights_2 = Panel(gh_srfpt.W)
greville_uv_pts = Panel(gh_srfpt.G)
u_count = Panel(gh_srfpt.U)
u_count_2 = Panel(srfpt.UCount)
greville_uv_pts_2 = Panel(srfpt.Greville)
v_count = Panel(gh_srfpt.V)
v_count_2 = Panel(srfpt.VCount)

# ---- group: Principal Curvature
pt_11 = ConstructPoint(XCoordinate="0", YCoordinate=Slider(10.58, range=0..19.49), ZCoordinate="0")
srf_3 = Surface(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)
pt_12 = Point(pt_11)

# ----
gh_curvature = CSharpScript(S=srf_3, uv=pt_12)  # -> out, F, C1, C2, K1, K2; inputs S: Surface, uv: Point3d
# ---------- gh_curvature: C# ----------
    // Component created by @mirahx24

    double u = uv.X;
    double v = uv.Y;
    
    // Initiate empty variables
    double minCurvature;
    double maxCurvature;
    Vector3d minDir;
    Vector3d maxDir;
    
    // Get plane at uv coordinate
    Plane frame = new Plane();
    if(S.FrameAt(u, v, out frame)) {
      SurfaceCurvature curv = S.CurvatureAt(u, v); // get surface curvature at uv coordinate
      
      // SurfaceCurvature stores the following properties
      minCurvature = curv.Kappa(0); 
      maxCurvature = curv.Kappa(1);
      minDir = curv.Direction(0);
      maxDir = curv.Direction(1);
    }
    else {
      Component.AddRuntimeMessage(GH_RuntimeMessageLevel.Error, "Cannot compute Frame at given uv point");
      return;
    }

    // Output
    F = frame;
    C1 = minCurvature;
    C2 = maxCurvature;
    K1 = minDir;
    K2 = maxDir;
# ---------- end gh_curvature ----------
curvature = PrincipalCurvature(Surface=srf_3, Point=pt_12)  # -> Frame, Min, Max, MinDirection, MaxDirection

# ---- group: Principal Curvature (continued)
panel_52 = Panel(curvature.Frame)
panel_53 = Panel(curvature.Min)
panel_54 = Panel(curvature.Max)
panel_55 = Panel(curvature.MinDirection)
panel_56 = Panel(curvature.MaxDirection)
panel_57 = Panel(gh_curvature.C2)
panel_58 = Panel(gh_curvature.F)
panel_59 = Panel(gh_curvature.C1)
panel_60 = Panel(gh_curvature.K1)
panel_61 = Panel(gh_curvature.K2)

# ---- group: Brep Closest Point
pt_13 = Point(Point(2.216256994, 2.247253595, 2.777777632))
geo_7 = Geometry(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)

# ----
gh_brep_cp = CSharpScript(Pt=pt_13, B=geo_7)  # -> out, P, N, C; inputs Pt: Point3d, B: Brep
# ---------- gh_brep_cp: C# ----------
    // Component created by @mirahx24

    Point3d closestPt = B.ClosestPoint(Pt); // invoke method to find the closest point of Pt in B
    Vector3d normal = closestPt - Pt; // direction from closestPt to Pt
    normal.Unitize(); // unitize vector

    // Output
    P = closestPt;
    N = normal;
    C = Pt.DistanceTo(closestPt);
# ---------- end gh_brep_cp ----------
brep_cp = BrepClosestPoint(Point=pt_13, Brep=geo_7)  # -> Point, Normal, Distance

# ---- group: Brep Closest Point (continued)
panel_62 = Panel(gh_brep_cp.C)
panel_63 = Panel(brep_cp.Point)
panel_64 = Panel(brep_cp.Normal)
panel_65 = Panel(brep_cp.Distance)
panel_66 = Panel(gh_brep_cp.P)
panel_67 = Panel(gh_brep_cp.N)

# ---- group: Point in Brep
toggle_2 = BooleanToggle(False)
geo_8 = Geometry(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)
gh_brepinc = CSharpScript(B=geo_8, P=pt_2, S=toggle_2)  # -> out, I; inputs B: Brep, P: Point3d, S: Boolean
# ---------- gh_brepinc: C# ----------
    // Component created by @mirahx24

    // Invoke method to check whether the point is inside brep
    I = B.IsPointInside(P, RhinoMath.SqrtEpsilon, S);
# ---------- end gh_brepinc ----------
panel_68 = Panel(gh_brepinc.I)

# ----
brepinc = PointInBrep(Brep=geo_8, Point=pt_2, Strict=toggle_2)

# ---- group: Point in Brep (continued)
panel_69 = Panel(brepinc)

# ---- group: Evaluate Surface
srf_4 = Surface(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)
pt_14 = Point(Point(4.663708413, 1.889306389, -0.1706610635))
pt_15 = Point(Point(5.196461818, 1.889306389, -0.1706610635))
pt_16 = Point(Point(2.216256994, 2.247253595, 2.777777632))

# ----
gh_evalsrf = CSharpScript(S=srf_4, uv=pt_15)  # -> out, P, N, U, V, F; inputs S: Surface, uv: Point3d
# ---------- gh_evalsrf: C# ----------
    // Component created by @mirahx24

    // Get the u and v values
    double u = uv.X;
    double v = uv.Y;

    Vector3d[] uvDirs; // initiate vector3d that will store uv directions
    Point3d pt = new Point3d();
    Plane target_Plane = new Plane();

    // Invoke method to get normal vector at uv points
    Vector3d norm = S.NormalAt(u, v);

    // Invoke method to get the uv point and return the plane
    if(S.FrameAt(u, v, out target_Plane)){
      if(S.Evaluate(u, v, 1, out pt, out uvDirs)){ //get the point and uv directions based on uv coordinate
        uvDirs[0].Unitize(); // unitize u
        uvDirs[1].Unitize(); // unitize v
      }

      else{
        Component.AddRuntimeMessage(GH_RuntimeMessageLevel.Error, "Cannot find UV direction at {uv} Point");
        return;
      }
    }
    else{
      Component.AddRuntimeMessage(GH_RuntimeMessageLevel.Error, "Cannot find Frame at uv Point");
      return;
    }

    // Output
    P = pt;
    N = norm;
    U = uvDirs[0];
    V = uvDirs[1];
    F = target_Plane;
# ---------- end gh_evalsrf ----------
evalsrf = EvaluateSurface(Surface=srf_4, Point=pt_15)  # -> Point, Normal, UDirection, VDirection, Frame

# ---- group: Evaluate Surface (continued)
panel_70 = Panel(evalsrf.Point)
panel_71 = Panel(evalsrf.UDirection)
panel_72 = Panel(evalsrf.Normal)
panel_73 = Panel(evalsrf.VDirection)
panel_74 = Panel(evalsrf.Frame)
panel_75 = Panel(gh_evalsrf.P)
panel_76 = Panel(gh_evalsrf.U)
panel_77 = Panel(gh_evalsrf.N)
panel_78 = Panel(gh_evalsrf.V)
panel_79 = Panel(gh_evalsrf.F)

# ---- group: Volume
geo_9 = Geometry(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)

# ----
gh_volume = CSharpScript(G=geo_9)  # -> out, V, C; inputs G: GeometryBase
# ---------- gh_volume: C# ----------
    // Component created by @mirahx24

    // This component should be able to read in closed planar Brep and Mesh
    // Because of this requirement, the input G need to be set as class GeometryBase object
    // And need to implement try-catch statements
    // Try-catch statement enable the script to run potentially fail-able code in a saft environment
    // If code inside the Try block failed, the compiler will start to execute code inside the Catch statement and then the rest of the script
    // For more information on try-catch statements, read https://docs.microsoft.com/en-us/dotnet/csharp/language-reference/keywords/try-catch

    // Rhinocommon has an VolumeMassProperties class that is able to take in many different geometries
    // And able to return the associated volume property of that geometry
    // For more information on VolumeMassProperties, read https://developer.rhino3d.com/api/RhinoCommon/html/T_Rhino_Geometry_VolumeMassProperties.htm

    // First initialize a null object of VolumeMassProperties
    VolumeMassProperties vmp = null;

    // Boolean variable to check if the type of input geometry is already found
    bool computed = false;

    // Try to convert input G to a Brep
    try{
      // If G is a Brep, then the conversion will be successful and the rest of the code inside try block will execute.
      // Otherwise, it will go to the Catch statement without running the rest of the codes inside the try block
      Brep b = (Brep) G;

      // Check if Brep is a closed one
      if(!b.IsSolid){
        // If not, then add runtime error
        Component.AddRuntimeMessage(GH_RuntimeMessageLevel.Error, "Volume cannot be computed for an open brep.");
        return;
      }
      
      vmp = VolumeMassProperties.Compute(b); // compute vmp value of Brep
      computed = true; // flag computed as true
    }
    catch{}


    // If boolean varaible "computed" is false, vmp hasn't been computed
    // Which means the previous conversion failed
    if(!computed) {
      // Try to convert input G to a Mesh
      try{
        // If G is a Mesh, then the conversion will be successful and the rest of the code inside try block will execute.
        // Otherwise, it will go to the Catch statement without running the rest of the codes inside the try block
        Mesh m = (Mesh) G;

        vmp = VolumeMassProperties.Compute(m); // compute vmp value of Mesh
        computed = true; // flag computed as true
      }
      catch{}
    }

    // Check if we were able to compute vmp of a closed brep or a mesh
    // If computation is successful, find the volume and centroid of geometry
    if(vmp != null) {
      // Output volume and center of Geometry
      V = Math.Round(vmp.Volume, 6);

      //Find Centroid
      C = vmp.Centroid;
    }

      // Otherwise, add runtime error
    else{
      Component.AddRuntimeMessage(GH_RuntimeMessageLevel.Error, "Volume properties could not be solved.");
    }
# ---------- end gh_volume ----------
volume = Volume(Geometry=geo_9)  # -> Volume, Centroid

# ---- group: Volume (continued)
panel_80 = Panel(gh_volume.C)
panel_81 = Panel(gh_volume.V)
panel_82 = Panel(volume.Centroid)
panel_83 = Panel(volume.Volume)

# ---- group: Area
srf_5 = Surface(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)

# ----
area = Area(Geometry=srf_5)  # -> Area, Centroid
gh_area = CSharpScript(G=srf_5)  # -> out, A, C; inputs G: GeometryBase
# ---------- gh_area: C# ----------
    //Component written by @mirahx24

    // This component should be able to read in closed planar Curve, Brep, and Mesh
    // Because of this requirement, the input G need to be set as class GeometryBase object
    // And need to implement try-catch statements
    // Try-catch statement enable the script to run potentially fail-able code in a saft environment
    // If code inside the Try block failed, the compiler will start to execute code inside the Catch statement and then the rest of the script
    // For more information on try-catch statements, read https://docs.microsoft.com/en-us/dotnet/csharp/language-reference/keywords/try-catch

    // Rhinocommon has an AreaMassProperties class that is able to take in many different geometries
    // And able to return the associated area property of that geometry
    // For more information on AreaMassProperties, read https://developer.rhino3d.com/api/RhinoCommon/html/T_Rhino_Geometry_AreaMassProperties.htm

    // First initialize a null object of AreaMassProperties
    AreaMassProperties amp = null;

    // Boolean variable to check if the type of input geometry is already found
    bool computed = false;

    // Try to convert input G to a curve
    try{
      // If G is a curve, then the conversion will be successful and the rest of the code inside try block will execute.
      // Otherwise, it will go to the Catch statement without running the rest of the codes inside the try block
      Curve c = (Curve) G;

      // If G is a curve, then check curve is closed
      if (!c.IsClosed) {
        // If it is not closed, add runtime error message
        Component.AddRuntimeMessage(GH_RuntimeMessageLevel.Error, "Curve must be closed for Area calculation");
        return;
      }

      // Check if curve is planar
      if(!c.IsPlanar()) {
        // If it is not planar, add runtime error message
        Component.AddRuntimeMessage(GH_RuntimeMessageLevel.Error, "Curve must be planar for Area calculation");
        return;
      }

      // Compute values of the amp object
      amp = AreaMassProperties.Compute(c);
      computed = true; // Confirmed amp has been comupted, which mean type conversion succeed
    }
    catch{}

    // If boolean varaible "computed" is false, amp hasn't been computed
    // Which means the previous conversion failed
    if(!computed) {
      // Try converting G to a Brep
      try{
        // If G is a Brep, then the conversion will be successful and the rest of the code inside try block will execute.
        // Otherwise, it will go to the Catch statement without running the rest of the codes inside the try block
        Brep b = (Brep) G;

        amp = AreaMassProperties.Compute(b); // compute values of the amp object
        computed = true; // confirmed amp has been comupted, which mean type conversion succeed
      }
      catch{}
    }

    // If boolean varaible "computed" is false, amp hasn't been computed
    // Which means the previous conversion failed
    if(!computed) {
      // Try converting G to a Mesh
      try{
        // If G is a Mesh, then the conversion will be successful and the rest of the code inside try block will execute.
        // Otherwise, it will go to the Catch statement without running the rest of the codes inside the try block
        Mesh m = (Mesh) G;

        amp = AreaMassProperties.Compute(m); // Compute values of the amp object
        computed = true; // Confirmed amp has been comupted, which mean type conversion succeed
      }
      catch{}
    }

    // Check if we were able to compute amp of a closed planar curve, brep, or mesh
    // If computation is successful, find the area and centroid of geometry
    if(amp != null) {
      //Find Area
      A = Math.Round(amp.Area, 6);

      //Find Centroid
      C = amp.Centroid;
    }

      // Otherwise, add runtime error
    else{
      Component.AddRuntimeMessage(GH_RuntimeMessageLevel.Error, "Area properties could not be solved.");
    }
# ---------- end gh_area ----------

# ---- group: Area (continued)
panel_84 = Panel(area.Area)
panel_85 = Panel(area.Centroid)
panel_86 = Panel(gh_area.C)

# ----
panel_87 = Panel(gh_area.A)

# ---- group: Evaluate Box
number_slider_2 = Slider(0.5, range=0..1)
number_slider_3 = Slider(0.6, range=0..1)
number_slider_4 = Slider(0.8, range=0..1)
box_2 = CenterBox(Base=PlaneXY(0, 0, 0), X=1, Y=1, Z=1)

# ----
gh_box = CSharpScript(B=box_2, U=number_slider_2, V=number_slider_3, W=number_slider_4)  # -> out, Pl, Pt, I; inputs B: Box, U: Double, V: Double, W: Double
# ---------- gh_box: C# ----------
    // Component created by @mirahx24

    // Get the Point in world coorindate that is represented as UVW
    Point3d pt = new Point3d(B.X.Min + B.X.Length * U, B.Y.Min + B.Y.Length * V, B.Z.Min + B.Z.Length * W);

    // Get the box's plane normal
    // Then move that plane to the new point
    Vector3d vt = B.Plane.Normal;
    Plane planeUVW = new Plane(pt, vt);

    // Check if the new point is actually on the plane
    // With U, V, W within the range of 0-1, this should always return true
    bool isInside = B.Contains(pt);

    // Output
    Pl = planeUVW;
    Pt = pt;
    I = isInside;
# ---------- end gh_box ----------
box_3 = EvaluateBox(Box=box_2, UParameter=number_slider_2, VParameter=number_slider_3, WParameter=number_slider_4)  # -> Plane, Point, Include

# ---- group: Evaluate Box (continued)
panel_88 = Panel(gh_box.Pl)
panel_89 = Panel(gh_box.Pt)
panel_90 = Panel(gh_box.I)
panel_91 = Panel(box_3.Plane)
panel_92 = Panel(box_3.Point)
panel_93 = Panel(box_3.Include)

# ---- group: Box Properties
box_4 = CenterBox(Base=PlaneXY(0, 0, 0), X=Slider(4, range=0..10), Y=Slider(0, range=0..10), Z=Slider(0, range=0..10))

# ----
gh_boxprop = CSharpScript(B=box_4)  # -> out, C, D, A, V, d; inputs B: Box
# ---------- gh_boxprop: C# ----------
    // Component created by @mirahx24

    // First get the array of Box's corners
    Point3d[] corners = B.GetCorners();

    // Then calculate vector from 1st corner to the 7th corner
    Vector3d diagonal = corners[corners.Length - 2] - corners[0];

    // To my understanding of Degeneracy,
    // it returns the number of edges that are 0 length
    int degeneracy = 0;
    if ( B.X.Length == 0) {
      degeneracy++;
    }
    if ( B.Y.Length == 0) {
      degeneracy++;
    }
    if ( B.Z.Length == 0) {
      degeneracy++;
    }

    // Output
    C = B.Center; // box's center
    D = diagonal;
    A = B.Area; // box's total area
    V = B.Volume; // box's volume
    d = degeneracy;
# ---------- end gh_boxprop ----------
boxprop = BoxProperties(Box=box_4)  # -> Center, Diagonal, Area, Volume, Degeneracy

# ---- group: Box Properties (continued)
panel_94 = Panel(boxprop.Center)
panel_95 = Panel(boxprop.Area)
panel_96 = Panel(boxprop.Volume)
panel_97 = Panel(boxprop.Degeneracy)
panel_98 = Panel(boxprop.Diagonal)
panel_99 = Panel(gh_boxprop.C)
panel_100 = Panel(gh_boxprop.D)
panel_101 = Panel(gh_boxprop.A)
panel_102 = Panel(gh_boxprop.V)
panel_103 = Panel(gh_boxprop.d)

# ---- group: Point in Breps
toggle_3 = BooleanToggle(True)
geo_10 = Geometry([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])

# ----
gh_brepsinc = CSharpScript(B=geo_10, P=pt_9, S=toggle_3)  # -> out, I, i; inputs B: list of Brep, P: Point3d, S: Boolean
# ---------- gh_brepsinc: C# ----------
    // Component created by @mirahx24

    bool inside = false; // set boolean flag to check whether point inside
    int index = -1; // for later use to store idex

    // Iterate the list of breps 
    for(int j = 0; j < B.Count; j++){
      // check if point is inside current brep
      if(B[j].IsPointInside(P, RhinoMath.SqrtEpsilon, S)) {
        inside = true; // if it is, set flag to true
        index = j; // save the index of current brep
        break; // stop the for-loop from executing
      }
    }

    // Output
    I = inside;
    i = index;
# ---------- end gh_brepsinc ----------
brepsinc = PointInBreps(Brep=geo_10, Point=pt_9, Strict=toggle_3)  # -> Inside, Index

# ---- group: Point in Breps (continued)
panel_104 = Panel(brepsinc.Inside)
panel_105 = Panel(brepsinc.Index)
panel_106 = Panel(gh_brepsinc.I)
panel_107 = Panel(gh_brepsinc.i)

# ---- group: Surface Closest Point
pt_17 = Point(Point(2.216256994, 2.247253595, 2.777777632))
srf_6 = Surface(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)

# ----
gh_srf_cp = CSharpScript(Pt=pt_17, S=srf_6)  # -> out, P, uvP, D; inputs Pt: Point3d, S: Surface
# ---------- gh_srf_cp: C# ----------
    // Component created by @mirahx24

    // Initialize the u and v as double
    double u;
    double v;
    Point3d closestPt = Pt;

    // Get the plane for Pt in world coordinate
    Plane source_Plane = Plane.WorldXY;
    source_Plane.Origin = Pt;

    // This function returns true if successful
    // It doesn't return the resulting closest point of Pt on surface
    // Instead it returns them as outputs
    if(S.ClosestPoint(Pt, out u, out v)) {

      //Get the plane for Pt in uv coordinate
      Plane target_Plane;
      S.FrameAt(u, v, out target_Plane);

      // Perform matrix transforms to to convert plane in world coordinate to uv coordinate
      Transform xform = Transform.PlaneToPlane(source_Plane, target_Plane);
      closestPt.Transform(xform); // apply the transformation to the closestPt
    }
    else{
      return; // if cannot find closest point, stop script from executing
    }

    Point3d uvPt = new Point3d(u, v, 0);

    // Output
    P = closestPt;
    uvP = uvPt;
    D = closestPt.DistanceTo(Pt);
# ---------- end gh_srf_cp ----------
srf_cp = SurfaceClosestPoint(Point=pt_17, Surface=srf_6)  # -> Point, UVPoint, Distance

# ---- group: Surface Closest Point (continued)
pt_18 = Point(srf_cp.Point)
pt_19 = Point(gh_srf_cp.P)
panel_108 = Panel(gh_srf_cp.P)
panel_109 = Panel(gh_srf_cp.D)
panel_110 = Panel(srf_cp.Point)
panel_111 = Panel(srf_cp.UVPoint)
panel_112 = Panel(srf_cp.Distance)
panel_113 = Panel(gh_srf_cp.uvP)

# ---- group: Deconstruct Brep
geo_11 = Geometry(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)

# ----
gh_debrep = CSharpScript(B=geo_11)  # -> out, F, E, V; inputs B: Brep
# ---------- gh_debrep: C# ----------
    // This component is created by @mirahx24

    // Safety check! Only run component if input Brep exist
    if( B != null) {
      F = B.Faces; 
      E = B.Edges;
      V = B.Vertices;
    }
# ---------- end gh_debrep ----------
debrep = DeconstructBrep(Brep=geo_11)  # -> Faces, Edges, Vertices

# ---- group: Deconstruct Brep (continued)
geo_12 = Geometry(gh_debrep.F)
geo_13 = Geometry(gh_debrep.E)
geo_14 = Geometry(gh_debrep.V)
geo_15 = Geometry(debrep.Faces)
geo_16 = Geometry(debrep.Edges)
geo_17 = Geometry(debrep.Vertices)
panel_114 = Panel(geo_15)
panel_115 = Panel(geo_12)
panel_116 = Panel(geo_16)
panel_117 = Panel(geo_13)
panel_118 = Panel(geo_17)
panel_119 = Panel(geo_14)

# ---- group: Osculating Circles
pt_20 = ConstructPoint(XCoordinate="0", YCoordinate=Slider(10.58, range=0..19.49), ZCoordinate="0")
pt_21 = Point(pt_20)
srf_7 = Surface(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)

# ----
gh_osc = CSharpScript(S=srf_7, uv=pt_21)  # -> out, P, C1, C2; inputs S: Surface, uv: Point3d
# ---------- gh_osc: C# ----------
    // Component created by @mirahx24

    // Get u and v dimensions
    double u = uv.X;
    double v = uv.Y;

    Point3d pt = S.PointAt(u, v); // get surface point at uv coordinate
    SurfaceCurvature curv = S.CurvatureAt(u, v); // get surface curvature at uv coordinate

    // Get the oscilating circles of curvature at uv coordinate
    NurbsCurve cir1 = curv.OsculatingCircle(0).ToNurbsCurve();
    NurbsCurve cir2 = curv.OsculatingCircle(1).ToNurbsCurve();

    // Output
    P = pt;
    C1 = cir1;
    C2 = cir2;
# ---------- end gh_osc ----------
osc = OsculatingCircles(Surface=srf_7, Point=pt_21)  # -> Point, FirstCircle, SecondCircle

# ---- group: Osculating Circles (continued)
panel_120 = Panel(gh_osc.P)
panel_121 = Panel(gh_osc.C1)
panel_122 = Panel(gh_osc.C2)
panel_123 = Panel(osc.Point)
panel_124 = Panel(osc.FirstCircle)
panel_125 = Panel(osc.SecondCircle)

# ---- group: Surface Curvature
pt_22 = ConstructPoint(XCoordinate="0", YCoordinate=Slider(10.58, range=0..19.49), ZCoordinate="0")
srf_8 = Surface(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)
pt_23 = Point(pt_22)

# ----
gh_cruvature = CSharpScript(S=srf_8, uv=pt_23)  # -> out, F, G, M; inputs S: Surface, uv: Point3d
# ---------- gh_cruvature: C# ----------
    // Component created by @mirahx24
    
    double u = uv.X;
    double v = uv.Y;
    double gau;
    double mean;
    
    // Get plane at surface uv coordinate
    Plane frame = new Plane();
    if(S.FrameAt(u, v, out frame)) {
      SurfaceCurvature curv = S.CurvatureAt(u, v);
      gau = curv.Gaussian; // get the gaussian value of surface curvature
      mean = curv.Mean; // get the mean value of surface curvature
    }
    else {
      // Create runtime error message if cannot get plane at uv coordinate
      Component.AddRuntimeMessage(GH_RuntimeMessageLevel.Error, "Cannot compute Frame at given uv point");
      return;
    }
    
    // Output
    F = frame;
    G = gau;
    M = mean;
# ---------- end gh_cruvature ----------
curvature_2 = SurfaceCurvature(Surface=srf_8, Point=pt_23)  # -> Frame, Gaussian, Mean

# ---- group: Surface Curvature (continued)
panel_126 = Panel(gh_cruvature.F)
panel_127 = Panel(gh_cruvature.M)
panel_128 = Panel(curvature_2.Frame)
panel_129 = Panel(curvature_2.Gaussian)
panel_130 = Panel(curvature_2.Mean)
panel_131 = Panel(gh_cruvature.G)

# ---- group: Area Moments
srf_9 = Surface(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)

# ----
gh_amoments = CSharpScript(Geo=srf_9)  # -> out, A, C, I, Ii, S, Ss, G; inputs Geo: GeometryBase
# ---------- gh_amoments: C# ----------
    // Component created by @mirahx24
    
    // This component should be able to read in closed planar Curve, Surface, and Brep
    // Because of this requirement, the input Geo need to be set as class GeometryBase object
    // And need to implement try-catch statements
    // Try-catch statement enable the script to run potentially fail-able code in a saft environment
    // If code inside the Try block failed, the compiler will start to execute code inside the Catch statement and then the rest of the script
    // For more information on try-catch statements, read https://docs.microsoft.com/en-us/dotnet/csharp/language-reference/keywords/try-catch

    
    // Rhinocommon has an AreaMassProperties class that is able to take in many different geometries
    // And able to return the associated area property of that geometry
    // For more information on AreaMassProperties, read https://developer.rhino3d.com/api/RhinoCommon/html/T_Rhino_Geometry_AreaMassProperties.htm
    
    // First initialize a null object of AreaMassProperties
    AreaMassProperties amp = null;
    
    // Boolean variable to check if the type of input geometry is already found
    bool computed = false;
    
    // Try to convert input G to a curve
    try {
      // If Geo is a curve, then the conversion will be successful and the rest of the code inside try block will execute.
      // Otherwise, it will go to the Catch statement without running the rest of the codes inside the try block
      Curve c = (Curve) Geo;
      
      // If G is a curve, then check curve is closed
      if (!c.IsClosed) {
        // If it is not closed, add runtime error message
        Component.AddRuntimeMessage(GH_RuntimeMessageLevel.Error, "Curve must be closed for Area calculation");
        return;
      }

      // Check if curve is planar
      if(!c.IsPlanar()) {
        // If it is not planar, add runtime error message
        Component.AddRuntimeMessage(GH_RuntimeMessageLevel.Error, "Curve must be planar for Area calculation");
        return;
      }
      
      amp = AreaMassProperties.Compute(c); // compute values of the amp object
      computed = true; // confirmed amp has been comupted, which mean type conversion succeed
    }
    catch {}

    // If boolean varaible "computed" is false, amp hasn't been computed
    // Which means the previous conversion failed
    if (!computed) {
      // Try converting Geo to a Surface
      try {
        // If Geo is a Surface, then the conversion will be successful and the rest of the code inside try block will execute.
        // Otherwise, it will go to the Catch statement without running the rest of the codes inside the try block
        Surface s = (Surface) Geo;
        amp = AreaMassProperties.Compute(s); // compute values of the amp object
        computed = true; // confirmed amp has been comupted, which mean type conversion succeed
      }
      catch {}
    }

    if (!computed) {
      // Try converting Geo to a Brep
      try {
        // If Geo is a Brep, then the conversion will be successful and the rest of the code inside try block will execute.
        // Otherwise, it will go to the Catch statement without running the rest of the codes inside the try block
        Brep b = (Brep) Geo;
        
        amp = AreaMassProperties.Compute(b); // compute values of the amp object
        computed = true; // confirmed amp has been comupted, which mean type conversion succeed
      }
      catch {}
    }


    // Check if we were able to compute amp of a closed planar curve, surface, or brep
    // If computation is successful, find the properties of geometry 
    if (amp != null) {
      A = amp.Area;
      C = amp.Centroid;
      I = amp.CentroidCoordinatesMomentsOfInertia;
      Ii = amp.CentroidCoordinatesMomentsOfInertiaError;
      S = amp.CentroidCoordinatesSecondMoments;
      Ss = amp.CentroidCoordinatesSecondMomentsError;
      G = amp.CentroidCoordinatesRadiiOfGyration;
    }
    
    // Otherwise, add runtime error
    else {
      Component.AddRuntimeMessage(GH_RuntimeMessageLevel.Error, "Area properties could not be solved.");

    }
# ---------- end gh_amoments ----------
amoments = AreaMoments(Geometry=srf_9)  # -> Area, Centroid, Inertia, InertiaError, Secondary, SecondaryError, Gyration

# ---- group: Area Moments (continued)
panel_132 = Panel(amoments.Area)
panel_133 = Panel(amoments.Centroid)
panel_134 = Panel(amoments.Inertia)
panel_135 = Panel(amoments.InertiaError)
panel_136 = Panel(amoments.Secondary)
panel_137 = Panel(amoments.SecondaryError)
panel_138 = Panel(amoments.Gyration)
panel_139 = Panel(gh_amoments.A)
panel_140 = Panel(gh_amoments.Ii)
panel_141 = Panel(gh_amoments.S)
panel_142 = Panel(gh_amoments.C)
panel_143 = Panel(gh_amoments.I)
panel_144 = Panel(gh_amoments.Ss)
panel_145 = Panel(gh_amoments.G)

# ---- group: Volume Moments
geo_18 = Geometry(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)

# ----
gh_vmoments = CSharpScript(Geo=geo_18)  # -> out, V, C, I, Ii, S, Ss, G; inputs Geo: GeometryBase
# ---------- gh_vmoments: C# ----------
    // Component created by @mirahx24

    // This component should be able to read in closed planar Brep and Mesh
    // Because of this requirement, the input G need to be set as class GeometryBase object
    // And need to implement try-catch statements
    // Try-catch statement enable the script to run potentially fail-able code in a saft environment
    // If code inside the Try block failed, the compiler will start to execute code inside the Catch statement and then the rest of the script
    // For more information on try-catch statements, read https://docs.microsoft.com/en-us/dotnet/csharp/language-reference/keywords/try-catch

    // Rhinocommon has an VolumeMassProperties class that is able to take in many different geometries
    // And able to return the associated volume property of that geometry
    // For more information on VolumeMassProperties, read https://developer.rhino3d.com/api/RhinoCommon/html/T_Rhino_Geometry_VolumeMassProperties.htm

    // First initialize a null object of VolumeMassProperties
    VolumeMassProperties vmp = null;

    // Boolean variable to check if the type of input geometry is already found
    bool computed = false;
    
    // Try to convert input Geo to a Brep
    try{
      // If G is a Brep, then the conversion will be successful and the rest of the code inside try block will execute.
      // Otherwise, it will go to the Catch statement without running the rest of the codes inside the try block
      Brep b = (Brep) Geo;
      
      // Check if Brep is closed
      if(!b.IsSolid){
        // If not, then add runtime error
        Component.AddRuntimeMessage(GH_RuntimeMessageLevel.Error, "Volume cannot be computed for an open brep.");
        return;
      }
      
      vmp = VolumeMassProperties.Compute(b); // compute vmp value of Brep
      computed = true; // flag computed as true
    }
    catch{}

    // If boolean varaible "computed" is false, vmp hasn't been computed
    // Which means the previous conversion failed
    if(!computed) {
      try{
        // Try to convert input Geo to a Mesh
        Mesh m = (Mesh) Geo;

        vmp = VolumeMassProperties.Compute(m); // compute vmp value of Mesh
        computed = true; // flag computed as true
      }
      catch{}
    }

    // Check if we were able to compute vmp of a closed brep or a mesh
    // If computation is successful, find the volume and centroid of geometry
    if(vmp != null) {
      // Output volume properties of Geometry
      V = Math.Round(vmp.Volume, 6);
      C = vmp.Centroid;
      I = vmp.CentroidCoordinatesMomentsOfInertia;
      Ii = vmp.CentroidCoordinatesMomentsOfInertiaError;
      S = vmp.CentroidCoordinatesSecondMoments;
      Ss = vmp.CentroidCoordinatesSecondMomentsError;
      G = vmp.CentroidCoordinatesRadiiOfGyration;
    }
      
    // Otherwise, add runtime error
    else{
      Component.AddRuntimeMessage(GH_RuntimeMessageLevel.Error, "Volume properties could not be solved.");
    }
# ---------- end gh_vmoments ----------
vmoments = VolumeMoments(Geometry=geo_18)  # -> Volume, Centroid, Inertia, InertiaError, Secondary, SecondaryError, Gyration

# ---- group: Volume Moments (continued)
panel_146 = Panel(gh_vmoments.Ss)
panel_147 = Panel(gh_vmoments.G)
panel_148 = Panel(vmoments.Volume)
panel_149 = Panel(vmoments.Centroid)
panel_150 = Panel(vmoments.Inertia)
panel_151 = Panel(vmoments.InertiaError)
panel_152 = Panel(vmoments.Secondary)
panel_153 = Panel(vmoments.SecondaryError)
panel_154 = Panel(vmoments.Gyration)
panel_155 = Panel(gh_vmoments.V)
panel_156 = Panel(gh_vmoments.C)
panel_157 = Panel(gh_vmoments.I)
panel_158 = Panel(gh_vmoments.Ii)
panel_159 = Panel(gh_vmoments.S)
