# Grasshopper definition Surface_Freeform.ghx (Grasshopper 1.0.7)

# ---- group: 4Point Surface
# GH#: A C# dictionary of Grasshopper3D components.
# 
# This file contains a category of Grasshopper components, and a mirroring C#/RhinoCommon implementation.
# 
# This is an educational project initiated by students/faculty of GSD-6338: Introduction to Computational Design, at the Harvard Graduate School of Design.
# 
# More information: {{project link}}
# Surface Freeform
pt = Point(Point(-5.736158344, -5.736158344, 0))
pt_2 = Point(Point(-5.736158344, 5.736158344, 0))
pt_3 = Point(Point(5.736158344, 5.736158344, 0))
pt_4 = Point(Point(5.736158344, -5.736158344, 0))
gh_srf4pt = CSharpScript(A=pt, B=pt_2, C=pt_3, D=pt_4)  # -> out, S; inputs A: Point3d, B: Point3d, C: Point3d, D: Point3d
# ---------- gh_srf4pt: C# ----------
    //Component written by @erinlinseyhunt

    //Create a nurbs surface from four corner points. The fifth input is a tolerance.
    NurbsSurface a = NurbsSurface.CreateFromCorners(A, B, C, D, this.RhinoDocument.ModelAbsoluteTolerance);

    //Output
    S = a;
# ---------- end gh_srf4pt ----------
srf4pt = _4PointSurface(CornerA=pt, CornerB=pt_2, CornerC=pt_3, CornerD=pt_4)
panel = Panel(srf4pt)
panel_2 = Panel(gh_srf4pt.S)

# ---- group: Boundary Surfaces
crv = Curve(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)
gh_boundary = CSharpScript(E=crv)  # -> out, S; inputs E: list of Curve
# ---------- gh_boundary: C# ----------
    //Component written by @erinlinseyhunt

    //Create a planar brep from a list of curves. The second input is the tolerance.
    Brep[] c = Brep.CreatePlanarBreps(E, this.RhinoDocument.ModelAbsoluteTolerance);

    //Output
    S = c;
# ---------- end gh_boundary ----------
boundary = BoundarySurfaces(Edges=crv)
panel_3 = Panel(boundary)
panel_4 = Panel(gh_boundary.S)

# ---- group: Edge Surface
crv_2 = Curve(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)
crv_3 = Curve(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)
crv_4 = Curve(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)
crv_5 = Curve(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)
gh_edgesrf = CSharpScript(A=crv_2, B=crv_3, C=crv_4, D=crv_5)  # -> out, S; inputs A: Curve, B: Curve, C: Curve, D: Curve
# ---------- gh_edgesrf: C# ----------
    //Component written by @erinlinseyhunt

    //Create a new list of curves.
    List<Curve> E = new List<Curve>();

    //Add the four input curves to the new curve list using a for loop.
    for (int i = 0; i < 4; i++)
    {
      E.Add(A);
      E.Add(B);
      E.Add(C);
      E.Add(D);
    }

    //Creates a surface from a list of edge curves
    Brep b = Brep.CreateEdgeSurface(E);

    //Output
    S = b;
# ---------- end gh_edgesrf ----------
edgesrf = EdgeSurface(CurveA=crv_2, CurveB=crv_3, CurveC=crv_4, CurveD=crv_5)
panel_5 = Panel(edgesrf)
panel_6 = Panel(gh_edgesrf.S)

# ---- group: Network Surface
crv_6 = Curve([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])
crv_7 = Curve([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])
number_slider = Slider(2, range=0..100)
gh_netsurf = CSharpScript(U=crv_6, V=crv_7, C=number_slider)  # -> out, S; inputs U: list of Curve, V: list of Curve, C: Int32
# ---------- gh_netsurf: C# ----------
    //Component written by @erinlinseyhunt

    //declaring
    int e;

    //Builds a surface from an ordered network of curves.
    NurbsSurface a = NurbsSurface.CreateNetworkSurface(U, C, C, V, C, C, 1.0, 1.0, 1.0, out e);

    //Output
    S = a;
# ---------- end gh_netsurf ----------
netsurf = NetworkSurface(CurvesU=crv_6, CurvesV=crv_7, Continuity=number_slider)
panel_7 = Panel(netsurf)
panel_8 = Panel(gh_netsurf.S)

# ---- group: Sum Surface
crv_8 = Curve(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)
crv_9 = Curve(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)
gh_sumsrf = CSharpScript(A=crv_8, B=crv_9)  # -> out, S; inputs A: Curve, B: Curve
# ---------- gh_sumsrf: C# ----------
    //Component written by @erinlinseyhunt

    //Creates a surface from two perpendicular curves.
    Surface C = SumSurface.Create(A, B);

    //Output
    S = C;
# ---------- end gh_sumsrf ----------
sumsrf = SumSurface(CurveA=crv_8, CurveB=crv_9)
panel_9 = Panel(sumsrf)
panel_10 = Panel(gh_sumsrf.S)

# ---- group: Extrude
crv_10 = Curve(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)
distance = Slider(31, range=0..60)
Z = UnitZ(Factor=distance)
gh_extr = CSharpScript(B=crv_10, D=Z)  # -> out, E; inputs B: Curve, D: Vector3d
# ---------- gh_extr: C# ----------
    //Component written by @erinlinseyhunt

    //Create an extrusion from an input curve and a vector.
    Surface a = Surface.CreateExtrusion(B, D);

    //Output
    E = a;
# ---------- end gh_extr ----------
extr = Extrude(Base=crv_10, Direction=Z)
panel_11 = Panel(extr)
panel_12 = Panel(gh_extr.E)

# ---- group: ExtrudeLinear
geo = Geometry()
xy = XYPlane(Origin=Point(0, 0, 0))
line = Line()
pln = Plane()
gh_extrude = CSharpScript(Po=xy, A=line, Ao=pln)  # -> Out, E
extrude = ExtrudeLinear(Profile=geo, OrientationP=xy, Axis=line, OrientationA=pln)

# ---- group: Patch
crv_11 = Curve([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])
pt_5 = Point([Point(19.31643315, 11.44099955, 0), Point(12.15728012, 39.46167327, 0), Point(35.42923991, 36.50658085, 0), Point(34.85200419, 13.16266063, 0), Point(25.94944124, 24.16271935, 7.95995046)])
number_slider_2 = Slider(40, range=0..50)
number_slider_3 = Slider(1.5, range=0..3)
toggle = BooleanToggle(False)
gh_patch = CSharpScript(C=crv_11, P=pt_5, S=number_slider_2, F=number_slider_3, T=toggle)  # -> out, POut; inputs C: list of Curve, P: list of Point3d, S: Int32, F: Double, T: Boolean
# ---------- gh_patch: C# ----------
    // Component written by @erinlinseyhunt & @garciadelcastillo

    // Creates a patch surface given a list of curves and points.

    // Let's add all geometry entities to a single list of the base class GeometryBase
    List<GeometryBase> geometry = new List<GeometryBase>();
    geometry.AddRange(C);

    // Point3d doesn't inherit from GeometryBase, so we need to convert
    // them to Point, which does: https://developer.rhino3d.com/api/RhinoCommon/html/T_Rhino_Geometry_Point.htm
    foreach (Point3d p3d in P)
    {
      Point p = new Point(p3d);  // copy from Point3d
      geometry.Add(p);
    }

    // Let's calculate some values that we will need for the patch.
    // Point spacing will be a small factor of the average curve length
    double totalLength = 0;
    foreach (Curve crv in C)
    {
      totalLength += crv.GetLength();
    }
    double pointSpacing = 0.01 * totalLength / C.Count;

    // Whether if to fix the sides of the patch
    bool[] fixEdges = new bool[4] {false, false, false, false};

    // Let's start by creating a simple patch with the available geometry:
    Brep simplePatch = Brep.CreatePatch(geometry, S, S, this.RhinoDocument.ModelAbsoluteTolerance);

    // Extract the main surface from it
    Surface simpleSurface = simplePatch.Faces[0] as Surface;

    // Now we can use that to generate the patch with all the input parameters:
    // https://developer.rhino3d.com/api/RhinoCommon/html/M_Rhino_Geometry_Brep_CreatePatch_1.htm
    Brep patch = Brep.CreatePatch(geometry, simpleSurface, S, S, T, false, pointSpacing, F, 0.01, fixEdges,
      this.RhinoDocument.ModelAbsoluteTolerance);

    // Output
    POut = patch;
# ---------- end gh_patch ----------
patch = Patch(Curves=crv_11, Points=pt_5, Spans=number_slider_2, Flexibility=number_slider_3, Trim=toggle)
panel_13 = Panel(patch)
panel_14 = Panel(gh_patch.POut)

# ---- group: Pipe
crv_12 = Curve(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)
number_slider_4 = Slider(1, range=0..10)
number_slider_5 = Slider(1, range=0..2)
gh_pipe = CSharpScript(C=crv_12, R=number_slider_4, E=number_slider_5)  # -> out, P; inputs C: Curve, R: Double, E: Int32
# ---------- gh_pipe: C# ----------
    // Component written by @erinlinseyhunt

    // Casting to PipeCapMode
    PipeCapMode pcm = (PipeCapMode) E;

    // Creating a Pipe
    P = Brep.CreatePipe(C, R, true, pcm, true, this.RhinoDocument.ModelAbsoluteTolerance, this.RhinoDocument.ModelAngleToleranceRadians);
# ---------- end gh_pipe ----------
pipe = Pipe(Curve=crv_12, Radius=number_slider_4, Caps=number_slider_5)
panel_15 = Panel(pipe)
panel_16 = Panel(gh_pipe.P)

# ---- group: Sweep1
crv_13 = Curve(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)
crv_14 = Curve(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)
toggle_2 = BooleanToggle(False)
gh_swp1 = CSharpScript(R=crv_13, S=crv_14, M=toggle_2)  # -> out, Sout; inputs R: Curve, S: Curve, M: Boolean
# ---------- gh_swp1: C# ----------
    //Component written by @erinlinseyhunt

    //Creating a surface from a guide rail and a section curve.
    Brep[] a = Brep.CreateFromSweep(R, S, M, 0.1);

    //Output
    Sout = a;
# ---------- end gh_swp1 ----------
swp1 = Sweep1(Rail=crv_13, Sections=crv_14, Miter=toggle_2)
panel_17 = Panel(swp1)
panel_18 = Panel(gh_swp1.Sout)

# ---- group: Rail Revolution
crv_15 = Curve(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)
crv_16 = Curve(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)
line_2 = Line(Line((-0.9052572758, 2.262307137, 0), (-0.9052572758, 2.262307137, 3.845153002)))
toggle_3 = BooleanToggle(True)
gh_railrev = CSharpScript(P=crv_15, R=crv_16, A=line_2, S=toggle_3)  # -> out, SOut; inputs P: Curve, R: Curve, A: Line, S: Boolean
# ---------- gh_railrev: C# ----------
    //Component written by @erinlinseyhunt

    //Create a surface of revolution using a sweep rail.
    //Inputs defined: P- Profile Curve, R- Rail Curve, A- Rovolution Axis, S- Scale Height of Profile Curve
    NurbsSurface a = NurbsSurface.CreateRailRevolvedSurface(P, R, A, S);

    //Output
    SOut = a;
# ---------- end gh_railrev ----------
railrev = RailRevolution(Curve=crv_15, Rail=crv_16, Axis=line_2, Scale=toggle_3)
panel_19 = Panel(railrev)
panel_20 = Panel(gh_railrev.SOut)

# ---- group: Surface from Points
pt_6 = Point([Point(3.502195346, -2.194951084, 0), Point(-2.704732184, -2.194951084, 0), Point(1.235859161, 2.304070851, 0), Point(-4.433958533, 2.304070851, 0)])
number_slider_6 = Slider(2, range=0..2)
gh_srf_grid = CSharpScript(P=pt_6, U=number_slider_6)  # -> out, S; inputs P: list of Point3d, U: Int32
# ---------- gh_srf_grid: C# ----------
    //Component written by @erinlinseyhunt

    //Create a nurbs suface from a grid of points.
    NurbsSurface a = NurbsSurface.CreateFromPoints(P, U, U, U, U);

    //Output
    S = a;
# ---------- end gh_srf_grid ----------
srfgrid = SurfaceFromPoints(Points=pt_6, UCount=number_slider_6, Interpolate=False)
panel_21 = Panel(srfgrid)
panel_22 = Panel(gh_srf_grid.S)

# ---- group: Control Point Loft
crv_17 = Curve([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])
crv_18 = Curve([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])
number_slider_7 = Slider(2, range=0..10)
gh_cploft = CSharpScript(C=crv_17, D=number_slider_7)  # -> out, S; inputs C: list of Curve, D: Int32
# ---------- gh_cploft: C# ----------
    // Convert Curves to NurbsCurves to access their control points.
    List<NurbsCurve> curves = new List<NurbsCurve>();
    foreach (Curve c in C)
    {
      curves.Add(c.ToNurbsCurve());
    }

    // Figure out the curve with the max number of control points
    int maxCPCount = -1;
    foreach(NurbsCurve crv in curves)
    {
      if (maxCPCount < crv.Points.Count)
      {
        maxCPCount = crv.Points.Count;
      }
    }

    // If any curve has less than those control points, rebuild it
    bool wasAnyCurveRebuilt = false;
    for (int i = 0; i < curves.Count; i++)
    {
      if (curves[i].Points.Count < maxCPCount)
      {
        curves[i].Rebuild(maxCPCount, curves[i].Degree, true);
        wasAnyCurveRebuilt = true;
      }
    }
    if (wasAnyCurveRebuilt == true)
    {
      this.Component.AddRuntimeMessage(GH_RuntimeMessageLevel.Warning, "The control-point count of at least one curve has to be increased.");
    }

    // Figure out the degree of the surface
    int degree = D;
    if (D > C.Count - 1)
    {
      this.Component.AddRuntimeMessage(GH_RuntimeMessageLevel.Warning, "Degree may not exceed the curve count - 1");
      degree = C.Count - 1;
    }
    if (degree < 2)
    {
      this.Component.AddRuntimeMessage(GH_RuntimeMessageLevel.Warning, "Degree must be at least 2");
      degree = 2;
    }

    // Extract control points from the curves
    List<Point3d> controlPoints = new List<Point3d>();
    foreach(NurbsCurve crv in curves)
    {
      foreach (ControlPoint cp in crv.Points)
      {
        controlPoints.Add(cp.Location);
      }
    }

    // Use them to create a surface
    NurbsSurface surface = NurbsSurface.CreateFromPoints(controlPoints, C.Count, maxCPCount, degree, curves[0].Degree);

    // Outputs
    S = surface;
# ---------- end gh_cploft ----------
cploft = ControlPointLoft(Curves=crv_17, Degree=number_slider_7)
panel_23 = Panel(cploft)
panel_24 = Panel(gh_cploft.S)

# ---- group: Fit Loft
crv_19 = Curve([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])
number_slider_8 = Slider(3, range=0..10)
number_slider_9 = Slider(2, range=0..10)
number_slider_10 = Slider(3, range=0..10)
gh_fitloft = CSharpScript(C=crv_19, Nu=number_slider_8, Du=number_slider_9, Dv=number_slider_10)  # -> out, S; inputs C: list of Curve, Nu: Int32, Du: Int32, Dv: Int32
# ---------- gh_fitloft: C# ----------
    // Component written by @garciadelcastillo

    // This component lofts a surface through a set of rebuilt curves (?)
    this.Component.AddRuntimeMessage(GH_RuntimeMessageLevel.Warning, "Output differs from original");

    // Rebuild the curves
    List<NurbsCurve> curves = new List<NurbsCurve>();
    foreach (Curve c in C)
    {
      NurbsCurve rebuilt = c.Rebuild(Nu, Du, true);
      curves.Add(rebuilt);
    }

    // Extract control points from the curves
    List<Point3d> controlPoints = new List<Point3d>();
    foreach(NurbsCurve crv in curves)
    {
      foreach (ControlPoint cp in crv.Points)
      {
        controlPoints.Add(cp.Location);
      }
    }

    // Use them to create a surface
    NurbsSurface surface = NurbsSurface.CreateFromPoints(controlPoints, curves.Count, Nu, Dv, Du);

    // Outputs
    S = surface;
# ---------- end gh_fitloft ----------
fitloft = FitLoft(Curves=crv_19, CountU=number_slider_8, DegreeU=number_slider_9, DegreeV=number_slider_10)
panel_25 = Panel(fitloft)
panel_26 = Panel(gh_fitloft.S)

# ---- group: Loft Options
# NOTE: if GH# component doesn't work, see code for managed assembly notes.
toggle_4 = BooleanToggle(False)
toggle_5 = BooleanToggle(True)
number_slider_11 = Slider(0, range=0..10)
number_slider_12 = Slider(0, range=0..1)
number_slider_13 = Slider(0, range=0..5)
gh_loft_opt = CSharpScript(
    Cls=toggle_4,
    Adj=toggle_5,
    Rbd=number_slider_11,
    Rft=number_slider_12,
    T=number_slider_13,
    Reference="C:\Program Files\Rhino 7\Plug-ins\Grasshopper\Components\SurfaceComponents.gha")  # -> out, O; inputs Cls: Boolean, Adj: Boolean, Rbd: Int32, Rft: Double, T: Int32
# ---------- gh_loft_opt: C# usings ----------
using SurfaceComponents.SurfaceComponents;
# ---------- gh_loft_opt: C# ----------
    // Component written by @garciadelcastillo

    // NOTE:
    // This component uses the LoftOptions class, which is not part of RhinoCommon / Grasshopper SDK.
    // You need to load it manually load the assembly that contains it by right clicking
    // on the C# script component > Manage Assemblies... > and add a reference to your
    // Grasshopper's "SurfaceComponents.gha" file, typically found on:
    // "C:\Program Files\Rhino 7\Plug-ins\Grasshopper\Components\SurfaceComponents.gha"

    // Create an instance of a LoftOptions class
    LoftOptions options = new LoftOptions();

    // Fill in with the input data
    options.ClosedLoft = Cls;
    options.AdjustSeams = Adj;
    options.LoftType = (LoftType) T;
    if (Rbd > 0)
    {
      options.LoftFit = LoftSimplify.Rebuild;
      options.RebuildCount = Rbd;
    }
    else if (Rft > 0)
    {
      options.LoftFit = LoftSimplify.Refit;
      options.RefitTolerance = Rft;
    }
    
    // Outputs
    O = options;
# ---------- end gh_loft_opt ----------
loft_opt = LoftOptions(Closed=toggle_4, Adjust=toggle_5, Rebuild=number_slider_11, Refit=number_slider_12, Type=number_slider_13)
panel_27 = Panel(loft_opt)
panel_28 = Panel(gh_loft_opt.O)

# ---- group: Loft
# NOTE: if GH# component doesn't work, see code for managed assembly notes.
crv_20 = Curve([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])
O = Options(gh_loft_opt.O)
gh_loft = CSharpScript(C=crv_20, O=O, Reference="C:\Program Files\Rhino 7\Plug-ins\Grasshopper\Components\SurfaceComponents.gha")  # -> out, L; inputs C: list of Curve
# ---------- gh_loft: C# ----------
    // Component written by @erinlinseyhunt & @garciadelcastillo
    
    // This component creates a loft surface through a list of curves. 
    
    // The code below is trying to account por all possible loft creation options, 
    // mimicking the original, and hence a little long. 
    // If you only care about creating a simple Loft surface, you can do so like this:
    
    // Brep[] loft = Brep.CreateFromLoft(C, Point3d.Unset, Point3d.Unset, LoftType.Normal, false);
    // L = loft;
    
    // If you want the complete set of options (and a little GH data handling), keep going :)

    
    // NOTE:
    // This component uses the LoftOptions class, which is not part of RhinoCommon / Grasshopper SDK.
    // You need to load it manually load the assembly that contains it by right clicking
    // on the C# script component > Manage Assemblies... > and add a reference to your
    // Grasshopper's "SurfaceComponents.gha" file, typically found on:
    //    "C:\Program Files\Rhino 7\Plug-ins\Grasshopper\Components\SurfaceComponents.gha"

    // Similarly, GH Script components take input IGH_Goo elements and cast them
    // to a "script-safe" type before being usable inside the script.
    // In our case, the input LoftOptions object becomes stringified...
    // For this reason, we have to use some workarounds to retrieve the object
    // before it is automatically converted to a string by the Script component.
    // (see https://discourse.mcneel.com/t/access-gh-transform-type-from-c-script-component/93484)
    LoftOptions options = null;
    GH_Structure<IGH_Goo> volatileData = this.Component.Params.Input[1].VolatileData as GH_Structure<IGH_Goo>;
    foreach (IGH_Goo item in volatileData)
    {
      options = item as LoftOptions;
      if (options == null)
      {
        this.Component.AddRuntimeMessage(GH_RuntimeMessageLevel.Error, "Make sure to provide a LoftOptions input object.");
        return;
      }
    }

    // Before lofting, let's adjust the seams by aligning the start points of the curves
    if (options.AdjustSeams)
    {
      Curve first = C[0];
      Point3d lastPt = first.PointAtStart;
      Vector3d lastVec = first.TangentAtStart;

      for (int i = 1; i < C.Count; i++)
      {
        Curve curve = C[i];

        if (curve.IsClosed)
        {
          // If curve is closed, align starting seam to closest point
          double t;
          curve.ClosestPoint(lastPt, out t);
          Point3d closestPoint = curve.PointAt(t);
          Vector3d closestTangent = curve.TangentAt(t);
          curve.ChangeClosedCurveSeam(t);

          // If the internal direction of the curve is different, reverse it.
          // Comparison returns -1 when anti-parallel
          int parallelType = lastVec.IsParallelTo(closestTangent, 0.5 * Math.PI);
          if (parallelType == -1)
          {
            curve.Reverse();
          }
        }
        else
        {
          // If curve is flipped, reverse it
          if (lastPt.DistanceTo(curve.PointAtEnd) < lastPt.DistanceTo(curve.PointAtStart))
          {
            curve.Reverse();
          }
        }

        // Use info from this curve for next iteration
        lastPt = curve.PointAtStart;
        lastVec = curve.TangentAtStart;
      }

    }

    // Now, let's get lofting!


    // Create a loft based on the type and parameters specified in options
    Brep[] loft = null;
    if (options.LoftFit == LoftSimplify.None)
    {
      loft = Brep.CreateFromLoft(C, Point3d.Unset, Point3d.Unset, options.LoftType, options.ClosedLoft);
    }
    else if (options.LoftFit == LoftSimplify.Rebuild)
    {
      loft = Brep.CreateFromLoftRebuild(C, Point3d.Unset, Point3d.Unset, options.LoftType, options.ClosedLoft, options.RebuildCount);
    }
    else if (options.LoftFit == LoftSimplify.Refit)
    {
      loft = Brep.CreateFromLoftRefit(C, Point3d.Unset, Point3d.Unset, options.LoftType, options.ClosedLoft, options.RefitTolerance);
    }

    // Outputs
    L = loft;
# ---------- end gh_loft ----------
loft = Loft(Curves=crv_20, Options=O)
panel_29 = Panel(loft)
panel_30 = Panel(gh_loft.L)

# ---- group: Ruled Surface
crv_21 = Curve(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)
crv_22 = Curve(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)
gh_rulesrf = CSharpScript(A=crv_21, B=crv_22)  # -> out, S; inputs A: Curve, B: Curve
# ---------- gh_rulesrf: C# ----------
    //Component written by @erinlinseyhunt

    //Creates a surface between two curves.
    NurbsSurface a = NurbsSurface.CreateRuledSurface(A, B);

    //Output
    S = a;
# ---------- end gh_rulesrf ----------
rulesrf = RuledSurface(CurveA=crv_21, CurveB=crv_22)
panel_31 = Panel(rulesrf)
panel_32 = Panel(gh_rulesrf.S)

# ---- group: Extrude Along
crv_23 = Curve(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)
srf = Surface(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)
brep = Brep(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)
crv_24 = Curve(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)
gh_extrcrv = CSharpScript(B=srf, C=crv_24)  # -> out, E; inputs B: GeometryBase, C: Curve
# ---------- gh_extrcrv: C# ----------
    // Component written by @garciadelcastillo

    // This component extrudes curves and breps along a rail curve.

    // Try if this object is a Curve
    Curve curve = B as Curve;
    if (curve != null)
    {
      // If curve, extrude it along the rail curve using SumSurface
      SumSurface sum = SumSurface.Create(curve, C);

      // Output
      E = sum;

      // Stop executing this component
      return;
    }

    // Try if input is Brep
    Brep brep = B as Brep;
    if (brep != null)
    {
      // If brep, extrude each one of its edges
      List<Brep> extrusions = new List<Brep>();
      foreach(BrepEdge edge in brep.Edges)
      {
        Curve edgeCrv = edge as Curve;
        SumSurface sum = SumSurface.Create(edgeCrv, C);
        extrusions.Add(sum.ToBrep());
      }

      // Add "caps": a copy of the original brep, and another one
      // translated to the end of the curve
      Brep startCap = brep.DuplicateBrep();
      extrusions.Add(startCap);

      Brep endCap = brep.DuplicateBrep();
      Vector3d translationVector = C.PointAtEnd - C.PointAtStart;
      endCap.Translate(translationVector);
      extrusions.Add(endCap);

      // Now try to join them in one single brep
      Brep[] joint = Brep.JoinBreps(extrusions, this.RhinoDocument.ModelAbsoluteTolerance);

      // Sanity
      if (joint.Length > 1)
      {
        E = brep;  // output
        this.Component.AddRuntimeMessage(GH_RuntimeMessageLevel.Error, "Brep extrusion resulted in disjoint fragment");
        return;
      }

      // Output
      E = joint;
    }
# ---------- end gh_extrcrv ----------
extrcrv = ExtrudeAlong(Base=srf, Curve=crv_24)
panel_33 = Panel(extrcrv)
panel_34 = Panel(gh_extrcrv.E)

# ---- group: Extrude Point
crv_25 = Curve(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)
srf_2 = Surface(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)
brep_2 = Brep(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)
pt_7 = Point(Point(0, 0, 15.36996932))
gh_extr_2 = CSharpScript(B=crv_25, P=pt_7)  # -> out, E; inputs B: GeometryBase, P: Point3d
# ---------- gh_extr_2: C# ----------
    // Component written by @erinlinseyhunt & @garciadelcastillo

    // This component extrudes curves and breps to a point.

    // Try if this object is a Curve
    Curve curve = B as Curve;
    if (curve != null)
    {
      // If curve, extrude it to a point
      Surface surf = Surface.CreateExtrusionToPoint(curve, P);

      // Output
      E = surf.ToBrep();

      // Stop executing this component
      return;
    }

    // Try if input is Brep
    Brep brep = B as Brep;
    if (brep != null)
    {
      // If brep, extrude each one of its edges
      List<Brep> extrusions = new List<Brep>();
      foreach(BrepEdge edge in brep.Edges)
      {
        Curve edgeCrv = edge as Curve;
        Surface surf = Surface.CreateExtrusionToPoint(edgeCrv, P);
        extrusions.Add(surf.ToBrep());
      }

      // Add "caps": a copy of the original brep at the base
      Brep startCap = brep.DuplicateBrep();
      extrusions.Add(startCap);

      // Now try to join them in one single brep
      Brep[] joint = Brep.JoinBreps(extrusions, this.RhinoDocument.ModelAbsoluteTolerance);

      // Sanity
      if (joint.Length > 1)
      {
        E = brep;  // output
        return;
      }

      // Output
      E = joint;
    }
# ---------- end gh_extr_2 ----------
extr_2 = ExtrudePoint(Base=crv_25, Point=pt_7)
panel_35 = Panel(extr_2)
panel_36 = Panel(gh_extr_2.E)

# ---- group: Fragment Patch
crv_26 = Curve(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)
crv_27 = Curve(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)
crv_28 = Curve(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)
gh_fpatch = CSharpScript(B=crv_26)  # -> out, P; inputs B: Curve
# ---------- gh_fpatch: C# ----------
    
    // Is input a Polyline curve?
    Polyline poly = null;
    bool isPoly = B.TryGetPolyline(out poly);
    if (isPoly == false)
    {
      this.Component.AddRuntimeMessage(GH_RuntimeMessageLevel.Error, "Boundary must be a polyline.");
      return;
    }
    
    // If the polyline is open, close it
    if (poly.IsClosed == false)
    {
      this.Component.AddRuntimeMessage(GH_RuntimeMessageLevel.Warning, "Boundary should be closed.");
      poly.Add(poly[0]);
    }
    
    // Create fragment patch as a list of mesh faces
    MeshFace[] faces = poly.TriangulateClosedPolyline();
    
    // Now turn each one of them into a Brep
    List<Brep> breps = new List<Brep>();
    foreach (MeshFace face in faces)
    {
      Point3d p0 = poly[face.A];
      Point3d p1 = poly[face.B];
      Point3d p2 = poly[face.C];
      Brep b = Brep.CreateFromCornerPoints(p0, p1, p2, this.RhinoDocument.ModelAbsoluteTolerance);
      breps.Add(b);
    }
    
    // Try to join them into a single brep
    Brep[] joint = Brep.JoinBreps(breps, this.RhinoDocument.ModelAbsoluteTolerance);
    
    if (joint.Length != 1)
    {
      this.Component.AddRuntimeMessage(GH_RuntimeMessageLevel.Warning, "Something went wrong?");
    }
    
    // Outputs
    P = joint;
# ---------- end gh_fpatch ----------
fpatch = FragmentPatch(Boundary=crv_26)
panel_37 = Panel(fpatch)
panel_38 = Panel(gh_fpatch.P)

# ---- group: Pipe Variable
crv_29 = Curve(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)
genes = GenePool(Decimals=2, Maximum=1, Minimum=0, Value=[0, 0.5, 1])
genes_2 = GenePool(Decimals=2, Maximum=1, Minimum=0, Value=[1, 0.45, 1])
caps = Slider(2, range=0..2)
gh_vpipe = CSharpScript(C=crv_29, t=genes, R=genes_2, E=caps)  # -> out, P; inputs C: Curve, t: list of Double, R: list of Double, E: Int32
# ---------- gh_vpipe: C# ----------
    // Component written by @garciadelcastillo
    
    // This component creates a pipe with variable thicknesses.
    
    // Let's crunch a few numbers first.
    // Figure out pipe cap mode
    PipeCapMode cap = (PipeCapMode) E;
    
    // The Pipe method takes normalized domain parameters, 
    // whereas the vanilla component treats them as absolute parameter values.
    // So, we need to normalize them, before feeding them to the method.
    Interval domain = C.Domain;
    List<double> normParams = new List<double>();
    foreach (double p in t)
    {
      double n = domain.NormalizedParameterAt(p);
      normParams.Add(n);
    }
    
    // We are ready to create the pipe  
    Brep[] pipe = Brep.CreatePipe(C, normParams, R, true, cap, false,
      this.RhinoDocument.ModelAbsoluteTolerance, this.RhinoDocument.ModelAngleToleranceRadians);

    // Ouptuts
    P = pipe;
# ---------- end gh_vpipe ----------
vpipe = PipeVariable(Curve=crv_29, Parameters=genes, Radii=genes_2, Caps=caps)
panel_39 = Panel(vpipe)
panel_40 = Panel(gh_vpipe.P)

# ---- group: Sweep2
crv_30 = Curve(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)
crv_31 = Curve(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)
crv_32 = Curve(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)
toggle_6 = BooleanToggle(False)
gh_swp2 = CSharpScript(R1=crv_30, R2=crv_31, S=crv_32, H=toggle_6)  # -> out, Sout; inputs R1: Curve, R2: Curve, S: Curve, H: Boolean
# ---------- gh_swp2: C# ----------
    //Component written by @erinlinseyhunt

    //Creating a surface from two guide rails and a section curve.
    //If H is true, it creates a sweep with the same-height properties.
    Brep[] a = Brep.CreateFromSweep(R1, R2, S, H, 0.1);

    //Output
    Sout = a;
# ---------- end gh_swp2 ----------
swp2 = Sweep2(Rail1=crv_30, Rail2=crv_31, Sections=crv_32, SameHeight=toggle_6)
panel_41 = Panel(swp2)
panel_42 = Panel(gh_swp2.Sout)

# ---- group: Revolution
crv_33 = Curve(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)
line_3 = Line(Line((-0.0149407726, -0.1708126088, 0), (-0.0149407726, -0.1708126088, 11.22436453)))
gh_revsrf = CSharpScript(P=crv_33, A=line_3, D="0 To 2 * Pi")  # -> out, S; inputs P: Curve, A: Line
# ---------- gh_revsrf: C# ----------
    //Component written by @erinlinseyhunt

    //Creates a surface of revolution using a profile (curve), a revolution axis (line), and a domain start and end.
    Surface a = RevSurface.Create(P, A, D.T0, D.T1);

      //Output
      S = a;
# ---------- end gh_revsrf ----------
revsrf = Revolution(Curve=crv_33, Axis=line_3, Domain="0 To 2 * Pi")
panel_43 = Panel(revsrf)
panel_44 = Panel(gh_revsrf.S)
