# Grasshopper definition Mesh_Analysis.ghx (Grasshopper 1.0.7)

# ----
# Mesh Analysis
face = MeshFace({A=8, B=86, C=81, D=81})
face_2 = MeshFace({A=0, B=1, C=3, D=2})
gh_deface = CSharpScript(F=face)  # -> out, A, B, C, D
# ---------- gh_deface: C# ----------
    // Component written by @garciadelcastillo

    // This component outputs the indices of each vertex from the input face.

    // Since inputs on C# script components don't have the MeshFace type option,
    // we need to manually cast the input.
    try {
      MeshFace mf = (MeshFace) F;

      // Face indices are properties of any MeshFace object
      A = mf.A;
      B = mf.B;
      C = mf.C;
      D = mf.D;
    }
    catch {
      Component.AddRuntimeMessage(GH_RuntimeMessageLevel.Error, "Data conversion to MeshFace failed");
    }
# ---------- end gh_deface ----------
# GH#: A C# dictionary of Grasshopper3D components.
# 
# This file contains a category of Grasshopper components, and a mirroring C#/RhinoCommon implementation.
# 
# This is an educational project initiated by students/faculty of GSD-6338: Introduction to Computational Design, at the Harvard Graduate School of Design.
# 
# More information: {{project link}}
deface = DeconstructFace(Face=face)  # -> CornerA, CornerB, CornerC, CornerD
panel = Panel(deface.CornerA)
panel_2 = Panel(deface.CornerB)
panel_3 = Panel(deface.CornerC)
panel_4 = Panel(deface.CornerD)
panel_5 = Panel(gh_deface.A)
panel_6 = Panel(gh_deface.B)
panel_7 = Panel(gh_deface.C)
panel_8 = Panel(gh_deface.D)

mesh = Mesh(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)
gh_demesh = CSharpScript(M=mesh)  # -> out, V, F, C, N; inputs M: Mesh
# ---------- gh_demesh: C# ----------
    // Component written by @garciadelcastillo

    // This component outputs relevant mesh information, such as
    // vertices, faces, vertex color and vertex normals.
    // Most of this information is avaliable as collections inside
    // the Mesh class, so it can be output directly.
    V = M.Vertices;
    F = M.Faces;
    C = M.VertexColors;
    N = M.Normals;
# ---------- end gh_demesh ----------
demesh = DeconstructMesh(Mesh=mesh)  # -> Vertices, Faces, Colours, Normals
mesh_vertices = Panel(demesh.Vertices)
mesh_vertices_2 = Panel(gh_demesh.V)
mesh_faces = Panel(demesh.Faces)
mesh_faces_2 = Panel(gh_demesh.F)
mesh_vertex_colors = Panel(demesh.Colours)
mesh_vertex_colors_2 = Panel(gh_demesh.C)
mesh_vertex_normals = Panel(demesh.Normals)
mesh_vertex_normals_2 = Panel(gh_demesh.N)

mesh_2 = Mesh(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)
gh_facen = CSharpScript(M=mesh_2)  # -> out, C, N; inputs M: Mesh
# ---------- gh_facen: C# ----------
    // Component written by @garciadelcastillo

    // This component outputs relevant MeshFace information,
    // such as the face center and normal.

    // Create an array with all face centers.
    Point3d[] centers = new Point3d[M.Faces.Count];
    for (int i = 0; i < M.Faces.Count; i++) {
      Point3d center = M.Faces.GetFaceCenter(i);
      centers[i] = center;
    }

    // Meshes may not contain face normal information.
    // If it isn't available, compute it.
    if (M.FaceNormals.Count != M.Faces.Count) {
      M.FaceNormals.ComputeFaceNormals();
    }

    // Outputs
    C = centers;
    N = M.FaceNormals;
# ---------- end gh_facen ----------
facen = FaceNormals(Mesh=mesh_2)  # -> Centers, Normals
face_centers = Panel(gh_facen.C)
face_centers_2 = Panel(facen.Centers)
face_normals = Panel(gh_facen.N)
face_normals_2 = Panel(facen.Normals)

mesh_3 = Mesh(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)
gh_medges = CSharpScript(M=mesh_3)  # -> out, E1, E2, E3; inputs M: Mesh
# ---------- gh_medges: C# ----------
    // Component written by @garciadelcastillo

    // This component outputs mesh edges as lines,
    // split in three lists based on their topology.
    
    // Let's create three lists to store each edge collection.
    List<Line> nakedEdges = new List<Line>();         // "boundary" edges
    List<Line> interiorEdges = new List<Line>();      // regular edges on a surface-like mesh
    List<Line> nonManifoldEdges = new List<Line>();   // edges with more than two neighbours, forming a non-orientable joint

    // The MeshTopologyEdgeList class contains a lot of info about edge connectivity.
    Rhino.Geometry.Collections.MeshTopologyEdgeList topoEdges = M.TopologyEdges;

    // Check each edge on the MeshTopologyEdgeList.
    for (int i = 0; i < topoEdges.Count; i++) {
      // Get a Line representation of the edge.
      Line edge = topoEdges.EdgeLine(i);
      
      // Query how many adjacent faces it has.
      int[] connectedFaces = topoEdges.GetConnectedFaces(i);
      int connectedCount = connectedFaces.Length;

      // Depending on the adjacency count (valence), send it to each list.
      // 0 is not accounted for, as edges without adjacent faces are not valid.
      if (connectedCount == 1) {
        nakedEdges.Add(edge);
      } else if (connectedCount == 2) {
        interiorEdges.Add(edge);
      } else if (connectedCount > 2) {
        nonManifoldEdges.Add(edge);
      }
    }

    // Outputs
    E1 = nakedEdges;
    E2 = interiorEdges;
    E3 = nonManifoldEdges;
# ---------- end gh_medges ----------
medges = MeshEdges(Mesh=mesh_3)  # -> NakedEdges, InteriorEdges, NonManifoldEdges
naked_edges = Panel(medges.NakedEdges)
naked_edges_2 = Panel(gh_medges.E1)
interior_edges = Panel(gh_medges.E2)
interior_edges_2 = Panel(medges.InteriorEdges)
non_manifold_edges = Panel(gh_medges.E3)
non_manifold_edges_2 = Panel(medges.NonManifoldEdges)

mesh_4 = Mesh(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)
faceb = FaceBoundaries(Mesh=mesh_4)
gh_faceb = CSharpScript(M=mesh_4)  # -> out, B; inputs M: tree of Mesh
# ---------- gh_faceb: C# ----------
    // Component written by @garciadelcastillo

    // This component outputs a Polyline representation of the boundary
    // of each face on the mesh.

    // The output will be a DataTree, with an additional level for each input mesh.
    DataTree<Polyline> boundaries = new DataTree<Polyline>();

    // Iterate over all the branches on the input DataTree.
    for (int k = 0; k < M.BranchCount; k++) {
      List<Mesh> branchMeshes = M.Branches[k];
      GH_Path branchPath = M.Paths[k];
      
      // Iterate over all the meshes in each branch.
      for (int j = 0; j < branchMeshes.Count; j++) {
        Mesh mesh = branchMeshes[j];
        GH_Path meshPath = branchPath.AppendElement(j);

        // Iterate over all the faces of each mesh.
        for (int i = 0; i < mesh.Faces.Count; i++) {
          MeshFace face = mesh.Faces[i];
          
          // Create an empty polyline, and add all the vertices of this face.
          // Remember that faces are composed of vertex indices, so we need to use
          // those to retrieve the vertices from the mesh.
          Polyline pol = new Polyline();
          pol.Add(mesh.Vertices[face.A]);
          pol.Add(mesh.Vertices[face.B]);
          pol.Add(mesh.Vertices[face.C]);
          if (face.IsQuad) {
            pol.Add(mesh.Vertices[face.D]);
          }
          // Double on the first vertex for a closed Polyline.
          pol.Add(mesh.Vertices[face.A]);

          // Store this Polyline on the right path of the DataTree
          boundaries.Add(pol, meshPath);
        }
      }
    }

    // Outputs
    B = boundaries;
# ---------- end gh_faceb ----------
face_polylines = Panel(gh_faceb.B)
face_polylines_2 = Panel(faceb)

mesh_5 = Mesh(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)
mesh_6 = Mesh(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)
gh_faceb_2 = CSharpScript(M=mesh_5)  # -> out, C, R; inputs M: tree of Mesh
# ---------- gh_faceb_2: C# ----------
    // Component written by @garciadelcastillo

    // This component outputs a Circle circumscribing the vertices of each face
    // of the input meshes and corresponding radius.
    // Works only for triangular faces, as four points will likely not form a circle
    // (if not co-planar, they define a sphere instead).

    // The output will be a DataTree, with an additional level for each input mesh.
    DataTree<object> circles = new DataTree<object>();   // Circle is non-nullable, so we use `object` here to accept `null` ouptuts
    DataTree<double?> ratios = new DataTree<double?>();  // primitives (like double) are also non-nullable; the `?` turns it into a nullable type

    // Iterate over all the branches on the input DataTree.
    for (int k = 0; k < M.BranchCount; k++) {
      List<Mesh> branchMeshes = M.Branches[k];
      GH_Path branchPath = M.Paths[k];

      // Iterate over all the meshes in each branch.
      for (int j = 0; j < branchMeshes.Count; j++) {
        Mesh mesh = branchMeshes[j];
        GH_Path meshPath = branchPath.AppendElement(j);

        // Iterate over all the faces of each mesh.
        for (int i = 0; i < mesh.Faces.Count; i++) {
          MeshFace face = mesh.Faces[i];

          // Initialize two nullable variables
          object c = null;
          double? r = null;

          // If face is not a quad, compute circle and ratio
          if (face.IsTriangle) {
            c = new Circle(
              mesh.Vertices[face.A],
              mesh.Vertices[face.B],
              mesh.Vertices[face.C]);

            // Use custom function to compute the MeshFace height/longest-edge ratio
            r = ComputeTriangleRatio(mesh, i);
          }

          // Add them to the output DataTrees
          circles.Add(c, meshPath);
          ratios.Add(r, meshPath);
        }
      }
    }

    // Outputs
    C = circles;
    R = ratios;
# ---------- gh_faceb_2: C# additional code ----------
  // Given a mesh and the index of the MeshFace to analyxe, this function
  // returns the height/longest-edge ratio.
  double ComputeTriangleRatio(Mesh mesh, int faceIndex) {
    // Retrieve MeshFace and vertices
    MeshFace face = mesh.Faces[faceIndex];
    Point3d A = mesh.Vertices[face.A];
    Point3d B = mesh.Vertices[face.B];
    Point3d C = mesh.Vertices[face.C];

    // Compute lengths of triangle sides
    double a = A.DistanceTo(B);
    double b = B.DistanceTo(C);
    double c = C.DistanceTo(A);

    // Use Heron's formula to calculate the area of the triangle.
    // https://en.wikipedia.org/wiki/Heron%27s_formula
    double s = 0.5 * (a + b + c);  // semi-perimeter
    double area = Math.Sqrt(s * (s - a) * (s - b) * (s - c));

    // Figure out which side in longer, and compute ratio.
    // If the area of a triangle is A = b * h / 2,
    // solve for h with the longest side.
    double height = 0;
    double ratio = 0;
    if (a > b && a > c) {
      height = 2 * area / a;
      ratio = height / a;     // this could have been simplified to ratio = 2 * area / (a * a), left here for clarity
    }
    else if (b > c && b > a) {
      height = 2 * area / b;
      ratio = height / b;
    }
    else {
      height = 2 * area / c;
      ratio = height / c;
    }

    return ratio;
  }
# ---------- end gh_faceb_2 ----------
facec = FaceCircles(Mesh=mesh_5)  # -> Centers, Ratio
circumscribed_circles = Panel(facec.Centers)
circumscribed_circles_2 = Panel(gh_faceb_2.C)
face_ratios = Panel(facec.Ratio)
face_ratios_2 = Panel(gh_faceb_2.R)

strict = BooleanToggle(True)
mesh_7 = Mesh(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)
mesh_8 = Mesh(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)
mesh_9 = Mesh(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)
pt = Point([Point(0.5, 0.5, 0.5), Point(1, 0, 0), Point(1, 0, 1)])
minc = MeshInclusion(Mesh=mesh_7, Point=pt, Strict=strict)
gh_minc = CSharpScript(M=mesh_7, P=pt, S=strict)  # -> out, I; inputs M: Mesh, P: Point3d, S: Boolean
# ---------- gh_minc: C# ----------
    // Component written by @garciadelcastillo

    // This component tests points for containment on a Mesh.

    // Sanity check, perform only for closed meshes.
    if (!M.IsClosed) {
      I = false;
      return;
    }

    // Compute containment check for Point3d in Mesh
    // (estimating 0.001 as tolerance, value used by GH component is unknown).
    bool isInside = M.IsPointInside(P, 0.001, S);

    // Outputs
    I = isInside;
# ---------- end gh_minc ----------
is_inside = Panel(minc)
is_inside_2 = Panel(gh_minc.I)

pt_2 = Point([Point(0.5, 0.5, 0.5), Point(1, 0, 0), Point(1, 0, 1), Point(0.4238440531, 0.3363536785, 0), Point(1.352593681, 1.583233967, 0), Point(1.352593681, 1.583233967, 1.235884781)])
mesh_10 = Mesh(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)
gh_meshcp = CSharpScript(Pt=pt_2, M=mesh_10)  # -> out, P, I, Pm, Mp; inputs Pt: Point3d, M: Mesh
# ---------- gh_meshcp: C# ----------
    // Component written by @garciadelcastillo

    // This component takes a Point3d, finds its closest Point3d on a Mesh,
    // and outputs related information.

    // Using `Mesh.ClosestMeshPoint` gives us more information that
    // using `Mesh.ClosestPoint` instead.
    MeshPoint mp = M.ClosestMeshPoint(Pt, 0.0);

    // Pick relevant information
    Point3d closestPoint = mp.Point;
    int faceIndex = mp.FaceIndex;

    // The `MeshParameter` type is not available in RhinoCommon:
    // https://discourse.mcneel.com/t/meshparameter-or-meshfaceparameter-classes/92223
    // Mimicquing a `MeshParameter` class by outputting a string with the same information,
    // derived from the MeshPoint class.
    double[] v = mp.T;
    string meshParamString = mp.FaceIndex + "["
      + String.Format("{0:0.000###}", v[0]) + ";"
      + String.Format("{0:0.000###}", v[1]) + ";"
      + String.Format("{0:0.000###}", v[2]) + ";"
      + String.Format("{0:0.000###}", v[3]) + "]";

    // Outputs
    P = closestPoint;
    I = faceIndex;
    Pm = meshParamString;
    Mp = mp;  // output the MeshPoint object as well, to be used for MEval
# ---------- end gh_meshcp ----------
meshcp = MeshClosestPoint(Point=pt_2, Mesh=mesh_10)  # -> Point, Index, Parameter
closest_point = Panel(gh_meshcp.P)
closest_point_2 = Panel(meshcp.Point)
face_index = Panel(meshcp.Index)
face_index_2 = Panel(gh_meshcp.I)
mesh_parameter = Panel(meshcp.Parameter)
mesh_parameter_2 = Panel(gh_meshcp.Pm)

data = Data(meshcp.Parameter)
mesh_11 = Mesh(mesh_10)
data_2 = Data(gh_meshcp.Mp)
gh_meval = CSharpScript(M=mesh_11, Mp=data_2)  # -> out, P, N, C; inputs M: Mesh
# ---------- gh_meval: C# ----------
    // Component written by @garciadelcastillo

    // This component evaluates a Mesh at a given MeshParameter,
    // and returns relevant information on that location.

    // The `MeshParameter` class is not available in RhinoCommon:
    // https://discourse.mcneel.com/t/meshparameter-or-meshfaceparameter-classes/92223
    // For this component, we will use the `MeshPoint` class instead,
    // which contains very similar information and functionality.
    MeshPoint mp = (MeshPoint) Mp;

    // Query the Mesh at the MeshPoint parameter
    Point3d pointAtParameter = M.PointAt(mp);
    Vector3d normalAtParameter = M.NormalAt(mp);
    System.Drawing.Color colorAtParameter = M.ColorAt(mp);

    // Outputs
    P = pointAtParameter;
    N = normalAtParameter;
    C = colorAtParameter;
# ---------- end gh_meval ----------
meval = MeshEval(Mesh=mesh_11, Parameter=data)  # -> Point, Normal, Colour
point = Panel(meval.Point)
point_2 = Panel(gh_meval.P)
normal = Panel(meval.Normal)
normal_2 = Panel(gh_meval.N)
color = Panel(meval.Colour)
color_2 = Panel(gh_meval.C)
