# Grasshopper definition Mesh_Primitive.ghx (Grasshopper 1.0.7)

# ----
# GH#: A C# dictionary of Grasshopper3D components.
# 
# This file contains a category of Grasshopper components, and a mirroring C#/RhinoCommon implementation.
# 
# This is an educational project initiated by students/faculty of GSD-6338: Introduction to Computational Design, at the Harvard Graduate School of Design.
# 
# More information: {{project link}}
# Mesh Primitive
pt = Point([Point(1, 1, 1), Point(1, 1, -1), Point(1, -1, 1), Point(1, -1, -1), Point(-1, 1, 1), Point(-1, 1, -1), Point(-1, -1, 1), Point(-1, -1, -1)])
face = MeshFace([{A=7, B=5, C=1, D=3}, {A=7, B=3, C=2, D=6}, {A=3, B=1, C=0, D=2}, {A=1, B=5, C=4, D=0}, {A=5, B=7, C=6, D=4}, {A=6, B=2, C=0, D=4}])
col = Colour([RGB(158, 85, 110), RGB(112, 65, 97), RGB(112, 65, 97), RGB(66, 44, 83), RGB(112, 65, 97), RGB(66, 44, 83), RGB(66, 44, 83), RGB(20, 24, 70)])
gh_conmesh = CSharpScript(V=pt, F=face, C=col)  # -> out, M; inputs V: list of Point3d, F: list, C: list of Color
# ---------- gh_conmesh: C# usings ----------
// Bring in the `System.Drawing` library so that we can use Color objects.
using System.Drawing;
# ---------- gh_conmesh: C# ----------
    // Component written by @garciadelcastillo

    // This component creates a Mesh from scratch, from a set of input
    // vertices, faces and vertex colors.

    // C# Script components cannot take MeshFace as inputs,
    // so use the generic `object` type and cast it to MeshFace objects.
    List<MeshFace> faces = new List<MeshFace>();
    try {
      for (int i = 0; i < F.Count; i++) {
        faces.Add((MeshFace) F[i]);
      }
    }
    catch {
      Component.AddRuntimeMessage(GH_RuntimeMessageLevel.Error, "Data conversion to MeshFace failed");
    }

    // Start an empty Mesh.
    Mesh m = new Mesh();

    // Add the vertices.
    m.Vertices.AddVertices(V);

    // Add the faces, making sure the vertex indices are within range.
    int maxI = V.Count - 1;
    for (int i = 0; i < faces.Count; i++) {
      MeshFace f = faces[i];
      if (f.A > maxI || f.B > maxI || f.C > maxI || f.D > maxI) {
        Component.AddRuntimeMessage(GH_RuntimeMessageLevel.Warning, "Face vertex exceeds mesh vertex count.");
      }
      else {
        m.Faces.AddFace(f);
      }
    }

    // Add vertex colors.
    for (int i = 0; i < C.Count; i++) {
      m.VertexColors.Add(C[i]);
    }

    // Outputs.
    M = m;
# ---------- end gh_conmesh ----------
conmesh = ConstructMesh(Vertices=pt, Faces=face, Colours=col)
mesh = Panel(conmesh)
mesh_2 = Panel(gh_conmesh.M)

panel = Panel("""Red
Green
Blue""")
mesh_3 = Mesh(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)
col_2 = Colour([RGB(255, 0, 0), RGB(0, 255, 0), RGB(0, 0, 255)])
gh_mcol = CSharpScript(Msh=mesh_3, C=col_2)  # -> out, M; inputs Msh: Mesh, C: list
# ---------- gh_mcol: C# ----------
    // Component written by @garciadelcastillo

    // This applies a list of input colors to the vertices of a Mesh.

    // Let's first try to parse the inputs based on whether if they are Color objects
    // or strings representing named colors.
    List<Color> colors = new List<Color>();
    for (int i = 0; i < C.Count; i++) {
      try {
        object c = C[i];
        // Is it a Color object?
        if (c is Color) {
          Color clr = (Color) c;
          colors.Add(clr);
        }
          // is it a string object?
        else if (c is string) {
          string name = (string) c;
          Color clr = Color.FromName(name);
          colors.Add(clr);
        }
      }
      catch {
        Component.AddRuntimeMessage(GH_RuntimeMessageLevel.Error, "Data conversion to Color failed");
      }
    }

    // Reset previous colors in the Mesh.
    Msh.VertexColors.Clear();

    // Apply colors sequentially to the Mesh, using the modulo
    // operator to wrap around the list
    int colorCount = colors.Count;
    for (int i = 0; i < Msh.Vertices.Count; i++) {
      int colorId = i % colorCount;
      Msh.VertexColors.Add(colors[colorId]);
    }

    // Outputs
    M = Msh;
# ---------- end gh_mcol ----------
mcol = MeshColours(Mesh=mesh_3, Colours=col_2)
mesh_4 = Panel(mcol)
mesh_5 = Panel(gh_mcol.M)

number_slider = Slider(2, range=0..10)
number_slider_2 = Slider(1, range=0..10)
number_slider_3 = Slider(3, range=0..10)
number_slider_4 = Slider(0, range=0..10)
gh_quad = CSharpScript(A=number_slider_3, B=number_slider, C=number_slider_2, D=number_slider_4)  # -> out, F; inputs A: Int32, B: Int32, C: Int32, D: Int32
# ---------- gh_quad: C# ----------
    // Component written by @garciadelcastillo

    // This component creates a quad MeshFace object given its four indices.
    MeshFace face = new MeshFace(A, B, C, D);
    
    // Outputs
    F = face;
# ---------- end gh_quad ----------
quad = MeshQuad(CornerA=number_slider_3, CornerB=number_slider, CornerC=number_slider_2, CornerD=number_slider_4)
mesh_face = Panel(quad)
mesh_face_2 = Panel(gh_quad.F)

number_slider_5 = Slider(1, range=0..10)
number_slider_6 = Slider(3, range=0..10)
number_slider_7 = Slider(2, range=0..10)
gh_triangle = CSharpScript(A=number_slider_6, B=number_slider_7, C=number_slider_5)  # -> out, F; inputs A: Int32, B: Int32, C: Int32
# ---------- gh_triangle: C# ----------
    // Component written by @garciadelcastillo

    // This component creates a tringle MeshFace object given its four indices.
    MeshFace face = new MeshFace(A, B, C);

    // Outputs
    F = face;
# ---------- end gh_triangle ----------
triangle = MeshTriangle(CornerA=number_slider_6, CornerB=number_slider_7, CornerC=number_slider_5)
mesh_face_3 = Panel(triangle)
mesh_face_4 = Panel(gh_triangle.F)

number_slider_8 = Slider(4, range=0..10)
number_slider_9 = Slider(3, range=0..10)
box = Box({Plane=Plane(origin=(6.511498572, 2.535932165, 2.759865345), x=(-0.4345616552, 0.7713427642, -0.4649586088), y=(-0.6045577157, -0.6324842021, -0.484224847)), X=Domain(-1, 1), Y=Domain(-1.5, 1.5), Z=Domain(-2, 2)})
number_slider_10 = Slider(2, range=0..10)
mbox = MeshBox(Base=box, XCount=number_slider_8, YCount=number_slider_9, ZCount=number_slider_10)
gh_mbox = CSharpScript(B=box, X=number_slider_8, Y=number_slider_9, Z=number_slider_10)  # -> out, F; inputs B: Box, X: Int32, Y: Int32, Z: Int32
# ---------- gh_mbox: C# ----------
    // Component written by @garciadelcastillo

    // This component creates a box-like Mesh.
    // This example was written before finding out the RhinoCommon way:
    //   Mesh mesh = Mesh.CreateFromBox(B, X, Y, Z);

    // Let's start with an empty Mesh:
    Mesh mesh = new Mesh();

    // Let's get the Box's main orientation Plane.
    Plane pl = B.Plane;

    // Let's calculate the quad dimensions on each direction.
    double dx = B.X.Length / X;
    double dy = B.Y.Length / Y;
    double dz = B.Z.Length / Z;

    // Bottom side
    Plane pl0 = new Plane();
    pl0.Origin = pl.PointAt(-0.5 * B.X.Length, -0.5 * B.Y.Length, -0.5 * B.Z.Length);
    pl0.XAxis = pl.YAxis;
    pl0.YAxis = pl.XAxis;
    AddGridToMesh(mesh, pl0, Y, dy, X, dx);

    // Front side
    Plane pl1 = new Plane();
    pl1.Origin = pl.PointAt(-0.5 * B.X.Length, -0.5 * B.Y.Length, -0.5 * B.Z.Length);
    pl1.XAxis = pl.XAxis;
    pl1.YAxis = pl.ZAxis;
    AddGridToMesh(mesh, pl1, X, dx, Z, dz);

    // Right side
    Plane pl2 = new Plane();
    pl2.Origin = pl.PointAt(0.5 * B.X.Length, -0.5 * B.Y.Length, -0.5 * B.Z.Length);
    pl2.XAxis = pl.YAxis;
    pl2.YAxis = pl.ZAxis;
    AddGridToMesh(mesh, pl2, Y, dy, Z, dz);

    // Back side
    Plane pl3 = new Plane();
    pl3.Origin = pl.PointAt(0.5 * B.X.Length, 0.5 * B.Y.Length, -0.5 * B.Z.Length);
    pl3.XAxis = -pl.XAxis;
    pl3.YAxis = pl.ZAxis;
    AddGridToMesh(mesh, pl3, X, dx, Z, dz);

    // Left side
    Plane pl4 = new Plane();
    pl4.Origin = pl.PointAt(-0.5 * B.X.Length, 0.5 * B.Y.Length, -0.5 * B.Z.Length);
    pl4.XAxis = -pl.YAxis;
    pl4.YAxis = pl.ZAxis;
    AddGridToMesh(mesh, pl4, Y, dy, Z, dz);

    // Top side
    Plane pl5 = new Plane();
    pl5.Origin = pl.PointAt(-0.5 * B.X.Length, -0.5 * B.Y.Length, 0.5 * B.Z.Length);
    pl5.XAxis = pl.XAxis;
    pl5.YAxis = pl.YAxis;
    AddGridToMesh(mesh, pl5, X, dx, Y, dy);

    F = mesh;
# ---------- gh_mbox: C# additional code ----------
  // This function takes a Mesh, and adds a planar grid of vertices+faces to it.
  // Takes the plane containing the grid, face count in each direction, and face dimensions.
  void AddGridToMesh(Mesh m, Plane pl, int facesX, double dx, int facesY, double dy) {
    // Read how many vertices the Mesh had before more are added.
    int vc = m.Vertices.Count;

    // Add new vertices.
    Point3d v;
    for (int j = 0; j <= facesY; j++) {
      for (int i = 0; i <= facesX; i++) {
        v = pl.PointAt(i * dx, j * dy);
        m.Vertices.Add(v);
      }
    }

    // Add new faces by matching vertices counter-clockwise based on their row/column indices.
    int a, b, c, d;
    for (int j = 0; j < facesY; j++) {
      for (int i = 0; i < facesX; i++) {
        a = vc + j * (facesX + 1) + i;
        b = a + 1;
        c = b + facesX + 1;
        d = c - 1;

        m.Faces.AddFace(a, b, c, d);
      }
    }
  }
# ---------- end gh_mbox ----------
mesh_6 = Panel(mbox)
mesh_7 = Panel(gh_mbox.F)

number_slider_11 = Slider(4, range=0..10)
rec = Rectangle({Plane=Plane(origin=(6.511498572, 2.535932165, 2.759865345), x=(-0.4345616552, 0.7713427642, -0.4649586088), y=(-0.6045577157, -0.6324842021, -0.484224847)), Size=Domain2(u=-1..1, v=-2..2)})
number_slider_12 = Slider(8, range=0..10)
mplane = MeshPlane(Boundary=rec, WidthCount=number_slider_11, HeightCount=number_slider_12)  # -> Mesh, Area
gh_mplane = CSharpScript(B=rec, W=number_slider_11, H=number_slider_12)  # -> out, M, A; inputs B: Rectangle3d, W: Int32, H: Int32
# ---------- gh_mplane: C# ----------
    // Component written by @garciadelcastillo

    // This component creates a plane-like Mesh.
    // This example was written before finding out the RhinoCommon way:
    //   Mesh mesh = Mesh.CreateFromPlane(B.Plane, B.X, B.Y, W, H);

    // Let's start with an empty Mesh:
    Mesh mesh = new Mesh();

    // Let's get the Rectangle's main orientation Plane.
    Plane pl = B.Plane;

    // Let's calculate the quad dimensions on each direction.
    double dx = B.X.Length / W;
    double dy = B.Y.Length / H;

    // Let's create a plane on the lower-left corner of the rectangle,
    // and use it as the main coordinate system to generate a planar mesh.
    Plane pl0 = new Plane();
    pl0.Origin = pl.PointAt(-0.5 * B.X.Length, -0.5 * B.Y.Length, 0);
    pl0.XAxis = pl.XAxis;
    pl0.YAxis = pl.YAxis;
    AddGridToMesh(mesh, pl0, W, dx, H, dx);

    // Mesh area.
    double area = B.X.Length * B.Y.Length;

    M = mesh;
    A = area;
# ---------- gh_mplane: C# additional code ----------
  // This function takes a Mesh, and adds a planar grid of vertices+faces to it.
  // Takes the plane containing the grid, face count in each direction, and face dimensions.
  void AddGridToMesh(Mesh m, Plane pl, int facesX, double dx, int facesY, double dy) {
    // Read how many vertices the Mesh had before more are added.
    int vc = m.Vertices.Count;

    // Add new vertices.
    Point3d v;
    for (int j = 0; j <= facesY; j++) {
      for (int i = 0; i <= facesX; i++) {
        v = pl.PointAt(i * dx, j * dy);
        m.Vertices.Add(v);
      }
    }

    // Add new faces by matching vertices counter-clockwise based on their row/column indices.
    int a, b, c, d;
    for (int j = 0; j < facesY; j++) {
      for (int i = 0; i < facesX; i++) {
        a = vc + j * (facesX + 1) + i;
        b = a + 1;
        c = b + facesX + 1;
        d = c - 1;

        m.Faces.AddFace(a, b, c, d);
      }
    }
  }
# ---------- end gh_mplane ----------
mesh_8 = Panel(mplane.Mesh)
mesh_9 = Panel(gh_mplane.M)
area = Panel(mplane.Area)
area_2 = Panel(gh_mplane.A)

pln = Plane(Plane(origin=(6.511498572, 2.535932165, 2.759865345), x=(-0.4345616552, 0.7713427642, -0.4649586088), y=(-0.6045577157, -0.6324842021, -0.484224847)))
number_slider_13 = Slider(3, range=0..10)
number_slider_14 = Slider(7, range=0..10)
number_slider_15 = Slider(8, range=0..10)
msphere = MeshSphere(Base=pln, Radius=number_slider_13, UCount=number_slider_14, VCount=number_slider_15)
gh_msphere = CSharpScript(B=pln, R=number_slider_13, U=number_slider_14, V=number_slider_15)  # -> out, M; inputs B: Plane, R: Double, U: Int32, V: Int32
# ---------- gh_msphere: C# ----------
    // Component written by @garciadelcastillo

    // This component creates a sphere-like Mesh.
    // This example was written before finding out the RhinoCommon way:
    //   Mesh mesh = Mesh.CreateFromSphere(...);

    // In the original GH component, U and V are inverted: U is latitude (pole to pole),
    // and V is longitude (around the sphere). The values here are also inverted to
    // maintain consistency.

    // Some checks first:
    if (U < 3) {
      Component.AddRuntimeMessage(GH_RuntimeMessageLevel.Error, "Insufficient vertices in the u-direction.");
      return;
    }
    if (V < 2) {
      Component.AddRuntimeMessage(GH_RuntimeMessageLevel.Error, "Insufficient vertices in the v-direction.");
      return;
    }

    // The original component overrides V as 2, and turns it to 3.
    if (V == 2) {
      V = 3;
    }

    // Let's start with an empty Mesh:
    Mesh mesh = new Mesh();

    // Calculate the angle increments in the U (latitude) and V (longitude) directions in radians
    double du = Math.PI / U;
    double dv = 2.0 * Math.PI / V;

    // Let's create all the vertices!
    // South Pole
    Point3d sp = B.PointAt(0, 0, -R);
    mesh.Vertices.Add(sp);

    double x, y, z;
    Point3d p;
    // Iterate over the parallels
    for (int j = 1; j < U; j++) {
      z = R * Math.Sin(-0.5 * Math.PI + j * du);

      // Iterate over the meridians
      for (int i = 0; i < V; i++) {
        x = R * Math.Cos(-0.5 * Math.PI + j * du) * Math.Cos(i * dv);
        y = R * Math.Cos(-0.5 * Math.PI + j * du) * Math.Sin(i * dv);

        p = B.PointAt(x, y, z);

        mesh.Vertices.Add(p);
      }
    }

    // North Pole
    Point3d np = B.PointAt(0, 0, R);
    mesh.Vertices.Add(np);

    // Now, let's create the faces by matching vertex indices.
    // Let's start with the south crown (triangles).
    int a, b, c, d;
    for (int i = 0; i < V; i++) {
      // Remember to maintain CCW orientation of the face.
      a = 0;
      c = 1 + i;

      // Indices are different if the triangle is last on the row.
      if (i == V - 1) {
        b = 1;
      }
      else {
        b = i + 2;
      }

      mesh.Faces.AddFace(a, b, c);
    }

    // Let's do the parallel rows now (quads).
    for (int j = 0 ; j < U - 2; j++) {
      for (int i = 0; i < V; i++) {
        // First corner
        a = 1 + j * V + i;

        // Indices are different if the quad is last on the row.
        if (i == V - 1) {
          b = a - V + 1;
          c = a + 1;
          d = a + V;
        }
        else {
          b = a + 1;
          c = a + V + 1;
          d = a + V;
        }

        mesh.Faces.AddFace(a, b, c, d);
      }
    }

    // And finally, let's top the north crown (triangles).
    for (int i = 0; i < V; i++) {
      // Remember to maintain CCW orientation of the face.
      a = 1 + V * (U - 2) + i;
      c = 1 + V * (U - 1);

      // Indices are different if the triangle is last on the row.
      if (i == V - 1) {
        b = a - V + 1;
      }
      else {
        b = a + 1;
      }

      mesh.Faces.AddFace(a, b, c);
    }

    // Outputs
    M = mesh;
# ---------- end gh_msphere ----------
mesh_10 = Panel(msphere)
mesh_11 = Panel(gh_msphere.M)

pln_2 = Plane(Plane(origin=(6.511498572, 2.535932165, 2.759865345), x=(-0.4345616552, 0.7713427642, -0.4649586088), y=(-0.6045577157, -0.6324842021, -0.484224847)))
number_slider_16 = Slider(3, range=0..10)
number_slider_17 = Slider(7, range=0..10)
gh_msphereex = CSharpScript(B=pln_2, R=number_slider_16, C=number_slider_17)  # -> out, M; inputs B: Plane, R: Double, C: Int32
# ---------- gh_msphereex: C# ----------
    // Component written by @garciadelcastillo

    // This component creates a quad mesh sphere.

    // The RhinoCommon implementation differs from the original, as the
    // RhinoCommon method uses quad subdivisions, rather than face count:
    //   Sphere s = new Sphere(B, R);
    //   Mesh mesh = Mesh.CreateQuadSphere(s, C);

    // Instead, for this component, we will create the quad mesh sphere manually
    // by starting from a cube mesh, and "pushing" the vertices normal to the
    // center of the sphere, so that their distance to the center equals the radius.

    // Let's create a box mesh of side 1 unit, and faces equal to the input.
    Interval interv = new Interval(-0.5, 0.5);
    Box box = new Box(B, interv, interv, interv);
    Mesh mesh = Mesh.CreateFromBox(box, C, C, C);
    
    // "Push" each vertex so that it's distance to the center equals the radius of the sphere.
    // Since mesh vertices have float coordinates (Point3f), we will use float coordinates for 
    // calculations. 
    Point3f center = (Point3f) B.Origin;
    for (int i = 0; i < mesh.Vertices.Count; i++) {
      Point3f pt = mesh.Vertices[i];
      Vector3f v = pt - center;
      float factor = (float) (R / v.Length);
      Point3f ptR = center + factor *v;
      mesh.Vertices[i] = ptR;
    }

    // Outputs
    M = mesh;
# ---------- end gh_msphereex ----------
msphereex = MeshSphereEx(Base=pln_2, Radius=number_slider_16, Count=number_slider_17)
mesh_12 = Panel(msphereex)
mesh_13 = Panel(gh_msphereex.M)

c_mspray = CSharpScript()  # -> out, Mout
# ---------- c_mspray: C# ----------
    // TBD
# ---------- end c_mspray ----------
mspray = MeshSpray(SprayMode=12)
