# Grasshopper definition Mesh_Util.ghx (Grasshopper 1.0.7)

toggle = BooleanToggle(True)
toggle_2 = BooleanToggle(False)
toggle_3 = BooleanToggle(True)
number_slider = Slider(400, range=0..1000)
number_slider_2 = Slider(20, range=0..100)
number_slider_3 = Slider(0, range=0..100)
number_slider_4 = Slider(0, range=0..100)
number_slider_5 = Slider(36, range=0..100)
number_slider_6 = Slider(0, range=0..100)
number_slider_7 = Slider(20, range=0..100)
gh_custom_mesh_settings = CSharpScript(
    Stitch=toggle,
    Planes=toggle_2,
    Refine=toggle_3,
    Min=number_slider_5,
    Max=number_slider,
    Aspect=number_slider_2,
    MaxDist=number_slider_6,
    MaxAngle=number_slider_7,
    MinEdge=number_slider_3,
    MaxEdge=number_slider_4)  # -> out, S; inputs Stitch: Boolean, Planes: Boolean, Refine: Boolean, Min: Int32, Max: Int32, Aspect: Double, MaxDist: Double, MaxAngle: Double, MinEdge: Double, MaxEdge: Double
# ---------- gh_custom_mesh_settings: C# ----------
    // Component written by @garciadelcastillo

    // This component outputs a MeshingParameters object, with
    // information about Brep to Mesh conversion.
    MeshingParameters mp = new MeshingParameters();

    mp.JaggedSeams = !Stitch;
    mp.SimplePlanes = Planes;
    mp.RefineGrid = Refine;
    mp.GridMinCount = Min;
    mp.GridMaxCount = Max;
    mp.GridAspectRatio = Aspect;
    mp.Tolerance = MaxDist;
    double angleRads = MaxAngle * Math.PI / 180.0;
    mp.GridAngle = angleRads;
    mp.MinimumEdgeLength = MinEdge;
    mp.MaximumEdgeLength = MaxEdge;

    // Outputs
    S = mp;
# ---------- end gh_custom_mesh_settings ----------
custom_mesh_settings = SettingsCustom(
    StitchSeams=toggle,
    SimplePlanes=toggle_2,
    Refine=toggle_3,
    MinCount=number_slider_5,
    MaxCount=number_slider,
    AspectRatio=number_slider_2,
    MaxDistance=number_slider_6,
    MaxAngle=number_slider_7,
    MinEdge=number_slider_3,
    MaxEdge=number_slider_4)
gh_mpreader = CSharpScript(MP=custom_mesh_settings)  # -> out
# ---------- gh_mpreader: C# ----------
    // Component written by @garciadelcastillo

    // This component prints out MeshingParameters values.
    // NOTE: this component is for debugging, no mirror on the main GH API.
    MeshingParameters mp = (MeshingParameters) MP;

    Print("Stitch: " + mp.JaggedSeams.ToString());
    Print("Planes: " + mp.SimplePlanes.ToString());
    Print("Refine: " + mp.RefineGrid.ToString());
    Print("Min: " + mp.GridMinCount.ToString());
    Print("Max: " + mp.GridMaxCount.ToString());
    Print("Aspect: " + mp.GridAspectRatio.ToString());
    Print("Max Dist: " + mp.Tolerance.ToString());
    double angleDegs = mp.GridAngle * 180 / Math.PI;
    Print("Max Angle: " + angleDegs.ToString());
    Print("Min Edge: " + mp.MinimumEdgeLength.ToString());
    Print("Max Edge: " + mp.MaximumEdgeLength.ToString());
# ---------- end gh_mpreader ----------
gh_mpreader_2 = CSharpScript(MP=gh_custom_mesh_settings.S)  # -> out; same code as gh_mpreader
meshing_parameters = Panel(gh_mpreader)
meshing_parameters_2 = Panel(gh_mpreader_2)

# ----
# GH#: A C# dictionary of Grasshopper3D components.
# 
# This file contains a category of Grasshopper components, and a mirroring C#/RhinoCommon implementation.
# 
# This is an educational project initiated by students/faculty of GSD-6338: Introduction to Computational Design, at the Harvard Graduate School of Design.
# 
# More information: {{project link}}
# Mesh Util
brep = Brep(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)
data = Data(custom_mesh_settings)
data_2 = Data(gh_custom_mesh_settings.S)
mesh = MeshBrep(Brep=brep, Settings=data)
gh_mesh = CSharpScript(B=brep, S=data_2)  # -> out, M; inputs B: Brep
# ---------- gh_mesh: C# ----------
    // Component written by @garciadelcastillo

    // This component outputs relevant mesh information, such as
    // vertices, faces, vertex color and vertex normals.
    // Most of this information is avaliable as collections inside
    // the Mesh class, so it can be output directly.

    MeshingParameters mp = (MeshingParameters) S;
    Mesh[] meshes = Mesh.CreateFromBrep(B, mp);

    // Output
    M = meshes;
# ---------- end gh_mesh ----------
mesh_2 = Panel(mesh)
mesh_3 = Panel(gh_mesh.M)

mesh_4 = Mesh(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)
toggle_4 = BooleanToggle(False)
bool = Boolean([Toggle(True), Toggle(False), Toggle(False), Toggle(False), Toggle(False), Toggle(False)])
gh_cullv = CSharpScript(M=mesh_4, P=bool, S=toggle_4)  # -> out, Mout; inputs M: Mesh, P: list of Boolean, S: Boolean
# ---------- gh_cullv: C# ----------
    // Component written by @garciadelcastillo

    // This component removes vertices from a Mesh based on a repetitive pattern.

    // Let's create a list with the indices we need to cull
    List<int> indices = new List<int>();

    // Let's count total vertices before we start culling them.
    int vertexCount = M.Vertices.Count;

    // Now, flip over all the vertices, and add their indices based on the culling pattern
    int patternCount = P.Count;
    for (int i = 0; i < vertexCount; i++) {
      // Calculate a rotating id between 0 and the length of the culling pattern
      int patternId = i % patternCount;
      bool cull = P[patternId];
      if (cull) {
        indices.Add(i);
      }
    }

    // Now use those indices to remove the vertices
    M.Vertices.Remove(indices, S);

    // Cleanup: Make sure all normals are up to date.
    M.RebuildNormals();


    // Outputs
    Mout = M;
# ---------- end gh_cullv ----------
cullv = CullVertices(Mesh=mesh_4, Pattern=bool, Shrink=toggle_4)
mesh_5 = Panel(cullv)
mesh_6 = Panel(gh_cullv.Mout)

panel = Panel("""0
15
24
33
45""")
toggle_5 = BooleanToggle(False)
mesh_7 = Mesh(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)
gh_deletev = CSharpScript(M=mesh_7, I=panel, S=toggle_5)  # -> out, Mout; inputs M: Mesh, I: list of Int32, S: Boolean
# ---------- gh_deletev: C# ----------
    // Component written by @garciadelcastillo

    // This component removes vertices from a Mesh based on a list of indices.
    // Use the input list to remove the vertices.
    M.Vertices.Remove(I, S);

    // Outputs
    Mout = M;
# ---------- end gh_deletev ----------
deletev = DeleteVertices(Mesh=mesh_7, Indices=panel, Shrink=toggle_5)
mesh_8 = Panel(deletev)
mesh_9 = Panel(gh_deletev.Mout)

mesh_10 = Mesh(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)
mblur = BlurMesh(Mesh=mesh_10, Iterations=1)

mesh_11 = Mesh([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])
panel_2 = Panel(mesh_11)
gh_mjoin = CSharpScript(M=mesh_11)  # -> out, Mout; inputs M: list of Mesh
# ---------- gh_mjoin: C# ----------
    // Component written by @garciadelcastillo

    // This component joins different meshes into one, by appending them together.
    Mesh jointMesh = new Mesh();
    for (int i = 0; i < M.Count; i++) {
      jointMesh.Append(M[i]);
    }

    // Outputs
    Mout = jointMesh;
# ---------- end gh_mjoin ----------
mjoin = MeshJoin(Meshes=mesh_11)
mesh_12 = Panel(mjoin)

mesh_13 = Mesh(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)
pln = Plane(Plane(origin=(0, 0, 0), x=(0.5796831591, 0.8148419694, 0), y=(-0.387507732, 0.2756751796, 0.8796823023)))
gh_msplit = CSharpScript(M=mesh_13, P=pln)  # -> out, A, B; inputs M: Mesh, P: Plane
# ---------- gh_msplit: C# ----------
    // Component written by @garciadelcastillo

    // This component splits a Mesh using a cutting Plane, and returns
    // two collections of Meshes: the ones in front of the Plane, and the ones on the back.

    // Let's first perform "the cut"
    Mesh[] meshes = M.Split(P);

    // Now, we need to split the Meshes in two lists
    List<Mesh> front = new List<Mesh>();
    List<Mesh> back = new List<Mesh>();
   
    // For each Mesh, start checking each vertex, until finding one that 
    // doesn't lie on the plane (dot product == 0). When found, use the sign
    // of the dot product to determine if it is front or back.
    Vector3d n = P.Normal;
    Point3d origin = P.Origin;
    foreach (Mesh mesh in meshes) 
    {
      bool foundVertexOutsidePlane = false;
      for (int i = 0; i < mesh.Vertices.Count; i++)
      {
        Point3d v = mesh.Vertices[i];
        Vector3d dir = v - origin;
        double dot = n * dir;
        
        // Doubles cannot be compared with == due to precision problems.
        // It is better to use some small tolerance value.
        if (dot > RhinoMath.ZeroTolerance) 
        {
          // Add to front list and stop the for loop
          front.Add(mesh);
          foundVertexOutsidePlane = true;
          break;
        }
        else if (dot < -RhinoMath.ZeroTolerance) 
        {
          // Add to back list and stop the for loop
          back.Add(mesh);
          foundVertexOutsidePlane = true;
          break;
        }
      }
      
      // If all the mesh was coplanar with the splitting plane, 
      // just push it to the front...
      if (!foundVertexOutsidePlane)
      {
        front.Add(mesh);
      }
    }
    

    // Outputs
    A = front;
    B = back;
# ---------- end gh_msplit ----------
msplit = MeshSplitPlane(Mesh=mesh_13, Plane=pln)  # -> Above, Below
mesh_14 = Panel(msplit.Above)
mesh_15 = Panel(gh_msplit.A)
mesh_16 = Panel(msplit.Below)
mesh_17 = Panel(gh_msplit.B)

mesh_18 = Mesh(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)
number_slider_8 = Slider(2.41, range=0..10)
gh_alignvert = CSharpScript(M=mesh_18, T=number_slider_8)  # -> out, R, N; inputs M: Mesh, T: Double
# ---------- gh_alignvert: C# ----------
    // Component written by @garciadelcastillo

    // This component takes a Mesh, and welds naked vertices with their neighbors 
    // based on a distance value. From the RhinoCommon docs:
    // "Moves mesh vertices that belong to naked edges to neighboring vertices, 
    // within the specified distance. This forces unaligned mesh vertices to the same
    // location and is helpful to clean meshes for 3D printing."
    
    // Align those vertices
    int changedCount = M.Vertices.Align(T, null);

    // Outputs
    R = M;
    N = changedCount;
# ---------- end gh_alignvert ----------
alignvert = AlignVertices(Mesh=mesh_18, Tolerance=number_slider_8)  # -> Result, Count
mesh_19 = Panel(alignvert.Result)
mesh_20 = Panel(gh_alignvert.R)
aligned_vertices = Panel(alignvert.Count)
aligned_vertices_2 = Panel(gh_alignvert.N)

mesh_21 = Mesh(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)
number_slider_9 = Slider(0.1, range=0..1)
number_slider_10 = Slider(0.9, range=0..1)
gh_quad = CSharpScript(M=mesh_21, A=number_slider_9, R=number_slider_10)  # -> out, Mout, N; inputs M: Mesh, A: Double, R: Double
# ---------- gh_quad: C# ----------
    // Component written by @garciadelcastillo

    // This component tries to convert pairs of triangle faces to quads
    
    int beforeCount = M.Faces.Count;
    M.Faces.ConvertTrianglesToQuads(A, R);
    int changedCount = beforeCount - M.Faces.Count;

    // Outputs
    Mout = M;
    N = changedCount;
# ---------- end gh_quad ----------
quad = Quadrangulate(Mesh=mesh_21, Angle=number_slider_9, Ratio=number_slider_10)  # -> Mesh, Count
mesh_22 = Panel(quad.Mesh)
mesh_23 = Panel(gh_quad.Mout)
changed_faces = Panel(quad.Count)
changed_faces_2 = Panel(gh_quad.N)

mesh_24 = Mesh(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)
gh_unim = CSharpScript(M=mesh_24)  # -> out, R, N; inputs M: Mesh
# ---------- gh_unim: C# ----------
    // Component written by @garciadelcastillo

    // This component selectively flips mesh faces so that they are all
    // consistent with its overall orientation.
    int changedCount = M.UnifyNormals();
    
    // Recompute normals if necessary
    if (changedCount > 0) 
    {
      M.Normals.ComputeNormals();
    }

    // Outputs
    R = M;
    N = changedCount;
# ---------- end gh_unim ----------
unim = UnifyMesh(Mesh=mesh_24)  # -> Result, Count
mesh_25 = Panel(unim.Result)
mesh_26 = Panel(gh_unim.R)
changed_normals = Panel(unim.Count)
changed_normals_2 = Panel(gh_unim.N)

number_slider_11 = Slider(1.7952, range=0..3.1415)
mesh_27 = Mesh(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)
mesh_28 = Panel(mesh_27)
gh_weld = CSharpScript(M=mesh_27, A=number_slider_11)  # -> out, R; inputs M: Mesh, A: Double
# ---------- gh_weld: C# ----------
    // Component written by @garciadelcastillo

    // This component checks the angle of adjacent faces, and if over the tolerance,
    // welds the edge, removing duplicate vertices.
    M.Weld(A);

    // Outputs
    R = M;
# ---------- end gh_weld ----------
weld = WeldMesh(Mesh=mesh_27, Angle=number_slider_11)
mesh_29 = Panel(gh_weld.R)
mesh_30 = Panel(weld)

exposure = Exposure(Lambert=False)  # -> Exposure, Range

gh_jagged = CSharpScript()  # -> out, S
# ---------- gh_jagged: C# ----------
    // Component written by @garciadelcastillo

    // This component outputs a MeshingParameter object
    // of the type FastRenderMesh.
    S = MeshingParameters.FastRenderMesh;
# ---------- end gh_jagged ----------
jagged = SettingsSpeed()
gh_mpreader_3 = CSharpScript(MP=gh_jagged.S)  # -> out; same code as gh_mpreader
gh_mpreader_4 = CSharpScript(MP=jagged)  # -> out; same code as gh_mpreader
meshing_parameters_3 = Panel(gh_mpreader_3)
meshing_parameters_4 = Panel(gh_mpreader_4)

mesh_31 = Panel(gh_mjoin.Mout)

srf = Surface(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)
srf_2 = Surface(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)
toggle_6 = BooleanToggle(True)
toggle_7 = BooleanToggle(True)
number_slider_12 = Slider(9, range=0..10)
number_slider_13 = Slider(9, range=0..10)
gh_mesh_uv = CSharpScript(S=srf, U=number_slider_12, V=number_slider_13, H=toggle_6, Q=toggle_7)  # -> out, M; inputs S: Brep, U: Int32, V: Int32, H: Boolean, Q: Boolean
# ---------- gh_mesh_uv: C# ----------
    // Component written by @garciadelcastillo

    // This component creates a Mesh out of a Surface by subdividing it
    // along its main U and V directions.
    // In the original GH component, U and V directions seem inverted according to
    // the main 0 and 1 surface directions.
    // The values here are also inverted to maintain consistency.

    // Let's start with an empty Mesh.
    Mesh mesh = new Mesh();

    // Grasshopper Surfaces are Breps with just one face.
    // Check if this is the case.
    if (S.Faces.Count != 1) {
      Component.AddRuntimeMessage(GH_RuntimeMessageLevel.Error, "Can only work with single-surface Breps.");
    }

    // Retrieve surface information from the surface/s in the Brep,
    // and reparameterize it for easier manipulation.
    BrepFace surf = S.Faces[0];
    Interval normD = new Interval(0, 1);
    surf.SetDomain(0, normD);
    surf.SetDomain(1, normD);

    // Retrieve trimming information if available.
    Curve trim = null;
    if (S.Curves2D.Count == 1) {
      trim = S.Curves2D[0];
    }


    // First, create a grid of UV points on the surface.
    List<Point2d> uvCoords = new List<Point2d>();  // note Point2d here

    // Using 1.0, since surface was reparameterized.
    double du = 1.0 / U;
    double dv = 1.0 / V;

    for (int j = 0; j <= U; j++) {
      double u = j * du;

      for (int i = 0; i <= V; i++) {
        double v = i * dv;

        // Store UV coordinates as a Point2d
        Point2d uvPt = new Point2d(u, v);
        uvCoords.Add(uvPt);
      }
    }

    // If equalization is on, we need to redistribute the points along the surface,
    // trying to make their euclidean distance in each direction aproximately equal.
    if (Q) {
      // Let's first equalize points in the U direction.
      List<Point2d> equalizedUPts = EqualizeUVPtsOnSurface(surf, uvCoords, U + 1, V + 1, 0);

      // Repeat process for the V direction
      List<Point2d> equalizedVPts = EqualizeUVPtsOnSurface(surf, equalizedUPts, U + 1, V + 1, 1);

      // Overwrite previous coordinates
      uvCoords = equalizedVPts;
    }

    // Now find those UV points in world coordinates
    List<Point3d> pointsOnSurf = new List<Point3d>();
    foreach(Point2d p in uvCoords) {
      Point3d pt = surf.PointAt(p.X, p.Y);
      pointsOnSurf.Add(pt);
    }

    // Add those as Mesh vertices
    mesh.Vertices.AddVertices(pointsOnSurf);


    // Now, populate the Mesh with faces respecting trimming options.
    // If no trim, all vertices shall be joined by faces.
    if (trim == null) {
      int a, b, c, d;
      for (int j = 0; j < U; j++) {
        for (int i = 0; i < V; i++) {
          a = j * (V + 1) + i;
          b = a + 1;
          c = b + V + 1;
          d = c - 1;

          mesh.Faces.AddFace(a, d, c, b);  // d and b are flipped to mirror original component
        }
      }
    }

      // If surface is trimmed, check if vertices are inside trim and act accordingly.
    else {
      // Check trim containment of every vertex using their UV coordinates on the surface.
      List<PointContainment> contains = new List<PointContainment>();
      for (int i = 0; i < uvCoords.Count; i++) {
        // Curve.Contains only takes Point3d objects, must convert UV coordinates first.
        Point3d p = new Point3d(uvCoords[i].X, uvCoords[i].Y, 0);
        PointContainment pc = trim.Contains(p, Plane.WorldXY, RhinoMath.ZeroTolerance);
        contains.Add(pc);
      }

      // If faces can overhang...
      if (H) {
        int a, b, c, d;
        for (int j = 0; j < U; j++) {
          for (int i = 0; i < V; i++) {
            a = j * (V + 1) + i;
            b = a + 1;
            c = b + V + 1;
            d = c - 1;

            // ...check if AT LEAST ONE of the face vertices is inside the trim
            // by checking its corresponding UV coordinates.
            if (
              contains[a] == PointContainment.Inside ||
              contains[b] == PointContainment.Inside ||
              contains[c] == PointContainment.Inside ||
              contains[d] == PointContainment.Inside
            ) {
              mesh.Faces.AddFace(a, d, c, b);  // d and b are flipped to mirror original component
            }
          }
        }
      }
        // Otherwise...
      else {
        int a, b, c, d;
        for (int j = 0; j < U; j++) {
          for (int i = 0; i < V; i++) {
            a = j * (V + 1) + i;
            b = a + 1;
            c = b + V + 1;
            d = c - 1;

            // ...check if ALL of the face vertices are inside the trim
            // by checking its corresponding UV coordinates.
            if (
              contains[a] == PointContainment.Inside &&
              contains[b] == PointContainment.Inside &&
              contains[c] == PointContainment.Inside &&
              contains[d] == PointContainment.Inside
            ) {
              mesh.Faces.AddFace(a, d, c, b);  // d and b are flipped to mirror original component
            }
          }
        }
      }

      // Clean up unused vertices.
      mesh.Vertices.CullUnused();
    }

    // Output
    M = mesh;
# ---------- gh_mesh_uv: C# additional code ----------
  // This function takes a list of UV coordinates for a surface, and tries to equalize them
  // along a given direction.
  List<Point2d> EqualizeUVPtsOnSurface(Surface surface, List<Point2d> uvPoints, int uCount, int vCount, int direction){

    // First, prepare some data based on the chosen direction.
    int dirCount, perpCount;
    List<Point2d> uvPts;

    if (direction == 0)
    {
      dirCount = uCount;
      perpCount = vCount;

      // Clone the incoming list
      uvPts = new List<Point2d>(uvPoints);
    }
    else
    {
      dirCount = vCount;
      perpCount = uCount;

      // Flip the grid the UV points
      uvPts = new List<Point2d>();
      for (int v = 0; v < vCount; v++) {
        for (int u = 0; u < uCount; u++) {
          int id = v + u * vCount;
          uvPts.Add(uvPoints[id]);
        }
      }
    }

    // Create interpolated curves with the UV points in the chosen direction.
    List<NurbsCurve > dirCurves = new List<NurbsCurve>();
    for (int i = 0; i < dirCount; i++) {
      List<Point2d> dirPoints = uvPts.GetRange(i * perpCount, perpCount);
      NurbsCurve dirCurve;

      //// Let's create the interpolated curve contained in the surface.
      //// For some reason, this is not working correctly and is generating lots of null curves.
      //// @TODO: fix later :(
      //dirCurve = NurbsSurface.CreateCurveOnSurface(surface, dirPoints, 0.001, false);
      
      // Alternatively, let's define an interpolated curve in 2D UV domain,
      // and find it's 3D mapping on the surface by "pushing it up".
      // Must convert Point2d to Point3d first to feed them to CreateInterpolatedCurve.
      List<Point3d> pts = new List<Point3d>();
      foreach (Point2d p in dirPoints) {
        pts.Add(new Point3d(p.X, p.Y, 0));
      }
      Curve dirNormCurve = NurbsCurve.CreateInterpolatedCurve(pts, 3).ToNurbsCurve();
      dirCurve = surface.Pushup(dirNormCurve, RhinoMath.ZeroTolerance).ToNurbsCurve();

      dirCurves.Add(dirCurve);
    }

    // Find points at equal lengths on the direction curves.
    uvPts.Clear();
    foreach (NurbsCurve c in dirCurves) {
      Point3d[] pts;
      c.DivideByCount(perpCount - 1, true, out pts);
      
      double u, v;
      foreach (Point3d p in pts) {
        surface.ClosestPoint(p, out u, out v);
        Point2d uv = new Point2d(u, v);
        uvPts.Add(uv);
      }
    }

    // Before returning, if point order was flipped,
    // unflip it for consistency with the incoming data.
    if (direction != 0)
    {
      // Flip the order of the UV points
      List<Point2d> flippedPts = new List<Point2d>();
      for (int u = 0; u < uCount; u++) {
        for (int v = 0; v < vCount; v++) {
          int id = u + v * uCount;
          flippedPts.Add(uvPts[id]);
        }
      }

      uvPts = flippedPts;
    }
    
    // Done!
    return uvPts;
  }
# ---------- end gh_mesh_uv ----------
mesh_uv = MeshSurface(Surface=srf, UCount=number_slider_12, VCount=number_slider_13, Overhang=toggle_6, Equalize=toggle_7)
mesh_32 = Panel(mesh_uv)
mesh_33 = Panel(gh_mesh_uv.M)

mesh_34 = Mesh(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)
bool_2 = Boolean([Toggle(True), Toggle(False), Toggle(True)])
gh_cullf = CSharpScript(M=mesh_34, P=bool_2)  # -> out, Mout; inputs M: Mesh, P: list of Boolean
# ---------- gh_cullf: C# ----------
    // Component written by @garciadelcastillo

    // This component removes faces from a Mesh based on a repetitive pattern.

    // Let's create a list with the indices we need to cull
    List<int> indices = new List<int>();

    // Let's count total vertices before we start culling them.
    int faceCount = M.Faces.Count;

    // Now, flip over all the faces, and add their indices based on the culling pattern
    int patternCount = P.Count;
    for (int i = 0; i < faceCount; i++) 
    {
      // Calculate a rotating id between 0 and the length of the culling pattern
      int patternId = i % patternCount;
      bool cull = P[patternId];
      if (cull) {
        indices.Add(i);
      }
    }

    // Now use those indices to remove the faces
    M.Faces.DeleteFaces(indices);

    // Cleanup:
    // Make sure there are no vertices left in the Mesh linked to a Face.
    M.Vertices.CullUnused();

    // And rebuild all normals based on remaining vertices and faces.
    M.RebuildNormals();


    // Outputs
    Mout = M;
# ---------- end gh_cullf ----------
cullf = CullFaces(Mesh=mesh_34, Pattern=bool_2)
mesh_35 = Panel(cullf)
mesh_36 = Panel(gh_cullf.Mout)

panel_3 = Panel("""0
15
24
33
45""")
mesh_37 = Mesh(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)
gh_deletef = CSharpScript(M=mesh_37, I=panel_3)  # -> out, Mout; inputs M: Mesh, I: list of Int32
# ---------- gh_deletef: C# ----------
    // Component written by @garciadelcastillo

    // This component removes faces from a Mesh based on a list of indices.
    // Use the input list to remove the faces.
    M.Faces.DeleteFaces(I);

    // Outputs
    Mout = M;
# ---------- end gh_deletef ----------
deletef = DeleteFaces(Mesh=mesh_37, Indices=panel_3)
mesh_38 = Panel(gh_deletef.Mout)
mesh_39 = Panel(deletef)

mesh_40 = Mesh(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)
gh_disjoint = CSharpScript(M=mesh_40)  # -> out, Mout; inputs M: Mesh
# ---------- gh_disjoint: C# ----------
    // Component written by @garciadelcastillo

    // This component splits a Mesh into those submeshes that are topologically disconnected.
    Mesh[] meshes = M.SplitDisjointPieces();

    // Outputs
    Mout = meshes;
# ---------- end gh_disjoint ----------
disjoint = DisjointMesh(Mesh=mesh_40)
meshes = Panel(disjoint)
meshes_2 = Panel(gh_disjoint.Mout)

mesh_41 = Mesh(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)
mesh_42 = Mesh(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)
xy = XYPlane(Origin=Point(0, 0, 0))
gh_mshadow = CSharpScript(M=mesh_42, L="{0.5, 0.5, -1}", P=xy)  # -> out, O; inputs M: Mesh, L: Vector3d, P: Plane
# ---------- gh_mshadow: C# usings ----------
// Added intersections namespace
using Rhino.Geometry.Intersect;
# ---------- gh_mshadow: C# ----------
    // Component written by @garciadelcastillo

    // This component projects the naked edges of a Mesh onto a Plane, giving a shadow feeling.

    // First, let's create a plane oriented by the vector input.
    Plane sun = new Plane(Point3d.Origin, L);

    // Let's project all the outlines to that plane.
    Polyline[] outlines = M.GetOutlines(sun);

    // The outlines are on the "sun plane," but we need to project them now to the input "ground plane."
    // A way to do this would be, for each point of the polyline, to compute the intersection
    // of a line on that point on sun direction with the target plane, and then move the point to
    // that intersection.

    // Alternatively, a perhaps more elegant and cheap solution is to create a transformation
    // that encapsulates a projection along a certain direction, and apply it to the polylines.
    Transform obliqueProj = ObliqueProjection(P, L);
    foreach (Polyline poly in outlines)
    {
      poly.Transform(obliqueProj);
    }


    // Outputs
    O = outlines;
# ---------- gh_mshadow: C# additional code ----------
  // This function returns an oblique projection transform, that is,
  // a transform that projects some geometry to a plane along a vector.
  // See: https://stackoverflow.com/a/2500707/1934487
  Transform ObliqueProjection(Plane targetPlane, Vector3d direction)
  {
    // Get the plane equation parameters
    double[] planeEq = targetPlane.GetPlaneEquation();
    double A = planeEq[0];
    double B = planeEq[1];
    double C = planeEq[2];
    double D = planeEq[3];

    // Precalculate some constants that we will use a lot
    double PV = A * direction.X + B * direction.Y + C * direction.Z;
    double APV = -A / PV;
    double BPV = -B / PV;
    double CPV = -C / PV;
    double DPV = -D / PV;

    // Now, initialize an identity transform, and set each value of the matrix
    Transform t = new Transform(1);

    t.M00 = APV * direction.X + 1;
    t.M01 = BPV * direction.X;
    t.M02 = CPV * direction.X;
    t.M03 = DPV * direction.X;

    t.M10 = APV * direction.Y;
    t.M11 = BPV * direction.Y + 1;
    t.M12 = CPV * direction.Y;
    t.M13 = DPV * direction.Y;

    t.M20 = APV * direction.Z;
    t.M21 = BPV * direction.Z;
    t.M22 = CPV * direction.Z + 1;
    t.M23 = DPV * direction.Z;

    t.M30 = 0;
    t.M31 = 0;
    t.M32 = 0;
    t.M33 = 1;

    // Return the transform
    return t;
  }
# ---------- end gh_mshadow ----------
mshadow = MeshShadow(Mesh=mesh_42, Light="{0.5, 0.5, -1}", Plane=xy)
shadow = Panel(mshadow)
shadow_2 = Panel(gh_mshadow.O)

toggle_8 = BooleanToggle(True)
toggle_9 = BooleanToggle(True)
toggle_10 = BooleanToggle(True)
mesh_43 = Mesh(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)
gh_flipm = CSharpScript(M=mesh_43, Vn=toggle_8, Fn=toggle_9, Fo=toggle_10)  # -> out, R; inputs M: Mesh, Vn: Boolean, Fn: Boolean, Fo: Boolean
# ---------- gh_flipm: C# ----------
    // Component written by @garciadelcastillo

    // This component flips everything that is flippable in a Mesh! 
    
    // There is a RhinoCommon method that is a perfect mirror of this component.
    M.Flip(Vn, Fn, Fo);

    
    // Outputs
    R = M;
# ---------- end gh_flipm ----------
flipm = FlipMesh(Mesh=mesh_43, VertexNormals=toggle_8, FaceNormals=toggle_9, FaceOrientation=toggle_10)
mesh_44 = Mesh(gh_flipm.R)
mesh_45 = Mesh(flipm)
demesh = DeconstructMesh(Mesh=mesh_44)  # -> Vertices, Faces, Colours, Normals
facen = FaceNormals(Mesh=mesh_44)  # -> Centers, Normals
demesh_2 = DeconstructMesh(Mesh=mesh_45)  # -> Vertices, Faces, Colours, Normals
facen_2 = FaceNormals(Mesh=mesh_45)  # -> Centers, Normals
demesh_3 = DeconstructMesh(Mesh=mesh_43)  # -> Vertices, Faces, Colours, Normals
facen_3 = FaceNormals(Mesh=mesh_43)  # -> Centers, Normals
vertex_normals = Panel(demesh.Normals)
vertex_normals_2 = Panel(demesh_2.Normals)
vertex_normals_3 = Panel(demesh_3.Normals)
face_normals = Panel(facen.Normals)
face_normals_2 = Panel(facen_2.Normals)
face_normals_3 = Panel(facen_3.Normals)
faces = Panel(demesh.Faces)
faces_2 = Panel(demesh_2.Faces)
faces_3 = Panel(demesh_3.Faces)

brep_2 = Brep(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)
gh_smesh = CSharpScript(B=brep_2)  # -> out, M; inputs B: Brep
# ---------- gh_smesh: C# ----------
    // Component written by @garciadelcastillo
    
    // This component creates a simple Mesh out of a Brep, by turning
    // each one of the Brep faces into a simple triangular/quad Mesh face.
    // Only valid for Brep faces with 3 or 4 edges. 
    
    // Let's start with an empty Mesh.    
    Mesh m = new Mesh();

    // And add a face to it for each Brep face.
    foreach(BrepFace face in B.Faces) 
    {
      // Let's extract the indices of the edge curves adjacent to this BrepFace
      int[] adjacencies = face.AdjacentEdges();
      
      // Only add the MeshFace if we have a valid amount of edges
      if (adjacencies.Length == 3 || adjacencies.Length == 4) 
      {
        // Extract the actual edge curves of this BrepFace
        Curve[] edgeCurves = new Curve[adjacencies.Length];
        for (int i = 0; i < adjacencies.Length; i++) 
        {
          edgeCurves[i] = B.Edges[adjacencies[i]].EdgeCurve;
        }

        // Reorder (and flip) those curves to make sure the end point of a
        // curve matches the start point of the next.
        List<Curve> sortedCurves = SortCurvesByEndPoints(edgeCurves, true);
        
        // Extract start points of all the edge curves...
        List<Point3d> startPts = new List<Point3d>();
        foreach(Curve c in sortedCurves) {
          startPts.Add(c.PointAtStart);
        }
        
        // ...and use them as vertices to create a new face on the mesh, 
        // oriented with the same normal as the center of the BrepFace.
        Vector3d n = face.NormalAt(face.Domain(0).Mid, face.Domain(1).Mid);
        AddOrientedFaceToMesh(m, startPts, n);
      }
    }

    // Outputs
    M = m;
# ---------- gh_smesh: C# additional code ----------
  
  // This function takes an array of curves, and returns a list with the same curves
  // sorted so that the endpoint of any curve matches the start point of the next. 
  // The first curve of the array will be used as the guiding curve.
  // If flip is true, curves may be reversed in order to fulfill the goal.
  // Note that if there is a gap between curves, the returned list will not include them.
  List<Curve> SortCurvesByEndPoints(Curve[] curves, bool flip) 
  {
    // Let's start by creating two lists of sorted and pending to sort Curves.
    List<Curve> sorted = new List<Curve>();
    List<Curve> toSort = new List<Curve>(curves);
    int it = 0;

    // Take the first curve as the guiding one
    sorted.Add(toSort[it]);
    toSort.RemoveAt(it);
    it++;

    // While there are curves remaining to sort...
    while(toSort.Count > 0) 
    {
      // Take the guiding point for checks
      Point3d endPt = sorted[it - 1].PointAtEnd;

      // Iterate over the remaining curves to check
      bool success = false;
      for (int i = 0; i < toSort.Count; i++) 
      {
        // If flippping is allowed, and the end point matches, reverse this curve
        if (flip && endPt.DistanceToSquared(toSort[i].PointAtEnd) < RhinoMath.ZeroTolerance)
        {
          toSort[i].Reverse();
        }
        
        // If the end point of the previous curve matches the start point of this one...
        if (endPt.DistanceToSquared(toSort[i].PointAtStart) < RhinoMath.ZeroTolerance) 
        {
          // Chose this curve as the next one in the list, and stop checking the rest of the curves.
          sorted.Add(toSort[i]);
          toSort.RemoveAt(i);
          it++;
          success = true;
          break;
        }
      }
      
      // If no matching curve was found (there could be a gap between them), stop the while loop.
      if (!success) {
        Print("Could not find overlapping curve");
        break;
      }
    }
    
    // Return whatever could be sorted
    return sorted;
  }
  
  
  // This function takes a Mesh and a list of Points, and add a new MeshFace with those as vertices. 
  // If a valid normal vector is passed, the function will try to align the face normal to it. 
  bool AddOrientedFaceToMesh(Mesh mesh, List<Point3d> vertices, Vector3d normal) 
  {
    // Some sanity
    if (vertices.Count < 3 || vertices.Count > 4) {
      Print("Invalid amount of vertices for new face");
      return false;
    }
    
    // Let's add the vertices to the Mesh
    mesh.Vertices.AddVertices(vertices);

    // Now, let's figure out the MeshFace situation
    int vertC = mesh.Vertices.Count;
    Vector3d faceNormal = Vector3d.Unset;
    // If triangle face...
    if (vertices.Count == 3)
    {
      // ...add the face to the mesh...
      mesh.Faces.AddFace(vertC - 3, vertC - 2, vertC - 1);
      
      // ...and compute the triangle normal.
      if (normal.IsValid) 
      {
        Vector3d a = vertices[1] - vertices[0];
        Vector3d b = vertices[2] - vertices[0];
        faceNormal = Vector3d.CrossProduct(a, b);
      }
    }
    // If quad face...
    else
    {
      // ...add the fac to the mesh...
      mesh.Faces.AddFace(vertC - 4, vertC - 3, vertC - 2, vertC - 1);

      // ...and compute the quad normal as the average of the two triangle ones.
      if (normal.IsValid) 
      {
        Vector3d a = vertices[1] - vertices[0];
        Vector3d b = vertices[2] - vertices[0];
        Vector3d c = vertices[3] - vertices[0];
        Vector3d n0 = Vector3d.CrossProduct(a, b);
        n0.Unitize();
        Vector3d n1 = Vector3d.CrossProduct(b, c);
        n1.Unitize();
        // We average the normals of the two triangles
        faceNormal = 0.5 * (n0 + n1);  
      }
    }
  
    // Check if normals are aligned by looking at the sign of their dot product
    if (faceNormal.IsValid)
    {
      faceNormal.Unitize();
      
      double cosAngle = normal * faceNormal;  // dot product of two unit vectors
      if (cosAngle < 0) {
        mesh.Faces[mesh.Faces.Count - 1].Flip();
        faceNormal.Reverse();
      }

      mesh.FaceNormals.AddFaceNormal(faceNormal);
    }
    
    // This operation was successful
    return true;
  }
# ---------- end gh_smesh ----------
smesh = SimpleMesh(Brep=brep_2)
mesh_46 = Panel(gh_smesh.M)
mesh_47 = Panel(smesh)

mesh_48 = Mesh(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)
gh_tri = CSharpScript(M=mesh_48)  # -> out, Mout, N; inputs M: Mesh
# ---------- gh_tri: C# ----------
    // Component written by @garciadelcastillo

    // This component converts the quads faces in a Mesh to pairs of triangles.

    int beforeCount = M.Faces.Count;
    M.Faces.ConvertQuadsToTriangles();
    int changedCount = M.Faces.Count - beforeCount;


    // Outputs
    Mout = M;
    N = changedCount;
# ---------- end gh_tri ----------
tri = Triangulate(Mesh=mesh_48)  # -> Mesh, Count
mesh_49 = Panel(tri.Mesh)
mesh_50 = Panel(gh_tri.Mout)
changed_faces_3 = Panel(tri.Count)
changed_faces_4 = Panel(gh_tri.N)

mesh_51 = Mesh(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)
number_slider_14 = Slider(0.2518, range=0..3.1415)
mesh_52 = Panel(mesh_51)
gh_unweld = CSharpScript(M=mesh_51, A=number_slider_14)  # -> out, R; inputs M: Mesh, A: Double
# ---------- gh_unweld: C# ----------
    // Component written by @garciadelcastillo

    // This component checks the angle of adjacent faces, and if over the tolerance,
    // unwelds the edge, creating new (duplicate) vertices for each one of the faces.
    M.Unweld(A, true);

    // Outputs
    R = M;
# ---------- end gh_unweld ----------
unweld = UnweldMesh(Mesh=mesh_51, Angle=number_slider_14)
mesh_53 = Panel(unweld)
mesh_54 = Panel(gh_unweld.R)

msmooth = SmoothMesh(Strength=0.5, SkipNaked=True, Iterations=1)
occ = Occlusion()  # -> Hits, Occlusion

smooth = SettingsQuality()
gh_smooth = CSharpScript()  # -> out, S
# ---------- gh_smooth: C# ----------
    // Component written by @garciadelcastillo

    // This component outputs a MeshingParameter object
    // of the type QualityRenderMesh
    S = MeshingParameters.QualityRenderMesh;
# ---------- end gh_smooth ----------
gh_mpreader_5 = CSharpScript(MP=gh_smooth.S)  # -> out; same code as gh_mpreader
gh_mpreader_6 = CSharpScript(MP=smooth)  # -> out; same code as gh_mpreader
meshing_parameters_5 = Panel(gh_mpreader_5)
meshing_parameters_6 = Panel(gh_mpreader_6)

panel_4 = Panel(gh_mesh_uv.out)
