# Grasshopper definition Intersect_Mathematical.ghx (Grasshopper 1.0.7)

# ---- group: Brep | Line
# GH#: A C# dictionary of Grasshopper3D components.
# 
# This file contains a category of Grasshopper components, and a mirroring C#/RhinoCommon implementation.
# 
# This is an educational project initiated by students/faculty of GSD-6338: Introduction to Computational Design, at the Harvard Graduate School of Design.
# 
# More information: {{project link}}
# Intersect Mathematical
brep = Brep(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)
line = Line(Line((15, 9, 0), (-6, 0, 0)))
blx = BrepLine(Brep=brep, Line=line, LimitToFirst=False)  # -> Curves, Points
gh_blx = CSharpScript(B=brep, L=line)  # -> out, C, P; inputs B: Brep, L: Line
# ---------- gh_blx: C# ----------
    //Component written by @bava-kumaravel
    //Solve intersection events between a Brep B and a Line L
    //and return curve overlaps C and point intersections P

    //Define arrays to hold the overlapping curves and intersecting pts
    Curve[] curves = new Curve[0];
    Point3d[] points = new Point3d[0];

    //To perform intersection, first convert Line L to a curve
    Curve inputCurve = L.ToNurbsCurve();

    //Set the tolerance value to the Model Space Absolute Tolerance
    double tol = doc.ModelAbsoluteTolerance;

    //Perform Intersection
    bool success = Rhino.Geometry.Intersect.Intersection.CurveBrep(
      inputCurve, B, tol, out curves, out points);

    //Outputs
    if(success){
      C = curves;
      P = points;
    }
# ---------- end gh_blx ----------
panel = Panel(blx.Curves)
panel_2 = Panel(blx.Points)
panel_3 = Panel(gh_blx.C)
panel_4 = Panel(gh_blx.P)

# ---- group: Line | Line
line_2 = Line(Line((-4, -2, 0), (23, 16, 0)))
line_3 = Line(Line((-12, 14, 0), (21, -5, 0)))
gh_llx = CSharpScript(A=line_2, B=line_3)  # -> out, tA, tB, pA, pB; inputs A: Line, B: Line
# ---------- gh_llx: C# ----------
    //Component written by @bava-kumaravel
    //Solves intersection between two lines A and B and return
    //points of intersections pA and pB and parameters tA and tB

    //Define points on A and B and parameters in A and B
    Point3d pointA = new Point3d();
    Point3d pointB = new Point3d();
    double paramA;
    double paramB;

    //Perform intersection
    bool success = Rhino.Geometry.Intersect.Intersection.LineLine
      (A, B, out paramA, out paramB);

    if(success){
      //Find points on A and B using their parameters
      pointA = A.PointAt(paramA);
      pointB = B.PointAt(paramB);

      //Outputs
      tA = paramA;
      tB = paramB;
      pA = pointA;
      pB = pointB;
    }
# ---------- end gh_llx ----------
llx = LineLine(Line1=line_2, Line2=line_3)  # -> ParamA, ParamB, PointA, PointB
panel_5 = Panel(llx.ParamA)
panel_6 = Panel(llx.ParamB)
panel_7 = Panel(llx.PointA)
panel_8 = Panel(llx.PointB)
panel_9 = Panel(gh_llx.tA)
panel_10 = Panel(gh_llx.tB)
panel_11 = Panel(gh_llx.pA)
panel_12 = Panel(gh_llx.pB)

# ---- group: Surface | Line
srf = Surface(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)
line_4 = Line(Line((26, -25, 8), (-3, -25, 6)))
slx = SurfaceLine(Surface=srf, Line=line_4, LimitToFirst=False)  # -> Curves, Points, UVPoints, Normal
gh_slx = CSharpScript(S=srf, L=line_4)  # -> out, C, P, uv, N; inputs S: Surface, L: Line
# ---------- gh_slx: C# ----------
    //Component written by @bava-kumaravel
    //Solves intersections between a surface S and a line L and return
    //overlapping curves C, intersection points P, uv parameters on the
    //surface and normals N at the points

    //Convert the line L into a curve
    Curve inputCurve = L.ToNurbsCurve();

    //Define lists to hold overlapping curves, intersections points
    //uv parameters and normals
    List<Curve> curves = new List<Curve>();
    List<Point3d> points = new List<Point3d>();
    List<Point3d> param = new List<Point3d>();
    List<Vector3d> normals = new List<Vector3d>();

    //Define tolerance as the Model Space Absolute Tolerance
    double tol = doc.ModelAbsoluteTolerance;

    //Perform intersection and find the CurveIntersections event
    Rhino.Geometry.Intersect.CurveIntersections inter = Rhino.
      Geometry.Intersect.Intersection.CurveSurface(inputCurve, S, tol, tol);

    //Go through the CurveIntersections List and retrieve overlaps and
    //intersections and populate the 4 lists
    for(int i = 0;i < inter.Count;i++){
      //Check if the event is an intersection
      if(inter[i].IsPoint){
        //Define intersection point, normal and u and v parameters
        Point3d point = new Point3d();
        double u,v;
        Vector3d normal = new Vector3d();
        point = inter[i].PointA;
        inter[i].SurfacePointParameter(out u, out v);
        normal = S.NormalAt(u, v);
        //Construct a point to hold the u, v values
        Point3d parameter = new Point3d(u, v, 0);
        //Add the values to the lists
        points.Add(point);
        param.Add(parameter);
        normals.Add(normal);
      }
      else{
        //If the intersection event is an overlap
        Interval domain = inter[i].OverlapA;
        Curve curve = inputCurve.Trim(domain);
        curves.Add(curve);
      }
    }

    //Outputs
    C = curves;
    P = points;
    uv = param;
    N = normals;
# ---------- end gh_slx ----------
panel_13 = Panel(slx.Curves)
panel_14 = Panel(gh_slx.C)
panel_15 = Panel(slx.Points)
panel_16 = Panel(gh_slx.P)
panel_17 = Panel(slx.UVPoints)
panel_18 = Panel(gh_slx.uv)
panel_19 = Panel(slx.Normal)
panel_20 = Panel(gh_slx.N)

# ---- group: Brep | Plane
brep_2 = Brep(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)
pln = Plane(Plane(origin=(0, 0, 0), x=(0.9696955626, 0, 0.2443164257), y=(0, 1, 0)))
gh_sec = CSharpScript(B=brep_2, P=pln)  # -> out, C, POut; inputs B: Brep, P: Plane
# ---------- gh_sec: C# ----------
    //Component written by @bava-kumaravel
    //Solve intersection between a brep B and an infinite plane P and
    //return list of section curves C and list of intersection points POut

    //Define arrays to hold the section curves and intersection points
    Curve[] curves = new Curve[0];
    Point3d[] points = new Point3d[0];

    //Define tolerance as the Model Space Absolute Tolerance
    double tol = doc.ModelAbsoluteTolerance;

    //Perform intersection
    bool success = Rhino.Geometry.Intersect.Intersection.BrepPlane(
      B, P, tol, out curves, out points);

    //Outputs
    if(success){
      C = curves;
      POut = points;
    }
# ---------- end gh_sec ----------
sec = BrepPlane(Brep=brep_2, Plane=pln)  # -> Curves, Points
panel_21 = Panel(sec.Curves)
panel_22 = Panel(sec.Points)
panel_23 = Panel(gh_sec.C)
panel_24 = Panel(gh_sec.POut)

# ---- group: Contours (ex)
brep_3 = Brep(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)
pln_2 = Plane(Plane(origin=(-7.419283127, 3.926638653, -2.173498116), x=(-0.6902275847, -0.7132465239, 0.1219232437), y=(0.07836642648, -0.2411902049, -0.9673086313)))
num = Number([0, 0.7308, 1.4616, 2.1924, 2.9232, 3.654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])
num_2 = Number([0.771094, 0.406563, 0.170799, 0.992247, 0.118605, 0.31868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])
panel_25 = Panel(num)
panel_26 = Panel(num_2)
gh_contour = CSharpScript(S=brep_3, P=pln_2, D=panel_25)  # -> out, C; inputs S: GeometryBase, P: Plane, O: tree of Double, D: tree of Double
# ---------- gh_contour: C# ----------
    //Component written by @bava-kumaravel
    //Creates contour curves C on a Brep or Mesh S, using a Plane P and
    //either a list if offsets O or distances between contours D

    //Sanity Check
    //Check one - Check if the Geometry S is either a Brep or a Mesh
    //Define a boolean to store the value
    bool isBrep;
    if(S.ObjectType == ObjectType.Brep){
      isBrep = true;
    }
    else if(S.ObjectType == ObjectType.Mesh){
      isBrep = false;
    }
    else{
      //If it is neither a brep nor a mesh, throw an error and stop execution
      Component.AddRuntimeMessage(GH_RuntimeMessageLevel.Error,
        "Shape must be a Mesh or a Brep");
      return;
    }

    //Check two - Check if offsets or distances are given
    //Define a boolean to store the value
    bool isOffsets;
    if(Component.Params.Input[2].VolatileDataCount > 0){
      //If offsets are given
      //This also includes the case where both are given, in which
      //we use offsets for the execution
      isOffsets = true;
    }
    else if(Component.Params.Input[3].VolatileDataCount > 0){
      //If distances are given
      isOffsets = false;
    }
    else{
      //If both aren't provided, throw an error and stop execution
      Component.AddRuntimeMessage(GH_RuntimeMessageLevel.Error,
        "You either have to specify Distances or Offsets");
      return;
    }

    //Define a data tree to store the output contours
    DataTree<Curve> contours = new DataTree<Curve>();

    if(isBrep){
      if(isOffsets){      //Offsets given
        //Define arrays to hold the curves and intersection points
        Curve[] curves = new Curve[0];
        Point3d[] points = new Point3d[0];
        //Go through the datatree of offsets
        for(int branchIndex = 0; branchIndex < O.BranchCount;branchIndex++){
          List<double> offsets = O.Branches[branchIndex];
          GH_Path branchPath = O.Paths[branchIndex];
          for(int i = 0;i < offsets.Count;i++){
            //Define a new datatree branch
            GH_Path branch = branchPath.AppendElement(i);
            //Move the plane in its Z direction, using the offset O[i]
            //Define a motion vector
            Vector3d vector = Vector3d.Multiply(P.ZAxis, offsets[i]);
            Plane plane = P;
            bool move = plane.Translate(vector);
            //Define tolerance as the model space absolute tolerance
            double tol = doc.ModelAbsoluteTolerance;
            //Intersect the Brep with the translated plane
            bool success = Rhino.Geometry.Intersect.Intersection.BrepPlane
              ((Brep) S, plane, tol, out curves, out points);
            //Add the curves from the curve array to the Data Tree
            if(success){
              for(int j = 0;j < curves.Length;j++){
                contours.Add(curves[j], branch);
              }
            }
            else{
              contours.Add(null, branch);
            }
          }
        }
      }
      else{     //Distances given
        //Define arrays to hold the curves and intersection points
        Curve[] curves = new Curve[0];
        Point3d[] points = new Point3d[0];
        //Planes' distances are incremented cumulatively with each value
        //So define a double to store the distance at each iteration
        double dist = 0;
        //Go through the datatree of distances
        for(int branchIndex = 0; branchIndex < D.BranchCount;branchIndex++){
          List<double> distances = D.Branches[branchIndex];
          GH_Path branchPath = D.Paths[branchIndex];
          for(int i = 0;i < distances.Count;i++){
            //Define a new datatree branch
            GH_Path branch = branchPath.AppendElement(i);
            //Add the distance D[i] to the distance variable dist
            dist += distances[i];
            //Move the plane in its Z direction, using dist
            //Define a motion vector
            Vector3d vector = Vector3d.Multiply(P.ZAxis, dist);
            Plane plane = P;
            bool move = plane.Translate(vector);
            //Define tolerance as the model space absolute tolerance
            double tol = doc.ModelAbsoluteTolerance;
            //Intersect the Brep with the translated plane
            bool success = Rhino.Geometry.Intersect.Intersection.BrepPlane
              ((Brep) S, plane, tol, out curves, out points);
            //Add the curves from the curve array to the Data Tree
            if(success){
              for(int j = 0;j < curves.Length;j++){
                contours.Add(curves[j], branch);
              }
            }
            else{
              contours.Add(null, branch);
            }
          }
        }
      }
    }
    else{       //For Mesh Operation
      if(isOffsets){      //Offsets given
        //Define arrays to hold the output polylines
        Polyline[] polylines = new Polyline[0];
        //Go through the datatree of offsets
        for(int branchIndex = 0; branchIndex < O.BranchCount;branchIndex++){
          List<double> offsets = O.Branches[branchIndex];
          GH_Path branchPath = O.Paths[branchIndex];
          for(int i = 0;i < offsets.Count;i++){
            //Define a new datatree branch
            GH_Path branch = branchPath.AppendElement(i);
            //Move the plane in its Z direction, using the offset O[i]
            //Define a motion vector
            Vector3d vector = Vector3d.Multiply(P.ZAxis, offsets[i]);
            Plane plane = P;
            bool move = plane.Translate(vector);
            //Intersect the Brep with the translated plane
            polylines = Rhino.Geometry.Intersect.Intersection.MeshPlane
              ((Mesh) S, plane);
            //Add the polylines from the polyline array to the Data Tree
            if(polylines != null){
              for(int j = 0;j < polylines.Length;j++){
                //Convert the polyline into a curve
                Curve curve = polylines[j].ToPolylineCurve();
                contours.Add(curve, branch);
              }
            }
            else{
              contours.Add(null, branch);
            }
          }
        }
      }
      else{     //Distances given
        //Define arrays to hold the polylines
        Polyline[] polylines = new Polyline[0];
        //Planes' distances are incremented cumulatively with each value
        //So define a double to store the distance at each iteration
        double dist = 0;
        //Go through the list of distances
        for(int branchIndex = 0; branchIndex < D.BranchCount;branchIndex++){
          List<double> distances = D.Branches[branchIndex];
          GH_Path branchPath = D.Paths[branchIndex];
          for(int i = 0;i < distances.Count;i++){
            //Define a new datatree branch
            GH_Path branch = branchPath.AppendElement(i);
            //Add the distance D[i] to the distance variable dist
            dist += distances[i];
            //Move the plane in its Z direction, using dist
            //Define a motion vector
            Vector3d vector = Vector3d.Multiply(P.ZAxis, dist);
            Plane plane = P;
            bool move = plane.Translate(vector);
            //Intersect the Mesh with the translated plane
            polylines = Rhino.Geometry.Intersect.Intersection.MeshPlane
              ((Mesh) S, plane);
            //Add the curves from the curve array to the Data Tree
            if(polylines != null){
              for(int j = 0;j < polylines.Length;j++){
                //Convert the polyline into a curve
                Curve curve = polylines[j].ToPolylineCurve();
                contours.Add(curve, branch);
              }
            }
            else{
              contours.Add(null, branch);
            }
          }
        }
      }
    }
    //Outputs
    C = contours;
# ---------- end gh_contour ----------
contour = ContourEx(Shape=brep_3, Plane=pln_2, Distances=panel_25)
panel_27 = Panel(contour)
panel_28 = Panel(gh_contour.C)

# ---- group: Line | Plane
line_5 = Line(Line((-6, -7, 0), (5, 6, 0)))
pln_3 = Plane(Plane(origin=(0, 0, 0), x=(0.9696955626, 0, 0.2443164257), y=(0, 1, 0)))
gh_plx = CSharpScript(L=line_5, P=pln_3)  # -> out, POut, t, uv; inputs L: Line, P: Plane
# ---------- gh_plx: C# ----------
    //Component written by @bava-kumaravel
    //Solves intersection between a line L and a Plane P and returns
    //point of intersection, parameter on the line and uv parameter on the plane

    //Define variables to hold the point of intersection, t parameter of line
    //and u, v parameters of Plane
    Point3d point = new Point3d();
    double paramL, u, v;
    //Define a point to hold the u, v parameters
    Point3d uvPoint = new Point3d();

    //Perform intersection
    bool success = Rhino.Geometry.Intersect.Intersection.LinePlane(L, P, out paramL);

    if(success){
      //Get the point of intersection using the line parameter
      point = L.PointAt(paramL);
      //Use the intersection point to get the u, v parameters of the plane
      P.ClosestParameter(point, out u, out v);
      //Define the uv point with the u, v parameters
      uvPoint = new Point3d(u, v, 0);

      //Outputs
      POut = point;
      t = paramL;
      uv = uvPoint;
    }
# ---------- end gh_plx ----------
plx = LinePlane(Line=line_5, Plane=pln_3)  # -> Point, ParamL, ParamP
panel_29 = Panel(plx.Point)
panel_30 = Panel(plx.ParamL)
panel_31 = Panel(plx.ParamP)
panel_32 = Panel(gh_plx.POut)
panel_33 = Panel(gh_plx.t)
panel_34 = Panel(gh_plx.uv)

# ---- group: Plane | Plane
pln_4 = Plane(PlaneYZ(0, 0, 0))
pln_5 = Plane(Plane(origin=(0, 0, 0), x=(0.9696955626, 0, 0.2443164257), y=(0, 1, 0)))
gh_ppx = CSharpScript(A=pln_4, B=pln_5)  # -> out, L; inputs A: Plane, B: Plane
# ---------- gh_ppx: C# ----------
    //Component written by @bava-kumaravel
    //Solves intersection between two planes A and B, and returns 
    //the line of intersection L
    
    //Define the line of intersection
    Line line = new Line();
    
    //Perform intersection
    bool success = Rhino.Geometry.Intersect.Intersection.PlanePlane
      (A, B, out line);
    
    if(success){
      //Outputs
      L = line;
    }
# ---------- end gh_ppx ----------
ppx = PlanePlane(PlaneA=pln_4, PlaneB=pln_5)
panel_35 = Panel(ppx)
panel_36 = Panel(gh_ppx.L)

# ---- group: Plane Region
pln_6 = Plane(Plane(origin=(0, 0, 0), x=(0.9696955626, 0, 0.2443164257), y=(0, 1, 0)))
pln_7 = Plane([PlaneYZ(0, 0, 0), PlaneXY(0, 0, 0), Plane(origin=(-7.419283127, 3.926638653, -2.173498116), x=(-0.6902275847, -0.7132465239, 0.1219232437), y=(0.07836642648, -0.2411902049, -0.9673086313))])
plreg = PlaneRegion(Plane=pln_6, Bounds=pln_7)
gh_plreg = CSharpScript(P=pln_6, B=pln_7)  # -> out, R; inputs P: Plane, B: list of Plane
# ---------- gh_plreg: C# usings ----------
using System.IO;
using System.Linq;
using System.Data;
using System.Drawing;
using System.Reflection;
using System.Windows.Forms;
using System.Xml;
using System.Xml.Linq;
using System.Runtime.InteropServices;

using Rhino.DocObjects;
using Rhino.Collections;
using GH_IO;
using GH_IO.Serialization;
# ---------- gh_plreg: C# ----------
    Component.AddRuntimeMessage(GH_RuntimeMessageLevel.Warning,
      "Component under development. Work in Progress");
# ---------- end gh_plreg ----------
panel_37 = Panel(plreg)
panel_38 = Panel(gh_plreg.R)

# ---- group: IsoVist
pln_8 = Plane(PlaneXY(0, 0, 0))
number_slider = Slider(6, range=0..100)
number_slider_2 = Slider(21.66, range=0..100)
geo = Geometry([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])
gh_ivist = CSharpScript(P=pln_8, N=number_slider, R=number_slider_2, O=geo)  # -> out, POut, D, I; inputs P: Plane, N: Int32, R: Double, O: list of GeometryBase
# ---------- gh_ivist: C# ----------
    //Component written by @bava-kumaravel
    //Compute an isovist sampling at a Plane P, with obstacles O
    //at a distance range of R and sample count of N, and return
    //points of intersection, the distances to them and the indices
    //of obstacles hit

    //Sanity check

    //Check 1 - Check if sample count is one or higher
    if(N < 1){
      //If it is less than 1, throw an error and stop execution
      Component.AddRuntimeMessage(GH_RuntimeMessageLevel.Error,
        "Sample count must be one or higher");
    }

    //Check 2 - Check if sample radius is more than zero
    if(R <= 0.00){
      //If it is equal or less than 0, throw an error and stop execution
      Component.AddRuntimeMessage(GH_RuntimeMessageLevel.Error,
        "Sample radius must be higher than zero");
    }

    //Check 3 - Check if all incoming geometry is a valid obstacle
    //that is, if it is either a curve, surface, mesh or brep - it is valid
    //Other object types such as points are not valid

    //We convert valid obstacles into curves for ease of computation
    //Define a curve array to hold the obstacles curves
    Curve[] curvesOb = new Curve[O.Count];

    //Go through the list of obstacles and check for their validity
    //Convert valid geometries to curves
    for(int i = 0;i < O.Count;i++){
      GeometryBase obj = O[i];
      if(obj.ObjectType == ObjectType.Curve ||
        obj.ObjectType == ObjectType.Surface ||
        obj.ObjectType == ObjectType.Brep ||
      obj.ObjectType == ObjectType.Mesh){
        //Convert the geomtries to curves
        if(obj.ObjectType == ObjectType.Curve){ //Curve
          curvesOb[i] = (Curve) obj;
        }
        else if(obj.ObjectType == ObjectType.Surface){ //Surface
          //Convert the Surface to a Brep
          Surface surface = (Surface) obj;
          Brep brep = surface.ToBrep();
          //Intersect the brep with the plane
          Curve[] curvesInt = new Curve[0];
          Point3d[] pointsInt = new Point3d[0];
          bool success = Rhino.Geometry.Intersect.Intersection.BrepPlane
            (brep, P, doc.ModelAbsoluteTolerance, out curvesInt, out pointsInt);
          if(success){
            curvesOb[i] = curvesInt[0];
          }
          else{
            curvesOb[i] = null;
          }
        }
        else if(obj.ObjectType == ObjectType.Brep){ //Brep
          Brep brep = (Brep) obj;
          //Intersect the brep with the plane
          Curve[] curvesInt = new Curve[0];
          Point3d[] pointsInt = new Point3d[0];
          bool success = Rhino.Geometry.Intersect.Intersection.BrepPlane
            (brep, P, doc.ModelAbsoluteTolerance, out curvesInt, out pointsInt);
          if(curvesInt.Length > 0){
            curvesOb[i] = curvesInt[0];
          }
          else{
            curvesOb[i] = null;
          }
        }
        else { //Mesh
          Mesh mesh = (Mesh) obj;
          //Intersect Mesh with Plane
          Polyline[] polylinesInt = Rhino.Geometry.Intersect.Intersection.MeshPlane
            (mesh, P);
          if(polylinesInt != null){
            //Convert polyline into a curve
            Curve curveInt = polylinesInt[0].ToPolylineCurve();
            curvesOb[i] = curveInt;
          }
          else{
            curvesOb[i] = null;
          }
        }
      }
      else{     //Not valid
        //Throw an error
        Component.AddRuntimeMessage(GH_RuntimeMessageLevel.Error,
          "Obstacle at index " + i + " is of unknown type.");
        curvesOb[i] = null;
      }
    }

    //Define lists of points of intersection, distances and obstacles index
    //for the outputs
    List<Point3d> points = new List<Point3d>();
    List<double> distances = new List<double>();
    List<int> indices = new List<int>();

    //Create N lines and check for their intersections with the obstacles
    //To compute the angle increment for each line from the plane
    //origin, we divide 2 pi radius by N
    double angleInc = 2 * Math.PI / N;

    for(int i = 0;i < N;i++){
      //Find direction vector of the line
      //Initialize it with the X axis of the plane
      Vector3d direction = P.XAxis;
      //Rotate the vector with the angle increment times the index
      //around the Z axis of the plane
      bool success = direction.Rotate(angleInc * i, P.ZAxis);
      //Draw a line of distance R along the direction vector
      Line line = new Line(P.Origin, direction, R);

      //Define boolean to check if an intersection has occured
      bool intersectionFound = false;

      //Go through the list of obstacle curves and check for intersection
      for(int j = 0;j < curvesOb.Length;j++){

        if(curvesOb[j] != null){ //If the curve is existent
          Curve curve1 = curvesOb[j];
          //Check for intersection
          double tol = doc.ModelAbsoluteTolerance;
          //Convert line to curve for the intersection operation
          Curve curve2 = line.ToNurbsCurve();
          Rhino.Geometry.Intersect.CurveIntersections inter = Rhino.Geometry.Intersect.Intersection.CurveCurve
            (curve1, curve2, tol, tol);
          if(inter.Count > 0){ //If there are intersections
            //Define a point list to hold all the intersection points
            List<Point3d> interPts = new List<Point3d>();
            //Go through the list of interseciton events
            for(int k = 0;k < inter.Count;k++){
              if(inter[k].IsPoint){
                interPts.Add(inter[k].PointA);
              }
            }
            //Find the closest point to the origin of the plane within the point list
            //That gives the true point of intersection
            Point3d point = Point3dList.ClosestPointInList(interPts, P.Origin);
            //Add it to the list of points
            points.Add(point);
            //Find the distance between the origin of the plane P and the point
            double dist = P.Origin.DistanceTo(point);
            //Add it to the list of distances
            distances.Add(dist);
            //Add the index j to the list of indices
            indices.Add(j);
            //Set boolean to true
            intersectionFound = true;
            //Break the loop for this line
            break;
          }
        }
        else{   //If the curve is non-existent
          //Skip this obstacle
          continue;
        }
      }
      //If an intersection has not occured
      if(!intersectionFound){
        //Set point to the end of the line
        Point3d point = line.PointAt(1);
        //Add it to the list of points
        points.Add(point);
        //Set the distance to the range R
        double dist = R;
        //Add it to the list of distances
        distances.Add(dist);
        //Add -1 to the list of indices
        indices.Add(-1);
      }
    }

    //Outputs
    POut = points;
    D = distances;
    I = indices;
# ---------- end gh_ivist ----------
ivist = IsoVist(Plane=pln_8, Count=number_slider, Radius=number_slider_2, Obstacles=geo)  # -> Points, Distance, Index
panel_39 = Panel(ivist.Points)
panel_40 = Panel(gh_ivist.POut)
panel_41 = Panel(ivist.Distance)
panel_42 = Panel(gh_ivist.D)
panel_43 = Panel(ivist.Index)
panel_44 = Panel(gh_ivist.I)

# ---- group: IsoVist Ray
line_6 = Line(Line((-3, -5, 0), (2, 6, 0)))
number_slider_3 = Slider(17.54, range=0..100)
geo_2 = Geometry([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])
gh_ivray = CSharpScript(S=line_6, R=number_slider_3, O=geo_2)  # -> out, P, D, I; inputs S: Line, R: Double, O: list of GeometryBase
# ---------- gh_ivray: C# ----------
    //Component written by @bava-kumaravel
    //Compute a single isovist sampling at a line S, with obstacles O at a
    //distance range of R from the start point of S and return the point
    //of intersection, the distance to them and the index of obstacle hit

    //Sanity Check

    //Check 1 - Check if sample radius is more than zero
    if(R<= 0.00){
      //If it is equal or less than 0, throw an error and stop execution
      Component.AddRuntimeMessage(GH_RuntimeMessageLevel.Error,
        "Sample radius must be higher than zero");
    }

    //Check 2 - Check if all incoming geometry is a valid obstacle
    //that is, if it is either a curve, surface, mesh or brep - it is valid
    //Other object types such as points are not valid

    //We convert valid obstacles into curves for ease of computation
    //Define a curve array to hold the obstacles curves
    Curve[] curvesOb = new Curve[O.Count];

    //Go through the list of obstacles and check for their validity
    //Convert valid geometries to curves
    //Get the plane that the line lies in for the conversion
    Plane plane = new Plane();
    bool planeTry = S.TryGetPlane(out plane);

    for(int i = 0;i < O.Count;i++){
      GeometryBase obj = O[i];
      if(obj.ObjectType == ObjectType.Curve ||
        obj.ObjectType == ObjectType.Surface ||
        obj.ObjectType == ObjectType.Brep ||
      obj.ObjectType == ObjectType.Mesh){
        //Convert the geomtries to curves

        if(obj.ObjectType == ObjectType.Curve){ //Curve
          curvesOb[i] = (Curve) obj;
        }
        else if(obj.ObjectType == ObjectType.Surface){ //Surface
          //Convert the Surface to a Brep
          Surface surface = (Surface) obj;
          Brep brep = surface.ToBrep();
          //Intersect the brep with the plane
          Curve[] curvesInt = new Curve[0];
          Point3d[] pointsInt = new Point3d[0];
          bool success = Rhino.Geometry.Intersect.Intersection.BrepPlane
            (brep, plane, doc.ModelAbsoluteTolerance, out curvesInt, out pointsInt);
          if(success){
            curvesOb[i] = curvesInt[0];
          }
          else{
            curvesOb[i] = null;
          }
        }
        else if(obj.ObjectType == ObjectType.Brep){ //Brep
          Brep brep = (Brep) obj;
          //Intersect the brep with the plane
          Curve[] curvesInt = new Curve[0];
          Point3d[] pointsInt = new Point3d[0];
          bool success = Rhino.Geometry.Intersect.Intersection.BrepPlane
            (brep, plane, doc.ModelAbsoluteTolerance, out curvesInt, out pointsInt);
          if(curvesInt.Length > 0){
            curvesOb[i] = curvesInt[0];
          }
          else{
            curvesOb[i] = null;
          }
        }
        else { //Mesh
          Mesh mesh = (Mesh) obj;
          //Intersect Mesh with Plane
          Polyline[] polylinesInt = Rhino.Geometry.Intersect.Intersection.MeshPlane
            (mesh, plane);
          if(polylinesInt != null){
            //Convert polyline into a curve
            Curve curveInt = polylinesInt[0].ToPolylineCurve();
            curvesOb[i] = curveInt;
          }
          else{
            curvesOb[i] = null;
          }
        }
      }
      else{     //Not valid
        //Throw an error
        Component.AddRuntimeMessage(GH_RuntimeMessageLevel.Error,
          "Obstacle at index " + i + " is of unknown type.");
        curvesOb[i] = null;
      }
    }


    //Store the input line
    Line line = S;
    //Extend or shorten the line by the given ranga
    bool successLine = line.Extend(0, R - line.Length);
    //Convert line to curve for the intersection operation
    Curve curve1 = line.ToNurbsCurve();

    //Define the point of intersection, distance and obstacle index
    //for the outputs
    Point3d point = new Point3d();
    double distance = R;
    int index = -1;

    //Define boolean to check if an intersection has occured
    bool intersectionFound = false;

    //Go through the list of obstacle curves and check for intersection
    for(int j = 0;j < curvesOb.Length;j++){

      if(curvesOb[j] != null){ //If the curve is existent
        Curve curve2 = curvesOb[j];
        //Check for intersection
        double tol = doc.ModelAbsoluteTolerance;
        Rhino.Geometry.Intersect.CurveIntersections inter = Rhino.Geometry.Intersect.Intersection.CurveCurve
          (curve1, curve2, tol, tol);
        if(inter.Count > 0){ //If there are intersections
          //Define a point list to hold all the intersection points
          List<Point3d> interPts = new List<Point3d>();
          //Go through the list of interseciton events
          for(int k = 0;k < inter.Count;k++){
            if(inter[k].IsPoint){
              interPts.Add(inter[k].PointA);
            }
          }
          //Find the closest point to the origin of the plane within the point list
          //That gives the true point of intersection
          point = Point3dList.ClosestPointInList(interPts, plane.Origin);
          //Find the distance between the origin of the plane P and the point
          distance = plane.Origin.DistanceTo(point);
          //Set the index as j
          index = j;
          //Set boolean to true
          intersectionFound = true;
          //Exit the loop
          break;
        }
      }
      else{   //If the curve is non-existent
        //Skip this obstacle
        continue;
      }
    }
    //If an intersection has not occured
    if(!intersectionFound){
      //Set point to the end of the line
      point = line.PointAt(1);
      //Set the distance to the range R
      distance = R;
      //Set index as -1
      index = -1;
    }


    //Outputs
    P = point;
    D = distance;
    I = index;
# ---------- end gh_ivray ----------
ivray = IsoVistRay(Sample=line_6, Radius=number_slider_3, Obstacles=geo_2)  # -> Point, Distance, Index
panel_45 = Panel(ivray.Point)
panel_46 = Panel(ivray.Distance)
panel_47 = Panel(ivray.Index)
panel_48 = Panel(gh_ivray.P)
panel_49 = Panel(gh_ivray.D)
panel_50 = Panel(gh_ivray.I)

# ---- group: Curve | Line
crv = Curve(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)
line_7 = Line(Line((15, 9, 0), (-6, 0, 0)))
gh_clx = CSharpScript(C=crv, L=line_7)  # -> out, P, t, N; inputs C: Curve, L: Line
# ---------- gh_clx: C# ----------
    //Component written by @bava-kumaravel
    //Solve intersection events between a curve C and a line P
    //and find the points of intersection P and the curve parameters t

    //Define lists to hold the points of intersection and the
    //curve parameters
    List<Point3d> points = new List<Point3d>();
    List<double> param = new List<double>();

    //Define tolerance as the Model Space Absolute Tolerance
    double tol = doc.ModelAbsoluteTolerance;

    //Define a Curve intersection event and perform intersection
    Rhino.Geometry.Intersect.CurveIntersections inter =
      Rhino.Geometry.Intersect.Intersection.CurveLine(C, L, tol, tol);

    //Go through the intersection event list, retrieve the point of
    //intersection on Line (B) and parameter on the Curve (A) and
    //add them to the points and parameters list
    for(int i = 0;i < inter.Count;i++){
      Point3d point = inter[i].PointB;
      double parameter = inter[i].ParameterA;
      points.Add(point);
      param.Add(parameter);
    }

    //Outputs
    P = points;
    t = param;
    N = points.Count;
# ---------- end gh_clx ----------
clx = CurveLine(Curve=crv, Line=line_7)  # -> Points, Params, Count
panel_51 = Panel(clx.Points)
panel_52 = Panel(gh_clx.P)
panel_53 = Panel(gh_clx.t)
panel_54 = Panel(clx.Params)
panel_55 = Panel(clx.Count)
panel_56 = Panel(gh_clx.N)

# ---- group: Mesh | Ray
mesh = Mesh(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)
pt = Point(Point(12, -11.39902814, 0))
vec = Vector(Vector(-0.2152316853, 0.5983366383, 0.7717956912))
gh_meshray = CSharpScript(M=mesh, P=pt, D=vec)  # -> out, X, H; inputs M: Mesh, P: Point3d, D: Vector3d
# ---------- gh_meshray: C# ----------
    //Component written by @bava-kumaravel
    //Solve intersection between a Mesh M and and Ray from Point P
    //along the direction D, and return intersection point X

    //Define a ray from point P in the direction D
    Ray3d ray = new Ray3d(P, D);

    //Perform intersection between Mesh M and Ray ray
    double param = Rhino.Geometry.Intersect.Intersection.MeshRay(M, ray);

    //Define intersection point and success bool
    Point3d point = new Point3d();
    bool success = false;

    //Check if intersection is successful by checking if parameter is
    //greater than or equal to zero
    if(param >= 0){

      //If successful, find point of intersection using the parameter
      point = ray.PointAt(param);
      success = true;

      //Outputs
      X = point;
      H = success;
    }
    else{
      //Outputs
      H = success;
    }
# ---------- end gh_meshray ----------
meshray = MeshRay(Mesh=mesh, Point=pt, Direction=vec)  # -> Point, Hit
panel_57 = Panel(meshray.Point)
panel_58 = Panel(meshray.Hit)
panel_59 = Panel(gh_meshray.X)
panel_60 = Panel(gh_meshray.H)

# ---- group: Contour
brep_4 = Brep(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)
pt_2 = Point(Point(13.00829152, -35.81340594, -1.781845832))
vec_2 = Vector(Vector(-0.2152316853, 0.5983366383, 0.7717956912))
number_slider_4 = Slider(1.12, range=0..10)
gh_contour_2 = CSharpScript(S=brep_4, P=pt_2, N=vec_2, D=number_slider_4)  # -> out, C; inputs S: tree of GeometryBase, P: Point3d, N: Vector3d, D: Double
# ---------- gh_contour_2: C# ----------
    //Component written by @bava-kumaravel
    //Create a set of contour curves C for a Brep or Mesh S, with the origin P,
    //direction N and distance D

    //Sanity Check
    //Check one - Check if the contour distance is over zero
    if(D <= 0){
      //If it is less than or equal to zero, throw an error and stop execution
      Component.AddRuntimeMessage(GH_RuntimeMessageLevel.Error,
        "Contour distance must be larger than the document absolute tolerance");
      return;
    }

    //Check if all the incoming geometry is either a brep or a mesh
    for(int i = 0;i < S.BranchCount;i++){
      List<GeometryBase> geometries = S.Branches[i];
      for(int j = 0;j < geometries.Count;j++){
        GeometryBase geo = geometries[j];
        if(geo.ObjectType != ObjectType.Brep && geo.ObjectType != ObjectType.Mesh){
          //If it is neither, throw an error and stop execution
          Component.AddRuntimeMessage(GH_RuntimeMessageLevel.Error,
            "Shape must be a Mesh or a Brep");
          return;
        }
      }
    }
    
    //Define a curves datatree to hold the contour lines
    DataTree<Curve> curves = new DataTree<Curve>();

    //Go through the data tree of geometries
    for(int branchIndex = 0; branchIndex < S.BranchCount;branchIndex++){
      List<GeometryBase> geometries = S.Branches[branchIndex];
      GH_Path branchPath = S.Paths[branchIndex];
      for(int i = 0;i < geometries.Count;i++){
        GeometryBase geo = geometries[i];
        
        //Create a list of planes to intersect with the Geometry to form contours
        //Duplicate the point along it direction vector, to generate the intersection planes
        //To get the number of planes needed, first calculate the maximum distance
        //from the input point P, the planes have to span.
        //The maximum distance is calculated using the furthest point on the geometry S
        //To calculate the furthest point, first get the bounding box of the geometry S
        BoundingBox box = geo.GetBoundingBox(true);
        Point3d furthestPt = box.FurthestPoint(P);
        double dist = P.DistanceTo(furthestPt);
        //Divide the total distance by the distance between each contour line
        int num = (int) Math.Ceiling(dist / D);

        //Define an int to store number of contour groups
        //to initiate brances in the output data tree
        int contourCount = 0;
        
        //Go through the list of 'num' planes and make intersections
        for(int j = 0;j < num;j++){
          //Move the point P in the direction N, with distance D times i
          double distance = D * j;
          //Multiply the unitized N with the distance, and add to point P, to get the
          //moved point location
          N.Unitize();
          Point3d pointNew = P + (N * distance);
          //With pointNew as the base point and N as the normal vector, create a plane
          Plane plane = new Plane(pointNew, N);
          //Perform intersection based on whether it is a brep or a mesh

          if(geo.ObjectType==ObjectType.Brep){     //Brep
            //Define tolerance as model space absolute tolerance
            double tol = doc.ModelAbsoluteTolerance;
            
            //Define array of curves and points ato hold the intersections at level i
            Curve[] curvesAtI = new Curve[0];
            Point3d[] pointsAtI = new Point3d[0];
            bool success = Rhino.Geometry.Intersect.Intersection.BrepPlane
              ((Brep) geo, plane, tol, out curvesAtI, out pointsAtI);
            
            //If the intersection is a success
            if(success){
              //If there is atleast one intersecting curve
              if(curvesAtI.Length > 0){
                //Go through the array of curves and add them to the output datatree
                GH_Path branchId = branchPath.AppendElement(contourCount);
                for(int k = 0;k < curvesAtI.Length;k++){
                  Curve curve = curvesAtI[k];
                  curves.Add(curve, branchId);
                }
                //Increase the contour branches count by 1
                contourCount++;
              }
            }
          }
            
          else{     //Mesh
            //Define an array of polylines to hold the list of intersections at level i
            Polyline[] polylines = Rhino.Geometry.Intersect.Intersection.MeshPlane
              ((Mesh) geo, plane);
            
            //If there is atleast one intersecting polyline
            if(polylines.Length > 0){
              for(int k = 0;k < polylines.Length;k++){
                //Convert polyline into a curve
                Curve curve = polylines[k].ToPolylineCurve();
                //Add curve to the datatree
                GH_Path branchId = new GH_Path(contourCount);
                curves.Add(curve, branchId);
              }
              //Increase the contour branches count by 1
              contourCount++;
            }
          }
        }
      }
    }
    
    //Outputs
    C = curves;
# ---------- end gh_contour_2 ----------
contour_2 = Contour(Shape=brep_4, Point=pt_2, Direction=vec_2, Distance=number_slider_4)
panel_61 = Panel(contour_2)
panel_62 = Panel(gh_contour_2.C)

# ---- group: Curve | Plane
crv_2 = Curve(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)
pln_9 = Plane(PlaneXY(0, 0, 0))
gh_pcx = CSharpScript(C=crv_2, P=pln_9)  # -> out, POut, t, uv; inputs C: Curve, P: Plane
# ---------- gh_pcx: C# ----------
    //Component written by @bava-kumaravel
    //Solves intersection between a curve C and a plane P and returns
    //intersection points P, parameters on curve t and parameters on plane uv

    //Set tolerance as the model space absolute tolerance
    double tol = doc.ModelAbsoluteTolerance;

    //Define lists to holds the intersection points, parameters of curve and plane
    List<Point3d> points = new List<Point3d>();
    List<double> paramC = new List<double>();
    List<Point3d> paramP = new List<Point3d>();

    //Perform intersection
    Rhino.Geometry.Intersect.CurveIntersections intersections = Rhino.Geometry.Intersect.Intersection.
      CurvePlane(C, P, tol);

    //Go through the list of intersection events
    for(int i = 0;i < intersections.Count;i++){
      Rhino.Geometry.Intersect.IntersectionEvent inter = intersections[i];
      if(inter.IsPoint){  //Point intersecion
        //Point A refers to the point of intersection on the curve C
        points.Add(inter.PointA);
        //Parameter A refers to the parameter of the curve C at the intersection
        paramC.Add(inter.ParameterA);
        //Define variables to hold the u, v parameter of the plane
        double u, v;
        inter.SurfacePointParameter(out u, out v);
        //Define a point using the u, v parameters
        Point3d uvParam = new Point3d(u, v, 0);
        paramP.Add(uvParam);
      }
      else{  //Overlap
        //Overlap A refers to the overlapping parameter interval on the curve C
        Interval curveOverlap = inter.OverlapA;
        //Get the parameters from the interval
        double startingParamC = curveOverlap.Min;
        double endingParamC = curveOverlap.Max;
        paramC.Add(curveOverlap.Min);
        paramC.Add(curveOverlap.Max);
        //Get the points of intersection using the parameters
        points.Add(C.PointAt(startingParamC));
        points.Add(C.PointAt(endingParamC));
        //Define intervals for the u and v paramers
        Interval u, v;
        //Get the overlapping interval on the surface
        inter.SurfaceOverlapParameter(out u, out v);
        //Define two points with the starting and ending u v parameters
        Point3d uv1 = new Point3d(u.Min, v.Min, 0);
        Point3d uv2 = new Point3d(u.Max, v.Max, 0);
        paramP.Add(uv1);
        paramP.Add(uv2);
      }
    }

    //Outputs
    POut = points;
    t = paramC;
    uv = paramP;
# ---------- end gh_pcx ----------
pcx = CurvePlane(Curve=crv_2, Plane=pln_9)  # -> Points, ParamsC, ParamsP
panel_63 = Panel(pcx.Points)
panel_64 = Panel(gh_pcx.POut)
panel_65 = Panel(gh_pcx.t)
panel_66 = Panel(pcx.ParamsC)
panel_67 = Panel(pcx.ParamsP)
panel_68 = Panel(gh_pcx.uv)

# ---- group: Mesh | Plane
mesh_2 = Mesh(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)
pln_10 = Plane(Plane(origin=(0, 0, 0), x=(0.9696955626, 0, 0.2443164257), y=(0, 1, 0)))
gh_sec_2 = CSharpScript(M=mesh_2, P=pln_10)  # -> out, C; inputs M: Mesh, P: Plane
# ---------- gh_sec_2: C# ----------
    //Component written by @bava-kumaravel
    //Solves intersection between a Mesh M and a Plane P and returns
    //the curves of intersection C

    //Define list to hold the curves of intersection
    List<Curve> curves = new List<Curve>();
    
    //Perform intersection
    Polyline[] polylines = Rhino.Geometry.Intersect.Intersection.MeshPlane(
      M, P);
    
    //Go through the list of polylines, convert them to curves and add them
    //to the list of curves
    for(int i = 0;i < polylines.Length;i++){
      Curve curve = polylines[i].ToPolylineCurve();
      curves.Add(curve);
    }
    
    //Outputs
    C = curves;
# ---------- end gh_sec_2 ----------
sec_2 = MeshPlane(Mesh=mesh_2, Plane=pln_10)
panel_69 = Panel(sec_2)
panel_70 = Panel(gh_sec_2.C)

# ---- group: Plane | Plane | Plane
pln_11 = Plane(PlaneYZ(0, 0, 0))
pln_12 = Plane(Plane(origin=(0, 0, 0), x=(0.9696955626, 0, 0.2443164257), y=(0, 1, 0)))
pln_13 = Plane(Plane(origin=(-7.419283127, 3.926638653, -2.173498116), x=(-0.6902275847, -0.7132465239, 0.1219232437), y=(0.07836642648, -0.2411902049, -0.9673086313)))
gh_3px = CSharpScript(A=pln_11, B=pln_12, C=pln_13)  # -> out, Pt, AB, AC, BC; inputs A: Plane, B: Plane, C: Plane
# ---------- gh_3px: C# ----------
    //Component written by @bava-kumaravel
    //Solves intersectio between three planes A, B and C and returns
    //three lines of intersection between them Ab, Ac and BC and their
    //common point of intersection Pt

    //Define the lines of intersection and the point of intersection
    Line lineAB = new Line();
    Line lineAC = new Line();
    Line lineBC = new Line();
    Point3d pointABC = new Point3d();
    
    //Find the lines of intersection
    //Solving intersection between Plane A and B
    bool successAB = Rhino.Geometry.Intersect.Intersection.PlanePlane
      (A, B, out lineAB);
    if(successAB){
      //Output
      AB = lineAB;
    }
    
    //Solving intersection between Plane A and C
    bool successAC = Rhino.Geometry.Intersect.Intersection.PlanePlane
      (A, C, out lineAC);
    if(successAC){
      //Output
      AC = lineAC;
    }
    
    //Solving intersection between Plane B and C
    bool successBC = Rhino.Geometry.Intersect.Intersection.PlanePlane
      (B, C, out lineBC);
    if(successBC){
      //Output
      BC = lineBC;
    }

    //Find the point of intersection
    bool successABC = Rhino.Geometry.Intersect.Intersection.PlanePlanePlane
      (A, B, C, out pointABC);
    if(successABC){
      //Output
      Pt = pointABC;
    }
# ---------- end gh_3px ----------
_3px = PlanePlanePlane(PlaneA=pln_11, PlaneB=pln_12, PlaneC=pln_13)  # -> Point, LineAB, LineAC, LineBC
panel_71 = Panel(_3px.Point)
panel_72 = Panel(_3px.LineAB)
panel_73 = Panel(_3px.LineAC)
panel_74 = Panel(_3px.LineBC)
panel_75 = Panel(gh_3px.Pt)
panel_76 = Panel(gh_3px.AB)
panel_77 = Panel(gh_3px.AC)
panel_78 = Panel(gh_3px.BC)
