# Grasshopper definition Intersect_Physical.ghx (Grasshopper 1.0.7)

# ---- group: Curve | Curve
# GH#: A C# dictionary of Grasshopper3D components.
# 
# This file contains a category of Grasshopper components, and a mirroring C#/RhinoCommon implementation.
# 
# This is an educational project initiated by students/faculty of GSD-6338: Introduction to Computational Design, at the Harvard Graduate School of Design.
# 
# More information: {{project link}}
# Intersect Physical
crv = Curve(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)
crv_2 = Curve(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)
gh_ccx = CSharpScript(A=crv, B=crv_2)  # -> out, P, tA, tB; inputs A: Curve, B: Curve
# ---------- gh_ccx: C# usings ----------
using System.IO;
using System.Linq;
using System.Data;
using System.Drawing;
using System.Reflection;
using System.Windows.Forms;
using System.Xml;
using System.Xml.Linq;
using System.Runtime.InteropServices;

using Rhino.DocObjects;
using Rhino.Collections;
using GH_IO;
using GH_IO.Serialization;
# ---------- gh_ccx: C# ----------
    //Component written by @bava-kumaravel
    //Solves intersections between two curves A and B and returns the
    //points of intersection P and the parameters on the curves tA and tB

    //Define lists to hold the intersection points and parameters
    List<Point3d> points = new List<Point3d>();
    List<double> paramA = new List<double>();
    List<double> paramB = new List<double>();

    //Define tolerance as the Model Space Absolute Tolerance
    double tol = doc.ModelAbsoluteTolerance;

    //Perform intersection
    Rhino.Geometry.Intersect.CurveIntersections intersections =
      Rhino.Geometry.Intersect.Intersection.CurveCurve(A, B, tol, tol);

    if(intersections != null){
      //If there are intersections, go through the list of intersection events
      for(int i = 0;i < intersections.Count;i++){
        Rhino.Geometry.Intersect.IntersectionEvent inter = intersections[i];
        //Check if the intersection event is an intersection or an overlap
        if(inter.IsOverlap){
          //If it is an overlap, there will be two points and parameters as
          //outputs, one at the start of the overlap and one at the end
          Point3d startingPt = inter.PointA;
          Point3d endingPt = inter.PointA2;
          //Add the two points to the points list
          points.Add(startingPt);
          points.Add(endingPt);
          //Get the overlapping interval in Curve A and B
          Interval overlapA = inter.OverlapA;
          Interval overlapB = inter.OverlapB;
          //Get the starting and ending parameters from the overlapping intervals
          double startingParamA = overlapA.Min;
          double endingParamA = overlapA.Max;
          double startingParamB = overlapB.Min;
          double endingParamB = overlapB.Max;
          //Add the parameters to the respective lists
          paramA.Add(startingParamA);
          paramA.Add(endingParamA);
          paramB.Add(startingParamB);
          paramB.Add(endingParamB);
        }
        else if (inter.IsPoint){
          //If it is an intersection, there will be one point and one parameter
          //for each curve
          Point3d point = inter.PointA;
          //Add intersection point to the points list
          points.Add(point);
          //Get the parameters at curve A and B
          double parameterA = inter.ParameterA;
          double parameterB = inter.ParameterB;
          //Add the parameters to their respective lists
          paramA.Add(parameterA);
          paramB.Add(parameterB);
        }
      }
    }

    //Outputs
    P = points;
    tA = paramA;
    tB = paramB;
# ---------- end gh_ccx ----------
ccx = CurveCurve(CurveA=crv, CurveB=crv_2)  # -> Points, ParamsA, ParamsB
panel = Panel(ccx.Points)
panel_2 = Panel(gh_ccx.P)
panel_3 = Panel(ccx.ParamsA)
panel_4 = Panel(gh_ccx.tA)
panel_6 = Panel(gh_ccx.tB)

# ---- group: Curve | Self
crv_3 = Curve(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)
cx = CurveSelf(Curve=crv_3)  # -> Points, Params
gh_cx = CSharpScript(C=crv_3)  # -> out, P, t; inputs C: Curve
# ---------- gh_cx: C# ----------
    //Component written by @bava-kumaravel
    //Solves all self intersections on a curve and returns the points of
    //intersection P and its parameters t

    //Define lists to hold the output intersection points and parameters
    List<Point3d> points = new List<Point3d>();
    List<double> param = new List<double>();

    //Define tolerance as the Model Space Absolute Tolerance
    double tol = doc.ModelAbsoluteTolerance;

    //Perform intersection
    Rhino.Geometry.Intersect.CurveIntersections intersections =
      Rhino.Geometry.Intersect.Intersection.CurveSelf(C, tol);

    if(intersections != null){
      //If there are intersections, go through the list of intersection events
      for(int i = 0;i < intersections.Count;i++){
        Rhino.Geometry.Intersect.IntersectionEvent inter = intersections[i];
        //Check if the intersection event is an intersection and not an overlap
        if (inter.IsPoint){
          //An intersection results in two parameters along the curve
          //for the same point
          //First get and store the parameters to the parameters list
          double parameterA = inter.ParameterA;
          double parameterB = inter.ParameterB;
          //Add the parameters to the parameters list
          param.Add(parameterA);
          param.Add(parameterB);
        }
      }
    }

    //Sort the parameters list
    param.Sort();

    //Go through the parameters array and get the points at them
    //and add them to the points list
    for(int i = 0;i < param.Count;i++){
      double parameter = param[i];
      Point3d point = C.PointAt(parameter);
      points.Add(point);
    }

    //Outputs
    P = points;
    t = param;
# ---------- end gh_cx ----------
panel_7 = Panel(cx.Points)
panel_8 = Panel(gh_cx.P)
panel_9 = Panel(cx.Params)
panel_10 = Panel(gh_cx.t)

# ---- group: Multiple Curves
crv_4 = Curve([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])
mcx = MultipleCurves(Curves=crv_4)  # -> Points, IndexA, IndexB, ParamA, ParamB
gh_mcx = CSharpScript(C=crv_4)  # -> out, P, iA, iB, tA, tB; inputs C: list of Curve
# ---------- gh_mcx: C# ----------
    //Component written by @bava-kumaravel
    //Solves intersection events between multiple curves C and returns
    //the points of intersection P, the indices of the two curves in intersection
    //iA and iB and their respective parameters tA and tB

    //Define lists to hold the output points, indices and parameters
    List<Point3d> points = new List<Point3d>();
    List<int> indicesA = new List<int>();
    List<int> indicesB = new List<int>();
    List<double> paramA = new List<double>();
    List<double> paramB = new List<double>();

    //Define tolerance as the Model Space Absolute Tolerance
    double tol = doc.ModelAbsoluteTolerance;

    //Go through the list of curves, taking two at a time and perform intersection
    for(int i = 0;i < C.Count;i++){
      for(int j = i + 1;j < C.Count;j++){
        
        //Store the two curves as A and B
        Curve A = C[i];
        Curve B = C[j];
        
        //Perform intersection
        Rhino.Geometry.Intersect.CurveIntersections intersections =
          Rhino.Geometry.Intersect.Intersection.CurveCurve(A, B, tol, tol);

        if(intersections != null){
          //If there are intersections, go through the list of intersection events
          for(int k = 0;k < intersections.Count;k++){
            Rhino.Geometry.Intersect.IntersectionEvent inter = intersections[k];
            //Check if the intersection event is an intersection or an overlap
            if(inter.IsOverlap){
              //If it is an overlap, there will be two points and parameters as
              //outputs, one at the start of the overlap and one at the end
              Point3d startingPt = inter.PointA;
              Point3d endingPt = inter.PointA2;
              //Add the two points to the points list
              points.Add(startingPt);
              points.Add(endingPt);
              //Get the overlapping interval in Curve A and B
              Interval overlapA = inter.OverlapA;
              Interval overlapB = inter.OverlapB;
              //Get the starting and ending parameters from the overlapping intervals
              double startingParamA = overlapA.Min;
              double endingParamA = overlapA.Max;
              double startingParamB = overlapB.Min;
              double endingParamB = overlapB.Max;
              //Add the parameters to the respective lists
              paramA.Add(startingParamA);
              paramA.Add(endingParamA);
              paramB.Add(startingParamB);
              paramB.Add(endingParamB);
              //Add the indices to the indices lists
              indicesA.Add(i);
              indicesB.Add(j);
            }
            else if (inter.IsPoint){
              //If it is an intersection, there will be one point and one parameter
              //for each curve
              Point3d point = inter.PointA;
              //Add intersection point to the points list
              points.Add(point);
              //Get the parameters at curve A and B
              double parameterA = inter.ParameterA;
              double parameterB = inter.ParameterB;
              //Add the parameters to their respective lists
              paramA.Add(parameterA);
              paramB.Add(parameterB);
              //Add the indices to the indices lists
              indicesA.Add(i);
              indicesB.Add(j);
            }
          }
        }
      }
    }
    
    //Outputs
    P = points;
    iA = indicesA;
    iB = indicesB;
    tA = paramA;
    tB = paramB;
# ---------- end gh_mcx ----------
panel_11 = Panel(mcx.Points)
panel_12 = Panel(gh_mcx.P)
panel_13 = Panel(mcx.IndexA)
panel_14 = Panel(gh_mcx.iA)
panel_15 = Panel(mcx.IndexB)
panel_16 = Panel(gh_mcx.iB)
panel_17 = Panel(mcx.ParamA)
panel_18 = Panel(gh_mcx.tA)
panel_19 = Panel(mcx.ParamB)
panel_20 = Panel(gh_mcx.tB)

# ---- group: Brep | Brep
brep = Brep(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)
brep_2 = Brep(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)
gh_bbx = CSharpScript(A=brep, B=brep_2)  # -> out, C, P; inputs A: Brep, B: Brep
# ---------- gh_bbx: C# ----------
    //Component written by @bava-kumaravel
    //Solves intersection between two Breps A and B and returns
    //the intersection curves C and points P
    
    //Define arrays to store the output curves and points
    Curve[] curves = new Curve[0];
    Point3d[] points = new Point3d[0];
    
    //Define tolerance as the model space absolute tolerance
    double tol = doc.ModelAbsoluteTolerance;
    
    //Perform intersection
    bool success = Rhino.Geometry.Intersect.Intersection.BrepBrep
      (A, B, tol, out curves, out points);
    
    //Outputs
    if(success){
      C = curves;
      P = points;
    }
# ---------- end gh_bbx ----------
bbx = BrepBrep(BrepA=brep, BrepB=brep_2)  # -> Curves, Points
panel_21 = Panel(bbx.Curves)
panel_22 = Panel(gh_bbx.C)
panel_23 = Panel(bbx.Points)
panel_24 = Panel(gh_bbx.P)

# ---- group: Brep | Curve
brep_3 = Brep(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)
crv_5 = Curve(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)
bcx = BrepCurve(Brep=brep_3, Curve=crv_5)  # -> Curves, Points
gh_bcx = CSharpScript(B=brep_3, C=crv_5)  # -> out, COut, P; inputs B: Brep, C: Curve
# ---------- gh_bcx: C# ----------
    //Component written by @bava-kumaravel
    //Solves intersections between a Brep B and a curve C and returns
    //intersection curves and points

    //Define arrays to hold the intersection curves and points
    Curve[] curves = new Curve[0];
    Point3d[] points = new Point3d[0];

    //Define tolerance as the model space absolute tolerance
    double tol = doc.ModelAbsoluteTolerance;

    //Peform intersection
    bool success = Rhino.Geometry.Intersect.Intersection.CurveBrep
      (C, B, tol, out curves, out points);

    //Outputs
    COut = curves;
    P = points;
# ---------- end gh_bcx ----------
panel_25 = Panel(bcx.Curves)
panel_26 = Panel(gh_bcx.COut)
panel_27 = Panel(bcx.Points)
panel_28 = Panel(gh_bcx.P)

# ---- group: Surface | Curve
srf = Surface(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)
crv_6 = Curve(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)
gh_scx = CSharpScript(S=srf, C=crv_6)  # -> out, COut, P, uv, N, t, T; inputs S: tree of Surface, C: list of Curve
# ---------- gh_scx: C# ----------
    //Component written by @bava-kumaravel
    //Solves intersections between a Surface S and a curve C and returns
    //the overlapping curves COut, points of intersection P, their parameters on the
    //surface and the curve uv & t, their normal vectors on the surface N and their
    //tangents along the curve T

    //Define datatrees to hold the outputs
    DataTree<Curve> curves = new DataTree<Curve>();
    DataTree<Point3d> points = new DataTree<Point3d>();
    DataTree<Point3d> paramS = new DataTree<Point3d>();
    DataTree<double> paramC = new DataTree<double>();
    DataTree<Vector3d> normals = new DataTree<Vector3d>();
    DataTree<Vector3d> tangents = new DataTree<Vector3d>();

    //Define tolerance as the model space absolute tolerance
    double tol = doc.ModelAbsoluteTolerance;

    //Go through the data tree of incoming surfaces and find the
    //intersections with curve C
    for(int branchIndex = 0;branchIndex < S.BranchCount;branchIndex++){
      //Get the list of surfaces in a branch
      List<Surface> surfaces = S.Branches[branchIndex];
      //Store its branch path
      GH_Path branchPath = S.Paths[branchIndex];
      //Go through the branch of surfaces

      for(int pathIndex = 0; pathIndex < surfaces.Count;pathIndex++){
        //Store the surface at the current index
        Surface surface = surfaces[pathIndex];

        //Go through the list of input curves
        for(int i = 0;i < C.Count;i++){
          //Store the curve at the current index
          Curve curve = C[i];

          //Initiate a new data branch
          GH_Path branchId = branchPath.AppendElement(i);

          //Perform intersection
          Rhino.Geometry.Intersect.CurveIntersections intersections =
            Rhino.Geometry.Intersect.Intersection.CurveSurface
            (curve, surface, tol, tol);

          if(intersections.Count>0){
            //If there are valid intersections, go through the list of intersection events
            for(int j = 0;j < intersections.Count;j++){
              //Get the intersection event at the current index j
              Rhino.Geometry.Intersect.IntersectionEvent inter = intersections[j];

              //Check if it is an overlap or an intersection
              if(inter.IsOverlap){
                //If it is an overlap, get the overlapping interval on the curve
                Interval overlap = inter.OverlapA;
                //Trim the curve with this interval
                Curve trimmedCurve = curve.Trim(overlap);
                //Add the curve to the curves list
                curves.Add(trimmedCurve, branchId);

                //Add null elements to the points, parameters, normals and tangents lists
                points.Add(Point3d.Unset, branchId);
                paramS.Add(Point3d.Unset, branchId);
                paramC.Add(double.NaN, branchId);
                normals.Add(Vector3d.Unset, branchId);
                tangents.Add(Vector3d.Unset, branchId);
              }

              else if(inter.IsPoint){
                //If it is an intersection, get the point of intersection
                Point3d point = inter.PointA;
                //Add the point to the list of intersection points
                points.Add(point, branchId);

                //Get the parameters on the curve and the surface with this point
                //Define the variables to hold the parameters
                double parameterC, u, v;
                bool successC = curve.ClosestPoint(point, out parameterC);
                bool successS = surface.ClosestPoint(point, out u, out v);
                //Construct a point with the u, v parameters
                Point3d parameterS = new Point3d(u, v, 0);
                //Add the parameters to their respective lists
                paramC.Add(parameterC, branchId);
                paramS.Add(parameterS, branchId);

                //Find normal vector and tangent vector using the paramters
                Vector3d normal = surface.NormalAt(u, v);
                Vector3d tangent = curve.TangentAt(parameterC);
                //Add them to their respective lists
                normals.Add(normal, branchId);
                tangents.Add(tangent, branchId);

                //Add a null element to the curves list
                curves.Add(null, branchId);
              }
            }
          }
          else{
            Print("No intersections for curve " + i);
            //If there are no intersections, add null elements to all output lists
            curves.Add(null, branchId);
            points.Add(Point3d.Unset, branchId);
            paramS.Add(Point3d.Unset, branchId);
            paramC.Add(double.NaN, branchId);
            normals.Add(Vector3d.Unset, branchId);
            tangents.Add(Vector3d.Unset, branchId);
          }
        }
      }
    }

    //Outputs
    COut = curves;
    P = points;
    uv = paramS;
    N = normals;
    t = paramC;
    T = tangents;
# ---------- end gh_scx ----------
scx = SurfaceCurve(Surface=srf, Curve=crv_6)  # -> Curves, Points, UVPoints, Normals, Parameters, Tangents
panel_29 = Panel(scx.Curves)
panel_30 = Panel(gh_scx.COut)
panel_31 = Panel(scx.Points)
panel_32 = Panel(gh_scx.P)
panel_33 = Panel(scx.UVPoints)
panel_34 = Panel(gh_scx.uv)
panel_35 = Panel(scx.Normals)
panel_36 = Panel(gh_scx.N)
panel_37 = Panel(scx.Parameters)
panel_38 = Panel(gh_scx.t)
panel_39 = Panel(scx.Tangents)
panel_40 = Panel(gh_scx.T)

# ---- group: Surface Split
srf_2 = Surface(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)
crv_7 = Curve([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])
gh_srfsplit = CSharpScript(S=srf_2, C=crv_7)  # -> Out, F
srfsplit = SurfaceSplit(Surface=srf_2, Curves=crv_7)
panel_41 = Panel(srfsplit)
panel_42 = Panel(gh_srfsplit.F)

# ---- group: Mesh | Curve
mesh = Mesh(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)
crv_8 = Curve(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)
mcx_2 = MeshCurve(Mesh=mesh, Curve=crv_8)  # -> Points, Faces
gh_mcx_2 = CSharpScript(M=mesh, C=crv_8)  # -> out, X, F; inputs M: tree of Mesh, C: Curve
# ---------- gh_mcx_2: C# ----------
    //Component written by @bava-kumaravel
    //Solves intersections between a Mesh M and a curve C and returns
    //points of intersection X and the indexes F of the mesh faces intersected

    //Define datatree to hold the output points and face ids
    DataTree<Point3d> points = new DataTree<Point3d>();
    DataTree<int> indices = new DataTree<int>();

    //Go through the input mesh datatree
    for(int branchIndex = 0; branchIndex < M.BranchCount;branchIndex++){
      //Store the path
      List<Mesh> meshes = M.Branches[branchIndex];
      GH_Path branchPath = M.Paths[branchIndex];
      for(int i = 0;i < meshes.Count;i++){
        //Get the mesh at the current index
        Mesh mesh = meshes[i];

        //Define tolerance as the model space absolute tolerance
        double tol = doc.ModelAbsoluteTolerance;

        //Convert Curve C to a PolylineCurve
        //Divide the curve into points
        Point3d[] pointsCurve = new Point3d[0];
        double[] t = C.DivideByLength(0.01, true, out pointsCurve);
        //Use the points to construct a polyline curve
        PolylineCurve polyCurve = new PolylineCurve(pointsCurve);

        //Define arrays to hold the intersection points and face ids
        Point3d[] pointArray = new Point3d[0];
        int[] faceId = new int[0];
        pointArray = Rhino.Geometry.Intersect.Intersection.MeshPolyline
          (mesh, polyCurve, out faceId);

        if(pointArray != null && pointArray.Length > 0){
          //Construct path
          GH_Path branchId = branchPath.AppendElement(i);
          //Go through point array and add them to points datatree
          for(int j = 0;j < pointArray.Length;j++){
            points.Add(pointArray[j], branchId);
          }
          //Go through face id array and add the ids to the indices datatree
          for(int j = 0;j < faceId.Length;j++){
            indices.Add(faceId[j], branchId);
          }
        }
        else{
          //Construct path
          GH_Path branchId = branchPath.AppendElement(i);
          //Add null elements
          points.Add(Point3d.Unset, branchId);
          indices.Add(RhinoMath.UnsetIntIndex, branchId);
        }
      }

      //Outputs
      X = points;
      F = indices;
    }
# ---------- end gh_mcx_2 ----------
panel_43 = Panel(mcx_2.Points)
panel_44 = Panel(gh_mcx_2.X)
panel_45 = Panel(mcx_2.Faces)
panel_46 = Panel(gh_mcx_2.F)

# ----
mesh_2 = Mesh(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)
mesh_3 = Mesh(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)
gh_mmx = CSharpScript(A=mesh_2, B=mesh_3)  # -> out, X; inputs A: tree of Mesh, B: tree of Mesh
# ---------- gh_mmx: C# ----------
    //Component written by @bava-kumaravel
    //Solves intersections between two meshes A and B and
    //returns the curves of intersection X
    
    // TODO: Match result with original
    Component.AddRuntimeMessage(GH_RuntimeMessageLevel.Warning, "Output doesn't match original exactly");

    //Initialize data tree to hold the outputs
    DataTree<Curve> curves = new DataTree<Curve>();

    //Go through data tree A
    for(int branchIndexA = 0;branchIndexA < A.BranchCount;branchIndexA++){
      //Get the current branch and path
      List<Mesh> meshesA = A.Branches[branchIndexA];
      GH_Path branchPath = A.Paths[branchIndexA];

      //Go through the list of meshes in the current branch
      for(int i = 0;i < meshesA.Count;i++){
        //Get the mesh in the current index
        Mesh meshA = meshesA[i];

        //Go through data tree B
        for(int branchIndexB = 0;branchIndexB < B.BranchCount;branchIndexB++){
          //Get the current branch
          List<Mesh> meshesB = B.Branches[branchIndexB];

          //Go through the list of meshes in the current branch
          for(int j = 0;j < meshesB.Count;j++){
            Mesh meshB = meshesB[j];
            GH_Path branchId = branchPath.AppendElement(j);

            //Define tolerance as the model space absolute tolerance
            double tol = doc.ModelAbsoluteTolerance;

            //Perform Intersection
            Polyline[] polylines = Rhino.Geometry.Intersect.Intersection.
              MeshMeshAccurate(meshA, meshB, tol);

            if(polylines != null){
              if(polylines.Length > 0){
                for(int k = 0;k < polylines.Length;k++){
                  //Convert polyline to curve
                  Curve curve = polylines[k].ToPolylineCurve();
                  curves.Add(curve, branchId);
                }
              }
              else{
                curves.Add(null, branchId);
              }
            }
            else{
              curves.Add(null, branchId);
            }
          }
        }
      }
    }

    //Outputs
    X = curves;
# ---------- end gh_mmx ----------
mmx = MeshMesh(MeshA=mesh_2, MeshB=mesh_3, UseMeshMeshFast=True)
panel_47 = Panel(mmx)
panel_48 = Panel(gh_mmx.X)

# ---- group: Collision Many|Many
geo = Geometry(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)
line = Line(Line((9, 20, 0), (14, -16, 0)))
crv_9 = Curve(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)
brep_4 = Brep(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)
mesh_4 = Mesh(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)
srf_3 = Surface(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)
merge = Merge(Data1=geo, Data2=line, Data3=crv_9, Data4=brep_4, Data5=mesh_4, Data6=srf_3)
gh_colmm = CSharpScript(C=merge)  # -> out, COut, I; inputs C: list of GeometryBase
# ---------- gh_colmm: C# ----------
    //Component written by @bava-kumaravel
    //Tests for collisions between a list of geometries C and returns
    //information if an object has a collision, and the index of the object
    //it first collides with

    //Define lists to hold the collision booleans and indices
    List<bool> isCollidingList = new List<bool>();
    List<int> collidingIndexList = new List<int>();

    //Define tolerance as the model space absolute tolerance
    double tol = doc.ModelAbsoluteTolerance;

    //Go through the list of incoming geometries
    for(int i = 0;i < C.Count;i++){
      //Get first geomtry
      GeometryBase A = C[i];

      //Define boolean to check if there is a collision
      bool isColliding = false;
      //Define integer to hold the index of the colliding geometry
      int collidingIndex = -1;

      //Go through the rest of the list
      for(int j = 0;j < C.Count;j++){
        if(i == j){
          //If both geometries are the same, ignore this index
          continue;
        }
        //Get second geometry
        GeometryBase B = C[j];

        //Get the Object Type of geometry A
        if(A.ObjectType == ObjectType.Curve){
          //If A is a curve
          Curve curveA = (Curve) A;

          //Get the Object Type of geometry B
          if(B.ObjectType == ObjectType.Curve){
            //If B is a curve
            Curve curveB = (Curve) B;
            //Both A and B are curves. Perform intersection
            bool success = SolveIntersection(curveA, curveB);
            if(success){
              //Set boolean as true
              isColliding = true;
              isCollidingList.Add(isColliding);
              //Save the index j as the colliding index
              collidingIndex = j;
              collidingIndexList.Add(collidingIndex);
              //Break the inner for loop
              break;
            }
          }

          else if(B.ObjectType == ObjectType.Surface){
            //If B is a Surface
            Surface surfaceB = (Surface) B;
            //A is a curve and B is a surface. Perform Intersection
            bool success = SolveIntersection(curveA, surfaceB);
            if(success){
              //Set boolean as true
              isColliding = true;
              isCollidingList.Add(isColliding);
              //Save the index j as the colliding index
              collidingIndex = j;
              collidingIndexList.Add(collidingIndex);
              //Break the inner for loop
              break;
            }
          }

          else if(B.ObjectType == ObjectType.Brep){
            //If B is a Brep
            Brep brepB = (Brep) B;
            //A is a curve and B is a brep. Perform intersection
            bool success = SolveIntersection(curveA, brepB);
            if(success){
              //Set boolean as true
              isColliding = true;
              isCollidingList.Add(isColliding);
              //Save the index j as the colliding index
              collidingIndex = j;
              collidingIndexList.Add(collidingIndex);
              //Break the inner for loop
              break;
            }
          }

          else if(B.ObjectType == ObjectType.Mesh){
            //If B is a Mesh
            Mesh meshB = (Mesh) B;
            //A is a curve and B is a mesh. Perform intersection.
            bool success = SolveIntersection(curveA, meshB);
            if(success){
              //Set boolean as true
              isColliding = true;
              isCollidingList.Add(isColliding);
              //Save the index j as the colliding index
              collidingIndex = j;
              collidingIndexList.Add(collidingIndex);
              //Break the inner for loop
              break;
            }
          }

          else{
            //If B has an Object type other than a curve, surface, brep or mesh
            //give a warning and break loop
            Component.AddRuntimeMessage(GH_RuntimeMessageLevel.Warning,
              "Obstacle is of unhandled type [" + B.ObjectType.ToString() + "]");
            //Break the inner for loop
            break;
          }
        }

        else if(A.ObjectType == ObjectType.Surface){
          //If A is a surface
          Surface surfaceA = (Surface) A;

          //Get the Object Type of geometry B
          if(B.ObjectType == ObjectType.Curve){
            //If B is a curve
            Curve curveB = (Curve) B;
            //A is a Surface and B is a curve. Perform intersection
            bool success = SolveIntersection(curveB, surfaceA);
            if(success){
              //Set boolean as true
              isColliding = true;
              isCollidingList.Add(isColliding);
              //Save the index j as the colliding index
              collidingIndex = j;
              collidingIndexList.Add(collidingIndex);
              //Break the inner for loop
              break;
            }
          }

          else if(B.ObjectType == ObjectType.Surface){
            //If B is a Surface
            Surface surfaceB = (Surface) B;
            //Both A and B are surfaces. Perform Intersection
            bool success = SolveIntersection(surfaceA, surfaceB);
            if(success){
              //Set boolean as true
              isColliding = true;
              isCollidingList.Add(isColliding);
              //Save the index j as the colliding index
              collidingIndex = j;
              collidingIndexList.Add(collidingIndex);
              //Break the inner for loop
              break;
            }
          }

          else if(B.ObjectType == ObjectType.Brep){
            //If B is a Brep
            Brep brepB = (Brep) B;
            //A is a surface and B is a brep. Perform intersection
            bool success = SolveIntersection(surfaceA, brepB);
            if(success){
              //Set boolean as true
              isColliding = true;
              isCollidingList.Add(isColliding);
              //Save the index j as the colliding index
              collidingIndex = j;
              collidingIndexList.Add(collidingIndex);
              //Break the inner for loop
              break;
            }
          }

          else if(B.ObjectType == ObjectType.Mesh){
            //If B is a Mesh, convert it into a Brep
            Brep brepB = Brep.TryConvertBrep(B);
            //A is a surface and B is a brep (from a mesh). Perform intersection.
            bool success = SolveIntersection(surfaceA, brepB);
            if(success){
              //Set boolean as true
              isColliding = true;
              isCollidingList.Add(isColliding);
              //Save the index j as the colliding index
              collidingIndex = j;
              collidingIndexList.Add(collidingIndex);
              //Break the inner for loop
              break;
            }
          }

          else{
            //If B has an Object type other than a curve, surface, brep or mesh
            //give a warning and break loop
            Component.AddRuntimeMessage(GH_RuntimeMessageLevel.Warning,
              "Obstacle is of unhandled type [" + B.ObjectType.ToString() + "]");
            //Break the inner for loop
            break;
          }
        }

        else if(A.ObjectType == ObjectType.Brep){
          //If A is Brep
          Brep brepA = (Brep) A;

          //Get the Object Type of geometry B
          if(B.ObjectType == ObjectType.Curve){
            //If B is a curve
            Curve curveB = (Curve) B;
            //A is Brep and B is a curve. Perform intersection.
            bool success = SolveIntersection(curveB, brepA);
            if(success){
              //Set boolean as true
              isColliding = true;
              isCollidingList.Add(isColliding);
              //Save the index j as the colliding index
              collidingIndex = j;
              collidingIndexList.Add(collidingIndex);
              //Break the inner for loop
              break;
            }
          }

          else if(B.ObjectType == ObjectType.Surface){
            //If B is a Surface
            Surface surfaceB = (Surface) B;
            //A is a brep and B is a surface. Perform Intersection
            bool success = SolveIntersection(surfaceB, brepA);
            if(success){
              //Set boolean as true
              isColliding = true;
              isCollidingList.Add(isColliding);
              //Save the index j as the colliding index
              collidingIndex = j;
              collidingIndexList.Add(collidingIndex);
              //Break the inner for loop
              break;
            }
          }

          else if(B.ObjectType == ObjectType.Brep){
            //If B is a Brep
            Brep brepB = (Brep) B;
            //Both A and B are breps. Perform intersection
            bool success = SolveIntersection(brepA, brepB);
            if(success){
              //Set boolean as true
              isColliding = true;
              isCollidingList.Add(isColliding);
              //Save the index j as the colliding index
              collidingIndex = j;
              collidingIndexList.Add(collidingIndex);
              //Break the inner for loop
              break;
            }
          }

          else if(B.ObjectType == ObjectType.Mesh){
            //If B is a Mesh
            Mesh meshB = (Mesh) B;
            //Convert Brep A into a Mesh
            Mesh[] meshes = Mesh.CreateFromBrep(brepA, MeshingParameters.Default);
            //Combine the output meshes to a single mesh
            Mesh meshA = new Mesh();
            foreach(Mesh mesh in meshes){
              meshA.Append(mesh);
            }
            //A is a mesh (from a brep) and B is a mesh. Perform intersection.
            bool success = SolveIntersection(meshA, meshB);
            if(success){
              //Set boolean as true
              isColliding = true;
              isCollidingList.Add(isColliding);
              //Save the index j as the colliding index
              collidingIndex = j;
              collidingIndexList.Add(collidingIndex);
              //Break the inner for loop
              break;
            }
          }

          else{
            //If B has an Object type other than a curve, surface, brep or mesh
            //give a warning and break loop
            Component.AddRuntimeMessage(GH_RuntimeMessageLevel.Warning,
              "Obstacle is of unhandled type [" + B.ObjectType.ToString() + "]");
            //Break the inner for loop
            break;
          }
        }

        else if(A.ObjectType == ObjectType.Mesh){
          //If A is a Mesh
          Mesh meshA = (Mesh) A;

          //Get the Object Type of geometry B
          if(B.ObjectType == ObjectType.Curve){
            //If B is a curve
            Curve curveB = (Curve) B;
            //A is a mesh and B is a curve. Perform intersection
            bool success = SolveIntersection(curveB, meshA);
            if(success){
              //Set boolean as true
              isColliding = true;
              isCollidingList.Add(isColliding);
              //Save the index j as the colliding index
              collidingIndex = j;
              collidingIndexList.Add(collidingIndex);
              //Break the inner for loop
              break;
            }
          }

          else if(B.ObjectType == ObjectType.Surface){
            //If B is a Surface
            Surface surfaceB = (Surface) B;
            //Convert mesh A into a Brep
            Brep brepA = Brep.TryConvertBrep(A);

            //A is a brep (from a mesh) and B is a surface. Perform Intersection
            bool success = SolveIntersection(surfaceB, brepA);
            if(success){
              //Set boolean as true
              isColliding = true;
              isCollidingList.Add(isColliding);
              //Save the index j as the colliding index
              collidingIndex = j;
              collidingIndexList.Add(collidingIndex);
              //Break the inner for loop
              break;
            }
          }

          else if(B.ObjectType == ObjectType.Brep){
            //If B is a brep, convert it to a Mesh
            Mesh[] meshes = Mesh.CreateFromBrep((Brep) B, MeshingParameters.Default);
            //Combine the output meshes to a single mesh
            Mesh meshB = new Mesh();
            foreach(Mesh mesh in meshes){
              meshB.Append(mesh);
            }

            //A is a mesh and B is mesh(from a brep). Perform intersection.
            bool success = SolveIntersection(meshA, meshB);
            if(success){
              //Set boolean as true
              isColliding = true;
              isCollidingList.Add(isColliding);
              //Save the index j as the colliding index
              collidingIndex = j;
              collidingIndexList.Add(collidingIndex);
              //Break the inner for loop
              break;
            }
          }

          else if(B.ObjectType == ObjectType.Mesh){
            //If B is a Mesh
            Mesh meshB = (Mesh) B;
            //Both A and B are meshes. Perform intersection.
            bool success = SolveIntersection(meshA, meshB);
            if(success){
              //Set boolean as true
              isColliding = true;
              isCollidingList.Add(isColliding);
              //Save the index j as the colliding index
              collidingIndex = j;
              collidingIndexList.Add(collidingIndex);
              //Break the inner for loop
              break;
            }
          }

          else{
            //If B has an Object type other than a curve, surface, brep or mesh
            //give a warning and break loop
            Component.AddRuntimeMessage(GH_RuntimeMessageLevel.Warning,
              "Obstacle is of unhandled type [" + B.ObjectType.ToString() + "]");
            //Break the inner for loop
            break;
          }
        }

        else{
          //If A has an Object type other than a curve, surface, brep or mesh
          //give a warning and break loop
          Component.AddRuntimeMessage(GH_RuntimeMessageLevel.Warning,
            "Collider is of unhandled type [" + A.ObjectType.ToString() + "]");
          //Set boolean as false
          isColliding = false;
          isCollidingList.Add(isColliding);
          //Save -1 as the colliding index
          collidingIndex = -1;
          collidingIndexList.Add(collidingIndex);
          //Break the outer for loop
          break;
        }
      }

      //If Collider A does not collide with any other geometry
      if(!isColliding){
        isCollidingList.Add(isColliding);
        collidingIndexList.Add(collidingIndex);
      }
    }

    //Outputs
    COut = isCollidingList;
    I = collidingIndexList;
# ---------- gh_colmm: C# additional code ----------
  private bool SolveIntersection(Curve curveA, Curve curveB){
    bool intersecting = false;
    double tol = doc.ModelAbsoluteTolerance;
    Rhino.Geometry.Intersect.CurveIntersections inter =
      Rhino.Geometry.Intersect.Intersection.CurveCurve
      (curveA, curveB, tol, tol);
    //If there is an intersection
    if(inter != null){
      //Set boolean as true
      intersecting = true;
    }
    return intersecting;
  }

  private bool SolveIntersection(Curve curveA, Surface surfaceB){
    bool intersecting = false;
    double tol = doc.ModelAbsoluteTolerance;
    Rhino.Geometry.Intersect.CurveIntersections inter =
      Rhino.Geometry.Intersect.Intersection.CurveSurface
      (curveA, surfaceB, tol, tol);
    //If there is an intersection
    if(inter != null){
      //Set boolean as true
      intersecting = true;
    }
    return intersecting;
  }

  private bool SolveIntersection(Curve curveA, Brep brepB){
    bool intersecting = false;
    double tol = doc.ModelAbsoluteTolerance;
    //Define arrays to hold the intersection curves and points
    Curve[] interCurves = new Curve[0];
    Point3d[] interPoints = new Point3d[0];
    bool success = Rhino.Geometry.Intersect.Intersection.CurveBrep
      (curveA, brepB, tol, out interCurves, out interPoints);
    //If there is an intersection
    if(interCurves.Length > 0 || interPoints.Length > 0){
      //Set boolean as true
      intersecting = true;
    }
    return intersecting;
  }

  private bool SolveIntersection(Curve curveA, Mesh meshB){
    bool intersecting = false;
    double tol = doc.ModelAbsoluteTolerance;

    //Convert Curve A to a PolylineCurve
    //Divide the curve into points
    Point3d[] pointsCurve = new Point3d[0];
    double[] t = curveA.DivideByLength(0.01, true, out pointsCurve);
    //Use the points to construct a polyline curve
    PolylineCurve polyCurveA = new PolylineCurve(pointsCurve);

    //Define arrays to hold the intersection points and face ids
    Point3d[] pointArray = new Point3d[0];
    int[] faceId = new int[0];
    pointArray = Rhino.Geometry.Intersect.Intersection.MeshPolyline
      (meshB, polyCurveA, out faceId);

    //If there is an intersection
    if(pointArray != null && pointArray.Length > 0){
      //Set boolean as true
      intersecting = true;
    }
    return intersecting;
  }

  private bool SolveIntersection(Surface surfaceA, Surface surfaceB){
    bool intersecting = false;
    double tol = doc.ModelAbsoluteTolerance;
    //Define arrays to hold the intersection curves and points
    Curve[] interCurves = new Curve[0];
    Point3d[] interPoints = new Point3d[0];
    bool success = Rhino.Geometry.Intersect.Intersection.SurfaceSurface
      (surfaceA, surfaceB, tol, out interCurves, out interPoints);

    //If there is an intersection
    if(interCurves.Length > 0 || interPoints.Length > 0){
      //Set boolean as true
      intersecting = true;
    }
    return intersecting;
  }

  private bool SolveIntersection(Surface surfaceA, Brep brepB){
    bool intersecting = false;
    double tol = doc.ModelAbsoluteTolerance;
    //Define arrays to hold the intersection curves and points
    Curve[] interCurves = new Curve[0];
    Point3d[] interPoints = new Point3d[0];
    bool success = Rhino.Geometry.Intersect.Intersection.BrepSurface
      (brepB, surfaceA, tol, out interCurves, out interPoints);
    //If there is an intersection
    if(interCurves.Length > 0 || interPoints.Length > 0){
      //Set boolean as true
      intersecting = true;
    }
    return intersecting;
  }

  private bool SolveIntersection(Brep brepA, Brep brepB){
    bool intersecting = false;
    double tol = doc.ModelAbsoluteTolerance;
    //Define arrays to hold the intersection curves and points
    Curve[] interCurves = new Curve[0];
    Point3d[] interPoints = new Point3d[0];
    bool success = Rhino.Geometry.Intersect.Intersection.BrepBrep
      (brepA, brepB, tol, out interCurves, out interPoints);
    //If there is an intersection
    if(interCurves.Length > 0 || interPoints.Length > 0){
      //Set boolean as true
      intersecting = true;
    }
    return intersecting;
  }

  private bool SolveIntersection(Mesh meshA, Mesh meshB){
    bool intersecting = false;
    double tol = doc.ModelAbsoluteTolerance;
    Polyline[] polylines = Rhino.Geometry.Intersect.Intersection.MeshMeshAccurate
      (meshA, meshB, tol);
    //If there is an intersection
    if(polylines != null && polylines.Length > 0){
      //Set boolean as true
      intersecting = true;
    }
    return intersecting;
  }
# ---------- end gh_colmm ----------
colmm = CollisionManyMany(Colliders=merge)  # -> Collision, Indices
panel_49 = Panel(colmm.Collision)
panel_50 = Panel(gh_colmm.COut)
panel_51 = Panel(colmm.Indices)
panel_52 = Panel(gh_colmm.I)

# ---- group: Collision One|Many
crv_10 = Curve(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)
geo_2 = Geometry(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)
line_2 = Line(Line((9, 20, 0), (14, -16, 0)))
brep_5 = Brep(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)
mesh_5 = Mesh(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)
srf_4 = Surface(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)
merge_2 = Merge(Data1=line_2, Data2=geo_2, Data3=brep_5, Data4=mesh_5, Data5=srf_4)
gh_colom = CSharpScript(C=crv_10, O=merge_2)  # -> out, COut, I; inputs C: GeometryBase, O: list of GeometryBase
# ---------- gh_colom: C# ----------
    //Component written by @bava-kumaravel
    //Tests for collisions between a collider C and list of obstacles O
    //and returns information if it has a collision, and the index of
    //the object it first collides with

    //Define boolean to check if there is a collision
    bool isColliding = false;
    //Define integer to hold the index of the colliding geometry
    int collidingIndex = -1;

    //Define tolerance as the model space absolute tolerance
    double tol = doc.ModelAbsoluteTolerance;

    //Go through the list of incoming obstacles
    for(int i = 0;i < O.Count;i++){
      //Get obstacle at index i
      GeometryBase obs = O[i];

      //Get the Object Type of collider C
      if(C.ObjectType == ObjectType.Curve){
        //If C is a curve
        Curve curveC = (Curve) C;

        //Get the Object Type of obstacle
        if(obs.ObjectType == ObjectType.Curve){
          //If obstacle is a curve
          Curve curveO = (Curve) obs;
          //Both C and O are curves. Perform intersection
          bool success = SolveIntersection(curveC, curveO);
          if(success){
            //Set boolean as true
            isColliding = true;
            //Save the index i as the colliding index
            collidingIndex = i;
            //Break the inner for loop
            break;
          }
        }

        else if(obs.ObjectType == ObjectType.Surface){
          //If obstacle is a Surface
          Surface surfaceO = (Surface) obs;
          //C is a curve and O is a surface. Perform Intersection
          bool success = SolveIntersection(curveC, surfaceO);
          if(success){
            //Set boolean as true
            isColliding = true;
            //Save the index i as the colliding index
            collidingIndex = i;
            //Break the inner for loop
            break;
          }
        }

        else if(obs.ObjectType == ObjectType.Brep){
          //If obstacle is a Brep
          Brep brepO = (Brep) obs;
          //C is a curve and O is a brep. Perform intersection
          bool success = SolveIntersection(curveC, brepO);
          if(success){
            //Set boolean as true
            isColliding = true;
            //Save the index i as the colliding index
            collidingIndex = i;
            //Break the inner for loop
            break;
          }
        }

        else if(obs.ObjectType == ObjectType.Mesh){
          //If obstacle is a Mesh
          Mesh meshO = (Mesh) obs;
          //C is a curve and O is a mesh. Perform intersection.
          bool success = SolveIntersection(curveC, meshO);
          if(success){
            //Set boolean as true
            isColliding = true;
            //Save the index i as the colliding index
            collidingIndex = i;
            //Break the inner for loop
            break;
          }
        }

        else{
          //If obstacle has an Object type other than a curve, surface, brep
          //or mesh give a warning and break loop
          Component.AddRuntimeMessage(GH_RuntimeMessageLevel.Warning,
            "Obstacle is of unhandled type [" + obs.ObjectType.ToString() + "]");
          //Break the inner for loop
          break;
        }
      }

      else if(C.ObjectType == ObjectType.Surface){
        //If C is a surface
        Surface surfaceC = (Surface) C;

        //Get the Object Type of obstacle
        if(obs.ObjectType == ObjectType.Curve){
          //If obstacle is a curve
          Curve curveO = (Curve) obs;
          //C is a Surface and O is a curve. Perform intersection
          bool success = SolveIntersection(curveO, surfaceC);
          if(success){
            //Set boolean as true
            isColliding = true;
            //Save the index i as the colliding index
            collidingIndex = i;
            //Break the inner for loop
            break;
          }
        }

        else if(obs.ObjectType == ObjectType.Surface){
          //If obstacle is a Surface
          Surface surfaceO = (Surface) obs;
          //Both C and O are surfaces. Perform Intersection
          bool success = SolveIntersection(surfaceC, surfaceO);
          if(success){
            //Set boolean as true
            isColliding = true;
            //Save the index i as the colliding index
            collidingIndex = i;
            //Break the inner for loop
            break;
          }
        }

        else if(obs.ObjectType == ObjectType.Brep){
          //If obstacle is a Brep
          Brep brepO = (Brep) obs;
          //A is a surface and B is a brep. Perform intersection
          bool success = SolveIntersection(surfaceC, brepO);
          if(success){
            //Set boolean as true
            isColliding = true;
            //Save the index i as the colliding index
            collidingIndex = i;
            //Break the inner for loop
            break;
          }
        }

        else if(obs.ObjectType == ObjectType.Mesh){
          //If obstacle is a Mesh, convert it into a Brep
          Brep brepO = Brep.TryConvertBrep(obs);
          //C is a surface and O is a brep (from a mesh). Perform intersection.
          bool success = SolveIntersection(surfaceC, brepO);
          if(success){
            //Set boolean as true
            isColliding = true;
            //Save the index i as the colliding index
            collidingIndex = i;
            //Break the inner for loop
            break;
          }
        }

        else{
          //If obstacle has an Object type other than a curve, surface, brep
          //or mesh give a warning and break loop
          Component.AddRuntimeMessage(GH_RuntimeMessageLevel.Warning,
            "Obstacle is of unhandled type [" + obs.ObjectType.ToString() + "]");
          //Break the inner for loop
          break;
        }
      }

      else if(C.ObjectType == ObjectType.Brep){
        //If C is Brep
        Brep brepC = (Brep) C;

        //Get the Object Type of obstacle
        if(obs.ObjectType == ObjectType.Curve){
          //If obstacle is a curve
          Curve curveO = (Curve) obs;
          //C is Brep and O is a curve. Perform intersection.
          bool success = SolveIntersection(curveO, brepC);
          if(success){
            //Set boolean as true
            isColliding = true;
            //Save the index i as the colliding index
            collidingIndex = i;
            //Break the inner for loop
            break;
          }
        }

        else if(obs.ObjectType == ObjectType.Surface){
          //If obstacle is a Surface
          Surface surfaceO = (Surface) obs;
          //C is a brep and O is a surface. Perform Intersection
          bool success = SolveIntersection(surfaceO, brepC);
          if(success){
            //Set boolean as true
            isColliding = true;
            //Save the index i as the colliding index
            collidingIndex = i;
            //Break the inner for loop
            break;
          }
        }

        else if(obs.ObjectType == ObjectType.Brep){
          //If obstacle is a Brep
          Brep brepO = (Brep) obs;
          //Both C and O are breps. Perform intersection
          bool success = SolveIntersection(brepC, brepO);
          if(success){
            //Set boolean as true
            isColliding = true;
            //Save the index i as the colliding index
            collidingIndex = i;
            //Break the inner for loop
            break;
          }
        }

        else if(obs.ObjectType == ObjectType.Mesh){
          //If obstacle is a Mesh
          Mesh meshO = (Mesh) obs;
          //Convert Brep C into a Mesh
          Mesh[] meshes = Mesh.CreateFromBrep(brepC, MeshingParameters.Default);
          //Combine the output meshes to a single mesh
          Mesh meshC = new Mesh();
          foreach(Mesh mesh in meshes){
            meshC.Append(mesh);
          }
          //C is a mesh (from a brep) and O is a mesh. Perform intersection.
          bool success = SolveIntersection(meshC, meshO);
          if(success){
            //Set boolean as true
            isColliding = true;
            //Save the index i as the colliding index
            collidingIndex = i;
            //Break the inner for loop
            break;
          }
        }

        else{
          //If obstacle has an Object type other than a curve, surface, brep
          //or mesh give a warning and break loop
          Component.AddRuntimeMessage(GH_RuntimeMessageLevel.Warning,
            "Obstacle is of unhandled type [" + obs.ObjectType.ToString() + "]");
          //Break the inner for loop
          break;
        }
      }

      else if(C.ObjectType == ObjectType.Mesh){
        //If C is a Mesh
        Mesh meshC = (Mesh) C;

        //Get the Object Type of obstacle
        if(obs.ObjectType == ObjectType.Curve){
          //If obstacle is a curve
          Curve curveO = (Curve) obs;
          //A is a mesh and B is a curve. Perform intersection
          bool success = SolveIntersection(curveO, meshC);
          if(success){
            //Set boolean as true
            isColliding = true;
            //Save the index i as the colliding index
            collidingIndex = i;
            //Break the inner for loop
            break;
          }
        }

        else if(obs.ObjectType == ObjectType.Surface){
          //If obstacle is a Surface
          Surface surfaceO = (Surface) obs;
          //Convert mesh C into a Brep
          Brep brepC = Brep.TryConvertBrep(C);

          //C is a brep (from a mesh) and O is a surface. Perform Intersection
          bool success = SolveIntersection(surfaceO, brepC);
          if(success){
            //Set boolean as true
            isColliding = true;
            //Save the index i as the colliding index
            collidingIndex = i;
            //Break the inner for loop
            break;
          }
        }

        else if(obs.ObjectType == ObjectType.Brep){
          //If obstacle is a brep, convert it to a Mesh
          Mesh[] meshes = Mesh.CreateFromBrep((Brep) obs, MeshingParameters.Default);
          //Combine the output meshes to a single mesh
          Mesh meshO = new Mesh();
          foreach(Mesh mesh in meshes){
            meshO.Append(mesh);
          }

          //C is a mesh and O is mesh(from a brep). Perform intersection.
          bool success = SolveIntersection(meshC, meshO);
          if(success){
            //Set boolean as true
            isColliding = true;
            //Save the index i as the colliding index
            collidingIndex = i;
            //Break the inner for loop
            break;
          }
        }

        else if(obs.ObjectType == ObjectType.Mesh){
          //If obstacle is a Mesh
          Mesh meshO = (Mesh) obs;
          //Both C and O are meshes. Perform intersection.
          bool success = SolveIntersection(meshC, meshO);
          if(success){
            //Set boolean as true
            isColliding = true;
            //Save the index i as the colliding index
            collidingIndex = i;
            //Break the inner for loop
            break;
          }
        }

        else{
          //If obstacle has an Object type other than a curve, surface, brep
          //or mesh give a warning and break loop
          Component.AddRuntimeMessage(GH_RuntimeMessageLevel.Warning,
            "Obstacle is of unhandled type [" + obs.ObjectType.ToString() + "]");
          //Break the inner for loop
          break;
        }
      }

      else{
        //If C has an Object type other than a curve, surface, brep or mesh
        //give a warning and break loop
        Component.AddRuntimeMessage(GH_RuntimeMessageLevel.Warning,
          "Collider is of unhandled type [" + C.ObjectType.ToString() + "]");
        //Set boolean as false
        isColliding = false;
        //Save -1 as the colliding index
        collidingIndex = -1;
        //Break the outer for loop
        break;
      }

      //If Collider A does not collide with any other geometry
      if(!isColliding){
        //Set boolean as false
        isColliding = false;
        //Save -1 as the colliding index
        collidingIndex = -1;
      }
    }

    //Outputs
    COut = isColliding;
    I = collidingIndex;
# ---------- gh_colom: C# additional code ----------
  private bool SolveIntersection(Curve curveA, Curve curveB){
    bool intersecting = false;
    double tol = doc.ModelAbsoluteTolerance;
    Rhino.Geometry.Intersect.CurveIntersections inter =
      Rhino.Geometry.Intersect.Intersection.CurveCurve
      (curveA, curveB, tol, tol);
    //If there is an intersection
    if(inter != null){
      //Set boolean as true
      intersecting = true;
    }
    return intersecting;
  }

  private bool SolveIntersection(Curve curveA, Surface surfaceB){
    bool intersecting = false;
    double tol = doc.ModelAbsoluteTolerance;
    Rhino.Geometry.Intersect.CurveIntersections inter =
      Rhino.Geometry.Intersect.Intersection.CurveSurface
      (curveA, surfaceB, tol, tol);
    //If there is an intersection
    if(inter != null){
      //Set boolean as true
      intersecting = true;
    }
    return intersecting;
  }

  private bool SolveIntersection(Curve curveA, Brep brepB){
    bool intersecting = false;
    double tol = doc.ModelAbsoluteTolerance;
    //Define arrays to hold the intersection curves and points
    Curve[] interCurves = new Curve[0];
    Point3d[] interPoints = new Point3d[0];
    bool success = Rhino.Geometry.Intersect.Intersection.CurveBrep
      (curveA, brepB, tol, out interCurves, out interPoints);
    //If there is an intersection
    if(interCurves.Length > 0 || interPoints.Length > 0){
      //Set boolean as true
      intersecting = true;
    }
    return intersecting;
  }

  private bool SolveIntersection(Curve curveA, Mesh meshB){
    bool intersecting = false;
    double tol = doc.ModelAbsoluteTolerance;

    //Convert Curve A to a PolylineCurve
    //Divide the curve into points
    Point3d[] pointsCurve = new Point3d[0];
    double[] t = curveA.DivideByLength(0.01, true, out pointsCurve);
    //Use the points to construct a polyline curve
    PolylineCurve polyCurveA = new PolylineCurve(pointsCurve);

    //Define arrays to hold the intersection points and face ids
    Point3d[] pointArray = new Point3d[0];
    int[] faceId = new int[0];
    pointArray = Rhino.Geometry.Intersect.Intersection.MeshPolyline
      (meshB, polyCurveA, out faceId);

    //If there is an intersection
    if(pointArray != null && pointArray.Length > 0){
      //Set boolean as true
      intersecting = true;
    }
    return intersecting;
  }

  private bool SolveIntersection(Surface surfaceA, Surface surfaceB){
    bool intersecting = false;
    double tol = doc.ModelAbsoluteTolerance;
    //Define arrays to hold the intersection curves and points
    Curve[] interCurves = new Curve[0];
    Point3d[] interPoints = new Point3d[0];
    bool success = Rhino.Geometry.Intersect.Intersection.SurfaceSurface
      (surfaceA, surfaceB, tol, out interCurves, out interPoints);

    //If there is an intersection
    if(interCurves.Length > 0 || interPoints.Length > 0){
      //Set boolean as true
      intersecting = true;
    }
    return intersecting;
  }

  private bool SolveIntersection(Surface surfaceA, Brep brepB){
    bool intersecting = false;
    double tol = doc.ModelAbsoluteTolerance;
    //Define arrays to hold the intersection curves and points
    Curve[] interCurves = new Curve[0];
    Point3d[] interPoints = new Point3d[0];
    bool success = Rhino.Geometry.Intersect.Intersection.BrepSurface
      (brepB, surfaceA, tol, out interCurves, out interPoints);
    //If there is an intersection
    if(interCurves.Length > 0 || interPoints.Length > 0){
      //Set boolean as true
      intersecting = true;
    }
    return intersecting;
  }

  private bool SolveIntersection(Brep brepA, Brep brepB){
    bool intersecting = false;
    double tol = doc.ModelAbsoluteTolerance;
    //Define arrays to hold the intersection curves and points
    Curve[] interCurves = new Curve[0];
    Point3d[] interPoints = new Point3d[0];
    bool success = Rhino.Geometry.Intersect.Intersection.BrepBrep
      (brepA, brepB, tol, out interCurves, out interPoints);
    //If there is an intersection
    if(interCurves.Length > 0 || interPoints.Length > 0){
      //Set boolean as true
      intersecting = true;
    }
    return intersecting;
  }

  private bool SolveIntersection(Mesh meshA, Mesh meshB){
    bool intersecting = false;
    double tol = doc.ModelAbsoluteTolerance;
    Polyline[] polylines = Rhino.Geometry.Intersect.Intersection.MeshMeshAccurate
      (meshA, meshB, tol);
    //If there is an intersection
    if(polylines != null && polylines.Length > 0){
      //Set boolean as true
      intersecting = true;
    }
    return intersecting;
  }
# ---------- end gh_colom ----------
colom = CollisionOneMany(Collider=crv_10, Obstacles=merge_2)  # -> Collision, Index
panel_53 = Panel(colom.Collision)
panel_54 = Panel(gh_colom.COut)
panel_55 = Panel(colom.Index)
panel_56 = Panel(gh_colom.I)
