# Grasshopper definition Intersect_Region.ghx (Grasshopper 1.0.7)

# ---- group: Split with Brep
# GH#: A C# dictionary of Grasshopper3D components.
# 
# This file contains a category of Grasshopper components, and a mirroring C#/RhinoCommon implementation.
# 
# This is an educational project initiated by students/faculty of GSD-6338: Introduction to Computational Design, at the Harvard Graduate School of Design.
# 
# More information: {{project link}}
# Intersect Region
crv = Curve(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)
brep = Brep(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)
gh_split = CSharpScript(C=crv, B=brep)  # -> out, COut, P; inputs C: Curve, B: Brep
# ---------- gh_split: C# ----------
    //Component written by @bava-kumaravel
    //Split a curve C with a Brep B and return split curves and
    //intersection points

    //Define lists to hold the output curves and points
    Curve[] curves = new Curve[0];
    Point3d[] points = new Point3d[0];

    //Define tolerance as model space absolute tolerance
    double tol = doc.ModelAbsoluteTolerance;

    //Split curve with brep
    curves = C.Split(B, tol, tol);

    //If split operation was successful
    if(curves.Length > 0){
      //Define array to hold curve parameters at the split
      double[] param = new double[0];

      //Find the point of intersection
      bool success = Rhino.Geometry.Intersect.Intersection.CurveBrep
        (C, B, tol, tol, out param);

      //Sort the parameters array
      Array.Sort(param);

      //Set the length of the points array to the length of the parameters array
      points = new Point3d[param.Length];

      //Go through the parameter array and get their respective points
      for(int i = 0;i < param.Length;i++){
        //Get the parameter t at index i
        double t = param[i];
        //Get point at parameter t
        Point3d point = C.PointAt(t);
        //Add point to the points array
        points[i] = point;
      }

      //Outputs
      COut = curves;
      P = points;
    }
# ---------- end gh_split ----------
split = SplitWithBrep(Curve=crv, Brep=brep)  # -> Curve, Points
panel = Panel(split.Curve)
panel_2 = Panel(gh_split.COut)
panel_3 = Panel(split.Points)
panel_4 = Panel(gh_split.P)

# ---- group: Split with Breps
crv_2 = Curve(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)
brep_2 = Brep([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])
gh_split_2 = CSharpScript(C=crv_2, B=brep_2)  # -> out, COut, P; inputs C: Curve, B: list of Brep
# ---------- gh_split_2: C# ----------
    //Component written by @bava-kumaravel
    //Split a curve C with a list of Breps B and return split curves and 
    //intersection points
    
    //Define arrays and lists to hold the split curves, parameters and the 
    //intersection points
    Curve[] curves = new Curve[0];
    List<double> parameters = new List<double>();
    Point3d[] points = new Point3d[0];
    
    //Define tolerance as the model space absolute tolerance
    double tol = doc.ModelAbsoluteTolerance;
    
    //Intersect the curve with the breps
    //Go through the list of breps
    for(int i = 0;i < B.Count;i++){
      //Get brep at the current index i
      Brep brep = B[i];
      
      //Perform intersection
      //Define array to hold the output parameters
      double[] param = new double[0];
      
      bool success = Rhino.Geometry.Intersect.Intersection.CurveBrep
        (C, brep, tol, tol, out param);
      
      //If there is an intersection
      if(param.Length > 0){
        //Add the parameters to the parameters list
        parameters.AddRange(param);
      }
    }
    
    //If there are intersection parameters
    if(parameters.Count > 0){
      //Sort the parameters list
      parameters.Sort();
      
      //Split the curve with the parameters
      curves = C.Split(parameters);
      
      //Go through the list of parameters and get the intersection points
      //Initialize point array with the parameters list length
      points = new Point3d[parameters.Count];
      
      for(int i = 0;i < parameters.Count;i++){
        //Get parameter at the current index i
        double t = parameters[i];
        
        //Get the point at the parameter t
        Point3d point = C.PointAt(t);
        
        //Add point to the points array
        points[i] = point;
      }
      
      //Outputs
      COut = curves;
      P = points;
    }
# ---------- end gh_split_2 ----------
split_2 = SplitWithBreps(Curve=crv_2, Brep=brep_2)  # -> Curve, Points
panel_5 = Panel(split_2.Curve)
panel_6 = Panel(gh_split_2.COut)
panel_7 = Panel(split_2.Points)
panel_8 = Panel(gh_split_2.P)

# ---- group: Trim with Brep
crv_3 = Curve(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)
brep_3 = Brep(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)
trim = TrimWithBrep(Curve=crv_3, Brep=brep_3)  # -> Inside, Outside
gh_trim = CSharpScript(C=crv_3, B=brep_3)  # -> out, Ci, Co; inputs C: Curve, B: Brep
# ---------- gh_trim: C# ----------
    //Component written by @bava-kumaravel
    //Trim a curve C with a Brep B and return split curves that lie within the
    //brep and outside it

    //Define lists to hold the curves within the brep and curves outside the brep
    List<Curve> curvesInside = new List<Curve>();
    List<Curve> curvesOutside = new List<Curve>();

    //Define array to hold the all the curves resulting from split operation
    Curve[] curves = new Curve[0];

    //Define tolerance as model space absolute tolerance
    double tol = doc.ModelAbsoluteTolerance;

    //Split curve with brep
    curves = C.Split(B, tol, tol);

    //If split operation was successful
    if(curves.Length > 0){
      //Go through the list of curves and check which lie within the brep B
      //and which do not
      //To do that first check if the Brep is closed and manifold (Solid)

      if(B.IsSolid){
        for(int i = 0;i < curves.Length;i++){
          Curve curve = curves[i];
          //Get a point on the curve and check if it is inside the brep B
          //Let us get the mid point
          Point3d testPoint = curve.PointAtNormalizedLength(0.5);

          //Check if the test point lies inside the brep B
          bool inside = B.IsPointInside(testPoint, tol, false);

          if(inside){
            //If the point lies inside the brep, add it to the inside curves list
            curvesInside.Add(curve);
          }
          else{
            //Else if the point doesn't lie within the brep, add the curve to
            //the outside curves list
            curvesOutside.Add(curve);
          }
        }
      }
      else{
        //If the brep is not closed or non manifold
        //Show a warning message
        Component.AddRuntimeMessage(GH_RuntimeMessageLevel.Warning,
          "Curves should only be trimmed with a closed Brep.");
        //Add all curves to the curves outside list
        curvesOutside.AddRange(curves);
      }

      //Outputs
      Ci = curvesInside;
      Co = curvesOutside;
    }
# ---------- end gh_trim ----------
panel_9 = Panel(trim.Inside)
panel_10 = Panel(gh_trim.Ci)
panel_11 = Panel(trim.Outside)
panel_12 = Panel(gh_trim.Co)

# ---- group: Split with Breps
crv_4 = Curve(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)
brep_4 = Brep([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])
gh_trim_2 = CSharpScript(C=crv_4, B=brep_4)  # -> out, Ci, Co; inputs C: Curve, B: list of Brep
# ---------- gh_trim_2: C# ----------
    //Component written by @bava-kumaravel
    //Trim a curve C with a list of Breps B and return curves inside the breps
    //and curves outside

    //Define lists to hold the curves inside and outside the breps
    List<Curve> curvesInside = new List<Curve>();
    List<Curve> curvesOutside = new List<Curve>();

    //Define array to hold all the resuting curves from the split operation
    Curve[] curves = new Curve[0];

    //Define a list to hold the split parameters
    List<double> parameters = new List<double>();

    //Define tolerance as the model space absolute tolerance
    double tol = doc.ModelAbsoluteTolerance;

    //Intersect the curve with the breps
    //Go through the list of breps
    for(int i = 0;i < B.Count;i++){
      //Get brep at the current index i
      Brep brep = B[i];

      //Perform intersection
      //Define array to hold the output parameters
      double[] param = new double[0];

      bool success = Rhino.Geometry.Intersect.Intersection.CurveBrep
        (C, brep, tol, tol, out param);

      //If there is an intersection
      if(param.Length > 0){
        //Add the parameters to the parameters list
        parameters.AddRange(param);
      }
    }

    //If there are intersection parameters
    if(parameters.Count > 0){
      //Sort the parameters list
      parameters.Sort();

      //Split the curve with the parameters
      curves = C.Split(parameters);

      //Go through the array of curves to check which lie within the breps
      //and which dont
      //To do that, first get the breps that are closed and Manifold
      List<Brep> solidBreps = new List<Brep>();
      //Go through the list of breps and populate the solid breps list
      foreach(Brep brep in B){
        if(brep.IsSolid){
          //If it is solid add it to the list
          solidBreps.Add(brep);
        }
        else{
          //Else give a warning message
          Component.AddRuntimeMessage(GH_RuntimeMessageLevel.Warning, 
            "Only closed breps ought to be used.");
        }
      }
        
      //Now go through the array of curves
      for(int i = 0;i < curves.Length;i++){
        //Get the curve at the current index i
        Curve curve = curves[i];
         
        //Get the mid point of the curve
        Point3d testPoint = curve.PointAtNormalizedLength(0.5);
          
        //Check if this point lies within a brep
        //Define a boolean
        bool isInside = false;
          
        //Go through the list of solidbreps
        foreach(Brep brep in solidBreps){
          bool check = brep.IsPointInside(testPoint, tol, true);
          if(check){
            //If point lies within a brep, set the boolean to true and break the for loop
            isInside = check;
            break;
          }
        }
        
        if(isInside){
          //If the curve is inside any Brep, add it to the list of inside curves
          curvesInside.Add(curve);
        }
        else{
          //Else if it doesn't lie within any brep, add it to the outside curves list
          curvesOutside.Add(curve);
        }
      }
   
      //Outputs
      Ci = curvesInside;
      Co = curvesOutside;
    }
# ---------- end gh_trim_2 ----------
trim_2 = TrimWithBreps(Curve=crv_4, Brep=brep_4)  # -> Inside, Outside
panel_13 = Panel(trim_2.Inside)
panel_14 = Panel(gh_trim_2.Ci)
panel_15 = Panel(trim_2.Outside)
panel_16 = Panel(gh_trim_2.Co)

# ---- group: Trim with Region
crv_5 = Curve(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)
crv_6 = Curve(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)
xy = XYPlane(Origin=Point(0, 0, 0))
gh_trim_3 = CSharpScript(C=crv_5, R=crv_6, P=xy)  # -> out, Ci, Co; inputs C: Curve, R: Curve, P: Plane
# ---------- gh_trim_3: C# usings ----------
using System.IO;
using System.Linq;
using System.Data;
using System.Drawing;
using System.Reflection;
using System.Windows.Forms;
using System.Xml;
using System.Xml.Linq;
using System.Runtime.InteropServices;

using Rhino.DocObjects;
using Rhino.Collections;
using GH_IO;
using GH_IO.Serialization;
# ---------- end gh_trim_3 ----------
trim_3 = TrimWithRegion(Curve=crv_5, Region=crv_6)  # -> Inside, Outside
panel_17 = Panel(trim_3.Inside)
panel_18 = Panel(gh_trim_3.Ci)
panel_19 = Panel(trim_3.Outside)
panel_20 = Panel(gh_trim_3.Co)

# ---- group: Trim with Regions
crv_7 = Curve(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)
crv_8 = Curve([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])
xy_2 = XYPlane(Origin=Point(0, 0, 0))
gh_trim_4 = CSharpScript(C=crv_7, R=crv_8, P=xy_2)  # -> out, Ci, Co; inputs C: Curve, R: list of Curve, P: Plane; same code as gh_trim_3
trim_4 = TrimWithRegions(Curve=crv_7, Regions=crv_8, Plane=xy_2)  # -> Inside, Outside
panel_21 = Panel(gh_trim_4.Ci)
panel_22 = Panel(trim_4.Inside)
panel_23 = Panel(trim_4.Outside)
panel_24 = Panel(gh_trim_4.Co)
