# Grasshopper definition Intersect_Shape.ghx (Grasshopper 1.0.7)

# ---- group: Boundary Volume
# GH#: A C# dictionary of Grasshopper3D components.
# 
# This file contains a category of Grasshopper components, and a mirroring C#/RhinoCommon implementation.
# 
# This is an educational project initiated by students/faculty of GSD-6338: Introduction to Computational Design, at the Harvard Graduate School of Design.
# 
# More information: {{project link}}
# Intersect Shape
srf = Surface([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])
gh_bvol = CSharpScript(B=srf)  # -> out, S; inputs B: list of Brep
# ---------- gh_bvol: C# ----------
    //Component written by @bava-kumaravel
    //Create closed polysurfaces from a list of intersecting Breps B

    //Define tolerance as model space absolute tolerance
    double tol = doc.ModelAbsoluteTolerance;

    //Create closed breps
    Brep[] breps = Brep.CreateSolid(B, tol);

    //If no breps are formed, give a warning
    if(breps.Length == 0){
      Component.AddRuntimeMessage(GH_RuntimeMessageLevel.Warning,
        "Boundaries did not define a valid solid.");
    }

    //Outputs
    S = breps;
# ---------- end gh_bvol ----------
bvol = BoundaryVolume(Boundaries=srf)
panel = Panel(bvol)
panel_2 = Panel(gh_bvol.S)

# ---- group: Solid Intersection
brep = Brep([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])
brep_2 = Brep([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])
gh_sint = CSharpScript(A=brep, B=brep_2)  # -> out, R; inputs A: list of Brep, B: list of Brep
# ---------- gh_sint: C# ----------
    //Component written by @bava-kumaravel
    //Performs intersection between two sets of Breps A and B

    //Define tolerance as the model space absolute tolerance
    double tol = doc.ModelAbsoluteTolerance;

    //Perform boolean intersection
    Brep[] result = Brep.CreateBooleanIntersection(A, B, tol, true);

    Component.AddRuntimeMessage(GH_RuntimeMessageLevel.Warning,
      "Output is different from that of the vanilla GH component.");

    //Output
    R = result;
# ---------- end gh_sint ----------
sint = SolidIntersection(BrepsA=brep, BrepsB=brep_2)
panel_3 = Panel(sint)
panel_4 = Panel(gh_sint.R)

# ---- group: Split Brep
brep_3 = Brep(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)
brep_4 = Brep(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)
gh_split = CSharpScript(B=brep_3, C=brep_4)  # -> out, R; inputs B: Brep, C: Brep
# ---------- gh_split: C# ----------
    //Component written by @bava-kumaravel
    //Splits a brep B with a cutter C

    //Define tolerance as the model space absolute tolerance
    double tol = doc.ModelAbsoluteTolerance;

    //Perform split operation
    Brep[] result = B.Split(C, tol);

    //Output
    R = result;
# ---------- end gh_split ----------
split = SplitBrep(Brep=brep_3, Cutter=brep_4)
panel_5 = Panel(split)
panel_6 = Panel(gh_split.R)

# ---- group: Trim Solid
brep_5 = Brep(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)
brep_6 = Brep([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])
gh_trim = CSharpScript(S=brep_5, T=brep_6)  # -> out, R; inputs S: Brep, T: list of Brep
# ---------- gh_trim: C# ----------
    //Component written by @bava-kumaravel
    //Trims a brep S with a list of cutters T

    //Define tolerance as the model space absolute tolerance
    double tol = doc.ModelAbsoluteTolerance;

    //Define a variable to hold the trimmed brep
    //Initialize it with the input brep S
    Brep trimBrep = S;
    
    //Go through the list of trim breps and cutters

    for(int j = 0;j < T.Count;j++){
      //Check if the cutter is closed
      if(!T[j].IsSolid){
        Component.AddRuntimeMessage(GH_RuntimeMessageLevel.Error,
          "It is only possible to trim with closed Breps");
        break;
      }
      else{
        //Split the brep with the cutter
        Brep[] breps = trimBrep.Split(T[j], tol);
        //If the split is successful
        if(breps.Length > 0){
          //Remove the original trim brep and replace it with the 
          //first item of the split breps
          trimBrep = breps[0];
        }
      }
    }

    //Output
    R = trimBrep;
# ---------- gh_trim: C# additional code ----------
  /// <summary>
  /// This method will be called once every solution, before any calls to RunScript.
  /// </summary>
  public override void BeforeRunScript()
  { }
  /// <summary>
  /// This method will be called once every solution, after any calls to RunScript.
  /// </summary>
  public override void AfterRunScript()
  { }
# ---------- end gh_trim ----------
trim = TrimSolid(Shape=brep_5, Cutters=brep_6)
panel_7 = Panel(trim)
panel_8 = Panel(gh_trim.R)

# ---- group: Region Difference
crv = Curve([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])
crv_2 = Curve([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])
xy = XYPlane(Origin=Point(0, 0, 0))
gh_rdiff = CSharpScript(A=crv, B=crv_2, P=xy)  # -> out, R; inputs A: list of Curve, B: list of Curve, P: Plane
# ---------- gh_rdiff: C# ----------
    //Component written by @bava-kumaravel
    //Performs boolean difference between a list of curves A and B
    //using an optional reference plane P

    //Define tolerance as the model space absolute tolerance
    double tol = doc.ModelAbsoluteTolerance;
    
    //Define a list of curves to hold the outputs
    List<Curve> curves = new List<Curve>();

    //Go through list of curves A
    for(int i = 0;i < A.Count;i++){
      //Trim the current curve A[i] with the list of curves B
      Curve[] result = Curve.CreateBooleanDifference(A[i], B, tol);
      //Add the trimmed curves to the output list
      curves.AddRange(result);
    }

    //Output
    R = curves;
# ---------- end gh_rdiff ----------
rdiff = RegionDifference(CurvesA=crv, CurvesB=crv_2, Plane=xy)
panel_9 = Panel(rdiff)
panel_10 = Panel(gh_rdiff.R)

# ---- group: Region Union
crv_3 = Curve([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])
xy_2 = XYPlane(Origin=Point(0, 0, 0))
gh_runion = CSharpScript(C=crv_3, P=xy_2)  # -> out, R; inputs C: list of Curve, P: Plane
# ---------- gh_runion: C# ----------
    //Component written by @bava-kumaravel
    //Performs boolean union between a list of coplanar curves C

    //Define tolerance as the model space absolute tolerance
    double tol = doc.ModelAbsoluteTolerance;

    //Perform boolean union
    Curve[] result = Curve.CreateBooleanUnion(C, tol);

    //Output
    R = result;
# ---------- end gh_runion ----------
runion = RegionUnion(Curves=crv_3, Plane=xy_2)
panel_11 = Panel(runion)
panel_12 = Panel(gh_runion.R)

# ---- group: Mesh Difference
mesh = Mesh(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)
mesh_2 = Mesh([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])
gh_mdif = CSharpScript(A=mesh, B=mesh_2)  # -> out, R; inputs A: list of Mesh, B: list of Mesh
# ---------- gh_mdif: C# ----------
    //Component written by @bava-kumaravel
    //Performs boolean difference between two sets of Meshes A and B

    //Perform boolean difference
    Mesh[] result = Mesh.CreateBooleanDifference(A, B);

    //Output
    R = result;
# ---------- end gh_mdif ----------
mdif = MeshDifference(MeshesA=mesh, MeshesB=mesh_2)
panel_13 = Panel(mdif)
panel_14 = Panel(gh_mdif.R)

# ---- group: Mesh Split
mesh_3 = Mesh(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)
mesh_4 = Mesh([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])
gh_msplit = CSharpScript(M=mesh_3, S=mesh_4)  # -> out, R; inputs M: Mesh, S: list of Mesh
# ---------- gh_msplit: C# ----------
    //Component written by @bava-kumaravel
    //Split a Mesh M with a list of splitters S

    //Perform split operation
    Mesh[] result = M.Split(S);

    //Output
    R = result;
# ---------- end gh_msplit ----------
msplit = MeshSplit(Mesh=mesh_3, Splitters=mesh_4)
panel_15 = Panel(msplit)
panel_16 = Panel(gh_msplit.R)

# ---- group: Box Slits
box = Box([{Plane=PlaneXY(35, -62, 0), X=Domain(0, 29), Y=Domain(0, 1), Z=Domain(0, 10)}, {Plane=PlaneXY(43, -71, 0), X=Domain(0, 1), Y=Domain(0, 17), Z=Domain(0, 4)}, {Plane=PlaneXY(39, -65, 0), X=Domain(0, 24), Y=Domain(0, 1), Z=Domain(0, 7)}, {Plane=PlaneXY(55, -70, 0), X=Domain(0, 1), Y=Domain(0, 17), Z=Domain(0, 4)}])
number_slider = Slider(0.1, range=0..1)
gh_slits = CSharpScript(B=box, G=number_slider)  # -> out, BOut, T; inputs B: tree of Box, G: Double
# ---------- gh_slits: C# ----------
    //Component written by @bava-kumaravel
    //Adds slits to a list of boxes B, with an additional gap tolerance G

    
    //Define data trees to hold the output breps and the tree topology
    DataTree<Brep> outputBreps = new DataTree<Brep>();
    DataTree<int?> topology = new DataTree<int?>();
    
    //Santiy check
    //Check if the incoming boxes are valid boxes
    //Define a list of breps to store them
    for(int branchId = 0;branchId < B.BranchCount;branchId++){
      List<Box> input = B.Branches[branchId];
      GH_Path branchPath = B.Paths[branchId];
      List<Brep> inputBoxes = new List<Brep>();
      for(int i = 0;i < input.Count;i++){
        if(input[i].IsValid){
          //If the box is valid, convert it to a brep and add it to the input list
          Brep brep = input[i].ToBrep();
          inputBoxes.Add(brep);
        }
        else{
          //If the box is not valid, get its bounding box
          //and add it to the input list
          Box box = new Box(input[i].BoundingBox);
          Brep brep = box.ToBrep();
          inputBoxes.Add(brep);
        }
      }

      //Define tolerance as the model space absolute tolerance
      double tol = doc.ModelAbsoluteTolerance;

      for(int i = 0;i < inputBoxes.Count;i++){
        for(int j = i + 1;j < inputBoxes.Count;j++){
          Brep brepA = inputBoxes[i];
          Brep brepB = inputBoxes[j];
          //Perform intersection between box A and B
          Brep[] inter = Brep.CreateBooleanIntersection(brepA, brepB, tol);

          //If the intersection is successful
          if(inter.Length > 0){
            //Get the intersecting box from the inter array (index 0)
            Brep interBrep = inter[0];
            //Convert it into a box by getting its bounding box
            Box interBox = new Box(interBrep.GetBoundingBox(true));

            //Get the center of the intersection box
            Point3d center = interBox.Center;
            //Reposition the base plane to the center and then get it
            interBox.RepositionBasePlane(center);
            Plane basePlane = interBox.Plane;

            //Scale the intersecting brep and box to match the gap tolerance
            //on all side
            //To get the scale factors, get the dimensions of the box first
            double xLen = interBox.X.Length;
            double yLen = interBox.Y.Length;
            double zLen = interBox.Z.Length;

            //Formula for the scale factor is (Length+(2 x Gap))/Length
            double xFactor = (xLen + (2 * G)) / xLen;
            double yFactor = (yLen + (2 * G)) / yLen;
            double zFactor = (zLen + (2 * G)) / zLen;

            //Get the scale transform
            Transform scaleTransform = Transform.Scale(basePlane, xFactor, yFactor, zFactor);
            //Scale the intersection brep and box with it
            interBrep.Transform(scaleTransform);
            interBox.Transform(scaleTransform);

            //Split the scaled intersection brep with the plane
            //Get the intersection curve between the brep and the plane
            Curve[] interCurves = new Curve[0];
            Point3d[] interPoints = new Point3d[0];
            bool success = Rhino.Geometry.Intersect.Intersection.BrepPlane
              (interBrep, basePlane, tol, out interCurves, out interPoints);
            Curve interCurve = interCurves[0];
            //Convert the intersecting curve into a brep
            Brep[] curveBreps = Brep.CreatePlanarBreps(interCurve, tol);
            Brep splitter = curveBreps[0];
            //Split the intersection brep with the splitter
            Brep[] splitBreps = interBrep.Split(splitter, tol);
            //Cap the two breps
            Brep splitBrepA = splitBreps[0].CapPlanarHoles(tol);
            Brep splitBrepB = splitBreps[1].CapPlanarHoles(tol);
            splitBrepA.Flip();
            //Go through the two splitBreps and check which is closest to the
            //brep A
            //To check it, get their centers
            Point3d centerSplitBrepA = splitBrepA.GetBoundingBox(true).Center;
            Point3d centerSplitBrepB = splitBrepB.GetBoundingBox(true).Center;
            //Also get the centers of breps A and B
            Point3d centerA = brepA.GetBoundingBox(true).Center;
            Point3d centerB = brepB.GetBoundingBox(true).Center;

            //Check which split brep is farthest to brepA
            //Trim the brepA with it and the brepB with the other split brep
            double distA = centerA.DistanceToSquared(centerSplitBrepA);
            double distB = centerA.DistanceToSquared(centerSplitBrepB);

            //Define arrays of breps to hold the trimmed breps
            Brep[] trimmedA = new Brep[0];
            Brep[] trimmedB = new Brep[0];

            if(distA >= distB){
              trimmedA = Brep.CreateBooleanDifference(brepA, splitBrepA, tol);
              trimmedB = Brep.CreateBooleanDifference(brepB, splitBrepB, tol);
            }
            else{
              trimmedA = Brep.CreateBooleanDifference(brepA, splitBrepB, tol);
              trimmedB = Brep.CreateBooleanDifference(brepB, splitBrepA, tol);
            }

            //Replace the breps at index i and j with the trimmed breps A and B
            inputBoxes[i] = trimmedA[0];
            inputBoxes[j] = trimmedB[0];
          }
        }
      }

      //Convert the updated input boxes list to a data tree
      for(int i = 0;i < inputBoxes.Count;i++){
        GH_Path currentPath = branchPath.AppendElement(i);
        outputBreps.Add(inputBoxes[i], currentPath);
        topology.Add(null, currentPath);
      }
    }

    //Outputs
    BOut = outputBreps;
    T = topology;
# ---------- end gh_slits ----------
slits = BoxSlits(Boxes=box, Gap=number_slider)  # -> Breps, Topology
panel_17 = Panel(slits.Breps)
panel_18 = Panel(gh_slits.BOut)
panel_19 = Panel(slits.Topology)
panel_20 = Panel(gh_slits.T)

# ---- group: Solid Difference
brep_7 = Brep([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])
brep_8 = Brep([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])
gh_sdiff = CSharpScript(A=brep_7, B=brep_8)  # -> out, R; inputs A: list of Brep, B: list of Brep
# ---------- gh_sdiff: C# ----------
    //Component written by @bava-kumaravel
    //Performs boolean difference between two sets of Breps A and B

    //Define tolerance as the model space absolute tolerance
    double tol = doc.ModelAbsoluteTolerance;

    //Perform boolean difference
    Brep[] result = Brep.CreateBooleanDifference(A, B, tol, false);

    //Output
    R = result;
# ---------- end gh_sdiff ----------
sdiff = SolidDifference(BrepsA=brep_7, BrepsB=brep_8)
panel_21 = Panel(sdiff)
panel_22 = Panel(gh_sdiff.R)

# ---- group: Solid Union
brep_9 = Brep([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])
gh_sunion = CSharpScript(B=brep_9)  # -> out, R; inputs B: list of Brep
# ---------- gh_sunion: C# ----------
    //Component written by @bava-kumaravel
    //Performs boolean union between a list of Breps B

    //Define tolerance as the model space absolute tolerance
    double tol = doc.ModelAbsoluteTolerance;

    //Perform boolean union
    Brep[] result = Brep.CreateBooleanUnion(B, tol, false);

    //Output
    R = result;
# ---------- end gh_sunion ----------
sunion = SolidUnion(Breps=brep_9)
panel_23 = Panel(sunion)
panel_24 = Panel(gh_sunion.R)

# ---- group: Split Brep Multiple
brep_10 = Brep(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)
brep_11 = Brep([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])
gh_splitmul = CSharpScript(B=brep_10, C=brep_11)  # -> out, R; inputs B: Brep, C: list of Brep
# ---------- gh_splitmul: C# ----------
    //Component written by @bava-kumaravel
    //Splits a brep B with a list of cutters C

    //Define tolerance as the model space absolute tolerance
    double tol = doc.ModelAbsoluteTolerance;

    //Define a list to hold the split breps
    List<Brep> splitBreps = new List<Brep>();

    //Add the input brep B to the list
    splitBreps.Add(B);

    //Go through the list of split breps and cutters
    for(int i = C.Count - 1;i >= 0;i--){
      for(int j = 0;j < splitBreps.Count;j++){
        //Perform split operation
        Brep[] breps = splitBreps[j].Split(C[i], tol);
        //If the split is successful
        if(breps.Length > 0){
          //Remove the original brep and replace it with the split breps
          splitBreps.RemoveAt(j);
          splitBreps.AddRange(breps);
          //To bring j to 0 again, we set it to -1, so it will become 0 on
          //increment
          j = -1;
        }
      }
    }

    Component.AddRuntimeMessage(GH_RuntimeMessageLevel.Warning,
      "Order of the outputs is different from the vanilla GH component.");

    //Output
    R = splitBreps;
# ---------- end gh_splitmul ----------
splitmul = SplitBrepMultiple(Brep=brep_10, Cutters=brep_11)
panel_25 = Panel(splitmul)
panel_26 = Panel(gh_splitmul.R)

# ---- group: Region Intersection
crv_4 = Curve([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])
crv_5 = Curve([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])
xy_3 = XYPlane(Origin=Point(0, 0, 0))
gh_rint = CSharpScript(A=crv_4, B=crv_5, P=xy_3)  # -> out, R; inputs A: list of Curve, B: list of Curve, P: Plane
# ---------- gh_rint: C# ----------
    //Component written by @bava-kumaravel
    //Performs boolean intersection between a list of curves A and B
    //using an optional reference plane P

    //Define tolerance as the model space absolute tolerance
    double tol = doc.ModelAbsoluteTolerance;

    //Define a list of curves to hold the outputs
    List<Curve> curves = new List<Curve>();

    //Go through list of curves A
    for(int i = 0;i < A.Count;i++){
      for(int j = 0;j < B.Count;j++){
        //Trim the current curve A[i] with the list of curves B
        Curve[] result = Curve.CreateBooleanIntersection(A[i], B[j], tol);
        //Add the trimmed curves to the output list
        curves.AddRange(result);
      }
    }

    List<Curve> curves1 = new List<Curve>();
    for(int i = 0;i < curves.Count;i++){
      for(int j = i + 1;j < curves.Count;j++){
        //Trim the current curve A[i] with the list of curves B
        Curve[] result = Curve.CreateBooleanIntersection(curves[i], curves[j], tol);
        //Add the trimmed curves to the output list
        curves1.AddRange(result);
      }
    }
    
    Component.AddRuntimeMessage(GH_RuntimeMessageLevel.Warning,
      "Output is different from that of the vanilla GH component.");

    //Output
    R = curves1;
# ---------- end gh_rint ----------
rint = RegionIntersection(CurvesA=crv_4, CurvesB=crv_5, Plane=xy_3)
panel_27 = Panel(rint)
panel_28 = Panel(gh_rint.R)

# ---- group: Mesh Intersection
mesh_5 = Mesh(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)
mesh_6 = Mesh([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])
gh_mint = CSharpScript(A=mesh_5, B=mesh_6)  # -> out, R; inputs A: list of Mesh, B: list of Mesh
# ---------- gh_mint: C# ----------
    //Component written by @bava-kumaravel
    //Performs boolean intersection between two sets of Meshes A and B

    //Perform boolean intersection
    Mesh[] result = Mesh.CreateBooleanIntersection(A, B);

    //Output
    R = result;
# ---------- end gh_mint ----------
mint = MeshIntersection(MeshesA=mesh_5, MeshesB=mesh_6)
panel_29 = Panel(mint)
panel_30 = Panel(gh_mint.R)

# ---- group: Mesh Union
mesh_7 = Mesh([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])
gh_munion = CSharpScript(M=mesh_7)  # -> out, R; inputs M: list of Mesh
# ---------- gh_munion: C# ----------
    //Component written by @bava-kumaravel
    //Performs boolean union between a set of Meshes M

    //Perform boolean union
    Mesh[] result = Mesh.CreateBooleanUnion(M);

    //Output
    R = result;
# ---------- end gh_munion ----------
munion = MeshUnion(Meshes=mesh_7)
panel_31 = Panel(munion)
panel_32 = Panel(gh_munion.R)

# ---- group: Region Slits
crv_6 = Curve([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])
number_slider_2 = Slider(0.81, range=0..1)
number_slider_3 = Slider(0.13, range=0..1)
gh_slits_2 = CSharpScript(R=crv_6, W=number_slider_2, G=number_slider_3)  # -> out, ROut, T; inputs R: tree of Curve, W: Double, G: Double
# ---------- gh_slits_2: C# ----------
    //Component written by @bava-kumaravel
    //Adds slits of width W and gap G to a set of intersecting planar
    //curves R

    //Define data trees to hold the output regions and topography
    DataTree<Brep> outputRegions = new DataTree<Brep>();
    DataTree<int?> topology = new DataTree<int?>();

    //Define tolerance as model space absolute tolerance
    double tol = doc.ModelAbsoluteTolerance;

    //Go through the input datatree
    for(int branchId = 0;branchId < R.BranchCount;branchId++){
      List<Curve> inputCurves = R.Branches[branchId];
      GH_Path branchPath = R.Paths[branchId];

      //If both width and gap of slits is 0, the result is null
      if(W == 0 && G == 0){
        for(int i = 0;i < inputCurves.Count;i++){
          GH_Path path = branchPath.AppendElement(i);
          outputRegions.Add(null, path);
          topology.Add(null, path);
        }
        //Outputs
        ROut = outputRegions;
        T = topology;
        return;
      }

      //Convert the input curves into breps
      //Define a list to store them
      for(int i = 0;i < inputCurves.Count;i++){
        Curve curveA = inputCurves[i];
        //Check if the curve A is planar and closed
        //Else continue to the next iteration
        if(!curveA.IsClosed){
          if(!curveA.IsPlanar()){
            //Throw error
            Component.AddRuntimeMessage(GH_RuntimeMessageLevel.Error,
              "Shape must be a planar region.");
          }
          continue;
        }

        for(int j = i + 1;j < inputCurves.Count;j++){
          curveA = inputCurves[i];
          Curve curveB = inputCurves[j];

          //Check if the curve B is planar and closed
          //Else continue to the next iteration
          if(!curveB.IsClosed){
            if(!curveB.IsPlanar()){
              //Throw error
              Component.AddRuntimeMessage(GH_RuntimeMessageLevel.Error,
                "Shape must be a planar region.");
            }
            continue;
          }

          //Convert the two curves into two breps
          Brep[] planarBreps = new Brep[0];
          planarBreps = Brep.CreatePlanarBreps(curveA, tol);
          Brep brepA = planarBreps[0];
          planarBreps = Brep.CreatePlanarBreps(curveB, tol);
          Brep brepB = planarBreps[0];

          //Check the two breps for intersection
          Curve[] interCurves = new Curve[0];
          Point3d[] interPoints = new Point3d[0];
          bool success = Rhino.Geometry.Intersect.Intersection.BrepBrep
            (brepA, brepB, tol, out interCurves, out interPoints);

          if(interCurves.Length > 0){
            //If intersection is succssful, get the intersection curve
            Curve interLine = interCurves[0];

            //Check if the intersection curve is a line or a planar curve
            if(interLine.IsLinear()){
              //If it is a line, offset it along both breps
              Curve[] offsetCurves = new Curve[0];
              offsetCurves = interLine.OffsetOnSurface(brepA.Faces[0], W, tol);
              Curve offsetLineA1 = offsetCurves[0];
              offsetCurves = interLine.OffsetOnSurface(brepA.Faces[0], (W * -1), tol);
              Curve offsetLineA2 = offsetCurves[0];
              offsetCurves = interLine.OffsetOnSurface(brepB.Faces[0], W, tol);
              Curve offsetLineB1 = offsetCurves[0];
              offsetCurves = interLine.OffsetOnSurface(brepB.Faces[0], (W * -1), tol);
              Curve offsetLineB2 = offsetCurves[0];

              //Convert the two offset lines on each side into a closed curve
              //Create a list of points from the offset line end points
              List<Point3d> pointsA = new List<Point3d>();
              pointsA.Add(offsetLineA1.PointAtStart);
              pointsA.Add(offsetLineA1.PointAtEnd);
              pointsA.Add(offsetLineA2.PointAtEnd);
              pointsA.Add(offsetLineA2.PointAtStart);
              pointsA.Add(offsetLineA1.PointAtStart);
              List<Point3d> pointsB = new List<Point3d>();
              pointsB.Add(offsetLineB1.PointAtStart);
              pointsB.Add(offsetLineB1.PointAtEnd);
              pointsB.Add(offsetLineB2.PointAtEnd);
              pointsB.Add(offsetLineB2.PointAtStart);
              pointsB.Add(offsetLineB1.PointAtStart);

              //Use the point lists to create a polylines
              Polyline polylineA = new Polyline(pointsA);
              Polyline polylineB = new Polyline(pointsB);

              //Convert the polylines to curves
              Curve offsetCurveA = polylineA.ToNurbsCurve();
              Curve offsetCurveB = polylineB.ToNurbsCurve();

              //Next determine which side of the intersecting line the slit
              //needs to be made
              //To do that, first get the center points of the 2 halfs of the
              //intersecting line - that is, the points at the parameters 0.25 and 0.75
              Point3d point1 = interLine.PointAt(0.25);
              Point3d point2 = interLine.PointAt(0.75);

              //Get the center point of the first brep
              Point3d CentreA = brepA.Faces[0].PointAt(0.5, 0.5);

              //Get the distance between the centre point of the first brep and
              //both the points on the intersecting line
              double dist1 = CentreA.DistanceToSquared(point1);
              double dist2 = CentreA.DistanceToSquared(point2);

              //Find the farthest distance among the both
              if(dist1 >= dist2){
                //If distance 1 is greater than 2, the brep A needs to have a slit
                //at the side of point 1, that is close to the start point of the
                //intersection line and brep B needs to have a slit close to the
                //end point of the intersection line

                //To get the slit curves, the offset curve A is moved by half the length
                //of the interection line towards its start point of the intersection line and
                //similarly the offset curve B towards the end point of the intersection line

                //Additionally a gap G needs to be added to close to the mid point
                //of the intersection line for both offset curves.
                //So, a direction vector and distance is calculated to be calculated
                //for the offset curves translation. The distance is same for both and
                //the direction vector of one is the negative of the other.
                //To find them, the length of the intersecting line is used
                double length = interLine.GetLength();
                double distance = (length / 2) - G;
                Vector3d directionVector = interLine.PointAtStart - interLine.PointAtEnd;
                success = directionVector.Unitize();

                //Use them to move the two offset curves
                offsetCurveA.Translate(directionVector * distance);
                offsetCurveB.Translate(directionVector * distance * -1);
              }
              else{
                //Else, brep A has a slit close to the end point of the intersection
                //line and brep B has a slit close to the start point of the
                //intersection line

                //Calculate the direction vector and distance
                double length = interLine.GetLength();
                double distance = (length / 2) - G;
                Vector3d directionVector = interLine.PointAtEnd - interLine.PointAtStart;
                success = directionVector.Unitize();

                //Use them to move the two offset curves
                offsetCurveA.Translate(directionVector * distance);
                offsetCurveB.Translate(directionVector * distance * -1);
              }

              //Subtract the offset curves from the original curves
              Curve[] slitCurvesA = Curve.CreateBooleanDifference
                (curveA, offsetCurveA, tol);
              Curve[] slitCurvesB = Curve.CreateBooleanDifference
                (curveB, offsetCurveB, tol);

              Curve slitCurveA = slitCurvesA[0];
              Curve slitCurveB = slitCurvesB[0];

              //Update the input brep list with the slit breps
              inputCurves[i] = slitCurveA;
              inputCurves[j] = slitCurveB;
            }
          }
        }
      }

      //Convert the updated input curves list to a data tree
      for(int i = 0;i < inputCurves.Count;i++){
        Curve curve = inputCurves[i];
        //Convert the curve into a planar brep
        Brep[] planarBreps = Brep.CreatePlanarBreps(curve, tol);
        Brep brep = planarBreps[0];
        //Get the path for the data tree
        GH_Path currentPath = branchPath.AppendElement(i);
        //Add the brep to the output datatree and a null to the topology
        outputRegions.Add(brep, currentPath);
        topology.Add(null, currentPath);
      }
    }

    //Outputs
    ROut = outputRegions;
    T = topology;
# ---------- end gh_slits_2 ----------
rslits = RegionSlits(Regions=crv_6, Width=number_slider_2, Gap=number_slider_3)  # -> Regions, Topology
panel_33 = Panel(gh_slits_2.ROut)
panel_34 = Panel(rslits.Regions)
panel_35 = Panel(rslits.Topology)
panel_36 = Panel(gh_slits_2.T)
