# Grasshopper definition Transform_Affine.ghx (Grasshopper 1.0.7)

crv = Curve(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)
mesh = Mesh(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)
mesh_2 = Mesh(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)
pt = Point(Point(3.238495701, 6.548313808, 0))
number_slider = Slider(2.15, range=-5..5)
gh_scale = CSharpScript(G=mesh, C=pt, F=number_slider)  # -> out, Gout, X; inputs G: GeometryBase, C: Point3d, F: Double
# ---------- gh_scale: C# ----------
    // Component written by @garciadelcastillo

    // This component creates a Transformation that scales an object
    // by a factor aroung a given center.

    // Some sanity first
    // Comparing a decimal number to another with == can give problems due
    // to floating point precision. A better approach is to compare the numbers
    // to a small tolerance. 
    // See: https://stackoverflow.com/a/6598240/1934487
    if (Math.Abs(F) < RhinoMath.ZeroTolerance)
    {
      Component.AddRuntimeMessage(GH_RuntimeMessageLevel.Error, "Cannot scale by a factor of 0");
      return;
    }
    
    // Compute the Transform and output it
    Transform xform = Transform.Scale(C, F);
    X = xform;  // *

    // Apply it to the object and output it only if it exists
    if (G != null)
    {
      G.Transform(xform);
      Gout = G;
    }

    // * NOTE:
    //   This transform stringifies to "Generic" because it doesn't use
    //   the GH-flavored transforms in Grasshopper.Kernel.Types.Transforms.
# ---------- end gh_scale ----------
scale = Scale(Geometry=mesh, Center=pt, Factor=number_slider)  # -> Geometry, Transform
transform = Panel(scale.Transform)
transform_2 = Panel(gh_scale.X)
geometry = Panel(scale.Geometry)
geometry_2 = Panel(gh_scale.Gout)
matrix = DisplayMatrix(scale.Transform)
matrix_2 = DisplayMatrix(gh_scale.X)

crv_2 = Curve(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)
mesh_3 = Mesh(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)
mesh_4 = Mesh(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)
xy = XYPlane(Origin=Point(0, 0, 0))
pln = Plane(Plane(origin=(0, 0, 0), x=(0.5796831591, 0.8148419694, 0), y=(-0.387507732, 0.2756751796, 0.8796823023)))
number_slider_2 = Slider(-0.22, range=-3.14..3.14)
number_slider_3 = Slider(0.19, range=-3.14..3.14)
gh_shear = CSharpScript(G=mesh_3, P=xy, Ax=number_slider_2, Ay=number_slider_3)  # -> out, Gout, Xout; inputs G: GeometryBase, P: Plane, Ax: Double, Ay: Double
# ---------- gh_shear: C# ----------
    // Component written by @garciadelcastillo

    // This component creates a Transformation that shears an object
    // by applying angle shears around the X and Y axes of the input plane.

    // Compute the main shear vector in the Z direction by rotating
    // the plane normal along the X and Y axes.
    Vector3d shearVector = P.Normal;
    shearVector.Rotate(Ax, P.XAxis);
    shearVector.Rotate(Ay, P.YAxis);
        
    // Compute the Transform and output it
    Transform xform = Transform.Shear(P, P.XAxis, P.YAxis, shearVector);
    Xout = xform;  // *

    // Apply it to the object and output it only if it exists
    if (G != null)
    {
      G.Transform(xform);
      Gout = G;
    }

    // * NOTE:
    //   This transform stringifies to "Generic" because it doesn't use
    //   the GH-flavored transforms in Grasshopper.Kernel.Types.Transforms.
# ---------- end gh_shear ----------
shear = ShearAngle(Geometry=mesh_3, Base=xy, AngleX=number_slider_2, AngleY=number_slider_3)  # -> Geometry, Transform
transform_3 = Panel(shear.Transform)
transform_4 = Panel(gh_shear.Xout)
geometry_3 = Panel(shear.Geometry)
geometry_4 = Panel(gh_shear.Gout)
matrix_3 = DisplayMatrix(shear.Transform)
matrix_4 = DisplayMatrix(gh_shear.Xout)

mesh_5 = Mesh(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)
mesh_6 = Mesh(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)
pln_2 = Plane(Plane(origin=(0, 0, 0), x=(0.5796831591, 0.8148419694, 0), y=(-0.387507732, 0.2756751796, 0.8796823023)))
number_slider_4 = Slider(-1.69, range=-5..5)
number_slider_5 = Slider(1.66, range=-5..5)
number_slider_6 = Slider(-0.71, range=-5..5)
crv_3 = Curve(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)
gh_scale_nu = CSharpScript(G=mesh_5, P=pln_2, X=number_slider_4, Y=number_slider_5, Z=number_slider_6)  # -> out, Gout, Xout; inputs G: GeometryBase, P: Plane, X: Double, Y: Double, Z: Double
# ---------- gh_scale_nu: C# ----------
    // Component written by @garciadelcastillo

    // This component creates a Transformation that scales an object
    // along a plane by three factors in each direction.

    // Some sanity first
    // Comparing a decimal number to another with == can give problems due
    // to floating point precision. A better approach is to compare the numbers
    // to a small tolerance.
    // See: https://stackoverflow.com/a/6598240/1934487
    if (Math.Abs(X) < RhinoMath.ZeroTolerance &&
      Math.Abs(Y) < RhinoMath.ZeroTolerance &&
      Math.Abs(Z) < RhinoMath.ZeroTolerance)
    {
      Component.AddRuntimeMessage(GH_RuntimeMessageLevel.Error, "Cannot scale by a factor of 0");
      return;
    }

    // Compute the Transform and output it
    Transform xform = Transform.Scale(P, X, Y, Z);
    Xout = xform;  // *

    // Apply it to the object and output it only if it exists
    if (G != null)
    {
      G.Transform(xform);
      Gout = G;
    }

    // * NOTE:
    //   This transform stringifies to "Generic" because it doesn't use
    //   the GH-flavored transforms in Grasshopper.Kernel.Types.Transforms.
# ---------- end gh_scale_nu ----------
scale_nu = ScaleNU(Geometry=mesh_5, Plane=pln_2, ScaleX=number_slider_4, ScaleY=number_slider_5, ScaleZ=number_slider_6)  # -> Geometry, Transform
transform_5 = Panel(scale_nu.Transform)
transform_6 = Panel(gh_scale_nu.Xout)
geometry_5 = Panel(scale_nu.Geometry)
geometry_6 = Panel(gh_scale_nu.Gout)
matrix_5 = DisplayMatrix(scale_nu.Transform)
matrix_6 = DisplayMatrix(gh_scale_nu.Xout)

crv_4 = Curve(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)
mesh_7 = Mesh(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)
mesh_8 = Mesh(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)
xy_2 = XYPlane(Origin=Point(0, 0, 0))
vec = VectorXYZ(XComponent=Slider(1, range=-5..5), YComponent=Slider(1, range=-5..5), ZComponent=Slider(-0.42, range=-5..5))  # -> Vector, Length
gh_projecta = CSharpScript(G=mesh_8, P=xy_2, D=vec.Vector)  # -> out, Gout, Xout; inputs G: GeometryBase, P: Plane, D: Vector3d
# ---------- gh_projecta: C# ----------
    // Component written by @garciadelcastillo

    // This component creates a Transformation that projects an object
    // on a plane following a projection vector. This can be thought of as
    // projecting the shadow of the object from a directional light source.

    // Compute the Transform and output it
    Transform xform = ObliqueProjection(P, D);
    Xout = xform;  // *

    // Apply it to the object and output it only if it exists
    if (G != null)
    {
      G.Transform(xform);
      Gout = G;
    }

    // * NOTE:
    //   This transform stringifies to "Generic" because it doesn't use
    //   the GH-flavored transforms in Grasshopper.Kernel.Types.Transforms.
# ---------- gh_projecta: C# additional code ----------
  // This function returns an oblique projection transform, that is,
  // a transform that projects some geometry to a plane along a vector.
  // See: https://stackoverflow.com/a/2500707/1934487
  Transform ObliqueProjection(Plane targetPlane, Vector3d direction)
  {
    // Get the plane equation parameters
    double[] planeEq = targetPlane.GetPlaneEquation();
    double A = planeEq[0];
    double B = planeEq[1];
    double C = planeEq[2];
    double D = planeEq[3];

    // Precalculate some constants that we will use a lot
    double PV = A * direction.X + B * direction.Y + C * direction.Z;
    double APV = -A / PV;
    double BPV = -B / PV;
    double CPV = -C / PV;
    double DPV = -D / PV;

    // Now, initialize an identity transform, and set each value of the matrix
    Transform t = new Transform(1);

    t.M00 = APV * direction.X + 1;
    t.M01 = BPV * direction.X;
    t.M02 = CPV * direction.X;
    t.M03 = DPV * direction.X;

    t.M10 = APV * direction.Y;
    t.M11 = BPV * direction.Y + 1;
    t.M12 = CPV * direction.Y;
    t.M13 = DPV * direction.Y;

    t.M20 = APV * direction.Z;
    t.M21 = BPV * direction.Z;
    t.M22 = CPV * direction.Z + 1;
    t.M23 = DPV * direction.Z;

    t.M30 = 0;
    t.M31 = 0;
    t.M32 = 0;
    t.M33 = 1;

    // Return the transform
    return t;
  }
# ---------- end gh_projecta ----------
projecta = ProjectAlong(Geometry=mesh_8, Plane=xy_2, Direction=vec.Vector)  # -> Geometry, Transform
transform_7 = Panel(projecta.Transform)
geometry_7 = Panel(projecta.Geometry)
transform_8 = Panel(gh_projecta.Xout)
geometry_8 = Panel(gh_projecta.Gout)
matrix_7 = DisplayMatrix(projecta.Transform)
matrix_8 = DisplayMatrix(gh_projecta.Xout)

# ----
# GH#: A C# dictionary of Grasshopper3D components.
# 
# This file contains a category of Grasshopper components, and a mirroring C#/RhinoCommon implementation.
# 
# This is an educational project initiated by students/faculty of GSD-6338: Introduction to Computational Design, at the Harvard Graduate School of Design.
# 
# More information: {{project link}}
# Transform Affine
co = CameraObscura(Point=Point(0, 0, 0), Factor=1)  # -> Geometry, Transform
orient = OrientDirection(PointA=Point(0, 0, 0), DirectionA=Vector(0, 0, 1), PointB=Point(0, 0, 0), DirectionB=Vector(0, 0, 1))  # -> Geometry, Transform
project = Project(Plane=PlaneXY(0, 0, 0))  # -> Geometry, Transform
boxmap = BoxMapping()  # -> Geometry, Transform
recmap = RectangleMapping()  # -> Geometry, Transform
trimap = TriangleMapping()  # -> Geometry, Transform
shear_2 = Shear(Base=PlaneXY(0, 0, 0), Grip=Point(0, 0, 1), Target=Point(0, 0, 1))  # -> Geometry, Transform
