# Grasshopper definition Transform_Euclidean.ghx (Grasshopper 1.0.7)

pln = Plane(Plane(origin=(0, 0, 0), x=(0.5796831591, 0.8148419694, 0), y=(-0.387507732, 0.2756751796, 0.8796823023)))
# Transform Euclidean
mesh = Mesh(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)
gh_mirror = CSharpScript(G=mesh, P=pln)  # -> out, Gout, X; inputs G: GeometryBase, P: Plane
# ---------- gh_mirror: C# ----------
    // Component written by @garciadelcastillo

    // This component creates a Transformation that mirrors an object on a plane.

    // Compute the Transform and output it
    Transform xform = Transform.Mirror(P);
    X = xform;  // *

    // Apply it to the object and output it only if it exists
    if (G != null)
    {
      G.Transform(xform);
      Gout = G;
    }

    // * NOTE:
    //   This transform stringifies to "Generic" because it doesn't use
    //   the GH-flavored transforms in Grasshopper.Kernel.Types.Transforms.
# ---------- end gh_mirror ----------
# GH#: A C# dictionary of Grasshopper3D components.
# 
# This file contains a category of Grasshopper components, and a mirroring C#/RhinoCommon implementation.
# 
# This is an educational project initiated by students/faculty of GSD-6338: Introduction to Computational Design, at the Harvard Graduate School of Design.
# 
# More information: {{project link}}
mirror = Mirror(Geometry=mesh, Plane=pln)  # -> Geometry, Transform
transform = Panel(mirror.Transform)
transform_2 = Panel(gh_mirror.X)
geometry = Panel(mirror.Geometry)
geometry_2 = Panel(gh_mirror.Gout)
matrix = DisplayMatrix(mirror.Transform)
matrix_2 = DisplayMatrix(gh_mirror.X)

mesh_2 = Mesh(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)
gh_move = CSharpScript(G=mesh_2, T="{4.5, 6.7, -10.0}")  # -> out, Gout, X; inputs G: GeometryBase, T: Vector3d
# ---------- gh_move: C# ----------
    // Component written by @garciadelcastillo

    // This component creates a Transformation that translates (moves)
    // an object along a direction vector.

    // Compute the Transform and output it
    Transform xform = Transform.Translation(T);
    X = xform;  // *

    // Apply it to the object and output it only if it exists
    if (G != null)
    {
      G.Transform(xform);
      Gout = G;
    }

    // * NOTE:
    //   This transform stringifies to "Generic" because it doesn't use
    //   the GH-flavored transforms in Grasshopper.Kernel.Types.Transforms.
# ---------- end gh_move ----------
move = Move(Geometry=mesh_2, Motion="{4.5, 6.7, -10.0}")  # -> Geometry, Transform
transform_3 = Panel(move.Transform)
geometry_3 = Panel(move.Geometry)
transform_4 = Panel(gh_move.X)
geometry_4 = Panel(gh_move.Gout)
matrix_3 = DisplayMatrix(move.Transform)
matrix_4 = DisplayMatrix(gh_move.X)

crv = Curve(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)
crv_2 = Curve(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)
mesh_3 = Mesh(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)
pln_2 = Plane(Plane(origin=(0, 0, 0), x=(0.5796831591, 0.8148419694, 0), y=(-0.387507732, 0.2756751796, 0.8796823023)))
toggle = BooleanToggle(True)
toggle_2 = BooleanToggle(True)
gh_movetoplane = CSharpScript(G=crv, P=pln_2, A=toggle, B=toggle_2)  # -> out, Gout, X; inputs G: GeometryBase, P: Plane, A: Boolean, B: Boolean
# ---------- gh_movetoplane: C# ----------
    // Component written by @garciadelcastillo

    // This component creates a Transformation that translates the object
    // and places it on top of the plane.
    
    // Some sanity first
    if (G == null)
    {
      X = Transform.Identity;
      return;
    }
    
    // Compute the aligned bounding box of the input geometry, and its lowest point
    BoundingBox bb = G.GetBoundingBox(P);
    Point3d min = bb.Min;

    // Only run this component if the Z value of the lowest point matches the
    // condition described by the bool inputs.
    if ( (min.Z > 0 && A == false) ||
      (min.Z < 0 && B == false))
    {
      Gout = G;
      X = Transform.Identity;
      return;
    }

    // The translation vector is equal to the plane normal times
    // the inverse of the distance from the point to the plane
    Vector3d direction = -min.Z * P.Normal;

    // Compute the Transform and output it
    Transform xform = Transform.Translation(direction);
    X = xform;  // *

    // Apply it to the object and output it only if it exists
    if (G != null)
    {
      G.Transform(xform);
      Gout = G;
    }

    // * NOTE:
    //   This transform stringifies to "Generic" because it doesn't use
    //   the GH-flavored transforms in Grasshopper.Kernel.Types.Transforms.
# ---------- end gh_movetoplane ----------
movetoplane = MoveToPlane(Geometry=crv, Plane=pln_2, Above=toggle, Below=toggle_2)  # -> Geometry, Transform
transform_5 = Panel(movetoplane.Transform)
transform_6 = Panel(gh_movetoplane.X)
geometry_5 = Panel(movetoplane.Geometry)
geometry_6 = Panel(gh_movetoplane.Gout)
matrix_5 = DisplayMatrix(movetoplane.Transform)
matrix_6 = DisplayMatrix(gh_movetoplane.X)

crv_3 = Curve(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)
crv_4 = Curve(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)
mesh_4 = Mesh(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)
pln_3 = Plane(Plane(origin=(0, 0, 0), x=(0.5796831591, 0.8148419694, 0), y=(-0.387507732, 0.2756751796, 0.8796823023)))
pln_4 = Plane(Plane(origin=(2.119440919, 14.96502528, 5.276117027), x=(-0.6297879066, 0.7767671419, 0), y=(-0.468670943, -0.3799894153, -0.7974682385)))
orient = Orient(Geometry=mesh_4, Source=pln_3, Target=pln_4)  # -> Geometry, Transform
gh_orient = CSharpScript(G=mesh_4, A=pln_3, B=pln_4)  # -> out, Gout, X; inputs G: GeometryBase, A: Plane, B: Plane
# ---------- gh_orient: C# ----------
    // Component written by @garciadelcastillo

    // This component creates a rotation Transformation that changes an object
    // from plane A to plane B, thus reorienting it.

    // Compute the Transform and output it
    Transform xform = Transform.PlaneToPlane(A, B);
    X = xform;  // *

    // Apply it to the object and output it only if it exists
    if (G != null)
    {
      G.Transform(xform);
      Gout = G;
    }

    // * NOTE:
    //   This transform stringifies to "Generic" because it doesn't use
    //   the GH-flavored transforms in Grasshopper.Kernel.Types.Transforms.
# ---------- end gh_orient ----------
transform_7 = Panel(orient.Transform)
transform_8 = Panel(gh_orient.X)
geometry_7 = Panel(orient.Geometry)
geometry_8 = Panel(gh_orient.Gout)
matrix_7 = DisplayMatrix(orient.Transform)
matrix_8 = DisplayMatrix(gh_orient.X)

crv_5 = Curve(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)
crv_6 = Curve(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)
mesh_5 = Mesh(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)
number_slider = Slider(1.48, range=0..6.28)
pln_5 = Plane(Plane(origin=(0, 0, 0), x=(0.5796831591, 0.8148419694, 0), y=(-0.387507732, 0.2756751796, 0.8796823023)))
rotate = Rotate(Geometry=mesh_5, Angle=number_slider, Plane=pln_5)  # -> Geometry, Transform
gh_orient_2 = CSharpScript(G=mesh_5, A=number_slider, P=pln_5)  # -> out, Gout, X; inputs G: GeometryBase, A: Double, P: Plane
# ---------- gh_orient_2: C# ----------
    // Component written by @garciadelcastillo

    // This component creates a Transformation that rotates an object
    // around the origin and normal vector of a given plane.

    // Compute the Transform and output it
    Transform xform = Transform.Rotation(A, P.Normal, P.Origin);
    X = xform;  // *

    // Apply it to the object and output it only if it exists
    if (G != null)
    {
      G.Transform(xform);
      Gout = G;
    }

    // * NOTE:
    //   This transform stringifies to "Generic" because it doesn't use
    //   the GH-flavored transforms in Grasshopper.Kernel.Types.Transforms.
# ---------- end gh_orient_2 ----------
geometry_9 = Panel(rotate.Geometry)
transform_9 = Panel(rotate.Transform)
geometry_10 = Panel(gh_orient_2.Gout)
transform_10 = Panel(gh_orient_2.X)
matrix_9 = DisplayMatrix(rotate.Transform)
matrix_10 = DisplayMatrix(gh_orient_2.X)

mesh_6 = Mesh(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)
vec = Vector(Vector(3.238495701, 6.548313808, 9.031775098))
crv_7 = Curve(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)
crv_8 = Curve(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)
number_slider_2 = Slider(2.89, range=0..6.28)
pt = Point(Point(3.238495701, 6.548313808, 0))
rot3d = Rotate3D(Geometry=mesh_6, Angle=number_slider_2, Center=pt, Axis=vec)  # -> Geometry, Transform
gh_rot3d = CSharpScript(G=mesh_6, A=number_slider_2, C=pt, X=vec)  # -> out, Gout, Xout; inputs G: GeometryBase, A: Double, C: Point3d, X: Vector3d
# ---------- gh_rot3d: C# ----------
    // Component written by @garciadelcastillo

    // This component creates a Transformation that rotates an object
    // around a point and an axis vector.

    // Compute the Transform and output it
    Transform xform = Transform.Rotation(A, X, C);
    Xout = xform;  // *

    // Apply it to the object and output it only if it exists
    if (G != null)
    {
      G.Transform(xform);
      Gout = G;
    }

    // * NOTE:
    //   This transform stringifies to "Generic" because it doesn't use
    //   the GH-flavored transforms in Grasshopper.Kernel.Types.Transforms.
# ---------- end gh_rot3d ----------
geometry_11 = Panel(rot3d.Geometry)
transform_11 = Panel(rot3d.Transform)
geometry_12 = Panel(gh_rot3d.Gout)
transform_12 = Panel(gh_rot3d.Xout)
matrix_11 = DisplayMatrix(rot3d.Transform)
matrix_12 = DisplayMatrix(gh_rot3d.Xout)

line = Line(Line((6.531645448, 8.779378677, 0), (0, 0.8791993458, 10.95002822)))
crv_9 = Curve(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)
crv_10 = Curve(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)
mesh_7 = Mesh(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)
number_slider_3 = Slider(1.73, range=0..6.28)
gh_rotax = CSharpScript(G=mesh_7, A=number_slider_3, X=line)  # -> out, Gout, Xout; inputs G: GeometryBase, A: Double, X: Line
# ---------- gh_rotax: C# ----------
    // Component written by @garciadelcastillo

    // This component creates a Transformation that rotates an object
    // around a point and a line axis.

    // Let's create the axis vector using the line's end points
    Vector3d axis = X.To - X.From;

    // Compute the Transform and output it
    Transform xform = Transform.Rotation(A, axis, X.From);
    Xout = xform;  // *

    // Apply it to the object and output it only if it exists
    if (G != null)
    {
      G.Transform(xform);
      Gout = G;
    }

    // * NOTE:
    //   This transform stringifies to "Generic" because it doesn't use
    //   the GH-flavored transforms in Grasshopper.Kernel.Types.Transforms.
# ---------- end gh_rotax ----------
rotax = RotateAxis(Geometry=mesh_7, Angle=number_slider_3, Axis=line)  # -> Geometry, Transform
transform_13 = Panel(rotax.Transform)
transform_14 = Panel(gh_rotax.Xout)
geometry_13 = Panel(rotax.Geometry)
geometry_14 = Panel(gh_rotax.Gout)
matrix_13 = DisplayMatrix(rotax.Transform)
matrix_14 = DisplayMatrix(gh_rotax.Xout)

mesh_8 = Mesh(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)
pt_2 = Point(Point(3.238495701, 6.548313808, 0))
vec_2 = Vector(Vector(3.238495701, 6.548313808, 9.031775098))
crv_11 = Curve(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)
crv_12 = Curve(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)
vec_3 = Vector(Vector(6.402998761, -9.059442255, 0))
rotate_2 = RotateDirection(Geometry=mesh_8, Center=pt_2, From=vec_2, To=vec_3)  # -> Geometry, Transform
gh_rotate = CSharpScript(G=mesh_8, C=pt_2, F=vec_2, T=vec_3)  # -> out, Gout, Xout; inputs G: GeometryBase, C: Point3d, F: Vector3d, T: Vector3d
# ---------- gh_rotate: C# ----------
    // Component written by @garciadelcastillo

    // This component creates a Transformation that rotates an object
    // to orient it from one direction vector to another. 

    // Compute the Transform and output it
    Transform xform = Transform.Rotation(F, T, C);
    Xout = xform;  // *

    // Apply it to the object and output it only if it exists
    if (G != null)
    {
      G.Transform(xform);
      Gout = G;
    }

    // * NOTE:
    //   This transform stringifies to "Generic" because it doesn't use
    //   the GH-flavored transforms in Grasshopper.Kernel.Types.Transforms.
# ---------- end gh_rotate ----------
transform_15 = Panel(rotate_2.Transform)
transform_16 = Panel(gh_rotate.Xout)
geometry_15 = Panel(rotate_2.Geometry)
geometry_16 = Panel(gh_rotate.Gout)
matrix_15 = DisplayMatrix(rotate_2.Transform)
matrix_16 = DisplayMatrix(gh_rotate.Xout)

moveaway = MoveAwayFrom(Distance=10)  # -> Geometry, Transform
