# Grasshopper definition Transform_Util.ghx (Grasshopper 1.0.7)

transform = Transform({TransformCount=1, Name="Translation", tx=0, ty=0, tz=10})
transform_2 = Transform({TransformCount=1, Name="Rotation", angle=1.48, ax=0.7168020596, ay=-0.509937016, az=0.4755618225, cx=0, cy=0, cz=0})
transform_3 = Transform({TransformCount=1, Name="Rotation", angle=1.73, ax=-0.4354639872, ay=-0.5267039704, az=0.7300370151, cx=6.531645448, cy=8.779378677, cz=0})
gh_inverse_transform = CSharpScript(T=transform_2)  # -> out, X; inputs T: Transform
# ---------- gh_inverse_transform: C# ----------
    // Component written by @garciadelcastillo

    // This component tries to compute the inverse Transform
    // to the one provided.

    Transform xform;
    bool success = T.TryGetInverse(out xform);
    if (!success)
    {
      Component.AddRuntimeMessage(GH_RuntimeMessageLevel.Warning, "Inverse could not be computed");
    }

    // Output
    X = xform;  // *

    // * NOTE:
    //   This transform stringifies to "Generic" because it doesn't use
    //   the GH-flavored transforms in Grasshopper.Kernel.Types.Transforms.
# ---------- end gh_inverse_transform ----------
inverse = InverseTransform(Transform=transform_2)
transform_4 = Panel(inverse)
transform_5 = Panel(gh_inverse_transform.X)
matrix = DisplayMatrix(inverse)
matrix_2 = DisplayMatrix(gh_inverse_transform.X)

mesh = Mesh(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)
transform_6 = Transform({TransformCount=1, Name="Rotation", angle=1.48, ax=0.7168020596, ay=-0.509937016, az=0.4755618225, cx=0, cy=0, cz=0})
transform_7 = Transform({TransformCount=1, Name="Rotation", angle=1.73, ax=-0.4354639872, ay=-0.5267039704, az=0.7300370151, cx=6.531645448, cy=8.779378677, cz=0})
transform_8 = Transform({TransformCount=1, Name="Translation", tx=0, ty=0, tz=10})
gh_transform = CSharpScript(G=mesh, T=transform_6)  # -> out, Gout; inputs G: GeometryBase, T: Transform
# ---------- gh_transform: C# ----------
    // Component written by @garciadelcastillo

    // This component applies the input transformation to the input geometry.
    bool success = G.Transform(T);
    if (!success) 
    {
      Component.AddRuntimeMessage(GH_RuntimeMessageLevel.Error, "Transform could not be applied to Geometry");
    }

    // Output
    Gout = G;
# ---------- end gh_transform ----------
transform_9 = Transform(Geometry=mesh, Transform=transform_6)
geometry = Panel(gh_transform.Gout)
geometry_2 = Panel(transform_9)

# ----
# Transform Util
transform_10 = Transform({TransformCount=1, Name="Rotation", angle=1.48, ax=0.7168020596, ay=-0.509937016, az=0.4755618225, cx=0, cy=0, cz=0})

transform_11 = Transform({TransformCount=1, Name="Translation", tx=0, ty=0, tz=10})
transform_12 = Transform({TransformCount=1, Name="Rotation", angle=1.73, ax=-0.4354639872, ay=-0.5267039704, az=0.7300370151, cx=6.531645448, cy=8.779378677, cz=0})
# GH#: A C# dictionary of Grasshopper3D components.
# 
# This file contains a category of Grasshopper components, and a mirroring C#/RhinoCommon implementation.
# 
# This is an educational project initiated by students/faculty of GSD-6338: Introduction to Computational Design, at the Harvard Graduate School of Design.
# 
# More information: {{project link}}
relay = Relay([transform_10, transform_11, transform_12])
gh_comp = CSharpScript(T=relay)  # -> out, X; inputs T: list of Transform
# ---------- gh_comp: C# ----------
    // Component written by @garciadelcastillo

    // This component creates a compound Transformation which equals
    // the list of input Transformations concatenated together.

    // Start with the identity transform, and start applying
    // the input ones in order.
    Transform xform = Transform.Identity;
    foreach (Transform t in T)
    {
      // Transformations are applied to an object (or another transform)
      // by PREmultiplying it (matrix multiplication is non-commutative,
      // try switching the order of the input Trnsforms).
      xform = t * xform;
    }

    // Output
    X = xform;  // *

    // * NOTE:
    //   This transform stringifies to "Generic" because it doesn't use
    //   the GH-flavored transforms in Grasshopper.Kernel.Types.Transforms.
# ---------- end gh_comp ----------
comp = Compound(Transforms=relay)
transform_13 = Panel(comp)
transform_14 = Panel(gh_comp.X)
matrix_3 = DisplayMatrix(comp)
matrix_4 = DisplayMatrix(gh_comp.X)

transform_15 = Transform(comp)
gh_split = CSharpScript(T=transform_15)  # -> out, X
# ---------- gh_split: C# ----------
    // Component written by @garciadelcastillo

    // This component takes a compound transformation, and splits it into
    // the chain of individual transformations that were used to create it.

    // WARNING: code not for beginners! :)
    // GH 'wraps' native RhinoCommon types into its own data types, often
    // referred to as `GH_Goo<Type>` types. For example, RhinoCommon `Transform`
    // objects are wrapped as `GH_Transform` objects. They are often quite similar,
    // although some times they have slightly different properties or functionality.
    // This is the case for example of `GH_Transforms`, which (as opposed to `Transform`)
    // keep record of the history of transformations that created them, and stringify
    // to a nice text representation of the transformation.
    // The problem with C# Script components is that all GH types get converted to their
    // RhinoCommon counterparts before entering this function, losing their additional GH
    // properties. In the case of `Transform`, they lose their history and become a "flat"
    // 4x4 matrix.
    // In order to catch the native GH data type, and access its properties (like we need
    // in this script to read the transformation history), we need to read directly from the
    // component's _volatile data_, which is the original one before being converted to
    // RhinoCommon types.
    // In doing this, we also lose access to GH's nice data structure properties...?

    GH_Structure<IGH_Goo> volatileData = this.Component.Params.Input[0].VolatileData as GH_Structure<IGH_Goo>;

    foreach (IGH_Goo item in volatileData)
    {
      GH_Transform xForm = item as GH_Transform;

      if (xForm != null)
      {
        X = xForm.CompoundTransforms;
      }
    }
# ---------- end gh_split ----------
split = Split(Transform=transform_15)
transform_16 = Panel(split)
transform_17 = Panel(gh_split.X)

matrix_5 = TransformMatrix(Digits=3)
group = Group()
ungroup = Ungroup()
gsplit = SplitGroup(Wrap=False)  # -> GroupA, GroupB
gmerge = MergeGroup()
