# Grasshopper definition Display_Colour.ghx (Grasshopper 1.0.7)

# ---- group: Color HSL
number_slider = Slider(0.6, range=0..1)
saturation = Slider(0.18, range=0..1)
lightness = Slider(0.17, range=0..1)
number_slider_2 = Slider(0.32, range=0..1)
hsl = ColourHSL(Alpha=number_slider, Hue=number_slider_2, Saturation=saturation, Luminance=lightness)
gh_hsl = CSharpScript(A=number_slider, H=number_slider_2, S=saturation, L=lightness)  # -> out, C; inputs A: Double, H: Double, S: Double, L: Double
# ---------- gh_hsl: C# ----------
    // Component written by @thekaushikls

    // This component creates a DotNet Color object from Hue(H), aturation(S),
    // and Lightness(L) channels.
    Rhino.Display.ColorHSL newColorHSL = new Rhino.Display.ColorHSL(A, H, S, L);

    // Rhino implicitly casts ColorHSL object into DotNet Color Object.
    System.Drawing.Color newColor = newColorHSL;

    // Output
    C = newColor;
# ---------- end gh_hsl ----------
panel = Panel(hsl)
panel_2 = Panel(gh_hsl.C)

# ---- group: Color LCH
number_slider_3 = Slider(0.27, range=0..1)
chroma = Slider(0.58, range=0..1)
number_slider_4 = Slider(0.58, range=0..1)
hue = Slider(0.73, range=0..1)
lch = ColourLCH(Alpha=number_slider_4, Luminance=number_slider_3, Chroma=chroma, Hue=hue)
gh_lch = CSharpScript(A=number_slider_4, L=number_slider_3, C=chroma, H=hue)  # -> out, Col; inputs A: Double, L: Double, C: Double, H: Double
# ---------- gh_lch: C# ----------
    // Component written by @thekaushikls

    // This component creates DotNet Color object from Alpha(A), Lightness(L),
    // Chroma(C), and Hue(H) channels.
    Rhino.Display.ColorLCH newColorLCH = new Rhino.Display.ColorLCH(A, L, C, H);

    // Rhino implicitly casts ColorLCH object into DotNet Color Object.
    System.Drawing.Color newColor = newColorLCH;

    // Output
    Col = newColor;
# ---------- end gh_lch ----------
panel_3 = Panel(lch)
panel_4 = Panel(gh_lch.Col)

# ---- group: Color RGB
number_slider_5 = Slider(65, range=0..255)
green = Slider(213, range=0..255)
number_slider_6 = Slider(124, range=0..255)
blue = Slider(33, range=0..255)
rgb = ColourRGB(Alpha=number_slider_6, Red=number_slider_5, Green=green, Blue=blue)
gh_rgb = CSharpScript(A=number_slider_6, R=number_slider_5, G=green, B=blue)  # -> out, C; inputs A: Int32, R: Int32, G: Int32, B: Int32
# ---------- gh_rgb: C# ----------
    // Component written by @thekaushikls

    // This component creates DotNet Color object from Alpha(A), Red(R),
    // Green(G), and Blue(B) channels.

    // Output
    C = System.Drawing.Color.FromArgb(A, R, G, B);
# ---------- end gh_rgb ----------
panel_5 = Panel(gh_rgb.C)
panel_6 = Panel(rgb)

# ---- group: Color RGB(f)
number_slider_7 = Slider(0.23, range=0..1)
green_2 = Slider(0.48, range=0..1)
number_slider_8 = Slider(0.41, range=0..1)
blue_2 = Slider(0.16, range=0..1)
frgb = ColourRGBF(Alpha=number_slider_8, Red=number_slider_7, Green=green_2, Blue=blue_2)
gh_frgb = CSharpScript(A=number_slider_8, R=number_slider_7, G=green_2, B=blue_2)  # -> out, C; inputs A: Double, R: Double, G: Double, B: Double
# ---------- gh_frgb: C# ----------
    // Component written by @thekaushikls

    // This component creates DotNet Color object from Alpha(A), Red(R),
    // Green(G), and Blue(B) channels.
    Rhino.Display.ColorRGBA newColorRGB = new Rhino.Display.ColorRGBA(R, G, B, A);
    
    // Explicitly casts ColorRGBA into DotNet Color Object.
    // Output
    C = (System.Drawing.Color) newColorRGB;
# ---------- end gh_frgb ----------
panel_7 = Panel(frgb)
panel_8 = Panel(gh_frgb.C)

# ---- group: Color XYZ
X = Slider(0.43, range=0..1)
Y = Slider(0.15, range=0..1)
number_slider_9 = Slider(0.5, range=0..1)
Z = Slider(0.83, range=0..1)
xyz = ColourXYZ(Alpha=number_slider_9, X=X, Y=Y, Z=Z)
gh_xyz = CSharpScript(A=number_slider_9, X=X, Y=Y, Z=Z)  # -> out, C; inputs A: Double, X: Double, Y: Double, Z: Double
# ---------- gh_xyz: C# ----------
    // Component written by @thekaushikls

    // This component creates DotNet Color object from Alpha(A), X, Y, and Z channels.
    Rhino.Display.ColorXYZ newColorRGB = new Rhino.Display.ColorXYZ(A, X, Y, Z);

    // Explicitly casts ColorXYZ into DotNet Color Object.
    // Output
    C = (System.Drawing.Color) newColorRGB;
# ---------- end gh_xyz ----------
panel_9 = Panel(xyz)
panel_10 = Panel(gh_xyz.C)

# ---- group: Color L*ab
number_slider_10 = Slider(0.48, range=0..1)
A = Slider(0.31, range=0..1)
number_slider_11 = Slider(0.45, range=0..1)
B = Slider(0.15, range=0..1)
colour_l_ab = ColourLAb(Alpha=number_slider_11, Luminance=number_slider_10, A=1, B=B)
gh_l_ab = CSharpScript(A=number_slider_11, L=number_slider_10, a=A, b=B)  # -> out, C; inputs A: Double, L: Double, a: Double, b: Double
# ---------- gh_l_ab: C# ----------
    // Component written by @thekaushikls

    // This component creates DotNet Color object from Alpha(A), Lightness(L),
    // BaseColor(A), and OpponenstColor(B) channels.
    Rhino.Display.ColorLAB newColorLAB = new Rhino.Display.ColorLAB(A, L, a, b);

    // Rhino implicitly casts ColorLAB object into DotNet Color Object.
    System.Drawing.Color newColor = newColorLAB;

    // Output
    C = newColor;
# ---------- end gh_l_ab ----------
panel_11 = Panel(colour_l_ab)
panel_12 = Panel(gh_l_ab.C)

# ---- group: Color HSV
saturation_2 = Slider(0.18, range=0..1)
number_slider_12 = Slider(0.32, range=0..1)
number_slider_13 = Slider(0.6, range=0..1)
value = Slider(0.17, range=0..1)
hsv = ColourHSV(Alpha=number_slider_13, Hue=number_slider_12, Saturation=saturation_2, Value=value)
gh_hsv = CSharpScript(A=number_slider_13, H=number_slider_12, S=saturation_2, V=value)  # -> out, C; inputs A: Double, H: Double, S: Double, V: Double
# ---------- gh_hsv: C# ----------
    // Component written by @thekaushikls

    // This component creates a DotNet Color object from Hue(H), aturation(S),
    // and brightness Value(V) channels.
    Rhino.Display.ColorHSV newColorHSV = new Rhino.Display.ColorHSV(A, H, S, V);

    // Rhino implicitly casts ColorHSV object into DotNet Color Object.
    System.Drawing.Color newColor = newColorHSV;

    // Output
    C = newColor;
# ---------- end gh_hsv ----------
panel_13 = Panel(hsv)
panel_14 = Panel(gh_hsv.C)

# ---- group: Color CMYK
number_slider_14 = Slider(0.32, range=0..1)
number_slider_15 = Slider(0.18, range=0..1)
# GH#: A C# dictionary of Grasshopper3D components.
# 
# This file contains a category of Grasshopper components, and a mirroring C#/RhinoCommon implementation.
# 
# This is an educational project initiated by students/faculty of GSD-6338: Introduction to Computational Design, at the Harvard Graduate School of Design.
# 
# More information: {{project link}}
# Display Colour
number_slider_16 = Slider(0.38, range=0..1)
number_slider_17 = Slider(0.17, range=0..1)
cmyk = ColourCMYK(Cyan=number_slider_16, Magenta=number_slider_14, Yellow=number_slider_15, Key=number_slider_17)
gh_cmyk = CSharpScript(C=number_slider_16, M=number_slider_14, Y=number_slider_15, K=number_slider_17)  # -> out, Col; inputs C: Double, M: Double, Y: Double, K: Double
# ---------- gh_cmyk: C# ----------
    // Component written by @thekaushikls

    // This component creates a DotNet Color object from Cyan(C), Magenta(M),
    // Yellow(Y), and Key(K) channels.

    Rhino.Display.ColorCMYK newColorCMYK = new Rhino.Display.ColorCMYK(C, M, Y, K);

    // Rhino implicitly casts ColorCMYK object into DotNet Color Object.
    System.Drawing.Color newColor = newColorCMYK;

    // Output
    Col = newColor;
# ---------- end gh_cmyk ----------
panel_15 = Panel(cmyk)
panel_16 = Panel(gh_cmyk.Col)

# ---- group: Split AHSL
swatch = ColourSwatch(SwatchColor=RGB(130, 236, 114))
ahsl = SplitAHSL(Colour=swatch)  # -> Alpha, Hue, Saturation, Luminance
gh_ahsl = CSharpScript(C=swatch)  # -> out, A, H, S, L; inputs C: Color
# ---------- gh_ahsl: C# ----------
    // Component written by @thekaushikls

    // This component splits Colour into Alpha(A), Hue(H), Saturation(S),
    // and Lightness(L) channels.

    // Convert from DotNet colour type to Rhino color type,
    Rhino.Display.ColorHSL newColorHSL = new Rhino.Display.ColorHSL(C);

    // Output
    A = newColorHSL.A;
    H = newColorHSL.H;
    S = newColorHSL.S;
    L = newColorHSL.L;
# ---------- end gh_ahsl ----------
panel_17 = Panel(ahsl.Alpha)
panel_18 = Panel(ahsl.Hue)
panel_19 = Panel(ahsl.Saturation)
panel_20 = Panel(ahsl.Luminance)
panel_21 = Panel(gh_ahsl.H)
panel_22 = Panel(gh_ahsl.S)
panel_23 = Panel(gh_ahsl.L)
panel_24 = Panel(gh_ahsl.A)

# ---- group: Split AHSV
swatch_2 = ColourSwatch(SwatchColor=RGB(79, 173, 211))
ahsv = SplitAHSV(Colour=swatch_2)  # -> Alpha, Hue, Saturation, Value
gh_ahsv = CSharpScript(C=swatch_2)  # -> out, A, H, S, V; inputs C: Color
# ---------- gh_ahsv: C# ----------
    // Component written by @thekaushikls

    // This component splits Colour into Alpha(A), Hue(H), Saturation(S),
    // and brightnessValue(V) channels.

    // Convert from DotNet colour type to Rhino color type,
    Rhino.Display.ColorHSV newColorHSV = new Rhino.Display.ColorHSV(C);

    // Output
    A = newColorHSV.A;
    H = newColorHSV.H;
    S = newColorHSV.S;
    V = newColorHSV.V;
# ---------- end gh_ahsv ----------
panel_25 = Panel(ahsv.Alpha)
panel_26 = Panel(ahsv.Saturation)
panel_27 = Panel(ahsv.Value)
panel_28 = Panel(gh_ahsv.A)
panel_29 = Panel(gh_ahsv.H)
panel_30 = Panel(gh_ahsv.S)
panel_31 = Panel(gh_ahsv.V)
panel_32 = Panel(ahsv.Hue)

# ---- group: Split ARGB
swatch_3 = ColourSwatch(SwatchColor=RGB(242, 21, 117))
argb = SplitARGB(Colour=swatch_3)  # -> Alpha, Red, Green, Blue
gh_argb = CSharpScript(C=swatch_3)  # -> out, A, R, G, B; inputs C: Color
# ---------- gh_argb: C# ----------
    // Component written by @thekaushikls

    // This component splits Colour into Alpha(A), Hue(H), Saturation(S),
    // and brightnessValue(V) channels.

    // Convert from DotNet colour type to Rhino color type,
    Rhino.Display.ColorRGBA newColorRGB = new Rhino.Display.ColorRGBA(C);

    // Output
    A = newColorRGB.A;
    R = newColorRGB.R;
    G = newColorRGB.G;
    B = newColorRGB.B;
# ---------- end gh_argb ----------
panel_33 = Panel(gh_argb.A)
panel_34 = Panel(argb.Alpha)
panel_35 = Panel(argb.Red)
panel_36 = Panel(argb.Green)
panel_37 = Panel(argb.Blue)
panel_38 = Panel(gh_argb.R)
panel_39 = Panel(gh_argb.G)
panel_40 = Panel(gh_argb.B)
