# Grasshopper definition Vector_Plane_Example.ghx (Grasshopper 1.0.7)

# ----
# GH#: A C# dictionary of Grasshopper3D components.
# 
# This file contains a category of Grasshopper components, and a mirroring C#/RhinoCommon implementation.
# 
# This is an educational project initiated by students/faculty of GSD-6338: Introduction to Computational Design, at the Harvard Graduate School of Design.
# 
# More information: {{project link}}
# Vector Plane
# NOTES
# 
# Be sure to credit yourself by starting your components' code with the below comment.
# //Component written by @yourgithubusername
# 
# 
# Definition Label
# -Use a scribble to denote the Tab and the sub-tab in which you are working. These can be set to size 50 and grouped in white. More details regarding the white colored groups below.
# 
# 
# Naming the File
# tab_Subtab (ie. for this file the name would be vector_Plane
# 
# 
# Components
# - The order of the components should be the same as in the tab's sub-tab with the Grasshopper component above the C#.
# - A line created with a scribble should separate groups of components if that is found within the sub-tab.
# -Be sure to leave the out output on your C# components.
# -Try to get the inputs and outputs on the C# component as close as possible to the grasshopper component equivalent.
# - Each component is grouped with its name.
# - The numbers for the group colors are:
# 	Hue: 170
# 	Sat: 25
# 	Val: 90
# 	A: 150
# - Be sure to denote the name on the C# component's by clicking the interior/middle of the component and naming it C# Component Name.
# -Be sure to use the same inputs for the grasshopper and C# components. Make sure that you are internalizing the referenced geometries into the components so that a Rhino file will not be needed.
# -Group the grasshopper and C# components in white. The values are below.
# 	Hue: 0
# 	Sat: 0
# 	Val: 90
# 	A: 150
# 
# 
# Panels
# -The panels should be white more specifically the values below.
# 	Hue: 0
# 	Sat: 0
# 	Val: 100
# 	A: 255
# 
# 
# If you have any questions, comments, or concerns, please feel free to contact me, Erin Hunt at erinhunt@gsd.harvard.edu
xy = XYPlane(Origin=Point(0, 0, 0))
c_deplane = CSharpScript(P=xy)  # -> Out, O, X, Y, Z
panel = Panel(c_deplane.X)
panel_2 = Panel(c_deplane.O)
panel_3 = Panel(c_deplane.Y)
panel_4 = Panel(c_deplane.Z)

# ---- group: Grasshopper DePlane
deplane = DeconstructPlane(Plane=xy)  # -> Origin, XAxis, YAxis, ZAxis

# ----
panel_5 = Panel(deplane.YAxis)
panel_6 = Panel(deplane.Origin)
panel_7 = Panel(deplane.XAxis)
panel_8 = Panel(deplane.ZAxis)

xy_2 = XYPlane(Origin=Point(0, 0, 0))
number_slider = Slider(1, range=0..1)

# ---- group: Grasshopper Pl Offset
pl_offset = PlaneOffset(BasePlane=xy_2, Offset=number_slider)

# ---- group: C# PI Offset
c_pl_offset = CSharpScript(P=xy_2, O=number_slider)  # -> Out, Pl

# ----
pln = Plane(pl_offset)
pln_2 = Plane(c_pl_offset.Pl)

xy_3 = XYPlane(Origin=Point(0, 0, 0))
X = UnitX(Factor=1)
c_padjust = CSharpScript(P=xy_3, N=X)  # -> Out, P
pln_3 = Plane(c_padjust.P)

# ---- group: Grasshopper PAdjust
padjust = AdjustPlane(Plane=xy_3, Normal=X)

# ----
pln_4 = Plane(padjust)

xy_4 = XYPlane(Origin=Point(0, 0, 0))
pln_5 = Plane([Plane(origin=(-18.00867755, 8.094398381, 0), x=(0.6693414041, 0.7429549682, 0), y=(0, 0, 1)), Plane(origin=(-15.60908894, 6.017764458, 0), x=(0.6402538266, 0.7681634185, 0), y=(0, 0, 1)), Plane(origin=(-13.13702255, 4.02789191, 0), x=(0.6137683, 0.7894862088, 0), y=(0, 0, 1)), Plane(origin=(-10.59743953, 2.124981747, 0), x=(0.5844139317, 0.8114557021, 0), y=(0, 0, 1)), Plane(origin=(-7.979564921, 0.3315971985, 0), x=(0.5419800382, 0.8403913602, 0), y=(0, 0, 1)), Plane(origin=(-5.24266772, -1.272687082, 0), x=(0.4613547686, 0.8872157446, 0), y=(0, 0, 1))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])
c_align = CSharpScript(P=pln_5, M=xy_4)  # -> Out, P
pln_6 = Plane(c_align.P)

# ---- group: Grasshopper Align
align = AlignPlanes(Planes=pln_5, Master=xy_4)

# ----
pln_7 = Plane(align)

xy_5 = XYPlane(Origin=Point(0, 0, 0))
pt = Point(Point(5.409136367, -2.140998851, 0))
c_cp = CSharpScript(S=pt, P=xy_5)  # -> Out, P, Uv, D
panel_9 = Panel(c_cp.D)
pt_2 = Point(c_cp.Uv)
pt_3 = Point(c_cp.P)

# ---- group: Grasshopper CP
cp = PlaneClosestPoint(Point=pt, Plane=xy_5)  # -> Point, UVPoint, Distance

# ----
panel_10 = Panel(cp.Distance)
pt_4 = Point(cp.Point)
pt_5 = Point(cp.UVPoint)

xy_6 = XYPlane(Origin=Point(0, 0, 0))
angle = Slider(45, range=0..360)
c_prot = CSharpScript(P=xy_6, A=angle)  # -> Out, P
pln_8 = Plane(c_prot.P)

# ---- group: Grasshopper PRot
prot = RotatePlane(Plane=xy_6, Angle=degrees(angle))

# ----
pln_9 = Plane(prot)

Y = Slider(1, range=1..5)
pt_6 = Point(Point(5.928926226, 17.76513586, 0))
X_2 = Slider(1, range=1..5)
X_3 = UnitX(Factor=X_2)
Y_2 = UnitY(Factor=Y)
c_pl = CSharpScript(O=pt_6, X=X_3, Y=Y_2)  # -> Out, Pl
pln_10 = Plane(c_pl.Pl)

# ---- group: Grasshopper Pl
pl = ConstructPlane(Origin=pt_6, XAxis=X_3, YAxis=Y_2)

# ----
pln_11 = Plane(pl)

crv = Curve(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)
pt_7 = Point(Point(-8.200616191, 1.956036226, 0))
c_lnpt = CSharpScript(L=crv, P=pt_7)  # -> Out, Pl
pln_12 = Plane(c_lnpt.Pl)

# ---- group: Grasshopper LnPt
lnpt = LinePt(Line=crv, Point=pt_7)

# ----
pln_13 = Plane(lnpt)

pt_8 = Point([Point(-4.877285035, -3.599413098, 0), Point(-7.736858841, 3.705606443, 0), Point(1.069701807, -2.094291859, 0), Point(2.60360817, -8.103521298, 0), Point(-2.686847376, -1.834569842, 0), Point(-1.494729184, 2.616587729, 0), Point(3.058239807, -1.630175255, 0), Point(5.601482559, -6.182381913, 0), Point(4.251827656, -8.053757949, 0), Point(0.7774944458, -5.448354787, 0), Point(-2.891598841, -6.478730454, 0)])
c_plfit = CSharpScript(P=pt_8)  # -> Out, Pl, Dx
panel_11 = Panel(c_plfit.Dx)
pln_14 = Plane(c_plfit.Pl)

# ---- group: Grasshopper PlFit
plfit = PlaneFit(Points=pt_8)  # -> Plane, Deviation

# ----
panel_12 = Panel(plfit.Deviation)
pln_15 = Plane(plfit.Plane)

pt_9 = Point(Point(-8.200616191, 1.956036226, 0))

# ---- group: Grasshopper XZ
xz = XZPlane(Origin=pt_9)

# ---- group: C# XZ
c_xy = CSharpScript(O=pt_9)  # -> Out, P

# ----
panel_13 = Panel(xz)
panel_14 = Panel(c_xy.P)

Z = UnitZ(Factor=1)
pt_10 = Point(Point(0.01220753703, -1.47574791, 0))
c_pl_2 = CSharpScript(O=pt_10, Z=Z)  # -> Out, P
pln_16 = Plane(c_pl_2.P)

# ---- group: Grasshopper Pl
pl_2 = PlaneNormal(Origin=pt_10, ZAxis=Z)

# ----
pln_17 = Plane(pl_2)

xy_7 = XYPlane(Origin=Point(0, 0, 0))
Y_3 = UnitY(Factor=1)
c_align_2 = CSharpScript(P=xy_7, D=Y_3)  # -> Out, P, A
panel_15 = Panel(c_align_2.A)
pln_18 = Plane(c_align_2.P)

# ---- group: Grasshopper Align
align_2 = AlignPlane(Plane=xy_7, Direction=Y_3)  # -> Plane, Angle

# ----
panel_16 = Panel(align_2.Angle)
pln_19 = Plane(align_2.Plane)

xy_8 = XYPlane(Origin=Point(0, 0, 0))
toggle = BooleanToggle(True)
toggle_2 = BooleanToggle(True)
toggle_3 = BooleanToggle(True)
c_pflip = CSharpScript(P=xy_8, X=toggle, Y=toggle_2, S=toggle_3)  # -> Out, P
pln_20 = Plane(c_pflip.P)

# ---- group: Grasshopper PFlip
pflip = FlipPlane(Plane=xy_8, ReverseX=toggle, ReverseY=toggle_2, SwapAxes=toggle_3)

# ----
pln_21 = Plane(pflip)

xy_9 = XYPlane(Origin=Point(0, 0, 0))
pt_11 = Point(Point(12.08494025, 17.98450827, 0))
c_plcoord = CSharpScript(P=pt_11, S=xy_9)  # -> Out, X, Y, Z
panel_17 = Panel(c_plcoord.Y)
panel_18 = Panel(c_plcoord.Z)
panel_19 = Panel(c_plcoord.X)

# ---- group: Grasshopper PlCoord
plcoord = PlaneCoordinates(Point=pt_11, System=xy_9)  # -> XCoordinate, YCoordinate, ZCoordinate

# ----
panel_20 = Panel(plcoord.YCoordinate)
panel_21 = Panel(plcoord.ZCoordinate)
panel_22 = Panel(plcoord.XCoordinate)

crv_2 = Curve(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)
crv_3 = Curve(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)
c_lnln = CSharpScript(A=crv_3, B=crv_2)  # -> Out, Pl
pln_22 = Plane(c_lnln.Pl)

# ---- group: Grasshopper LnLn
lnln = LineLine(LineA=crv_3, LineB=crv_2)

# ----
pln_23 = Plane(lnln)

pt_12 = Point(Point(5.771559159, -6.59850313, 0))
pt_13 = Point(Point(2.022902763, -2.775234427, 0))
pt_14 = Point(Point(2.149540586, 2.849301367, 0))
c_pl_3pt = CSharpScript(A=pt_13, B=pt_14, C=pt_12)  # -> Out, Pl
pln_24 = Plane(c_pl_3pt.Pl)

# ---- group: Grasshopper Pl 3Pt
pl_3pt = Plane3Pt(PointA=pt_13, PointB=pt_14, PointC=pt_12)

# ----
pln_25 = Plane(pl_3pt)

pt_15 = Point(Point(-8.200616191, 1.956036226, 0))
c_xy_2 = CSharpScript(O=pt_15)  # -> Out, P
panel_23 = Panel(c_xy_2.P)

# ---- group: Grasshopper XY
xy_10 = XYPlane(Origin=pt_15)

# ----
panel_24 = Panel(xy_10)

pt_16 = Point(Point(-8.200616191, 1.956036226, 0))
c_yz = CSharpScript(O=pt_16)  # -> Out, P
panel_25 = Panel(c_yz.P)

# ---- group: Grasshopper YZ
yz = YZPlane(Origin=pt_16)

# ----
panel_26 = Panel(yz)

pt_17 = Point(Point(-4.295710257, -2.027285036, 0))
pt_18 = Point(Point(0.01220753703, -1.47574791, 0))
c_pl_origin = CSharpScript(B=pt_17, O=pt_18)  # -> Out, Pl
pln_26 = Plane(c_pl_origin.Pl)

# ---- group: Grasshopper Pl Origin
pl_origin = PlaneOrigin(Base=pt_17, Origin=pt_18)

# ----
pln_27 = Plane(pl_origin)
