# Grasshopper definition Bi_Arc.gh (Grasshopper 1.0.7)

number_slider = Slider(0.2, range=-1..1)
pt = Point(Point(-339.3951548, -374.7666514, 0))
vec = Vector(Vector(0, -381.8800117, 0))
pt_2 = Point(Point(-310.5464607, -455.731285, 0))
vec_2 = Vector(Vector(0, -371.9520625, 0))
biarc = BiArc(StartPoint=pt, StartTangent=vec, EndPoint=pt_2, EndTangent=vec_2, Ratio=number_slider)  # -> FirstArc, SecondArc, BiArc
c_biarc = CSharpScript(S=pt, Ts=vec, E=pt_2, Te=vec_2, R=number_slider)  # -> out, A1, A2, B, A, C; inputs S: Point3d, Ts: Vector3d, E: Point3d, Te: Vector3d, R: Double
# ---------- c_biarc: C# usings ----------
using System.IO;
using System.Linq;
using System.Data;
using System.Drawing;
using System.Reflection;
using System.Windows.Forms;
using System.Xml;
using System.Xml.Linq;
using System.Runtime.InteropServices;

using Rhino.DocObjects;
using Rhino.Collections;
using GH_IO;
using GH_IO.Serialization;
# ---------- c_biarc: C# ----------
    //Component written by @Suekim37

    Curve c = Curve.CreateArcBlend(S, Ts, E, Te, R);

    A1 = c;


    //outputs
# ---------- end c_biarc ----------
geo = Geometry(c_biarc.B)
arc = CircularArc(c_biarc.A1)
arc_2 = CircularArc(c_biarc.A2)

arc_3 = CircularArc(biarc.FirstArc)
arc_4 = CircularArc(biarc.SecondArc)
