# Grasshopper definition Curve_Analysis.gh (Grasshopper 1.0.7)

pt = Point(Point(-2.47056265, 4.097518542, 0))
crv = Curve(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)

# ---- group: Grasshopper Curve Closest Point
crv_cp = CurveClosestPoint(Point=pt, Curve=crv)  # -> Point, Parameter, Distance

# ---- group: C# CurveClosestPoint
c_script = CSharpScript(P=pt, C=crv)  # -> out, Pt, t, D; inputs P: Point3d, C: Curve
# ---------- c_script: C# ----------
    // Component written by @joonhaeng-code
    // joonhaenglee@gsd.harvard.edu

    // Now we will get a closest point on input curve from input point.
    // To do that I found one function that find curve parameter t of the closest point.
    // Curve.Closest Point( input Point, Out t)
    // To extract the value t, we need to define that value first. lets say that as tempt (temporary t value).
       
    double tempt;
    
    // And run the function to get tempt
    
    C.ClosestPoint(P, out tempt);
    
    // Good! Now we have tempt value. It means, we can get the actual Point3d with xyz value in it.
    // Curve.PointAt(t) returns a point on input t value. Let's use this.
    
    Point3d pointOnCurve = C.PointAt(tempt);
    
    // Now you have a tempt and a point!
    // Lastly, lets get the distance between the input point and closest point!
    
    double distance = P.DistanceTo(pointOnCurve);
    
    // Done!
    // Now lets send tempt, pointOnCurve, and distance to c# output value.

    Pt = pointOnCurve;
    t = tempt;
    D = distance;
# ---------- end c_script ----------

# ----
panel = Panel(crv_cp.Point)
panel_2 = Panel(c_script.t)
panel_3 = Panel(c_script.D)
panel_4 = Panel(crv_cp.Parameter)
panel_5 = Panel(crv_cp.Distance)
panel_6 = Panel(c_script.Pt)

geo = Geometry(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)
geo_2 = Geometry(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)

# ---- group: Grasshopper Curve Proximity
crvprox = CurveProximity(CurveA=geo, CurveB=geo_2)  # -> PointA, PointB, Distance

# ---- group: C# Curve Proximity
c_script_2 = CSharpScript(A=geo, B=geo_2)  # -> out, PtA, PtB, D; inputs A: Curve, B: Curve
# ---------- c_script_2: C# ----------
    // Component written by @joonhaeng-code
    // joonhaenglee@gsd.harvard.edu

    // We will get a points in each curve which makes minial distance between two curves. 
    // There is a method in Curve class to do this fucntion. 
    // Curve.ClosestPoints( Curve, out Point1, out Point2)
    // to use this function, we need to define Point1 and Point2 first.
    
    // Let's make empty two Point3ds.
    
    Point3d Pt1;
    Point3d Pt2;
    
    // Let's use the method to get two points!

    A.ClosestPoints(B, out Pt1, out Pt2);
    
    // Now we have two Points. Pt1 is a point on A curve, and Pt2 is a curve on B.
    
    // Lastly, lets send this data to our C# component output.

    PtA = Pt1;
    PtB = Pt2;
    
    // One more, Let's get distance between those two points!
    
    D = Pt1.DistanceTo(Pt2);
# ---------- end c_script_2 ----------

# ----
panel_7 = Panel(crvprox.PointA)
panel_8 = Panel(crvprox.PointB)
panel_9 = Panel(crvprox.Distance)
panel_10 = Panel(c_script_2.PtA)
panel_11 = Panel(c_script_2.PtB)
panel_12 = Panel(c_script_2.D)

crv_2 = Curve(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)

# ---- group: Grasshopper Curve Middle
midpt = CurveMiddle(Curve=crv_2)

# ---- group: C# Curve Middle
c_script_3 = CSharpScript(C=crv_2)  # -> out, M; inputs C: Curve
# ---------- c_script_3: C# ----------
    // Component written by @joonhaeng-code
    // joonhaenglee@gsd.harvard.edu

    // Now we will get a middle point of input curve.
    // What is middle by the way? It could be the point that divide curve into two curves with same length.
    //
    // From Rhinocommon documentation, there is a function(below) that get Point that get a point at certain length from the startpoint.
    // Curve.PointAtLengt(Length)
    
    // So, If I know the "half length" of the curve, we might get the point in the middle.
    // To get "half length" lets try to get full length of the curve by using syntax
    // Curve.GetLength();
    
    double leng = C.GetLength();
    
    // Since we have leng, which is length of the curve, we can use 
    // Curve.PointAtLengt(half length)
    
    M = C.PointAtLength(leng / 2);
# ---------- end c_script_3 ----------

# ----
panel_13 = Panel(midpt)
panel_14 = Panel(c_script_3.M)

rec = Geometry(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)

# ---- group: Grasshopper Deconstruct Rectangle
drec = DeconstuctRectangle(Rectangle=rec)  # -> BasePlane, XInterval, YInterval

# ---- group: C# Deconstruct Rectangle
c_script_4 = CSharpScript(R=rec)  # -> out, B, X, Y; inputs R: Rectangle3d
# ---------- c_script_4: C# ----------
    // Component written by @joonhaeng-code
    // joonhaenglee@gsd.harvard.edu

    // We will going to get Base Plane, width(X) and height(Y) of Rectangle.
    // Luckly, those are all properties of Rectangle.
    // So we can get those values directly buy using below.

    B = R.Plane;
    X = R.X;
    Y = R.Y;
# ---------- end c_script_4 ----------

# ----
panel_15 = Panel(drec.YInterval)
panel_16 = Panel(c_script_4.B)
panel_17 = Panel(drec.BasePlane)
panel_18 = Panel(drec.XInterval)
panel_19 = Panel(c_script_4.X)
panel_20 = Panel(c_script_4.Y)

crv_3 = Curve(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)

# ---- group: Grasshopper Closed
cls = Closed(Curve=crv_3)  # -> Closed, Periodic

# ---- group: C# Closed
c_script_5 = CSharpScript(C=crv_3)  # -> out, Cl, P; inputs C: Curve
# ---------- c_script_5: C# ----------
    // Component written by @joonhaeng-code
    // joonhaenglee@gsd.harvard.edu

    // We will check whether the input curve is closed and is periodic.
    // Those are the properties of the curve.
    // We can get those value by using function below.

    Cl = C.IsClosed;
    P = C.IsPeriodic;
# ---------- end c_script_5 ----------

# ----
panel_21 = Panel(cls.Closed)
panel_22 = Panel(c_script_5.Cl)
panel_23 = Panel(cls.Periodic)
panel_24 = Panel(c_script_5.P)

# ----
# Curve Analysis
crv_4 = Curve(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)

# ---- group: Grasshopper Control Points
cp = ControlPoints(Curve=crv_4)  # -> Points, Weights, Knots

# ---- group: c# Control Points
c_script_6 = CSharpScript(C=crv_4)  # -> out, P, W, K; inputs C: Curve
# ---------- c_script_6: C# ----------
    // Component written by @joonhaeng-code
    // joonhaenglee@gsd.harvard.edu

    // We will going to get Control Points, Weight, and Knots from curve.
    // Oh, in Rhinocommon, we can get those values from NurbsCurve Class since those are the properties of NurbsCurve.
    // Let change our Curve input to NurbsCurve.

    NurbsCurve tempC = C.ToNurbsCurve();

    // There will be more than one items or values in Point, Weight, and Knot. So I will going to make empty lists.

    List <Point3d> controlPoint = new List<Point3d>();
    List <double> Weights = new List<double>();
    List <double> Knots = new List<double>();

    // Lets get Control Points and Weights.
    // Control Point is a property of Nurbscurve, and Weight is a property of Control Point. So, we can use
    // Nurbscurve.Points
    // Nurbscurve.Points.GetWeight
    //
    // Let's get those value using for loop.
    // I will define a n value as the number of control points in Nurbscurve.

    int n = tempC.Points.Count;

    for (int i = 0 ; i < n ; i++)
    {

      // It does not mean that Control Point is same as point.
      // To get XYZ coordinate of control point, we have do extract XYZ value from control points and make a new points.

      Point3d tempControlPoint = new Point3d(tempC.Points[i].X, tempC.Points[i].Y, tempC.Points[i].Z);

      // Now tempControlPoint is a temporary new point on the [i]th controlpoint on Nurbscurve. Let's Put this point in our list.

      controlPoint.Add(tempControlPoint);

      // To get weight of control point, we can use
      // NurbsCurve.Points.GetWeight();

      double tempW = tempC.Points.GetWeight(i);

      // Let's add this weight value in our list.
      Weights.Add(tempW);

    }

    // Let's get Knots value using for loop.
    // I will define a np value as the number of knots in Nurbscurve.

    int np = tempC.Knots.Count;

    for (int i = 0 ; i < np ; i++)
    {
      Knots.Add(tempC.Knots[i]);
    }

    // Done!
    // Lastly, lets sent this list to our output values of this C# component.


    P = controlPoint;
    W = Weights;
    K = Knots;
# ---------- end c_script_6 ----------

# ----
panel_25 = Panel(cp.Points)
panel_26 = Panel(cp.Weights)
panel_27 = Panel(cp.Knots)
panel_28 = Panel(c_script_6.P)
panel_29 = Panel(c_script_6.W)
panel_30 = Panel(c_script_6.K)

# ---- group: WORKING
polygon = Geometry(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)

# ---- group: WORKING / Grasshopper Polygon Center
pcen = PolygonCenter(Polyline=polygon)  # -> CenterV, CenterE, CenterA

# ---- group: WORKING / C# Polygon Center
c_script_7 = CSharpScript(P=polygon)  # -> out, Cv, Ce, Ca; inputs P: Polyline
# ---------- c_script_7: C# ----------
    //Point3d centerPoint = P.CenterPoint();

    double tempX = 0;
    double tempY = 0;
    double tempZ = 0;
    int n = P.Count;

    for (int i = 0 ; i < n  ; i++)
    {
      tempX = tempX + P.X[i];
      tempY = tempY + P.Y[i];
      tempZ = tempZ + P.Z[i];
    }

    Point3d centerVertex = new Point3d(tempX / n, tempY / n, tempZ / n);

    Cv = centerVertex;
    Ce = P.CenterPoint();
    Ca = P.CenterPoint();
# ---------- end c_script_7 ----------

# ---- group: WORKING (continued)
panel_31 = Panel(pcen.CenterV)
panel_32 = Panel(c_script_7.Cv)
panel_33 = Panel(pcen.CenterE)
panel_34 = Panel(c_script_7.Ce)
panel_35 = Panel(pcen.CenterA)
panel_36 = Panel(c_script_7.Ca)

# ----
crv_5 = Geometry(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)

# ---- group: Grasshopper Deconstruct Arc
darc = DeconstructArc(Arc=crv_5)  # -> BasePlane, Radius, Angle

# ---- group: C# Deconstruct Arc
c_script_8 = CSharpScript(A=crv_5)  # -> out, B, R, An
# ---------- c_script_8: C# ----------
    // Component written by @joonhaeng-code
    // joonhaenglee@gsd.harvard.edu

    // We will get Plane, Radius and Angle Domain of input arc.
    // Those are the properties of the arc.
    // We can get those value by using function below.

    B = A.Plane;
    R = A.Radius;
    An = A.AngleDomain;
# ---------- end c_script_8 ----------

# ----
panel_37 = Panel(darc.BasePlane)
panel_38 = Panel(darc.Radius)
panel_39 = Panel(darc.Angle)
panel_40 = Panel(c_script_8.B)
panel_41 = Panel(c_script_8.R)
panel_42 = Panel(c_script_8.An)

crv_6 = Curve(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)

# ---- group: Grasshopper Control Polygon
cpoly = ControlPolygon(Curve=crv_6)  # -> Polygon, Points

# ---- group: C# Control Polygon
c_script_9 = CSharpScript(C=crv_6)  # -> out, CP, P; inputs C: Curve
# ---------- c_script_9: C# ----------
    // Component written by @joonhaeng-code
    // joonhaenglee@gsd.harvard.edu

    // We will get Control Points of input curve and polyline that links those points.
    // So, first, let's make a empty list to contain the control points.

    List<Point3d> Points = new List<Point3d>();

    for (int i = 0, n = C.ToNurbsCurve().Points.Count; i < n; i++)
    {
      // It does not mean that Control Point is same as point.
      // To get XYZ coordinate of control point, we have do extract XYZ value from control points and make a new points.
      // Meanwhile, to get Control Points from Curve, we have to convert Curve to Nurbscurve.
      // To do that, we can use
      // Curve.ToNurbsCurve()

      // So, X coordiate of ith Control Point of Curve may looks like following.
      // C.ToNurbsCurve().Points[i].X

      Point3d temp = new Point3d(C.ToNurbsCurve().Points[i].X, C.ToNurbsCurve().Points[i].Y, C.ToNurbsCurve().Points[i].Z);

      //Let's add this temp to our point list.
      Points.Add(temp);
    }

    // We can simply make polyline using Point list by using below.
    Polyline pl = new Polyline(Points);

    // Finally, let's make pl and Points as output of this C# components.
    CP = pl;
    P = Points;
# ---------- end c_script_9 ----------

# ----
panel_43 = Panel(cpoly.Polygon)
panel_44 = Panel(cpoly.Points)
panel_45 = Panel(c_script_9.CP)
panel_46 = Panel(c_script_9.P)

crv_7 = Curve(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)

# ---- group: Grasshopper End Points
end = EndPoints(Curve=crv_7)  # -> Start, End

# ---- group: C# End Points
c_script_10 = CSharpScript(C=crv_7)  # -> out, S, E; inputs C: Curve
# ---------- c_script_10: C# ----------
    // Component written by @joonhaeng-code
    // joonhaenglee@gsd.harvard.edu

    // Now we will get start Point and end point of input curve.
    // From Properties tap in Curve Class we can find that those two values are inherent properties of the curve.
    // So we can get those value easily by using function below.

    S = C.PointAtStart;
    E = C.PointAtEnd;
# ---------- end c_script_10 ----------

# ----
panel_47 = Panel(end.End)
panel_48 = Panel(end.Start)
panel_49 = Panel(c_script_10.S)
panel_50 = Panel(c_script_10.E)
