# Grasshopper definition Curve_Analysis_PCen.ghx (Grasshopper 1.0.7)

# ---- group: WORKING
polygon = Geometry(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)
c_pcen = CSharpScript(P=polygon)  # -> out, Cv, Ce, Ca; inputs P: Polyline
# ---------- c_pcen: C# ----------
    //Point3d centerPoint = P.CenterPoint();

    double tempX = 0;
    double tempY = 0;
    double tempZ = 0;
    int n = P.Count;

    for (int i = 0 ; i < n  ; i++)
    {
      tempX = tempX + P.X[i];
      tempY = tempY + P.Y[i];
      tempZ = tempZ + P.Z[i];
    }

    Point3d centerVertex = new Point3d(tempX / n, tempY / n, tempZ / n);

    Cv = centerVertex;
    Ce = P.CenterPoint();
    Ca = P.CenterPoint();
# ---------- end c_pcen ----------
panel = Panel(c_pcen.Cv)
panel_2 = Panel(c_pcen.Ce)
panel_3 = Panel(c_pcen.Ca)

# ---- group: WORKING / Grasshopper PCen
pcen = PolygonCenter(Polyline=polygon)  # -> CenterV, CenterE, CenterA

# ---- group: WORKING (continued)
panel_4 = Panel(pcen.CenterV)
panel_5 = Panel(pcen.CenterE)
panel_6 = Panel(pcen.CenterA)

# ----
pt = Point(c_pcen.Cv)
