# Grasshopper definition Curve_Analysis_PCen_JL.ghx (Grasshopper 1.0.7)

# ---- group: WORKING
polygon = Geometry(<curve referenced from the Rhino model>)
c_pcen = CSharpScript(P=polygon)  # -> out, Cv, Ce, Ca; inputs P: Polyline
# ---------- c_pcen: C# ----------
    //Point3d centerPoint = P.CenterPoint();

    double tempX = 0;
    double tempY = 0;
    double tempZ = 0;
    int n = P.Count;

    for (int i = 0 ; i < n  ; i++)
    {
      tempX = tempX + P.X[i];
      tempY = tempY + P.Y[i];
      tempZ = tempZ + P.Z[i];
    }

    Point3d centerVertex = new Point3d(tempX / n, tempY / n, tempZ / n);

    Brep[] brep = Brep.CreatePlanarBreps(P.ToNurbsCurve(), 0.001);
    if (brep != null && brep.Length > 0) {
      AreaMassProperties props = AreaMassProperties.Compute(brep[0]);
      Ca = props.Centroid;
    }

    Cv = centerVertex;
    Ce = P.CenterPoint();
# ---------- end c_pcen ----------
panel = Panel(c_pcen.Cv)
panel_2 = Panel(c_pcen.Ce)
panel_3 = Panel(c_pcen.Ca)

# ----
boundary = BoundarySurfaces(Edges=polygon)

# ---- group: WORKING / Grasshopper PCen
pcen = PolygonCenter(Polyline=polygon)  # -> CenterV, CenterE, CenterA

# ---- group: WORKING (continued)
panel_4 = Panel(pcen.CenterV)
panel_5 = Panel(pcen.CenterE)
panel_6 = Panel(pcen.CenterA)

# ----
pt = Point(c_pcen.Cv)
