# Grasshopper definition Curve.Division.ghx (Grasshopper 1.0.7)

number_slider = Slider(10, range=0..10)
crv = Curve(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)
gh_divdist = GHDivideDistance(Curve=crv, Distance=number_slider)  # -> out, Points, Tangents, Parameters; inputs Curve: Curve, Distance: Double
# ---------- gh_divdist: C# ----------
    // Written by @v-xup6.

    // Divide a curve with a preset distance between points

    //Name the component
    this.Component.Name = "GH# Divide Distance";
    this.Component.NickName = "GH# DivDist";
    this.Component.Description = "Divide a curve with a preset distance between points";
# ---------- end gh_divdist ----------
divdist = DivideDistance(Curve=crv, Distance=number_slider)  # -> Points, Tangents, Parameters
panel = Panel(divdist.Points)
panel_2 = Panel(gh_divdist.Points)
panel_3 = Panel(divdist.Tangents)
panel_4 = Panel(gh_divdist.Tangents)
panel_5 = Panel(divdist.Parameters)
panel_6 = Panel(gh_divdist.Parameters)

# ---- group: Dash
# 0
# 60
# 100
# 150
crv_2 = Curve(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)
panel_7 = Panel("""1
2
6""")
gh_dash = GHDashPattern(Curve=crv_2, Distances=panel_7)  # -> out, Dashes, Gaps; inputs Curve: Curve, Distances: list of Double
# ---------- gh_dash: C# ----------
    // Written by @v-xup6.

    // Convert a curve to a dash pattern


    //find parameter of where each dash should start and end
    List<double> param = findParam(Curve, Distances);
    //use the found parameters to split the curve into 2 lists, dash and gap
    List<List<Curve>> results = splitCurve(Curve, param);
    Dashes = results[0];
    Gaps = results[1];
# ---------- gh_dash: C# additional code ----------
  List<double> findParam(Curve curve, List<double> dist){
    /* 4 variables to store:
    start end position parameter of dashs
    current position parameter on curve
    start position parameter of crv
    end position parameter of curve */
    List<double> param = new List<double>();
    double t, t0, t1;
    //find start and end point of curve
    Point3d startPt = curve.PointAtStart;
    Point3d endPt = curve.PointAtEnd;
    //find start and end parameter of curve
    curve.ClosestPoint(startPt, out t0);
    curve.ClosestPoint(endPt, out t1);
    //create a domain, range to evaluate the dash
    Interval subdomain = new Interval(t0, t1);
    double dashLength = 0.0;
    //boolean to start the for loop in findParam
    bool run = true;
    for(int i = 0;run;i++){
      // find accumulated dash length from input list
      dashLength += dist[i % dist.Count];
      //find parameter at accumulated length
      run = curve.LengthParameter(dashLength, out t, subdomain);
      //record found parameter
      param.Add(t);
    }
    return param;
  }

  List<List<Curve>> splitCurve(Curve crv, List<double> param){
    //Create a List of 2 lists, to seperate dash and gap curves
    List<List<Curve>> crvs = new List<List<Curve>>();
    crvs.Add(new List<Curve>());
    crvs.Add(new List<Curve>());
    //loop thru parameters to split the curve
    for(int i = 0;i < param.Count;i++){
      Curve[] crvSplit = crv.Split(param[i]);
      //use try catch to avoid errors, if last segment not long enought crv.Split returns nothing
      try{
        //split the curve at parameter, odd segments are added to 1st list, even to 2nd list
        crvs[i % 2].Add(crvSplit[0]);
        //overwrite crv with remaining curve
        crv = crvSplit[1];
      }
      catch{
        //end of curve, end loop
        break;
      }
    }
    //return list of 2 lists, 1st list = dash, 2nd list = gap
    return crvs;
  }
# ---------- end gh_dash ----------
dash = DashPattern(Curve=crv_2, Pattern=panel_7)  # -> Dashes, Gaps
panel_8 = Panel(dash.Dashes)
panel_9 = Panel(gh_dash.Dashes)
panel_10 = Panel(dash.Gaps)
panel_11 = Panel(gh_dash.Gaps)

# ----
number_slider_2 = Slider(10, range=0..10)
crv_3 = Curve(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)
gh_divlength = GHDivideLength(Curve=crv_3, Length=number_slider_2)  # -> out, Points, Tangents, Parameters; inputs Curve: Curve, Length: Double
# ---------- gh_divlength: C# ----------
    // Written by @v-xup6.

    // Divide a curve into segments with a preset length
    
    //Name the component
    this.Component.Name = "GH# Divide Length";
    this.Component.NickName = "GH# DivLength";
    this.Component.Description = "Divide a curve into segments with a preset length";
# ---------- end gh_divlength ----------
divlength = DivideLength(Curve=crv_3, Length=number_slider_2)  # -> Points, Tangents, Parameters
panel_12 = Panel(divlength.Points)
panel_13 = Panel(gh_divlength.Points)
panel_14 = Panel(gh_divlength.Tangents)
panel_15 = Panel(divlength.Tangents)
panel_16 = Panel(gh_divlength.Parameters)
panel_17 = Panel(divlength.Parameters)

number_slider_3 = Slider(0.5, range=0..1)
crv_4 = Curve(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)
shatter = Shatter(Curve=crv_4, Parameters=number_slider_3)
gh_divlength_2 = GHDivideLength(Curve=crv_4, Reparameterize=Toggle(False), Parameters=number_slider_3)  # -> out, Segments; inputs Curve: Curve, Reparameterize: Boolean, Parameters: Double; same code as gh_divlength
panel_18 = Panel(shatter)
panel_19 = Panel(gh_divlength_2.Segments)

# ---- group: Contour
number_slider_4 = Slider(3.5, range=0..10)
unit_z = UnitZ(Factor=1)
pt = Point(Point(0, -16, 6.798196873))
# GH#: A C# dictionary of Grasshopper3D components.
# 
# This file contains a category of Grasshopper components, and a mirroring C#/RhinoCommon implementation.
# 
# This is an educational project initiated by students/faculty of GSD-6338: Introduction to Computational Design, at the Harvard Graduate School of Design.
# 
# More information: https://github.com/garciadelcastillo/gh-sharp
# Curve Division
crv_5 = Curve(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)
gh_contour = GHContour(Curve=crv_5, Point=pt, Direction=unit_z, Distance=number_slider_4)  # -> out, Contours, Parameters; inputs Curve: Curve, Point: Point3d, Direction: Vector3d, Distance: Double
# ---------- gh_contour: C# usings ----------
using Rhino.Geometry.Intersect;
# ---------- gh_contour: C# ----------
    // Written by @v-xup6.

    // Create a set of Curve contours

    this.Component.AddRuntimeMessage(
      GH_RuntimeMessageLevel.Warning,
      "Issue with output path if any of the inputs is more than a single item");

    //SANITY CHECK: if no direction is provided, infinite loop occurs
    if(Direction == new Vector3d(0, 0, 0)){
      this.Component.AddRuntimeMessage(
        GH_RuntimeMessageLevel.Error,
        "Direction must be provided to avoid infinite loop");
      return;
    }
    //SANITY CHECK: if contour distance too small, don't calculate to avoid crashing
    if(Distance <= tolerance){
      this.Component.AddRuntimeMessage(
        GH_RuntimeMessageLevel.Error,
        "Contour distance must be larger than the document absolute tolerance");
      return;
    }

    //List to store all the intersection events below and above the starting point
    List<CurveIntersections> intEvent = new List<CurveIntersections>();
    //starting level for contour
    Plane pln = new Plane(Point, Direction);
    //find intersections below point
    intEvent.AddRange(FindInt(Curve, pln, -Distance));
    //reverse list of intersection events to match ascending order
    intEvent.Reverse();
    //find intersections above point
    intEvent.AddRange(FindInt(Curve, pln, Distance));

    //list to store parameters
    DataTree<double> param = new DataTree<double>();
    //calculate intersection point, use ref to passback parameters
    DataTree<Point3d> intPt = DeIntEvent(intEvent, ref param);

    //output
    Contours = intPt;
    Parameters = param;
# ---------- gh_contour: C# additional code ----------
  bool NoInput(int i){
    //check if input parameter is empty
    return this.Component.Params.Input[i].VolatileDataCount <= 0;
  }
  double tolerance = RhinoDoc.ActiveDoc.ModelAbsoluteTolerance;

  List<CurveIntersections> FindInt(Curve crv, Plane pln, double dist){
    //list to store intersection events
    List<CurveIntersections> intersects = new List<CurveIntersections>();
    //boolean to start the while loop
    bool run = true;
    bool possible = Possible(crv, pln, dist);
    Print(possible.ToString() + pln.Normal);
    while(run){
      //check intersection at plane of provide point
      CurveIntersections intersect = Intersection.CurvePlane(crv, pln, tolerance);
      if(intersect != null){
        //if there was an intersection, store the intersection event
        intersects.Add(intersect);
      }
      else if((possible && intersects.Count > 0) || !possible){
        Print(possible + " : " + intersects.Count);
        run = false; //if no intersection exit loop
      }
      //move check point position by a step according to provided direction and distance
      pln.Origin = pln.Origin + (pln.Normal * dist);
    }
    return intersects;
  }

  DataTree<Point3d> DeIntEvent (List<CurveIntersections> ints, ref DataTree<double> param){
    //Data tree for storing all intersection points, each level is one branch
    DataTree<Point3d> intersects = new DataTree<Point3d>();
    //iterate thru levels
    for(int i = 0;i < ints.Count;i++){
      GH_Path path = new GH_Path(i);
      //iterate thru all intersections at each level and find the point and parameter
      for(int j = 0;j < ints[i].Count;j++){
        intersects.Add(ints[i][j].PointA, path);
        param.Add(ints[i][j].ParameterA, path);
      }
    }
    return intersects;
  }

  bool Possible(Curve crv, Plane pln, double dist){
    //find z height of curve start point in contour plane coordinates
    double startZ = LocalCoordinate(crv.PointAtStart, pln);
    Print(pln + "");
    //find z height of curve end point in contour plane coordinates
    double endZ = LocalCoordinate(crv.PointAtEnd, pln);
    //test if either is above contour plane
    bool start = startZ > 0;
    bool end = endZ > 0;
    if(dist > 0){//if testing for above, return test results
      return (start || end);
    }
    else{//if testing for below, flip test results
      return !(start || end);
    }
  }

  double LocalCoordinate(Point3d pt, Plane cSys){
    //vector from origin of coordinate system to point
    Vector3d posVec = pt - cSys.Origin;

    //dot product = a.x*b.x+a.y*b.y+a.z*b.z
    double projZ = posVec * cSys.ZAxis;

    return projZ;
  }
# ---------- end gh_contour ----------
contour = Contour(Curve=crv_5, Point=pt, Direction=unit_z, Distance=number_slider_4)  # -> Contours, Parameters
panel_20 = Panel(contour.Contours)
panel_21 = Panel(gh_contour.Contours)
panel_22 = Panel(contour.Parameters)
panel_23 = Panel(gh_contour.Parameters)

# ---- group: Contour (ex)
# 0
# 0
# 90
# 150
# 25
# 43
# 100
# 150
offset = Panel("""0
20
40""")
pln = Plane(Plane(origin=(0, 0, 0), x=(0.7649596321, 0.4240240481, -0.4848096202), y=(-0.4848096202, 0.8746197071, 0)))
distance = Panel("""0
3
5
7""")
crv_6 = Curve(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)
gh_contour_2 = GHContour(Curve=crv_6, Plane=pln, Offsets=offset, Distances=distance)  # -> out, Contours, Parameters; inputs Curve: Curve, Plane: Plane, Offsets: list of Double, Distances: list of Double
# ---------- gh_contour_2: C# ----------
    // Written by @v-xup6.

    // Create a set of Curve contours

    this.Component.AddRuntimeMessage(
      GH_RuntimeMessageLevel.Warning,
      "Issue with output path if any of the inputs is more than a single item");

    //check offsets or disatances, offsets takes priority over distances
    List<CurveIntersections> intEvent = new List<CurveIntersections>();
    if(Offsets.Count != 0) {
      //if there's something in offsets input
      intEvent = FindInt(Curve, Plane, Offsets, 0);
    }
    else if(Distances.Count != 0) {
      //if nothing in offsets input, but there's something in distances input
      intEvent = FindInt(Curve, Plane, Distances, 1);
    }
    else{
      //if neither offset or distances are set, give warning and exit program
      this.Component.AddRuntimeMessage(
        GH_RuntimeMessageLevel.Warning,
        "You either have to specify Distances or Offsets");
      return;
    }

    //list to store parameters
    DataTree<double> param = new DataTree<double>();
    //output
    Contours = DeIntEvent(intEvent, ref param); //calculate intersection point, use ref to passback parameters
    Parameters = param;
# ---------- gh_contour_2: C# additional code ----------
  //read document tolerance value, needed for finding intersections
  double tolerance = RhinoDoc.ActiveDoc.ModelAbsoluteTolerance;

  List<CurveIntersections> FindInt(Curve crv, Plane pln, List<double> levels, int option){
    //list to store intersection events
    List<CurveIntersections> intersects = new List<CurveIntersections>();
    if(option == 0){
      //using offset values from plane
      for(int i = 0; i < levels.Count;i++){
        //origin position for level of contour
        Point3d origin = pln.Origin + (pln.Normal * levels[i]);
        //create plane for contour
        Plane pos = new Plane(origin, pln.Normal);
        //find contour with plane
        CurveIntersections intersect = Intersection.CurvePlane(crv, pos, tolerance);
        //add intersection event to list
        intersects.Add(intersect);
      }
    }
    else{
      //using distance between contours
      for(int i = 0; i < levels.Count;i++){
        //move plane to offset position
        pln.Origin = pln.Origin + (pln.Normal * levels[i]);
        //find contour with plane
        CurveIntersections intersect = Intersection.CurvePlane(crv, pln, tolerance);
        //add intersection event to list
        intersects.Add(intersect);
      }
    }
    return intersects;
  }

  DataTree<Point3d> DeIntEvent (List<CurveIntersections> ints, ref DataTree<double> param){
    //Data tree for storing all intersection points, each level is one branch
    DataTree<Point3d> intersects = new DataTree<Point3d>();
    //iterate thru levels
    for(int i = 0;i < ints.Count;i++){
      GH_Path path = new GH_Path(i);
      //create empty paths if there's no intersection
      if(ints[i] == null){
        intersects.EnsurePath(path);
        param.EnsurePath(path);
        continue;
      }
      //iterate thru all intersections at each level and find the point and parameter
      for(int j = 0;j < ints[i].Count;j++){
        intersects.Add(ints[i][j].PointA, path);
        param.Add(ints[i][j].ParameterA, path);
      }
    }
    return intersects;
  }
# ---------- end gh_contour_2 ----------
contour_2 = ContourEx(Curve=crv_6, Plane=pln, Offsets=offset, Distances=distance)  # -> Contours, Parameters
panel_24 = Panel(contour_2.Contours)
panel_25 = Panel(gh_contour_2.Contours)
panel_26 = Panel(contour_2.Parameters)
panel_27 = Panel(gh_contour_2.Parameters)

# ----
number_slider_5 = Slider(2, range=0..10)
crv_7 = Curve(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)
gh_frames = GHCurveFrames(Curve=crv_7, Count=number_slider_5)  # -> out, Frames, Parameters; inputs Curve: Curve, Count: Double
# ---------- gh_frames: C# ----------
    // Written by @v-xup6.

    // Generate a number of equally spaced curve frames.
    
    //Name the component
    this.Component.Name = "GH# Curve Frames";
    this.Component.NickName = "GH# Frames";
    this.Component.Description = "Generate a number of equally spaced curve frames.";
# ---------- end gh_frames ----------
frames = CurveFrames(Curve=crv_7, Count=number_slider_5)  # -> Frames, Parameters
panel_28 = Panel(frames.Frames)
panel_29 = Panel(gh_frames.Frames)
panel_30 = Panel(frames.Parameters)
panel_31 = Panel(gh_frames.Parameters)

number_slider_6 = Slider(2, range=0..10)
crv_8 = Curve(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)
gh_hframes = GHHorizontalFrames(Curve=crv_8, Count=number_slider_6)  # -> out, Frames, Parameters; inputs Curve: Curve, Count: Double
# ---------- gh_hframes: C# ----------
    // Written by @v-xup6.

    // Generate a number of equally spaced, horitonally aligned curve frames
    
    //Name the component
    this.Component.Name = "GH# Horizontal Frames";
    this.Component.NickName = "GH# HFrames";
    this.Component.Description = "Generate a number of equally spaced, horitonally aligned curve frames.";
# ---------- end gh_hframes ----------
hframes = HorizontalFrames(Curve=crv_8, Count=number_slider_6)  # -> Frames, Parameters
panel_32 = Panel(hframes.Frames)
panel_33 = Panel(gh_hframes.Frames)
panel_34 = Panel(hframes.Parameters)
panel_35 = Panel(gh_hframes.Parameters)

number_slider_7 = Slider(2, range=0..10)
toggle = BooleanToggle(False)
crv_9 = Curve(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)
gh_pframes = GHPerpFrames(Curve=crv_9, Count=number_slider_7, Align=toggle)  # -> out, Frames, Parameters; inputs Curve: Curve, Count: Double, Align: Boolean
# ---------- gh_pframes: C# ----------
    // Written by @v-xup6.

    // Generate a number of equally spaced, perpendicular frames along a curve
    
    //Name the component
    this.Component.Name = "GH# Perp Frames";
    this.Component.NickName = "GH# PFrames";
    this.Component.Description = "Generate a number of equally spaced, perpendicular frames along a curve.";
# ---------- end gh_pframes ----------
pframes = PerpFrames(Curve=crv_9, Count=number_slider_7, Align=toggle)  # -> Frames, Parameters
panel_36 = Panel(pframes.Frames)
panel_37 = Panel(gh_pframes.Frames)
panel_38 = Panel(pframes.Parameters)
panel_39 = Panel(gh_pframes.Parameters)

crv_10 = Curve(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)

# ---- group: Divide Curve
number_slider_8 = Slider(3, range=0..10)
toggle_2 = BooleanToggle(True)
gh_divide = GHDivideCurve(Curve=crv_10, Count=number_slider_8, Kinks=toggle_2)  # -> out, Points, Tangents, Parameters; inputs Curve: Curve, Count: Int32, Kinks: Boolean
# ---------- gh_divide: C# usings ----------
using System.Linq;
# ---------- gh_divide: C# ----------
    // Written by @v-xup6.

    // Divide a curve into equal length segments


    //find points
    List<Point3d> points = DivPt(Curve, Count);
    //find parameters
    List<double> param = DivParam(Curve, points);
    if(Kinks){
      //find kink parameters
      List<double> kinkParam = GetKinkParam(Curve);
      //add kink parameters to previously found parameters and sort them ascending
      param.AddRange(kinkParam);
      param.Sort();
      //find points at kinks and add them to points list according to parameter values
      List<Point3d> pts = DivPtKink(Curve, kinkParam);
      for(int i = 0; i < kinkParam.Count;i++){
        int index = param.IndexOf(kinkParam[i]);
        points.Insert(index, pts[i]);
      }
    }

    //outputs
    Points = points;
    Parameters = param;
    Tangents = GetTangents(Curve, param);
# ---------- gh_divide: C# additional code ----------
  List<Point3d> DivPt(Curve crv, int divC){
    //if no need for division, don't divide
    if(divC <= 0) return new List<Point3d>();
    Point3d[] pts;
    //divide curve and include ends
    crv.DivideByCount(divC, true, out pts);
    return pts.ToList();
  }

  List<double> DivParam(Curve crv, List<Point3d> pts){
    List<double> param = new List<double>();
    //find paramerter of each point
    foreach(Point3d pt in pts){
      double t;
      crv.ClosestPoint(pt, out t);
      param.Add(t);
    }
    return param;
  }

  List<double> GetKinkParam(Curve crv){
    //true boolean to start the while loop
    bool run = true;
    //start finding kinks from the start of the curve
    double t0 = crv.Domain.T0;
    //list to store parameters of the kinks
    List<double> t = new List<double>();
    while(run){
      //find first kink between t0 and end of curve
      //if kink found, run remains true, kink parameter overwrites t0 so next iteration starts after this kink
      //if not found, run turns false, 0 outputted to t0
      run = crv.GetNextDiscontinuity(Continuity.C2_continuous, t0, crv.Domain.T1, out t0);
      //if kink found add to t list, else do nothing and while loop ends
      if(run) t.Add(t0);
    }
    return t;
  }

  List<Point3d> DivPtKink(Curve crv, List<double> param){
    List<Point3d> pts = new List<Point3d>();
    //find points at parameters of kinks
    foreach(double t in param){
      pts.Add(crv.PointAt(t));
    }
    return pts;
  }

  List<Vector3d> GetTangents(Curve crv, List<double> param){
    List<Vector3d> tang = new List<Vector3d>();
    //find Tangent at parameters
    foreach(double t in param){
      tang.Add(crv.TangentAt(t));
    }
    return tang;
  }
# ---------- end gh_divide ----------
divide = DivideCurve(Curve=crv_10, Count=number_slider_8, Kinks=toggle_2)  # -> Points, Tangents, Parameters
panel_40 = Panel(divide.Points)
panel_41 = Panel(gh_divide.Points)
panel_42 = Panel(divide.Tangents)
panel_43 = Panel(gh_divide.Tangents)
panel_44 = Panel(gh_divide.Parameters)
panel_45 = Panel(divide.Parameters)

# ---- group: Working Advanced Version
gh_contour_3 = GHContour(Curve=crv_6, Plane=pln, Offsets=offset, Distances=distance)  # -> out, Contours, Parameters; inputs Curve: Curve, Plane: Plane, Offsets: list of Double, Distances: list of Double; disabled
# ---------- gh_contour_3: C# ----------
    // Written by @v-xup6.

    // Create a set of Curve contours

    //Name the component
    this.Component.Name = "GH# Contour";
    this.Component.NickName = "GH# Contour";
    this.Component.Description = "Create a set of Curve contours";
    //default input values
    if(NoInput(1)) this.Component.Params.Input[1].AddVolatileData(new GH_Path(0), 0, Plane.WorldXY);

    //check offsets or disatances, offsets takes priority over distances
    List<CurveIntersections> intEvent = new List<CurveIntersections>();
    if(!NoInput(2)) intEvent = FindInt(Curve, Plane, Offsets, 0);
    else if(!NoInput(3)) intEvent = FindInt(Curve, Plane, Distances, 1);
    else{
      this.Component.AddRuntimeMessage(
        GH_RuntimeMessageLevel.Warning,
        "You either have to specify Distances or Offsets");
      return;
    }

    //list to store parameters
    DataTree<double> param = new DataTree<double>();
    Print(intEvent.Count+"");
    //output
    Contours = DeIntEvent(intEvent, ref param); //calculate intersection point, use ref to passback parameters
    Parameters = param;
# ---------- gh_contour_3: C# additional code ----------
  bool NoInput(int i){
    //check if input parameter is empty
    return this.Component.Params.Input[i].VolatileDataCount <= 0;
  }
  double tolerance = RhinoDoc.ActiveDoc.ModelAbsoluteTolerance;

  List<CurveIntersections> FindInt(Curve crv, Plane pln, List<double> levels, int option){
    //list to store intersection events
    List<CurveIntersections> intersects = new List<CurveIntersections>();

    if(option == 0){
      //using offset values from plane
      for(int i = 0; i < levels.Count;i++){
        //origin position for level of contour
        Point3d origin = pln.Origin + (pln.Normal * levels[i]);
        //create plane for contour
        Plane pos = new Plane(origin, pln.Normal);
        //find contour with plane
        CurveIntersections intersect = Intersection.CurvePlane(crv, pos, tolerance);
        //add intersection event to list
        intersects.Add(intersect);
      }
    }
    else{
      //using distance between contours
      for(int i = 0; i < levels.Count;i++){
        //move plane to offset position
        pln.Origin = pln.Origin + (pln.Normal * levels[i]);
        //find contour with plane
        CurveIntersections intersect = Intersection.CurvePlane(crv, pln, tolerance);
        //add intersection event to list
        intersects.Add(intersect);
      }
    }

    return intersects;
  }

  DataTree<Point3d> DeIntEvent (List<CurveIntersections> ints, ref DataTree<double> param){
    //Data tree for storing all intersection points, each level is one branch
    DataTree<Point3d> intersects = new DataTree<Point3d>();
    //iterate thru levels
    for(int i = 0;i < ints.Count;i++){
      GH_Path path = new GH_Path(i);
      //create empty paths if there's no intersection
      if(ints[i] == null){
        intersects.EnsurePath(path);
        param.EnsurePath(path);
        continue;
      }
      //iterate thru all intersections at each level and find the point and parameter
      for(int j = 0;j < ints[i].Count;j++){
        intersects.Add(ints[i][j].PointA, path);
        param.Add(ints[i][j].ParameterA, path);
      }
    }
    return intersects;
  }
# ---------- end gh_contour_3 ----------
gh_dash_2 = GHDashPattern(Curve=crv_2, Distances=panel_7)  # -> out, Dashes, Gaps; inputs Curve: Curve, Distances: list of Double; disabled
# ---------- gh_dash_2: C# ----------
    // Written by @v-xup6.

    // Convert a curve to a dash pattern

    //Name the component
    this.Component.Name = "GH# Dash Pattern";
    this.Component.NickName = "GH# Dash";
    this.Component.Description = "Convert a curve to a dash pattern.";


    List<double> param = findParam(Curve, Distances);


    List<List<Curve>> results = splitCurve(Curve, param);
    Dashes = results[0];
    Gaps = results[1];
# ---------- gh_dash_2: C# additional code ----------
  List<double> findParam(Curve curve, List<double> dist){
    /* 4 variables to store:
    start end position parameter of dashs
    current position parameter on curve
    start position parameter of crv
    end position parameter of curve */
    List<double> param = new List<double>();
    double t, t0, t1;
    //find start and end point of curve
    Point3d startPt = curve.PointAtStart;
    Point3d endPt = curve.PointAtEnd;
    //find start and end parameter of curve
    curve.ClosestPoint(startPt, out t0);
    curve.ClosestPoint(endPt, out t1);
    //create a domain, range to evaluate the dash
    Interval subdomain = new Interval(t0, t1);
    double dashLength = 0.0;
    //boolean to start the for loop
    bool run = true;
    for(int i = 0;run;i++){
      // find dash length from input list
      dashLength += dist[i % dist.Count];
      run = curve.LengthParameter(dashLength, out t, subdomain);
      param.Add(t);
    }
    return param;
  }

  List<List<Curve>> splitCurve(Curve crv, List<double> param){
    //Create a List of 2 lists, to seperate dash and gap curves
    List<List<Curve>> crvs = new List<List<Curve>>();
    crvs.Add(new List<Curve>());
    crvs.Add(new List<Curve>());
    //loop thru parameters to split the curve
    for(int i = 0;i < param.Count;i++){
      Curve[] crvSplit = crv.Split(param[i]);
      //use try catch to avoid errors, if last segment not long enought crv.Split returns nothing
      try{
        //split the curve at parameter, odd segments are added to 1st list, even to 2nd list
        crvs[i % 2].Add(crvSplit[0]);
        //overwrite crv with remaining curve
        crv = crvSplit[1];
      }
      catch{
        //end of curve, end loop
        break;
      }
    }
    //return list of 2 lists, 1st list = dash, 2nd list = gap
    return crvs;
  }
# ---------- end gh_dash_2 ----------
gh_divide_2 = GHDivideCurve(Curve=crv_10, Count=number_slider_8, Kinks=toggle_2)  # -> out, Points, Tangents, Parameters; inputs Curve: Curve, Count: Int32, Kinks: Boolean; disabled
# ---------- gh_divide_2: C# ----------
    // Written by @v-xup6.

    // Divide a curve into equal length segments

    //name this componenet
    this.Component.Name = "GH# Divide Curve";
    this.Component.NickName = "GH# Divide";
    this.Component.Description = "Divide a curve into equal length segments";

    //find points
    List<Point3d> points = DivPt(Curve, Count);
    //find parameters
    List<double> param = DivParam(Curve, points);
    if(Kinks){
      //find kink parameters
      List<double> kinkParam = GetKinkParam(Curve);
      //add kink parameters to previously found parameters and sort them ascending
      param.AddRange(kinkParam);
      param.Sort();
      //find points at kinks and add them to points list according to parameter values
      List<Point3d> pts = DivPtKink(Curve, kinkParam);
      for(int i = 0; i < kinkParam.Count;i++){
        int index = param.IndexOf(kinkParam[i]);
        points.Insert(index, pts[i]);
      }
    }

    //outputs
    Points = points;
    Parameters = param;
    Tangents = GetTangents(Curve, param);
# ---------- gh_divide_2: C# additional code ----------
  List<Point3d> DivPt(Curve crv, int divC){
    //if no need for division, don't divide
    if(divC <= 0) return new List<Point3d>();
    Point3d[] pts;
    //divide curve and include ends
    crv.DivideByCount(divC, true, out pts);
    return pts.ToList();
  }

  List<double> DivParam(Curve crv, List<Point3d> pts){
    List<double> param = new List<double>();
    //find paramerter of each point
    foreach(Point3d pt in pts){
      double t;
      crv.ClosestPoint(pt, out t);
      param.Add(t);
    }
    return param;
  }

  List<double> GetKinkParam(Curve crv){
    //true boolean to start the while loop
    bool run = true;
    //start finding kinks from the start of the curve
    double t0 = crv.Domain.T0;
    //list to store parameters of the kinks
    List<double> t = new List<double>();
    while(run){
      //find first kink between t0 and end of curve
      //if kink found, run remains true, kink parameter overwrites t0 so next iteration starts after this kink
      //if not found, run turns false, 0 outputted to t0
      run = crv.GetNextDiscontinuity(Continuity.C2_continuous, t0, crv.Domain.T1, out t0);
      //if kink found add to t list, else do nothing and while loop ends
      if(run) t.Add(t0);
    }
    return t;
  }

  List<Point3d> DivPtKink(Curve crv, List<double> param){
    List<Point3d> pts = new List<Point3d>();
    //find points at parameters of kinks
    foreach(double t in param){
      pts.Add(crv.PointAt(t));
    }
    return pts;
  }

  List<Vector3d> GetTangents(Curve crv, List<double> param){
    List<Vector3d> tang = new List<Vector3d>();
    //find Tangent at parameters
    foreach(double t in param){
      tang.Add(crv.TangentAt(t));
    }
    return tang;
  }
# ---------- end gh_divide_2 ----------

# ---- group: infinite loop / not exactly same
gh_contour_4 = GHContour(Curve=crv_5, Point=pt, Distance=number_slider_4)  # -> out, Contours, Parameters; inputs Curve: Curve, Point: Point3d, Direction: Vector3d, Distance: Double; disabled
# ---------- gh_contour_4: C# ----------
    // Written by @v-xup6.

    // Create a set of Curve contours
    this.Component.AddRuntimeMessage(
      GH_RuntimeMessageLevel.Warning,
      "Does not work when starting point too far and first contour doesn't intersect anything"
      );

    //Name the component
    this.Component.Name = "GH# Contour";
    this.Component.NickName = "GH# Contour";
    this.Component.Description = "Create a set of Curve contours";
    //default input values
    if(NoInput(1)) this.Component.Params.Input[1].AddVolatileData(new GH_Path(0), 0, new Point3d(0, 0, 0));
    if(NoInput(2)) this.Component.Params.Input[2].AddVolatileData(new GH_Path(0), 0, new Vector3d(0, 0, 1));
    //if contour distance too small, don't calculate to avoid crashing
    if(Distance <= tolerance){
      this.Component.AddRuntimeMessage(
        GH_RuntimeMessageLevel.Error,
        "Contour distance must be larger than the document absolute tolerance");
      return;
    }

    //List to store all the intersection events below and above the starting point
    List<CurveIntersections> intEvent = new List<CurveIntersections>();
    //starting level for contour
    Plane pln = new Plane(Point, Direction);
    //find intersections below point
    intEvent.AddRange(FindInt(Curve, pln, -Distance));
    //reverse list of intersection events to match ascending order
    intEvent.Reverse();
    //find intersections above point
    intEvent.AddRange(FindInt(Curve, pln, Distance));

    //list to store parameters
    DataTree<double> param = new DataTree<double>();

    //output
    Contours = DeIntEvent(intEvent, ref param); //calculate intersection point, use ref to passback parameters
    Parameters = param;
# ---------- gh_contour_4: C# additional code ----------
  bool NoInput(int i){
    //check if input parameter is empty
    return this.Component.Params.Input[i].VolatileDataCount <= 0;
  }
  double tolerance = RhinoDoc.ActiveDoc.ModelAbsoluteTolerance;

  List<CurveIntersections> FindInt(Curve crv, Plane pln, double dist){
    //list to store intersection events
    List<CurveIntersections> intersects = new List<CurveIntersections>();
    //boolean to start the while loop
    bool run = true;
    while(run){
      //check intersection at plane of provide point
      CurveIntersections intersect = Intersection.CurvePlane(crv, pln, tolerance);
      if(intersect != null){
        //if there was an intersection, store the intersection event
        intersects.Add(intersect);
      }
      else{
        run = false; //if no intersection exit loop
      }
      //move check point position by a step according to provided direction and distance
      pln.Origin = pln.Origin + (pln.Normal * dist);
    }
    return intersects;
  }

  DataTree<Point3d> DeIntEvent (List<CurveIntersections> ints, ref DataTree<double> param){
    //Data tree for storing all intersection points, each level is one branch
    DataTree<Point3d> intersects = new DataTree<Point3d>();
    //iterate thru levels
    for(int i = 0;i < ints.Count;i++){
      GH_Path path = new GH_Path(i);
      //iterate thru all intersections at each level and find the point and parameter
      for(int j = 0;j < ints[i].Count;j++){
        intersects.Add(ints[i][j].PointA, path);
        param.Add(ints[i][j].ParameterA, path);
      }
    }
    return intersects;
  }
# ---------- end gh_contour_4 ----------
gh_contour_5 = GHContour(Curve=crv_5, Point=pt, Distance=number_slider_4)  # -> out, Contours, Parameters; inputs Curve: Curve, Point: Point3d, Direction: Vector3d, Distance: Double; disabled
# ---------- gh_contour_5: C# ----------
    // Written by @v-xup6.

    // Create a set of Curve contours
    // problem with detection of empty inputs on load and recompute, gets filled in with 0, causes infinite loop

    //Name the component
    this.Component.Name = "GH# Contour";
    this.Component.NickName = "GH# Contour";
    this.Component.Description = "Create a set of Curve contours";
    //default input values
    if(NoInput(1)) this.Component.Params.Input[1].AddVolatileData(new GH_Path(0), 0, new Point3d(0, 0, 0));
    if(NoInput(2)) this.Component.Params.Input[2].AddVolatileData(new GH_Path(0), 0, new Vector3d(0, 0, 1));
    //if contour distance too small, don't calculate to avoid crashing
    if(Distance <= tolerance){
      this.Component.AddRuntimeMessage(
        GH_RuntimeMessageLevel.Error,
        "Contour distance must be larger than the document absolute tolerance");
      return;
    }

    //List to store all the intersection events below and above the starting point
    List<CurveIntersections> intEvent = new List<CurveIntersections>();
    //starting level for contour
    Plane pln = new Plane(Point, Direction);
    //find intersections below point
    intEvent.AddRange(FindInt(Curve, pln, -Distance));
    //reverse list of intersection events to match ascending order
    intEvent.Reverse();
    //find intersections above point
    intEvent.AddRange(FindInt(Curve, pln, Distance));

    //list to store parameters
    DataTree<double> param = new DataTree<double>();
    //calculate intersection point, use ref to passback parameters
    DataTree<Point3d> intPt = DeIntEvent(intEvent, ref param);

    //output
    Contours = intPt;
    Parameters = param;
# ---------- gh_contour_5: C# additional code ----------
  bool NoInput(int i){
    //check if input parameter is empty
    return this.Component.Params.Input[i].VolatileDataCount <= 0;
  }
  double tolerance = RhinoDoc.ActiveDoc.ModelAbsoluteTolerance;

  List<CurveIntersections> FindInt(Curve crv, Plane pln, double dist){
    //list to store intersection events
    List<CurveIntersections> intersects = new List<CurveIntersections>();
    //boolean to start the while loop
    bool run = true;
    bool possible = Possible(crv, pln, dist);
    /*while(run){
      //check intersection at plane of provide point
      CurveIntersections intersect = Intersection.CurvePlane(crv, pln, tolerance);
      if(intersect != null){
        //if there was an intersection, store the intersection event
        intersects.Add(intersect);
      }
      else if((possible && intersects.Count > 0) || !possible){
        Print(possible + " : " + intersects.Count);
        run = false; //if no intersection exit loop
      }
      //move check point position by a step according to provided direction and distance
      pln.Origin = pln.Origin + (pln.Normal * dist);
    }*/
    return intersects;
  }

  DataTree<Point3d> DeIntEvent (List<CurveIntersections> ints, ref DataTree<double> param){
    //Data tree for storing all intersection points, each level is one branch
    DataTree<Point3d> intersects = new DataTree<Point3d>();
    //iterate thru levels
    for(int i = 0;i < ints.Count;i++){
      GH_Path path = new GH_Path(i);
      //iterate thru all intersections at each level and find the point and parameter
      for(int j = 0;j < ints[i].Count;j++){
        intersects.Add(ints[i][j].PointA, path);
        param.Add(ints[i][j].ParameterA, path);
      }
    }
    return intersects;
  }

  bool Possible(Curve crv, Plane pln, double dist){
    //find z height of curve start point in contour plane coordinates
    double startZ = LocalCoordinate(crv.PointAtStart, pln);
    Print(pln + "");
    //find z height of curve end point in contour plane coordinates
    double endZ = LocalCoordinate(crv.PointAtEnd, pln);
    //test if either is above contour plane
    bool start = startZ > 0;
    bool end = endZ > 0;
    if(dist > 0){//if testing for above, return test results
      return (start || end);
    }
    else{//if testing for below, flip test results
      return !(start || end);
    }
  }

  double LocalCoordinate(Point3d pt, Plane cSys){
    //vector from origin of coordinate system to point
    Vector3d posVec = pt - cSys.Origin;

    //dot product = a.x*b.x+a.y*b.y+a.z*b.z
    double projZ = posVec * cSys.ZAxis;

    return projZ;
  }
# ---------- end gh_contour_5 ----------

# ---- group: parameter and position on curve relation is not linear
gh_divide_3 = GHDivideCurve(Curve=crv_10, Count=number_slider_8, Kinks=toggle_2)  # -> out, Points, Tangents, Parameters; inputs Curve: Curve, Count: Int32, Kinks: Boolean; disabled
# ---------- gh_divide_3: C# ----------
    /*
  Victor Lin
  victorlin@gapps.ntust.edu.tw
*/

    //naming the component
    this.Component.Name = "GH# Divide Curve";
    this.Component.NickName = "GH# Divide";
    this.Component.Description = "Divide a curve into equal length segments";
    this.Component.AddRuntimeMessage(GH_RuntimeMessageLevel.Remark, "Unclear how to get t of EQ crv length without calculating pt divisions");

    //find parameters of where all the points should be
    List<double> param = GetParams(Curve, Count, Kinks);
    //new list to store tangent vectors
    List<Vector3d> tang = new List<Vector3d>();
    //find point and tangent of each parameter, using ref so function can return 2 things
    List<Point3d> points = GetPt(Curve, param, ref tang);

    //Output results
    Points = points;
    Parameters = param;
    Tangents = tang;
# ---------- gh_divide_3: C# additional code ----------
  List<double> GetParams(Curve crv, int divC, bool k){
    //list to store all the parameters
    List<double> p = new List<double>();
    if((k && divC <= 0) || divC <= 0) goto Kinks;
    //find start and end parameter of curve
    double t0 = crv.Domain.T0;
    double t1 = crv.Domain.T1;
    //finding the interval of each parameter
    double step = (t1 - t0) / divC;
    //find all parameters and add them to p list
    for(int i = 0; i <= divC;i++){
      p.Add(step * i + t0);
    }
    //if kinks, find parameter at kink, add them to end of p list, sort the p list so parameters are ascending/in order
    Kinks:
      if(k){
        p.AddRange(GetKinkParam(crv));
        p.Sort();
      }
    //return the paramters found
    return p;
  }

  List<double> GetKinkParam(Curve crv){
    //true boolean to start the while loop
    bool run = true;
    //start finding kinks from the start of the curve
    double t0 = crv.Domain.T0;
    //list to store parameters of the kinks
    List<double> t = new List<double>();
    while(run){
      //find first kink between t0 and end of curve
      //if kink found, run remains true, kink parameter output to t0
      //if not found, run turns false, 0 outputted to t0
      run = crv.GetNextDiscontinuity(Continuity.C2_continuous, t0, crv.Domain.T1, out t0);
      //if kink found add to t list, else do nothing
      if(run) t.Add(t0);
    }
    //return list of parameters representing kink locations
    return t;
  }

  List<Point3d> GetPt(Curve crv, List<double> param, ref List<Vector3d> tang){
    //new list to store point locations
    List<Point3d> pts = new List<Point3d>();
    //find point location and it's tangent then add them to the respective lists
    foreach(double t in param){
      pts.Add(crv.PointAt(t));
      tang.Add(crv.TangentAt(t));
    }
    //return the points, tangent is returned thru reference
    return pts;
  }
# ---------- end gh_divide_3 ----------
panel_46 = Panel(gh_divide_3.Points)
panel_47 = Panel(gh_divide_3.Tangents)
panel_48 = Panel(gh_divide_3.Parameters)
