# Grasshopper definition JLX_WIP.gh (Grasshopper 1.0.7)

mesh = Mesh(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)
pt = Point(<point referenced from the Rhino model>)
mesh_2 = Mesh(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)
number_slider = Slider(7.9, range=0..10)
crv = Curve(<curve referenced from the Rhino model>)
gh_moveaway = CSharpScript(G=mesh, E=pt, T=number_slider)  # -> out, Gout, X; inputs G: GeometryBase, E: GeometryBase, T: Double
# ---------- gh_moveaway: C# ----------
    // Component written by @garciadelcastillo

    BoundingBox bb = G.GetBoundingBox(false);
    Point3d geoCenter = bb.Center;


    Point3d fromOrigin = Point3d.Unset;
    Print(fromOrigin.ToString());
    
    object e = E;
    if (e is Point3d)
    {
      Point p = (Point) E;
      Print(p.ToString());
      fromOrigin = p.Location;
      Print(fromOrigin.ToString());
    }
    else if (e is Curve)
    {
      Curve c = (Curve) E;
      double t;
      if (c.ClosestPoint(geoCenter, out t)) {
        fromOrigin = c.PointAt(t);
      }
    }
    
    Print(fromOrigin.ToString());
    
    if (fromOrigin == Point3d.Unset) 
    {
      Component.AddRuntimeMessage(GH_RuntimeMessageLevel.Warning, "Unable to work with this geometry");
      return;
    }
    
    

    
    Vector3d direction = geoCenter - fromOrigin;
    
    // Compute the Transform and output it
    Transform xform = Transform.Translation(direction);
    X = xform;  // *

    // Apply it to the object and output it only if it exists
    if (G != null)
    {
      G.Transform(xform);
      Gout = G;
    }
# ---------- end gh_moveaway ----------
moveaway = MoveAwayFrom(Geometry=mesh, Emitter=pt, Distance=number_slider)  # -> Geometry, Transform
panel = Panel(gh_moveaway.out)
transform = Panel(moveaway.Transform)
geometry = Panel(moveaway.Geometry)
transform_2 = Panel(gh_moveaway.X)
geometry_2 = Panel(gh_moveaway.Gout)
matrix = DisplayMatrix(moveaway.Transform)
matrix_2 = DisplayMatrix(gh_moveaway.X)

mesh_3 = Mesh(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)
mblur = BlurMesh(Mesh=mesh_3, Iterations=1)
demesh = DeconstructMesh(Mesh=mblur)  # -> Vertices, Faces, Colours, Normals
demesh_2 = DeconstructMesh(Mesh=mesh_3)  # -> Vertices, Faces, Colours, Normals
panel_2 = Panel(demesh_2.Colours)
points = PointList(Points=demesh_2.Vertices, Size=Slider(1, range=0..10))
panel_3 = Panel(demesh.Colours)
