# Grasshopper definition JLX_utils.gh (Grasshopper 1.0.7)

mesh = Mesh(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)
pln = Plane(Plane(origin=(0, 0, 0), x=(0.5796831591, 0.8148419694, 0), y=(-0.387507732, 0.2756751796, 0.8796823023)))
xy = XYPlane(Origin=Point(0, 0, 0))
X = UnitX(Factor=Slider(1, range=-5..5))
Y = UnitY(Factor=Slider(1, range=-5..5))
Z = UnitZ(Factor=Slider(1, range=-5..5))
vec = VectorXYZ(XComponent=Slider(1.34, range=-5..5), YComponent=Slider(0.34, range=-5..5), ZComponent=Slider(0, range=-5..5))  # -> Vector, Length
gh_shear_nu = CSharpScript(G=mesh, P=xy, X=vec.Vector, Y=vec.Vector, Z=vec.Vector)  # -> out, Gout, Xout; inputs G: GeometryBase, P: Plane, X: Vector3d, Y: Vector3d, Z: Vector3d
# ---------- gh_shear_nu: C# ----------
    // Component written by @garciadelcastillo

    // Compute the Transform and output it
    Transform xform = Transform.Shear(P, X, Y, Z);
    Xout = xform;  // *

    // Apply it to the object and output it only if it exists
    if (G != null)
    {
      G.Transform(xform);
      Gout = G;
    }

    // * NOTE:
    //   This transform stringifies to "Generic" because it doesn't use
    //   the GH-flavored transforms in Grasshopper.Kernel.Types.Transforms.
# ---------- end gh_shear_nu ----------
transform = Panel(gh_shear_nu.Xout)
geometry = Panel(gh_shear_nu.Gout)
matrix = DisplayMatrix(gh_shear_nu.Xout)

panel = Panel("""0
15
24
33
45""")
panel_2 = Panel("""0
15
24
33
45
20
3
56""")
mesh_2 = Mesh(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)
mesh_3 = Mesh(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)
jlx_meshcoloring = CSharpScript(x=mesh_3, y=Slider(9, range=0..10))  # -> out, A; inputs x: Mesh, y: Int32
# ---------- jlx_meshcoloring: C# ----------
    //x.VertexColors.CreateMonotoneMesh(System.Drawing.Color.White);

    for (int i = 0 ; i < x.Vertices.Count; i++) {
      int id = i % y;

      switch (id) {
        case 0: x.VertexColors.Add(0, 0, 0); break;
        case 2: x.VertexColors.Add(255, 0, 0); break;
        case 4: x.VertexColors.Add(0, 255, 0); break;
        case 6: x.VertexColors.Add(0, 0, 255); break;
        default: x.VertexColors.Add(255, 255, 255); break;
      }
    }

    A = x;
# ---------- end jlx_meshcoloring ----------
jlx_faceflipping = CSharpScript(x=mesh_2, y=panel_2)  # -> out, A; inputs x: Mesh, y: list of Int32
# ---------- jlx_faceflipping: C# ----------
    for (int i = 0; i < y.Count; i++) {
      MeshFace flipped = x.Faces[y[i]].Flip();
      x.Faces[y[i]] = flipped;
    }



    A = x;
# ---------- end jlx_faceflipping ----------
mesh_4 = Mesh(jlx_meshcoloring.A)
mesh_5 = Mesh(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)
