# Grasshopper definition example_gh_datatrees.gh (Grasshopper 1.0.7)

cyl = Cylinder(Base=PlaneXY(0, 0, 0), Radius=0.5, Length=1)
sph = Sphere(Base=PlaneXY(0, 0, 0), Radius=1)
path_mapper = PathMapper([cyl, sph], source="{a}", target="{0;0;a}")
number_slider = Slider(5, range=0..10)
number_slider_2 = Slider(10, range=0..10)
panel = Panel(path_mapper)
topology = BrepTopology(Brep=cyl, PerspectiveOnly=False)  # -> FaceFaceAdjacency, FaceEdgeAdjacency, EdgeFaceAdjacency
sdivide = DivideSurface(Surface=path_mapper, UCount=number_slider_2, VCount=number_slider)  # -> Points, Normals, Parameters
c_script = CSharpScript(S=path_mapper, U=number_slider_2, V=number_slider)  # -> out, P; inputs S: tree of Surface, U: Int32, V: Int32
# ---------- c_script: C# ----------
    DataTree<Point3d> points = new DataTree<Point3d>();

    for (int k = 0; k < S.BranchCount; k++) {
      GH_Path currentPath = S.Paths[k];
      List<Surface> branchSurfs = S.Branches[k];

      for (int m = 0; m < branchSurfs.Count; m++) {
        GH_Path surfPath = currentPath.AppendElement(m);
        Surface surf = branchSurfs[m];

        Interval uInt = surf.Domain(0);
        Interval vInt = surf.Domain(1);

        double du = uInt.Length / U;
        double dv = vInt.Length / V;

        double u, v;
        for (int i = 0; i < U + 1; i++) {
          GH_Path rowPath = surfPath.AppendElement(i);
          u = uInt.Min + i * du;

          for (int j = 0; j < V + 1; j++) {
            v = vInt.Min + j * dv;

            Point3d pt = surf.PointAt(u, v);
            points.Add(pt, rowPath);
          }
        }
      }
    }

    P = points;
# ---------- end c_script ----------
panel_2 = Panel(topology.EdgeFaceAdjacency)
panel_3 = Panel(c_script.P)
panel_4 = Panel(sdivide.Points)
