# Grasshopper definition example_polycast.gh (Grasshopper 1.0.7)

number_slider = Slider(10, range=0..10)
X = UnitX(Factor=1)
pt = ConstructPoint(XCoordinate=0, YCoordinate=0, ZCoordinate=number_slider)
pt_2 = ConstructPoint(XCoordinate=0, YCoordinate=Slider(5, range=0..10), ZCoordinate=0)
addition = Addition(A=number_slider, B=pt)
c_script = CSharpScript(A=pt, B=pt_2)  # -> out, R
# ---------- c_script: C# ----------
    
    try {
      double a = (double) A;
      double b = (double) B;
      double sum = a + b;
      R = sum;
      return;
    }
    catch { }
    
    try {
      Point3d a = (Point3d) A;
      Point3d b = (Point3d) B;
      R = a + b;
      return;
    }
    catch{}
# ---------- end c_script ----------
panel = Panel(c_script.out)
